# Grasshopper definition Simple Room.gh (Grasshopper 1.0.7)
# Copyright: 2021
# plug-ins: MantaRay, LadybugGrasshopper, ImageClipboard, Human, LINK_Dashboards

falsestart = LBFalseStartToggle(True)
# SimpleRoom
# MantaRay
panel = Panel("lio")
connect = ConnectSSHFTP(User=panel, Ip="mm-c0d0e-028", ProjectName="SimpleRoom", Password="_prompt", _port="2222", Connect=falsestart)  # -> Status, Prefixes, Run

# ----
# Connect to SSH
# we added "cd <LinuxHome>" to
# the prefixes. This allows all of the
# components to startup in our
# LinuxHome folder
# to login on the above pc use (in local cmd)
# 
# ssh -l <username> -p <port> <computername>
panel_2 = Panel(". /etc/profile;. ~/.profile;mkdir -p <LinuxHome>;cd <LinuxHome>")
panel_3 = Panel(connect.Prefixes)
panel_4 = Panel(connect.Status)
run = Boolean(connect.Run)

# ----
# Read Rhino file
run_2 = Boolean(run)
parserhinofile = ParseRhinoFile(LayerPrefix="Daylight_Inputs::_", Grids="Grids", Run=run_2)  # -> GlassGeometries, GlassModifiers, port, OpaqueGeometries, OpaqueModifiers, port_2, CustomGeometries, ModifierNames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
panel_5 = Panel(parserhinofile.SkippedLayers)
opaque_modifiers = Text(parserhinofile.OpaqueModifiers)
glass_modifiers = Text(parserhinofile.GlassModifiers)
opaque_mesh = Mesh(parserhinofile.OpaqueGeometries)
all_modifiers = Text([parserhinofile.GlassModifiers, parserhinofile.OpaqueModifiers])
glass_mesh = Mesh(parserhinofile.GlassGeometries)
grids = Geometry(parserhinofile.GridGeometries)
run_3 = Boolean(parserhinofile.Ran)

# ----
# 10klx overcast sky (RwR p357)
panel_6 = Panel("""mkdir -p skies/
echo "##Will control the gradient of the sky
" > <target>
gensky -ang 45 0 -c -B 55.866 >> <target>
echo "<glowandsource>" >> <target>
echo <target>""")
and_append_the_ground = Panel("""##The 1 will be multiplie with brightfunc
skyfunc glow sky_glow
0
0
4 1 1 1 0

##Set to 1 as it will be multiplied with the gensky result
sky_glow source sky
0
0
4 0 0 1 180

##Set to 1 as it will be multiplied with the gensky result
skyfunc glow ground_glow
0
0
4 1 1 1 0

##The ground pane
ground_glow source ground
0
0
4 0 0 -1 180""")
bool = Boolean(run_3)
overrides = ApplyOverrides(Input=panel_6, Target=graft("10kluxOvercast.sky"), Glowandsource=graft(and_append_the_ground))  # -> Output, DynamicOutput
executessh = ExecuteSSH(
    _SSHCommands_=overrides.DynamicOutput,
    Run=bool,
    addPrefix=True,
    description="""mkdir -p skies/
echo "##Will control the gradient of the sky
" > 10kluxOvercast.sky
gensky -ang 45 0 -c -B 55.866 >> 10kluxOvercast.sky
echo "

##The 1 will be multiplie with brightfunc
skyfunc glow sky_glow
0
0
4 1 1 1 0

##Set to 1 as it will be multiplied with the gensky result
sky_glow source sky
0
0
4 0 0 1 180

##Set to 1 as it will be multiplied with the gensky result
skyfunc glow ground_glow
0
0
4 1 1 1 0

##The ground pane
ground_glow source ground
0
0
4 0 0 -1 180" >> 10kluxOvercast.sky
echo 10kluxOvercast.sky""",
    fireLogs=False,
    lastRunTime=39.2849,
    suppressWarnings=False,
    results="10kluxOvercast.sky",
    commands="""mkdir -p skies/
echo "##Will control the gradient of the sky
" > 10kluxOvercast.sky
gensky -ang 45 0 -c -B 55.866 >> 10kluxOvercast.sky
echo "

##The 1 will be multiplie with brightfunc
skyfunc glow sky_glow
0
0
4 1 1 1 0

##Set to 1 as it will be multiplied with the gensky result
sky_glow source sky
0
0
4 0 0 1 180

##Set to 1 as it will be multiplied with the gensky result
skyfunc glow ground_glow
0
0
4 1 1 1 0

##The ground pane
ground_glow source ground
0
0
4 0 0 -1 180" >> 10kluxOvercast.sky
echo 10kluxOvercast.sky""")  # -> Stdout, Stderr_, Ran
panel_7 = Panel(executessh.Stderr_)
sky_ovc = Text(executessh.Stdout)

# ----
# Create grids in pts file
panel_8 = Panel("0.3")
grids_geometry = Geometry(grids)
run_4 = Boolean(run_3)
grid = GridCreate(
    Geometry=graft(grids_geometry),
    GridSize_m="0.3",
    VerticalOffset_m=0.75,
    EdgeOffset_m=panel_8,
    IsoCurves=True,
    GoLarge=False)  # -> Grids, Mesh, Points, Normals
points2pts = PointsToPts(
    Points=flatten(grid.Points),
    Vectors=flatten(grid.Normals),
    Run=run_4,
    stdouts="""-1.67399914550781 3.60464135742188 0.75 0 0 1
-1.73892529296875 3.91261474609375 0.75 0 0 1
-1.80385144042969 4.22058837890625 0.75 0 0 1
-1.86877758789062 4.5285615234375 0.75 0 0 1
-1.93370373535156 4.83653515625 0.75 0 0 1
-1.9986298828125 5.1445087890625 0.75 0 0 1
-1.37458044433594 3.66776391601563 0.75 0 0 1
-1.43950659179688 3.9757373046875 0.75 0 0 1
-1.50443273925781 4.2837109375 0.75 0 0 1
-1.56935888671875 4.5916845703125 0.75 0 0 1
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""")  # -> PtsString, Run
grid_2 = Data(grid.Grids)

# ----
# Create Rad files
run_5 = Boolean(run_3)
de_modifier = DeconstructModifier(Modifier=glass_modifiers)  # -> GeoName, ModifierName
de_modifier_2 = DeconstructModifier(Modifier=opaque_modifiers)  # -> GeoName, ModifierName
mesh2obj = MeshToObj(
    Mesh=graft(opaque_mesh),
    Name=graft(de_modifier_2.GeoName),
    ModifierName=graft(de_modifier_2.ModifierName),
    MapFileName="mapping",
    TargetFolder="objFiles",
    Run=run_5,
    MapFile="mapping")  # -> ObjFiles, MapFile, Run
mesh2obj_2 = MeshToObj(
    Mesh=graft(glass_mesh),
    Name=graft(de_modifier.GeoName),
    ModifierName=graft(de_modifier.ModifierName),
    MapFileName="glass",
    TargetFolder="objFiles",
    Run=run_5,
    MapFile="glass")  # -> ObjFiles, MapFile, Run
obj2rad = ObjToRad(
    ObjFiles=mesh2obj_2.ObjFiles,
    MapFile=mesh2obj_2.MapFile,
    TargetFolder="radFiles",
    Run=mesh2obj_2.Run,
    stdouts="radFiles/Glass_70_geo.rad")  # -> Status, RadFiles, Run
obj2rad_2 = ObjToRad(
    ObjFiles=mesh2obj.ObjFiles,
    MapFile=mesh2obj.MapFile,
    TargetFolder="radFiles",
    Run=mesh2obj.Run,
    stdouts="radFiles/Frames_70_00_geo.rad>JOIN<radFiles/Walls_50_00_geo.rad>JOIN<radFiles/Ceilings_70_00_geo.rad>JOIN<radFiles/Ground_20_00_geo.rad>JOIN<radFiles/Floors_20_00_geo.rad>JOIN<radFiles/Context_20_00_geo.rad")  # -> Status, RadFiles, Run

# ----
# Create mat files
panel_9 = Panel("""echo "<radFiles>" > radFiles/materials.mat
echo radFiles/materials.mat""")
all_modifiers_2 = Text(all_modifiers)
run_6 = Boolean(run_3)
join = TextJoin(Text=all_modifiers_2)
overrides_2 = ApplyOverrides(Input=panel_9, RadFiles=graft(join))  # -> Output, DynamicOutput
executessh_2 = ExecuteSSH(
    _SSHCommands_=overrides_2.DynamicOutput,
    Run=run_6,
    addPrefix=True,
    description="""echo "void glass Glass_70
0
0
3 0.762841984823016 0.762841984823016 0.762841984823016

void plastic Context_20_00
0
0
5 0.2 0.2 0.2 0 0

void plastic Floors_20_00
0
0
5 0.2 0.2 0.2 0 0

void plastic Ground_20_00
0
0
5 0.2 0.2 0.2 0 0

void plastic Ceilings_70_00
0
0
5 0.7 0.7 0.7 0 0

void plastic Walls_50_00
0
0
5 0.5 0.5 0.5 0 0

void plastic Frames_70_00
0
0
5 0.7 0.7 0.7 0 0" > radFiles/materials.mat
echo radFiles/materials.mat""",
    fireLogs=False,
    lastRunTime=86.1361,
    suppressWarnings=False,
    results="radFiles/materials.mat",
    commands="""echo "void glass Glass_70
0
0
3 0.762841984823016 0.762841984823016 0.762841984823016

void plastic Context_20_00
0
0
5 0.2 0.2 0.2 0 0

void plastic Floors_20_00
0
0
5 0.2 0.2 0.2 0 0

void plastic Ground_20_00
0
0
5 0.2 0.2 0.2 0 0

void plastic Ceilings_70_00
0
0
5 0.7 0.7 0.7 0 0

void plastic Walls_50_00
0
0
5 0.5 0.5 0.5 0 0

void plastic Frames_70_00
0
0
5 0.7 0.7 0.7 0 0" > radFiles/materials.mat
echo radFiles/materials.mat""")  # -> Stdout, Stderr_, Ran

# ----
# Save pts file (on linux)
ptsstring = Text(points2pts.PtsString)
run_7 = Boolean(points2pts.Run)
panel_10 = Panel("""mkdir -p ptsFiles/
echo "<pts>" > ptsFiles/<target>
echo ptsFiles/<target>""")
overrides_3 = ApplyOverrides(Input=panel_10, Target=graft("ptsFiles.pts"), Pts=graft(ptsstring))  # -> Output, DynamicOutput
executessh_3 = ExecuteSSH(
    _SSHCommands_=overrides_3.Output,
    Run=run_7,
    addPrefix=True,
    fireLogs=False,
    lastRunTime=65.623,
    suppressWarnings=False,
    results="ptsFiles/ptsFiles.pts",
    commands="""mkdir -p ptsFiles/
echo "-1.67399914550781 3.60464135742188 0.75 0 0 1
-1.73892529296875 3.91261474609375 0.75 0 0 1
-1.80385144042969 4.22058837890625 0.75 0 0 1
-1.86877758789062 4.5285615234375 0.75 0 0 1
-1.93370373535156 4.83653515625 0.75 0 0 1
-1.9986298828125 5.1445087890625 0.75 0 0 1
-1.37458044433594 3.66776391601563 0.75 0 0 1
-1.43950659179688 3.9757373046875 0.75 0 0 1
-1.50443273925781 4.2837109375 0.75 0 0 1
-1.56935888671875 4.5916845703125 0.75 0 0 1
-1.63428503417969 4.89965771484375 0.75 0 0 1
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" > ptsFiles/ptsFiles.pts
echo ptsFiles/ptsFiles.pts""")  # -> Stdout, Stderr_, Ran
ptsfile = Text(executessh_3.Stdout)

# ----
# check content of sky
panel_11 = Panel("cat <target>")
overrides_4 = ApplyOverrides(Input=panel_11, Target=graft(executessh.Stdout))  # -> Output, DynamicOutput
executessh_4 = ExecuteSSH(
    _SSHCommands_=overrides_4.Output,
    Run=executessh.Ran,
    addPrefix=True,
    fireLogs=False,
    lastRunTime=32.0861,
    suppressWarnings=False,
    results="""##Will control the gradient of the sky

# gensky -ang 45 0 -c -B 55.866
# Ground ambient level: 17.8

void brightfunc skyfunc
2 skybr skybright.cal
0
3 2 2.29e+01 3.56e+00


##The 1 will be multiplie with brightfunc
skyfunc glow sky_glow
0
0
4 1 1 1 0

##Set to 1 as it will be multiplied with the gensky result
sky_glow source sky
0
0
4 0 0 1 180

##Set to 1 as it will be multiplied with the gensky result
skyfunc glow ground_glow
0
0
4 1 1 1 0

##The ground pane
ground_glow source ground
0
0
4 0 0 -1 180""",
    commands="cat 10kluxOvercast.sky")  # -> Stdout, Stderr_, Ran
panel_12 = Panel(executessh_4.Stdout)

entwine = Entwine(Branch00=executessh_2.Stdout, Branch01=obj2rad.RadFiles, Branch02=obj2rad_2.RadFiles, FlattenInputs=True)  # -> flatten(Result)
all_rad_files = Text(entwine)

# ----
# Octree - oconv
panel_13 = Panel("""mkdir -p octrees/
oconv -r 2048 -w -f <rads> > octrees/<target>
echo octrees/<target>""")
scene_rads = Text(all_rad_files)
sky_ovc_2 = Text(sky_ovc)
python = GhPythonScript(x=flatten(scene_rads))  # -> noNulls; inputs x: list
# ---------- python: Python ----------
__author__ = "mm1013"
__version__ = "2022.06.15"

import rhinoscriptsyntax as rs

noNulls = None not in x and len(x) > 0
# ---------- end python ----------
entwine_2 = Entwine(Branch01=sky_ovc_2, Branch02=scene_rads, FlattenInputs=True)  # -> flatten(Radfiles)
join_2 = TextJoin(Text=entwine_2, Join=" ")
and = GateAnd(A=python, B=executessh_2.Ran)
overrides_5 = ApplyOverrides(Input=panel_13, Rads=graft(join_2), Target=graft("Scene_Overcast10klux.oct"))  # -> Output, DynamicOutput
executessh_5 = ExecuteSSH(
    _SSHCommands=overrides_5.DynamicOutput,
    Run=and,
    addPrefix=True,
    description="""mkdir -p octrees/
oconv -r 2048 -w -f 10kluxOvercast.sky radFiles/materials.mat radFiles/Glass_70_geo.rad radFiles/Frames_70_00_geo.rad radFiles/Walls_50_00_geo.rad radFiles/Ceilings_70_00_geo.rad radFiles/Ground_20_00_geo.rad radFiles/Floors_20_00_geo.rad radFiles/Context_20_00_geo.rad > octrees/Scene_Overcast10klux.oct
echo octrees/Scene_Overcast10klux.oct""",
    fireLogs=True,
    lastRunTime=22.0003,
    name="oconv Scene_Overcast10klux.oct",
    staticDescription="""mkdir -p ~/MantaRay/Andrei/octrees/
oconv -r 2048 -w -f ~/MantaRay/Andrei/skies/overcast_sky.rad ~/MantaRay/Andrei/radFiles/Glass_70.mat /home/lio/MantaRay/Andrei/radFiles/Glass_70_geo.rad ~/MantaRay/Andrei/radFiles/opaque_materials.mat /home/lio/MantaRay/Andrei/radFiles/FloorMat_0.7_geo.rad /home/lio/MantaRay/Andrei/radFiles/Cladding_0.5_geo.rad /home/lio/MantaRay/Andrei/radFiles/ConcreteWhite_0.8_geo.rad /home/lio/MantaRay/Andrei/radFiles/ConcreteStructure_0.3_geo.rad /home/lio/MantaRay/Andrei/radFiles/ConcreteGrey_0.5_geo.rad /home/lio/MantaRay/Andrei/radFiles/IntWalls_0.9_geo.rad /home/lio/MantaRay/Andrei/radFiles/Pipes_0.03_geo.rad /home/lio/MantaRay/Andrei/radFiles/ConcreteDarker_0.1_geo.rad /home/lio/MantaRay/Andrei/radFiles/Frames_0.6_geo.rad /home/lio/MantaRay/Andrei/radFiles/Black_0.01_geo.rad /home/lio/MantaRay/Andrei/radFiles/CurvedCeiling_0.8_geo.rad /home/lio/MantaRay/Andrei/radFiles/IntWalls_0.8_geo.rad /home/lio/MantaRay/Andrei/radFiles/FloorBox_0.75_geo.rad ~/MantaRay/Andrei/radFiles/other_materials.mat > ~/MantaRay/Andrei/octrees/Scene_Overcast10klux.oct
echo ~/MantaRay/Andrei/octrees/Scene_Overcast10klux.oct""",
    suppressWarnings=False,
    results="octrees/Scene_Overcast10klux.oct",
    commands="""mkdir -p octrees/
oconv -r 2048 -w -f 10kluxOvercast.sky radFiles/materials.mat radFiles/Glass_70_geo.rad radFiles/Frames_70_00_geo.rad radFiles/Walls_50_00_geo.rad radFiles/Ceilings_70_00_geo.rad radFiles/Ground_20_00_geo.rad radFiles/Floors_20_00_geo.rad radFiles/Context_20_00_geo.rad > octrees/Scene_Overcast10klux.oct
echo octrees/Scene_Overcast10klux.oct""")  # -> Stdout, Stderr_, Ran
panel_14 = Panel(executessh_5.Stderr_)
panel_15 = Panel(overrides_5.Output)
octree_overcast = Text(executessh_5.Stdout)

# ----
# View rad files (inspect first 10 lines)
panel_16 = Panel("head <radFile>")
all_rad_files_2 = Text(all_rad_files)
falsestart_2 = LBFalseStartToggle(False)
overrides_6 = ApplyOverrides(Input=panel_16, RadFile=graft(all_rad_files_2))  # -> Output, DynamicOutput
executessh_6 = ExecuteSSH(
    _SSHCommands_=overrides_6.DynamicOutput,
    Run=falsestart_2,
    addPrefix=True,
    description="""head radFiles/materials.mat


- - -

head radFiles/Glass_70_geo.rad


- - -

head radFiles/Frames_70_00_geo.rad


- - -

head radFiles/Walls_50_00_geo.rad


- - -

head radFiles/Ceilings_70_00_geo.rad


- - -

head radFiles/Ground_20_00_geo.rad


- - -

head radFiles/Floors_20_00_geo.rad


- - -

head radFiles/Context_20_00_geo.rad""",
    fireLogs=False,
    lastRunTime=93,
    suppressWarnings=False,
    results=["""void glass Glass_70
0
0
3 0.762841984823016 0.762841984823016 0.762841984823016

void plastic Ceilings_70_00
0
0
5 0.7 0.7 0.7 0 0""", """# obj2rad -m /home/lio/MantaRay/SimpleRoom/radFiles/glass.map -f /home/lio/MantaRay/SimpleRoom/radFiles/Glass_70_geo.obj
# Written with MantaRay plugin/GH_MeshToRad

Glass_70 polygon Glass_70_geo_1.1
0
0
12
              1.198             -3.115              2.131
              3.164             -3.115              2.131
              3.164             -3.115               1.11""", """# obj2rad -m /home/lio/MantaRay/SimpleRoom/radFiles/mapping.map -f /home/lio/MantaRay/SimpleRoom/radFiles/Floors_20_00_geo.obj
# Written with MantaRay plugin/GH_MeshToRad

Floors_20_00 polygon Floors_20_00_geo_1.1
0
0
12
                4.5                  0                  0
                4.5                 -3                  0
                  0                 -3                  0""", """# obj2rad -m /home/lio/MantaRay/SimpleRoom/radFiles/mapping.map -f /home/lio/MantaRay/SimpleRoom/radFiles/Walls_50_00_geo.obj
# Written with MantaRay plugin/GH_MeshToRad

Walls_50_00 polygon Walls_50_00_geo_1.1
0
0
12
                  0                 -3                2.7
                  0                 -3                  0
              1.198                 -3               1.11""", """# obj2rad -m /home/lio/MantaRay/SimpleRoom/radFiles/mapping.map -f /home/lio/MantaRay/SimpleRoom/radFiles/Ground_20_00_geo.obj
# Written with MantaRay plugin/GH_MeshToRad

Ground_20_00 polygon Ground_20_00_geo_1.1
0
0
12
              -8.24             -8.918                  0
             11.055             -8.918                  0
             11.055               6.63                  0""", """# obj2rad -m /home/lio/MantaRay/SimpleRoom/radFiles/mapping.map -f /home/lio/MantaRay/SimpleRoom/radFiles/Frames_70_00_geo.obj
# Written with MantaRay plugin/GH_MeshToRad

Frames_70_00 polygon Frames_70_00_geo_1.1
0
0
12
              1.198                 -3               1.11
              3.164                 -3               1.11
              3.164             -3.103               1.11""", """# obj2rad -m /home/lio/MantaRay/SimpleRoom/radFiles/mapping.map -f /home/lio/MantaRay/SimpleRoom/radFiles/Context_20_00_geo.obj
# Written with MantaRay plugin/GH_MeshToRad

Context_20_00 polygon Context_20_00_geo_1.1
0
0
12
             -1.183             -7.158                  0
              0.747             -7.158                  0
              0.747             -7.158              1.983""", """# obj2rad -m /home/lio/MantaRay/SimpleRoom/radFiles/mapping.map -f /home/lio/MantaRay/SimpleRoom/radFiles/Ceilings_70_00_geo.obj
# Written with MantaRay plugin/GH_MeshToRad

Ceilings_70_00 polygon Ceilings_70_00_geo_1.1
0
0
12
                4.5                  0                2.7
                  0                  0                2.7
                  0                 -3                2.7"""],
    commands=["head radFiles/materials.mat", "head radFiles/Walls_50_00_geo.rad"])  # -> Stdout, Stderr_, Ran
panel_17 = Panel(executessh_6.Stdout)

# ----
# View rad files in 3d
all_rad_files_3 = Text(all_rad_files)
falsestart_3 = LBFalseStartToggle(False)
download = Download(
    SftpPaths=all_rad_files_3,
    Run=falsestart_3,
    stdouts="C:\Users\mm1013\MantaRay\SimpleRoom\materials.mat>JOIN<C:\Users\mm1013\MantaRay\SimpleRoom\Glass_70_geo.rad>JOIN<C:\Users\mm1013\MantaRay\SimpleRoom\Frames_70_00_geo.rad>JOIN<C:\Users\mm1013\MantaRay\SimpleRoom\Walls_50_00_geo.rad>JOIN<C:\Users\mm1013\MantaRay\SimpleRoom\Context_20_00_geo.rad>JOIN<C:\Users\mm1013\MantaRay\SimpleRoom\Ceilings_70_00_geo.rad>JOIN<C:\Users\mm1013\MantaRay\SimpleRoom\Floors_20_00_geo.rad>JOIN<C:\Users\mm1013\MantaRay\SimpleRoom\Ground_20_00_geo.rad")  # -> FilePaths, Status, Ran
cull = CullPattern(List=download.FilePaths, CullPattern=falsestart_3)
radviewer = RadViewer(
    RadFiles=flatten(cull),
    IsTwoSided=False,
    Polychromatic=True,
    ShowEdges=True,
    Transparent=True,
    ColorNames=["Glass_70", "Floors_20_00", "Walls_50_00", "Ground_20_00", "Frames_70_00", "Context_20_00", "Ceilings_70_00"],
    Colors=[RGB(138, 134, 190), RGB(132, 165, 122), RGB(132, 235, 142), RGB(185, 176, 113), RGB(140, 155, 219), RGB(120, 153, 213), RGB(180, 246, 253)])  # -> Geo, ModifierNames, Modifiers, FailedWireFrame

image = ClipboardImage(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)
# to check if raytracing is actually running try the following in ssh:
# 
# ps -aux | grep rtrace | grep -v grep | awk '{$1=$3=$4=$5=$6=$7=$8=$9=$10=""}1'
image_2 = ClipboardImage(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)
docunits = ConvertToDocumentUnits(ValueString="0.05m")
Z = UnitZ(Factor=docunits)
move = Move(Geometry=grid.Points, Motion=Z)  # -> Geometry, Transform
image_3 = ClipboardImage(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)
docunits_2 = ConvertToDocumentUnits(ValueString="0.05m")

# ----
# Daylight Factor simulation grid based
panel_18 = Panel("""mkdir -p results/
mkdir -p ambFiles/
mkdir -p timing/
date > timing/start.md
rtrace -af ambFiles/<af> -n <cpus> -w -h -I+ <ambientSettings> <octree> < <pts> > results/daylightFactor.ill
echo results/daylightFactor.ill
date > timing/end.md""")
octree_overcast_2 = Text(octree_overcast)
grid_3 = Data(grid_2)
pt = Point(grid.Points)
ptsfile_2 = Text(ptsfile)
falsestart_4 = LBFalseStartToggle(True)
gradient = Gradient(
    LowerLimit=1,
    UpperLimit=0,
    Parameter=1,
    stops=[0: RGB(0, 0, 255), 0.1: RGB(53, 0, 202), 0.2: RGB(107, 0, 148), 0.3: RGB(160, 0, 95), 0.4: RGB(214, 0, 41), 0.5: RGB(255, 12, 0), 0.6: RGB(255, 66, 0), 0.7: RGB(255, 119, 0), 0.8: RGB(255, 173, 0), 0.9: RGB(255, 226, 0), 1: RGB(255, 255, 0)])
gradient_2 = Gradient(
    LowerLimit=0,
    UpperLimit=1,
    Parameter=1,
    stops=[0: RGB(237, 237, 206), 0.542: RGB(212, 209, 182), 0.61: RGB(207, 206, 188), 0.632: RGB(179, 187, 199), 1: RGB(132, 146, 173)])
gridsettings = GridSettings(From="0", To="5", ASteps="11", BStepSize=-1)

default = DefaultMSS(data=flatten(parserhinofile.Ran), default_value_flattened=flatten(falsestart_4))

python_2 = GhPythonScript(update=flatten(default))  # -> time; inputs update: tree
# ---------- python_2: Python ----------
#if not update:
#    return self.time
"""Provides a scripting component.
    Inputs:
        x: The x script variable
        y: The y script variable
    Output:
        a: The a output variable"""
        
__author__ = "mm1013"
__version__ = "2022.08.30"
        
import rhinoscriptsyntax as rs
        
from datetime import datetime
dt = datetime.now()
        
time = "%02d_%02d_%02d_%02d%02d_%02d" % (dt.year, dt.month, dt.day, dt.hour, dt.minute, dt.second)
# ---------- end python_2 ----------
overrides_7 = ApplyOverrides(
    Input=panel_18,
    AmbientSettings=graft("-aa 0.1 -ab 5 -ad 1024 -lw 0.001"),
    Octree=graft(octree_overcast_2),
    Pts=graft(ptsfile_2),
    Af=graft(python_2))  # -> Output, DynamicOutput
executessh_7 = ExecuteSSH(
    _SSHCommands_=overrides_7.DynamicOutput,
    Run=falsestart_4,
    addPrefix=True,
    description="""mkdir -p results/
mkdir -p ambFiles/
mkdir -p timing/
date > timing/start.md
rtrace -af ambFiles/2023_10_25_2210_26 -n 63 -w -h -I+ -aa 0.1 -ab 5 -ad 1024 -lw 0.001 octrees/Scene_Overcast10klux.oct < ptsFiles/ptsFiles.pts > results/daylightFactor.ill
echo results/daylightFactor.ill
date > timing/end.md""",
    fireLogs=True,
    lastRunTime=122,
    name="rtrace daylightfactor",
    suppressWarnings=False,
    commands="""mkdir -p results/
mkdir -p ambFiles/
mkdir -p timing/
date > timing/start.md
rtrace -af ambFiles/2023_10_25_2210_26 -n 63 -w -h -I+ -aa 0.1 -ab 5 -ad 1024 -lw 0.001 octrees/Scene_Overcast10klux.oct < ptsFiles/ptsFiles.pts > results/daylightFactor.ill
echo results/daylightFactor.ill
date > timing/end.md""")  # -> Stdout, Stderr_, Ran
overrides_8 = ApplyOverrides(Input="cat <ill> | rcalc -e '$1=179*($1*.265+$2*.670+$3*.065)'", Ill=graft(executessh_7.Stdout))  # -> Output, DynamicOutput
executessh_8 = ExecuteSSH(
    _SSHCommands_=overrides_8.DynamicOutput,
    Run=executessh_7.Ran,
    addPrefix=True,
    description="cat <ill> | rcalc -e '$1=179*($1*.265+$2*.670+$3*.065)'",
    fireLogs=False,
    lastRunTime=49,
    suppressWarnings=False,
    results="""12.9397042
14.8617811
16.921151
18.3061152
19.5640019
21.074207
14.9304276
18.6029688
20.6623459
22.4471191
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""",
    commands="cat results/daylightFactor.ill | rcalc -e '$1=179*($1*.265+$2*.670+$3*.065)'")  # -> Stdout, Stderr_, Ran
split = TextSplit(Text=executessh_8.Stdout)
num = Number(expr("x/100", split))
unflatten = UnflattenTree(Tree=num, Guide=pt)
expression = Expression(x=unflatten, Expression="Format(\"{0:0.0}\", x)")
gridviewer = GridViewer(
    Grids=flatten(grid_3),
    Results=unflatten,
    _Gradient=reverse(gradient_2),
    _MinColor=RGB(169, 169, 169),
    _MaxColor=RGB(211, 211, 211),
    _SectionType=gridsettings)  # -> ColoredMesh, LayeredMesh, Curves, Planes, TempMeshes, flatten(Colors), flatten(Values)
mesh = Mesh(gridviewer.LayeredMesh)
col = Colour(gridviewer.Colors)
data = Data(gridviewer.Values)
preview = CustomPreview(Geometry=gridviewer.Curves, Material=ColourSwatch(SwatchColor=RGB(117, 117, 117)))

panel_19 = Panel(overrides_7.DynamicOutput)
tag = TextTag3D(
    Location=move.Geometry,
    Text=expression,
    Size=docunits_2,
    Colour=ColourSwatch(SwatchColor=RGB(43, 43, 43)),
    Justification=7)

# ----
# Setup dashboards
mesh_2 = Mesh(mesh)
col_2 = Colour(col)
data_2 = Data(data)
path_mapper = PathMapper(mesh_2, source="{A;B}", target="{A;B+1}")
split_2 = SplitTree(Data=path_mapper, Masks=flatten("{*;0}"))  # -> Positive, Negative
mesh_3 = Mesh(split_2.Positive)
mesh_4 = Mesh(split_2.Negative)
abx = ABX(data=mesh_4, pathCount=1)  # -> data; inputs data: tree, pathCount: Int32
# ---------- abx: C# usings ----------
using System.Linq;
# ---------- abx: C# ----------
    DataTree<object> newTree = new DataTree<object>();
    _data.SimplifyPaths();
    var y = _data.Paths;
    if (pathCount < 1)
    {
      pathCount = 1;
    }


    for (int i = 0; i < _data.BranchCount; i++)
    {
      GH_Path oldPath = _data.Paths[i];
      GH_Path p = new GH_Path(oldPath.Indices.Take(pathCount).ToArray());


      newTree.AddRange(_data.Branches[i], p);
    }
    data = newTree;
# ---------- end abx ----------
python_linkajou = PythonLinkajou(base_mesh=mesh_3, value_mesh=abx, values=data_2, colors=col_2)  # -> flatten(items); inputs base_mesh: Mesh, value_mesh: list of Mesh, values: list, colors: list of Color
# ---------- python_linkajou: Python ----------
import rhinoscriptsyntax as rs



import Grasshopper
import Linkajou
from Grasshopper.Kernel.Types import *
from System.Collections import *
import System
import Rhino


if Rhino.RhinoDoc.ActiveDoc.ModelUnitSystem == Rhino.UnitSystem.Meters:
    units = 1
    unit = "m2"
elif Rhino.RhinoDoc.ActiveDoc.ModelUnitSystem == Rhino.UnitSystem.Millimeters:
    units = 1000
    unit = "m2"
elif Rhino.RhinoDoc.ActiveDoc.ModelUnitSystem == Rhino.UnitSystem.Feet:
    units = 304.8 / 1000.0
    unit = "ft"

def to_unit(u):
    return u / units / units
    
    

#clr.ImportExtensions(Linkajou.Extensions)

base_area = to_unit(Rhino.Geometry.AreaMassProperties.Compute(base_mesh, True, False, False,False).Area)
sub_area = to_unit(Rhino.Geometry.AreaMassProperties.Compute(value_mesh[0], True, False, False,False).Area)

main_item = Linkajou.Dashboards.DashboardItemPartitioned()

main_item.NestedItems = System.Collections.Generic.List[Linkajou.Dashboards.DashboardItem]()
main_item.Name = "Room %s" % ghenv.Component.RunCount
main_item.MaxValue = base_area



import clr
clr.AddReference('LINK_Dashboards')
#clr.AddReference('Linkajou')
ghenv.Component.Message = "LINK_Dashboards"


#main_item.
for i,value in enumerate(values):
    print i
    newmesh = value_mesh[i].DuplicateMesh()
    newmesh.VertexColors.Clear()
    main_item.AssociatedGeometry.Add(GH_Mesh(value_mesh[i]))
    last_area = sub_area
    sub_area = to_unit(Rhino.Geometry.AreaMassProperties.Compute(value_mesh[i], True, False, False,False).Area)
    
    child_item = Linkajou.Dashboards.DashboardItem() # show area above xx threshold
    child_item.Value = sub_area
    #child_item.ShowPinned
    child_item.MaxValue = base_area
    child_item.Name = "%s %%" % values[i]
    child_item.AssociatedGeometry.Add(GH_Mesh(newmesh))
    child_item.Units = unit
    child_item.ShowValueInName = True


    nested_item = Linkajou.Dashboards.DashboardItem() # shown in the % distribution
    if i == len(values) - 1:
        nested_item.Value = sub_area
        nested_item.Name = "%s" % values[i]
    else:
        nested_item.Value = last_area - sub_area
        nested_item.Name = "%s to %s" % (values[i], values[i+1])
    nested_item.AssociatedGeometry.Add(GH_Mesh(value_mesh[i]))
    nested_item.Units = unit

    main_item.NestedItems.Add(nested_item)
    main_item.Children.Add(child_item)
    
    
    child_item.Color = nested_item.Color = colors[i]
    
    
for nested_item in main_item.NestedItems:
    nested_item.AssociatedGeometry = main_item.AssociatedGeometry
    
main_item.PinnedPreview = True
main_item.CapMinMax = True
#main_item.Max
#main_item.PreviewNestedGeometriesDepth = 3
items = main_item
# ---------- end python_linkajou ----------

python_linkajou_2 = PythonLinkajou(items=python_linkajou)  # -> flatten(a); inputs items: list
# ---------- python_linkajou_2: Python ----------
import rhinoscriptsyntax as rs

import clr
clr.AddReference('LINK_Dashboards')
#clr.AddReference('Linkajou')

import Grasshopper
import Linkajou
from Grasshopper.Kernel.Types import *
from System.Collections import *
import System
import Rhino

main_item = Linkajou.Dashboards.DashboardItem()
main_item.Name = "Daylight Factors"
main_item.Value = 1
main_item.MaxValue = 1
main_item.Color = System.Drawing.Color.FromArgb(200, 170,180,194)

for item in items:
    
    main_item.Children.Add(item)

a = main_item
# ---------- end python_linkajou_2 ----------

linkdashboard_show = LINKDashboardShow(
    Items=flatten(python_linkajou_2),
    _Enable=True,
    Logo=0,
    OverrideAnchor=False,
    OverrideAnchorX=0,
    OverrideAnchorY=0,
    DrawChannel=0)

# ==== cluster DefaultMSS
default_value_flattened = ClusterInput()
data = ClusterInput()
data_2 = Data(data)
merge = Merge(Data1=flatten(data_2), Data2="0")  # -> flatten(Result)
default_value_flattened_2 = Data(flatten(default_value_flattened))
lng = ListLength(List=merge)
equals = Equality(FirstNumber=lng, SecondNumber="1")  # -> Equality, Inequality
cull = CullPattern(List=data_2, CullPattern=invert(equals.Equality))
panel = Panel(equals.Equality)
cull_2 = CullPattern(List=default_value_flattened_2, CullPattern=equals.Equality)
data_3 = Data([cull, cull_2])
data_4 = ClusterOutput(data_3)
