# Grasshopper definition 01 Basics.gh (Grasshopper 1.0.7)
# Copyright: 2021
# plug-ins: MantaRay, LadybugGrasshopper

# ----
# 1) Connect
# To be able to use the plugin you will need access to a linux server through SSH.
# 
# In the component below you can insert your credentials and it's optional whether
#  you will save the password in the GH document. If you don't, you'll be prompted
# once per grasshopper session.
# 
# If SSH is not found on the host and the ip is
# local (127.0.0.1) there's a chance that the
# plugin will establish SSH through a bash prompt.
# 
# Don't worry, it wont ask for the question again
# on reloads etc. If you want to re/disconnect
# then toggle connect to false and back to true.
# Set it to true and eventually recompute
# everything after setting it to true
python = GhPythonScript()  # -> username
# ---------- python: Python ----------
__author__ = "mm1013"
__version__ = "2022.09.25"

import rhinoscriptsyntax as rs

import System

username = System.Environment.UserName

if username == "mm1013":
    username = "mss"
# ---------- end python ----------
panel = Panel(python)
connect = ConnectSSHFTP(User=panel, Ip="localhost", Subfolder="MyProject", Password="_prompt", _port=22, Connect=Toggle(True))  # -> Status, Prefixes, Run
# Make sure the connection is up and running
# before jumping into the examples to the right.
# 
# If they show red error/no connection,
# then right click on an empty spot on the canvas
# and select recompute
panel_2 = Panel(connect.Status)

# ----
# MantaRay
# An Educational Tool to Work Directly with
# Radiance Through Grasshopper and SSH
# https://github.com/Sonderwoods/MantaRay
# Mathias Sønderskov Schaltz
image = ImageSampler(
    FilePath="C:\Users\mm1013\Desktop\mantarayLowres.PNG",
    Filter="Colour",
    Interpolate=True,
    Umax=1,
    Umin=0,
    Vmax=1,
    Vmin=0,
    Wrap=1)  # disabled

# ----
# If the connection is working properly
# you should see Hello World here!
toggle = BooleanToggle(True)
# 2) Execute Component
panel_3 = Panel("echo \"Hello World\"")
executessh = ExecuteSSH(
    _SSHCommands_=panel_3,
    Run=toggle,
    addPrefix=True,
    fireLogs=False,
    lastRunTime=21.7615,
    suppressWarnings=False,
    results="Hello World",
    commands="echo \"Hello World\"")  # -> Stdout, Stderr_, Ran
panel_4 = Panel(executessh.Ran)
panel_5 = Panel(executessh.Stdout)

# ----
# Here we have an stderr
# instead of the stdout
# Here we a typo. (ehho)
# Btw, this component is supposed to be yellow.
# If it's red, then the connection is not established.
toggle_2 = BooleanToggle(True)
executessh_2 = ExecuteSSH(
    _SSHCommands_="ehho \"Hello World\"",
    Run=toggle_2,
    addPrefix=True,
    fireLogs=False,
    lastRunTime=18.3444,
    suppressWarnings=False,
    stderr="bash: ehho: command not found",
    commands="ehho \"Hello World\"")  # -> Stdout, Stderr_, Ran
panel_6 = Panel(executessh_2.Stdout)
panel_7 = Panel(executessh_2.Ran)
panel_8 = Panel(executessh_2.Stderr_)

# ----
# Right click on your component.
# It knows we are calling oconv and
# proposes to view oconv manpage
# Automatic manpages
panel_9 = Panel("oconv aFile.rad > myTestFile.oct")
executessh_3 = ExecuteSSH(_SSHCommands_=panel_9, Run=Toggle(False), addPrefix=True, fireLogs=False, lastRunTime=7, suppressWarnings=False)  # -> Stdout, Stderr_, Ran
panel_10 = Panel(executessh_3.Stdout)

# ----
# Color codes
# Running
component_color = TestComponentColor(Color=RGB(140, 13, 140), SelColor=RGB(140, 13, 140))

# ----
# Here, run is set to false
# But we're still seeing the
# stdout.
# 
# That's because it previously has
# been run in this file before it was saved.
# 
# Also this descending connected components will
# only be expired when run is set to true.
# This avoids that the rest of your script runs twice
# after setting Run to true and then false.
# The component saves the last successful stdout.
# So now it has a green color.
# 
# The component saves the stdout even when you reload
# the grasshopper document. This way, the component
# will just output the path for the result file.
# 
# This is ideal for cases where you generate static
# content such as a reusable MF6 sky etc that takes time.
# 
# If you want to clear the cache for this component (or for all components),
# simply right click on it and hit clear.
toggle_3 = BooleanToggle(False)
executessh_4 = ExecuteSSH(
    _SSHCommands_="echo \"Hello World\"",
    Run=toggle_3,
    addPrefix=True,
    fireLogs=False,
    lastRunTime=11,
    suppressWarnings=False,
    results="Hello World",
    commands="echo \"Hello World\"")  # -> Stdout, Stderr_, Ran
panel_11 = Panel(executessh_4.Stdout)

# ----
# This thing is purple while it is running
panel_12 = Panel("sleep 9")
trigger = Trigger(Interval=10000, TimerInterval=10000, Target=executessh_5)  # disabled
executessh_5 = ExecuteSSH(
    _SSHCommands_=panel_12,
    Run=Toggle(True),
    addPrefix=True,
    fireLogs=False,
    lastRunTime=8783.015,
    suppressWarnings=False,
    commands="sleep 9")  # -> Stdout, Stderr_, Ran
panel_13 = Panel(executessh_5.Stdout)
panel_14 = Panel(executessh_5.Ran)

# ----
# Ran fine
component_color_2 = TestComponentColor(Color=RGB(217, 217, 217), SelColor=RGB(217, 217, 217))

# ----
# stderr
component_color_3 = TestComponentColor(Color=RGB(255, 155, 33), SelColor=RGB(255, 155, 33))

# ----
# errors such as no connection
component_color_4 = TestComponentColor(Color=RGB(217, 17, 17), SelColor=RGB(217, 17, 17))

# ----
# Here you setup globals for your document.
# It could be paths to result files, ambient parameters,
# project name etc etc
panel_15 = Panel("""TestProject
-ab 3 -ad 4096""")
panel_16 = Panel("""projectName
amb""")
global_overrides = GlobalOverrides(Keys=panel_16, Values=panel_15)  # disabled
panel_17 = Panel(global_overrides)

# ----
# You can also use the zoomable UI,
# simply rename the inputs to value names.
panel_18 = Panel("TestProject")
global_overrides_2 = GlobalOverrides(ProjectName=panel_18, Amb="-ab 3 -ad 4096")  # disabled
panel_19 = Panel(global_overrides_2)

# ----
# <cpus> is set to your local cpu count minus 1.
# If running remotely, this can be overwriten like below.
# changing items in this component will NOT update other execute components in your script.
# You'll have to manually trigger/recompute those.
# 
# It's technically possible,
# but I'm afraid it will cause unwanted effects such as loosing long simulation results etc.
panel_20 = Panel("6")
global_overrides_3 = GlobalOverrides(Cpus=panel_20)  # disabled
panel_21 = Panel(global_overrides_3)

# ----
# 3) Global Variables
# This component outputs globals created already in the connect component above
global_overrides_4 = GlobalOverrides()
panel_22 = Panel(global_overrides_4)

# ----
# There can only be one of these components active on your canvas at a time.
# So to activate this one, you will have to deactivate the first one above!
global_overrides_5 = GlobalOverrides()  # disabled
panel_23 = Panel(global_overrides_5)

# ----
# Now the component automatically
# added the missing parameters
# Try connecting the hello world to message
panel_24 = Panel("Hello World")
overrides = ApplyOverrides(Input_="echo \"<message>\"")
panel_25 = Panel(overrides)

# ----
# you can omit file names by using <input-.>
# This will remove everything after the dot.
# Convenient for file names.
# 
# Alternatively you can use <myinput-N> to remove the last N characters
panel_26 = Panel("""echo "<message-.>"
echo "<message-6>"
""")
overrides_2 = ApplyOverrides(Input_=panel_26, Message=graft("MyRadFile.rad"))
python_2 = GhPythonScript(x=overrides_2)  # -> a
# ---------- python_2: Python ----------
__author__ = "mm1013"
__version__ = "2022.09.25"

import rhinoscriptsyntax as rs

a = x.Value
# ---------- end python_2 ----------
panel_27 = Panel(python_2)

# ----
# You can right click on the component and choose "Fill missing parameters"
# Right click here in the middle
panel_28 = Panel("echo \"<message>\"")
overrides_3 = ApplyOverrides(Input_=panel_28)

# ----
# Now it looks good
panel_29 = Panel("echo \"<message>\"")
overrides_4 = ApplyOverrides(Input_=panel_29, Message=graft("Hello World"))
panel_30 = Panel(overrides_4)

# ----
# 4) Using the variables
# Start inputting your SSH command (linux command) into the ApplyGlobals component
# You see an error now that "message" is missing
panel_31 = Panel("echo \"<message>\"")
overrides_5 = ApplyOverrides(Input_=panel_31)

# ----
# If you don't depend on any local variables but only the globals,
# you can input the prompt directly to the Execute component
panel_32 = Panel("echo \"You'll use <cpus> cpus\"")
executessh_6 = ExecuteSSH(_SSHCommands_=panel_32, Run=Toggle(False), addPrefix=True, fireLogs=False, lastRunTime=0, suppressWarnings=False)  # -> Stdout, Stderr_, Ran
panel_33 = Panel(executessh_6.Stdout)

# ----
# You might have noticed the python component
# i use to print the commands to a panel.
# 
# If we omit it, then we get a class of "Overridable Text"
# which will be updated on runtime.
# This is clever in case of updates to globals such
# as project name etc. Then we don't have to rerun
# all of our ApplyGlobals components.
# 
# However it can also create confusion as we should parse
# the ApplyGlobals component directly into the Execute.
# If we don't, then it will not be updated on runtime and we will
# also get the tail of the message.
toggle_4 = BooleanToggle(True)

# ----
# This works
panel_34 = Panel("echo \"<message>\"")
overrides_6 = ApplyOverrides(Input_=panel_34, Message=graft("MyRadFile.rad"))
panel_35 = Panel(overrides_6)
executessh_7 = ExecuteSSH(
    _SSHCommands_=overrides_6,
    Run=toggle_4,
    addPrefix=True,
    description="echo \"MyRadFile.rad\"",
    fireLogs=False,
    lastRunTime=21.8053,
    suppressWarnings=False,
    results="MyRadFile.rad",
    commands="echo \"MyRadFile.rad\"")  # -> Stdout, Stderr_, Ran
panel_36 = Panel(executessh_7.Stdout)

# ----
# This works but is bad!
panel_37 = Panel("echo \"<Project>/<message>\"")
overrides_7 = ApplyOverrides(Input_=panel_37, Message=graft("MyRadFile.rad"))
panel_38 = Panel(overrides_7)
executessh_8 = ExecuteSSH(
    _SSHCommands_=panel_38,
    Run=Toggle(True),
    addPrefix=True,
    fireLogs=False,
    lastRunTime=18.5269,
    suppressWarnings=False,
    results="MyProject/MyRadFile.rad",
    commands="""echo "MyProject/MyRadFile.rad"

# This is a MantaRay Dictionary
# Globals will be updated in Execute component
# Locals will not!
# This tail is ignored by the Execute component""")  # -> Stdout, Stderr_, Ran
panel_39 = Panel(executessh_8.Stdout)

# ----
# 5) Uploading and downloading
# Download a file through SSH/sFTP
panel_40 = Panel("""echo "Hello World" > ~/hello_world.txt
echo ~/hello_world.txt""")
executessh_9 = ExecuteSSH(
    _SSHCommands_=panel_40,
    Run=Toggle(True),
    addPrefix=True,
    fireLogs=False,
    lastRunTime=7.1752,
    suppressWarnings=False,
    results="/home/mss/hello_world.txt",
    commands="""echo "Hello World" > ~/hello_world.txt
echo ~/hello_world.txt""")  # -> Stdout, Stderr_, Ran
download = Download(LinuxFilePaths=executessh_9.Stdout, TargetLocalFolder="C:\Temp", Run=executessh_9.Ran, stdouts="C:\Temp\hello_world.txt")  # -> Status, FilePaths, Ran
panel_41 = Panel(download.Status)
filename = Text(download.FilePaths)
panel_42 = Panel(filename)

# ----
# Check the file in windows environment
filename_2 = Text(filename)
file = ReadFile(File=filename_2, PerLineParse=True)
panel_43 = Panel(file)

# ----
# Upload a file through SSH/sFTP
filename_3 = Text(filename)
run = Boolean(executessh_9.Ran)
upload = Upload(LocalFilePaths=filename_3, Run=run, stdouts="~/MantaRay/MyProject/hello_world.txt")  # -> Status, FilePaths, Ran
panel_44 = Panel(upload.Status)
filename_4 = Text(upload.FilePaths)
panel_45 = Panel(filename_4)

# ----
# Check in linux
run_2 = Boolean(upload.Ran)
filename_5 = Text(filename_4)
overrides_8 = ApplyOverrides(Input_="cat <filename>", Filename=graft(filename_5))
executessh_10 = ExecuteSSH(
    _SSHCommands_=overrides_8,
    Run=run_2,
    addPrefix=True,
    description="cat ~/MantaRay/MyProject/hello_world.txt",
    fireLogs=False,
    lastRunTime=7.3264,
    suppressWarnings=False,
    results="Hello World",
    commands="cat ~/MantaRay/MyProject/hello_world.txt")  # -> Stdout, Stderr_, Ran
panel_46 = Panel(executessh_10.Stdout)

# ----
# create a sky
panel_47 = Panel("""echo "
# uniform brightness sky (B=1)
void glow sky_glow
0
0
4 1 1 1 0
sky_glow source sky
0
0
4 0 0 1 180" > <target>
echo <target>""")
overrides_9 = ApplyOverrides(Input_=panel_47, Target=graft("myFile.rad"))
executessh_11 = ExecuteSSH(
    _SSHCommands_=overrides_9,
    Run=Toggle(True),
    addPrefix=True,
    description="""echo "
# uniform brightness sky (B=1)
void glow sky_glow
0
0
4 1 1 1 0
sky_glow source sky
0
0
4 0 0 1 180" > myFile.rad
echo myFile.rad""",
    fireLogs=False,
    lastRunTime=9.2793,
    suppressWarnings=False,
    results="myFile.rad",
    commands="""echo "
# uniform brightness sky (B=1)
void glow sky_glow
0
0
4 1 1 1 0
sky_glow source sky
0
0
4 0 0 1 180" > myFile.rad
echo myFile.rad""")  # -> Stdout, Stderr_, Ran
panel_48 = Panel(executessh_11.Stdout)

# ----
# show the content of the file (cat)
run_3 = Boolean(executessh_11.Ran)
radfile = Text(panel_48)
overrides_10 = ApplyOverrides(Input_="cat <file>", File=graft(radfile))
executessh_12 = ExecuteSSH(
    _SSHCommands_=overrides_10,
    Run=run_3,
    addPrefix=True,
    description="cat myFile.rad",
    fireLogs=False,
    lastRunTime=6.6186,
    suppressWarnings=False,
    results="""# uniform brightness sky (B=1)
void glow sky_glow
0
0
4 1 1 1 0
sky_glow source sky
0
0
4 0 0 1 180""",
    commands="cat myFile.rad")  # -> Stdout, Stderr_, Ran
panel_49 = Panel(executessh_12.Stdout)

# ----
# 7) Octree
pt = Point(Point(10, 10, 10))
pt_2 = Point(Point(0, 0, 0))
falsestart = LBFalseStartToggle(True)
box = Box2Pt(PointA=pt_2, PointB=pt, Plane=PlaneXY(0, 0, 0))
mesh2obj = MeshToObj(Mesh=box, Name=graft("TestBox2"), MapFileName="mapping", ModifierName=graft("TestBoxMaterial"), Run=falsestart)  # -> ObjFiles, MapFile, Run
opaquecolormat = OpaqueColorMat(Name="TestBoxMaterial", Color=ColourSwatch(SwatchColor=RGB(153, 153, 153)), Specularity=0, Roughness=0)  # -> RadMaterials, RadMaterialList
obj2rad = ObjToRad(ObjFiles=mesh2obj.ObjFiles, MapFile=mesh2obj.MapFile, Run=mesh2obj.Run, stdouts="~/MantaRay/MyProject/TestBox2.rad")  # -> Status, RadFiles, Run
panel_50 = Panel(obj2rad.RadFiles)

# ----
# 8) Rad viewer
panel_51 = Panel("radFiles")
python_3 = GhPythonScript(file=panel_51)  # -> localpath
# ---------- python_3: Python ----------
__author__ = "mm1013"
__version__ = "2022.09.25"

import rhinoscriptsyntax as rs


import Grasshopper as gh
import os

if file is None:
    file = ""
localpath = os.path.dirname(gh.Instances.ActiveCanvas.Document.FilePath) + "\\" + file
# ---------- end python_3 ----------
python_4 = GhPythonScript(dir=python_3)  # -> out
# ---------- python_4: Python ----------
__author__ = "mm1013"
__version__ = "2022.08.05"

import rhinoscriptsyntax as rs

import glob, os
os.chdir(dir)
for file in glob.glob("*.rad"):
    print(file)
for file in glob.glob("*.mat"):
    print(file)
# ---------- end python_4 ----------
panel_52 = Panel(python_4)
radviewer = RadViewer(
    RadFiles=panel_52,
    IsTwoSided=True,
    Polychromatic=True,
    ShowEdges=True,
    Transparent=True,
    ColorNames=["Ceiling_70_mat", "Context_25_mat", "Floor_20_mat", "Frames_70_mat", "Glass_30_mat", "Glass_50_mat", "Terrain_20_mat", "Wall_50_mat"],
    Colors=[RGB(212, 208, 167), RGB(229, 231, 224), RGB(247, 144, 230), RGB(195, 218, 252), RGB(220, 104, 159), RGB(139, 219, 144), RGB(238, 139, 159), RGB(149, 207, 127)])  # -> Meshes, Names, ModifierNames, Modifiers

panel_53 = Panel("""echo "<rad>" > ~/simulation/tempRad.rad
echo ~/simulation/tempRad.rad""")
panel_54 = Panel("""void plastic Black
0
0
5 0.0 0.0 0.0 0.0 0.0

Black sphere mySphere
0
0
4 1.0 1.0 1.0 1.0

Black cylinder myCylinder
0
0
7
0.0 0.0 0.0 1.0 1.0 1.0 1.0

Black tube myCylinder
0
0
7
0.0 0.0 0.0 -1.0 -1.0 -1.0 1.0""")
toggle_5 = BooleanToggle(True)
overrides_11 = ApplyOverrides(Input_=panel_53, Rad=graft(panel_54))  # -> Output, Pairs
executessh_13 = ExecuteSSH(
    _SSHCommands_=overrides_11.Output,
    Run=toggle_5,
    addPrefix=True,
    description="""echo "void plastic Black
0
0
5 0.0 0.0 0.0 0.0 0.0

Black sphere mySphere
0
0
4 1.0 1.0 1.0 1.0

Black cylinder myCylinder
0
0
7
0.0 0.0 0.0 1.0 1.0 1.0 1.0

Black tube myCylinder
0
0
7
0.0 0.0 0.0 -1.0 -1.0 -1.0 1.0" > ~/simulation/tempRad.rad
echo ~/simulation/tempRad.rad""",
    fireLogs=False,
    lastRunTime=11.6063,
    suppressWarnings=False,
    results="/home/mss/simulation/tempRad.rad",
    commands="""echo "void plastic Black
0
0
5 0.0 0.0 0.0 0.0 0.0

Black sphere mySphere
0
0
4 1.0 1.0 1.0 1.0

Black cylinder myCylinder
0
0
7
0.0 0.0 0.0 1.0 1.0 1.0 1.0

Black tube myCylinder
0
0
7
0.0 0.0 0.0 -1.0 -1.0 -1.0 1.0" > ~/simulation/tempRad.rad
echo ~/simulation/tempRad.rad""")  # -> Stdout, Stderr_, Ran
overrides_12 = ApplyOverrides(Input_="cat <rad>", Rad=graft(executessh_13.Stdout))  # -> Output, Pairs
convertpaths = ConvertPaths(I=executessh_13.Stdout)  # -> Linux, Windows
executessh_14 = ExecuteSSH(
    _SSHCommands_=overrides_12.Output,
    Run=toggle_5,
    addPrefix=True,
    description="cat /home/mss/simulation/tempRad.rad",
    fireLogs=False,
    lastRunTime=7.8188,
    suppressWarnings=False,
    results="""void plastic Black
0
0
5 0.0 0.0 0.0 0.0 0.0

Black sphere mySphere
0
0
4 1.0 1.0 1.0 1.0

Black cylinder myCylinder
0
0
7
0.0 0.0 0.0 1.0 1.0 1.0 1.0

Black tube myCylinder
0
0
7
0.0 0.0 0.0 -1.0 -1.0 -1.0 1.0""",
    commands="cat /home/mss/simulation/tempRad.rad")  # -> Stdout, Stderr_, Ran
radviewer_2 = RadViewer(RadFiles=convertpaths.Windows, IsTwoSided=False, Polychromatic=True, ShowEdges=True, Transparent=True)  # -> Meshes, Names, ModifierNames, Modifiers
panel_55 = Panel(executessh_14.Stdout)

# ----
# You can also use the globals set up (left column of here)
panel_56 = Panel("echo \"Your project <Project> is working in <LinuxHome>\"")

overrides_13 = ApplyOverrides(Input_=["echo \"You will use <cpus> cpus\"", panel_56])

python_5 = GhPythonScript(x=overrides_13)  # -> a; same code as python_2
panel_57 = Panel(python_5)

# ----
# Assemble octree
panel_58 = Panel("""oconv <file> > <file-.>.oct
echo <file-.>.oct""")
radfile_2 = Text(panel_48)
run_4 = Boolean(executessh_12.Ran)

overrides_14 = ApplyOverrides(Input_=panel_58, File=graft(radfile_2))

executessh_15 = ExecuteSSH(
    _SSHCommands_=overrides_14,
    Run=run_4,
    addPrefix=True,
    description="""oconv myFile.rad > myFile.oct
echo myFile.oct""",
    fireLogs=False,
    lastRunTime=8.9778,
    suppressWarnings=False,
    results="myFile.oct",
    commands="""oconv myFile.rad > myFile.oct
echo myFile.oct""")  # -> Stdout, Stderr_, Ran
panel_59 = Panel(executessh_15.Stdout)

# ----
# converted
# OMG it's close to PI!
# The litterature will tell you why
octree = Text(executessh_15.Stdout)
panel_60 = Panel("""echo "0 0 0 0 0 1" | rtrace -w -h -I+ -ab 1 <octree> | rcalc -e \
'$1=$1*0.265+$2*0.670+$3*0.065'""")
overrides_15 = ApplyOverrides(Input_=panel_60, Octree=graft(octree))

# ----
# 6) First radiance script
# Example as pr 6.3
# Case Study I in Rendering with Radiance p355
# Illuminance on a 0,0,0 point
octree_2 = Text(executessh_15.Stdout)
run_5 = Boolean(executessh_15.Ran)

overrides_16 = ApplyOverrides(Input_="echo \"0 0 0 0 0 1\" | rtrace -h -I+ -w -ab 1 <octree>", Octree=graft(octree_2))
executessh_16 = ExecuteSSH(
    _SSHCommands_=overrides_16,
    Run=run_5,
    addPrefix=True,
    description="echo \"0 0 0 0 0 1\" | rtrace -h -I+ -w -ab 1 myFile.oct",
    fireLogs=False,
    lastRunTime=7.3837,
    suppressWarnings=False,
    results="3.141593e+00\t3.141593e+00\t3.141593e+00\t",
    commands="echo \"0 0 0 0 0 1\" | rtrace -h -I+ -w -ab 1 myFile.oct")  # -> Stdout, Stderr_, Ran

run_6 = Boolean(executessh_16.Ran)
executessh_17 = ExecuteSSH(
    _SSHCommands_=overrides_15,
    Run=run_6,
    addPrefix=True,
    description="""echo "0 0 0 0 0 1" | rtrace -w -h -I+ -ab 1 myFile.oct | rcalc -e \
'$1=$1*0.265+$2*0.670+$3*0.065'""",
    fireLogs=False,
    lastRunTime=8.0338,
    suppressWarnings=False,
    results="3.141593",
    commands="""echo "0 0 0 0 0 1" | rtrace -w -h -I+ -ab 1 myFile.oct | rcalc -e \
'$1=$1*0.265+$2*0.670+$3*0.065'""")  # -> Stdout, Stderr_, Ran
panel_61 = Panel(executessh_17.Stdout)

panel_62 = Panel(executessh_16.Stdout)
