# Grasshopper definition TestConnection.gh (Grasshopper 1.0.7)
# Copyright: 2021
# Copyright: 2022-28-21
# Copyright: 2022-06-43
# plug-ins: MantaRay, LadybugGrasshopper, Human, HDTTreeUtils

# ----
# you can remove last characters of a value
# 
# Here adding render instead of image
panel = Panel("echo <proj>/<target-8>_render.gif")
applyglobals = ApplyGlobals(Input=panel, AdditionalKeys="target", AdditionalValues="myFiles/myImage.hdr")  # -> Output, Pairs
panel_2 = Panel(applyglobals.Output)

# ----
# you can combine globals and locals
panel_3 = Panel("echo <proj>/<target-.>.gif")
applyglobals_2 = ApplyGlobals(Input=panel_3, AdditionalKeys="target", AdditionalValues="myFiles/myImage.hdr")  # -> Output, Pairs
panel_4 = Panel(applyglobals_2.Output)

# ----
# Applyglobals
# try <target-.>  to remove the file ending on <target>
# 
# Here we are changing from hdr to gif
panel_5 = Panel("echo <target-.>.gif")
applyglobals_3 = ApplyGlobals(Input=panel_5, AdditionalKeys="target", AdditionalValues="myFiles/myImage.hdr")  # -> Output, Pairs
panel_6 = Panel(applyglobals_3.Output)

# ----
# Setup globals
panel_7 = Panel("""~/simulation/test_project2
test_project2
/simulation/test_project2""")
panel_8 = Panel("""proj
projname
projfolder""")
global_overrides = GlobalOverrides(Keys=panel_8, Values=panel_7)
panel_9 = Panel(global_overrides)

# ----
# Connect
panel_10 = Panel("mss")
connect_ssh = ConnectSSH(User=panel_10, Ip="127.0.0.1", Password="_prompt", _port=22, Connect=Toggle(True))  # -> Status, Run
panel_11 = Panel(connect_ssh.Status)

od_outdated = ColourSwatch(SwatchColor=RGBA(97, 97, 97, 150))
u_updated = ColourSwatch(SwatchColor=RGBA(208, 115, 230, 112))
o_outputs = ColourSwatch(SwatchColor=RGBA(160, 218, 242, 203))
toggle = BooleanToggle(True)
s_settings = ColourSwatch(SwatchColor=RGBA(224, 145, 81, 154))
g_general = ColourSwatch(SwatchColor=RGBA(245, 243, 237, 156))
cc_core2 = ColourSwatch(SwatchColor=RGBA(230, 216, 186, 208))
y_yellow = ColourSwatch(SwatchColor=RGBA(247, 244, 64, 188))
i_inputs = ColourSwatch(SwatchColor=RGBA(125, 217, 98, 150))
c_core = ColourSwatch(SwatchColor=RGBA(235, 227, 206, 203))
r_red = ColourSwatch(SwatchColor=RGBA(242, 63, 63, 203))

# ----
# Test connection
testconnection = TestConnection()  # -> Status, Errors
panel_12 = Panel(testconnection.Status)
panel_13 = Panel(testconnection.Errors)

colorgroups = CSharpScript(
    Colors=[i_inputs, s_settings, g_general, c_core, o_outputs, r_red, y_yellow, u_updated, od_outdated, cc_core2],
    Enable=toggle,
    Rename=Toggle(False),
    RunOnce=Button(),
    Debug=Toggle(False))  # -> out; inputs Colors: list of Color, Enable: Boolean, Rename: Boolean, RunOnce: Boolean, Debug: Boolean
# ---------- colorgroups: C# usings ----------
using System.Linq;
using System.Text;
using System.Reflection;
# ---------- colorgroups: C# ----------
    msg.Clear();


    this.Component.Message = "id: " + id.ToString();

    _debug = Debug; //Set to true to have all events printed in rhino log
    _rename = Rename;

    if (Enable)
    {
      msg.AppendFormat("Set up events on ID {0}\n", id);
      SetupDict(); // Create a dictionary of the input swatches
      SetEventHandlers(); // This would do the job.


    }
    else
    {
      RemoveEventHandlers();
    }
    if (RunOnce)
    {
      foreach(Grasshopper.Kernel.Special.GH_Group grp in Grasshopper.Instances.ActiveCanvas.Document.Objects.OfType<Grasshopper.Kernel.Special.GH_Group>())
      {
        ColorGroup(grp, null); // You decide if it should run once on all existing groups

      }
    }

    Print(msg.ToString());


    // Component setup
    Component.Description = "Set up event handlers to color groups based on prefixes such as 'in_' and 'out_'.\n"
      + "Please insert only swatcheds directly into the Colors input\n\n"
      + "MIT License. Copyright Mathias Sønderskov Schaltz 2022";
    Component.Params.Input[0].Description = "Please insert only swatcheds directly into the Colors input.\nRemember to rename them";
    Component.Params.Input[1].Description = "Toggle to run...";
    Component.Params.Input[2].Description = "Set to true if you want to automatically rename the groups and remove prefix. Default is false.";
    Component.Params.Input[3].Description = "Set to true to run it once and color all existing groups.";
    Component.Params.Input[Component.Params.Input.Count - 1].Description = "Set debug to true to get all the events printed in the rhino log";
# ---------- colorgroups: C# additional code ----------
  public static Random rnd = new Random();
  public int id = rnd.Next(0, 1000);
  StringBuilder msg = new StringBuilder();
  Dictionary<string, System.Drawing.Color> colorDict = new Dictionary<string, System.Drawing.Color>();

  bool _debug = false;
  bool _rename = false;

  public bool IdExists(int id)
  {
    IList<IGH_DocumentObject> objs = Grasshopper.Instances.ActiveCanvas.Document.Objects;
    return objs
      .OfType<IGH_Component>()
      .Where(ob => ob.NickName == this.Component.NickName)
      .Where(ob => ob.GetType().ToString() == "ScriptComponents.Component_CSNET_Script")
      .Where(ob => ob.Message == "id: " + id.ToString()).Any();

  }


  public void SetupDict()
  {
    colorDict.Clear();
    // Get all inputs to "Colors"
    IList<IGH_Param> colorSources = this.Component.Params.Input[0].Sources;
    if (colorSources.Count == 0)
    {
      throw new Exception("You forgot to setup the colors. Please input swatch components and rename them");
    }
    foreach(IGH_Param source in colorSources)
    {
      //if (source.Type.ToString() == "Grasshopper.Kernel.Types.GH_Colour")
      if (source is Grasshopper.Kernel.Special.GH_ColourSwatch)
      {
        string nickName = source.NickName.Split('_')[0].Trim() + "_";
        if(!colorDict.ContainsKey(nickName))
        {
          Grasshopper.Kernel.Special.GH_ColourSwatch swatch = (Grasshopper.Kernel.Special.GH_ColourSwatch) source;
          colorDict.Add(nickName, swatch.SwatchColour);
        }
        else
        {
          throw new Exception("Multiple swatches using the same name detected. Please rename");
        }
      }
      else
      {
        throw new Exception("Whacko! Why did you input a non-swatch into the Colors? " + source.Type.ToString());
      }

    }

    msg.AppendFormat("Set up the dictionaries with {0} colors\n", colorDict.Count);
    foreach(var pairs in colorDict)
    {
      msg.AppendFormat("{0} -> {1}\n", ("\"" + pairs.Key + "\"").PadRight(5 + colorDict.Keys.Select(k => k.Length).Max()), pairs.Value);
    }
  }

  public void SetEventHandlers()
  {

    // Always remove events first to avoid duplicates
    GrasshopperDocument.ObjectsAdded -= OnObjectsAdded;
    GrasshopperDocument.ObjectsDeleted -= OnObjectsRemoved;
    GrasshopperDocument.ObjectsDeleted -= OnDeleteThisComponent;

    // Attach events
    GrasshopperDocument.ObjectsAdded += OnObjectsAdded;
    GrasshopperDocument.ObjectsDeleted += OnObjectsRemoved;
    GrasshopperDocument.ObjectsDeleted += OnDeleteThisComponent;


    foreach(Grasshopper.Kernel.Special.GH_Group grp in GrasshopperDocument.Objects.OfType<Grasshopper.Kernel.Special.GH_Group>())
    {
      grp.ObjectChanged -= ColorGroup;
      grp.ObjectChanged += ColorGroup;

      //ColorGroup(grp, null); // Make sure to run it once
    }
    msg.AppendFormat("Added the eventhandlers on {0} existing groups and on future created groups\n", GrasshopperDocument.Objects.OfType<Grasshopper.Kernel.Special.GH_Group>().Count());
  }

  public void OnObjectsAdded(object sender, GH_DocObjectEventArgs e)
  {
    bool any = false;
    foreach (Grasshopper.Kernel.Special.GH_Group grp in e.Objects.OfType<Grasshopper.Kernel.Special.GH_Group>())
    {
      grp.ObjectChanged -= ColorGroup;
      grp.ObjectChanged += ColorGroup;
      any = true;
    }

    DebugWrite(any ? "Group Objects Added: Attaching Events to ObjectChanged" : "Objects Added - but no groups");
  }

  //Same but reversed
  public void OnObjectsRemoved(object sender, GH_DocObjectEventArgs e)
  {
    bool any = false;
    foreach (Grasshopper.Kernel.Special.GH_Group grp in e.Objects.OfType<Grasshopper.Kernel.Special.GH_Group>())
    {
      grp.ObjectChanged -= ColorGroup;
      any = true;
    }

    DebugWrite(any ? "Group Objects Removed, removing event" : "Objects Removed - although not a group");

  }



  public void RemoveEventHandlers()
  {
    GrasshopperDocument.ObjectsAdded -= OnObjectsAdded;
    GrasshopperDocument.ObjectsDeleted -= OnObjectsRemoved;


    foreach(Grasshopper.Kernel.Special.GH_Group grp in GrasshopperDocument.Objects.OfType<Grasshopper.Kernel.Special.GH_Group>())
    {
      grp.ObjectChanged -= ColorGroup;

    }
    msg.AppendFormat("Removed event handlers on document and on {0} groups\n", GrasshopperDocument.Objects.OfType<Grasshopper.Kernel.Special.GH_Group>().Count());

  }

  public void ColorGroup(object sender, EventArgs e)
  {
    if (!IdExists(id))
    {
      DebugWrite("Component not relevant. Disabling old id + " + id.ToString());
      RemoveEventHandlers();
      return;
    }

    Grasshopper.Kernel.Special.GH_Group grp = sender as Grasshopper.Kernel.Special.GH_Group;
    if (grp == null) return; //not type GH_Group
    //if (!grp.NickName.EndsWith("_")) return;

    string[] nameParts = grp.NickName.Split('_');
    if (nameParts.Length <= 1)
      return;
    string prefix = grp.NickName.Split('_')[0].Trim() + '_';

    string prefixes = String.Join(", ", colorDict.Keys.Select(k => "\"" + k + "\""));

    msg.Append("prefix " + prefix + "\n");
    if (colorDict.ContainsKey(prefix))
    {
      //if (grp.NickName.EndsWith("_"))
      grp.Colour = colorDict[prefix];
      if (_rename)
      {
        grp.NickName = grp.NickName.Replace(prefix, "");
      }

      DebugWrite("Colored " + grp.NickName);

    }
    else
    {
      DebugWrite("Group changed but not relevant: prefix " + prefix + " is not among " + prefixes);
    }

  }
  public void DebugWrite(string msg)
  {
    if (_debug)
    {
      Rhino.RhinoApp.WriteLine(String.Format("[ColGrps {0}]: {1}", id, msg));
    }
  }

  public void OnDeleteThisComponent(object sender, GH_DocObjectEventArgs e)
  {

    if (e.Objects.OfType<Grasshopper.Kernel.GH_Component>().Where(o => o.NickName == this.Component.NickName).Any())
    {
      DebugWrite("Removed template component. Removing all the eventhandlers");
      RemoveEventHandlers();
    }

  }
# ---------- end colorgroups ----------

fixparams = CSharpScript(FixOnce=Button(), Enable=toggle, Debug=Toggle(False))  # -> out; inputs FixOnce: Boolean, Enable: Boolean, Debug: Boolean
# ---------- fixparams: C# usings ----------
using System.Text;
using System.Linq;
using Grasshopper.Kernel.Special;
# ---------- fixparams: C# ----------
    _debug = Debug;
    _enable = Enable;
    msg.Clear();
    this.Component.Message = "id: " + id.ToString();




    if (Enable)
    {
      SetEventHandlers();
    }
    else
    {
      RemoveEventHandlers();
    }


    if (FixOnce)
    {
      FixAll();
    }

    Print(msg.ToString());

    // Component setup
    Component.Description = "Set up event handlers to change params to show nickname and not icon"
      + "\n\n"
      + "MIT License. Copyright Mathias Sønderskov Schaltz 2022";
    Component.Params.Input[0].Description = "Run me once on the document";
    Component.Params.Input[1].Description = "Toggle to enable event listener";
    Component.Params.Input[Component.Params.Input.Count - 1].Description = "Set debug to true to get all the events printed in the rhino log";
# ---------- fixparams: C# additional code ----------
  public static Random rnd = new Random();
  public int id = rnd.Next(0, 1000);
  StringBuilder msg = new StringBuilder();
  bool _debug = false;
  bool _enable = false;

  public Dictionary<IGH_ActiveObject, HashSet<GH_Group>> groupsPerObject = new Dictionary<IGH_ActiveObject, HashSet<GH_Group>>();


  public void OnObjectsAdded(object sender, GH_DocObjectEventArgs e)
  {
    if (!IdExists(id))
    {
      DebugWrite("[FixParam] Component not relevant. Disabling old id " + id.ToString());
      RemoveEventHandlers();
      return;
    }


    if(_enable)
    {
      foreach(IGH_Param par in e.Objects.OfType<IGH_Param>())
      {
        FixInputs(par);
      }
    }


  }

  public void FixAll()
  {
    //DebugWrite("Fixing all?");
    foreach(IGH_Param par in GrasshopperDocument.Objects.OfType<IGH_Param>())
    {

      FixInputs(par);
    }
  }




  public void FixInputs(IGH_ActiveObject obj)
  {



    IGH_Param par = obj as IGH_Param;
    if (par != null)
    {

      par.IconDisplayMode = GH_IconDisplayMode.name;


    }

  }


  public void SetEventHandlers()
  {

    GrasshopperDocument.ObjectsAdded -= OnObjectsAdded;
    GrasshopperDocument.ObjectsAdded += OnObjectsAdded;
    GrasshopperDocument.ObjectsDeleted -= OnDeleteThisComponent;
    GrasshopperDocument.ObjectsDeleted += OnDeleteThisComponent;
    msg.AppendFormat("Added the eventhandlers to OnObjectsAdded\n", GrasshopperDocument.Objects.OfType<Grasshopper.Kernel.Special.GH_Group>().Count());
  }

  public void RemoveEventHandlers()
  {
    GrasshopperDocument.ObjectsAdded -= OnObjectsAdded;
    GrasshopperDocument.ObjectsDeleted -= OnDeleteThisComponent;

    msg.AppendFormat("Removed wire event handlers on document\n", GrasshopperDocument.Objects.OfType<Grasshopper.Kernel.Special.GH_Group>().Count());

  }

  public void OnDeleteThisComponent(object sender, GH_DocObjectEventArgs e)
  {

    if (e.Objects.OfType<Grasshopper.Kernel.GH_Component>().Where(o => o.NickName == this.Component.NickName).Any())
    {
      DebugWrite("Removed template component. Removing all the eventhandlers");
      RemoveEventHandlers();
    }

  }

  public bool IdExists(int id)
  {
    IList<IGH_DocumentObject> objs = Grasshopper.Instances.ActiveCanvas.Document.Objects;
    return objs
      .OfType<IGH_Component>()
      .Where(ob => ob.NickName == this.Component.NickName)
      .Where(ob => ob.GetType().ToString() == "ScriptComponents.Component_CSNET_Script")
      .Where(ob => ob.Message == "id: " + id.ToString()).Any();

  }

  public void DebugWrite(string msg)
  {
    if (_debug)
    {
      Rhino.RhinoApp.WriteLine(String.Format("[FixParams {0}]: {1}", id, msg));
    }
  }
# ---------- end fixparams ----------

fixwires = CSharpScript(FixOnce=Button(), Enable=toggle, Debug=Toggle(False))  # -> out; inputs FixOnce: Boolean, Enable: Boolean, Debug: Boolean
# ---------- fixwires: C# ----------
    _debug = Debug;
    _enable = Enable;
    msg.Clear();
    this.Component.Message = "id: " + id.ToString();


    SetDictionary();

    if (Enable)
    {
      SetEventHandlers();
    }
    else
    {
      RemoveEventHandlers();
    }


    if (FixOnce)
    {
      FixAll();
    }

    Print(msg.ToString());
    
    // Component setup
    Component.Description = "Set up event handlers to change all wire types across groups to faint"
      + "\n\n"
      + "MIT License. Copyright Mathias Sønderskov Schaltz 2022";
    Component.Params.Input[0].Description = "Run me once on the document";
    Component.Params.Input[1].Description = "Toggle to enable event listener";
    Component.Params.Input[Component.Params.Input.Count - 1].Description = "Set debug to true to get all the events printed in the rhino log";
# ---------- fixwires: C# additional code ----------
  public static Random rnd = new Random();
  public int id = rnd.Next(0, 1000);
  StringBuilder msg = new StringBuilder();
  bool _debug = false;
  bool _enable = false;

  public Dictionary<IGH_ActiveObject, HashSet<GH_Group>> groupsPerObject = new Dictionary<IGH_ActiveObject, HashSet<GH_Group>>();


  public void OnSolutionExpired(object sender, GH_DocUndoEventArgs e)
  {
    if(_enable)
      FixAll();
  }

  public void FixAll()
  {
    //DebugWrite("Fixing all?");
    foreach(IGH_ActiveObject key in groupsPerObject.Keys.Where(k => groupsPerObject[k].Count() > 0))
    {

      FixInputs(key);
    }
  }



  public bool HasGroup(IGH_ActiveObject obj)
  {
    return groupsPerObject[obj].Count > 0;
  }


  public void FixInputs(IGH_ActiveObject obj)
  {

    if (!IdExists(id))
    {
      DebugWrite("Component not relevant. Disabling old id " + id.ToString());
      RemoveEventHandlers();
      return;
    }

    //List<List<IGH_ActiveObject>> parents = new List<List<IGH_ActiveObject>>();
    IGH_Param par = obj as IGH_Param;
    if (par != null && par.Sources != null)
    {


      IEnumerable<IGH_ActiveObject> p = par.Sources.Select(s => s.Attributes.GetTopLevel.DocObject as IGH_ActiveObject);
      //parents.Add(p);
      if(HasGroup(obj) && p.All(o => !HasGroupsInCommon(o, obj)) && par.WireDisplay != GH_ParamWireDisplay.faint)
      {
        DebugWrite("Fixing " + par.Attributes.GetTopLevel.DocObject.NickName);
        par.WireDisplay = GH_ParamWireDisplay.faint;
      }

    }

    IGH_Component comp = obj as IGH_Component;
    if (comp != null)
    {
      foreach(IGH_Param inp in comp.Params.Input)
      {

        IEnumerable<IGH_ActiveObject> p = inp.Sources.Select(i => i.Attributes.GetTopLevel.DocObject as IGH_ActiveObject);

        if(HasGroup(obj) && p.All(o => !HasGroupsInCommon(o, obj)) && inp.WireDisplay != GH_ParamWireDisplay.faint)
        {
          DebugWrite("Fixing " + inp.Attributes.GetTopLevel.DocObject.NickName);
          inp.WireDisplay = GH_ParamWireDisplay.faint;
        }
      }

    }



  }





  public void SetDictionary()
  {
    IList<IGH_DocumentObject> objects = Grasshopper.Instances.ActiveCanvas.Document.Objects.ToList();
    //Print(String.Join(", ", objects.Select(o => o.NickName)));

    groupsPerObject = objects
      .Where(o => o.GetType() != typeof(GH_Group))
      .OfType<IGH_ActiveObject>()
      .ToDictionary(o => o, o => new HashSet<GH_Group>());

    foreach(GH_Group grp in objects.OfType<GH_Group>())
    {

      foreach(IGH_ActiveObject obj in grp.ObjectsRecursive().OfType<IGH_ActiveObject>())
      {
        groupsPerObject[obj].Add(grp);

      }
    }



  }

  public bool HasGroupsInCommon(IGH_ActiveObject obj1, IGH_ActiveObject obj2)
  {
    HashSet<GH_Group> set1 = groupsPerObject[obj1];
    HashSet<GH_Group> set2 = groupsPerObject[obj2];

    set1.IntersectWith(set2);

    return set1.Any();
  }

  public void SetEventHandlers()
  {

    GrasshopperDocument.UndoStateChanged -= OnSolutionExpired;
    GrasshopperDocument.UndoStateChanged += OnSolutionExpired;
    GrasshopperDocument.ObjectsDeleted -= OnDeleteThisComponent;
    GrasshopperDocument.ObjectsDeleted += OnDeleteThisComponent;
    msg.AppendFormat("Added the eventhandlers to UndoStateChanged\n", GrasshopperDocument.Objects.OfType<Grasshopper.Kernel.Special.GH_Group>().Count());
  }

  public void RemoveEventHandlers()
  {
    GrasshopperDocument.UndoStateChanged -= OnSolutionExpired;
    GrasshopperDocument.ObjectsDeleted -= OnDeleteThisComponent;

    msg.AppendFormat("Removed wire event handlers on document\n", GrasshopperDocument.Objects.OfType<Grasshopper.Kernel.Special.GH_Group>().Count());

  }

  public void OnDeleteThisComponent(object sender, GH_DocObjectEventArgs e)
  {

    if (e.Objects.OfType<Grasshopper.Kernel.GH_Component>().Where(o => o.NickName == this.Component.NickName).Any())
    {
      DebugWrite("Removed template component. Removing all the eventhandlers");
      RemoveEventHandlers();
    }

  }

  public bool IdExists(int id)
  {
    IList<IGH_DocumentObject> objs = Grasshopper.Instances.ActiveCanvas.Document.Objects;
    return objs
      .OfType<IGH_Component>()
      .Where(ob => ob.NickName == this.Component.NickName)
      .Where(ob => ob.GetType().ToString() == "ScriptComponents.Component_CSNET_Script")
      .Where(ob => ob.Message == "id: " + id.ToString()).Any();

  }

  public void DebugWrite(string msg)
  {
    if (_debug)
    {
      Rhino.RhinoApp.WriteLine(String.Format("[FixWire {0}]: {1}", id, msg));
    }
  }
# ---------- end fixwires ----------

nickname = GH_TestComponentColor(Color=ColourSwatch(SwatchColor=RGB(97, 97, 97)), SelColor=ColourSwatch(SwatchColor=RGB(59, 59, 59)))

# ----
# processes to kill
panel_14 = Panel("""dctimestep
rcontrib
rtrace
oconv
rvu""")
kill = LBFalseStartToggle(False)

# ----
# Kill processes running on linux
panel_15 = Panel("pkill -f <instance>")
overrides = ApplyOverrides(Input_=panel_15, Instance=graft(panel_14))  # -> flatten(Output), Pairs
join = TextJoin(Text=overrides.Output, Join=";")
execute_ssh_async = ExecuteSSHAsync(SSHCommands=join, Run=kill, addPrefix=False, addSuffix=False, fireLogs=False, suppressWarnings=False)  # -> Stdout, Stderr_, Log, Pid, Ran
panel_16 = Panel(execute_ssh_async.Stderr_)

# ----
# Template methods
# By Mathias Sønderskov Schaltz 2022
# Check for updates here https://github.com/Sonderwoods/GrasshopperScribbles
panel_17 = Panel(fixwires)
panel_18 = Panel(fixparams)
panel_19 = Panel(colorgroups)

panel_20 = Panel("""export PATH=$PATH.:/usr/local/radiance/bin
export RAYPATH=.:/usr/local/radiance/lib
objview <glowmat> ~/simulation/<name>.rad | meta2tga -x 1048 -y 1048 | ra_t8 -r > ~/simulation/<name>.hdr
normtiff ~/simulation/<name>.hdr ~/simulation/<name>.tif
convert ~/simulation/<name>.tif ~/simulation/<name>.png
echo "C:\Users\mm1013\simulation\<name>.png"
""")

panel_21 = Panel("""Mesh
Polysurface
Surface
Extrusion""")

panel_22 = Panel("""echo $PATH
genbox""")  # disabled
falsestart = LBFalseStartToggle(False)  # disabled
execute_ssh_async_2 = ExecuteSSHAsync(SSHCommands=panel_22, Run=falsestart, addPrefix=True, addSuffix=True, fireLogs=False, suppressWarnings=False)  # -> Stdout, Stderr, Log, Pid, Ran; disabled
panel_23 = Panel(execute_ssh_async_2.Stderr)  # disabled
panel_24 = Panel(execute_ssh_async_2.Stdout)  # disabled

# ----
# importing from rhino layers
dpipeline = DynamicGeometryPipeline(
    LayerFilter="Daylight_Inputs::*",
    TypeFilter=panel_21,
    NameFilter="*",
    GroupByLayer=False,
    GroupByType=False,
    IncludeHidden=True,
    IncludeLocked=True,
    enableFullPath=True,
    listenToAttributes=True)
dam = DataDam(DataA=dpipeline, BufferDelay=10000000, BufferMode=0)
objatts = ObjectAttributes(ObjectOrAttributes=dam)  # -> Name, LayerName, LayerFullPath, Color, MaterialName, LinetypeName, GroupIndices, PlotWeight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
cset = CreateSet(List=objatts.LayerName)  # -> Set, Map
assign_paths = AssignPaths(InputData=flatten(dam), PathsToAssign=flatten(cset.Map))
python = GhPythonScript(layer_name=graft(cset.Set))  # -> is_opaque, is_transparent, is_grid, is_HB_Room, is_HB_Window
# ---------- python: Python ----------
__author__ = "mm1013"
__version__ = "2022.01.16"

import rhinoscriptsyntax as rs

is_grid = layer_name == "Grids"

if layer_name.startswith("HB_"):
    is_opaque = is_transparent = is_grid = False
    
    is_HB_Window = layer_name.endswith("%")
    is_HB_Room = layer_name == "HB_Rooms"
    
    
else:
    if is_grid:
        is_opaque = False
        is_transparent = False
    else:
        is_transparent = layer_name.endswith("%")
        if is_transparent:
            transmittance = layer_name.split("_")[-1].replace("%","")
        is_opaque = not is_transparent
# ---------- end python ----------
layer_name = Text(cset.Set)
geo = Geometry(assign_paths)

mesh = Mesh([<mesh referenced from the Rhino model> x2])

# ----
# Log of latest(10) SSH Commands
nickname_2 = GH_LogViewer(Number=10)
panel_25 = Panel(nickname_2)

facen = FaceNormals(Mesh=mesh)  # -> Centers, Normals
demesh = DeconstructMesh(Mesh=mesh)  # -> Vertices, Faces, Colours, Normals
nickname_3 = GH_LogViewer(Number=10, Filter="Octree")
panel_26 = Panel("""up_clock3
up_ccw3""")
panel_27 = Panel("""glowmat
glowmat""")
points = PointList(Points=demesh.Vertices, Size="50")
vdis = VectorDisplay(Anchor=facen.Centers, Vector=expr("x*500", facen.Normals))
panel_28 = Panel("""echo "void glow glowmat
0
0
4 12 12 12 1000" > <target>;echo <target>""")
falsestart_2 = LBFalseStartToggle(False)
panel_29 = Panel(nickname_3)
mesh2obj = MeshToObj(Mesh=graft(mesh), Name=graft(panel_26), ModifierName=graft(panel_27), Run=falsestart_2)  # -> ObjFiles, MapFile, Run
overrides_2 = ApplyOverrides(Input=panel_28, AdditionalKeys="target", AdditionalValues="~/simulation/testglow.rad")  # -> Output, Pairs
execute_ssh_async_3 = ExecuteSSHAsync(
    _SSHCommands_=overrides_2.Output,
    Run=falsestart_2,
    addPrefix=True,
    addSuffix=True,
    fireLogs=False,
    suppressWarnings=False)  # -> Stdout, Stderr_, Log, Pid, Ran
overrides_3 = ApplyOverrides(Input=panel_20, AdditionalKeys="glowmat", AdditionalValues=execute_ssh_async_3.Stdout)  # -> Output, Pairs
overrides_4 = ApplyOverrides(Input=overrides_3.Output, AdditionalKeys="name", AdditionalValues=graft(panel_26))  # -> Output, Pairs
panel_30 = Panel("echo hi")
panel_31 = Panel(overrides_4.Output)

# ----
# 5 phase bash script from andy mcneil
panel_32 = Panel("""#!/bin/bash

procs=4

### First let me download and unpacking Axel\'s files for rtcontrib lesson

printf "\nDownloading Axels rtcontrib lesson files...\n"
curl -O http://www.jaloxa.eu/resources/radiance/documentation/docs/rtcontrib_lesson.tgz
tar -xf rtcontrib_lesson.tgz
mv rtcontrib_lesson 5p_tutorial_examples

cd 5p_tutorial_examples

mkdir bsdf hourlypics hourlypics_dir hourlypics_ds hourlyresult \
	matrices octs viewpics viewpics_dir viewpics_ds
	
### Let me download the weather data file for you
printf "\nDownloading weather data...\n"
curl -O http://apps1.eere.energy.gov/buildings/energyplus/weatherdata/4_north_and_central_america_wmo_region_4/1_usa/USA_CA_Oakland.Intl.AP.724930_TMY3.zip
tar -xf USA_CA_Oakland.Intl.AP.724930_TMY3.zip
rm USA_CA_Oakland.Intl.AP.724930_TMY3.ddy 
rm USA_CA_Oakland.Intl.AP.724930_TMY3.stat
rm USA_CA_Oakland.Intl.AP.724930_TMY3.zip 
mv USA_CA_Oakland.Intl.AP.724930_TMY3.epw skies/.

# grabbing reinsrc.cal from CVS
printf "\nDownloading reinsrc.cal...\n"
curl -O http://radiance-online.org/cgi-bin/viewcvs.cgi/ray/src/cal/cal/reinsrc.cal

### Section 6.1 - Model adjustments for five-phase simulation
printf "\nMaking model adjustments...\n"
cat <<EOF > objects/testroom_Swall.rad
!genbox wall_mat wall_s_bottom 4 .3 1 |xform -t 0 -.3 0
!genbox wall_mat wall_s_top 4 .3 .5 |xform -t 0 -.3 2
!genbox wall_mat wall_s_west .5 .3 1 |xform -t 0 -.3 1
!genbox wall_mat wall_s_west .5 .3 1 |xform -t 3.5 -.3 1
EOF

cat <<EOF > objects/testroom.rad
!genbox floor_mat floor 4.6 6.6 .3 |xform -t -.3 -.3 -.3
!genbox ceiling_mat ceiling 4.6 6.6 .3 |xform -t -.3 -.3 2.5

!genbox wall_mat wall_w .3 6.6 2.5 |xform -t -.3 -.3 0
!genbox wall_mat wall_e .3 6.6 2.5 |xform -t 4 -.3 0
!genbox wall_mat wall_n 4 .3 2.5 |xform -t 0 6 0
EOF

cat <<EOF > objects/glazing.rad
void glass glazing
0
0
3 0.73 0.73 0.73

glazing polygon glass
0
0
12    0.5  -0.25   1
        0.5  -0.25   2
        3.5  -0.25   2
        3.5  -0.25   1
EOF

cat <<EOF > objects/venetianblind.rad
void plastic blindslat
0
0
5 .65 .65 .65 .01 0 

!genblinds blindslat blinds .05 3 1 25 0 +r .15 | xform -rz -90 -t 0.5 -.15 1 
EOF

cat <<EOF > objects/viewmtxsurf.rad
void glow viewsurf
0
0
4 1 1 1 0

viewsurf polygon inside
0
0
12    0.5   0   1
        0.5   0   2
        3.5   0   2
        3.5   0   1
EOF

cat <<EOF > objects/daymtxsurf.rad
void plastic daymtxsurf
0
0
5 0 0 0 0 0

daymtxsurf polygon outside
0
0
12    0.5   -0.3   1
        0.5   -0.3   2
        3.5   -0.3   2
        3.5   -0.3  1
EOF

cat <<EOF > objects/glazing_bsdf.rad
void BSDF BSDFproxy
6 0.30 bsdf/fullwindow_t45.xml 0 0 1 .
0
0

BSDFproxy polygon inside
0
0
12    0.5   0   1
        0.5   0   2
        3.5   0   2
        3.5   0   1
EOF

cat <<EOF >> materials/testroom.mat
void plastic black
0
0
5 0 0 0 0 0
EOF


### Section 6.2 - Creating BSDFs
xform -rz 180 -rx -90 -t 4 0 0 objects/glazing.rad objects/venetianblind.rad materials/testroom.mat \
	objects/testroom_Swall.rad > bsdf/fullwindow.rad

### I am going to save you the trouble of generating the High-Res BSDF
#genBSDF -n $procs +f +b -geom meter -dim 0.5 3.5 1 2 -.3 0 -t4 5 \
#	bsdf/fullwindow.rad > bsdf/fullwindow_t45.xml
printf "\nDownloading tensor tree BSDF...\n"
curl -o bsdf/fullwindow_t45.xml http://www.radiance-online.org/learning/tutorials/fivephasetutorialfiles/fullwindow_t45.xml

### I will also save you the trouble with the low-res BSDF
#bsdf2klems bsdf/fullwindow_t45.xml > bsdf/fullwindow_klems.xml
#genBSDF -n $procs +f +b -geom meter -dim 0.5 3.5 1 2 -.3 0 \
#	bsdf/fullwindow.rad > bsdf/fullwindow_klems.xml
printf "\nDownloading klems BSDF...\n"
curl -o bsdf/fullwindow.xml http://www.radiance-online.org/learning/tutorials/fivephasetutorialfiles/fullwindow.xml


### Section 6.3 - View matrix (V)
printf "\nDoing 5-phase simulation for sensor points...\n"
oconv materials/testroom.mat objects/daymtxsurf.rad objects/ground.rad objects/testroom.rad \
	objects/testroom_Swall.rad objects/viewmtxsurf.rad skies/sky_white.rad \
	objects/viewmtxsurf.rad objects/daymtxsurf.rad > octs/model_3ph.oct
printf "\nView Matrix\n"
time rcontrib < data/photocells.pts -n $procs -f klems_int.cal -b kbinS -bn Nkbins -m viewsurf \
	-I+ -ab 10 -ad 65536 -lw 1.52e-5 octs/model_3ph.oct > matrices/viewmatrix.vmx


### Section 6.4 - Direct view matrix (Vd)
printf "\nDirect View Matrix\n"
time rcontrib < data/photocells.pts -n $procs -f klems_int.cal -b kbinS -bn Nkbins -m viewsurf \
	-I+ -ab 1 -ad 65536 -lw 1.52e-5 octs/model_3ph.oct > matrices/viewmatrix_direct.vmx

### Section 6.5 - Daylight matrix (D)
printf "\nDaylight Matrix\n"
time genklemsamp -c 1000 -vd 0 -1 0 objects/daymtxsurf.rad | \
	rcontrib -n $procs -c 1000 -ab 2 -ad 1024 -e MF:1 -f reinhart.cal -b rbin -bn Nrbins \
		-m sky_glow octs/model_3ph.oct > matrices/daylightmatrix.dmx

### Section 6.6 - Direct daylight matrix (Dd)
printf "\nDirect Daylight Matrix\n"
xform -m black objects/testroom_Swall.rad objects/testroom.rad objects/ground.rad \
	objects/venetianblind.rad | oconv materials/testroom.mat - objects/viewmtxsurf.rad \
	objects/daymtxsurf.rad skies/sky_white.rad > octs/model_allblack.oct

time genklemsamp -c 1000 -vd 0 -1 0 objects/daymtxsurf.rad | \
	rcontrib -n $procs -c 1000 -ab 0 -e MF:1 -f reinhart.cal -b rbin -bn Nrbins \
		-m sky_glow octs/model_allblack.oct > matrices/daylightmatrix_direct.dmx

### Section 6.7 - Direct sun coefficient matrix (Cds)
printf "\nDirect Sun Coefficient Matrix\n"
echo void light solar 0 0 3 1e6 1e6 1e6 > skies/suns.rad
cnt 5185  |  rcalc -e MF:6 -f reinsrc.cal -e Rbin=recno \
	-o 'solar source sun 0 0 4 ${ Dx } ${ Dy } ${ Dz } 0.533' >> skies/suns.rad

xform -m black objects/testroom_Swall.rad objects/testroom.rad objects/ground.rad \
	| oconv materials/testroom.mat - objects/glazing.rad objects/venetianblind.rad \
		objects/glazing_bsdf.rad skies/suns.rad > octs/model_suns.oct

time rcontrib < data/photocells.pts -n $procs -I -ab 1 -ad 65536 -lw 1.52e-5 -dc 1 -dt 0 -dj 0 -st 1 -ss 0 -faf  \
	-e MF:6 -f reinhart.cal -b rbin -bn Nrbins -m solar \
	octs/model_suns.oct > matrices/directsun.dsmx

### Section 6.8 - Putting it all together
printf "\nCombining it all\n"
epw2wea skies/USA_CA_Oakland.Intl.AP.724930_TMY3.epw skies/OakLand.wea
gendaymtx -of skies/OakLand.wea > matrices/OakLand.smx
gendaymtx -of -d skies/OakLand.wea > matrices/OakLand_direct.smx
gendaymtx -5 -d -m 6 -of skies/OakLand.wea > matrices/OakLand_direct_m6.smx

time dctimestep -n 8760 -if matrices/viewmatrix.vmx bsdf/fullwindow.xml  \
	matrices/daylightmatrix.dmx matrices/OakLand.smx | \
	rcollate -h -oc 1 > i_3ph.txt

time dctimestep -n 8760 -if  matrices/viewmatrix_direct.vmx bsdf/fullwindow.xml  \
	matrices/daylightmatrix_direct.dmx matrices/OakLand_direct.smx | \
	rcollate -h -oc 1 > i_ds3ph.txt

time dctimestep -n 8760 -if matrices/directsun.dsmx matrices/OakLand_direct_m6.smx | \
	rcollate -h -oc 1 > i_ds5ph.txt

rlam i_3ph.txt i_ds3ph.txt i_ds5ph.txt | \
	rcalc -e 'r=$1-$4+$7;g=$2-$5+$8;b=$3-$6+$9' \
	-e '$1=179*(.265*r+.670*g+.065*b)' | \
	rcollate -h -fa1 -ic 8760 -t > illum.txt

printf "\nAll done with example 1!  look at illum.txt for the result.\n"


printf "\n\n\nDoing 5-phase simulation for rendering...\n"
### 7.1	View matrix (V)
printf "\nView Matrix...\n"
time vwrays -vf views/back.vf  -ff -x 500 -y 500 \
	| rcontrib `vwrays -vf views/back.vf  -x 500 -y 500 -d` -n $procs -ffc -fo -o viewpics/back_%03d.hdr \
		-f klems_int.cal -b kbinS -bn Nkbins -m viewsurf \
		-ab 10 -ad 65536 -lw 1.52e-5 octs/model_3ph.oct

### 7.2	Direct view matrix (Vd)	
printf "\nDirect View Matrix...\n"	
time vwrays -vf views/back.vf  -ff -x 500 -y 500 \
	| rcontrib `vwrays -vf views/back.vf  -x 500 -y 500 -d` -n $procs -ffc -fo -o viewpics_dir/back_%03d.hdr \
		-f klems_int.cal -b kbinS -bn Nkbins -m viewsurf \
		-ab 1 -ad 65536 -lw 1.52e-5 octs/model_3ph.oct

### 7.5	Direct sun coefficient matrix (Cds)
printf "\nDirect Coefficient Matrix...\n"
ulimit -n 9999
xform -m black objects/testroom_Swall.rad objects/testroom.rad objects/ground.rad | \
	oconv materials/testroom.mat - objects/venetianblind.rad > octs/model_nosuns.oct
time vwrays -c 4 -pj 1 -fa -vf views/back.vf -x 500 -y 500 | \
	rtrace -h- -opn -faa -ab 0 octs/model_nosuns.oct | \
	rcontrib `vwrays -vf views/back.vf -x 500 -y 500 -d` -n $procs -fac -fo -o viewpics_ds/back_%04d.hdr \
	-e MF:6 -f reinhart.cal -b rbin -bn Nrbins -m solar -c 4 -I -ab 1 -ad 100 -dt 0 -dc 1 -lw 1e-2 octs/model_suns.oct

oconv materials/testroom.mat objects/testroom_Swall.rad objects/testroom.rad \
	objects/ground.rad objects/glazing.rad objects/venetianblind.rad \
	objects/daymtxsurf.rad > octs/model_material.oct
time rpict -x 1000 -y 1000 -vf views/back.vf -ps 1 -pj 1 -av 0.31831 0.31831 0.31831 -aa 0 \
	octs/model_material.oct | pfilt -x /2 -y /2 -1 -e 1 > materialmap.hdr  

### 7.6	Putting it all together
printf "\nPutting it together...\n"
time dctimestep -n 8760 -if -o hourlypics/back_%04d.hdr viewpics/back_%03d.hdr \
	bsdf/fullwindow.xml matrices/daylightmatrix.dmx matrices/OakLand.smx 

time dctimestep -n 8760 -if -o hourlypics_dir/back_%04d.hdr viewpics_dir/back_%03d.hdr \
	bsdf/fullwindow.xml matrices/daylightmatrix_direct.dmx matrices/OakLand_direct.smx 

time dctimestep -n 8760 -if -o hourlypics_ds/back_%04d.hdr viewpics_ds/back_%04d.hdr \
	matrices/OakLand_direct_m6.smx

time for t in {1..8760} 
do ts=`printf %04d $t `
pcomb -e 'lo=li(1)-li(2)+li(3)*li(4)' -o hourlypics/back_${ts}.hdr -o hourlypics_dir/back_${ts}.hdr \
	-o hourlypics_ds/back_${ts}.hdr -o materialmap.hdr > hourlyresult/back_${ts}.hdr 
done
printf "\nAll Done with 5-phase Rendering sim\n"
pcond hourlyresult/back_0015.hdr | ximage &""")  # disabled

cluster = Cluster(L=execute_ssh_async_3.Stdout)
cluster_2 = Cluster(L=overrides_4.Output)
panel_33 = Panel(cluster)
execute_ssh_async_4 = ExecuteSSHAsync(SSHCommands=overrides_4.Output, addPrefix=True, addSuffix=True, fireLogs=False, suppressWarnings=False)  # -> Stdout, Stderr, Log, Pid, Ran
panel_34 = Panel(cluster_2)
cluster_3 = Cluster(L=execute_ssh_async_4.Stdout)
item = ListItem(List=flatten(execute_ssh_async_4.Stdout), Index=0, Wrap=True)  # -> Item, Item1
panel_35 = Panel(cluster_3)

vertical_offset = Panel("0.75m")
grid_size = Panel("0.5m")
docunits = ConvertToDocumentUnits(ValueString=vertical_offset)
docunits_2 = ConvertToDocumentUnits(ValueString=grid_size)

imageviewer = LBImageViewer(ImagePath_=item.Item1, _scale_=1, DisableClickable=False, SaveImgWithCoords=False, scale=1)  # -> ImagePath, Values, GIF
panel_36 = Panel(execute_ssh_async_4.Stderr)

# ----
# Grid
# Setting up grid points
cull = CullPattern(List=graft(layer_name), CullPattern=graft(python.is_grid))  # -> simplify(List)
cull_2 = CullPattern(List=geo, CullPattern=python.is_grid)
grid_size_2 = Number(docunits_2)
clean = CleanTree(RemoveNulls=True, RemoveInvalid=True, RemoveEmpty=True, Tree=cull, SynchronousTree1=simplify(cull_2))  # -> Tree, SynchronousTree1
custom_mesh_settings = SettingsCustom(
    StitchSeams=True,
    SimplePlanes=False,
    Refine=True,
    MinCount=16,
    MaxCount=400,
    AspectRatio=20,
    MaxDistance=0,
    MaxAngle=20,
    MinEdge=grid_size_2,
    MaxEdge=grid_size_2)
offset = Number(docunits)
rectangle = Rectangle(Plane=PlaneXY(0, 0, 0), XSize=Domain(-1, 1), YSize=Domain(-2, 2), Radius=0)  # -> Rectangle, Length
geo_2 = Geometry(graft(clean.SynchronousTree1))
flip = Flip(Surface=geo_2, Guide=rectangle.Rectangle)  # -> Surface, Result
mesh_2 = MeshBrep(Brep=flip.Surface, Settings=custom_mesh_settings)
normals = Normals(geo=flip.Surface, amplitude=offset)  # -> center_2, norm_2, P
move = Move(Geometry=mesh_2, Motion=normals.norm_2)  # -> Geometry, Transform
facen_2 = FaceNormals(Mesh=move.Geometry)  # -> Centers, Normals

# ----
# opaque geometries
cull_3 = CullPattern(List=graft(layer_name), CullPattern=graft(python.is_opaque))  # -> simplify(List)
cull_4 = CullPattern(List=geo, CullPattern=graft(python.is_opaque))  # -> simplify(List)
panel_37 = Panel(cull_3)
python_2 = GhPythonScript(layer_name=panel_37)  # -> out, reflectance
# ---------- python_2: Python ----------
__author__ = "mm1013"
__version__ = "2022.01.16"

import rhinoscriptsyntax as rs
try:
    reflectance = layer_name.split("_")[-1]
    
except:
    reflectance = None
# ---------- end python_2 ----------
clean_2 = CleanTree(
    RemoveNulls=True,
    RemoveInvalid=True,
    RemoveEmpty=True,
    Tree=cull_3,
    SynchronousTree1=cull_4,
    SynchronousTree2=python_2.reflectance)  # -> Tree, SynchronousTree1, SynchronousTree2
geo_3 = Geometry(clean_2.SynchronousTree1)
refl = Number(clean_2.SynchronousTree2)
panel_38 = Panel(refl)
name = Text(clean_2.Tree)
concat = Concatenate(FragmentA=name, FragmentB="_mat")

imageviewer_2 = LBImageViewer(ImagePath_=item.Item, _scale_=1, DisableClickable=False, SaveImgWithCoords=False, scale=1)  # -> ImagePath, Values, GIF

# ----
# Glass geometries
cull_5 = CullPattern(List=graft(layer_name), CullPattern=graft(python.is_transparent))  # -> simplify(List)
cull_6 = CullPattern(List=geo, CullPattern=python.is_transparent)
python_3 = GhPythonScript(layer_name=cull_5)  # -> out, transmittance, name
# ---------- python_3: Python ----------
__author__ = "mm1013"
__version__ = "2022.01.16"

import rhinoscriptsyntax as rs

try:
    transmittance = layer_name.split("_")[-1].replace("%","")
    name = layer_name.replace("%","")
except:
    transmittance = None
    name = None
# ---------- end python_3 ----------
clean_3 = CleanTree(
    RemoveNulls=True,
    RemoveInvalid=True,
    RemoveEmpty=True,
    Tree=simplify(cull_6),
    SynchronousTree1=simplify(python_3.name),
    SynchronousTree2=simplify(python_3.transmittance))  # -> Tree, SynchronousTree1, SynchronousTree2
mesh_3 = MeshBrep(
    Brep=clean_3.Tree,
    Settings={GridMaxCount=0, GridMinCount=16, JaggedSeams=False, MaxEdgeLength=0, MinEdgeLength=0.0001, MinTolerance=0, Refine=True, RefineAngle=0, RelativeTolerance=0.65, SimplePlanes=True, Tolerance=0})
name_2 = Text(clean_3.SynchronousTree1)
geo_4 = Geometry(mesh_3)
panel_39 = Panel(name_2)
transmittance = Number(expr("x/100", clean_3.SynchronousTree2))
concat_2 = Concatenate(FragmentA=panel_39, FragmentB="_mat")
mesh_4 = Mesh(geo_4)

# ----
# export PATH=$PATH.:/usr/local/radiance/bin
# export RAYPATH=.:/usr/local/radiance/lib
# obj2rad -m /home/mss/simulation/mapping.map -f /home/mss/simulation/twoMeshes4.obj 2>&1 1>/home/mss/simulation/x.rad
# head /home/mss/simulation/x.rad
panel_40 = Panel("""export PATH=$PATH.:/usr/local/radiance/bin
export RAYPATH=.:/usr/local/radiance/lib
objline ~/simulation/twoMeshes5.rad | meta2tga -x 1048 -y 1048 | ra_t8 -r > ~/simulation/test.hdr
normtiff ~/simulation/test.hdr ~/simulation/test.tif
convert ~/simulation/test.tif ~/simulation/test.png
echo "C:\Users\mm1013\simulation\test.png"
""")  # disabled
folder_exists = Panel("[ -d <proj> ] && echo \"1\" || echo \"0\"")
prepare_everything_for_2ph_dds = LBFalseStartToggle(False)

start_raytracing_2ph_dds = LBFalseStartToggle(False)
prep_octrees = LBFalseStartToggle(False)
raytrace_2ph = Boolean(start_raytracing_2ph_dds)

# ----
# Create working folder
panel_41 = Panel("mkdir -p <proj>;echo <proj>")
applyglobals_4 = ApplyGlobals(Input=panel_41)  # -> Output, Pairs
execute_ssh_async_5 = ExecuteSSHAsync(
    _SSHCommands_=applyglobals_4.Output,
    Run=prep_octrees,
    addPrefix=True,
    addSuffix=True,
    description="mkdir -p ~/simulation/test_project2;echo ~/simulation/test_project2",
    fireLogs=False,
    name="Create folders",
    stdouts="/home/mss/simulation/test_project2",
    suppressWarnings=False)  # -> Stdout, Stderr_, Log, Pid, Ran

# ----
# grid points
pt = Point(facen_2.Centers)
vec = Vector(facen_2.Normals)
overrides_5 = ApplyOverrides(Input="<projfolder>")  # -> Output, Pairs
lng = ListLength(List=flatten(pt))
points2pts = PointsToPts(
    Points=flatten(pt),
    Vectors=flatten(vec),
    Name="points",
    SubfolderOverride=overrides_5.Output,
    Run=execute_ssh_async_5.Ran)  # -> PtsFile, Run
ptscount = Integer(lng)
points_2 = Text(points2pts.PtsFile)

execute_ssh_async_6 = ExecuteSSHAsync(
    _SSHCommands_=folder_exists,
    Run=Toggle(False),
    addPrefix=True,
    addSuffix=True,
    description="[ -d ~/simulation/test_project2 ] && echo \"1\" || echo \"0\"",
    fireLogs=False,
    name="Create folders",
    suppressWarnings=False)  # -> Stdout, Stderr_, Log, Pid, Ran
prep_2ph = Boolean(prepare_everything_for_2ph_dds)
falsestart_3 = LBFalseStartToggle(False)  # disabled
execute_ssh_async_7 = ExecuteSSHAsync(SSHCommands=panel_40, Run=falsestart_3, addPrefix=True, addSuffix=True, fireLogs=False, suppressWarnings=False)  # -> Stdout, Stderr, Log, Pid, Ran; disabled
file = Text("~/simulation/points.pts2")

overrides_6 = ApplyOverrides(Input="<projfolder>/radFiles")  # -> Output, Pairs
overrides_7 = ApplyOverrides(Input="<projfolder>")  # -> Output, Pairs

applyglobals_5 = ApplyGlobals(Input="[ -f <file> ] && echo \"1\" || echo \"0\"", AdditionalKeys="file", AdditionalValues=file)  # -> Output, Pairs
execute_ssh_async_8 = ExecuteSSHAsync(
    _SSHCommands_=applyglobals_5.Output,
    Run=Toggle(True),
    addPrefix=True,
    addSuffix=True,
    description="[ -f ~/simulation/points.pts2 ] && echo \"1\" || echo \"0\"",
    fireLogs=False,
    stdouts="0",
    suppressWarnings=False)  # -> Stdout, Stderr_, Log, Pid, Ran
imageviewer_3 = LBImageViewer(ImagePath_=execute_ssh_async_7.Stdout, _scale_=1, DisableClickable=False, SaveImgWithCoords=False, scale=1)  # -> ImagePath, Values, GIF; disabled

# ----
# Opaque geometry
names = Text(name)
mesh2obj_2 = MeshToObj(
    Mesh=geo_3,
    Name=graft(names),
    MapFileName="mapping_opaque",
    ModifierName=graft(concat),
    SubfolderOverride=overrides_7.Output,
    Run=execute_ssh_async_5.Ran)  # -> ObjFiles, MapFile, Run
obj2rad = ObjToRad(
    ObjFiles=mesh2obj_2.ObjFiles,
    MapFile=mesh2obj_2.MapFile,
    SubfolderOverride=overrides_6.Output,
    Run=mesh2obj_2.Run,
    stdouts="~/simulation/test_project2/radFiles/Ceiling_70.rad>JOIN<~/simulation/test_project2/radFiles/Floor_20.rad>JOIN<~/simulation/test_project2/radFiles/Context_25.rad>JOIN<~/simulation/test_project2/radFiles/Frames_70.rad>JOIN<~/simulation/test_project2/radFiles/Terrain_20.rad>JOIN<~/simulation/test_project2/radFiles/Wall_50.rad")  # -> Status, RadFiles, Run
opaque_rad = Text(obj2rad.RadFiles)

exists = Boolean(execute_ssh_async_8.Stdout)
panel_42 = Panel(exists)
panel_43 = Panel(execute_ssh_async_7.Stderr)  # disabled

# ----
# rad files
# Window geometry
panel_44 = Panel("mapping_windows")
mesh2obj_3 = MeshToObj(
    Mesh=mesh_4,
    Name=graft(panel_39),
    MapFileName=panel_44,
    ModifierName=graft(concat_2),
    SubfolderOverride=overrides_7.Output,
    Run=execute_ssh_async_5.Ran)  # -> ObjFiles, MapFile, Run
obj2rad_2 = ObjToRad(
    ObjFiles=mesh2obj_3.ObjFiles,
    MapFile=mesh2obj_3.MapFile,
    SubfolderOverride=overrides_6.Output,
    Run=mesh2obj_3.Run,
    stdouts="~/simulation/test_project2/radFiles/Glass_30.rad>JOIN<~/simulation/test_project2/radFiles/Glass_50.rad")  # -> Status, RadFiles, Run
window_rad = Text(obj2rad_2.RadFiles)

prep_2ph_2 = Boolean(prep_2ph)

# ----
# sun primitive
prep_2ph_3 = Boolean(prep_2ph)
panel_45 = Panel("""echo "void light solar 0 0 3 1e6 1e6 1e6" > <target>
echo "<target>"
""")
overrides_8 = ApplyOverrides(Input_=panel_45, Target=graft("<LinuxHome>/suns.rad"))  # -> Output, Pairs
execute_ssh_async_9 = ExecuteSSHAsync(
    _SSHCommands_=overrides_8.Output,
    Run=prep_2ph_3,
    addPrefix=True,
    addSuffix=True,
    description="echo \"void light solar 0 0 3 1e6 1e6 1e6\" > ~/simulation/suns.rad;echo \"~/simulation/suns.rad\"",
    fireLogs=False,
    name="Sun primitive",
    stdouts="~/simulation/suns.rad",
    suppressWarnings=False)  # -> Stdout, Stderr_, Log, Pid, Ran

# ----
# opaque materials
panel_46 = Panel("echo \"<mats>\" > <proj>/radFiles/<target>;echo \"<proj>/radFiles/<target>\"")
opaquegreymat = OpaqueGreyMat(Name=concat, Reflectance_0_1=refl, Specularity=0, Roughness=0)  # -> flatten(RadMaterials), RadMaterialList
join_2 = TextJoin(Text=opaquegreymat.RadMaterials)
overrides_9 = ApplyOverrides(Input_=panel_46, Mats=graft(join_2), Target=graft("opaque_materials.mat"))  # -> Output, Pairs
execute_ssh_async_10 = ExecuteSSHAsync(
    SSHCommands_=overrides_9.Output,
    Run=obj2rad.Run,
    addPrefix=False,
    addSuffix=True,
    description="""echo "void plastic Wall_50_mat
0
0
5 0.500 0.500 0.500 0.000 0.000
void plastic Terrain_20_mat
0
0
5 0.200 0.200 0.200 0.000 0.000
void plastic Frames_70_mat
0
0
5 0.700 0.700 0.700 0.000 0.000
void plastic Context_25_mat
0
0
5 0.250 0.250 0.250 0.000 0.000
void plastic Floor_20_mat
0
0
5 0.200 0.200 0.200 0.000 0.000
void plastic Ceiling_70_mat
0
0
5 0.700 0.700 0.700 0.000 0.000" > ~/simulation/test_project2/radFiles/opaque_materials.mat;echo "~/simulation/test_project2/radFiles/opaque_materials.mat"
""",
    fireLogs=False,
    name="Opaque Materials",
    stdouts="~/simulation/test_project2/radFiles/opaque_materials.mat",
    suppressWarnings=False)  # -> Stdout, Stderr_, Log, Pid, Ran
opaque_mat = Text(execute_ssh_async_10.Stdout)

# ----
# blackmaterials
panel_47 = Panel("blackMaterial")
panel_48 = Panel("echo \"<mats>\" > <proj>/radFiles/<target>;echo \"<proj>/radFiles/<target>\"")
blackmatname = Text(panel_47)
opaquegreymat_2 = OpaqueGreyMat(Name=flatten(blackmatname), Reflectance_0_1="0.0", Specularity=0, Roughness=0)  # -> RadMaterials, RadMaterialList
overrides_10 = ApplyOverrides(Input_=panel_48, Mats=graft(opaquegreymat_2.RadMaterials), Target=graft("black_material.mat"))  # -> Output, Pairs
execute_ssh_async_11 = ExecuteSSHAsync(
    _SSHCommands_=overrides_10.Output,
    Run=execute_ssh_async_5.Ran,
    addPrefix=True,
    addSuffix=True,
    description="""echo "void plastic blackMaterial
0
0
5 0.000 0.000 0.000 0.000 0.000" > ~/simulation/test_project2/radFiles/black_material.mat;echo "~/simulation/test_project2/radFiles/black_material.mat"
""",
    fireLogs=False,
    name="Black Materials",
    staticDescription="""echo "void plastic blackMaterial
0
0
5 0.000 0.000 0.000 0.000 0.000" > ~/simulation/test_project2/radFiles/black_material.mat;echo "~/simulation/testfefe_project2/radFiles/black_material.mat"
""",
    stdouts="~/simulation/test_project2/radFiles/black_material.mat",
    suppressWarnings=False)  # -> Stdout, Stderr_, Log, Pid, Ran
black_mat = Text(execute_ssh_async_11.Stdout)

names_2 = Text(names)
prep_2ph_4 = Boolean(prep_2ph)
panel_49 = Panel("xform -m <blackmat> <proj>/radFiles/<name>.rad > <proj>/radFiles/<name>_black.rad;echo \"<proj>/radFiles/<name>_black.rad\"")
overrides_11 = ApplyOverrides(Input_=panel_49, Name=graft(names_2), Blackmat=graft(blackmatname))  # -> Output, Pairs
execute_ssh_async_12 = ExecuteSSHAsync(
    _SSHCommands_=overrides_11.Output,
    Run=prep_2ph_4,
    addPrefix=True,
    addSuffix=True,
    description="""xform -m blackMaterial ~/simulation/test_project2/radFiles/Wall_50.rad > ~/simulation/test_project2/radFiles/Wall_50_black.rad;echo "~/simulation/test_project2/radFiles/Wall_50_black.rad"
xform -m blackMaterial ~/simulation/test_project2/radFiles/Terrain_20.rad > ~/simulation/test_project2/radFiles/Terrain_20_black.rad;echo "~/simulation/test_project2/radFiles/Terrain_20_black.rad"
xform -m blackMaterial ~/simulation/test_project2/radFiles/Frames_70.rad > ~/simulation/test_project2/radFiles/Frames_70_black.rad;echo "~/simulation/test_project2/radFiles/Frames_70_black.rad"
xform -m blackMaterial ~/simulation/test_project2/radFiles/Context_25.rad > ~/simulation/test_project2/radFiles/Context_25_black.rad;echo "~/simulation/test_project2/radFiles/Context_25_black.rad"
xform -m blackMaterial ~/simulation/test_project2/radFiles/Floor_20.rad > ~/simulation/test_project2/radFiles/Floor_20_black.rad;echo "~/simulation/test_project2/radFiles/Floor_20_black.rad"
xform -m blackMaterial ~/simulation/test_project2/radFiles/Ceiling_70.rad > ~/simulation/test_project2/radFiles/Ceiling_70_black.rad;echo "~/simulation/test_project2/radFiles/Ceiling_70_black.rad"
""",
    fireLogs=False,
    name="Black Materials",
    staticDescription="""echo "void plastic blackMaterial
0
0
5 0.000 0.000 0.000 0.000 0.000" > ~/simulation/test_project2/radFiles/black_material.mat;echo "~/simulation/testfefe_project2/radFiles/black_material.mat"
""",
    stdouts="~/simulation/test_project2/radFiles/Wall_50_black.rad>JOIN<~/simulation/test_project2/radFiles/Terrain_20_black.rad>JOIN<~/simulation/test_project2/radFiles/Frames_70_black.rad>JOIN<~/simulation/test_project2/radFiles/Context_25_black.rad>JOIN<~/simulation/test_project2/radFiles/Floor_20_black.rad>JOIN<~/simulation/test_project2/radFiles/Ceiling_70_black.rad",
    suppressWarnings=False)  # -> Stdout, Stderr_, Log, Pid, Ran
black_rad_files = Text(execute_ssh_async_12.Stdout)

# ----
# Setup glass materials
panel_50 = Panel("<mat>.mat")
python_4 = GhPythonScript(matname=concat_2)  # -> filename
# ---------- python_4: Python ----------
__author__ = "mm1013"
__version__ = "2022.07.06"

import rhinoscriptsyntax as rs

filename = matname.replace(" ","_").replace(".","_")
# ---------- end python_4 ----------
glassmat = GlassMat(Name=concat_2, Transmittance_0_1=transmittance)  # -> RadMaterials, RadMaterialList
# materials
panel_51 = Panel("echo \"<mats>\" > <proj>/radFiles/<target>;echo \"<proj>/radFiles/<target>\"")
overrides_12 = ApplyOverrides(Input_=panel_50, Mat=graft(python_4))  # -> Output, Pairs
overrides_13 = ApplyOverrides(Input_=panel_51, Mats=graft(glassmat.RadMaterials), Target=graft(overrides_12.Output))  # -> Output, Pairs
execute_ssh_async_13 = ExecuteSSHAsync(
    _SSHCommands_=overrides_13.Output,
    Run=obj2rad.Run,
    addPrefix=True,
    addSuffix=True,
    description="""echo "void glass Glass_50_mat
0
0
3 0.545 0.545 0.545" > ~/simulation/test_project2/radFiles/Glass_50_mat.mat;echo "~/simulation/test_project2/radFiles/Glass_50_mat.mat"
echo "void glass Glass_30_mat
0
0
3 0.327 0.327 0.327" > ~/simulation/test_project2/radFiles/Glass_30_mat.mat;echo "~/simulation/test_project2/radFiles/Glass_30_mat.mat"
""",
    fireLogs=False,
    name="Glass Materials",
    stdouts="~/simulation/test_project2/radFiles/Glass_50_mat.mat>JOIN<~/simulation/test_project2/radFiles/Glass_30_mat.mat",
    suppressWarnings=False)  # -> Stdout, Stderr_, Log, Pid, Ran
window_mat = Text(execute_ssh_async_13.Stdout)

# ----
# Sun
panel_52 = Panel("""cnt 5165 | rcalc -e MF:6 -f reinsrc.cal -e Rbin=recno -o 'solar source sun 0 0 4 ${Dx} ${Dy} ${Dz} 0.553' >> <target>
echo <target>""")

# ----
# solar discs and modifiers for 5165 suns (=MF:6)
overrides_14 = ApplyOverrides(Input_=panel_52, Target=graft(execute_ssh_async_9.Stdout))  # -> Output, Pairs
execute_ssh_async_14 = ExecuteSSHAsync(
    _SSHCommands_=overrides_14.Output,
    Run=execute_ssh_async_9.Ran,
    addPrefix=True,
    addSuffix=True,
    description="cnt 5165 | rcalc -e MF:6 -f reinsrc.cal -e Rbin=recno -o 'solar source sun 0 0 4 ${Dx} ${Dy} ${Dz} 0.553' >> ~/simulation/suns.rad;echo ~/simulation/suns.rad",
    fireLogs=False,
    name="Solar Dics",
    stdouts="/home/mss/simulation/suns.rad",
    suppressWarnings=False)  # -> Stdout, Stderr_, Log, Pid, Ran

# ----
# -f is frozen (all links embedded)
panel_53 = Panel("""mkdir -p <proj>/octrees
oconv -f <rads> > <proj>/octrees/<target>.oct;echo <proj>/octrees/<target>.oct""")

# ----
# create black octree
black_rad_files_2 = Text(black_rad_files)
window_mat_2 = Text(window_mat)
window_rad_2 = Text(window_rad)
black_mat_2 = Text(black_mat)
and = GateAnd(A=execute_ssh_async_13.Ran, B=execute_ssh_async_11.Ran)
panel_54 = Panel("""mkdir -p <proj>/octrees
oconv -f <rads> > <proj>/octrees/my_geometry_black.oct;echo <proj>/octrees/my_geometry_black.oct""")
entwine = Entwine(Branch02=black_mat_2, Branch03=black_rad_files_2, FlattenInputs=True)  # -> flatten(Result)
join_3 = TextJoin(Text=flatten(entwine), Join=" ")
overrides_15 = ApplyOverrides(Input=panel_54, Rads=graft(join_3))  # -> Output, Pairs
execute_ssh_async_15 = ExecuteSSHAsync(
    _SSHCommands_=overrides_15.Output,
    Run=and,
    addPrefix=True,
    addSuffix=True,
    description="""mkdir -p ~/simulation/test_project2/octrees
oconv -f ~/simulation/test_project2/radFiles/black_material.mat ~/simulation/test_project2/radFiles/Wall_50_black.rad ~/simulation/test_project2/radFiles/Terrain_20_black.rad ~/simulation/test_project2/radFiles/Frames_70_black.rad ~/simulation/test_project2/radFiles/Context_25_black.rad ~/simulation/test_project2/radFiles/Floor_20_black.rad ~/simulation/test_project2/radFiles/Ceiling_70_black.rad > ~/simulation/test_project2/octrees/my_geometry_black.oct;echo ~/simulation/test_project2/octrees/my_geometry_black.oct""",
    fireLogs=False,
    name="Black Octree",
    stdouts="/home/mss/simulation/test_project2/octrees/my_geometry_black.oct",
    suppressWarnings=False)  # -> Stdout, Stderr_, Log, Pid, Ran
panel_55 = Panel(execute_ssh_async_15.Stdout)
octree_black = Text(execute_ssh_async_15.Stdout)

# ----
# Create skyglow.rad
panel_56 = Panel("""#@rfluxmtx u=+Y h=u
void glow groundglow
0
0
4 1 1 1 0

groundglow source ground
0
0
4 0 0 -1 180

#@rfluxmtx u=+Y h=r1
void glow skyglow
0
0
4 1 1 1 0

skyglow source skydome
0
0
4 0 0 1 180""")
panel_57 = Panel("""mkdir -p <proj>/radFiles
echo "<skyglow>" > <proj>/radFiles/<target>; echo <proj>/radFiles/<target>""")
overrides_16 = ApplyOverrides(Input=panel_57, Skyglow=graft(panel_56), Target=graft("skyglow.rad"))  # -> Output, Pairs
execute_ssh_async_16 = ExecuteSSHAsync(
    _SSHCommands_=overrides_16.Output,
    Run=execute_ssh_async_5.Ran,
    addPrefix=True,
    addSuffix=True,
    description="""mkdir -p ~/simulation/test_project2/radFiles
echo "#@rfluxmtx u=+Y h=u
void glow groundglow
0
0
4 1 1 1 0

groundglow source ground
0
0
4 0 0 -1 180

#@rfluxmtx u=+Y h=r1
void glow skyglow
0
0
4 1 1 1 0

skyglow source skydome
0
0
4 0 0 1 180" > ~/simulation/test_project2/radFiles/skyglow.rad; echo ~/simulation/test_project2/radFiles/skyglow.rad""",
    fireLogs=False,
    stdouts="/home/mss/simulation/test_project2/radFiles/skyglow.rad",
    suppressWarnings=False)  # -> Stdout, Stderr_, Log, Pid, Ran
overrides_17 = ApplyOverrides(Input="head <proj>/radFiles/<target>", Target=graft("skyglow.rad"))  # -> Output, Pairs
execute_ssh_async_17 = ExecuteSSHAsync(
    _SSHCommands_=overrides_17.Output,
    Run=execute_ssh_async_16.Ran,
    addPrefix=True,
    addSuffix=True,
    description="head ~/simulation/test_project2/radFiles/skyglow.rad",
    fireLogs=False,
    stdouts="""#@rfluxmtx u=+Y h=u
void glow groundglow
0
0
4 1 1 1 0

groundglow source ground
0
0
4 0 0 -1 180""",
    suppressWarnings=False)  # -> Stdout, Stderr_, Log, Pid, Ran
panel_58 = Panel(execute_ssh_async_16.Stdout)
panel_59 = Panel(execute_ssh_async_17.Stdout)
skyglow = Text(execute_ssh_async_16.Stdout)

# ----
# preview pts files
# opt1 - cat directly from linux
panel_60 = Panel("cat <pts>")
points_3 = Text(points_2)
overrides_18 = ApplyOverrides(Input_=panel_60, Pts=graft(points_3))  # -> Output, Pairs
execute_ssh_async_18 = ExecuteSSHAsync(
    _SSHCommands_=overrides_18.Output,
    Run=Toggle(True),
    addPrefix=True,
    addSuffix=True,
    description="cat /home/mss/simulation/test_project2/points.pts",
    fireLogs=False,
    stdouts="""-10408 -15348 3750 0 0 1
-10853 -15684 3750 0 0 1
-11299 -16020 3750 0 0 1
-11744 -16356 3750 0 0 1
-12190 -16691 3750 0 0 1
-10742 -14904 3750 0 0 1
-11188 -15240 3750 0 0 1
-11633 -15576 3750 0 0 1
-12079 -15911 3750 0 0 1
-12524 -16247 3750 0 0 1
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""",
    suppressWarnings=False)  # -> Stdout, Stderr_, Log, Pid, Ran
ptsview = PtsViewer(PtsString=execute_ssh_async_18.Stdout)  # disabled

# ----
# opt2 - read local windows pts file
points_4 = Text(points_2)
convertpaths = ConvertPaths(I=points_4)  # -> Linux, Windows
ptsview_2 = PtsViewer(PtsString=convertpaths.Windows)

button = Button()
panel_61 = Panel("""Int1
Int2
Ext1
Ext2""")
view = CreateView(Viewport=panel_61, Update=button)  # -> ViewfileContent, ImageRatio
panel_62 = Panel(view.ViewfileContent)

# ----
# ground
panel_63 = Panel("""mkdir -p <proj>/radFiles/
echo "<gnd>" > <proj>/radFiles/<target>
echo <proj>/radFiles/<target>""")
panel_64 = Panel("""void plastic Ground

0

0

5 0.2 0.2 0.2 0.0 0.0

Ground polygon f_1_0
0
0
12
-172.195109 117.478512 -0.060960
-172.195109 -192.438001 -0.060960
226.699191 -192.438001 -0.060960
226.699191 117.478512 -0.060960""")
falsestart_4 = LBFalseStartToggle(False)
overrides_19 = ApplyOverrides(Input_=panel_63, Gnd=graft(panel_64), Target=graft("Ground.rad"))  # -> Output, Pairs
execute_ssh_async_19 = ExecuteSSHAsync(
    _SSHCommands_=overrides_19.Output,
    Run=falsestart_4,
    addPrefix=True,
    addSuffix=True,
    description="""mkdir -p ~/simulation/test_project2/radFiles/
echo "void plastic Ground

0

0

5 0.2 0.2 0.2 0.0 0.0

Ground polygon f_1_0
0
0
12
-172.195109 117.478512 -0.060960
-172.195109 -192.438001 -0.060960
226.699191 -192.438001 -0.060960
226.699191 117.478512 -0.060960" > ~/simulation/test_project2/radFiles/Ground.rad
echo ~/simulation/test_project2/radFiles/Ground.rad""",
    fireLogs=False,
    stdouts="/home/mss/simulation/test_project2/radFiles/Ground.rad",
    suppressWarnings=False)  # -> Stdout, Stderr_, Log, Pid, Ran
panel_65 = Panel(execute_ssh_async_19.Stdout)

# ----
# skyUp
panel_66 = Panel("""mkdir -p <proj>/views/
echo "<view>" > <proj>/views/<target>
echo <proj>/views/<target>""")
panel_67 = Panel("rvu -x 800 -y 800 -vd 0 0 1 -vv 180 -vh 180 -vp 0 0 0 -vu 0 1 0 -vth -vo 0 -va 0 -vs 0 -vl 0")
overrides_20 = ApplyOverrides(Input_=panel_66, View=graft(panel_67), Target=graft("skyUp.vf"))  # -> Output, Pairs
execute_ssh_async_20 = ExecuteSSHAsync(
    _SSHCommands_=overrides_20.Output,
    Run=falsestart_4,
    addPrefix=True,
    addSuffix=True,
    description="""mkdir -p ~/simulation/test_project2/views/
echo "rvu -x 800 -y 800 -vd 0 0 1 -vv 180 -vh 180 -vp 0 0 0 -vu 0 1 0 -vth -vo 0 -va 0 -vs 0 -vl 0" > ~/simulation/test_project2/views/skyUp.vf
echo ~/simulation/test_project2/views/skyUp.vf""",
    fireLogs=False,
    stdouts="/home/mss/simulation/test_project2/views/skyUp.vf",
    suppressWarnings=False)  # -> Stdout, Stderr_, Log, Pid, Ran
panel_68 = Panel(execute_ssh_async_20.Stdout)

# ----
# Visualize Sky (Sarith thesis appendix B)
# skydome
# vwrays views/skyUp.vf -x 300 -y 300 -pj 0.7 -c 9 -ff | rfluxmtx -ffc -v -n 16 `vwrays -vf views/skyUp.vf -x 300 -y 300 -d` -c 9  -ab 1 -ad 1000 -lw 0.001 -o mtxs/skyRenders/skyTregenza%04d.hdr - radFiles/skyglow.rad -i octrees/sky_mathias.oct
panel_69 = Panel("""#@rfluxmtx u=+Y h=u
void glow groundglow
0
0
4 1 1 1 0

groundglow source ground
0
0
4 0 0 -1 180

#@rfluxmtx u=+Y h=r1
void glow skyglow
0
0
4 1 1 1 0

skyglow source skydome
0
0
4 0 0 1 180""")
panel_70 = Panel("""mkdir -p <proj>/radFiles/
echo "<sky>" > <proj>/radFiles/<target>
echo <proj>/radFiles/<target>""")
overrides_21 = ApplyOverrides(Input_=panel_70, Sky=graft(panel_69), Target=graft("skyglow.rad"))  # -> Output, Pairs
execute_ssh_async_21 = ExecuteSSHAsync(
    _SSHCommands_=overrides_21.Output,
    Run=execute_ssh_async_19.Ran,
    addPrefix=True,
    addSuffix=True,
    description="""mkdir -p ~/simulation/test_project2/radFiles/
echo "#@rfluxmtx u=+Y h=u
void glow groundglow
0
0
4 1 1 1 0

groundglow source ground
0
0
4 0 0 -1 180

#@rfluxmtx u=+Y h=r1
void glow skyglow
0
0
4 1 1 1 0

skyglow source skydome
0
0
4 0 0 1 180" > ~/simulation/test_project2/radFiles/skyglow.rad
echo ~/simulation/test_project2/radFiles/skyglow.rad""",
    fireLogs=False,
    stdouts="/home/mss/simulation/test_project2/radFiles/skyglow.rad",
    suppressWarnings=False)  # -> Stdout, Stderr_, Log, Pid, Ran
falsestart_5 = LBFalseStartToggle(False)
execute_ssh_async_22 = ExecuteSSHAsync(
    _SSHCommands_="echo <proj>/radFiles/materials.rad",
    Run=falsestart_5,
    addPrefix=True,
    addSuffix=True,
    description="echo ~/simulation/test_project2/radFiles/materials.rad",
    fireLogs=False,
    stdouts="/home/mss/simulation/test_project2/radFiles/materials.rad",
    suppressWarnings=False)  # -> Stdout, Stderr_, Log, Pid, Ran
panel_71 = Panel("""mkdir -p <proj>/octrees/
oconv -f <mat> <rad> > <proj>/octrees/sky_mathias.oct
echo "<proj>/octrees/sky_mathias.oct"
""")
overrides_22 = ApplyOverrides(Input_=panel_71, Rad=graft(execute_ssh_async_19.Stdout), Mat=graft(execute_ssh_async_22.Stdout))  # -> Output, Pairs
panel_72 = Panel(overrides_22.Output)
execute_ssh_async_23 = ExecuteSSHAsync(
    _SSHCommands_=overrides_22.Output,
    Run=execute_ssh_async_19.Ran,
    addPrefix=True,
    addSuffix=True,
    description="""mkdir -p ~/simulation/test_project2/octrees/
oconv -f /home/mss/simulation/test_project2/radFiles/materials.rad /home/mss/simulation/test_project2/radFiles/Ground.rad > ~/simulation/test_project2/octrees/sky_mathias.oct
echo "~/simulation/test_project2/octrees/sky_mathias.oct"
""",
    fireLogs=False,
    stdouts="~/simulation/test_project2/octrees/sky_mathias.oct",
    suppressWarnings=False)  # -> Stdout, Stderr_, Log, Pid, Ran
panel_73 = Panel("""mkdir -p <proj>/mtxs/skyRenders/
cd <proj>
vwrays -vf <vf> -x <x> -y <y> -pj 0.7 -c 9 -ff | rfluxmtx -ffc -v -n 16 `vwrays -vf <vf> -x <x> -y <y> -d` -c 9  -ab 1 -ad 1000 -lw 0.001 -o <proj>/mtxs/skyRenders/skyTregenza%04d.hdr - <sky> -i <oct>""")
overrides_23 = ApplyOverrides(
    Input_=panel_73,
    Vf=graft(execute_ssh_async_20.Stdout),
    X=graft("300"),
    Y=graft("300"),
    Oct=graft(execute_ssh_async_23.Stdout),
    Sky=graft(execute_ssh_async_21.Stdout))  # -> Output, Pairs
panel_74 = Panel("mogrify -format png -resize 1500x1500 <proj>/mtxs/skyRenders/all.hdr;echo <proj>/mtxs/skyRenders/all.png")
execute_ssh_async_24 = ExecuteSSHAsync(
    _SSHCommands_=overrides_23.Output,
    Run=invert(execute_ssh_async_23.Ran),
    addPrefix=True,
    addSuffix=True,
    description="""mkdir -p ~/simulation/test_project2/mtxs/skyRenders/
cd ~/simulation/test_project2
vwrays -vf /home/mss/simulation/test_project2/views/skyUp.vf -x 300 -y 300 -pj 0.7 -c 9 -ff | rfluxmtx -ffc -v -n 16 `vwrays -vf /home/mss/simulation/test_project2/views/skyUp.vf -x 300 -y 300 -d` -c 9  -ab 1 -ad 1000 -lw 0.001 -o ~/simulation/test_project2/mtxs/skyRenders/skyTregenza%04d.hdr - /home/mss/simulation/test_project2/radFiles/skyglow.rad -i ~/simulation/test_project2/octrees/sky_mathias.oct""",
    fireLogs=True,
    name="rfluxmtx to visualize the sky",
    suppressWarnings=True)  # -> Stdout, Stderr, Log, Pid, Ran
panel_75 = Panel("pcompos -a 15 -b 1 1 1 -s 5 <proj>/mtxs/skyRenders/skyTregenza*.hdr > <proj>/mtxs/skyRenders/all.hdr")
falsestart_6 = LBFalseStartToggle(False)
panel_76 = Panel("convert '<proj>/mtxs/skyRenders/skyTregenza????.hdr' sky_converted_%04d.png;echo <proj>/mtxs/skyRenders/")
panel_77 = Panel(execute_ssh_async_24.Stderr)
execute_ssh_async_25 = ExecuteSSHAsync(
    _SSHCommands_=panel_76,
    Run=[execute_ssh_async_24.Ran, falsestart_6],
    addPrefix=True,
    addSuffix=True,
    description="convert '~/simulation/test_project2/mtxs/skyRenders/skyTregenza????.hdr' sky_converted_%04d.png;echo ~/simulation/test_project2/mtxs/skyRenders/",
    fireLogs=False,
    stdouts="/home/mss/simulation/test_project2/mtxs/skyRenders/",
    suppressWarnings=False)  # -> Stdout, Stderr_, Log, Pid, Ran
execute_ssh_async_26 = ExecuteSSHAsync(
    _SSHCommands_=panel_75,
    Run=execute_ssh_async_24.Ran,
    addPrefix=True,
    addSuffix=True,
    description="pcompos -a 15 -b 1 1 1 -s 5 ~/simulation/test_project2/mtxs/skyRenders/skyTregenza*.hdr > ~/simulation/test_project2/mtxs/skyRenders/all.hdr",
    fireLogs=True,
    name="pcompos combine the sky views to a collage",
    staticDescription="pcompos -a 15 -b 1 1 1 -s 5 ~/simulation/test_project2/mtxs/skyRenders/skyTregenza*.hdr > ~/simulation/test_project2/mtxs/skyRenders/all.hdr",
    suppressWarnings=False)  # -> Stdout, Stderr_, Log, Pid, Ran
execute_ssh_async_27 = ExecuteSSHAsync(
    _SSHCommands_=panel_74,
    Run=execute_ssh_async_26.Ran,
    addPrefix=True,
    addSuffix=True,
    description="mogrify -format png -resize 1500x1500 ~/simulation/test_project2/mtxs/skyRenders/all.hdr;echo ~/simulation/test_project2/mtxs/skyRenders/all.png",
    fireLogs=False,
    stdouts="/home/mss/simulation/test_project2/mtxs/skyRenders/all.png",
    suppressWarnings=False)  # -> Stdout, Stderr_, Log, Pid, Ran
convertpaths_2 = ConvertPaths(I=execute_ssh_async_27.Stdout)  # -> Linux, Windows
imageviewer_4 = LBImageViewer(ImagePath_=convertpaths_2.Windows, _scale_=1, DisableClickable=False, SaveImgWithCoords=False, scale=1)  # -> ImagePath, Values, GIF

cached_results_from_amb_pos_lev1 = Panel("""-20235.7207	-21236.8496	3000
-27713.6855	-19984.041	-600
-25227.498	-20426.375	3000
-24839.8379	-21823.7402	3000
-19835.0898	-35555.3203	-2190
-14724.1777	-66234.7266	-6000
-22647.6523	-23338.9082	3000
-21681.6699	-19211.7129	3000
-16749.207	-44659.9844	-2190
-21867.5391	-18586.3789	3000
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""")
split = TextSplit(Text=cached_results_from_amb_pos_lev1)
python_5 = GhPythonScript(x=split)  # -> out, a
# ---------- python_5: Python ----------
__author__ = "mm1013"
__version__ = "2022.07.06"

import rhinoscriptsyntax as rs
a = x.split("\t")
# ---------- end python_5 ----------
item_2 = ListItem(List=python_5.a, Index=0, Wrap=True)  # -> Item, Item1, Item2
num = Number(item_2.Item)
pt_2 = ConstructPoint(XCoordinate=num, YCoordinate=item_2.Item1, ZCoordinate=item_2.Item2)

panel_78 = Panel("""0
0
0
0
0
0
0
0
1
1
1
1
1
1
1
1
1
1
0
0
0
0
0
0""")
int = Integer(panel_78)
dup = DuplicateData(Data=int, Number="365", Order=True)

# ----
# Overview of all running tasks in linux
panel_79 = Panel("ps aux | grep '<AllRadProgs>'")

default = DefaultMSS(data=flatten(panel_79), default_value_flattened=flatten(nickname_2))

execute_ssh_async_28 = ExecuteSSHAsync(
    SSHCommands=default,
    Run=Toggle(True),
    addPrefix=True,
    addSuffix=True,
    description="ps aux | grep 'arch2rad\|bgraph\|cnt\|compamb\|cv\|dayfact\|dctimestep\|dgraph\|ev\|falsecolor\|fieldcomb\|findglare\|gcomp\|genblinds\|genbox\|genBSDF\|genclock\|genklemsamp\|genprism\|genrev\|gensky\|genskyvec\|gensurf\|genworm\|getbbox\|getinfo\|glare\|glarendx\|glrad\|histo\|icalc\|ies2rad\|igraph\|lampcolor\|libmeta.a\|lookamb\|macbethcal\|meta\|meta2bmp\|meta2tga\|metafile\|mgf2meta\|mgf2rad\|mkillum\|mksource\|neaten\|normpat\|normtiff\|obj2mesh\|obj2rad\|objline\|objview\|oconv\|pcomb\|pcompos\|pcond\|pdfblur\|pexpand\|pextrem\|pfilt\|pflip\|phisto\|pinterp\|pkgBSDF\|plotin\|pmblur\|pmdblur\|protate\|psign\|psmeta\|psort\|pvalue\|ra_bmp\|ra_gif\|ra_pict\|ra_ppm\|ra_ps\|ra_rgbe\|ra_t16\|ra_t8\|ra_tiff\|ra_xyze\|rad\|rad2mgf\|raddepend\|ran2tiff\|ranimate\|ranimove\|rcalc\|replmarks\|rhcopy\|rhinfo\|rholo\|rhoptimize\|rhpict\|rlam\|rpict\|rpiece\| rsensor \|rtcontrib\|rtrace\|rvu\|tabfunc\|tmesh2rad\|total\|trad\|ttyimage\|vwrays\|vwright\|x11meta\|xform\|xglaresrc\|ximage\|xshowtrace'",
    fireLogs=False,
    stdouts="mss      25798  0.0  0.0   8684  3124 ?        S    23:33   0:00 grep arch2rad\|bgraph\|cnt\|compamb\|cv\|dayfact\|dctimestep\|dgraph\|ev\|falsecolor\|fieldcomb\|findglare\|gcomp\|genblinds\|genbox\|genBSDF\|genclock\|genklemsamp\|genprism\|genrev\|gensky\|genskyvec\|gensurf\|genworm\|getbbox\|getinfo\|glare\|glarendx\|glrad\|histo\|icalc\|ies2rad\|igraph\|lampcolor\|libmeta.a\|lookamb\|macbethcal\|meta\|meta2bmp\|meta2tga\|metafile\|mgf2meta\|mgf2rad\|mkillum\|mksource\|neaten\|normpat\|normtiff\|obj2mesh\|obj2rad\|objline\|objview\|oconv\|pcomb\|pcompos\|pcond\|pdfblur\|pexpand\|pextrem\|pfilt\|pflip\|phisto\|pinterp\|pkgBSDF\|plotin\|pmblur\|pmdblur\|protate\|psign\|psmeta\|psort\|pvalue\|ra_bmp\|ra_gif\|ra_pict\|ra_ppm\|ra_ps\|ra_rgbe\|ra_t16\|ra_t8\|ra_tiff\|ra_xyze\|rad\|rad2mgf\|raddepend\|ran2tiff\|ranimate\|ranimove\|rcalc\|replmarks\|rhcopy\|rhinfo\|rholo\|rhoptimize\|rhpict\|rlam\|rpict\|rpiece\| rsensor \|rtcontrib\|rtrace\|rvu\|tabfunc\|tmesh2rad\|total\|trad\|ttyimage\|vwrays\|vwright\|x11meta\|xform\|xglaresrc\|ximage\|xshowtrace",
    suppressWarnings=False)  # -> Stdout, Stderr, Log, Pid, Ran
panel_80 = Panel(execute_ssh_async_28.Stdout)

panel_81 = Panel("cat ~/.bashrc")  # disabled
panel_82 = Panel("dwd | tee ~/simulation/log.txt")  # disabled
falsestart_7 = LBFalseStartToggle(False)  # disabled

execute_ssh_async_29 = ExecuteSSHAsync(
    SSHCommands=[panel_81, panel_82],
    Run=falsestart_7,
    addPrefix=True,
    addSuffix=True,
    fireLogs=False,
    suppressWarnings=False)  # -> Stdout, Stderr, Log, Pid, Ran; disabled

panel_83 = Panel(execute_ssh_async_29.Stdout)  # disabled
panel_84 = Panel(execute_ssh_async_29.Log)  # disabled
panel_85 = Panel(execute_ssh_async_29.Stderr)  # disabled

# ----
# Check if ximage and other x-commands work.
# Must have Xlaunch running on windows with disabled access control
# Otherwise it will crash!
panel_86 = Panel("""export "DISPLAY=$(ip route list default | awk '{print $3}'):0"
export "LIBGL_ALWAYS_INDIRECT=1"
xclock""")
falsestart_8 = LBFalseStartToggle(False)

execute_ssh_async_30 = ExecuteSSHAsync(_SSHCommands_=panel_86, Run=falsestart_8, addPrefix=True, addSuffix=True, fireLogs=False, suppressWarnings=False)  # -> Stdout, Stderr_, Log, Pid, Ran
panel_87 = Panel(execute_ssh_async_30.Log)

panel_88 = Panel(execute_ssh_async_30.Stderr_)

# ----
# WEA file
# create WEA file
panel_89 = Panel("<LinuxHome>/weatherData")
path = FilePath("C:\Users\mm1013\Documents\Rhino setup\DNK_DRY_OFFICIAL_2001-2010_epw-fil.epw")
overrides_24 = ApplyOverrides(Input_=panel_89)  # -> Output, Pairs

python_6 = GhPythonScript(x=overrides_24.Output)  # -> a
# ---------- python_6: Python ----------
__author__ = "mm1013"
__version__ = "2022.07.02"

import rhinoscriptsyntax as rs

a = x[1:]
# ---------- end python_6 ----------

upload = Upload(
    LocalFilePaths=path,
    SubfolderOverride=python_6,
    Run=execute_ssh_async_5.Ran,
    stdouts="~/simulation/weatherData/DNK_DRY_OFFICIAL_2001-2010_epw-fil.epw")  # -> Status, FilePaths, Run
overrides_25 = ApplyOverrides(Input_="epw2wea <epw> <epw-.>.wea 1>&2;echo <epw-.>.wea", Epw=graft(upload.FilePaths))  # -> Output, Pairs
execute_ssh_async_31 = ExecuteSSHAsync(
    _SSHCommands_=overrides_25.Output,
    Run=upload.Run,
    addPrefix=True,
    addSuffix=True,
    description="epw2wea ~/simulation/weatherData/DNK_DRY_OFFICIAL_2001-2010_epw-fil.epw ~/simulation/weatherData/DNK_DRY_OFFICIAL_2001-2010_epw-fil.wea 1>&2;echo ~/simulation/weatherData/DNK_DRY_OFFICIAL_2001-2010_epw-fil.wea",
    fireLogs=False,
    stdouts="/home/mss/simulation/weatherData/DNK_DRY_OFFICIAL_2001-2010_epw-fil.wea",
    suppressWarnings=True)  # -> Stdout, Stderr, Log, Pid, Ran
panel_90 = Panel(execute_ssh_async_31.Stdout)
panel_91 = Panel(execute_ssh_async_31.Stderr)
wea_file = Text(execute_ssh_async_31.Stdout)

# ----
# Get diffuseHorizontal from EPW
panel_92 = Panel("rcalc -t, -e '$1=$16' <epw>")
overrides_26 = ApplyOverrides(Input_=panel_92, Epw=graft(upload.FilePaths))  # -> Output, Pairs
execute_ssh_async_32 = ExecuteSSHAsync(
    _SSHCommands_=overrides_26.Output,
    Run=execute_ssh_async_31.Ran,
    addPrefix=True,
    addSuffix=True,
    description="rcalc -t, -e '$1=$16' ~/simulation/weatherData/DNK_DRY_OFFICIAL_2001-2010_epw-fil.epw",
    fireLogs=False,
    stdouts="""0
0
0
12
0
0
0
0
0
0
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""",
    suppressWarnings=True)  # -> Stdout, Stderr, Log, Pid, Ran
python_7 = GhPythonScript(inp=execute_ssh_async_32.Stdout)  # -> illum
# ---------- python_7: Python ----------
__author__ = "mm1013"
__version__ = "2022.07.04"

import rhinoscriptsyntax as rs

illum = [float(i) for i in inp.split("\n")][8:] #skipping headers
# ---------- end python_7 ----------

file_exists = Panel("[ -f <out> ] && echo \"1\" || echo \"0\"")
panel_93 = Panel("out")  # disabled
applyglobals_6 = ApplyGlobals(Input=file_exists, AdditionalKeys=panel_93, AdditionalValues=execute_ssh_async_31.Stdout)  # -> Output, Pairs; disabled
execute_ssh_async_33 = ExecuteSSHAsync(
    SSHCommands=applyglobals_6.Output,
    Run=upload.Run,
    addPrefix=True,
    addSuffix=True,
    fireLogs=False,
    stdouts="1",
    suppressWarnings=False)  # -> Stdout, Stderr, Log, Pid, Ran; disabled

# ----
# broken
panel_94 = Panel("50")
python_8 = GhPythonScript(inp=python_7, threshold=panel_94)  # -> on_off_sorted, port, illum, hoys_sorted, illum_sorted, hoys; inputs inp: list; disabled
# ---------- python_8: Python ----------
__author__ = "mm1013"
__version__ = "2022.07.04"

import rhinoscriptsyntax as rs
illum = inp
hoys = range(len(illum))
hoys_sorted = [hoy for _, hoy in sorted(zip(illum, hoys))]
illum_sorted = [il for il, _ in sorted(zip(illum, hoys))]

thres = int(len(illum) * float(threshold) / 100.0)

off = [0] * thres
on = [1] * (len(illum) - thres)
off.extend(on)

on_off_sorted = [o for _, o in sorted(zip(hoys_sorted, off))]



hoys_ = sorted(hoys_sorted[thres:])
# ---------- end python_8 ----------

# ----
# EN17037 Schedule
cluster_4 = Cluster_2(horizontaldiffrad=python_7)

_3dchart = Ladybug_3DChart(inputData=flatten(cluster_4), xScale="0.25", zScale="0")  # -> readMe, graphMesh, graphCurves, legend, legendBasePts, title, titleBasePts, dataPts, conditionalHOY; disabled; plug-in component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
ladybug = Ladybug_Ladybug()  # -> Vviiiiiiiiiizzz; disabled; plug-in component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

# ----
# Annual sky-matrix 145 patches
panel_95 = Panel("gendaymtx -m 1 \"<wea>\" > <wea-.>.smx;echo \"<wea-.>.smx\"")
wea_file_2 = Text(wea_file)
overrides_27 = ApplyOverrides(Input=panel_95, Wea=graft(wea_file_2))  # -> Output, Pairs
execute_ssh_async_34 = ExecuteSSHAsync(
    _SSHCommands_=overrides_27.Output,
    Run=execute_ssh_async_31.Ran,
    addPrefix=True,
    addSuffix=True,
    description="gendaymtx -m 1 \"/home/mss/simulation/weatherData/DNK_DRY_OFFICIAL_2001-2010_epw-fil.wea\" > /home/mss/simulation/weatherData/DNK_DRY_OFFICIAL_2001-2010_epw-fil.smx;echo \"/home/mss/simulation/weatherData/DNK_DRY_OFFICIAL_2001-2010_epw-fil.smx\"",
    fireLogs=False,
    name="Sky 145 patch",
    stdouts="/home/mss/simulation/weatherData/DNK_DRY_OFFICIAL_2001-2010_epw-fil.smx",
    suppressWarnings=False)  # -> Stdout, Stderr_, Log, Pid, Ran
panel_96 = Panel(execute_ssh_async_34.Stdout)

# ----
# Annual direct only daylight matrix with 145 patches
panel_97 = Panel("gendaymtx -m 1 -d \"<wea>\" > <wea-.>_d_m1.smx;echo \"<wea-.>_d_m1.smx\"")
wea_file_3 = Text(wea_file)
overrides_28 = ApplyOverrides(Input=panel_97, Wea=graft(wea_file_3))  # -> Output, Pairs
execute_ssh_async_35 = ExecuteSSHAsync(
    _SSHCommands_=overrides_28.Output,
    Run=execute_ssh_async_31.Ran,
    addPrefix=True,
    addSuffix=True,
    description="gendaymtx -m 1 -d \"/home/mss/simulation/weatherData/DNK_DRY_OFFICIAL_2001-2010_epw-fil.wea\" > /home/mss/simulation/weatherData/DNK_DRY_OFFICIAL_2001-2010_epw-fil_d_m1.smx;echo \"/home/mss/simulation/weatherData/DNK_DRY_OFFICIAL_2001-2010_epw-fil_d_m1.smx\"",
    fireLogs=False,
    name="Sky 145 patch direct only",
    stdouts="/home/mss/simulation/weatherData/DNK_DRY_OFFICIAL_2001-2010_epw-fil_d_m1.smx",
    suppressWarnings=False)  # -> Stdout, Stderr_, Log, Pid, Ran
panel_98 = Panel(execute_ssh_async_35.Stdout)

# ----
# Sun matrix with 5165 suns
panel_99 = Panel("gendaymtx -5 0.533 -d -m 6 \"<wea>\" > <wea-.>_d_m6.smx;echo \"<wea-.>_d_m6.smx\"")
wea_file_4 = Text(wea_file)
overrides_29 = ApplyOverrides(Input=panel_99, Wea=graft(wea_file_4))  # -> Output, Pairs
execute_ssh_async_36 = ExecuteSSHAsync(
    _SSHCommands_=overrides_29.Output,
    Run=execute_ssh_async_31.Ran,
    addPrefix=True,
    addSuffix=True,
    description="gendaymtx -5 0.533 -d -m 6 \"/home/mss/simulation/weatherData/DNK_DRY_OFFICIAL_2001-2010_epw-fil.wea\" > /home/mss/simulation/weatherData/DNK_DRY_OFFICIAL_2001-2010_epw-fil_d_m6.smx;echo \"/home/mss/simulation/weatherData/DNK_DRY_OFFICIAL_2001-2010_epw-fil_d_m6.smx\"",
    fireLogs=False,
    name="Sky 5165",
    stdouts="/home/mss/simulation/weatherData/DNK_DRY_OFFICIAL_2001-2010_epw-fil_d_m6.smx",
    suppressWarnings=False)  # -> Stdout, Stderr_, Log, Pid, Ran
panel_100 = Panel(execute_ssh_async_36.Stdout)

# ----
# RENDER TESTS
# # start of sky definition for daylighting studies
# # location name: COPENHAGEN_DNK LAT: 55.63
# !gensky 5 14 14.0 -c -a 55.63 -o -12.67 -m -15.0 | xform -rz 0.0
# skyfunc glow sky_mat
# 0
# 0
# 4
# 1 1 1 0
# sky_mat source sky
# 0
# 0
# 4
# 0 0 1 180
# skyfunc glow ground_glow
# 0
# 0
# 4
# 1 .8 .5 0
# ground_glow source ground
# 0
# 0
# 4
# 0 0 -1 180
# # end of sky definition for daylighting studies
panel_101 = Panel("""mkdir -p <proj>/radFiles/
gensky -ang 45 0 -c -B 55.866 > <proj>/radFiles/<target>; echo <proj>/radFiles/<target>""")
_10000lux_overcast = Panel("gensky -ang 45 0 -c -B 55.866")
and_append_the_ground = Panel("""##The 1 will be multiplie with brightfunc
skyfunc glow sky_glow
0
0
4 1 1 1 0

##Set to 1 as it will be multiplied with the gensky result
sky_glow source sky
0
0
4 0 0 1 180

##Set to 1 as it will be multiplied with the gensky result
skyfunc glow ground_glow
0
0
4 1 1 1 0

##The ground pane
ground_glow source ground
0
0
4 0 0 -1 180""")
ladybug_2 = Ladybug_Ladybug()  # -> Vviiiiiiiiiizzz; disabled; plug-in component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
geo_5 = Geometry(<brep referenced from the Rhino model>)  # disabled
path_2 = FilePath("C:\Users\mm1013\Documents\Rhino setup\DNK_Copenhagen.061800_IWEC.epw")  # disabled
panel_102 = Panel("5")  # disabled
panel_103 = Panel("14")  # disabled
panel_104 = Panel("14")  # disabled
debrep = DeconstructBrep(Brep=geo_5)  # -> Faces, Edges, Vertices; disabled
panel_105 = Panel("4")  # disabled
genstandardciesky = Honeybee_GenerateStandardCIESky(weatherFile=path_2, month=panel_102, day=panel_103, hour=panel_104, skyType=panel_105)  # -> skyFilePath; disabled; plug-in component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
createhbsrfs = Honeybee_createHBSrfs(geometry=debrep.Faces)  # -> readMe, simplify(HBSurface); disabled; plug-in component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
panel_106 = Panel("Perspective")  # disabled
panel_107 = Panel("700")  # disabled
panel_108 = Panel("152")  # disabled
imagebasedsimulation = Honeybee_ImageBasedSimulation(
    skyFile=genstandardciesky,
    rhinoViewsName=panel_106,
    simulationType=2,
    imageWidth=panel_108,
    imageHeight=panel_107,
    backupImages=0)  # -> analysisRecipe; disabled; plug-in component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
toggle_2 = BooleanToggle(True)  # disabled
rundaylightanalysis = Honeybee_RunDaylightSimulation(
    HBObjects=flatten(createhbsrfs.HBSurface),
    analysisRecipe=imagebasedsimulation,
    writeRad=toggle_2,
    runRad=toggle_2,
    overwriteResults=True)  # -> readMe, analysisType, resultsUnit, results, testPts, luminance_files, radGeoFile, studyFolder, done; disabled; plug-in component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
hdr_gif = Honeybee_ConvertHDRToGIF(HDRFilePath=rundaylightanalysis.luminance_files, adjustExposure=False)  # -> GIFFilePath; disabled; plug-in component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
imageviewer_5 = LBImageViewer(ImagePath_=hdr_gif, _scale_=1, DisableClickable=False, SaveImgWithCoords=False, scale=1)  # -> ImagePath, Values, GIF; disabled

# ----
# Create a dummy gensky for renders
# mkdir -p <proj>/radFiles/
# gensky 12 4 +12:00 -c -B 55.866 > <proj>/radFiles/<target>; echo <proj>/radFiles/<target>
panel_109 = Panel("sky_10klx.mat")
overrides_30 = ApplyOverrides(Input=panel_101, Target=graft(panel_109))  # -> Output, Pairs
execute_ssh_async_37 = ExecuteSSHAsync(
    _SSHCommands_=overrides_30.Output,
    Run=execute_ssh_async_5.Ran,
    addPrefix=True,
    addSuffix=True,
    description="""mkdir -p ~/simulation/test_project2/radFiles/
gensky -ang 45 0 -c -B 55.866 > ~/simulation/test_project2/radFiles/sky_10klx.mat; echo ~/simulation/test_project2/radFiles/sky_10klx.mat""",
    fireLogs=False,
    stdouts="/home/mss/simulation/test_project2/radFiles/sky_10klx.mat",
    suppressWarnings=False)  # -> Stdout, Stderr_, Log, Pid, Ran
overrides_31 = ApplyOverrides(Input="head <proj>/radFiles/<target>", Target=graft(panel_109))  # -> Output, Pairs
execute_ssh_async_38 = ExecuteSSHAsync(
    _SSHCommands_=overrides_31.Output,
    Run=execute_ssh_async_37.Ran,
    addPrefix=True,
    addSuffix=True,
    description="head ~/simulation/test_project2/radFiles/sky_10klx.mat",
    fireLogs=False,
    stdouts="""# gensky -ang 45 0 -c -B 55.866
# Ground ambient level: 17.8

void brightfunc skyfunc
2 skybr skybright.cal
0
3 2 2.29e+01 3.56e+00""",
    suppressWarnings=False)  # -> Stdout, Stderr_, Log, Pid, Ran
panel_110 = Panel(execute_ssh_async_37.Stdout)
panel_111 = Panel(execute_ssh_async_38.Stdout)
sky10klx = Text(execute_ssh_async_37.Stdout)

# ----
# Preview a RAD file with objpict
# can also use ra_tiff/normtiff/pfilt
# gamma will vary
# 
# check axel jacobs radiance tutorial p26
panel_112 = Panel("""mkdir -p <proj>/images/
objpict <rad> > <proj>/images/<target-.>.hdr
normtiff <proj>/images/<target-.>.hdr <proj>/images/<target-.>.tif
convert <proj>/images/<target-.>.tif <proj>/images/<target>
echo <proj>/images/<target>""")  # disabled
radfile = Text(execute_ssh_async_37.Stdout)  # disabled
panel_113 = Panel("quickRender.png")  # disabled
panel_114 = Panel("""rad
target""")  # disabled
applyglobals_7 = ApplyGlobals(Input=panel_112, AdditionalKeys=panel_114, AdditionalValues=[radfile, panel_113])  # -> Output, Pairs; disabled
execute_ssh_async_39 = ExecuteSSHAsync(
    SSHCommands=applyglobals_7.Output,
    Run=execute_ssh_async_38.Ran,
    addPrefix=True,
    addSuffix=True,
    fireLogs=False,
    stdouts="/home/mss/simulation/test_project/images/quickRender.png",
    suppressWarnings=False)  # -> Stdout, Stderr, Log, Pid, Ran; disabled
convertpaths_3 = ConvertPaths(I=execute_ssh_async_39.Stdout)  # -> Linux, Windows; disabled
imageviewer_6 = LBImageViewer(ImagePath_=convertpaths_3.Windows, _scale_=1, DisableClickable=False, SaveImgWithCoords=False, scale=1)  # -> ImagePath, Values, GIF; disabled

# ----
# Octrees
# STANDARD octree
window_mat_3 = Text(window_mat)
opaque_mat_2 = Text(opaque_mat)
opaque_rad_2 = Text(opaque_rad)
window_rad_3 = Text(window_rad)
and_2 = GateAnd(A=execute_ssh_async_13.Ran, B=execute_ssh_async_10.Ran)
entwine_2 = Entwine(Branch00=window_mat_3, Branch01=window_rad_3, Branch02=opaque_mat_2, Branch03=opaque_rad_2, FlattenInputs=True)  # -> flatten(Result)
join_4 = TextJoin(Text=flatten(entwine_2), Join=" ")

overrides_32 = ApplyOverrides(Input_=panel_53, Rads=graft(join_4), Target=graft("my_geometry"))  # -> Output, Pairs

execute_ssh_async_40 = ExecuteSSHAsync(
    _SSHCommands_=overrides_32.Output,
    Run=and_2,
    addPrefix=True,
    addSuffix=True,
    description="""mkdir -p ~/simulation/test_project2/octrees
oconv -f ~/simulation/test_project2/radFiles/Glass_50_mat.mat ~/simulation/test_project2/radFiles/Glass_30_mat.mat ~/simulation/test_project2/radFiles/Glass_30.rad ~/simulation/test_project2/radFiles/Glass_50.rad ~/simulation/test_project2/radFiles/opaque_materials.mat ~/simulation/test_project2/radFiles/Ceiling_70.rad ~/simulation/test_project2/radFiles/Floor_20.rad ~/simulation/test_project2/radFiles/Context_25.rad ~/simulation/test_project2/radFiles/Frames_70.rad ~/simulation/test_project2/radFiles/Terrain_20.rad ~/simulation/test_project2/radFiles/Wall_50.rad > ~/simulation/test_project2/octrees/my_geometry.oct;echo ~/simulation/test_project2/octrees/my_geometry.oct""",
    fireLogs=False,
    name="Standard Octree",
    stdouts="/home/mss/simulation/test_project2/octrees/my_geometry.oct",
    suppressWarnings=False)  # -> Stdout, Stderr_, Log, Pid, Ran
panel_115 = Panel(execute_ssh_async_40.Stdout)
octree = Text(execute_ssh_async_40.Stdout)

panel_116 = Panel(overrides_32.Output)

# ----
# preview rad files
convertpaths_4 = ConvertPaths(I=entwine_2)  # -> Linux, Windows
radviewer = RadViewer(RadFiles=convertpaths_4.Windows, IsTwoSided=False, Polychromatic=True, ShowEdges=True, Transparent=True)  # -> Meshes, Names, ModifierNames, Modifiers, FailedWireFrame

# ----
# 2phase DDS simulation
# NO GOOD METHOD (YET) OF MAKING SURE
# THESE 3 DONT RUN AT THE SAME TIME.
# 
# Unless we chain them (doing that as a temp fix)
# Raytracing (rfluxmtx)
# Generate daylight coefficients
# export PATH=$PATH.:/usr/local/radiance/bin
# export RAYPATH=.:/usr/local/radiance/lib
panel_117 = Panel("""mkdir -p <proj>/mtxs/
rfluxmtx -I+ -y <ptcount> -lw 0.0001 -ab 5 -ad 5000 -n <cpus> - <skyglow> -i <octree> < <points> > <proj>/mtxs/<target>;echo <proj>/mtxs/<target>""")
raytrace_2ph_2 = Boolean(raytrace_2ph)
ptscount_2 = Integer(ptscount)
and_3 = GateAnd(
    octree_ok=execute_ssh_async_40.Ran,
    skyglow_ok=execute_ssh_async_16.Ran,
    points_ok=points2pts.Run,
    raytrace=raytrace_2ph_2)
skyglow_2 = Text(skyglow)
octree_2 = Text(octree)
points_5 = Text(points_2)
overrides_33 = ApplyOverrides(
    Input_=panel_117,
    Ptcount=graft(ptscount_2),
    Skyglow=graft(skyglow_2),
    Octree=graft(octree_2),
    Points=graft(points_5),
    Target=graft("dc_illum.mtx"))  # -> Output, Pairs
execute_ssh_async_41 = ExecuteSSHAsync(
    _SSHCommands_=overrides_33.Output,
    Run=and_3,
    addPrefix=True,
    addSuffix=True,
    description="mkdir -p ~/simulation/test_project2/mtxs/;rfluxmtx -I+ -y 80 -lw 0.0001 -ab 5 -ad 5000 -n 11 - /home/mss/simulation/test_project2/radFiles/skyglow.rad -i /home/mss/simulation/test_project2/octrees/my_geometry.oct < /home/mss/simulation/test_project2/points.pts > ~/simulation/test_project2/mtxs/dc_illum.mtx;echo ~/simulation/test_project2/mtxs/dc_illum.mtx",
    fireLogs=False,
    stdouts="/home/mss/simulation/test_project2/mtxs/dc_illum.mtx",
    suppressWarnings=False)  # -> Stdout, Stderr_, Log, Pid, Ran
panel_118 = Panel(overrides_33.Output)
panel_119 = Panel(execute_ssh_async_41.Stdout)

# ----
# Raytracing (rfluxmtx)
# Generate daylight coefficients black (direct only)
panel_120 = Panel("dcd_illum.mtx")
panel_121 = Panel("""mkdir -p <proj>/mtxs/
rfluxmtx -I+ -y <ptcount> -lw 0.0002 -ab 1 -ad 5000 -n <cpus> - <skyglow> -i <octree> < <points> > <proj>/mtxs/<target>;echo <proj>/mtxs/<target>""")
octree_black_2 = Text(octree_black)
ptscount_3 = Integer(ptscount)
skyglow_3 = Text(skyglow)
points_6 = Text(points_2)
and_4 = GateAnd(
    octree_ok=execute_ssh_async_15.Ran,
    skyglow_ok=execute_ssh_async_15.Ran,
    points_ok=points2pts.Run,
    ran_above=execute_ssh_async_41.Ran)
overrides_34 = ApplyOverrides(
    Input=panel_121,
    Ptcount=graft(ptscount_3),
    Skyglow=graft(skyglow_3),
    Octree=graft(octree_black_2),
    Points=graft(points_6),
    Target=graft(panel_120))  # -> Output, Pairs
execute_ssh_async_42 = ExecuteSSHAsync(
    _SSHCommands_=overrides_34.Output,
    Run=and_4,
    addPrefix=True,
    addSuffix=True,
    description="mkdir -p ~/simulation/test_project2/mtxs/;rfluxmtx -I+ -y 198 -lw 0.0002 -ab 1 -ad 5000 -n 11 - /home/mss/simulation/test_project2/radFiles/skyglow.rad -i /home/mss/simulation/test_project2/octrees/my_geometry_black.oct < /home/mss/simulation/test_project2/points.pts > ~/simulation/test_project2/mtxs/dcd_illum.mtx;echo ~/simulation/test_project2/mtxs/dcd_illum.mtx",
    fireLogs=False,
    stdouts="/home/mss/simulation/test_project2/mtxs/dcd_illum.mtx",
    suppressWarnings=False)  # -> Stdout, Stderr_, Log, Pid, Ran
panel_122 = Panel(overrides_34.Output)
panel_123 = Panel(execute_ssh_async_42.Stdout)

# ----
# Getting results (dctimestep)
# Results of daylight coefficients
# mkdir -p <proj>/results/
# dctimestep <dcillum> <skymtx> > <proj>/results/dctimestep_dcillum_skymtx.txt
panel_124 = Panel("""mkdir -p <proj>/results/
dctimestep <dcillum> <skymtx> | rmtxop -fa -t -c 47.4 119.9 11.6 - > <proj>/results/<target>;echo <proj>/results/<target>""")
overrides_35 = ApplyOverrides(
    Input=panel_124,
    Dcillum=graft(execute_ssh_async_41.Stdout),
    Skymtx=graft(execute_ssh_async_34.Stdout),
    Target=graft("annualR_DC.ill"))  # -> Output, Pairs
and_5 = GateAnd(A=execute_ssh_async_41.Ran, B=execute_ssh_async_34.Ran)
execute_ssh_async_43 = ExecuteSSHAsync(
    _SSHCommands_=overrides_35.Output,
    Run=and_5,
    addPrefix=True,
    addSuffix=True,
    description="mkdir -p ~/simulation/test_project2/results/;dctimestep /home/mss/simulation/test_project2/mtxs/dc_illum.mtx /home/mss/simulation/weatherData/NOR_OS_Alna.014870_TMYx.2004-2018.smx | rmtxop -fa -t -c 47.4 119.9 11.6 - > ~/simulation/test_project2/results/annualR_DC.ill;echo ~/simulation/test_project2/results/annualR_DC.ill",
    fireLogs=False,
    stdouts="/home/mss/simulation/test_project2/results/annualR_DC.ill",
    suppressWarnings=False)  # -> Stdout, Stderr_, Log, Pid, Ran
panel_125 = Panel(overrides_35.Output)
panel_126 = Panel(execute_ssh_async_43.Stdout)

# ----
# - Results of daylight coefficients (direct from 145 sample sky)
panel_127 = Panel("""export PATH=$PATH.:/usr/local/radiance/bin
export RAYPATH=.:/usr/local/radiance/lib
mkdir -p <proj>/results/
dctimestep <dcillum> <skymtx> | rmtxop -fa -t -c 47.4 119.9 11.6 - > <proj>/results/<target>;echo <proj>/results/<target>""")
overrides_36 = ApplyOverrides(
    Input=panel_127,
    Dcillum=graft(execute_ssh_async_42.Stdout),
    Skymtx=graft(execute_ssh_async_35.Stdout),
    Target=graft("annualR_DCD.ill"))  # -> Output, Pairs
and_6 = GateAnd(A=execute_ssh_async_35.Ran, B=execute_ssh_async_42.Ran)
execute_ssh_async_44 = ExecuteSSHAsync(
    _SSHCommands_=overrides_36.Output,
    Run=and_6,
    addPrefix=True,
    addSuffix=True,
    description="export PATH=$PATH.:/usr/local/radiance/bin;export RAYPATH=.:/usr/local/radiance/lib;mkdir -p ~/simulation/test_project2/results/;dctimestep /home/mss/simulation/test_project2/mtxs/dcd_illum.mtx /home/mss/simulation/weatherData/NOR_OS_Alna.014870_TMYx.2004-2018_d_m1.smx | rmtxop -fa -t -c 47.4 119.9 11.6 - > ~/simulation/test_project2/results/annualR_DCD.ill;echo ~/simulation/test_project2/results/annualR_DCD.ill",
    fireLogs=False,
    stdouts="/home/mss/simulation/test_project2/results/annualR_DCD.ill",
    suppressWarnings=False)  # -> Stdout, Stderr_, Log, Pid, Ran
panel_128 = Panel(overrides_36.Output)
panel_129 = Panel(execute_ssh_async_44.Stdout)

panel_130 = Panel("head <ill> -n 13;echo \" \";echo \"Number of lines\";wc -l <ill>")
applyglobals_8 = ApplyGlobals(Input=panel_130, AdditionalKeys="ill", AdditionalValues=execute_ssh_async_43.Stdout)  # -> Output, Pairs
execute_ssh_async_45 = ExecuteSSHAsync(
    _SSHCommands_=applyglobals_8.Output,
    Run=execute_ssh_async_43.Ran,
    addPrefix=True,
    addSuffix=True,
    description="head /home/mss/simulation/test_project2/results/annualR_DC.ill -n 13;echo \" \";echo \"Number of lines\";wc -l /home/mss/simulation/test_project2/results/annualR_DC.ill",
    fireLogs=False,
    stdouts="""#?RADIANCE
rmtxop -fa -t -c 47.4 119.9 11.6 -
dctimestep /home/mss/simulation/test_project2/mtxs/dc_illum.mtx /home/mss/simulation/weatherData/NOR_OS_Alna.014870_TMYx.2004-2018.smx
CAPDATE= 2022:07:03 22:39:49
GMT= 2022:07:03 20:39:49
Applied 1x3 matrix transform
Transposed rows and columns
NROWS=8760
NCOLS=80
NCOMP=1
FORMAT=ascii

 0.000000000000000e+00	 0.000000000000000e+00	 0.000000000000000e+00	 0.000000000000000e+00	 0.000000000000000e+00	 0.000000000000000e+00	 0.000000000000000e+00	 0.000000000000000e+00	 0.000000000000000e+00	 0.000000000000000e+00	 0.000000000000000e+00	 0.000000000000000e+00	 0.000000000000000e+00	 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
 
Number of lines
8772 /home/mss/simulation/test_project2/results/annualR_DC.ill""",
    suppressWarnings=False)  # -> Stdout, Stderr_, Log, Pid, Ran
panel_131 = Panel(execute_ssh_async_45.Stdout)

panel_132 = Panel("head <ill> -n 13;echo \" \";echo \"Number of lines\";wc -l <ill>")
overrides_37 = ApplyOverrides(Input=panel_132, Ill=graft(execute_ssh_async_44.Stdout))  # -> Output, Pairs
execute_ssh_async_46 = ExecuteSSHAsync(
    _SSHCommands_=overrides_37.Output,
    Run=execute_ssh_async_44.Ran,
    addPrefix=True,
    addSuffix=True,
    description="head /home/mss/simulation/test_project2/results/annualR_DCD.ill -n 13;echo \" \";echo \"Number of lines\";wc -l /home/mss/simulation/test_project2/results/annualR_DCD.ill",
    fireLogs=False,
    stdouts="""#?RADIANCE
rmtxop -fa -t -c 47.4 119.9 11.6 -
dctimestep /home/mss/simulation/test_project2/mtxs/dcd_illum.mtx /home/mss/simulation/weatherData/NOR_OS_Alna.014870_TMYx.2004-2018_d_m1.smx
CAPDATE= 2022:07:03 22:39:51
GMT= 2022:07:03 20:39:51
Applied 1x3 matrix transform
Transposed rows and columns
NROWS=8760
NCOLS=80
NCOMP=1
FORMAT=ascii

 0.000000000000000e+00	 0.000000000000000e+00	 0.000000000000000e+00	 0.000000000000000e+00	 0.000000000000000e+00	 0.000000000000000e+00	 0.000000000000000e+00	 0.000000000000000e+00	 0.000000000000000e+00	 0.000000000000000e+00	 0.000000000000000e+00	 0.000000000000000e+00	 0.000000000000000e+00	 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
 
Number of lines
8772 /home/mss/simulation/test_project2/results/annualR_DCD.ill""",
    suppressWarnings=False)  # -> Stdout, Stderr_, Log, Pid, Ran
panel_133 = Panel(execute_ssh_async_46.Stdout)

# ----
# create black octreeDDS
suns_material = Text(execute_ssh_async_9.Stdout)
black_rad_files_3 = Text(black_rad_files)
window_mat_4 = Text(window_mat)
window_rad_4 = Text(window_rad)
black_mat_3 = Text(black_mat)
mf6_suns = Text(execute_ssh_async_14.Stdout)
# Skies and Skymatrices
and_7 = GateAnd(A=execute_ssh_async_12.Ran, B=execute_ssh_async_14.Ran)
entwine_3 = Entwine(
    Branch00=window_mat_4,
    Branch01=window_rad_4,
    Branch02=black_mat_3,
    Branch03=black_rad_files_3,
    Branch04=suns_material,
    Branch05=mf6_suns,
    FlattenInputs=True)  # -> flatten(Result)
panel_134 = Panel("""mkdir -p <proj>/octrees
oconv -f -n 1000 <rads> > <proj>/octrees/<target>;echo <proj>/octrees/<target>""")
join_5 = TextJoin(Text=flatten(entwine_3), Join=" ")
overrides_38 = ApplyOverrides(Input=panel_134, Rads=graft(join_5), Target=graft("my_geometry_black_sunCoeffecientsDDS.oct"))  # -> Output, Pairs

execute_ssh_async_47 = ExecuteSSHAsync(
    _SSHCommands_=overrides_38.Output,
    Run=and_7,
    addPrefix=True,
    addSuffix=True,
    description="""mkdir -p ~/simulation/test_project2/octrees
oconv -f ~/simulation/test_project2/radFiles/Glass_50_mat.mat ~/simulation/test_project2/radFiles/Glass_30_mat.mat ~/simulation/test_project2/radFiles/Glass_30.rad ~/simulation/test_project2/radFiles/Glass_50.rad ~/simulation/test_project2/radFiles/black_material.mat ~/simulation/test_project2/radFiles/Wall_50_black.rad ~/simulation/test_project2/radFiles/Terrain_20_black.rad ~/simulation/test_project2/radFiles/Frames_70_black.rad ~/simulation/test_project2/radFiles/Context_25_black.rad ~/simulation/test_project2/radFiles/Floor_20_black.rad ~/simulation/test_project2/radFiles/Ceiling_70_black.rad ~/simulation/suns.rad /home/mss/simulation/suns.rad > ~/simulation/test_project2/octrees/my_geometry_black_sunCoeffecientsDDS.oct;echo ~/simulation/test_project2/octrees/my_geometry_black_sunCoeffecientsDDS.oct""",
    fireLogs=False,
    name="Black Octree DDS",
    stdouts="/home/mss/simulation/test_project2/octrees/my_geometry_black_sunCoeffecientsDDS.oct",
    suppressWarnings=False)  # -> Stdout, Stderr_, Log, Pid, Ran

panel_135 = Panel(execute_ssh_async_47.Stdout)
octree_blackdds = Text(panel_135)

# ----
# Raytracing suns (rcontrib)
# Calculate illuminance sun coefficients for illuminance calculations
panel_136 = Panel("cdsDDS_illum.mtx")
panel_137 = Panel("""mkdir -p <proj>/mtxs/
rcontrib -I+ -ab 1 -y <ptcount> -n <cpus> -ad 256 -lw 1.0e-3 -dc 1 -dt 0 -dj 0 -faf -e MF:6 -f reinhart.cal -b rbin -bn Nrbins -m solar <octree> < <points> > <proj>/mtxs/<target>
echo <proj>/mtxs/<target>""")
octree_blackdds_2 = Text(octree_blackdds)
ptscount_4 = Integer(ptscount)
points_7 = Text(points_2)
overrides_39 = ApplyOverrides(
    Input=panel_137,
    Ptcount=graft(ptscount_4),
    Octree=graft(octree_blackdds_2),
    Points=graft(points_7),
    Target=graft(panel_136))  # -> Output, Pairs
and_8 = GateAnd(octree_ok=execute_ssh_async_47.Ran, points_ok=points2pts.Run, ran_above=execute_ssh_async_42.Ran)
execute_ssh_async_48 = ExecuteSSHAsync(
    _SSHCommands_=overrides_39.Output,
    Run=and_8,
    addPrefix=True,
    addSuffix=True,
    description="mkdir -p ~/simulation/test_project2/mtxs/;rcontrib -I+ -ab 1 -y 198 -n 11 -ad 256 -lw 1.0e-3 -dc 1 -dt 0 -dj 0 -faf -e MF:6 -f reinhart.cal -b rbin -bn Nrbins -m solar /home/mss/simulation/test_project2/octrees/my_geometry_black_sunCoeffecientsDDS.oct < /home/mss/simulation/test_project2/points.pts > ~/simulation/test_project2/mtxs/cdsDDS_illum.mtx;echo ~/simulation/test_project2/mtxs/cdsDDS_illum.mtx",
    fireLogs=False,
    stdouts="/home/mss/simulation/test_project2/mtxs/cdsDDS_illum.mtx",
    suppressWarnings=False)  # -> Stdout, Stderr_, Log, Pid, Ran
panel_138 = Panel(execute_ssh_async_48.Stdout)

# ----
# + Results of direct sun coefficients (5165 sample sky)
panel_139 = Panel("annualR_CDS.ill")
panel_140 = Panel("""export PATH=$PATH.:/usr/local/radiance/bin
export RAYPATH=.:/usr/local/radiance/lib
mkdir -p <proj>/results/
dctimestep <dcillum> <skymtx> | rmtxop -fa -t -c 47.4 119.9 11.6 - > <proj>/results/<target>;echo <proj>/results/<target>""")
m6_sky_mtx = Text(panel_100)
overrides_40 = ApplyOverrides(Input=panel_140, Dcillum=graft(panel_138), Skymtx=graft(m6_sky_mtx), Target=graft(panel_139))  # -> Output, Pairs
and_9 = GateAnd(A=execute_ssh_async_48.Ran, B=execute_ssh_async_36.Ran)
execute_ssh_async_49 = ExecuteSSHAsync(
    _SSHCommands_=overrides_40.Output,
    Run=and_9,
    addPrefix=True,
    addSuffix=True,
    description="export PATH=$PATH.:/usr/local/radiance/bin;export RAYPATH=.:/usr/local/radiance/lib;mkdir -p ~/simulation/test_project2/results/;dctimestep /home/mss/simulation/test_project2/mtxs/cdsDDS_illum.mtx /home/mss/simulation/weatherData/NOR_OS_Alna.014870_TMYx.2004-2018_d_m6.smx | rmtxop -fa -t -c 47.4 119.9 11.6 - > ~/simulation/test_project2/results/annualR_CDS.ill;echo ~/simulation/test_project2/results/annualR_CDS.ill",
    fireLogs=False,
    stdouts="/home/mss/simulation/test_project2/results/annualR_CDS.ill",
    suppressWarnings=False)  # -> Stdout, Stderr_, Log, Pid, Ran
panel_141 = Panel(overrides_40.Output)
panel_142 = Panel(execute_ssh_async_49.Stdout)

panel_143 = Panel("head <ill> -n 13;echo \" \";echo \"Number of lines\";wc -l <ill>")
overrides_41 = ApplyOverrides(Input=panel_143, Ill=graft(execute_ssh_async_49.Stdout))  # -> Output, Pairs
execute_ssh_async_50 = ExecuteSSHAsync(
    _SSHCommands_=overrides_41.Output,
    Run=execute_ssh_async_49.Ran,
    addPrefix=True,
    addSuffix=True,
    description="head /home/mss/simulation/test_project2/results/annualR_CDS.ill -n 13;echo \" \";echo \"Number of lines\";wc -l /home/mss/simulation/test_project2/results/annualR_CDS.ill",
    fireLogs=False,
    stdouts="""#?RADIANCE
rmtxop -fa -t -c 47.4 119.9 11.6 -
dctimestep /home/mss/simulation/test_project2/mtxs/cdsDDS_illum.mtx /home/mss/simulation/weatherData/NOR_OS_Alna.014870_TMYx.2004-2018_d_m6.smx
CAPDATE= 2022:07:03 22:40:50
GMT= 2022:07:03 20:40:50
Applied 1x3 matrix transform
Transposed rows and columns
NROWS=8760
NCOLS=80
NCOMP=1
FORMAT=ascii

 0.000000000000000e+00	 0.000000000000000e+00	 0.000000000000000e+00	 0.000000000000000e+00	 0.000000000000000e+00	 0.000000000000000e+00	 0.000000000000000e+00	 0.000000000000000e+00	 0.000000000000000e+00	 0.000000000000000e+00	 0.000000000000000e+00	 0.000000000000000e+00	 0.000000000000000e+00	 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
 
Number of lines
8772 /home/mss/simulation/test_project2/results/annualR_CDS.ill""",
    suppressWarnings=False)  # -> Stdout, Stderr_, Log, Pid, Ran
panel_144 = Panel(execute_ssh_async_50.Stdout)

# ----
# final step: Combine results
panel_145 = Panel("""export PATH=$PATH.:/usr/local/radiance/bin
export RAYPATH=.:/usr/local/radiance/lib
rmtxop <DCannualR> + -s -1 <DCDannualR> + <CDSannualR> > <proj>/results/<target>;echo <proj>/results/<target>""")
falsestart_9 = LBFalseStartToggle(False)
and_10 = GateAnd(A=execute_ssh_async_43.Ran, B=execute_ssh_async_44.Ran, C=execute_ssh_async_49.Ran)
overrides_42 = ApplyOverrides(
    Input_=panel_145,
    DCannualR=graft(execute_ssh_async_43.Stdout),
    DCDannualR=graft(execute_ssh_async_44.Stdout),
    CDSannualR=graft(execute_ssh_async_49.Stdout),
    Target=graft("DDS_Total.ill"))  # -> Output, Pairs
or = GateOr(A=and_10, B=falsestart_9)
execute_ssh_async_51 = ExecuteSSHAsync(
    _SSHCommands_=overrides_42.Output,
    Run=or,
    addPrefix=True,
    addSuffix=True,
    description="export PATH=$PATH.:/usr/local/radiance/bin;export RAYPATH=.:/usr/local/radiance/lib;rmtxop /home/mss/simulation/test_project2/results/annualR_DC.ill + -s -1 /home/mss/simulation/test_project2/results/annualR_DCD.ill + /home/mss/simulation/test_project2/results/annualR_CDS.ill > ~/simulation/test_project2/results/DDS_Total.ill;echo ~/simulation/test_project2/results/DDS_Total.ill",
    fireLogs=True,
    name="Combine mtxs (DC-DCD+CDS)",
    stdouts="/home/mss/simulation/test_project2/results/DDS_Total.ill",
    suppressWarnings=False)  # -> Stdout, Stderr_, Log, Pid, Ran
panel_146 = Panel(overrides_42.Output)
panel_147 = Panel(execute_ssh_async_51.Stdout)

txt = Text(sky10klx)

# ----
# 10klx overcast sky (RwR p357)
bool = Boolean(execute_ssh_async_38.Ran)
execute_ssh_async_52 = ExecuteSSHAsync(
    _SSHCommands_="gensky -ang 45 0 -c -B 55.866",
    Run=bool,
    addPrefix=True,
    addSuffix=True,
    description="gensky -ang 45 0 -c -B 55.866",
    fireLogs=False,
    stdouts="""# gensky -ang 45 0 -c -B 55.866
# Ground ambient level: 17.8

void brightfunc skyfunc
2 skybr skybright.cal
0
3 2 2.29e+01 3.56e+00""",
    suppressWarnings=False)  # -> Stdout, Stderr_, Log, Pid, Ran
panel_148 = Panel("""mkdir -p <proj>/skies/
echo "<sky>" > <proj>/skies/<target>
echo "<proj>/skies/<target>"
""")

concat_3 = Concatenate(
    FragmentC="##Will control the gradient of the sky",
    FragmentA=execute_ssh_async_52.Stdout,
    FragmentB=and_append_the_ground)

panel_149 = Panel(concat_3)
overrides_43 = ApplyOverrides(Input=panel_148, Sky=graft(panel_149), Target=graft("overcast_sky.rad"))  # -> Output, Pairs
execute_ssh_async_53 = ExecuteSSHAsync(
    _SSHCommands_=overrides_43.Output,
    Run=execute_ssh_async_52.Ran,
    addPrefix=True,
    addSuffix=True,
    description="""mkdir -p ~/simulation/test_project2/skies/;echo "##Will control the gradient of the sky
# gensky -ang 45 0 -c -B 55.866
# Ground ambient level: 17.8

void brightfunc skyfunc
2 skybr skybright.cal
0
3 2 2.29e+01 3.56e+00

##The 1 will be multiplie with brightfunc
skyfunc glow sky_glow
0
0
4 1 1 1 0

##Set to 1 as it will be multiplied with the gensky result
sky_glow source sky
0
0
4 0 0 1 180

##Set to 1 as it will be multiplied with the gensky result
skyfunc glow ground_glow
0
0
4 1 1 1 0

##The ground pane
ground_glow source ground
0
0
4 0 0 -1 180" > ~/simulation/test_project2/skies/overcast_sky.rad;echo "~/simulation/test_project2/skies/overcast_sky.rad"
""",
    fireLogs=False,
    stdouts="~/simulation/test_project2/skies/overcast_sky.rad",
    suppressWarnings=False)  # -> Stdout, Stderr_, Log, Pid, Ran
panel_150 = Panel(execute_ssh_async_53.Stdout)

overrides_44 = ApplyOverrides(Input="cat <target>", Target=graft(execute_ssh_async_53.Stdout))  # -> Output, Pairs
execute_ssh_async_54 = ExecuteSSHAsync(
    _SSHCommands_=overrides_44.Output,
    Run=execute_ssh_async_53.Ran,
    addPrefix=True,
    addSuffix=True,
    description="cat ~/simulation/test_project2/skies/overcast_sky.rad",
    fireLogs=False,
    stdouts="""##Will control the gradient of the sky
# gensky -ang 45 0 -c -B 55.866
# Ground ambient level: 17.8

void brightfunc skyfunc
2 skybr skybright.cal
0
3 2 2.29e+01 3.56e+00

##The 1 will be multiplie with brightfunc
skyfunc glow sky_glow
0
0
4 1 1 1 0

##Set to 1 as it will be multiplied with the gensky result
sky_glow source sky
0
0
4 0 0 1 180

##Set to 1 as it will be multiplied with the gensky result
skyfunc glow ground_glow
0
0
4 1 1 1 0

##The ground pane
ground_glow source ground
0
0
4 0 0 -1 180""",
    suppressWarnings=False)  # -> Stdout, Stderr_, Log, Pid, Ran
panel_151 = Panel(execute_ssh_async_54.Stdout)

# ----
# OCTREE
panel_152 = Panel("my_test_scene.oct")
scene_rads = Text(entwine_2)
sky_ovc = Text(execute_ssh_async_53.Stdout)
python_9 = GhPythonScript(x=flatten(scene_rads))  # -> a; inputs x: list
# ---------- python_9: Python ----------
__author__ = "mm1013"
__version__ = "2022.06.15"

import rhinoscriptsyntax as rs

a = None not in x
# ---------- end python_9 ----------
entwine_4 = Entwine(Branch01=sky_ovc, Branch02=scene_rads, FlattenInputs=True)  # -> flatten(Radfiles)
panel_153 = Panel("""mkdir -p <proj>/octrees/
oconv -r 2048 -f <rads> > <proj>/octrees/<target>
echo <proj>/octrees/<target>""")
and_11 = GateAnd(A=python_9, B=execute_ssh_async_53.Ran)
panel_154 = Panel(" ")
join_6 = TextJoin(Text=entwine_4, Join=" ")
overrides_45 = ApplyOverrides(Input=panel_153, Rads=graft(join_6), Target=graft(panel_152))  # -> Output, Pairs
execute_ssh_async_55 = ExecuteSSHAsync(
    _SSHCommands_=overrides_45.Output,
    Run=and_11,
    addPrefix=True,
    addSuffix=True,
    description="""mkdir -p ~/simulation/test_project2/octrees/
oconv -r 2048 -f ~/simulation/test_project2/skies/overcast_sky.rad ~/simulation/test_project2/radFiles/Glass_50_mat.mat ~/simulation/test_project2/radFiles/Glass_30_mat.mat ~/simulation/test_project2/radFiles/Glass_30.rad ~/simulation/test_project2/radFiles/Glass_50.rad ~/simulation/test_project2/radFiles/opaque_materials.mat ~/simulation/test_project2/radFiles/Ceiling_70.rad ~/simulation/test_project2/radFiles/Floor_20.rad ~/simulation/test_project2/radFiles/Context_25.rad ~/simulation/test_project2/radFiles/Frames_70.rad ~/simulation/test_project2/radFiles/Terrain_20.rad ~/simulation/test_project2/radFiles/Wall_50.rad > ~/simulation/test_project2/octrees/my_test_scene.oct
echo ~/simulation/test_project2/octrees/my_test_scene.oct""",
    fireLogs=False,
    stdouts="/home/mss/simulation/test_project2/octrees/my_test_scene.oct",
    suppressWarnings=False)  # -> Stdout, Stderr_, Log, Pid, Ran
convertpaths_5 = ConvertPaths(I=execute_ssh_async_55.Stdout)  # -> Linux, Windows
panel_155 = Panel(execute_ssh_async_55.Stdout)
panel_156 = Panel(convertpaths_5.Windows)

# ----
# VIEW
panel_157 = Panel("""mkdir -p <proj>/views/
echo "<vf>" > <proj>/views/<target>.vf
echo <proj>/views/<target>.vf""")
panel_158 = Panel("""vf
target""")
vf = Text(view.ViewfileContent)
overrides_46 = ApplyOverrides(Input=panel_157, Vf=graft(vf), Target=graft(panel_61))  # -> Output, Pairs
file_exists_2 = Panel("[ -f <out> ] && echo \"1\" || echo \"0\"")
execute_ssh_async_56 = ExecuteSSHAsync(
    _SSHCommands_=overrides_46.Output,
    Run=button,
    addPrefix=True,
    addSuffix=True,
    description="""mkdir -p ~/simulation/test_project2/views/
echo "rvu -vtv -vp -16129.6594378479 -13119.0887339954 1438.98379141628 -vd -0.309000050777079 -0.951004369262931 -0.0104717841162459 -vu -0.0032359592533459 -0.00995925852099161 0.999945169365512 -vh 83.719 -vv 50.000" > ~/simulation/test_project2/views/Int1.vf
echo ~/simulation/test_project2/views/Int1.vf
mkdir -p ~/simulation/test_project2/views/
echo "rvu -vtv -vp -22515.1031894701 -18917.6388779913 4325.25435296232 -vd 0.223222574198169 -0.974640940321721 -0.0157073173118207 -vu 0.0035066604120845 -0.0153108833804109 0.999876632481661 -vh 83.719 -vv 50.000" > ~/simulation/test_project2/views/Int2.vf
echo ~/simulation/test_project2/views/Int2.vf
mkdir -p ~/simulation/test_project2/views/
echo "rvu -vtv -vp -25409.5898832296 -51537.7113099733 -176.26047822389 -vd 0.296482456823451 0.946076670223119 0.130526192220052 -vu -0.0390326559316543 -0.124553356544041 0.99144486137381 -vh 49.513 -vv 26.991" > ~/simulation/test_project2/views/Ext1.vf
echo ~/simulation/test_project2/views/Ext1.vf
mkdir -p ~/simulation/test_project2/views/
echo "rvu -vtv -vp -21862.7849604518 -57227.1112993256 165765.363180022 -vd 0.0353111372197547 0.230759315075391 -0.972369920397677 -vu 0.147081471743077 0.961181722029749 0.233445363855906 -vh 19.085 -vv 10.000" > ~/simulation/test_project2/views/Ext2.vf
echo ~/simulation/test_project2/views/Ext2.vf""",
    fireLogs=False,
    stdouts="/home/mss/simulation/test_project2/views/Int1.vf>JOIN</home/mss/simulation/test_project2/views/Int2.vf>JOIN</home/mss/simulation/test_project2/views/Ext1.vf>JOIN</home/mss/simulation/test_project2/views/Ext2.vf",
    suppressWarnings=False)  # -> Stdout, Stderr_, Log, Pid, Ran
item_3 = ListItem(List=flatten(execute_ssh_async_56.Stdout), Index=0, Wrap=True)
panel_159 = Panel(execute_ssh_async_56.Stdout)
overrides_47 = ApplyOverrides(Input=file_exists_2, Out=graft(item_3))  # -> Output, Pairs
execute_ssh_async_57 = ExecuteSSHAsync(
    _SSHCommands_=overrides_47.Output,
    Run=execute_ssh_async_55.Ran,
    addPrefix=True,
    addSuffix=True,
    description="[ -f /home/mss/simulation/test_project2/views/Int1.vf ] && echo \"1\" || echo \"0\"",
    fireLogs=False,
    stdouts="1",
    suppressWarnings=False)  # -> Stdout, Stderr_, Log, Pid, Ran

# ----
# rpict RENDER
# single core render, using normtiff to set
# exposure and convert to png
# -ps 8 -pt 0.15 -pj 0.6 -dj 0 -ds 0.5 -dt 0.5 -dc 0.25 -dr 0 -dp 64 -st 0.85 -ab 2 -ad 512 -as 128 -ar 16 -aa 0.250 -lr 4 -lw 0.050 -av 0 0 0
panel_160 = Panel("""mkdir -p <proj>/images/
rpict -t 10 -vf <vf> -x <x> -y <y> <radPar> <octree> > <proj>/images/<target-.>_<vn>.hdr
normtiff <proj>/images/<target-.>_<vn>.hdr <proj>/images/<target-.>_<vn>.tif
convert <proj>/images/<target-.>_<vn>.tif <proj>/images/<target-.>_<vn>.png
echo <proj>/images/<target-.>_<vn>.png""")
octree_3 = Text(execute_ssh_async_55.Stdout)
and_12 = GateAnd(A=execute_ssh_async_55.Ran, B=execute_ssh_async_57.Stdout)
viewfiles = Text(execute_ssh_async_56.Stdout)
python_10 = GhPythonScript(viewfile=viewfiles)  # -> viewname
# ---------- python_10: Python ----------
__author__ = "mm1013"
__version__ = "2022.07.09"

import rhinoscriptsyntax as rs

viewname = viewfile.split("/")[-1].split(".")[0]
# ---------- end python_10 ----------
overrides_48 = ApplyOverrides(
    Input=panel_160,
    Vf=graft(viewfiles),
    X=graft("600"),
    Y=graft("500"),
    RadPar=graft("-ab 1 -ad 2048 -ar 128 -as 512 -aa 0.12 -lw 5e-2"),
    Octree=graft(octree_3),
    Target=graft("rpict_render"),
    Vn=graft(python_10))  # -> Output, Pairs
execute_ssh_async_58 = ExecuteSSHAsync(
    _SSHCommands_=overrides_48.Output,
    Run=and_12,
    addPrefix=True,
    addSuffix=True,
    description="""mkdir -p ~/simulation/test_project2/images/
rpict -t 10 -vf /home/mss/simulation/test_project2/views/Int1.vf -x 600 -y 500 -ab 1 -ad 2048 -ar 128 -as 512 -aa 0.12 -lw 5e-2 /home/mss/simulation/test_project2/octrees/my_test_scene.oct > ~/simulation/test_project2/images/_Int1.hdr
normtiff ~/simulation/test_project2/images/_Int1.hdr ~/simulation/test_project2/images/_Int1.tif
convert ~/simulation/test_project2/images/_Int1.tif ~/simulation/test_project2/images/_Int1.png
echo ~/simulation/test_project2/images/_Int1.png
mkdir -p ~/simulation/test_project2/images/
rpict -t 10 -vf /home/mss/simulation/test_project2/views/Int2.vf -x 600 -y 500 -ab 1 -ad 2048 -ar 128 -as 512 -aa 0.12 -lw 5e-2 /home/mss/simulation/test_project2/octrees/my_test_scene.oct > ~/simulation/test_project2/images/_Int2.hdr
normtiff ~/simulation/test_project2/images/_Int2.hdr ~/simulation/test_project2/images/_Int2.tif
convert ~/simulation/test_project2/images/_Int2.tif ~/simulation/test_project2/images/_Int2.png
echo ~/simulation/test_project2/images/_Int2.png
mkdir -p ~/simulation/test_project2/images/
rpict -t 10 -vf /home/mss/simulation/test_project2/views/Ext1.vf -x 600 -y 500 -ab 1 -ad 2048 -ar 128 -as 512 -aa 0.12 -lw 5e-2 /home/mss/simulation/test_project2/octrees/my_test_scene.oct > ~/simulation/test_project2/images/_Ext1.hdr
normtiff ~/simulation/test_project2/images/_Ext1.hdr ~/simulation/test_project2/images/_Ext1.tif
convert ~/simulation/test_project2/images/_Ext1.tif ~/simulation/test_project2/images/_Ext1.png
echo ~/simulation/test_project2/images/_Ext1.png
mkdir -p ~/simulation/test_project2/images/
rpict -t 10 -vf /home/mss/simulation/test_project2/views/Ext2.vf -x 600 -y 500 -ab 1 -ad 2048 -ar 128 -as 512 -aa 0.12 -lw 5e-2 /home/mss/simulation/test_project2/octrees/my_test_scene.oct > ~/simulation/test_project2/images/_Ext2.hdr
normtiff ~/simulation/test_project2/images/_Ext2.hdr ~/simulation/test_project2/images/_Ext2.tif
convert ~/simulation/test_project2/images/_Ext2.tif ~/simulation/test_project2/images/_Ext2.png
echo ~/simulation/test_project2/images/_Ext2.png""",
    fireLogs=False,
    stdouts="/home/mss/simulation/test_project2/images/_Int1.png>JOIN</home/mss/simulation/test_project2/images/_Int2.png>JOIN</home/mss/simulation/test_project2/images/_Ext1.png>JOIN</home/mss/simulation/test_project2/images/_Ext2.png",
    suppressWarnings=False)  # -> Stdout, Stderr_, Log, Pid, Ran
convertpaths_6 = ConvertPaths(I=execute_ssh_async_58.Stdout)  # -> Linux, Windows
imageviewer_7 = LBImageViewer(ImagePath_=convertpaths_6.Windows, _scale_=1, DisableClickable=False, SaveImgWithCoords=False, scale=1)  # -> ImagePath, Values, GIF

# ----
# show ambient positions
# genambpos can for some reason not find the
# files through grasshopper.
# 
# Try however to execute genambpos
# without any parameters inside
# same folder as your amb file and
# follow the instructions.
# single core render, using normtiff to set
# exposure and convert to png
panel_161 = Panel("""mkdir -p <proj>/images/
rpict -t 10 -vf <vf> -x <x> -y <y> <radPar> -af <proj>/<target-.>.amb <octree> > <proj>/images/<target-.>.hdr
normtiff <proj>/images/<target-.>.hdr <proj>/images/<target-.>.tif
convert <proj>/images/<target-.>.tif <proj>/images/<target>
echo <proj>/images/<target>""")
really_bad_ad = Panel("-ab 3 -ar 256 -as 256 -ad 256")
panel_162 = Panel("rpict_render_ambpos4.png")
octree_4 = Text(execute_ssh_async_55.Stdout)
falsestart_10 = LBFalseStartToggle(False)
overrides_49 = ApplyOverrides(
    Input=panel_161,
    Vf=graft(execute_ssh_async_56.Stdout),
    X=graft("600"),
    Y=graft("500"),
    RadPar=graft(really_bad_ad),
    Octree=graft(octree_4),
    Target=graft(panel_162))  # -> Output, Pairs
execute_ssh_async_59 = ExecuteSSHAsync(
    _SSHCommands_=overrides_49.Output,
    Run=falsestart_10,
    addPrefix=True,
    addSuffix=True,
    description="""mkdir -p ~/simulation/test_project2/images/
rpict -t 10 -vf /home/mss/simulation/test_project2/views/view.vf -x 600 -y 500 -ab 3 -ar 256 -as 256 -ad 256 -af ~/simulation/test_project2/rpict_render_ambpos4.amb /home/mss/simulation/test_project2/octrees/my_test_scene.oct > ~/simulation/test_project2/images/rpict_render_ambpos4.hdr
normtiff ~/simulation/test_project2/images/rpict_render_ambpos4.hdr ~/simulation/test_project2/images/rpict_render_ambpos4.tif
convert ~/simulation/test_project2/images/rpict_render_ambpos4.tif ~/simulation/test_project2/images/rpict_render_ambpos4.png
echo ~/simulation/test_project2/images/rpict_render_ambpos4.png""",
    fireLogs=False,
    stdouts="/home/mss/simulation/test_project2/images/rpict_render_ambpos4.png",
    suppressWarnings=False)  # -> Stdout, Stderr_, Log, Pid, Ran
convertpaths_7 = ConvertPaths(I=execute_ssh_async_59.Stdout)  # -> Linux, Windows
imageviewer_8 = LBImageViewer(ImagePath_=convertpaths_7.Windows, _scale_=1, DisableClickable=False, SaveImgWithCoords=False, scale=1)  # -> ImagePath, Values, GIF
panel_163 = Panel("""cd <proj>
rcalc -e 'x1=$1;y1=$2;z1=$3' -o sph_lev1.fmt amb_pos_lev1 > <proj>/<target>;head <target>""")
overrides_50 = ApplyOverrides(Input_=panel_163, Target=graft("spheres.rad"))  # -> Output, Pairs
overrides_51 = ApplyOverrides(Input_="cd <proj>;genambpos <amb-.>.amb > <proj>/<target>", Target=graft("amb_target.rad"), Amb=graft(panel_162))  # -> Output, Pairs
execute_ssh_async_60 = ExecuteSSHAsync(
    _SSHCommands_=overrides_50.Output,
    Run=execute_ssh_async_59.Ran,
    addPrefix=True,
    addSuffix=True,
    description="""cd ~/simulation/test_project2
rcalc -e 'x1=$1;y1=$2;z1=$3' -o sph_lev1.fmt amb_pos_lev1 > ~/simulation/test_project2/spheres.rad;head spheres.rad""",
    fireLogs=False,
    suppressWarnings=False)  # -> Stdout, Stderr_, Log, Pid, Ran
execute_ssh_async_61 = ExecuteSSHAsync(
    _SSHCommands_=overrides_51.Output,
    Run=execute_ssh_async_59.Ran,
    addPrefix=True,
    addSuffix=True,
    description="cd ~/simulation/test_project2;genambpos rpict_render_ambpos4.amb > ~/simulation/test_project2/amb_target.rad",
    fireLogs=False,
    suppressWarnings=False)  # -> Stdout, Stderr_, Log, Pid, Ran
panel_164 = Panel(overrides_51.Output)

# ----
# Parallel RTRACE render (illuminance)
# this hdr is over exposed,
# I wonder what we can do with that..
panel_165 = Panel("""mkdir -p <proj>/images/
vwrays -ff -x <x> -y <y> -vf <vf> -pa 1 | rtrace <radOptions> -n <cpus> `vwrays -d -ff -x <x> -y <y> -vf <vf> -pa 1` -ffc <oct> > <proj>/images/<target-.>.hdr
echo <proj>/images/<target-.>.hdr""")
octree_5 = Text(execute_ssh_async_55.Stdout)
run = LBFalseStartToggle(False)
viewfile = Text(execute_ssh_async_56.Stdout)
panel_166 = Panel("echo \"rvu -vtv -vp 0.5 4.5 1.6 -vd 0.830824 -1.13002 -0.181063 -vu 0 0 1 -vh 98.2132 -vv 79.2785 -vo 0 -va 0 -vs 0 -vl 0\" > <proj>/views/myview.vf;echo <proj>/views/myview.vf")
overrides_52 = ApplyOverrides(
    Input=panel_165,
    RadOptions=graft("-i -ab 1 -ad 512"),
    X=graft("600"),
    Y=graft("500"),
    Vf=graft(viewfile),
    Oct=graft(octree_5),
    Target=graft("rtrace_rendering_illum.png"))  # -> Output, Pairs
execute_ssh_async_62 = ExecuteSSHAsync(
    SSHCommands=panel_166,
    Run=run,
    addPrefix=True,
    addSuffix=True,
    fireLogs=False,
    stdouts="/home/mss/simulation/test_project2/views/myview.vf",
    suppressWarnings=False)  # -> Stdout, Stderr, Log, Pid, Ran; disabled
execute_ssh_async_63 = ExecuteSSHAsync(
    _SSHCommands=overrides_52.Output,
    Run=run,
    addPrefix=True,
    addSuffix=False,
    fireLogs=False,
    stdouts="/home/mss/simulation/test_project2/images/rtrace_rendering_illum.hdr",
    suppressWarnings=False)  # -> Stdout, Stderr_, Log, Pid, Ran
panel_167 = Panel(execute_ssh_async_63.Stdout)
convertpaths_8 = ConvertPaths(I=execute_ssh_async_63.Stdout)  # -> Linux, Windows
imageviewer_9 = LBImageViewer(ImagePath_=convertpaths_8.Windows, _scale_=1, DisableClickable=False, SaveImgWithCoords=False, scale=1)  # -> ImagePath, Values, GIF

# ----
# Parallel RTRACE render
# this hdr is over exposed,
# I wonder what we can do with that..
octree_6 = Text(execute_ssh_async_55.Stdout)
run_2 = LBFalseStartToggle(False)
viewfile_2 = Text(execute_ssh_async_56.Stdout)
panel_168 = Panel("""mkdir -p <proj>/images/
vwrays -ff -x <x> -y <y> -vf <vf> -pa 1 | rtrace <radOptions> -n <cpus> `vwrays -d -ff -x <x> -y <y> -vf <vf> -pa 1` -ffc <oct> > <proj>/images/<target-.>.hdr
echo <proj>/images/<target-.>.hdr""")
panel_169 = Panel("echo \"rvu -vtv -vp 0.5 4.5 1.6 -vd 0.830824 -1.13002 -0.181063 -vu 0 0 1 -vh 98.2132 -vv 79.2785 -vo 0 -va 0 -vs 0 -vl 0\" > <proj>/views/myview.vf;echo <proj>/views/myview.vf")
overrides_53 = ApplyOverrides(
    Input=panel_168,
    RadOptions=graft("-ab 1 -ad 512"),
    X=graft("600"),
    Y=graft("500"),
    Vf=graft(viewfile_2),
    Oct=graft(octree_6),
    Target=graft("rtrace_rendering.png"))  # -> Output, Pairs
execute_ssh_async_64 = ExecuteSSHAsync(
    SSHCommands=panel_169,
    Run=run_2,
    addPrefix=True,
    addSuffix=True,
    fireLogs=False,
    stdouts="/home/mss/simulation/test_project2/views/myview.vf",
    suppressWarnings=False)  # -> Stdout, Stderr, Log, Pid, Ran; disabled
execute_ssh_async_65 = ExecuteSSHAsync(
    _SSHCommands=overrides_53.Output,
    Run=run_2,
    addPrefix=True,
    addSuffix=False,
    description="Hi",
    fireLogs=False,
    name="Test",
    stdouts="/home/mss/simulation/test_project2/images/rtrace_rendering.hdr",
    suppressWarnings=False)  # -> Stdout, Stderr_, Log, Pid, Ran
panel_170 = Panel(execute_ssh_async_65.Stdout)
convertpaths_9 = ConvertPaths(I=execute_ssh_async_65.Stdout)  # -> Linux, Windows
imageviewer_10 = LBImageViewer(ImagePath_=convertpaths_9.Windows, _scale_=1, DisableClickable=False, SaveImgWithCoords=False, scale=1)  # -> ImagePath, Values, GIF

# ----
# RENDER PARALLEL (RPIECE)
# rpiece render multithreaded
# 
# https://discourse.radiance-online.org/t/another-rpiece-question/308/5
opt1 = Panel("""NCPU=<cpus>
COLS=<cpus>
ROWS=8
echo "-vf views/view.vf" > viewpoint
echo "-w -i -bv -ab 4 -ar 128 -ad 1024 -as 512 -aa 0.15 -av 0.0 0.0 0.0 -aw 0 -lr -10 -lw 0.004 -x 2048 -y 2048 -af ambfile -ps 1 -ds .1 -dj .6 -t 120" > options
echo "-o <proj>/<unf> <proj>/<octree>" > arguments
echo $COLS $ROWS > syncfile
rm -f pp
while [ "$NCPU" -gt 0 ]
do
	echo "running proc $NCPU"
	rpiece -v -PP pp -F syncfile @viewpoint @options @arguments &
	NCPU=`expr $NCPU - 1`
	sleep 2
done
wait""")
panel_171 = Panel("""echo "" > <proj>/run2.sh

tee -a <proj>/run2.sh > /dev/null <<EOF
<shell>
EOF""")
ex = Ex(T=opt1)
overrides_54 = ApplyOverrides(Input=panel_171, Shell=graft(ex))  # -> Output, Pairs
octree_7 = Text(execute_ssh_async_55.Stdout)
falsestart_11 = LBFalseStartToggle(False)
overrides_55 = ApplyOverrides(Input=overrides_54.Output, Unf=graft("collectedRender.unf"), Octree=graft(octree_7))  # -> Output, Pairs
panel_172 = Panel("pcompos -a <cpus> <unf> > <targethdr>")
execute_ssh_async_66 = ExecuteSSHAsync(
    SSHCommands_=overrides_55.Output,
    Run=falsestart_11,
    addPrefix=False,
    addSuffix=True,
    fireLogs=False,
    suppressWarnings=False)  # -> Stdout, Stderr_, Log, Pid, Ran
panel_173 = Panel(overrides_55.Output)
panel_174 = Panel(execute_ssh_async_66.Stderr_)

# ----
# Using PCOND to set automatic exposure
# and convert to PNG
panel_175 = Panel("""pcond -h <hdr> <hdr-.>_exposed.hdr
ra_tiff <hdr-.>_exposed.hdr <hdr-.>_exposed.tif
convert <hdr-.>_exposed.tif <hdr-.>_exposed.png
echo <hdr-.>_exposed.png""")
overrides_56 = ApplyOverrides(Input_=panel_175, Hdr=graft(execute_ssh_async_63.Stdout))  # -> Output, Pairs
execute_ssh_async_67 = ExecuteSSHAsync(
    _SSHCommands_=overrides_56.Output,
    Run=execute_ssh_async_63.Ran,
    addPrefix=True,
    addSuffix=True,
    fireLogs=False,
    stdouts="/home/mss/simulation/test_project2/images/rtrace_rendering_illum_exposed.png",
    suppressWarnings=False)  # -> Stdout, Stderr_, Log, Pid, Ran
convertpaths_10 = ConvertPaths(I=execute_ssh_async_67.Stdout)  # -> Linux, Windows
imageviewer_11 = LBImageViewer(ImagePath_=convertpaths_10.Windows, _scale_="1.5", DisableClickable=False, SaveImgWithCoords=False, scale=1.5)  # -> ImagePath, Values, GIF

# ----
# Using PCOND to set automatic exposure
# and convert to PNG
panel_176 = Panel("""pcond -h <hdr> <hdr-.>_exposed.hdr
ra_tiff <hdr-.>_exposed.hdr <hdr-.>_exposed.tif
convert <hdr-.>_exposed.tif <hdr-.>_exposed.png
echo <hdr-.>_exposed.png""")
overrides_57 = ApplyOverrides(Input_=panel_176, Hdr=graft(execute_ssh_async_65.Stdout))  # -> Output, Pairs
execute_ssh_async_68 = ExecuteSSHAsync(
    _SSHCommands_=overrides_57.Output,
    Run=execute_ssh_async_65.Ran,
    addPrefix=True,
    addSuffix=True,
    fireLogs=False,
    stdouts="/home/mss/simulation/test_project2/images/rtrace_rendering_exposed.png",
    suppressWarnings=False)  # -> Stdout, Stderr_, Log, Pid, Ran
convertpaths_11 = ConvertPaths(I=execute_ssh_async_68.Stdout)  # -> Linux, Windows
imageviewer_12 = LBImageViewer(ImagePath_=convertpaths_11.Windows, _scale_="1.5", DisableClickable=False, SaveImgWithCoords=False, scale=1.5)  # -> ImagePath, Values, GIF

# ----
# False color with illuminance curves
# on top of luminance picture
panel_177 = Panel("falsecolor -s 9000 -l lux -p <rad-.>_exposed.hdr -i <irrad> -cl -log 2 > <rad-.>_fc.hdr;echo <rad-.>_fc.hdr")
and_13 = GateAnd(A=execute_ssh_async_68.Ran, B=execute_ssh_async_63.Ran)
overrides_58 = ApplyOverrides(Input_=panel_177, Rad=graft(execute_ssh_async_65.Stdout), Irrad=graft(execute_ssh_async_63.Stdout))  # -> Output, Pairs
execute_ssh_async_69 = ExecuteSSHAsync(
    _SSHCommands_=overrides_58.Output,
    Run=and_13,
    addPrefix=True,
    addSuffix=True,
    fireLogs=False,
    stdouts="/home/mss/simulation/test_project2/images/rtrace_rendering_fc.hdr",
    suppressWarnings=False)  # -> Stdout, Stderr_, Log, Pid, Ran
convertpaths_12 = ConvertPaths(I=execute_ssh_async_69.Stdout)  # -> Linux, Windows
imageviewer_13 = LBImageViewer(ImagePath_=convertpaths_12.Windows, _scale_="1.5", DisableClickable=False, SaveImgWithCoords=False, scale=1.5)  # -> ImagePath, Values, GIF

# ----
# preview grid results
entwine_5 = Entwine(
    Branch00=execute_ssh_async_51.Stdout,
    Branch01=execute_ssh_async_44.Stdout,
    Branch02=execute_ssh_async_49.Stdout,
    FlattenInputs=True)  # -> flatten(Result)
list = ItemSelector(
    entwine_5,
    {"/home/mss/simulation/test_project2/results/DDS_Total.ill", "/home/mss/simulation/test_project2/results/annualR_DCD.ill", "/home/mss/simulation/test_project2/results/annualR_CDS.ill"}, selected="/home/mss/simulation/test_project2/results/DDS_Total.ill")
falsestart_12 = LBFalseStartToggle(False)
or_2 = GateOr(A=execute_ssh_async_51.Ran, B=falsestart_12)
_17037_schedule = Integer(cluster_4)
download = Download(LinuxFilePaths=list, Run=or_2, stdouts="C:\Users\mm1013\simulation\DDS_Total.ill")  # -> Status, FilePaths, Run
panel_178 = Panel(download.FilePaths)
annualresults = AnnualResults(
    IllFile=download.FilePaths,
    Schedule=_17037_schedule,
    Min=300,
    Max=0,
    Run=download.Run,
    stdouts="#?RADIANCE>JOIN<rmtxop /home/mss/simulation/test_project2/results/annualR_DC.ill + -s -1 /home/mss/simulation/test_project2/results/annualR_DCD.ill + /home/mss/simulation/test_project2/results/annualR_CDS.ill>JOIN<rmtxop -fa -t -c 47.4 119.9 11.6 ->JOIN<dctimestep /home/mss/simulation/test_project2/mtxs/dc_illum.mtx /home/mss/simulation/weatherData/NOR_OS_Alna.014870_TMYx.2004-2018.smx>JOIN<CAPDATE= 2022:07:03 22:39:49>JOIN<GMT= 2022:07:03 20:39:49>JOIN<Applied 1x3 matrix transform>JOIN<Transposed rows and columns>JOIN<NROWS=8760>JOIN<NCOLS=80>JOIN<NCOMP=1>JOIN<FORMAT=ascii",
    numbers=[0.8349315068, 0.8335616438, 0.7783105023, 0.4436073059, 0.3251141553, 0.7662100457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])  # -> Headers, Results, Ran
bnd = Bounds(Numbers=annualresults.Results)
pt_3 = Point(flatten(pt))
pt_4 = Point(pt_3)

# ----
# round to .2 (visual)
panel_179 = Panel(".2")
division = Division(A=annualresults.Results, B=panel_179)
int_2 = Integer(division)
multiplication = Multiplication(A=int_2, B=panel_179)

gradient = Gradient(
    LowerLimit="1",
    UpperLimit="0",
    Parameter=multiplication,
    stops=[0: RGB(234, 38, 0), 0.25: RGB(234, 126, 0), 0.5: RGB(254, 244, 84), 0.75: RGB(173, 203, 249), 1: RGB(75, 107, 169)])
preview = CustomPreview(Geometry=pt_4, Material=gradient)

# ==== cluster Cluster
L = ClusterInput()
item = ListItem(List=flatten(L), Index=0, Wrap=True)
rec = DataRecorder(item, DataLimit=-10, RecordData=True)
lng = ListLength(List=rec)
L_2 = ClusterOutput(lng)

# ==== cluster Normals
amplitude = ClusterInput()
amplitude_2 = Data(amplitude)
geo = ClusterInput()
merge = Merge(Data1=flatten(amplitude_2), Data2=flatten("1m"))
geo_2 = Geometry(geo)
item = ListItem(List=merge, Index=0, Wrap=True)
facen = FaceNormals(Mesh=geo_2)  # -> Centers, Normals
U = Units(ValueString=item)
avr = Average(Input=facen.Centers)
avr_2 = Average(Input=facen.Normals)
unflatten = UnflattenTree(Tree=avr, Guide=geo_2)
unflatten_2 = UnflattenTree(Tree=avr_2, Guide=geo_2)
amp = Amplitude(Vector=unflatten_2, Amplitude=U)
pl = PlaneNormal(Origin=unflatten, ZAxis=unflatten_2)
norm = Vector(amp)
center = Point(unflatten)
P = ClusterOutput(pl)
norm_2 = ClusterOutput(norm)
center_2 = ClusterOutput(center)

# ==== cluster Ex
T = ClusterInput()
rep = ReplaceText(Text=T, Find="\", Replace="\\", RecursiveReplace=False)
rep_2 = ReplaceText(Text=rep, Find="$", Replace="\$", RecursiveReplace=False)
rep_3 = ReplaceText(Text=rep_2, Find="`", Replace="\`", RecursiveReplace=False)
R = ClusterOutput(rep_3)

# ==== cluster Cluster_2
horizontaldiffrad = ClusterInput()
horizontaldiffrad_2 = Number(horizontaldiffrad)
lng = ListLength(List=horizontaldiffrad_2)
lng_2 = ListLength(List=horizontaldiffrad_2)
series = Series(Start=0, Step=0, Count=lng)
division = Division(A=lng, B=2)
series_2 = Series(Start=0, Step=1, Count=lng_2)
subtraction = Subtraction(A=division, B=1)
sort = SortList(Keys=horizontaldiffrad_2, ValuesA=series_2)  # -> reverse(Keys), reverse(ValuesA)
dom = ConstructDomain(DomainStart="0", DomainEnd=subtraction)
subset = SubList(List=sort.ValuesA, Domain=dom, Wrap=True)  # -> List, Index
replace = ReplaceItems(List=series, Item="1", Indices=subset.List, Wrap=False)
schedule_01 = ClusterOutput(replace)

# ==== cluster DefaultMSS
default_value_flattened = ClusterInput()
data = ClusterInput()
data_2 = Data(data)
merge = Merge(Data1=flatten(data_2), Data2="0")  # -> flatten(Result)
default_value_flattened_2 = Data(flatten(default_value_flattened))
lng = ListLength(List=merge)
equals = Equality(FirstNumber=lng, SecondNumber="1")  # -> Equality, Inequality
cull = CullPattern(List=data_2, CullPattern=invert(equals.Equality))
panel = Panel(equals.Equality)
cull_2 = CullPattern(List=default_value_flattened_2, CullPattern=equals.Equality)
data_3 = Data([cull, cull_2])
data_4 = ClusterOutput(data_3)
