# Grasshopper definition TestPaths.gh (Grasshopper 1.0.7)
# Copyright: 2021
# plug-ins: MantaRay, LadybugGrasshopper

panel = Panel("""echo hi2_1
echo hi2_2""")
panel_2 = Panel("localhost")
panel_3 = Panel("mss")
falsestart = LBFalseStartToggle(False)
entwine = Entwine(Branch00="echo hi", Branch01=panel, FlattenInputs=True)
logviewer = LogViewer(Number=10)  # -> CurrentTasks, Logs
executessh_wip = ExecuteSSHWIP(
    _SSHCommands_=entwine,
    Run=falsestart,
    addPrefix=True,
    description="""echo hi

- - -

echo hi2_1
echo hi2_2""",
    fireLogs=True,
    lastRunTime=44.1478,
    name="XX",
    staticDescription="""---

echo ll1
echo llll""",
    suppressWarnings=False,
    results=["hi", """hi2_1
_JOIN_
hi2_2"""],
    commands=["echo hi", """echo hi2_1
_JOIN_
echo hi2_2"""])  # -> Stdout, Stderr_, Ran
panel_4 = Panel(logviewer.CurrentTasks)
panel_5 = Panel(executessh_wip.Stdout)
panel_6 = Panel(logviewer.Logs)

# ----
# Connect
panel_7 = Panel("mm1013")

connect = ConnectSSHFTP(User=panel_7, Ip="10.71.5.181", Password="_prompt", _port=22, Connect=Toggle(True), Prefixes=". /etc/profile")  # -> Status, Prefixes, Run

panel_8 = Panel(connect.Status)
