# Grasshopper definition TestRenders.gh (Grasshopper 1.0.7)
# Copyright: 2021
# Copyright: 2022-29-14
# Copyright: 2022-22-28
# Copyright: 2022-11-38
# Copyright: 2022-06-43
# plug-ins: MantaRay, LadybugGrasshopper, Human, Telepathy

# ----
# Remote Connect
# Be sure to check the above profile files if your EXPORT PATH=radiance stuff is included
# Also, here i set "cd <proj>" which will
# automatically set the active folder for all of the prompts.
# export PATH=$PATH:/usr/local/radiance/bin:/usr/local/accelerad/bin;export RAYPATH=.:/usr/local/accelerad/lib:/usr/local/radiance/lib;export DISPLAY=$(ip route list default | awk '{print $3}'):0;export LIBGL_ALWAYS_INDIRECT=1;export LD_LIBRARY_PATH=/usr/local/accelerad/bin:$LD_LIBRARY_PATH
panel = Panel(". /etc/profile;. ~/.profile;mkdir -p <LinuxHome>;cd <LinuxHome>")
panel_2 = Panel("C:\MantaRayLinux")
connect = ConnectSSHFTP(
    User="lio",
    Ip="mm-c0d0e-028",
    ProjectName="Rikshospitalet",
    Password="_prompt",
    _port="2222",
    Connect=Toggle(True),
    Prefixes=panel)  # -> Status, Prefixes, Run
panel_3 = Panel(connect.Status)
panel_4 = Panel(connect.Prefixes)

# ----
# Setup globals
panel_5 = Panel("""<LinuxHome>
simulation""")
panel_6 = Panel("""proj
projname""")
global_overrides = GlobalOverrides(Keys=panel_6, Values=panel_5)
panel_7 = Panel(global_overrides)

od_outdated = ColourSwatch(SwatchColor=RGBA(97, 97, 97, 150))
u_updated = ColourSwatch(SwatchColor=RGBA(208, 115, 230, 112))
toggle = BooleanToggle(False)
g_general = ColourSwatch(SwatchColor=RGBA(245, 243, 237, 156))
o_outputs = ColourSwatch(SwatchColor=RGBA(160, 218, 242, 203))
s_settings = ColourSwatch(SwatchColor=RGBA(224, 145, 81, 154))
cc_core2 = ColourSwatch(SwatchColor=RGBA(230, 216, 186, 208))
y_yellow = ColourSwatch(SwatchColor=RGBA(247, 244, 64, 188))
i_inputs = ColourSwatch(SwatchColor=RGBA(125, 217, 98, 150))
c_core = ColourSwatch(SwatchColor=RGBA(235, 227, 206, 203))
r_red = ColourSwatch(SwatchColor=RGBA(242, 63, 63, 203))

# ----
# double click to update
parserhinofile = ParseRhinoFile(LayerPrefix="Daylight_Inputs::_", Grids="Grids", Run=invert(False))  # -> GlassGeometries, GlassModifiers, port, OpaqueGeometries, OpaqueModifiers, port_2, CustomGeometries, ModifierNames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

# ----
# Log of latest(10) SSH Commands
logviewer = LogViewer(Number=10)  # -> CurrentTasks, Logs
panel_8 = Panel(logviewer.CurrentTasks)
panel_9 = Panel(logviewer.Logs)

# ----
# Local Connect
python = GhPythonScript()  # -> username; disabled
# ---------- python: Python ----------
__author__ = "mm1013"
__version__ = "2022.09.25"

import rhinoscriptsyntax as rs

import System

username = System.Environment.UserName

if username == "mm1013":
    username = "mss"
# ---------- end python ----------
toggle_2 = BooleanToggle(True)  # disabled
panel_10 = Panel("127.0.0.1")  # disabled
panel_11 = Panel(python)  # disabled
connect_2 = ConnectSSHFTP(User=panel_11, Ip="127.0.0.1", Password="_prompt", _port=22, Connect=toggle_2)  # -> Status, Prefixes, Run; disabled
panel_12 = Panel(connect_2.Status)  # disabled

colorgroups = CSharpScript(
    Colors=[i_inputs, s_settings, g_general, c_core, o_outputs, r_red, y_yellow, u_updated, od_outdated, cc_core2],
    Enable=toggle,
    Rename=Toggle(False),
    RunOnce=Button(),
    Debug=Toggle(False))  # -> out; inputs Colors: list of Color, Enable: Boolean, Rename: Boolean, RunOnce: Boolean, Debug: Boolean
# ---------- colorgroups: C# usings ----------
using System.Linq;
using System.Text;
using System.Reflection;
# ---------- colorgroups: C# ----------
    msg.Clear();


    this.Component.Message = "id: " + id.ToString();

    _debug = Debug; //Set to true to have all events printed in rhino log
    _rename = Rename;

    if (Enable)
    {
      msg.AppendFormat("Set up events on ID {0}\n", id);
      SetupDict(); // Create a dictionary of the input swatches
      SetEventHandlers(); // This would do the job.


    }
    else
    {
      RemoveEventHandlers();
    }
    if (RunOnce)
    {
      foreach(Grasshopper.Kernel.Special.GH_Group grp in Grasshopper.Instances.ActiveCanvas.Document.Objects.OfType<Grasshopper.Kernel.Special.GH_Group>())
      {
        ColorGroup(grp, null); // You decide if it should run once on all existing groups

      }
    }

    Print(msg.ToString());


    // Component setup
    Component.Description = "Set up event handlers to color groups based on prefixes such as 'in_' and 'out_'.\n"
      + "Please insert only swatcheds directly into the Colors input\n\n"
      + "MIT License. Copyright Mathias Sønderskov Schaltz 2022";
    Component.Params.Input[0].Description = "Please insert only swatcheds directly into the Colors input.\nRemember to rename them";
    Component.Params.Input[1].Description = "Toggle to run...";
    Component.Params.Input[2].Description = "Set to true if you want to automatically rename the groups and remove prefix. Default is false.";
    Component.Params.Input[3].Description = "Set to true to run it once and color all existing groups.";
    Component.Params.Input[Component.Params.Input.Count - 1].Description = "Set debug to true to get all the events printed in the rhino log";
# ---------- colorgroups: C# additional code ----------
  public static Random rnd = new Random();
  public int id = rnd.Next(0, 1000);
  StringBuilder msg = new StringBuilder();
  Dictionary<string, System.Drawing.Color> colorDict = new Dictionary<string, System.Drawing.Color>();

  bool _debug = false;
  bool _rename = false;

  public bool IdExists(int id)
  {
    IList<IGH_DocumentObject> objs = Grasshopper.Instances.ActiveCanvas.Document.Objects;
    return objs
      .OfType<IGH_Component>()
      .Where(ob => ob.NickName == this.Component.NickName)
      .Where(ob => ob.GetType().ToString() == "ScriptComponents.Component_CSNET_Script")
      .Where(ob => ob.Message == "id: " + id.ToString()).Any();

  }


  public void SetupDict()
  {
    colorDict.Clear();
    // Get all inputs to "Colors"
    IList<IGH_Param> colorSources = this.Component.Params.Input[0].Sources;
    if (colorSources.Count == 0)
    {
      throw new Exception("You forgot to setup the colors. Please input swatch components and rename them");
    }
    foreach(IGH_Param source in colorSources)
    {
      //if (source.Type.ToString() == "Grasshopper.Kernel.Types.GH_Colour")
      if (source is Grasshopper.Kernel.Special.GH_ColourSwatch)
      {
        string nickName = source.NickName.Split('_')[0].Trim() + "_";
        if(!colorDict.ContainsKey(nickName))
        {
          Grasshopper.Kernel.Special.GH_ColourSwatch swatch = (Grasshopper.Kernel.Special.GH_ColourSwatch) source;
          colorDict.Add(nickName, swatch.SwatchColour);
        }
        else
        {
          throw new Exception("Multiple swatches using the same name detected. Please rename");
        }
      }
      else
      {
        throw new Exception("Whacko! Why did you input a non-swatch into the Colors? " + source.Type.ToString());
      }

    }

    msg.AppendFormat("Set up the dictionaries with {0} colors\n", colorDict.Count);
    foreach(var pairs in colorDict)
    {
      msg.AppendFormat("{0} -> {1}\n", ("\"" + pairs.Key + "\"").PadRight(5 + colorDict.Keys.Select(k => k.Length).Max()), pairs.Value);
    }
  }

  public void SetEventHandlers()
  {

    // Always remove events first to avoid duplicates
    GrasshopperDocument.ObjectsAdded -= OnObjectsAdded;
    GrasshopperDocument.ObjectsDeleted -= OnObjectsRemoved;
    GrasshopperDocument.ObjectsDeleted -= OnDeleteThisComponent;

    // Attach events
    GrasshopperDocument.ObjectsAdded += OnObjectsAdded;
    GrasshopperDocument.ObjectsDeleted += OnObjectsRemoved;
    GrasshopperDocument.ObjectsDeleted += OnDeleteThisComponent;


    foreach(Grasshopper.Kernel.Special.GH_Group grp in GrasshopperDocument.Objects.OfType<Grasshopper.Kernel.Special.GH_Group>())
    {
      grp.ObjectChanged -= ColorGroup;
      grp.ObjectChanged += ColorGroup;

      //ColorGroup(grp, null); // Make sure to run it once
    }
    msg.AppendFormat("Added the eventhandlers on {0} existing groups and on future created groups\n", GrasshopperDocument.Objects.OfType<Grasshopper.Kernel.Special.GH_Group>().Count());
  }

  public void OnObjectsAdded(object sender, GH_DocObjectEventArgs e)
  {
    bool any = false;
    foreach (Grasshopper.Kernel.Special.GH_Group grp in e.Objects.OfType<Grasshopper.Kernel.Special.GH_Group>())
    {
      grp.ObjectChanged -= ColorGroup;
      grp.ObjectChanged += ColorGroup;
      any = true;
    }

    DebugWrite(any ? "Group Objects Added: Attaching Events to ObjectChanged" : "Objects Added - but no groups");
  }

  //Same but reversed
  public void OnObjectsRemoved(object sender, GH_DocObjectEventArgs e)
  {
    bool any = false;
    foreach (Grasshopper.Kernel.Special.GH_Group grp in e.Objects.OfType<Grasshopper.Kernel.Special.GH_Group>())
    {
      grp.ObjectChanged -= ColorGroup;
      any = true;
    }

    DebugWrite(any ? "Group Objects Removed, removing event" : "Objects Removed - although not a group");

  }



  public void RemoveEventHandlers()
  {
    GrasshopperDocument.ObjectsAdded -= OnObjectsAdded;
    GrasshopperDocument.ObjectsDeleted -= OnObjectsRemoved;


    foreach(Grasshopper.Kernel.Special.GH_Group grp in GrasshopperDocument.Objects.OfType<Grasshopper.Kernel.Special.GH_Group>())
    {
      grp.ObjectChanged -= ColorGroup;

    }
    msg.AppendFormat("Removed event handlers on document and on {0} groups\n", GrasshopperDocument.Objects.OfType<Grasshopper.Kernel.Special.GH_Group>().Count());

  }

  public void ColorGroup(object sender, EventArgs e)
  {
    if (!IdExists(id))
    {
      DebugWrite("Component not relevant. Disabling old id + " + id.ToString());
      RemoveEventHandlers();
      return;
    }

    Grasshopper.Kernel.Special.GH_Group grp = sender as Grasshopper.Kernel.Special.GH_Group;
    if (grp == null) return; //not type GH_Group
    //if (!grp.NickName.EndsWith("_")) return;

    string[] nameParts = grp.NickName.Split('_');
    if (nameParts.Length <= 1)
      return;
    string prefix = grp.NickName.Split('_')[0].Trim() + '_';

    string prefixes = String.Join(", ", colorDict.Keys.Select(k => "\"" + k + "\""));

    msg.Append("prefix " + prefix + "\n");
    if (colorDict.ContainsKey(prefix))
    {
      //if (grp.NickName.EndsWith("_"))
      grp.Colour = colorDict[prefix];
      if (_rename)
      {
        grp.NickName = grp.NickName.Replace(prefix, "");
      }

      DebugWrite("Colored " + grp.NickName);

    }
    else
    {
      DebugWrite("Group changed but not relevant: prefix " + prefix + " is not among " + prefixes);
    }

  }
  public void DebugWrite(string msg)
  {
    if (_debug)
    {
      Rhino.RhinoApp.WriteLine(String.Format("[ColGrps {0}]: {1}", id, msg));
    }
  }

  public void OnDeleteThisComponent(object sender, GH_DocObjectEventArgs e)
  {

    if (e.Objects.OfType<Grasshopper.Kernel.GH_Component>().Where(o => o.NickName == this.Component.NickName).Any())
    {
      DebugWrite("Removed template component. Removing all the eventhandlers");
      RemoveEventHandlers();
    }

  }
# ---------- end colorgroups ----------

fixparams = CSharpScript(FixOnce=Button(), Enable=toggle, Debug=Toggle(False))  # -> out; inputs FixOnce: Boolean, Enable: Boolean, Debug: Boolean
# ---------- fixparams: C# usings ----------
using System.Text;
using System.Linq;
using Grasshopper.Kernel.Special;
# ---------- fixparams: C# ----------
    _debug = Debug;
    _enable = Enable;
    msg.Clear();
    this.Component.Message = "id: " + id.ToString();




    if (Enable)
    {
      SetEventHandlers();
    }
    else
    {
      RemoveEventHandlers();
    }


    if (FixOnce)
    {
      FixAll();
    }

    Print(msg.ToString());

    // Component setup
    Component.Description = "Set up event handlers to change params to show nickname and not icon"
      + "\n\n"
      + "MIT License. Copyright Mathias Sønderskov Schaltz 2022";
    Component.Params.Input[0].Description = "Run me once on the document";
    Component.Params.Input[1].Description = "Toggle to enable event listener";
    Component.Params.Input[Component.Params.Input.Count - 1].Description = "Set debug to true to get all the events printed in the rhino log";
# ---------- fixparams: C# additional code ----------
  public static Random rnd = new Random();
  public int id = rnd.Next(0, 1000);
  StringBuilder msg = new StringBuilder();
  bool _debug = false;
  bool _enable = false;

  public Dictionary<IGH_ActiveObject, HashSet<GH_Group>> groupsPerObject = new Dictionary<IGH_ActiveObject, HashSet<GH_Group>>();


  public void OnObjectsAdded(object sender, GH_DocObjectEventArgs e)
  {
    if (!IdExists(id))
    {
      DebugWrite("[FixParam] Component not relevant. Disabling old id " + id.ToString());
      RemoveEventHandlers();
      return;
    }


    if(_enable)
    {
      foreach(IGH_Param par in e.Objects.OfType<IGH_Param>())
      {
        FixInputs(par);
      }
    }


  }

  public void FixAll()
  {
    //DebugWrite("Fixing all?");
    foreach(IGH_Param par in GrasshopperDocument.Objects.OfType<IGH_Param>())
    {

      FixInputs(par);
    }
  }




  public void FixInputs(IGH_ActiveObject obj)
  {



    IGH_Param par = obj as IGH_Param;
    if (par != null)
    {

      par.IconDisplayMode = GH_IconDisplayMode.name;


    }

  }


  public void SetEventHandlers()
  {

    GrasshopperDocument.ObjectsAdded -= OnObjectsAdded;
    GrasshopperDocument.ObjectsAdded += OnObjectsAdded;
    GrasshopperDocument.ObjectsDeleted -= OnDeleteThisComponent;
    GrasshopperDocument.ObjectsDeleted += OnDeleteThisComponent;
    msg.AppendFormat("Added the eventhandlers to OnObjectsAdded\n", GrasshopperDocument.Objects.OfType<Grasshopper.Kernel.Special.GH_Group>().Count());
  }

  public void RemoveEventHandlers()
  {
    GrasshopperDocument.ObjectsAdded -= OnObjectsAdded;
    GrasshopperDocument.ObjectsDeleted -= OnDeleteThisComponent;

    msg.AppendFormat("Removed wire event handlers on document\n", GrasshopperDocument.Objects.OfType<Grasshopper.Kernel.Special.GH_Group>().Count());

  }

  public void OnDeleteThisComponent(object sender, GH_DocObjectEventArgs e)
  {

    if (e.Objects.OfType<Grasshopper.Kernel.GH_Component>().Where(o => o.NickName == this.Component.NickName).Any())
    {
      DebugWrite("Removed template component. Removing all the eventhandlers");
      RemoveEventHandlers();
    }

  }

  public bool IdExists(int id)
  {
    IList<IGH_DocumentObject> objs = Grasshopper.Instances.ActiveCanvas.Document.Objects;
    return objs
      .OfType<IGH_Component>()
      .Where(ob => ob.NickName == this.Component.NickName)
      .Where(ob => ob.GetType().ToString() == "ScriptComponents.Component_CSNET_Script")
      .Where(ob => ob.Message == "id: " + id.ToString()).Any();

  }

  public void DebugWrite(string msg)
  {
    if (_debug)
    {
      Rhino.RhinoApp.WriteLine(String.Format("[FixParams {0}]: {1}", id, msg));
    }
  }
# ---------- end fixparams ----------

fixwires = CSharpScript(FixOnce=Button(), Enable=toggle, Debug=Toggle(False))  # -> out; inputs FixOnce: Boolean, Enable: Boolean, Debug: Boolean
# ---------- fixwires: C# ----------
    _debug = Debug;
    _enable = Enable;
    msg.Clear();
    this.Component.Message = "id: " + id.ToString();


    SetDictionary();

    if (Enable)
    {
      SetEventHandlers();
    }
    else
    {
      RemoveEventHandlers();
    }


    if (FixOnce)
    {
      FixAll();
    }

    Print(msg.ToString());
    
    // Component setup
    Component.Description = "Set up event handlers to change all wire types across groups to faint"
      + "\n\n"
      + "MIT License. Copyright Mathias Sønderskov Schaltz 2022";
    Component.Params.Input[0].Description = "Run me once on the document";
    Component.Params.Input[1].Description = "Toggle to enable event listener";
    Component.Params.Input[Component.Params.Input.Count - 1].Description = "Set debug to true to get all the events printed in the rhino log";
# ---------- fixwires: C# additional code ----------
  public static Random rnd = new Random();
  public int id = rnd.Next(0, 1000);
  StringBuilder msg = new StringBuilder();
  bool _debug = false;
  bool _enable = false;

  public Dictionary<IGH_ActiveObject, HashSet<GH_Group>> groupsPerObject = new Dictionary<IGH_ActiveObject, HashSet<GH_Group>>();


  public void OnSolutionExpired(object sender, GH_DocUndoEventArgs e)
  {
    if(_enable)
      FixAll();
  }

  public void FixAll()
  {
    //DebugWrite("Fixing all?");
    foreach(IGH_ActiveObject key in groupsPerObject.Keys.Where(k => groupsPerObject[k].Count() > 0))
    {

      FixInputs(key);
    }
  }



  public bool HasGroup(IGH_ActiveObject obj)
  {
    return groupsPerObject[obj].Count > 0;
  }


  public void FixInputs(IGH_ActiveObject obj)
  {

    if (!IdExists(id))
    {
      DebugWrite("Component not relevant. Disabling old id " + id.ToString());
      RemoveEventHandlers();
      return;
    }

    //List<List<IGH_ActiveObject>> parents = new List<List<IGH_ActiveObject>>();
    IGH_Param par = obj as IGH_Param;
    if (par != null && par.Sources != null)
    {


      IEnumerable<IGH_ActiveObject> p = par.Sources.Select(s => s.Attributes.GetTopLevel.DocObject as IGH_ActiveObject);
      //parents.Add(p);
      if(HasGroup(obj) && p.All(o => !HasGroupsInCommon(o, obj)) && par.WireDisplay != GH_ParamWireDisplay.faint)
      {
        DebugWrite("Fixing " + par.Attributes.GetTopLevel.DocObject.NickName);
        par.WireDisplay = GH_ParamWireDisplay.faint;
      }

    }

    IGH_Component comp = obj as IGH_Component;
    if (comp != null)
    {
      foreach(IGH_Param inp in comp.Params.Input)
      {

        IEnumerable<IGH_ActiveObject> p = inp.Sources.Select(i => i.Attributes.GetTopLevel.DocObject as IGH_ActiveObject);

        if(HasGroup(obj) && p.All(o => !HasGroupsInCommon(o, obj)) && inp.WireDisplay != GH_ParamWireDisplay.faint)
        {
          DebugWrite("Fixing " + inp.Attributes.GetTopLevel.DocObject.NickName);
          inp.WireDisplay = GH_ParamWireDisplay.faint;
        }
      }

    }



  }





  public void SetDictionary()
  {
    IList<IGH_DocumentObject> objects = Grasshopper.Instances.ActiveCanvas.Document.Objects.ToList();
    //Print(String.Join(", ", objects.Select(o => o.NickName)));

    groupsPerObject = objects
      .Where(o => o.GetType() != typeof(GH_Group))
      .OfType<IGH_ActiveObject>()
      .ToDictionary(o => o, o => new HashSet<GH_Group>());

    foreach(GH_Group grp in objects.OfType<GH_Group>())
    {

      foreach(IGH_ActiveObject obj in grp.ObjectsRecursive().OfType<IGH_ActiveObject>())
      {
        groupsPerObject[obj].Add(grp);

      }
    }



  }

  public bool HasGroupsInCommon(IGH_ActiveObject obj1, IGH_ActiveObject obj2)
  {
    HashSet<GH_Group> set1 = groupsPerObject[obj1];
    HashSet<GH_Group> set2 = groupsPerObject[obj2];

    set1.IntersectWith(set2);

    return set1.Any();
  }

  public void SetEventHandlers()
  {

    GrasshopperDocument.UndoStateChanged -= OnSolutionExpired;
    GrasshopperDocument.UndoStateChanged += OnSolutionExpired;
    GrasshopperDocument.ObjectsDeleted -= OnDeleteThisComponent;
    GrasshopperDocument.ObjectsDeleted += OnDeleteThisComponent;
    msg.AppendFormat("Added the eventhandlers to UndoStateChanged\n", GrasshopperDocument.Objects.OfType<Grasshopper.Kernel.Special.GH_Group>().Count());
  }

  public void RemoveEventHandlers()
  {
    GrasshopperDocument.UndoStateChanged -= OnSolutionExpired;
    GrasshopperDocument.ObjectsDeleted -= OnDeleteThisComponent;

    msg.AppendFormat("Removed wire event handlers on document\n", GrasshopperDocument.Objects.OfType<Grasshopper.Kernel.Special.GH_Group>().Count());

  }

  public void OnDeleteThisComponent(object sender, GH_DocObjectEventArgs e)
  {

    if (e.Objects.OfType<Grasshopper.Kernel.GH_Component>().Where(o => o.NickName == this.Component.NickName).Any())
    {
      DebugWrite("Removed template component. Removing all the eventhandlers");
      RemoveEventHandlers();
    }

  }

  public bool IdExists(int id)
  {
    IList<IGH_DocumentObject> objs = Grasshopper.Instances.ActiveCanvas.Document.Objects;
    return objs
      .OfType<IGH_Component>()
      .Where(ob => ob.NickName == this.Component.NickName)
      .Where(ob => ob.GetType().ToString() == "ScriptComponents.Component_CSNET_Script")
      .Where(ob => ob.Message == "id: " + id.ToString()).Any();

  }

  public void DebugWrite(string msg)
  {
    if (_debug)
    {
      Rhino.RhinoApp.WriteLine(String.Format("[FixWire {0}]: {1}", id, msg));
    }
  }
# ---------- end fixwires ----------

# ----
# processes to kill
panel_13 = Panel("""dctimestep
rcontrib
rtrace
oconv
rvu
rmtxop""")
kill = LBFalseStartToggle(False)

# ----
# Kill processes running on linux
panel_14 = Panel("pkill -f <instance>")
overrides = ApplyOverrides(Input=panel_14, Instance=graft(panel_13))  # -> Output, DynamicOutput
join = TextJoin(Text=flatten(overrides.Output), Join=";")
executessh = ExecuteSSH(_SSHCommands_=join, Run=kill, addPrefix=True, fireLogs=False, lastRunTime=0, suppressWarnings=False)  # -> Stdout, Stderr_, Ran
panel_15 = Panel(executessh.Stderr_)

# ----
# Keep biggest srf
# Colored skies! Why not?
# from https://discourse.radiance-online.org/t/new-tool-for-generating-colored-sky/5891
largest_brep = LargestBREP(window_breps=[<geometry referenced from the Rhino model> x224])

geo = Geometry(parserhinofile.GlassGeometries)
panel_16 = Panel("<Project>/ptsFiles/")
grid = GridCreate(
    Geometry=graft(parserhinofile.Grids),
    GridSize_m=1,
    VerticalOffset_m=0.75,
    EdgeOffset_m=0.5,
    IsoCurves=True,
    GoLarge=False)  # -> Grids, Mesh, Points, Normals

# ----
# Template methods
# By Mathias Sønderskov Schaltz 2022
# Check for updates here https://github.com/Sonderwoods/GrasshopperScribbles
panel_17 = Panel(colorgroups)
panel_18 = Panel(fixwires)
panel_19 = Panel(fixparams)

partition = PartitionList(List=flatten(grid.Points), Size="100")
partition_2 = PartitionList(List=flatten(grid.Normals), Size="100")
lng = ListLength(List=partition)  # -> flatten(Length)
python_2 = GhPythonScript(x=lng)  # -> a; inputs x: list of Int32
# ---------- python_2: Python ----------
__author__ = "mm1013"
__version__ = "2023.04.04"

import rhinoscriptsyntax as rs

a = []
v = 0
for i in x:
    a.append("points%03d.pts" % (v,))
    v += 1
# ---------- end python_2 ----------

# ----
# Other users, linux
panel_20 = Panel("w")
falsestart = LBFalseStartToggle(False)
falsestart_2 = LBFalseStartToggle(False)
executessh_2 = ExecuteSSH(
    _SSHCommands_="last -10 --ip",
    Run=falsestart_2,
    addPrefix=True,
    fireLogs=False,
    lastRunTime=0,
    name="Last Users",
    suppressWarnings=False,
    commands="last -10 --ip")  # -> Stdout, Stderr_, Ran
executessh_3 = ExecuteSSH(
    _SSHCommands_=panel_20,
    Run=falsestart,
    addPrefix=True,
    fireLogs=False,
    lastRunTime=0,
    name="Who is logged in",
    suppressWarnings=False,
    commands="w")  # -> Stdout, Stderr_, Ran
panel_21 = Panel(executessh_3.Stdout)
panel_22 = Panel(executessh_2.Stdout)

# ----
# Vertex order (and normal)
# 
# source : https://www.radiance-online.org/learning/tutorials/Tutorial-ThreePhaseMethod.pdf
image = ImageSampler(Filter="Colour", Interpolate=True, Umax=1, Umin=0, Vmax=1, Vmin=0, Wrap=1)  # disabled

# ----
# Dummy
swatch = ColourSwatch(SwatchColor=RGB(188, 118, 194))
nickname = GH_TestComponentColor(Color=swatch, SelColor=ColourSwatch(SwatchColor=RGB(191, 128, 128)))

# ----
# Check radiance
# Radiacnce versino
# check ssh login
panel_23 = Panel("head /usr/local/radiance/bin/rtpict -n 2")
# Read more
# 
# 
# Ambient cache
# https://discourse.radiance-online.org/t/what-data-does-ambfile-store/4785/2
toggle_3 = BooleanToggle(True)
panel_24 = Panel("""whoami
pwd""")
executessh_4 = ExecuteSSH(
    _SSHCommands_="genbox",
    Run=Toggle(True),
    addPrefix=True,
    fireLogs=False,
    lastRunTime=44.0549,
    suppressWarnings=False,
    stderr="Usage: genbox material name xsize ysize zsize [-i] [-b bevel | -r round [-n nsegs][-s]] [-o]",
    commands="genbox")  # -> Stdout, Stderr_, Ran
executessh_5 = ExecuteSSH(
    _SSHCommands_=panel_24,
    Run=toggle_3,
    addPrefix=True,
    fireLogs=False,
    lastRunTime=32.1466,
    suppressWarnings=False,
    results="""lio
/home/lio/MantaRay/Rikshospitalet""",
    commands="""whoami
pwd""")  # -> Stdout, Stderr_, Ran
executessh_6 = ExecuteSSH(
    _SSHCommands_=panel_23,
    Run=Toggle(True),
    addPrefix=True,
    fireLogs=False,
    lastRunTime=30.3332,
    suppressWarnings=False,
    results="""#!/usr/bin/perl -w
# RCSid $Id: rtpict.pl,v 2.25 2022/04/12 00:30:58 greg Exp $""",
    commands="head /usr/local/radiance/bin/rtpict -n 2")  # -> Stdout, Stderr_, Ran
panel_25 = Panel(executessh_4.Stdout)
panel_26 = Panel(executessh_4.Stderr_)
# FILE NAMES: *.vmx - view matrix (data)
# *.hdr - view matrix (renderings)
# *.dmx - daylight matrix
# *.skv - sky vector
# *.smx – sky matrix
# *.xml - transmission matrix (the file is xml format)
# 
# *.rad - radiance scene data
# *.oct - octree file
# *.vf - view file
# *.dat - data
# 
# source : https://www.radiance-online.org/learning/tutorials/Tutorial-ThreePhaseMethod.pdf
panel_27 = Panel(executessh_5.Stdout)
panel_28 = Panel(executessh_6.Stdout)

cluster = Cluster(mod=parserhinofile.GlassModifiers)  # -> name_geo, name_mod
cluster_2 = Cluster(mod=parserhinofile.OpaqueModifiers)  # -> name_geo, name_mod
panel_29 = Panel("""Doors
Frames""")
txt = Text(flatten([cluster.name_mod, cluster_2.name_mod]))
python_3 = GhPythonScript(x=txt, y=panel_29)  # -> out, ae; inputs x: list, y: list
# ---------- python_3: Python ----------
__author__ = "mm1013"
__version__ = "2023.04.04"

import rhinoscriptsyntax as rs

a = []

for xs in x:
    for ys in y:
        if ys.lower() in xs.lower():
            a.append(xs)
            break
ae = " -ae " + " -ae ".join(a)
# ---------- end python_3 ----------

# ----
# OCONV - Creation of Octrees
# Scene + 10klx overcast sky (RwR p357)
# # start of sky definition for daylighting studies
# # location name: COPENHAGEN_DNK LAT: 55.63
# !gensky 5 14 14.0 -c -a 55.63 -o -12.67 -m -15.0 | xform -rz 0.0
# skyfunc glow sky_mat
# 0
# 0
# 4
# 1 1 1 0
# sky_mat source sky
# 0
# 0
# 4
# 0 0 1 180
# skyfunc glow ground_glow
# 0
# 0
# 4
# 1 .8 .5 0
# ground_glow source ground
# 0
# 0
# 4
# 0 0 -1 180
# # end of sky definition for daylighting studies
falsestart_3 = LBFalseStartToggle(False)
and_append_the_ground = Panel("""##The 1 will be multiplie with brightfunc
skyfunc glow sky_glow
0
0
4 1 1 1 0

##Set to 1 as it will be multiplied with the gensky result
sky_glow source sky
0
0
4 0 0 1 180

##Set to 1 as it will be multiplied with the gensky result
skyfunc glow ground_glow
0
0
4 1 1 1 0

##The ground pane
ground_glow source ground
0
0
4 0 0 -1 180""")
bool = Boolean(falsestart_3)
executessh_7 = ExecuteSSH(
    _SSHCommands_="gensky -ang 45 0 -c -B 55.866",
    Run=bool,
    addPrefix=True,
    fireLogs=False,
    lastRunTime=43,
    suppressWarnings=False,
    results="""# gensky -ang 45 0 -c -B 55.866
# Ground ambient level: 17.8

void brightfunc skyfunc
2 skybr skybright.cal
0
3 2 2.29e+01 3.56e+00""",
    commands="gensky -ang 45 0 -c -B 55.866")  # -> Stdout, Stderr_, Ran
concat = Concatenate(FragmentC="##Will control the gradient of the sky", FragmentA=executessh_7.Stdout, FragmentB=and_append_the_ground)
panel_30 = Panel(concat)
panel_31 = Panel("""mkdir -p skies/
echo "<sky>" > skies/<target>
echo "skies/<target>"
""")
overrides_2 = ApplyOverrides(Input=panel_31, Sky=graft(panel_30), Target=graft("overcast_sky.rad"))  # -> Output, DynamicOutput
executessh_8 = ExecuteSSH(
    _SSHCommands_=overrides_2.DynamicOutput,
    Run=executessh_7.Ran,
    addPrefix=True,
    description="""mkdir -p skies/
echo "##Will control the gradient of the sky
# gensky -ang 45 0 -c -B 55.866
# Ground ambient level: 17.8

void brightfunc skyfunc
2 skybr skybright.cal
0
3 2 2.29e+01 3.56e+00

##The 1 will be multiplie with brightfunc
skyfunc glow sky_glow
0
0
4 1 1 1 0

##Set to 1 as it will be multiplied with the gensky result
sky_glow source sky
0
0
4 0 0 1 180

##Set to 1 as it will be multiplied with the gensky result
skyfunc glow ground_glow
0
0
4 1 1 1 0

##The ground pane
ground_glow source ground
0
0
4 0 0 -1 180" > skies/overcast_sky.rad
echo "skies/overcast_sky.rad"
""",
    fireLogs=False,
    lastRunTime=57,
    suppressWarnings=False,
    results="""_JOIN_
_JOIN_
skies/overcast_sky.rad""",
    commands="""mkdir -p skies/
_JOIN_
echo "##Will control the gradient of the sky
# gensky -ang 45 0 -c -B 55.866
# Ground ambient level: 17.8

void brightfunc skyfunc
2 skybr skybright.cal
0
3 2 2.29e+01 3.56e+00

##The 1 will be multiplie with brightfunc
skyfunc glow sky_glow
0
0
4 1 1 1 0

##Set to 1 as it will be multiplied with the gensky result
sky_glow source sky
0
0
4 0 0 1 180

##Set to 1 as it will be multiplied with the gensky result
skyfunc glow ground_glow
0
0
4 1 1 1 0

##The ground pane
ground_glow source ground
0
0
4 0 0 -1 180" > skies/overcast_sky.rad
_JOIN_
echo "skies/overcast_sky.rad"
""")  # -> Stdout, Stderr_, Ran
panel_32 = Panel(overrides_2.DynamicOutput)
panel_33 = Panel(executessh_8.Stderr_)
sky_ovc = Text(executessh_8.Stdout)

# ----
# Scene + 10 sunny skies (SET LAT AND LON)
panel_34 = Panel("gensky 7 4 <h>:00CEST +s -a <lat> -o <lon>")
falsestart_4 = LBFalseStartToggle(False)
series = Series(Start=8, Step=1, Count=10)
overrides_3 = ApplyOverrides(Input=panel_34, H=graft(series), Lat=graft("59.9"), Lon=graft("10.7"))  # -> Output, DynamicOutput
bool_2 = Boolean(falsestart_4)
and_append_the_ground_2 = Panel("""##The 1 will be multiplie with brightfunc
skyfunc glow sky_glow
0
0
4 1 1 1 0

##Set to 1 as it will be multiplied with the gensky result
sky_glow source sky
0
0
4 0 0 1 180

##Set to 1 as it will be multiplied with the gensky result
skyfunc glow ground_glow
0
0
4 1 1 1 0

##The ground pane
ground_glow source ground
0
0
4 0 0 -1 180""")
executessh_9 = ExecuteSSH(
    _SSHCommands_=overrides_3.DynamicOutput,
    Run=bool_2,
    addPrefix=True,
    description="""gensky 7 4 8:00CEST +s -a 59.9 -o 10.7


- - -

gensky 7 4 9:00CEST +s -a 59.9 -o 10.7


- - -

gensky 7 4 10:00CEST +s -a 59.9 -o 10.7


- - -

gensky 7 4 11:00CEST +s -a 59.9 -o 10.7


- - -

gensky 7 4 12:00CEST +s -a 59.9 -o 10.7


- - -

gensky 7 4 13:00CEST +s -a 59.9 -o 10.7


- - -

gensky 7 4 14:00CEST +s -a 59.9 -o 10.7


- - -

gensky 7 4 15:00CEST +s -a 59.9 -o 10.7


- - -

gensky 7 4 16:00CEST +s -a 59.9 -o 10.7


- - -

gensky 7 4 17:00CEST +s -a 59.9 -o 10.7""",
    fireLogs=False,
    lastRunTime=39,
    suppressWarnings=False,
    results=["""# gensky 7 4 8:00CEST +s -a 59.9 -o 10.7
# Local solar time: 5.22
# Solar altitude and azimuth: 14.1 -111.6
# Ground ambient level: 8.8

void light solar
0
0
3 3.92e+06 3.92e+06 3.92e+06

solar source sun
0
0
4 0.901641 0.357186 0.243849 0.5

void brightfunc skyfunc
2 skybr skybright.cal
0
7 1 3.81e+00 5.41e+00 3.08e-01 0.901641 0.357186 0.243849""", """# gensky 7 4 9:00CEST +s -a 59.9 -o 10.7
# Local solar time: 6.22
# Solar altitude and azimuth: 21.4 -99.3
# Ground ambient level: 10.8

void light solar
0
0
3 5.36e+06 5.36e+06 5.36e+06

solar source sun
0
0
4 0.919246 0.149788 0.364073 0.5

void brightfunc skyfunc
2 skybr skybright.cal
0
7 1 4.88e+00 9.62e+00 3.41e-01 0.919246 0.149788 0.364073""", """# gensky 7 4 10:00CEST +s -a 59.9 -o 10.7
# Local solar time: 7.22
# Solar altitude and azimuth: 28.8 -86.4
# Ground ambient level: 12.6

void light solar
0
0
3 6.07e+06 6.07e+06 6.07e+06

solar source sun
0
0
4 0.874207 -0.054485 0.482486 0.5

void brightfunc skyfunc
2 skybr skybright.cal
0
7 1 6.11e+00 1.37e+01 3.90e-01 0.874207 -0.054485 0.482486""", """# gensky 7 4 11:00CEST +s -a 59.9 -o 10.7
# Local solar time: 8.22
# Solar altitude and azimuth: 36.2 -72.6
# Ground ambient level: 13.8

void light solar
0
0
3 6.48e+06 6.48e+06 6.48e+06

solar source sun
0
0
4 0.769592 -0.241712 0.591018 0.5

void brightfunc skyfunc
2 skybr skybright.cal
0
7 1 7.51e+00 1.74e+01 4.56e-01 0.769592 -0.241712 0.591018""", """# gensky 7 4 12:00CEST +s -a 59.9 -o 10.7
# Local solar time: 9.22
# Solar altitude and azimuth: 43.0 -56.9
# Ground ambient level: 14.6

void light solar
0
0
3 6.72e+06 6.72e+06 6.72e+06

solar source sun
0
0
4 0.612531 -0.399135 0.682273 0.5

void brightfunc skyfunc
2 skybr skybright.cal
0
7 1 9.05e+00 2.04e+01 5.41e-01 0.612531 -0.399135 0.682273""", """# gensky 7 4 13:00CEST +s -a 59.9 -o 10.7
# Local solar time: 10.22
# Solar altitude and azimuth: 48.6 -38.7
# Ground ambient level: 15.0

void light solar
0
0
3 6.86e+06 6.86e+06 6.86e+06

solar source sun
0
0
4 0.413727 -0.516025 0.750032 0.5

void brightfunc skyfunc
2 skybr skybright.cal
0
7 1 1.06e+01 2.26e+01 6.32e-01 0.413727 -0.516025 0.750032"""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],
    commands=["gensky 7 4 12:00CEST +s -a 59.9 -o 10.7", "gensky 7 4 8:00CEST +s -a 59.9 -o 10.7", "gensky 7 4 9:00CEST +s -a 59.9 -o 10.7", "gensky 7 4 13:00CEST +s -a 59.9 -o 10.7", "gensky 7 4 15:00CEST +s -a 59.9 -o 10.7", "gensky 7 4 16:00CEST +s -a 59.9 -o 10.7", "gensky 7 4 17:00CEST +s -a 59.9 -o 10.7"])  # -> Stdout, Stderr_, Ran
panel_35 = Panel(executessh_9.Stdout)
concat_2 = Concatenate(FragmentC="##Will control the gradient of the sky", FragmentA=executessh_9.Stdout, FragmentB=and_append_the_ground_2)
panel_36 = Panel("""mkdir -p skies/
echo "<sky>" > skies/<target>
echo "skies/<target>"
""")
overrides_4 = ApplyOverrides(Input=panel_36, Sky=graft(concat_2), Target=graft("sunny_sky_<h>.rad"), H=graft(series))  # -> Output, DynamicOutput
executessh_10 = ExecuteSSH(
    _SSHCommands_=overrides_4.DynamicOutput,
    Run=executessh_9.Ran,
    addPrefix=True,
    description="""mkdir -p skies/
echo "##Will control the gradient of the sky
# gensky 7 4 8:00CEST +s -a 59.9 -o 10.7
# Local solar time: 5.22
# Solar altitude and azimuth: 14.1 -111.6
# Ground ambient level: 8.8

void light solar
0
0
3 3.92e+06 3.92e+06 3.92e+06

solar source sun
0
0
4 0.901641 0.357186 0.243849 0.5

void brightfunc skyfunc
2 skybr skybright.cal
0
7 1 3.81e+00 5.41e+00 3.08e-01 0.901641 0.357186 0.243849

##The 1 will be multiplie with brightfunc
skyfunc glow sky_glow
0
0
4 1 1 1 0

##Set to 1 as it will be multiplied with the gensky result
sky_glow source sky
0
0
4 0 0 1 180

##Set to 1 as it will be multiplied with the gensky result
skyfunc glow ground_glow
0
0
4 1 1 1 0

##The ground pane
ground_glow source ground
0
0
4 0 0 -1 180" > skies/sunny_sky_8.rad
echo "skies/sunny_sky_8.rad"


- - -

mkdir -p skies/
echo "##Will control the gradient of the sky
# gensky 7 4 9:00CEST +s -a 59.9 -o 10.7
# Local solar time: 6.22
# Solar altitude and azimuth: 21.4 -99.3
# Ground ambient level: 10.8

void light solar
0
0
3 5.36e+06 5.36e+06 5.36e+06

solar source sun
0
0
4 0.919246 0.149788 0.364073 0.5

void brightfunc skyfunc
2 skybr skybright.cal
0
7 1 4.88e+00 9.62e+00 3.41e-01 0.919246 0.149788 0.364073

##The 1 will be multiplie with brightfunc
skyfunc glow sky_glow
0
0
4 1 1 1 0

##Set to 1 as it will be multiplied with the gensky result
sky_glow source sky
0
0
4 0 0 1 180

##Set to 1 as it will be multiplied with the gensky result
skyfunc glow ground_glow
0
0
4 1 1 1 0

##The ground pane
ground_glow source ground
0
0
4 0 0 -1 180" > skies/sunny_sky_9.rad
echo "skies/sunny_sky_9.rad"


- - -

mkdir -p skies/
echo "##Will control the gradient of the sky
# gensky 7 4 10:00CEST +s -a 59.9 -o 10.7
# Local solar time: 7.22
# Solar altitude and azimuth: 28.8 -86.4
# Ground ambient level: 12.6

void light solar
0
0
3 6.07e+06 6.07e+06 6.07e+06

solar source sun
0
0
4 0.874207 -0.054485 0.482486 0.5

void brightfunc skyfunc
2 skybr skybright.cal
0
7 1 6.11e+00 1.37e+01 3.90e-01 0.874207 -0.054485 0.482486

##The 1 will be multiplie with brightfunc
skyfunc glow sky_glow
0
0
4 1 1 1 0

##Set to 1 as it will be multiplied with the gensky result
sky_glow source sky
0
0
4 0 0 1 180

##Set to 1 as it will be multiplied with the gensky result
skyfunc glow ground_glow
0
0
4 1 1 1 0

##The ground pane
ground_glow source ground
0
0
4 0 0 -1 180" > skies/sunny_sky_10.rad
echo "skies/sunny_sky_10.rad"


- - -

mkdir -p skies/
echo "##Will control the gradient of the sky
# gensky 7 4 11:00CEST +s -a 59.9 -o 10.7
# Local solar time: 8.22
# Solar altitude and azimuth: 36.2 -72.6
# Ground ambient level: 13.8

void light solar
0
0
3 6.48e+06 6.48e+06 6.48e+06

solar source sun
0
0
4 0.769592 -0.241712 0.591018 0.5

void brightfunc skyfunc
2 skybr skybright.cal
0
7 1 7.51e+00 1.74e+01 4.56e-01 0.769592 -0.241712 0.591018

##The 1 will be multiplie with brightfunc
skyfunc glow sky_glow
0
0
4 1 1 1 0

##Set to 1 as it will be multiplied with the gensky result
sky_glow source sky
0
0
4 0 0 1 180

##Set to 1 as it will be multiplied with the gensky result
skyfunc glow ground_glow
0
0
4 1 1 1 0

##The ground pane
ground_glow source ground
0
0
4 0 0 -1 180" > skies/sunny_sky_11.rad
echo "skies/sunny_sky_11.rad"


- - -

mkdir -p skies/
echo "##Will control the gradient of the sky
# gensky 7 4 12:00CEST +s -a 59.9 -o 10.7
# Local solar time: 9.22
# Solar altitude and azimuth: 43.0 -56.9
# Ground ambient level: 14.6

void light solar
0
0
3 6.72e+06 6.72e+06 6.72e+06

solar source sun
0
0
4 0.612531 -0.399135 0.682273 0.5

void brightfunc skyfunc
2 skybr skybright.cal
0
7 1 9.05e+00 2.04e+01 5.41e-01 0.612531 -0.399135 0.682273

##The 1 will be multiplie with brightfunc
skyfunc glow sky_glow
0
0
4 1 1 1 0

##Set to 1 as it will be multiplied with the gensky result
sky_glow source sky
0
0
4 0 0 1 180

##Set to 1 as it will be multiplied with the gensky result
skyfunc glow ground_glow
0
0
4 1 1 1 0

##The ground pane
ground_glow source ground
0
0
4 0 0 -1 180" > skies/sunny_sky_12.rad
echo "skies/sunny_sky_12.rad"


- - -

mkdir -p skies/
echo "##Will control the gradient of the sky
# gensky 7 4 13:00CEST +s -a 59.9 -o 10.7
# Local solar time: 10.22
# Solar altitude and azimuth: 48.6 -38.7
# Ground ambient level: 15.0

void light solar
0
0
3 6.86e+06 6.86e+06 6.86e+06

solar source sun
0
0
4 0.413727 -0.516025 0.750032 0.5

void brightfunc skyfunc
2 skybr skybright.cal
0
7 1 1.06e+01 2.26e+01 6.32e-01 0.413727 -0.516025 0.750032

##The 1 will be multiplie with brightfunc
skyfunc glow sky_glow
0
0
4 1 1 1 0

##Set to 1 as it will be multiplied with the gensky result
sky_glow source sky
0
0
4 0 0 1 180

##Set to 1 as it will be multiplied with the gensky result
skyfunc glow ground_glow
0
0
4 1 1 1 0

##The ground pane
ground_glow source ground
0
0
4 0 0 -1 180" > skies/sunny_sky_13.rad
echo "skies/sunny_sky_13.rad"


- - -

mkdir -p skies/
echo "##Will control the gradient of the sky
# gensky 7 4 14:00CEST +s -a 59.9 -o 10.7
# Local solar time: 11.22
# Solar altitude and azimuth: 52.2 -17.7
# Ground ambient level: 15.1

void light solar
0
0
3 6.93e+06 6.93e+06 6.93e+06

solar source sun
0
0
4 0.186727 -0.584417 0.789677 0.5

void brightfunc skyfunc
2 skybr skybright.cal
0
7 1 1.18e+01 2.39e+01 7.04e-01 0.186727 -0.584417 0.789677

##The 1 will be multiplie with brightfunc
skyfunc glow sky_glow
0
0
4 1 1 1 0

##Set to 1 as it will be multiplied with the gensky result
sky_glow source sky
0
0
4 0 0 1 180

##Set to 1 as it will be multiplied with the gensky result
skyfunc glow ground_glow
0
0
4 1 1 1 0

##The ground pane
ground_glow source ground
0
0
4 0 0 -1 180" > skies/sunny_sky_14.rad
echo "skies/sunny_sky_14.rad"


- - -

mkdir -p skies/
echo "##Will control the gradient of the sky
# gensky 7 4 15:00CEST +s -a 59.9 -o 10.7
# Local solar time: 12.22
# Solar altitude and azimuth: 53.0 5.1
# Ground ambient level: 15.2

void light solar
0
0
3 6.94e+06 6.94e+06 6.94e+06

solar source sun
0
0
4 -0.052997 -0.599649 0.798507 0.5

void brightfunc skyfunc
2 skybr skybright.cal
0
7 1 1.21e+01 2.42e+01 7.23e-01 -0.052997 -0.599649 0.798507

##The 1 will be multiplie with brightfunc
skyfunc glow sky_glow
0
0
4 1 1 1 0

##Set to 1 as it will be multiplied with the gensky result
sky_glow source sky
0
0
4 0 0 1 180

##Set to 1 as it will be multiplied with the gensky result
skyfunc glow ground_glow
0
0
4 1 1 1 0

##The ground pane
ground_glow source ground
0
0
4 0 0 -1 180" > skies/sunny_sky_15.rad
echo "skies/sunny_sky_15.rad"


- - -

mkdir -p skies/
echo "##Will control the gradient of the sky
# gensky 7 4 16:00CEST +s -a 59.9 -o 10.7
# Local solar time: 13.22
# Solar altitude and azimuth: 50.9 27.3
# Ground ambient level: 15.1

void light solar
0
0
3 6.91e+06 6.91e+06 6.91e+06

solar source sun
0
0
4 -0.289110 -0.560683 0.775919 0.5

void brightfunc skyfunc
2 skybr skybright.cal
0
7 1 1.13e+01 2.35e+01 6.77e-01 -0.289110 -0.560683 0.775919

##The 1 will be multiplie with brightfunc
skyfunc glow sky_glow
0
0
4 1 1 1 0

##Set to 1 as it will be multiplied with the gensky result
sky_glow source sky
0
0
4 0 0 1 180

##Set to 1 as it will be multiplied with the gensky result
skyfunc glow ground_glow
0
0
4 1 1 1 0

##The ground pane
ground_glow source ground
0
0
4 0 0 -1 180" > skies/sunny_sky_16.rad
echo "skies/sunny_sky_16.rad"


- - -

mkdir -p skies/
echo "##Will control the gradient of the sky
# gensky 7 4 17:00CEST +s -a 59.9 -o 10.7
# Local solar time: 14.22
# Solar altitude and azimuth: 46.3 47.1
# Ground ambient level: 14.8

void light solar
0
0
3 6.81e+06 6.81e+06 6.81e+06

solar source sun
0
0
4 -0.505520 -0.470175 0.723454 0.5

void brightfunc skyfunc
2 skybr skybright.cal
0
7 1 9.93e+00 2.18e+01 5.92e-01 -0.505520 -0.470175 0.723454

##The 1 will be multiplie with brightfunc
skyfunc glow sky_glow
0
0
4 1 1 1 0

##Set to 1 as it will be multiplied with the gensky result
sky_glow source sky
0
0
4 0 0 1 180

##Set to 1 as it will be multiplied with the gensky result
skyfunc glow ground_glow
0
0
4 1 1 1 0

##The ground pane
ground_glow source ground
0
0
4 0 0 -1 180" > skies/sunny_sky_17.rad
echo "skies/sunny_sky_17.rad"
""",
    fireLogs=False,
    lastRunTime=45,
    suppressWarnings=False,
    results=["""_JOIN_
_JOIN_
~/MantaRay/TestingRemote/skies/sunny_sky_8.rad""", """_JOIN_
_JOIN_
~/MantaRay/TestingRemote/skies/sunny_sky_9.rad""", """_JOIN_
_JOIN_
~/MantaRay/TestingRemote/skies/sunny_sky_10.rad""", """_JOIN_
_JOIN_
~/MantaRay/TestingRemote/skies/sunny_sky_11.rad""", """_JOIN_
_JOIN_
~/MantaRay/TestingRemote/skies/sunny_sky_12.rad""", """_JOIN_
_JOIN_
~/MantaRay/TestingRemote/skies/sunny_sky_13.rad""", """_JOIN_
_JOIN_
~/MantaRay/TestingRemote/skies/sunny_sky_14.rad""", """_JOIN_
_JOIN_
~/MantaRay/TestingRemote/skies/sunny_sky_15.rad""", """_JOIN_
_JOIN_
~/MantaRay/TestingRemote/skies/sunny_sky_16.rad""", """_JOIN_
_JOIN_
~/MantaRay/TestingRemote/skies/sunny_sky_17.rad"""],
    commands=["""mkdir -p ~/MantaRay/TestingRemote/skies/
_JOIN_
echo "##Will control the gradient of the sky
# gensky 7 4 10:00CEST +s -a 59.9 -o 10.7
# Local solar time: 7.22
# Solar altitude and azimuth: 28.8 -86.4
# Ground ambient level: 12.6

void light solar
0
0
3 6.07e+06 6.07e+06 6.07e+06

solar source sun
0
0
4 0.874207 -0.054485 0.482486 0.5

void brightfunc skyfunc
2 skybr skybright.cal
0
7 1 6.11e+00 1.37e+01 3.90e-01 0.874207 -0.054485 0.482486

##The 1 will be multiplie with brightfunc
skyfunc glow sky_glow
0
0
4 1 1 1 0

##Set to 1 as it will be multiplied with the gensky result
sky_glow source sky
0
0
4 0 0 1 180

##Set to 1 as it will be multiplied with the gensky result
skyfunc glow ground_glow
0
0
4 1 1 1 0

##The ground pane
ground_glow source ground
0
0
4 0 0 -1 180" > ~/MantaRay/TestingRemote/skies/sunny_sky_10.rad
_JOIN_
echo "~/MantaRay/TestingRemote/skies/sunny_sky_10.rad"
""", """mkdir -p ~/MantaRay/TestingRemote/skies/
_JOIN_
echo "##Will control the gradient of the sky
# gensky 7 4 9:00CEST +s -a 59.9 -o 10.7
# Local solar time: 6.22
# Solar altitude and azimuth: 21.4 -99.3
# Ground ambient level: 10.8

void light solar
0
0
3 5.36e+06 5.36e+06 5.36e+06

solar source sun
0
0
4 0.919246 0.149788 0.364073 0.5

void brightfunc skyfunc
2 skybr skybright.cal
0
7 1 4.88e+00 9.62e+00 3.41e-01 0.919246 0.149788 0.364073

##The 1 will be multiplie with brightfunc
skyfunc glow sky_glow
0
0
4 1 1 1 0

##Set to 1 as it will be multiplied with the gensky result
sky_glow source sky
0
0
4 0 0 1 180

##Set to 1 as it will be multiplied with the gensky result
skyfunc glow ground_glow
0
0
4 1 1 1 0

##The ground pane
ground_glow source ground
0
0
4 0 0 -1 180" > ~/MantaRay/TestingRemote/skies/sunny_sky_9.rad
_JOIN_
echo "~/MantaRay/TestingRemote/skies/sunny_sky_9.rad"
""", """mkdir -p ~/MantaRay/TestingRemote/skies/
_JOIN_
echo "##Will control the gradient of the sky
# gensky 7 4 14:00CEST +s -a 59.9 -o 10.7
# Local solar time: 11.22
# Solar altitude and azimuth: 52.2 -17.7
# Ground ambient level: 15.1

void light solar
0
0
3 6.93e+06 6.93e+06 6.93e+06

solar source sun
0
0
4 0.186727 -0.584417 0.789677 0.5

void brightfunc skyfunc
2 skybr skybright.cal
0
7 1 1.18e+01 2.39e+01 7.04e-01 0.186727 -0.584417 0.789677

##The 1 will be multiplie with brightfunc
skyfunc glow sky_glow
0
0
4 1 1 1 0

##Set to 1 as it will be multiplied with the gensky result
sky_glow source sky
0
0
4 0 0 1 180

##Set to 1 as it will be multiplied with the gensky result
skyfunc glow ground_glow
0
0
4 1 1 1 0

##The ground pane
ground_glow source ground
0
0
4 0 0 -1 180" > ~/MantaRay/TestingRemote/skies/sunny_sky_14.rad
_JOIN_
echo "~/MantaRay/TestingRemote/skies/sunny_sky_14.rad"
""", """mkdir -p ~/MantaRay/TestingRemote/skies/
_JOIN_
echo "##Will control the gradient of the sky
# gensky 7 4 12:00CEST +s -a 59.9 -o 10.7
# Local solar time: 9.22
# Solar altitude and azimuth: 43.0 -56.9
# Ground ambient level: 14.6

void light solar
0
0
3 6.72e+06 6.72e+06 6.72e+06

solar source sun
0
0
4 0.612531 -0.399135 0.682273 0.5

void brightfunc skyfunc
2 skybr skybright.cal
0
7 1 9.05e+00 2.04e+01 5.41e-01 0.612531 -0.399135 0.682273

##The 1 will be multiplie with brightfunc
skyfunc glow sky_glow
0
0
4 1 1 1 0

##Set to 1 as it will be multiplied with the gensky result
sky_glow source sky
0
0
4 0 0 1 180

##Set to 1 as it will be multiplied with the gensky result
skyfunc glow ground_glow
0
0
4 1 1 1 0

##The ground pane
ground_glow source ground
0
0
4 0 0 -1 180" > ~/MantaRay/TestingRemote/skies/sunny_sky_12.rad
_JOIN_
echo "~/MantaRay/TestingRemote/skies/sunny_sky_12.rad"
""", """mkdir -p ~/MantaRay/TestingRemote/skies/
_JOIN_
echo "##Will control the gradient of the sky
# gensky 7 4 8:00CEST +s -a 59.9 -o 10.7
# Local solar time: 5.22
# Solar altitude and azimuth: 14.1 -111.6
# Ground ambient level: 8.8

void light solar
0
0
3 3.92e+06 3.92e+06 3.92e+06

solar source sun
0
0
4 0.901641 0.357186 0.243849 0.5

void brightfunc skyfunc
2 skybr skybright.cal
0
7 1 3.81e+00 5.41e+00 3.08e-01 0.901641 0.357186 0.243849

##The 1 will be multiplie with brightfunc
skyfunc glow sky_glow
0
0
4 1 1 1 0

##Set to 1 as it will be multiplied with the gensky result
sky_glow source sky
0
0
4 0 0 1 180

##Set to 1 as it will be multiplied with the gensky result
skyfunc glow ground_glow
0
0
4 1 1 1 0

##The ground pane
ground_glow source ground
0
0
4 0 0 -1 180" > ~/MantaRay/TestingRemote/skies/sunny_sky_8.rad
_JOIN_
echo "~/MantaRay/TestingRemote/skies/sunny_sky_8.rad"
""", """mkdir -p ~/MantaRay/TestingRemote/skies/
_JOIN_
echo "##Will control the gradient of the sky
# gensky 7 4 16:00CEST +s -a 59.9 -o 10.7
# Local solar time: 13.22
# Solar altitude and azimuth: 50.9 27.3
# Ground ambient level: 15.1

void light solar
0
0
3 6.91e+06 6.91e+06 6.91e+06

solar source sun
0
0
4 -0.289110 -0.560683 0.775919 0.5

void brightfunc skyfunc
2 skybr skybright.cal
0
7 1 1.13e+01 2.35e+01 6.77e-01 -0.289110 -0.560683 0.775919

##The 1 will be multiplie with brightfunc
skyfunc glow sky_glow
0
0
4 1 1 1 0

##Set to 1 as it will be multiplied with the gensky result
sky_glow source sky
0
0
4 0 0 1 180

##Set to 1 as it will be multiplied with the gensky result
skyfunc glow ground_glow
0
0
4 1 1 1 0

##The ground pane
ground_glow source ground
0
0
4 0 0 -1 180" > ~/MantaRay/TestingRemote/skies/sunny_sky_16.rad
_JOIN_
echo "~/MantaRay/TestingRemote/skies/sunny_sky_16.rad"
"""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])  # -> Stdout, Stderr_, Ran
item = ListItem(List=executessh_10.Stdout, Index=0, Wrap=True)  # -> Item1, Item
python_4 = GhPythonScript(x=series)  # -> a; inputs x: Int32
# ---------- python_4: Python ----------
__author__ = "mm1013"
__version__ = "2022.08.30"

import rhinoscriptsyntax as rs

a = "%02d00" % x
# ---------- end python_4 ----------
hours = Number(python_4)
hours_2 = Text(python_4)

overrides_5 = ApplyOverrides(Input="cat <target>", Target=graft(executessh_8.Stdout))  # -> Output, DynamicOutput
executessh_11 = ExecuteSSH(
    _SSHCommands_=overrides_5.Output,
    Run=False,
    addPrefix=True,
    fireLogs=False,
    lastRunTime=0,
    suppressWarnings=False,
    results="""##Will control the gradient of the sky
# gensky -ang 45 0 -c -B 55.866
# Ground ambient level: 17.8

void brightfunc skyfunc
2 skybr skybright.cal
0
3 2 2.29e+01 3.56e+00

##The 1 will be multiplie with brightfunc
skyfunc glow sky_glow
0
0
4 1 1 1 0

##Set to 1 as it will be multiplied with the gensky result
sky_glow source sky
0
0
4 0 0 1 180

##Set to 1 as it will be multiplied with the gensky result
skyfunc glow ground_glow
0
0
4 1 1 1 0

##The ground pane
ground_glow source ground
0
0
4 0 0 -1 180""",
    commands="cat ~/MantaRay/UnnamedProject/skies/overcast_sky.rad")  # -> Stdout, Stderr_, Ran
panel_37 = Panel(executessh_11.Stdout)

overrides_6 = ApplyOverrides(Input="head <target>", Target=graft(item.Item1))  # -> Output, DynamicOutput
executessh_12 = ExecuteSSH(
    _SSHCommands_=overrides_6.DynamicOutput,
    Run=executessh_10.Ran,
    addPrefix=True,
    description="""head ~/MantaRay/TestingRemote/skies/sunny_sky_8.rad


- - -

head ~/MantaRay/TestingRemote/skies/sunny_sky_9.rad


- - -

head ~/MantaRay/TestingRemote/skies/sunny_sky_10.rad


- - -

head ~/MantaRay/TestingRemote/skies/sunny_sky_11.rad


- - -

head ~/MantaRay/TestingRemote/skies/sunny_sky_12.rad


- - -

head ~/MantaRay/TestingRemote/skies/sunny_sky_13.rad


- - -

head ~/MantaRay/TestingRemote/skies/sunny_sky_14.rad


- - -

head ~/MantaRay/TestingRemote/skies/sunny_sky_15.rad


- - -

head ~/MantaRay/TestingRemote/skies/sunny_sky_16.rad


- - -

head ~/MantaRay/TestingRemote/skies/sunny_sky_17.rad""",
    fireLogs=False,
    lastRunTime=40,
    suppressWarnings=False,
    results=["""##Will control the gradient of the sky
# gensky 7 4 8:00CEST +s -a 59.9 -o 10.7
# Local solar time: 5.22
# Solar altitude and azimuth: 14.1 -111.6
# Ground ambient level: 8.8

void light solar
0
0
3 3.92e+06 3.92e+06 3.92e+06""", """##Will control the gradient of the sky
# gensky 7 4 9:00CEST +s -a 59.9 -o 10.7
# Local solar time: 6.22
# Solar altitude and azimuth: 21.4 -99.3
# Ground ambient level: 10.8

void light solar
0
0
3 5.36e+06 5.36e+06 5.36e+06""", """##Will control the gradient of the sky
# gensky 7 4 10:00CEST +s -a 59.9 -o 10.7
# Local solar time: 7.22
# Solar altitude and azimuth: 28.8 -86.4
# Ground ambient level: 12.6

void light solar
0
0
3 6.07e+06 6.07e+06 6.07e+06""", """##Will control the gradient of the sky
# gensky 7 4 11:00CEST +s -a 59.9 -o 10.7
# Local solar time: 8.22
# Solar altitude and azimuth: 36.2 -72.6
# Ground ambient level: 13.8

void light solar
0
0
3 6.48e+06 6.48e+06 6.48e+06""", """##Will control the gradient of the sky
# gensky 7 4 12:00CEST +s -a 59.9 -o 10.7
# Local solar time: 9.22
# Solar altitude and azimuth: 43.0 -56.9
# Ground ambient level: 14.6

void light solar
0
0
3 6.72e+06 6.72e+06 6.72e+06""", """##Will control the gradient of the sky
# gensky 7 4 13:00CEST +s -a 59.9 -o 10.7
# Local solar time: 10.22
# Solar altitude and azimuth: 48.6 -38.7
# Ground ambient level: 15.0

void light solar
0
0
3 6.86e+06 6.86e+06 6.86e+06""", """##Will control the gradient of the sky
# gensky 7 4 14:00CEST +s -a 59.9 -o 10.7
# Local solar time: 11.22
# Solar altitude and azimuth: 52.2 -17.7
# Ground ambient level: 15.1

void light solar
0
0
3 6.93e+06 6.93e+06 6.93e+06""", """##Will control the gradient of the sky
# gensky 7 4 15:00CEST +s -a 59.9 -o 10.7
# Local solar time: 12.22
# Solar altitude and azimuth: 53.0 5.1
# Ground ambient level: 15.2

void light solar
0
0
3 6.94e+06 6.94e+06 6.94e+06""", """##Will control the gradient of the sky
# gensky 7 4 16:00CEST +s -a 59.9 -o 10.7
# Local solar time: 13.22
# Solar altitude and azimuth: 50.9 27.3
# Ground ambient level: 15.1

void light solar
0
0
3 6.91e+06 6.91e+06 6.91e+06""", """##Will control the gradient of the sky
# gensky 7 4 17:00CEST +s -a 59.9 -o 10.7
# Local solar time: 14.22
# Solar altitude and azimuth: 46.3 47.1
# Ground ambient level: 14.8

void light solar
0
0
3 6.81e+06 6.81e+06 6.81e+06"""],
    commands=["head ~/MantaRay/TestingRemote/skies/sunny_sky_8.rad", "head ~/MantaRay/TestingRemote/skies/sunny_sky_9.rad", "head ~/MantaRay/TestingRemote/skies/sunny_sky_11.rad", "head ~/MantaRay/TestingRemote/skies/sunny_sky_10.rad", "head ~/MantaRay/TestingRemote/skies/sunny_sky_12.rad", "head ~/MantaRay/TestingRemote/skies/sunny_sky_13.rad", "head ~/MantaRay/TestingRemote/skies/sunny_sky_15.rad", "head ~/MantaRay/TestingRemote/skies/sunny_sky_14.rad", "head ~/MantaRay/TestingRemote/skies/sunny_sky_17.rad"])  # -> Stdout, Stderr_, Ran
panel_38 = Panel(executessh_12.Stdout)

ae_frames = Text(python_3.ae)
falsestart_5 = LBFalseStartToggle(False)
overrides_7 = ApplyOverrides()  # -> Output, DynamicOutput

falsestart_6 = LBFalseStartToggle(False)

overrides_8 = ApplyOverrides()  # -> Output, DynamicOutput
executessh_13 = ExecuteSSH(Run=False, addPrefix=True, fireLogs=False, lastRunTime=0, suppressWarnings=False)  # -> Stdout, Stderr_, Ran
overrides_9 = ApplyOverrides()  # -> Output, DynamicOutput
executessh_14 = ExecuteSSH(Run=False, addPrefix=True, fireLogs=False, lastRunTime=0, suppressWarnings=False)  # -> Stdout, Stderr_, Ran
overrides_10 = ApplyOverrides()  # -> Output, DynamicOutput
executessh_15 = ExecuteSSH(Run=False, addPrefix=True, fireLogs=False, lastRunTime=0, suppressWarnings=False)  # -> Stdout, Stderr_, Ran

view = CreateView(Viewport="Perspective")  # -> ViewfileContent, ImageRatio
panel_39 = Panel("""mkdir -p <proj>/views/
echo "<vf>" > <proj>/views/<target>.vf
echo <proj>/views/<target>.vf""")
concat_3 = Concatenate(FragmentA="Perspective", FragmentB="3")
vf = Text(view.ViewfileContent)
panel_40 = Panel(view.ViewfileContent)
overrides_11 = ApplyOverrides(Input=panel_39, Vf=graft(vf), Target=graft(concat_3))  # -> Output, DynamicOutput
executessh_16 = ExecuteSSH(
    _SSHCommands_=overrides_11.DynamicOutput,
    Run=Toggle(True),
    addPrefix=True,
    description="""mkdir -p ~/MantaRay/Rikshospitalet/views/
echo "rvu -vtv -vp 75.5197777614021 9.89092850558018 3.98572082775036 -vd -0.0917128823950573 0.977503100394468 -0.189937979145807 -vu -0.017742746895685 0.189107458484822 0.981796090885479 -vh 100.097 -vv 50.000" > ~/MantaRay/Rikshospitalet/views/Perspective3.vf
echo ~/MantaRay/Rikshospitalet/views/Perspective3.vf""",
    fireLogs=False,
    lastRunTime=31.1182,
    suppressWarnings=False,
    results="/home/lio/MantaRay/Rikshospitalet/views/Perspective3.vf",
    commands="""mkdir -p ~/MantaRay/Rikshospitalet/views/
echo "rvu -vtv -vp 75.5197777614021 9.89092850558018 3.98572082775036 -vd -0.0917128823950573 0.977503100394468 -0.189937979145807 -vu -0.017742746895685 0.189107458484822 0.981796090885479 -vh 100.097 -vv 50.000" > ~/MantaRay/Rikshospitalet/views/Perspective3.vf
echo ~/MantaRay/Rikshospitalet/views/Perspective3.vf""")  # -> Stdout, Stderr_, Ran
viewname = Text(concat_3)

falsestart_7 = LBFalseStartToggle(False)

# ----
# img size
target_res = ValueList({"750x330": 750, "1500x750": 1500, "3000x1500": 3000, "5000x2500": 5000, "7000x3500": 7000, "8000x4000": 8000}, selected="750x330")
division = Division(A=target_res, B=2)
x = RemoteSender(target_res)
y = RemoteSender(division)

view_2 = CreateView(Viewport="Perspective")  # -> ViewfileContent, ImageRatio
panel_41 = Panel("""mkdir -p views/
echo "<vf>" > views/<target>.vf
echo views/<target>.vf""")
panel_42 = Panel(view_2.ViewfileContent)
concat_4 = Concatenate(FragmentA="Perspective", FragmentB="2")
vf_2 = Text(view_2.ViewfileContent)
overrides_12 = ApplyOverrides(Input=panel_41, Vf=graft(vf_2), Target=graft(concat_4))  # -> Output, DynamicOutput
executessh_17 = ExecuteSSH(
    _SSHCommands_=overrides_12.DynamicOutput,
    Run=Toggle(True),
    addPrefix=True,
    description="""mkdir -p views/
echo "rvu -vtv -vp 75.5197777614021 9.89092850558018 3.98572082775036 -vd -0.0917128823950573 0.977503100394468 -0.189937979145807 -vu -0.017742746895685 0.189107458484822 0.981796090885479 -vh 100.097 -vv 50.000" > views/Perspective2.vf
echo views/Perspective2.vf""",
    fireLogs=False,
    lastRunTime=30.1575,
    suppressWarnings=False,
    results="views/Perspective2.vf",
    commands="""mkdir -p views/
echo "rvu -vtv -vp 75.5197777614021 9.89092850558018 3.98572082775036 -vd -0.0917128823950573 0.977503100394468 -0.189937979145807 -vu -0.017742746895685 0.189107458484822 0.981796090885479 -vh 100.097 -vv 50.000" > views/Perspective2.vf
echo views/Perspective2.vf""")  # -> Stdout, Stderr_, Ran
viewname_2 = Text(concat_4)

# ----
# Set focus zone to RAD
# to calculate parameters
type = ValueList({"Interior": "I", "Exterior": "E"}, selected="Exterior")
zone = Box({Plane=PlaneXY(67.34687306, 14.8177948, 0), X=Domain(0, 14.49025655), Y=Domain(0, 18.20965901), Z=Domain(0, 13.53214381)})
zone_2 = GhPythonScript(zoneBox=zone, type=type)  # -> out, zone; inputs zoneBox: Box
# ---------- zone_2: Python ----------
__author__ = "mm1013"
__version__ = "2022.10.06"

import rhinoscriptsyntax as rs
import Rhino.Geometry as rg

import Grasshopper.Kernel as gh

#e = gh.GH_RuntimeMessageLevel.Error
w = gh.GH_RuntimeMessageLevel.Warning

zone =""

testPlane = rg.Plane(rg.Point3d(0,0,0), zoneBox.Plane.XAxis, zoneBox.Plane.YAxis)
if testPlane != rg.Plane.WorldXY:
    ghenv.Component.AddRuntimeMessage(w, "Bounding box must have XY as base plane")
else:
    zone = "ZONE={type} {Xmin:.2f} {Xmax:.2f} {Ymin:.2f} {Ymax:.2f} {Zmin:.2f} {Zmax:.2f}\n".format( \
    type=type, Xmin = zoneBox.X.Min, Xmax = zoneBox.X.Max, Ymin = zoneBox.Y.Min, Ymax = zoneBox.Y.Max, Zmin = zoneBox.Z.Min, Zmax = zoneBox.Z.Max)
# ---------- end zone_2 ----------

# ----
# changed paths. untested
panel_43 = Panel("""rpict= rtpict -af <af>.af -n <cpus>
RESOLUTION=1700
QUALITY=M
DETAIL=H
EXPOSURE=+0.0
UP= Z
INDIRECT=2
VARIABILITY=H
REPORT= 1
<zone>
OCTREE=<oct>
view=<vn> -vf <v>""")
panel_44 = Panel("""mkdir -p settings
echo "<RIF>" > settings/<target>
rad -n -s <target> OPTFILE=settings/render.opt
echo settings/render.opt""")

panel_45 = Panel("~/MantaRay/Andrei/images/2023_03_12_2232_rtpict_rendering_aa0_5000_sunny_ad32_0/radiance.hdr")

resolution = ValueList({"750x330": 750, "1500x750": 1500, "3000x1500": 3000, "5000x2500": 5000, "7000x3500": 7000, "8000x4000": 8000, "16000x8000": 16000, "20000x12000": 20000}, selected="750x330")
x_2 = Number(resolution)

falsestart_8 = LBFalseStartToggle(False)
download = Download(SftpPaths=panel_45, Run=falsestart_8, stdouts="C:\Users\mm1013\MantaRay\Andrei\radiance.hdr")  # -> FilePaths, Status, Ran
supersampling = Panel("4")
y_2 = RemoteReceiver(y)
x_3 = RemoteReceiver(x)
multiplication = Multiplication(A=x_3, B=supersampling)
multiplication_2 = Multiplication(A=y_2, B=supersampling)

# ----
# attempt to do overcast discretized sky (rtcontrib tutorial p20)
panel_46 = Panel("gensky 3 21 10 -c -a 51 -o 0 -m 0 -b 22.86")  # disabled
falsestart_9 = LBFalseStartToggle(False)  # disabled
panel_47 = Panel("""gensky 3 21 10 -c -a 51 -o 0 -m 0 -b 22.86 \
|rcalc -i '3 2 <zenithbr> <groundbr>' \
-e '$1=<groundbr>'""")  # disabled
executessh_18 = ExecuteSSH(
    _SSHCommands_=panel_46,
    Run=falsestart_9,
    addPrefix=True,
    fireLogs=False,
    lastRunTime=76,
    suppressWarnings=False,
    results="""# gensky 3 21 10 -c -a 51 -o 0 -m 0 -b 22.86
# Local solar time: 9.88
# Solar altitude and azimuth: 31.9 -38.5
# Ground ambient level: 17.8

void brightfunc skyfunc
2 skybr skybright.cal
0
3 2 2.29e+01 3.56e+00""",
    commands="gensky 3 21 10 -c -a 51 -o 0 -m 0 -b 22.86")  # -> Stdout, Stderr_, Ran; disabled
python_5 = GhPythonScript(x=executessh_18.Stdout)  # -> a; disabled
# ---------- python_5: Python ----------
__author__ = "mm1013"
__version__ = "2022.09.27"

import rhinoscriptsyntax as rs

a = float(x.split("\n")[3].split(" ")[-1])
# ---------- end python_5 ----------
python_6 = GhPythonScript(x=executessh_18.Stdout)  # -> a; disabled
# ---------- python_6: Python ----------
__author__ = "mm1013"
__version__ = "2022.09.27"

import rhinoscriptsyntax as rs

a = float(x.split(" ")[-2])
# ---------- end python_6 ----------
panel_48 = Panel(executessh_18.Stdout)  # disabled
overrides_13 = ApplyOverrides(Input=panel_47, Zenithbr=graft(python_6), Groundbr=graft(python_5))  # -> Output, DynamicOutput; disabled
executessh_19 = ExecuteSSH(
    _SSHCommands_=overrides_13.Output,
    Run=executessh_18.Ran,
    addPrefix=True,
    fireLogs=False,
    lastRunTime=62,
    suppressWarnings=False,
    stderr="3 2 22.9 17.8: cannot open",
    commands="""gensky 3 21 10 -c -a 51 -o 0 -m 0 -b 22.86 \
|rcalc -i '3 2 22.9 17.8' \
-e '$1=17.8'""")  # -> Stdout, Stderr_, Ran; disabled
panel_49 = Panel(executessh_19.Stderr_)  # disabled

panel_50 = Panel("""pkill rtpict
pkill rtrace
pkill rpict""")
executessh_20 = ExecuteSSH(
    _SSHCommands_=panel_50,
    Run=Button(),
    addPrefix=True,
    fireLogs=False,
    lastRunTime=65,
    suppressWarnings=False,
    commands="""pkill rtpict
pkill rtrace
pkill rpict""")  # -> Stdout, Stderr_, Ran

panel_51 = Panel("""pfilt -e -1 <hdr> > <hdr-.>_exposed2.hdr
ra_tiff <hdr-.>_exposed2.hdr <hdr-.>_exposed2.tif
convert <hdr-.>_exposed2.tif <hdr-.>_exposed2.png
echo <hdr-.>_exposed2.png""")
logviewer_2 = LogViewer(Number=10)  # -> CurrentTasks, Logs
default = DefaultMSS(
    data=flatten(["date", "top -b -n1 | grep \"Cpu(s)\" | awk '{print $2 + $4}'"]),
    default_value_flattened=flatten(logviewer_2.CurrentTasks))
overrides_14 = ApplyOverrides()  # -> Output, DynamicOutput

panel_52 = Panel("head <ill> -n 13;echo \" \";echo \"Number of lines\";wc -l <ill>")

overrides_15 = ApplyOverrides()  # -> Output, DynamicOutput

panel_53 = Panel("head <ill> -n 13;echo \" \";echo \"Number of lines\";wc -l <ill>")

panel_54 = Panel("head <ill> -n 13;echo \" \";echo \"Number of lines\";wc -l <ill>")

falsestart_10 = LBFalseStartToggle(False)
panel_55 = Panel("""pwd
ls""")
falsestart_11 = LBFalseStartToggle(False)
falsestart_12 = LBFalseStartToggle(False)
executessh_21 = ExecuteSSH(_SSHCommands_=default, Run=falsestart_10, addPrefix=True, fireLogs=False, lastRunTime=64, suppressWarnings=False)  # -> Stdout, Stderr_, Ran
executessh_22 = ExecuteSSH(
    _SSHCommands_=panel_55,
    Run=falsestart_11,
    addPrefix=True,
    fireLogs=False,
    lastRunTime=63,
    suppressWarnings=False,
    results="""/home/lio/MantaRay/TestFolder
ambFiles
ambfileX_2023_03_31_2028_36.af
ambfileX_2023_03_31_2030_52.af
ambfileX_2023_03_31_2030_54.af
ambfileX_2023_03_31_2031_00.af
ambfileX_2023_03_31_2032_15.af
ambfileX_2023_03_31_2032_43.af
ambfileX_2023_03_31_2032_50.af
ambfileX_2023_03_31_2032_53.af
ambientFiles
images
myRender_exposed.hdr
myRender_exposed.png
myRender_exposed.tif
myRender.hdr
myRender_overture.hdr
objFiles
octrees
radFiles
render.opt
scene.rif
skies
views""",
    commands="""pwd
ls""")  # -> Stdout, Stderr_, Ran

# ---- group: Outdated
overrides_16 = ApplyOverrides(Input=panel_54)  # -> Output, Pairs

overrides_17 = ApplyOverrides(Input=panel_53)  # -> Output, Pairs

applyglobals = ApplyGlobals(Input=panel_52, AdditionalKeys="ill")  # -> Output, Pairs

# ----
overrides_18 = ApplyOverrides()  # -> Output, DynamicOutput
overrides_19 = ApplyOverrides()  # -> Output, DynamicOutput
overrides_20 = ApplyOverrides()  # -> Output, DynamicOutput
cpu_usage = Panel(executessh_21.Stdout)
pwd = Panel(executessh_22.Stdout)

falsestart_13 = LBFalseStartToggle(False)

# ----
# Test an overcast sky illuminance at a horizontal surface (RiR)
# try running below on your windows machine if you have RVU setup.
# It should show the sky seen from below
panel_56 = Panel("PureSky_Overcast10klux.oct")
panel_57 = Panel("""mkdir -p <proj>/octrees/
oconv -r 2048 -w -f <rads> > <proj>/octrees/<target>
echo <proj>/octrees/<target>""")
sky_ovc_2 = Text(sky_ovc)
panel_58 = Panel("echo \"0 0 0 0 0 1\" | rtrace -h -w -I+ -w -ab 1 -ad 10000 <oct> | rcalc -e '$1=($1*0.265+$2*0.670+$3*0.065)*179'")
overrides_21 = ApplyOverrides(Input=panel_57, Rads=graft(sky_ovc_2), Target=graft(panel_56))  # -> Output, DynamicOutput
executessh_23 = ExecuteSSH(
    _SSHCommands=overrides_21.DynamicOutput,
    Run=falsestart_13,
    addPrefix=True,
    description="""mkdir -p ~/MantaRay/Rikshospitalet/octrees/
oconv -r 2048 -w -f skies/overcast_sky.rad > ~/MantaRay/Rikshospitalet/octrees/PureSky_Overcast10klux.oct
echo ~/MantaRay/Rikshospitalet/octrees/PureSky_Overcast10klux.oct""",
    fireLogs=True,
    lastRunTime=66,
    name="oconv PureSky_Overcast10klux.oct",
    staticDescription="""mkdir -p ~/MantaRay/Andrei/octrees/
oconv -r 2048 -w -f ~/MantaRay/Andrei/skies/overcast_sky.rad ~/MantaRay/Andrei/radFiles/Glass_70.mat /home/lio/MantaRay/Andrei/radFiles/Glass_70_geo.rad ~/MantaRay/Andrei/radFiles/opaque_materials.mat /home/lio/MantaRay/Andrei/radFiles/FloorMat_0.7_geo.rad /home/lio/MantaRay/Andrei/radFiles/Cladding_0.5_geo.rad /home/lio/MantaRay/Andrei/radFiles/ConcreteWhite_0.8_geo.rad /home/lio/MantaRay/Andrei/radFiles/ConcreteStructure_0.3_geo.rad /home/lio/MantaRay/Andrei/radFiles/ConcreteGrey_0.5_geo.rad /home/lio/MantaRay/Andrei/radFiles/IntWalls_0.9_geo.rad /home/lio/MantaRay/Andrei/radFiles/Pipes_0.03_geo.rad /home/lio/MantaRay/Andrei/radFiles/ConcreteDarker_0.1_geo.rad /home/lio/MantaRay/Andrei/radFiles/Frames_0.6_geo.rad /home/lio/MantaRay/Andrei/radFiles/Black_0.01_geo.rad /home/lio/MantaRay/Andrei/radFiles/CurvedCeiling_0.8_geo.rad /home/lio/MantaRay/Andrei/radFiles/IntWalls_0.8_geo.rad /home/lio/MantaRay/Andrei/radFiles/FloorBox_0.75_geo.rad ~/MantaRay/Andrei/radFiles/other_materials.mat > ~/MantaRay/Andrei/octrees/Scene_Overcast10klux.oct
echo ~/MantaRay/Andrei/octrees/Scene_Overcast10klux.oct""",
    suppressWarnings=False,
    results="/home/lio/MantaRay/TestFolder/octrees/PureSky_Overcast10klux.oct",
    commands="""mkdir -p ~/MantaRay/TestFolder/octrees/
oconv -r 2048 -w -f ~/MantaRay/TestFolder/skies/overcast_sky.rad > ~/MantaRay/TestFolder/octrees/PureSky_Overcast10klux.oct
echo ~/MantaRay/TestFolder/octrees/PureSky_Overcast10klux.oct""")  # -> Stdout, Stderr_, Ran
overrides_22 = ApplyOverrides(Input=panel_58, Oct=graft(executessh_23.Stdout))  # -> Output, DynamicOutput
download_2 = Download(
    SftpPaths=executessh_23.Stdout,
    Run=executessh_23.Ran,
    stdouts="C:\Users\mm1013\MantaRay\TestFolder\PureSky_Overcast10klux.oct")  # -> FilePaths, Status, Ran
panel_59 = Panel("rvu -vta -vp 0 0 0 -vd 0 0 1 -vu 0 1 0 -vh 180 -vv 180 <oct>")
panel_60 = Panel(download_2.FilePaths)
executessh_24 = ExecuteSSH(
    _SSHCommands_=overrides_22.DynamicOutput,
    Run=executessh_23.Ran,
    addPrefix=True,
    description="echo \"0 0 0 0 0 1\" | rtrace -h -w -I+ -w -ab 1 -ad 10000 /home/lio/MantaRay/TestFolder/octrees/PureSky_Overcast10klux.oct | rcalc -e '$1=($1*0.265+$2*0.670+$3*0.065)*179'",
    fireLogs=False,
    lastRunTime=74,
    suppressWarnings=False,
    results="10003.449",
    commands="echo \"0 0 0 0 0 1\" | rtrace -h -w -I+ -w -ab 1 -ad 10000 /home/lio/MantaRay/TestFolder/octrees/PureSky_Overcast10klux.oct | rcalc -e '$1=($1*0.265+$2*0.670+$3*0.065)*179'")  # -> Stdout, Stderr_, Ran
_10000_lux_wohoo = Panel(executessh_24.Stdout)
overrides_23 = ApplyOverrides(Input=panel_59, Oct=graft(panel_60))  # -> Output, DynamicOutput
panel_61 = Panel(overrides_23.Output)

x_4 = RemoteReceiver(x)

# ---- group: Extracted Coordinates
pt = Point([Point(811, 630, 0), Point(812, 668, 0), Point(814, 715, 0), Point(816, 753, 0), Point(816, 798, 0), Point(1312, 468, 0), Point(1308, 506, 0), Point(1305, 547, 0), Point(1305, 574, 0), Point(1299, 606, 0), Point(1627, 410, 0), Point(1619, 440, 0), Point(1614, 468, 0), Point(1608, 500, 0), Point(132, 21, 0)])  # disabled

# ----
overrides_24 = ApplyOverrides()  # -> Output, DynamicOutput

panel_62 = Panel("""0
0
0
0
0
0
0
0
1
1
1
1
1
1
1
1
1
1
0
0
0
0
0
0""")
int = Integer(panel_62)
dup = DuplicateData(Data=int, Number="365", Order=True)

download_3 = Download()  # -> FilePaths, Status, Ran

# ----
# Create working folder
panel_63 = Panel("""mkdir -p <proj>
mkdir -p <proj>/radFiles
mkdir -p <proj>/objFiles""")
overrides_25 = ApplyOverrides(Input=panel_63)  # -> Output, DynamicOutput

# ----
# Overview of all running tasks in linux
panel_64 = Panel("ps -aux | grep '<AllRadProgs>'")
logviewer_3 = LogViewer(Number=10)  # -> CurrentTasks, Logs
default_2 = DefaultMSS(data=flatten(panel_64), default_value_flattened=flatten(logviewer_3.CurrentTasks))
panel_65 = Panel(logviewer_3.Logs)

executessh_25 = ExecuteSSH(
    _SSHCommands_=default_2,
    Run=Toggle(True),
    addPrefix=True,
    fireLogs=False,
    lastRunTime=25.7069,
    suppressWarnings=False,
    results="""USER         PID %CPU %MEM    VSZ   RSS TTY      STAT START   TIME COMMAND
root           1  0.0  0.0 168368  8592 ?        Ss   Mar31   0:08 /sbin/init
root           2  0.0  0.0      0     0 ?        S    Mar31   0:00 [kthreadd]
root           3  0.0  0.0      0     0 ?        I<   Mar31   0:00 [rcu_gp]
root           4  0.0  0.0      0     0 ?        I<   Mar31   0:00 [rcu_par_gp]
root           6  0.0  0.0      0     0 ?        I<   Mar31   0:00 [kworker/0:0H-events_highpri]
root           8  0.0  0.0      0     0 ?        I<   Mar31   0:00 [mm_percpu_wq]
root           9  0.0  0.0      0     0 ?        S    Mar31   0:02 [ksoftirqd/0]
root          10  0.0  0.0      0     0 ?        I    Mar31   0:26 [rcu_sched]
root          11  0.0  0.0      0     0 ?        S    Mar31   0:03 [migration/0]
root          12  0.0  0.0      0     0 ?        S    Mar31   0:00 [idle_inject/0]
root          14  0.0  0.0      0     0 ?        S    Mar31   0:00 [cpuhp/0]
root          15  0.0  0.0      0     0 ?        S    Mar31   0:00 [cpuhp/1]
root          16  0.0  0.0      0     0 ?        S    Mar31   0:00 [idle_inject/1]
root          17  0.0  0.0      0     0 ?        S    Mar31   0:03 [migration/1]
root          18  0.0  0.0      0     0 ?        S    Mar31   0:00 [ksoftirqd/1]
root          20  0.0  0.0      0     0 ?        I<   Mar31   0:00 [kworker/1:0H]
root          21  0.0  0.0      0     0 ?        S    Mar31   0:00 [cpuhp/2]
root          22  0.0  0.0      0     0 ?        S    Mar31   0:00 [idle_inject/2]
root          23  0.0  0.0      0     0 ?        S    Mar31   0:02 [migration/2]
root          24  0.0  0.0      0     0 ?        S    Mar31   0:00 [ksoftirqd/2]
root          26  0.0  0.0      0     0 ?        I<   Mar31   0:00 [kworker/2:0H-kblockd]
root          27  0.0  0.0      0     0 ?        S    Mar31   0:00 [cpuhp/3]
root          28  0.0  0.0      0     0 ?        S    Mar31   0:00 [idle_inject/3]
root          29  0.0  0.0      0     0 ?        S    Mar31   0:02 [migration/3]
root          30  0.0  0.0      0     0 ?        S    Mar31   0:00 [ksoftirqd/3]
root          31  0.0  0.0      0     0 ?        I    Mar31   0:00 [kworker/3:0-mm_percpu_wq]
root          32  0.0  0.0      0     0 ?        I<   Mar31   0:00 [kworker/3:0H-events_highpri]
root          33  0.0  0.0      0     0 ?        S    Mar31   0:00 [cpuhp/4]
root          34  0.0  0.0      0     0 ?        S    Mar31   0:00 [idle_inject/4]
root          35  0.0  0.0      0     0 ?        S    Mar31   0:02 [migration/4]
root          36  0.0  0.0      0     0 ?        S    Mar31   0:00 [ksoftirqd/4]
root          38  0.0  0.0      0     0 ?        I<   Mar31   0:00 [kworker/4:0H-kblockd]
root          39  0.0  0.0      0     0 ?        S    Mar31   0:00 [cpuhp/5]
root          40  0.0  0.0      0     0 ?        S    Mar31   0:00 [idle_inject/5]
root          41  0.0  0.0      0     0 ?        S    Mar31   0:02 [migration/5]
root          42  0.0  0.0      0     0 ?        S    Mar31   0:00 [ksoftirqd/5]
root          44  0.0  0.0      0     0 ?        I<   Mar31   0:00 [kworker/5:0H-events_highpri]
root          45  0.0  0.0      0     0 ?        S    Mar31   0:00 [cpuhp/6]
root          46  0.0  0.0      0     0 ?        S    Mar31   0:00 [idle_inject/6]
root          47  0.0  0.0      0     0 ?        S    Mar31   0:02 [migration/6]
root          48  0.0  0.0      0     0 ?        S    Mar31   0:00 [ksoftirqd/6]
root          50  0.0  0.0      0     0 ?        I<   Mar31   0:00 [kworker/6:0H-kblockd]
root          51  0.0  0.0      0     0 ?        S    Mar31   0:00 [cpuhp/7]
root          52  0.0  0.0      0     0 ?        S    Mar31   0:00 [idle_inject/7]
root          53  0.0  0.0      0     0 ?        S    Mar31   0:02 [migration/7]
root          54  0.0  0.0      0     0 ?        S    Mar31   0:00 [ksoftirqd/7]
root          56  0.0  0.0      0     0 ?        I<   Mar31   0:00 [kworker/7:0H-kblockd]
root          57  0.0  0.0      0     0 ?        S    Mar31   0:00 [cpuhp/8]
root          58  0.0  0.0      0     0 ?        S    Mar31   0:00 [idle_inject/8]
root          59  0.0  0.0      0     0 ?        S    Mar31   0:02 [migration/8]
root          60  0.0  0.0      0     0 ?        S    Mar31   0:00 [ksoftirqd/8]
root          62  0.0  0.0      0     0 ?        I<   Mar31   0:00 [kworker/8:0H-events_highpri]
root          63  0.0  0.0      0     0 ?        S    Mar31   0:00 [cpuhp/9]
root          64  0.0  0.0      0     0 ?        S    Mar31   0:00 [idle_inject/9]
root          65  0.0  0.0      0     0 ?        S    Mar31   0:02 [migration/9]
root          66  0.0  0.0      0     0 ?        S    Mar31   0:00 [ksoftirqd/9]
root          67  0.0  0.0      0     0 ?        I    Mar31   0:00 [kworker/9:0-rcu_gp]
root          68  0.0  0.0      0     0 ?        I<   Mar31   0:00 [kworker/9:0H-kblockd]
root          69  0.0  0.0      0     0 ?        S    Mar31   0:00 [cpuhp/10]
root          70  0.0  0.0      0     0 ?        S    Mar31   0:00 [idle_inject/10]
root          71  0.0  0.0      0     0 ?        S    Mar31   0:02 [migration/10]
root          72  0.0  0.0      0     0 ?        S    Mar31   0:00 [ksoftirqd/10]
root          74  0.0  0.0      0     0 ?        I<   Mar31   0:00 [kworker/10:0H-kblockd]
root          75  0.0  0.0      0     0 ?        S    Mar31   0:00 [cpuhp/11]
root          76  0.0  0.0      0     0 ?        S    Mar31   0:00 [idle_inject/11]
root          77  0.0  0.0      0     0 ?        S    Mar31   0:02 [migration/11]
root          78  0.0  0.0      0     0 ?        S    Mar31   0:00 [ksoftirqd/11]
root          80  0.0  0.0      0     0 ?        I<   Mar31   0:00 [kworker/11:0H-kblockd]
root          81  0.0  0.0      0     0 ?        S    Mar31   0:00 [cpuhp/12]
root          82  0.0  0.0      0     0 ?        S    Mar31   0:00 [idle_inject/12]
root          83  0.0  0.0      0     0 ?        S    Mar31   0:02 [migration/12]
root          84  0.0  0.0      0     0 ?        S    Mar31   0:00 [ksoftirqd/12]
root          86  0.0  0.0      0     0 ?        I<   Mar31   0:00 [kworker/12:0H-kblockd]
root          87  0.0  0.0      0     0 ?        S    Mar31   0:00 [cpuhp/13]
root          88  0.0  0.0      0     0 ?        S    Mar31   0:00 [idle_inject/13]
root          89  0.0  0.0      0     0 ?        S    Mar31   0:02 [migration/13]
root          90  0.0  0.0      0     0 ?        S    Mar31   0:00 [ksoftirqd/13]
root          92  0.0  0.0      0     0 ?        I<   Mar31   0:00 [kworker/13:0H-kblockd]
root          93  0.0  0.0      0     0 ?        S    Mar31   0:00 [cpuhp/14]
root          94  0.0  0.0      0     0 ?        S    Mar31   0:00 [idle_inject/14]
root          95  0.0  0.0      0     0 ?        S    Mar31   0:02 [migration/14]
root          96  0.0  0.0      0     0 ?        S    Mar31   0:00 [ksoftirqd/14]
root          98  0.0  0.0      0     0 ?        I<   Mar31   0:00 [kworker/14:0H-events_highpri]
root          99  0.0  0.0      0     0 ?        S    Mar31   0:00 [cpuhp/15]
root         100  0.0  0.0      0     0 ?        S    Mar31   0:00 [idle_inject/15]
root         101  0.0  0.0      0     0 ?        S    Mar31   0:02 [migration/15]
root         102  0.0  0.0      0     0 ?        S    Mar31   0:00 [ksoftirqd/15]
root         104  0.0  0.0      0     0 ?        I<   Mar31   0:00 [kworker/15:0H-events_highpri]
root         105  0.0  0.0      0     0 ?        S    Mar31   0:00 [cpuhp/16]
root         106  0.0  0.0      0     0 ?        S    Mar31   0:00 [idle_inject/16]
root         107  0.0  0.0      0     0 ?        S    Mar31   0:02 [migration/16]
root         108  0.0  0.0      0     0 ?        S    Mar31   0:00 [ksoftirqd/16]
root         110  0.0  0.0      0     0 ?        I<   Mar31   0:00 [kworker/16:0H-events_highpri]
root         111  0.0  0.0      0     0 ?        S    Mar31   0:00 [cpuhp/17]
root         112  0.0  0.0      0     0 ?        S    Mar31   0:00 [idle_inject/17]
root         113  0.0  0.0      0     0 ?        S    Mar31   0:02 [migration/17]
root         114  0.0  0.0      0     0 ?        S    Mar31   0:00 [ksoftirqd/17]
root         115  0.0  0.0      0     0 ?        I    Mar31   0:00 [kworker/17:0-mm_percpu_wq]
root         116  0.0  0.0      0     0 ?        I<   Mar31   0:00 [kworker/17:0H-events_highpri]
root         117  0.0  0.0      0     0 ?        S    Mar31   0:00 [cpuhp/18]
root         118  0.0  0.0      0     0 ?        S    Mar31   0:00 [idle_inject/18]
root         119  0.0  0.0      0     0 ?        S    Mar31   0:02 [migration/18]
root         120  0.0  0.0      0     0 ?        S    Mar31   0:00 [ksoftirqd/18]
root         122  0.0  0.0      0     0 ?        I<   Mar31   0:00 [kworker/18:0H-events_highpri]
root         123  0.0  0.0      0     0 ?        S    Mar31   0:00 [cpuhp/19]
root         124  0.0  0.0      0     0 ?        S    Mar31   0:00 [idle_inject/19]
root         125  0.0  0.0      0     0 ?        S    Mar31   0:02 [migration/19]
root         126  0.0  0.0      0     0 ?        S    Mar31   0:00 [ksoftirqd/19]
root         128  0.0  0.0      0     0 ?        I<   Mar31   0:00 [kworker/19:0H-kblockd]
root         129  0.0  0.0      0     0 ?        S    Mar31   0:00 [cpuhp/20]
root         130  0.0  0.0      0     0 ?        S    Mar31   0:00 [idle_inject/20]
root         131  0.0  0.0      0     0 ?        S    Mar31   0:02 [migration/20]
root         132  0.0  0.0      0     0 ?        S    Mar31   0:00 [ksoftirqd/20]
root         133  0.0  0.0      0     0 ?        I    Mar31   0:02 [kworker/20:0-cgroup_destroy]
root         134  0.0  0.0      0     0 ?        I<   Mar31   0:00 [kworker/20:0H-kblockd]
root         135  0.0  0.0      0     0 ?        S    Mar31   0:00 [cpuhp/21]
root         136  0.0  0.0      0     0 ?        S    Mar31   0:00 [idle_inject/21]
root         137  0.0  0.0      0     0 ?        S    Mar31   0:02 [migration/21]
root         138  0.0  0.0      0     0 ?        S    Mar31   0:00 [ksoftirqd/21]
root         140  0.0  0.0      0     0 ?        I<   Mar31   0:00 [kworker/21:0H-events_highpri]
root         141  0.0  0.0      0     0 ?        S    Mar31   0:00 [cpuhp/22]
root         142  0.0  0.0      0     0 ?        S    Mar31   0:00 [idle_inject/22]
root         143  0.0  0.0      0     0 ?        S    Mar31   0:02 [migration/22]
root         144  0.0  0.0      0     0 ?        S    Mar31   0:00 [ksoftirqd/22]
root         146  0.0  0.0      0     0 ?        I<   Mar31   0:00 [kworker/22:0H-events_highpri]
root         147  0.0  0.0      0     0 ?        S    Mar31   0:00 [cpuhp/23]
root         148  0.0  0.0      0     0 ?        S    Mar31   0:00 [idle_inject/23]
root         149  0.0  0.0      0     0 ?        S    Mar31   0:02 [migration/23]
root         150  0.0  0.0      0     0 ?        S    Mar31   0:00 [ksoftirqd/23]
root         152  0.0  0.0      0     0 ?        I<   Mar31   0:00 [kworker/23:0H-events_highpri]
root         153  0.0  0.0      0     0 ?        S    Mar31   0:00 [cpuhp/24]
root         154  0.0  0.0      0     0 ?        S    Mar31   0:00 [idle_inject/24]
root         155  0.0  0.0      0     0 ?        S    Mar31   0:02 [migration/24]
root         156  0.0  0.0      0     0 ?        S    Mar31   0:00 [ksoftirqd/24]
root         158  0.0  0.0      0     0 ?        I<   Mar31   0:00 [kworker/24:0H-events_highpri]
root         159  0.0  0.0      0     0 ?        S    Mar31   0:00 [cpuhp/25]
root         160  0.0  0.0      0     0 ?        S    Mar31   0:00 [idle_inject/25]
root         161  0.0  0.0      0     0 ?        S    Mar31   0:03 [migration/25]
root         162  0.0  0.0      0     0 ?        S    Mar31   0:00 [ksoftirqd/25]
root         164  0.0  0.0      0     0 ?        I<   Mar31   0:00 [kworker/25:0H-events_highpri]
root         165  0.0  0.0      0     0 ?        S    Mar31   0:00 [cpuhp/26]
root         166  0.0  0.0      0     0 ?        S    Mar31   0:00 [idle_inject/26]
root         167  0.0  0.0      0     0 ?        S    Mar31   0:02 [migration/26]
root         168  0.0  0.0      0     0 ?        S    Mar31   0:00 [ksoftirqd/26]
root         170  0.0  0.0      0     0 ?        I<   Mar31   0:00 [kworker/26:0H-events_highpri]
root         171  0.0  0.0      0     0 ?        S    Mar31   0:00 [cpuhp/27]
root         172  0.0  0.0      0     0 ?        S    Mar31   0:00 [idle_inject/27]
root         173  0.0  0.0      0     0 ?        S    Mar31   0:03 [migration/27]
root         174  0.0  0.0      0     0 ?        S    Mar31   0:00 [ksoftirqd/27]
root         175  0.0  0.0      0     0 ?        I    Mar31   0:00 [kworker/27:0-mm_percpu_wq]
root         176  0.0  0.0      0     0 ?        I<   Mar31   0:00 [kworker/27:0H-events_highpri]
root         177  0.0  0.0      0     0 ?        S    Mar31   0:00 [cpuhp/28]
root         178  0.0  0.0      0     0 ?        S    Mar31   0:00 [idle_inject/28]
root         179  0.0  0.0      0     0 ?        S    Mar31   0:02 [migration/28]
root         180  0.0  0.0      0     0 ?        S    Mar31   0:00 [ksoftirqd/28]
root         182  0.0  0.0      0     0 ?        I<   Mar31   0:00 [kworker/28:0H-events_highpri]
root         183  0.0  0.0      0     0 ?        S    Mar31   0:00 [cpuhp/29]
root         184  0.0  0.0      0     0 ?        S    Mar31   0:00 [idle_inject/29]
root         185  0.0  0.0      0     0 ?        S    Mar31   0:02 [migration/29]
root         186  0.0  0.0      0     0 ?        S    Mar31   0:00 [ksoftirqd/29]
root         187  0.0  0.0      0     0 ?        I    Mar31   0:00 [kworker/29:0-mm_percpu_wq]
root         188  0.0  0.0      0     0 ?        I<   Mar31   0:00 [kworker/29:0H-events_highpri]
root         189  0.0  0.0      0     0 ?        S    Mar31   0:00 [cpuhp/30]
root         190  0.0  0.0      0     0 ?        S    Mar31   0:00 [idle_inject/30]
root         191  0.0  0.0      0     0 ?        S    Mar31   0:02 [migration/30]
root         192  0.0  0.0      0     0 ?        S    Mar31   0:00 [ksoftirqd/30]
root         194  0.0  0.0      0     0 ?        I<   Mar31   0:00 [kworker/30:0H-events_highpri]
root         195  0.0  0.0      0     0 ?        S    Mar31   0:00 [cpuhp/31]
root         196  0.0  0.0      0     0 ?        S    Mar31   0:00 [idle_inject/31]
root         197  0.0  0.0      0     0 ?        S    Mar31   0:02 [migration/31]
root         198  0.0  0.0      0     0 ?        S    Mar31   0:00 [ksoftirqd/31]
root         200  0.0  0.0      0     0 ?        I<   Mar31   0:00 [kworker/31:0H-events_highpri]
root         201  0.0  0.0      0     0 ?        S    Mar31   0:00 [cpuhp/32]
root         202  0.0  0.0      0     0 ?        S    Mar31   0:00 [idle_inject/32]
root         203  0.0  0.0      0     0 ?        S    Mar31   0:02 [migration/32]
root         204  0.0  0.0      0     0 ?        S    Mar31   0:00 [ksoftirqd/32]
root         206  0.0  0.0      0     0 ?        I<   Mar31   0:00 [kworker/32:0H-kblockd]
root         207  0.0  0.0      0     0 ?        S    Mar31   0:00 [cpuhp/33]
root         208  0.0  0.0      0     0 ?        S    Mar31   0:00 [idle_inject/33]
root         209  0.0  0.0      0     0 ?        S    Mar31   0:02 [migration/33]
root         210  0.0  0.0      0     0 ?        S    Mar31   0:00 [ksoftirqd/33]
root         212  0.0  0.0      0     0 ?        I<   Mar31   0:00 [kworker/33:0H-kblockd]
root         213  0.0  0.0      0     0 ?        S    Mar31   0:00 [cpuhp/34]
root         214  0.0  0.0      0     0 ?        S    Mar31   0:00 [idle_inject/34]
root         215  0.0  0.0      0     0 ?        S    Mar31   0:02 [migration/34]
root         216  0.0  0.0      0     0 ?        S    Mar31   0:00 [ksoftirqd/34]
root         218  0.0  0.0      0     0 ?        I<   Mar31   0:00 [kworker/34:0H-kblockd]
root         219  0.0  0.0      0     0 ?        S    Mar31   0:00 [cpuhp/35]
root         220  0.0  0.0      0     0 ?        S    Mar31   0:00 [idle_inject/35]
root         221  0.0  0.0      0     0 ?        S    Mar31   0:02 [migration/35]
root         222  0.0  0.0      0     0 ?        S    Mar31   0:00 [ksoftirqd/35]
root         224  0.0  0.0      0     0 ?        I<   Mar31   0:00 [kworker/35:0H-kblockd]
root         225  0.0  0.0      0     0 ?        S    Mar31   0:00 [cpuhp/36]
root         226  0.0  0.0      0     0 ?        S    Mar31   0:00 [idle_inject/36]
root         227  0.0  0.0      0     0 ?        S    Mar31   0:02 [migration/36]
root         228  0.0  0.0      0     0 ?        S    Mar31   0:00 [ksoftirqd/36]
root         230  0.0  0.0      0     0 ?        I<   Mar31   0:00 [kworker/36:0H-events_highpri]
root         231  0.0  0.0      0     0 ?        S    Mar31   0:00 [cpuhp/37]
root         232  0.0  0.0      0     0 ?        S    Mar31   0:00 [idle_inject/37]
root         233  0.0  0.0      0     0 ?        S    Mar31   0:02 [migration/37]
root         234  0.0  0.0      0     0 ?        S    Mar31   0:00 [ksoftirqd/37]
root         236  0.0  0.0      0     0 ?        I<   Mar31   0:00 [kworker/37:0H-kblockd]
root         237  0.0  0.0      0     0 ?        S    Mar31   0:00 [cpuhp/38]
root         238  0.0  0.0      0     0 ?        S    Mar31   0:00 [idle_inject/38]
root         239  0.0  0.0      0     0 ?        S    Mar31   0:02 [migration/38]
root         240  0.0  0.0      0     0 ?        S    Mar31   0:00 [ksoftirqd/38]
root         242  0.0  0.0      0     0 ?        I<   Mar31   0:00 [kworker/38:0H-events_highpri]
root         243  0.0  0.0      0     0 ?        S    Mar31   0:00 [cpuhp/39]
root         244  0.0  0.0      0     0 ?        S    Mar31   0:00 [idle_inject/39]
root         245  0.0  0.0      0     0 ?        S    Mar31   0:02 [migration/39]
root         246  0.0  0.0      0     0 ?        S    Mar31   0:00 [ksoftirqd/39]
root         248  0.0  0.0      0     0 ?        I<   Mar31   0:00 [kworker/39:0H-events_highpri]
root         249  0.0  0.0      0     0 ?        S    Mar31   0:00 [cpuhp/40]
root         250  0.0  0.0      0     0 ?        S    Mar31   0:00 [idle_inject/40]
root         251  0.0  0.0      0     0 ?        S    Mar31   0:02 [migration/40]
root         252  0.0  0.0      0     0 ?        S    Mar31   0:00 [ksoftirqd/40]
root         254  0.0  0.0      0     0 ?        I<   Mar31   0:00 [kworker/40:0H-events_highpri]
root         255  0.0  0.0      0     0 ?        S    Mar31   0:00 [cpuhp/41]
root         256  0.0  0.0      0     0 ?        S    Mar31   0:00 [idle_inject/41]
root         257  0.0  0.0      0     0 ?        S    Mar31   0:02 [migration/41]
root         258  0.0  0.0      0     0 ?        S    Mar31   0:00 [ksoftirqd/41]
root         260  0.0  0.0      0     0 ?        I<   Mar31   0:00 [kworker/41:0H-events_highpri]
root         261  0.0  0.0      0     0 ?        S    Mar31   0:00 [cpuhp/42]
root         262  0.0  0.0      0     0 ?        S    Mar31   0:00 [idle_inject/42]
root         263  0.0  0.0      0     0 ?        S    Mar31   0:03 [migration/42]
root         264  0.0  0.0      0     0 ?        S    Mar31   0:00 [ksoftirqd/42]
root         266  0.0  0.0      0     0 ?        I<   Mar31   0:00 [kworker/42:0H-events_highpri]
root         267  0.0  0.0      0     0 ?        S    Mar31   0:00 [cpuhp/43]
root         268  0.0  0.0      0     0 ?        S    Mar31   0:00 [idle_inject/43]
root         269  0.0  0.0      0     0 ?        S    Mar31   0:03 [migration/43]
root         270  0.0  0.0      0     0 ?        S    Mar31   0:00 [ksoftirqd/43]
root         272  0.0  0.0      0     0 ?        I<   Mar31   0:00 [kworker/43:0H-events_highpri]
root         273  0.0  0.0      0     0 ?        S    Mar31   0:00 [cpuhp/44]
root         274  0.0  0.0      0     0 ?        S    Mar31   0:00 [idle_inject/44]
root         275  0.0  0.0      0     0 ?        S    Mar31   0:02 [migration/44]
root         276  0.0  0.0      0     0 ?        S    Mar31   0:00 [ksoftirqd/44]
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""",
    commands="ps -aux | grep ''")  # -> Stdout, Stderr_, Ran

python_7 = GhPythonScript(x=executessh_25.Stdout)  # -> a
# ---------- python_7: Python ----------
__author__ = "mm1013"
__version__ = "2022.08.30"

import rhinoscriptsyntax as rs

a = [l for l in x.split("\n") if "grep" not in l]
# ---------- end python_7 ----------
panel_66 = Panel(python_7)

# ----
# Read rhino file and prepare simple geometry
falsestart_14 = LBFalseStartToggle(False)
panel_67 = Panel(parserhinofile.SkippedLayers)
panel_68 = Panel("""mkdir -p ptsFiles
echo "<content>" > ptsFiles/<file>;echo ptsFiles/<file>""")
points2pts = PointsToPts(
    Points=partition,
    Vectors=partition_2,
    Run=invert(falsestart_14),
    stdouts="""72.3313674926758 16.1354179382324 0.75 0 0 1
72.3313674926758 17.1697044372559 0.75 0 0 1
72.3313674926758 18.2039890289307 0.75 0 0 1
72.3313674926758 19.2382755279541 0.75 0 0 1
72.3313674926758 20.2725601196289 0.75 0 0 1
72.3313674926758 21.3068466186523 0.75 0 0 1
72.3313674926758 22.3411331176758 0.75 0 0 1
72.3313674926758 23.3754177093506 0.75 0 0 1
72.3313674926758 24.409704208374 0.75 0 0 1
72.3313674926758 25.4439888000488 0.75 0 0 1
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>JOIN<78.3763732910156 26.4782752990723 0.75 0 0 1
78.3763732910156 27.5125598907471 0.75 0 0 1
78.3763732910156 28.5468463897705 0.75 0 0 1
78.3763732910156 29.5811328887939 0.75 0 0 1
78.3763732910156 30.6154174804688 0.75 0 0 1
79.3838729858398 16.1354179382324 0.75 0 0 1
79.3838729858398 17.1697044372559 0.75 0 0 1
79.3838729858398 18.2039890289307 0.75 0 0 1
79.3838729858398 19.2382755279541 0.75 0 0 1
79.3838729858398 20.2725601196289 0.75 0 0 1
79.3838729858398 21.3068466186523 0.75 0 0 1
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""")  # -> flatten(PtsString), Run
overrides_26 = ApplyOverrides(Input=panel_68, content=graft(points2pts.PtsString), file=graft(python_2))  # -> Output, DynamicOutput
executessh_26 = ExecuteSSH(
    _SSHCommands_=overrides_26.DynamicOutput,
    Run=points2pts.Run,
    addPrefix=True,
    description="""mkdir -p ptsFiles
echo "72.3313674926758 16.1354179382324 0.75 0 0 1
72.3313674926758 17.1697044372559 0.75 0 0 1
72.3313674926758 18.2039890289307 0.75 0 0 1
72.3313674926758 19.2382755279541 0.75 0 0 1
72.3313674926758 20.2725601196289 0.75 0 0 1
72.3313674926758 21.3068466186523 0.75 0 0 1
72.3313674926758 22.3411331176758 0.75 0 0 1
72.3313674926758 23.3754177093506 0.75 0 0 1
72.3313674926758 24.409704208374 0.75 0 0 1
72.3313674926758 25.4439888000488 0.75 0 0 1
72.3313674926758 26.4782752990723 0.75 0 0 1
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" > ptsFiles/points000.pts;echo ptsFiles/points000.pts


- - -

mkdir -p ptsFiles
echo "78.3763732910156 26.4782752990723 0.75 0 0 1
78.3763732910156 27.5125598907471 0.75 0 0 1
78.3763732910156 28.5468463897705 0.75 0 0 1
78.3763732910156 29.5811328887939 0.75 0 0 1
78.3763732910156 30.6154174804688 0.75 0 0 1
79.3838729858398 16.1354179382324 0.75 0 0 1
79.3838729858398 17.1697044372559 0.75 0 0 1
79.3838729858398 18.2039890289307 0.75 0 0 1
79.3838729858398 19.2382755279541 0.75 0 0 1
79.3838729858398 20.2725601196289 0.75 0 0 1
79.3838729858398 21.3068466186523 0.75 0 0 1
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" > ptsFiles/points001.pts;echo ptsFiles/points001.pts""",
    fireLogs=False,
    lastRunTime=106.6876,
    suppressWarnings=False,
    results=["ptsFiles/points000.pts", "ptsFiles/points001.pts"],
    commands=["""mkdir -p ptsFiles
echo "78.3763732910156 26.4782752990723 0.75 0 0 1
78.3763732910156 27.5125598907471 0.75 0 0 1
78.3763732910156 28.5468463897705 0.75 0 0 1
78.3763732910156 29.5811328887939 0.75 0 0 1
78.3763732910156 30.6154174804688 0.75 0 0 1
79.3838729858398 16.1354179382324 0.75 0 0 1
79.3838729858398 17.1697044372559 0.75 0 0 1
79.3838729858398 18.2039890289307 0.75 0 0 1
79.3838729858398 19.2382755279541 0.75 0 0 1
79.3838729858398 20.2725601196289 0.75 0 0 1
79.3838729858398 21.3068466186523 0.75 0 0 1
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" > ptsFiles/points001.pts;echo ptsFiles/points001.pts""", """mkdir -p ptsFiles
echo "72.3313674926758 16.1354179382324 0.75 0 0 1
72.3313674926758 17.1697044372559 0.75 0 0 1
72.3313674926758 18.2039890289307 0.75 0 0 1
72.3313674926758 19.2382755279541 0.75 0 0 1
72.3313674926758 20.2725601196289 0.75 0 0 1
72.3313674926758 21.3068466186523 0.75 0 0 1
72.3313674926758 22.3411331176758 0.75 0 0 1
72.3313674926758 23.3754177093506 0.75 0 0 1
72.3313674926758 24.409704208374 0.75 0 0 1
72.3313674926758 25.4439888000488 0.75 0 0 1
72.3313674926758 26.4782752990723 0.75 0 0 1
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" > ptsFiles/points000.pts;echo ptsFiles/points000.pts"""])  # -> flatten(Stdout), Stderr_, Ran
panel_69 = Panel("""void trans TRANSLUCENT
0
0
7 0.968 0.968 0.968 0.070 0.010 0.389 0.000""")

executessh_27 = ExecuteSSH(
    _SSHCommands_=overrides_25.DynamicOutput,
    Run=falsestart_14,
    addPrefix=True,
    description="""mkdir -p ~/MantaRay/Rikshospitalet
mkdir -p ~/MantaRay/Rikshospitalet/radFiles
mkdir -p ~/MantaRay/Rikshospitalet/objFiles""",
    fireLogs=False,
    lastRunTime=34,
    name="Create working dir",
    suppressWarnings=False,
    commands="""mkdir -p ~/MantaRay/Rikshospitalet
mkdir -p ~/MantaRay/Rikshospitalet/radFiles
mkdir -p ~/MantaRay/Rikshospitalet/objFiles""")  # -> Stdout, Stderr_, Ran

points2pts_2 = PointsToPts(
    Points=grid.Points,
    Vectors=grid.Normals,
    Run=falsestart_14,
    stdouts="""72.3313674926758 16.1354179382324 0.75 0 0 1
72.3313674926758 17.1697044372559 0.75 0 0 1
72.3313674926758 18.2039890289307 0.75 0 0 1
72.3313674926758 19.2382755279541 0.75 0 0 1
72.3313674926758 20.2725601196289 0.75 0 0 1
72.3313674926758 21.3068466186523 0.75 0 0 1
72.3313674926758 22.3411331176758 0.75 0 0 1
72.3313674926758 23.3754177093506 0.75 0 0 1
72.3313674926758 24.409704208374 0.75 0 0 1
72.3313674926758 25.4439888000488 0.75 0 0 1
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""")  # -> PtsString, Run

bool_3 = Boolean(executessh_27.Ran)
cluster_3 = Cluster(mod=parserhinofile.GlassModifiers)  # -> name_geo, name_mod
geo_2 = Geometry(parserhinofile.GlassGeometries)
overrides_27 = ApplyOverrides(Input="<proj>/objFiles")
mesh2obj = MeshToObj(
    Mesh=graft(geo_2),
    Name=graft(cluster_3.name_geo),
    MapFileName="mapping_glass",
    ModifierName=graft(cluster_3.name_mod),
    TargetFolder=overrides_27,
    Run=bool_3)  # -> ObjFiles, MapFile, Run
entwine = Entwine(Branch00=mesh2obj.ObjFiles, Branch01=mesh2obj.MapFile, FlattenInputs=True)
upload = Upload(
    LocalFilePaths=flatten(entwine),
    TargetFolder=overrides_27,
    Run=mesh2obj.Run,
    stdouts="/home/lio/MantaRay/Rikshospitalet/objFiles/InnerDoors_80_geo.obj>JOIN</home/lio/MantaRay/Rikshospitalet/objFiles/CurtainWallGlass_65_geo.obj>JOIN</home/lio/MantaRay/Rikshospitalet/objFiles/Window_72_geo.obj>JOIN</home/lio/MantaRay/Rikshospitalet/objFiles/ExternalDoorPanel_70_geo.obj>JOIN</home/lio/MantaRay/Rikshospitalet/objFiles/Skylights_55_geo.obj>JOIN</home/lio/MantaRay/Rikshospitalet/objFiles/Skylights_45_geo.obj>JOIN</home/lio/MantaRay/Rikshospitalet/objFiles/IntDoors_80_geo.obj>JOIN</home/lio/MantaRay/Rikshospitalet/objFiles/mapping_glass.map")  # -> Status, FilePaths, Ran
panel_70 = Panel("""obj2rad -m <mapfile> -f <objFile> > radFiles/<name>.rad
echo radFiles/<name>.rad""")
python_8 = GhPythonScript(f=upload.FilePaths)  # -> m, o; inputs f: list
# ---------- python_8: Python ----------
__author__ = "mm1013"
__version__ = "2023.03.11"

import rhinoscriptsyntax as rs

try:
    m = "objFiles"  + f[-1].split("objFiles")[-1]
    o = ["objFiles" + v.split("objFiles")[-1] for v in f[:-1]]
except:
    pass
# ---------- end python_8 ----------
overrides_28 = ApplyOverrides(Input=panel_70, Mapfile=graft(python_8.m), ObjFile=graft(python_8.o), Name=graft(cluster_3.name_geo))  # -> Output, flatten(DynamicOutput)
executessh_28 = ExecuteSSH(
    _SSHCommands_=graft(overrides_28.DynamicOutput),
    Run=upload.Ran,
    addPrefix=True,
    description="""obj2rad -m objFiles/mapping_glass.map -f objFiles/InnerDoors_80_geo.obj > radFiles/Glass_70_geo.rad
echo radFiles/Glass_70_geo.rad


- - -

obj2rad -m objFiles/mapping_glass.map -f objFiles/CurtainWallGlass_65_geo.obj > radFiles/Glass_70_geo.rad
echo radFiles/Glass_70_geo.rad


- - -

obj2rad -m objFiles/mapping_glass.map -f objFiles/Window_72_geo.obj > radFiles/Glass_70_geo.rad
echo radFiles/Glass_70_geo.rad


- - -

obj2rad -m objFiles/mapping_glass.map -f objFiles/ExternalDoorPanel_70_geo.obj > radFiles/Glass_70_geo.rad
echo radFiles/Glass_70_geo.rad


- - -

obj2rad -m objFiles/mapping_glass.map -f objFiles/Skylights_55_geo.obj > radFiles/Glass_70_geo.rad
echo radFiles/Glass_70_geo.rad


- - -

obj2rad -m objFiles/mapping_glass.map -f objFiles/Skylights_45_geo.obj > radFiles/Glass_70_geo.rad
echo radFiles/Glass_70_geo.rad


- - -

obj2rad -m objFiles/mapping_glass.map -f objFiles/IntDoors_80_geo.obj > radFiles/Glass_70_geo.rad
echo radFiles/Glass_70_geo.rad""",
    fireLogs=True,
    lastRunTime=67,
    name="obj2map - glass",
    suppressWarnings=False,
    results=["radFiles/InnerDoors_80_geo.rad", "radFiles/CurtainWallGlass_65_geo.rad", "radFiles/Window_72_geo.rad", "radFiles/ExternalDoorPanel_70_geo.rad", "radFiles/Skylights_55_geo.rad", "radFiles/Skylights_45_geo.rad", "radFiles/IntDoors_80_geo.rad"],
    commands=["""obj2rad -m objFiles/mapping_glass.map -f objFiles/ExternalDoorPanel_70_geo.obj > radFiles/ExternalDoorPanel_70_geo.rad
echo radFiles/ExternalDoorPanel_70_geo.rad""", """obj2rad -m objFiles/mapping_glass.map -f objFiles/InnerDoors_80_geo.obj > radFiles/InnerDoors_80_geo.rad
echo radFiles/InnerDoors_80_geo.rad""", """obj2rad -m objFiles/mapping_glass.map -f objFiles/Window_72_geo.obj > radFiles/Window_72_geo.rad
echo radFiles/Window_72_geo.rad""", """obj2rad -m objFiles/mapping_glass.map -f objFiles/Skylights_55_geo.obj > radFiles/Skylights_55_geo.rad
echo radFiles/Skylights_55_geo.rad""", """obj2rad -m objFiles/mapping_glass.map -f objFiles/IntDoors_80_geo.obj > radFiles/IntDoors_80_geo.rad
echo radFiles/IntDoors_80_geo.rad"""])  # -> flatten(Stdout), Stderr_, Ran
window_rad = Text(executessh_28.Stdout)

bool_4 = Boolean(executessh_27.Ran)
cluster_4 = Cluster(mod=parserhinofile.OpaqueModifiers)  # -> name_geo, name_mod
geo_3 = Geometry(parserhinofile.OpaqueGeometries)
overrides_29 = ApplyOverrides(Input="<proj>/objFiles")
mesh2obj_2 = MeshToObj(
    Mesh=graft(geo_3),
    Name=graft(cluster_4.name_geo),
    MapFileName="mapping_opaque",
    ModifierName=graft(cluster_4.name_mod),
    TargetFolder=overrides_29,
    Run=bool_4)  # -> ObjFiles, MapFile, Run
entwine_2 = Entwine(Branch00=mesh2obj_2.ObjFiles, Branch01=mesh2obj_2.MapFile, FlattenInputs=True)
upload_2 = Upload(
    LocalFilePaths=flatten(entwine_2),
    TargetFolder=overrides_29,
    Run=mesh2obj_2.Run,
    stdouts="/home/lio/MantaRay/Rikshospitalet/objFiles/InnerWalls_60_geo.obj>JOIN</home/lio/MantaRay/Rikshospitalet/objFiles/InnerDoors_60_geo.obj>JOIN</home/lio/MantaRay/Rikshospitalet/objFiles/CurtainWallFrames_70_geo.obj>JOIN</home/lio/MantaRay/Rikshospitalet/objFiles/FacadeWHITE_65_geo.obj>JOIN</home/lio/MantaRay/Rikshospitalet/objFiles/WindowFrames_70_geo.obj>JOIN</home/lio/MantaRay/Rikshospitalet/objFiles/ExternalDoors_55_geo.obj>JOIN</home/lio/MantaRay/Rikshospitalet/objFiles/Floors_40_geo.obj>JOIN</home/lio/MantaRay/Rikshospitalet/objFiles/Ceilings_80_geo.obj>JOIN</home/lio/MantaRay/Rikshospitalet/objFiles/Roofs_40_geo.obj>JOIN</home/lio/MantaRay/Rikshospitalet/objFiles/IntDoors_60_geo.obj>JOIN</home/lio/MantaRay/Rikshospitalet/objFiles/FacadeBrown_30_geo.obj>JOIN</home/lio/MantaRay/Rikshospitalet/objFiles/FacadeRegular_60_geo.obj>JOIN</home/lio/MantaRay/Rikshospitalet/objFiles/FacadeTegl_25_geo.obj>JOIN</home/lio/MantaRay/Rikshospitalet/objFiles/FacadeWHITEish_50_geo.obj>JOIN</home/lio/MantaRay/Rikshospitalet/objFiles/Ground_20_geo.obj>JOIN</home/lio/MantaRay/Rikshospitalet/objFiles/ContextMat_40_geo.obj>JOIN</home/lio/MantaRay/Rikshospitalet/objFiles/RoofMullions_80_geo.obj>JOIN</home/lio/MantaRay/Rikshospitalet/objFiles/mapping_opaque.map")  # -> Status, FilePaths, Ran
panel_71 = Panel("""obj2rad -m <mapfile> -f <objFile> > radFiles/<name>.rad
echo radFiles/<name>.rad""")
python_9 = GhPythonScript(f=upload_2.FilePaths)  # -> m, o; inputs f: list; same code as python_8
overrides_30 = ApplyOverrides(Input=panel_71, Mapfile=graft(python_9.m), ObjFile=graft(python_9.o), Name=graft(cluster_4.name_geo))  # -> Output, flatten(DynamicOutput)
executessh_29 = ExecuteSSH(
    _SSHCommands_=graft(overrides_30.DynamicOutput),
    Run=upload_2.Ran,
    addPrefix=True,
    description="""obj2rad -m objFiles/mapping_opaque.map -f objFiles/InnerWalls_60_geo.obj > radFiles/FloorMat_0_70_geo.rad
echo radFiles/FloorMat_0_70_geo.rad


- - -

obj2rad -m objFiles/mapping_opaque.map -f objFiles/InnerDoors_60_geo.obj > radFiles/IntWalls_0_90_geo.rad
echo radFiles/IntWalls_0_90_geo.rad


- - -

obj2rad -m objFiles/mapping_opaque.map -f objFiles/CurtainWallFrames_70_geo.obj > radFiles/Pipes_0_03_geo.rad
echo radFiles/Pipes_0_03_geo.rad


- - -

obj2rad -m objFiles/mapping_opaque.map -f objFiles/FacadeWHITE_65_geo.obj > radFiles/Black_0_01_geo.rad
echo radFiles/Black_0_01_geo.rad


- - -

obj2rad -m objFiles/mapping_opaque.map -f objFiles/WindowFrames_70_geo.obj > radFiles/Cladding_0_50_geo.rad
echo radFiles/Cladding_0_50_geo.rad


- - -

obj2rad -m objFiles/mapping_opaque.map -f objFiles/ExternalDoors_55_geo.obj > radFiles/ConcreteDarker_0_10_geo.rad
echo radFiles/ConcreteDarker_0_10_geo.rad


- - -

obj2rad -m objFiles/mapping_opaque.map -f objFiles/Floors_40_geo.obj > radFiles/ConcreteStructure_0_30_geo.rad
echo radFiles/ConcreteStructure_0_30_geo.rad


- - -

obj2rad -m objFiles/mapping_opaque.map -f objFiles/Ceilings_80_geo.obj > radFiles/CurvedCeiling_0_80_geo.rad
echo radFiles/CurvedCeiling_0_80_geo.rad


- - -

obj2rad -m objFiles/mapping_opaque.map -f objFiles/Roofs_40_geo.obj > radFiles/FloorBox_0_75_geo.rad
echo radFiles/FloorBox_0_75_geo.rad


- - -

obj2rad -m objFiles/mapping_opaque.map -f objFiles/IntDoors_60_geo.obj > radFiles/ConcreteGrey_0_50_geo.rad
echo radFiles/ConcreteGrey_0_50_geo.rad


- - -

obj2rad -m objFiles/mapping_opaque.map -f objFiles/FacadeBrown_30_geo.obj > radFiles/ConcreteWhite_0_80_geo.rad
echo radFiles/ConcreteWhite_0_80_geo.rad


- - -

obj2rad -m objFiles/mapping_opaque.map -f objFiles/FacadeRegular_60_geo.obj > radFiles/Frames_0_60_geo.rad
echo radFiles/Frames_0_60_geo.rad


- - -

obj2rad -m objFiles/mapping_opaque.map -f objFiles/FacadeTegl_25_geo.obj > radFiles/IntWalls_0_80_geo.rad
echo radFiles/IntWalls_0_80_geo.rad""",
    fireLogs=True,
    lastRunTime=2392,
    name="obj2map - opaque",
    suppressWarnings=False,
    results=["radFiles/InnerWalls_60_geo.rad", "radFiles/InnerDoors_60_geo.rad", "radFiles/CurtainWallFrames_70_geo.rad", "radFiles/FacadeWHITE_65_geo.rad", "radFiles/WindowFrames_70_geo.rad", "radFiles/ExternalDoors_55_geo.rad", "radFiles/Floors_40_geo.rad", "radFiles/Ceilings_80_geo.rad", "radFiles/Roofs_40_geo.rad", "radFiles/IntDoors_60_geo.rad", "radFiles/FacadeBrown_30_geo.rad", "radFiles/FacadeRegular_60_geo.rad", "radFiles/FacadeTegl_25_geo.rad", "radFiles/FacadeWHITEish_50_geo.rad", "radFiles/Ground_20_geo.rad", "radFiles/ContextMat_40_geo.rad", "radFiles/RoofMullions_80_geo.rad"],
    commands=["""obj2rad -m objFiles/mapping_opaque.map -f objFiles/InnerWalls_60_geo.obj > radFiles/InnerWalls_60_geo.rad
echo radFiles/InnerWalls_60_geo.rad""", """obj2rad -m objFiles/mapping_opaque.map -f objFiles/InnerDoors_60_geo.obj > radFiles/InnerDoors_60_geo.rad
echo radFiles/InnerDoors_60_geo.rad""", """obj2rad -m objFiles/mapping_opaque.map -f objFiles/CurtainWallFrames_70_geo.obj > radFiles/CurtainWallFrames_70_geo.rad
echo radFiles/CurtainWallFrames_70_geo.rad""", """obj2rad -m objFiles/mapping_opaque.map -f objFiles/FacadeWHITE_65_geo.obj > radFiles/FacadeWHITE_65_geo.rad
echo radFiles/FacadeWHITE_65_geo.rad""", """obj2rad -m objFiles/mapping_opaque.map -f objFiles/WindowFrames_70_geo.obj > radFiles/WindowFrames_70_geo.rad
echo radFiles/WindowFrames_70_geo.rad""", """obj2rad -m objFiles/mapping_opaque.map -f objFiles/ExternalDoors_55_geo.obj > radFiles/ExternalDoors_55_geo.rad
echo radFiles/ExternalDoors_55_geo.rad""", """obj2rad -m objFiles/mapping_opaque.map -f objFiles/Floors_40_geo.obj > radFiles/Floors_40_geo.rad
echo radFiles/Floors_40_geo.rad""", """obj2rad -m objFiles/mapping_opaque.map -f objFiles/Ceilings_80_geo.obj > radFiles/Ceilings_80_geo.rad
echo radFiles/Ceilings_80_geo.rad""", """obj2rad -m objFiles/mapping_opaque.map -f objFiles/Roofs_40_geo.obj > radFiles/Roofs_40_geo.rad
echo radFiles/Roofs_40_geo.rad""", """obj2rad -m objFiles/mapping_opaque.map -f objFiles/IntDoors_60_geo.obj > radFiles/IntDoors_60_geo.rad
echo radFiles/IntDoors_60_geo.rad""", """obj2rad -m objFiles/mapping_opaque.map -f objFiles/FacadeBrown_30_geo.obj > radFiles/FacadeBrown_30_geo.rad
echo radFiles/FacadeBrown_30_geo.rad""", """obj2rad -m objFiles/mapping_opaque.map -f objFiles/FacadeRegular_60_geo.obj > radFiles/FacadeRegular_60_geo.rad
echo radFiles/FacadeRegular_60_geo.rad""", """obj2rad -m objFiles/mapping_opaque.map -f objFiles/FacadeTegl_25_geo.obj > radFiles/FacadeTegl_25_geo.rad
echo radFiles/FacadeTegl_25_geo.rad""", """obj2rad -m objFiles/mapping_opaque.map -f objFiles/FacadeWHITEish_50_geo.obj > radFiles/FacadeWHITEish_50_geo.rad
echo radFiles/FacadeWHITEish_50_geo.rad""", """obj2rad -m objFiles/mapping_opaque.map -f objFiles/Ground_20_geo.obj > radFiles/Ground_20_geo.rad
echo radFiles/Ground_20_geo.rad""", """obj2rad -m objFiles/mapping_opaque.map -f objFiles/ContextMat_40_geo.obj > radFiles/ContextMat_40_geo.rad
echo radFiles/ContextMat_40_geo.rad""", """obj2rad -m objFiles/mapping_opaque.map -f objFiles/RoofMullions_80_geo.obj > radFiles/RoofMullions_80_geo.rad
echo radFiles/RoofMullions_80_geo.rad"""])  # -> flatten(Stdout), Stderr_, Ran
opaque_rad = Text(executessh_29.Stdout)

bool_5 = Boolean(executessh_27.Ran)
geo_4 = Geometry(parserhinofile.CustomGeometries)
cluster_5 = Cluster_3(L=geo_4)
n = N(mod=parserhinofile.ModifierNames)  # -> name_geo, name_mod
and = GateAnd(A=bool_5, B=cluster_5)
overrides_31 = ApplyOverrides(Input="<proj>/objFiles")
mesh2obj_3 = MeshToObj(
    Mesh=graft(geo_4),
    Name=graft(n.name_geo),
    MapFileName="mapping_other",
    ModifierName=graft(n.name_mod),
    TargetFolder=overrides_31,
    Run=and)  # -> ObjFiles, MapFile, Run
entwine_3 = Entwine(Branch00=mesh2obj_3.ObjFiles, Branch01=mesh2obj_3.MapFile, FlattenInputs=True)
upload_3 = Upload(
    LocalFilePaths=flatten(entwine_3),
    TargetFolder=overrides_31,
    Run=mesh2obj_3.Run,
    stdouts="/home/lio/MantaRay/Rikshospitalet/objFiles/TRANSLUCENT_geo.obj>JOIN</home/lio/MantaRay/Rikshospitalet/objFiles/mapping_other.map")  # -> Status, FilePaths, Ran
panel_72 = Panel("""obj2rad -m <mapfile> -f <objFile> >  radFiles/<name>.rad
echo radFiles/<name>.rad""")
python_10 = GhPythonScript(f=upload_3.FilePaths)  # -> m, o; inputs f: list; same code as python_8
cull = CullPattern(List=panel_72, CullPattern=and)
overrides_32 = ApplyOverrides(Input=cull, Mapfile=graft(python_10.m), ObjFile=graft(python_10.o), Name=graft(n.name_geo))  # -> Output, flatten(DynamicOutput)
executessh_30 = ExecuteSSH(
    _SSHCommands_=graft(overrides_32.DynamicOutput),
    Run=upload_3.Ran,
    addPrefix=True,
    fireLogs=True,
    lastRunTime=34,
    name="obj2map - other",
    suppressWarnings=False,
    results="radFiles/TRANSLUCENT_geo.rad",
    commands="""obj2rad -m objFiles/mapping_other.map -f objFiles/TRANSLUCENT_geo.obj >  radFiles/TRANSLUCENT_geo.rad
echo radFiles/TRANSLUCENT_geo.rad""")  # -> flatten(Stdout), Stderr_, Ran
cull_2 = CullPattern(List=executessh_30.Stdout, CullPattern=and)
other_rad = Text(cull_2)

overrides_33 = ApplyOverrides(Input=panel_68, Content=graft(points2pts_2.PtsString), File=graft("points.pts"))  # -> Output, DynamicOutput
executessh_31 = ExecuteSSH(
    _SSHCommands_=overrides_33.DynamicOutput,
    Run=points2pts.Run,
    addPrefix=True,
    description="""mkdir -p ptsFiles
echo "72.3313674926758 16.1354179382324 0.75 0 0 1
72.3313674926758 17.1697044372559 0.75 0 0 1
72.3313674926758 18.2039890289307 0.75 0 0 1
72.3313674926758 19.2382755279541 0.75 0 0 1
72.3313674926758 20.2725601196289 0.75 0 0 1
72.3313674926758 21.3068466186523 0.75 0 0 1
72.3313674926758 22.3411331176758 0.75 0 0 1
72.3313674926758 23.3754177093506 0.75 0 0 1
72.3313674926758 24.409704208374 0.75 0 0 1
72.3313674926758 25.4439888000488 0.75 0 0 1
72.3313674926758 26.4782752990723 0.75 0 0 1
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" > ptsFiles/points.pts;echo ptsFiles/points.pts""",
    fireLogs=False,
    lastRunTime=38.1106,
    suppressWarnings=False,
    results="ptsFiles/points.pts",
    commands="""mkdir -p ptsFiles
echo "72.3313674926758 16.1354179382324 0.75 0 0 1
72.3313674926758 17.1697044372559 0.75 0 0 1
72.3313674926758 18.2039890289307 0.75 0 0 1
72.3313674926758 19.2382755279541 0.75 0 0 1
72.3313674926758 20.2725601196289 0.75 0 0 1
72.3313674926758 21.3068466186523 0.75 0 0 1
72.3313674926758 22.3411331176758 0.75 0 0 1
72.3313674926758 23.3754177093506 0.75 0 0 1
72.3313674926758 24.409704208374 0.75 0 0 1
72.3313674926758 25.4439888000488 0.75 0 0 1
72.3313674926758 26.4782752990723 0.75 0 0 1
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" > ptsFiles/points.pts;echo ptsFiles/points.pts""")  # -> Stdout, Stderr_, Ran
panel_73 = Panel(executessh_31.Stdout)
ptsfile = Text(executessh_31.Stdout)

# ----
# materials
run = Boolean(executessh_27.Ran)

# ----
# other materials (trans etc, NOT BSDF)
panel_74 = Panel("echo \"<mats>\" > radFiles/<target>;echo \"radFiles/<target>\"")
opaque_mats = Data(panel_69)
join_2 = TextJoin(Text=opaque_mats)
overrides_34 = ApplyOverrides(Input=panel_74, Mats=graft(join_2), Target=graft("other_materials.mat"))  # -> Output, DynamicOutput
executessh_32 = ExecuteSSH(
    _SSHCommands_=overrides_34.DynamicOutput,
    Run=run,
    addPrefix=True,
    description="""echo "void trans TRANSLUCENT
0
0
7 0.968 0.968 0.968 0.070 0.010 0.389 0.000" > radFiles/other_materials.mat;echo "radFiles/other_materials.mat"
""",
    fireLogs=False,
    lastRunTime=2094,
    name="otherMats",
    suppressWarnings=False,
    results="radFiles/other_materials.mat",
    commands="""echo "void trans TRANSLUCENT
0
0
7 0.968 0.968 0.968 0.070 0.010 0.389 0.000" > radFiles/other_materials.mat;echo "radFiles/other_materials.mat"
""")  # -> Stdout, Stderr_, Ran
other_mat = Text(executessh_32.Stdout)

# ----
# opaque materials
opaque_mats_2 = Data(parserhinofile.OpaqueModifiers)
panel_75 = Panel("echo \"<mats>\" > radFiles/<target>;echo \"radFiles/<target>\"")
join_3 = TextJoin(Text=opaque_mats_2)
overrides_35 = ApplyOverrides(Input=panel_75, Mats=graft(join_3), Target=graft("opaque_materials.mat"))  # -> Output, DynamicOutput
executessh_33 = ExecuteSSH(
    _SSHCommands_=overrides_35.DynamicOutput,
    Run=run,
    addPrefix=True,
    description="""echo "void plastic FloorMat_0_70
0
0
5 0.7 0.7 0.7 0 0
void plastic IntWalls_0_90
0
0
5 0.9 0.9 0.9 0 0
void plastic Pipes_0_03
0
0
5 0.03 0.03 0.03 0 0
void plastic Black_0_01
0
0
5 0.01 0.01 0.01 0 0
void plastic Cladding_0_50
0
0
5 0.5 0.5 0.5 0 0
void plastic ConcreteDarker_0_10
0
0
5 0.1 0.1 0.1 0 0
void plastic ConcreteStructure_0_30
0
0
5 0.3 0.3 0.3 0 0
void plastic CurvedCeiling_0_80
0
0
5 0.8 0.8 0.8 0 0
void plastic FloorBox_0_75
0
0
5 0.75 0.75 0.75 0 0
void plastic ConcreteGrey_0_50
0
0
5 0.5 0.5 0.5 0 0
void plastic ConcreteWhite_0_80
0
0
5 0.8 0.8 0.8 0 0
void plastic Frames_0_60
0
0
5 0.6 0.6 0.6 0 0
void plastic IntWalls_0_80
0
0
5 0.8 0.8 0.8 0 0" > radFiles/opaque_materials.mat;echo "radFiles/opaque_materials.mat"
""",
    fireLogs=False,
    lastRunTime=41,
    name="opaqueMats",
    suppressWarnings=False,
    results="radFiles/opaque_materials.mat",
    commands="""echo "void plastic InnerWalls_60
0
0
5 6000.000 6000.000 6000.000 0.000 0.000
void plastic InnerDoors_60
0
0
5 6000.000 6000.000 6000.000 0.000 0.000
void plastic CurtainWallFrames_70
0
0
5 7000.000 7000.000 7000.000 0.000 0.000
void plastic FacadeWHITE_65
0
0
5 6500.000 6500.000 6500.000 0.000 0.000
void plastic WindowFrames_70
0
0
5 7000.000 7000.000 7000.000 0.000 0.000
void plastic ExternalDoors_55
0
0
5 5500.000 5500.000 5500.000 0.000 0.000
void plastic Floors_40
0
0
5 4000.000 4000.000 4000.000 0.000 0.000
void plastic Ceilings_80
0
0
5 8000.000 8000.000 8000.000 0.000 0.000
void plastic Roofs_40
0
0
5 4000.000 4000.000 4000.000 0.000 0.000
void plastic IntDoors_60
0
0
5 6000.000 6000.000 6000.000 0.000 0.000
void plastic FacadeBrown_30
0
0
5 3000.000 3000.000 3000.000 0.000 0.000
void plastic FacadeRegular_60
0
0
5 6000.000 6000.000 6000.000 0.000 0.000
void plastic FacadeTegl_25
0
0
5 2500.000 2500.000 2500.000 0.000 0.000
void plastic FacadeWHITEish_50
0
0
5 5000.000 5000.000 5000.000 0.000 0.000
void plastic Ground_20
0
0
5 2000.000 2000.000 2000.000 0.000 0.000
void plastic ContextMat_40
0
0
5 4000.000 4000.000 4000.000 0.000 0.000
void plastic RoofMullions_80
0
0
5 8000.000 8000.000 8000.000 0.000 0.000" > radFiles/opaque_materials.mat;echo "radFiles/opaque_materials.mat"
""")  # -> Stdout, Stderr_, Ran
opaque_mat = Text(executessh_33.Stdout)

ptsfile_2 = Text(ptsfile)

# ----
# Setup glass materials
glass_mat = Data(parserhinofile.GlassModifiers)
panel_76 = Panel("echo \"<mats>\" > radFiles/<target>;echo \"radFiles/<target>\"")
overrides_36 = ApplyOverrides(Input="<mat>.mat", Mat=graft(cluster_3.name_mod))
overrides_37 = ApplyOverrides(Input=panel_76, Mats=graft(glass_mat), Target=graft(overrides_36))  # -> Output, DynamicOutput
cluster_6 = Cluster_2(L=glass_mat)

executessh_34 = ExecuteSSH(
    _SSHCommands_=overrides_37.DynamicOutput,
    Run=run,
    addPrefix=True,
    description="""echo "void glass Glass_70
0
0
3 0.762841984823016 0.762841984823016 0.762841984823016" > radFiles/Glass_70.mat;echo "radFiles/Glass_70.mat"
""",
    fireLogs=False,
    lastRunTime=247,
    suppressWarnings=False,
    results=["radFiles/InnerDoors_80.mat", "radFiles/CurtainWallGlass_65.mat", "radFiles/Window_72.mat", "radFiles/ExternalDoorPanel_70.mat", "radFiles/Skylights_55.mat", "radFiles/Skylights_45.mat", "radFiles/IntDoors_80.mat"],
    commands=["""echo "void glass CurtainWallGlass_65
0
0
3 0.708 0.708 0.708" > radFiles/CurtainWallGlass_65.mat;echo "radFiles/CurtainWallGlass_65.mat"
""", """echo "void glass Window_72
0
0
3 0.785 0.785 0.785" > radFiles/Window_72.mat;echo "radFiles/Window_72.mat"
""", """echo "void glass ExternalDoorPanel_70
0
0
3 0.763 0.763 0.763" > radFiles/ExternalDoorPanel_70.mat;echo "radFiles/ExternalDoorPanel_70.mat"
""", """echo "void glass Skylights_45
0
0
3 0.491 0.491 0.491" > radFiles/Skylights_45.mat;echo "radFiles/Skylights_45.mat"
""", """echo "void glass IntDoors_80
0
0
3 0.872 0.872 0.872" > radFiles/IntDoors_80.mat;echo "radFiles/IntDoors_80.mat"
"""])  # -> Stdout, Stderr_, Ran

cull_3 = CullPattern(List=executessh_34.Stdout, CullPattern=cluster_6)
window_mat = Text(flatten(cull_3))

# ----
# RAD files
# STANDARD octree
window_mat_2 = Text(window_mat)
window_rad_2 = Text(window_rad)
opaque_mat_2 = Text(opaque_mat)
other_mat_2 = Text(other_mat)
opaque_rad_2 = Text(opaque_rad)
other_rad_2 = Text(other_rad)
entwine_4 = Entwine(
    Branch00=window_mat_2,
    Branch01=window_rad_2,
    Branch02=opaque_mat_2,
    Branch03=opaque_rad_2,
    Branch04=other_mat_2,
    Branch05=other_rad_2,
    FlattenInputs=True)  # -> flatten(Result)

# ----
# Preview a RAD file with objpict (takes 20 sec)
# can also use ra_tiff/normtiff/pfilt
# gamma will vary
# 
# check axel jacobs radiance tutorial p26
panel_77 = Panel("""mkdir -p images/objPict/
objpict <rad> > images/objPict/<target-.>.hdr
normtiff images/objPict/<target-.>.hdr images/objPict/<target-.>.tif
convert images/objPict/<target-.>.tif images/objPict/<target-.>.png
rm images/objPict/<target-.>.hdr
rm images/objPict/<target-.>.tif
echo images/objPict/<target-.>.png""")
python_11 = GhPythonScript(x=flatten(entwine_4))  # -> a; inputs x: list
# ---------- python_11: Python ----------
__author__ = "mm1013"
__version__ = "2023.04.02"

import rhinoscriptsyntax as rs

a = [v for v in x if v.endswith(".rad")]
# ---------- end python_11 ----------
list = ItemSelector(
    python_11,
    {"radFiles/InnerDoors_80_geo.rad", "radFiles/CurtainWallGlass_65_geo.rad", "radFiles/Window_72_geo.rad", "radFiles/ExternalDoorPanel_70_geo.rad", "radFiles/Skylights_55_geo.rad", "radFiles/Skylights_45_geo.rad", "radFiles/IntDoors_80_geo.rad", "radFiles/InnerWalls_60_geo.rad", "radFiles/InnerDoors_60_geo.rad", "radFiles/CurtainWallFrames_70_geo.rad", "radFiles/FacadeWHITE_65_geo.rad", "radFiles/WindowFrames_70_geo.rad", "radFiles/ExternalDoors_55_geo.rad", "radFiles/Floors_40_geo.rad", "radFiles/Ceilings_80_geo.rad", "radFiles/Roofs_40_geo.rad", "radFiles/IntDoors_60_geo.rad", "radFiles/FacadeBrown_30_geo.rad", "radFiles/FacadeRegular_60_geo.rad", "radFiles/FacadeTegl_25_geo.rad"}, selected="radFiles/InnerDoors_80_geo.rad")
falsestart_15 = LBFalseStartToggle(False)
python_12 = GhPythonScript(x=flatten(python_11))  # -> a; inputs x: list
# ---------- python_12: Python ----------
__author__ = "mm1013"
__version__ = "2023.04.02"

import rhinoscriptsyntax as rs

a = [v.split("/")[-1] for v in x]
# ---------- end python_12 ----------
entwine_5 = Entwine(Branch00=window_mat_2, Branch01=opaque_mat_2, FlattenInputs=True)  # -> flatten(Result)
join_4 = TextJoin(Text=entwine_5, Join=" ")
concat_5 = Concatenate(FragmentA=join_4, FragmentB=python_11, JoinSeparator=" ")
overrides_38 = ApplyOverrides(Input=panel_77, Rad=graft(concat_5), Target=graft(python_12))  # -> Output, DynamicOutput
executessh_35 = ExecuteSSH(
    _SSHCommands=overrides_38.DynamicOutput,
    Run=falsestart_15,
    addPrefix=True,
    description="""mkdir -p images/objPict/
objpict radFiles/InnerDoors_80.mat radFiles/opaque_materials.mat radFiles/InnerDoors_80_geo.rad > images/objPict/InnerDoors_80_geo.hdr
normtiff images/objPict/InnerDoors_80_geo.hdr images/objPict/InnerDoors_80_geo.tif
convert images/objPict/InnerDoors_80_geo.tif images/objPict/InnerDoors_80_geo.png
rm images/objPict/InnerDoors_80_geo.hdr
rm images/objPict/InnerDoors_80_geo.tif
echo images/objPict/InnerDoors_80_geo.png


- - -

mkdir -p images/objPict/
objpict radFiles/InnerDoors_80.mat radFiles/opaque_materials.mat radFiles/CurtainWallGlass_65_geo.rad > images/objPict/CurtainWallGlass_65_geo.hdr
normtiff images/objPict/CurtainWallGlass_65_geo.hdr images/objPict/CurtainWallGlass_65_geo.tif
convert images/objPict/CurtainWallGlass_65_geo.tif images/objPict/CurtainWallGlass_65_geo.png
rm images/objPict/CurtainWallGlass_65_geo.hdr
rm images/objPict/CurtainWallGlass_65_geo.tif
echo images/objPict/CurtainWallGlass_65_geo.png


- - -

mkdir -p images/objPict/
objpict radFiles/InnerDoors_80.mat radFiles/opaque_materials.mat radFiles/Window_72_geo.rad > images/objPict/Window_72_geo.hdr
normtiff images/objPict/Window_72_geo.hdr images/objPict/Window_72_geo.tif
convert images/objPict/Window_72_geo.tif images/objPict/Window_72_geo.png
rm images/objPict/Window_72_geo.hdr
rm images/objPict/Window_72_geo.tif
echo images/objPict/Window_72_geo.png


- - -

mkdir -p images/objPict/
objpict radFiles/InnerDoors_80.mat radFiles/opaque_materials.mat radFiles/ExternalDoorPanel_70_geo.rad > images/objPict/ExternalDoorPanel_70_geo.hdr
normtiff images/objPict/ExternalDoorPanel_70_geo.hdr images/objPict/ExternalDoorPanel_70_geo.tif
convert images/objPict/ExternalDoorPanel_70_geo.tif images/objPict/ExternalDoorPanel_70_geo.png
rm images/objPict/ExternalDoorPanel_70_geo.hdr
rm images/objPict/ExternalDoorPanel_70_geo.tif
echo images/objPict/ExternalDoorPanel_70_geo.png


- - -

mkdir -p images/objPict/
objpict radFiles/InnerDoors_80.mat radFiles/opaque_materials.mat radFiles/Skylights_55_geo.rad > images/objPict/Skylights_55_geo.hdr
normtiff images/objPict/Skylights_55_geo.hdr images/objPict/Skylights_55_geo.tif
convert images/objPict/Skylights_55_geo.tif images/objPict/Skylights_55_geo.png
rm images/objPict/Skylights_55_geo.hdr
rm images/objPict/Skylights_55_geo.tif
echo images/objPict/Skylights_55_geo.png


- - -

mkdir -p images/objPict/
objpict radFiles/InnerDoors_80.mat radFiles/opaque_materials.mat radFiles/Skylights_45_geo.rad > images/objPict/Skylights_45_geo.hdr
normtiff images/objPict/Skylights_45_geo.hdr images/objPict/Skylights_45_geo.tif
convert images/objPict/Skylights_45_geo.tif images/objPict/Skylights_45_geo.png
rm images/objPict/Skylights_45_geo.hdr
rm images/objPict/Skylights_45_geo.tif
echo images/objPict/Skylights_45_geo.png


- - -

mkdir -p images/objPict/
objpict radFiles/InnerDoors_80.mat radFiles/opaque_materials.mat radFiles/IntDoors_80_geo.rad > images/objPict/IntDoors_80_geo.hdr
normtiff images/objPict/IntDoors_80_geo.hdr images/objPict/IntDoors_80_geo.tif
convert images/objPict/IntDoors_80_geo.tif images/objPict/IntDoors_80_geo.png
rm images/objPict/IntDoors_80_geo.hdr
rm images/objPict/IntDoors_80_geo.tif
echo images/objPict/IntDoors_80_geo.png


- - -

mkdir -p images/objPict/
objpict radFiles/InnerDoors_80.mat radFiles/opaque_materials.mat radFiles/InnerWalls_60_geo.rad > images/objPict/InnerWalls_60_geo.hdr
normtiff images/objPict/InnerWalls_60_geo.hdr images/objPict/InnerWalls_60_geo.tif
convert images/objPict/InnerWalls_60_geo.tif images/objPict/InnerWalls_60_geo.png
rm images/objPict/InnerWalls_60_geo.hdr
rm images/objPict/InnerWalls_60_geo.tif
echo images/objPict/InnerWalls_60_geo.png


- - -

mkdir -p images/objPict/
objpict radFiles/InnerDoors_80.mat radFiles/opaque_materials.mat radFiles/InnerDoors_60_geo.rad > images/objPict/InnerDoors_60_geo.hdr
normtiff images/objPict/InnerDoors_60_geo.hdr images/objPict/InnerDoors_60_geo.tif
convert images/objPict/InnerDoors_60_geo.tif images/objPict/InnerDoors_60_geo.png
rm images/objPict/InnerDoors_60_geo.hdr
rm images/objPict/InnerDoors_60_geo.tif
echo images/objPict/InnerDoors_60_geo.png


- - -

mkdir -p images/objPict/
objpict radFiles/InnerDoors_80.mat radFiles/opaque_materials.mat radFiles/CurtainWallFrames_70_geo.rad > images/objPict/CurtainWallFrames_70_geo.hdr
normtiff images/objPict/CurtainWallFrames_70_geo.hdr images/objPict/CurtainWallFrames_70_geo.tif
convert images/objPict/CurtainWallFrames_70_geo.tif images/objPict/CurtainWallFrames_70_geo.png
rm images/objPict/CurtainWallFrames_70_geo.hdr
rm images/objPict/CurtainWallFrames_70_geo.tif
echo images/objPict/CurtainWallFrames_70_geo.png


- - -

mkdir -p images/objPict/
objpict radFiles/InnerDoors_80.mat radFiles/opaque_materials.mat radFiles/FacadeWHITE_65_geo.rad > images/objPict/FacadeWHITE_65_geo.hdr
normtiff images/objPict/FacadeWHITE_65_geo.hdr images/objPict/FacadeWHITE_65_geo.tif
convert images/objPict/FacadeWHITE_65_geo.tif images/objPict/FacadeWHITE_65_geo.png
rm images/objPict/FacadeWHITE_65_geo.hdr
rm images/objPict/FacadeWHITE_65_geo.tif
echo images/objPict/FacadeWHITE_65_geo.png


- - -

mkdir -p images/objPict/
objpict radFiles/InnerDoors_80.mat radFiles/opaque_materials.mat radFiles/WindowFrames_70_geo.rad > images/objPict/WindowFrames_70_geo.hdr
normtiff images/objPict/WindowFrames_70_geo.hdr images/objPict/WindowFrames_70_geo.tif
convert images/objPict/WindowFrames_70_geo.tif images/objPict/WindowFrames_70_geo.png
rm images/objPict/WindowFrames_70_geo.hdr
rm images/objPict/WindowFrames_70_geo.tif
echo images/objPict/WindowFrames_70_geo.png


- - -

mkdir -p images/objPict/
objpict radFiles/InnerDoors_80.mat radFiles/opaque_materials.mat radFiles/ExternalDoors_55_geo.rad > images/objPict/ExternalDoors_55_geo.hdr
normtiff images/objPict/ExternalDoors_55_geo.hdr images/objPict/ExternalDoors_55_geo.tif
convert images/objPict/ExternalDoors_55_geo.tif images/objPict/ExternalDoors_55_geo.png
rm images/objPict/ExternalDoors_55_geo.hdr
rm images/objPict/ExternalDoors_55_geo.tif
echo images/objPict/ExternalDoors_55_geo.png


- - -

mkdir -p images/objPict/
objpict radFiles/InnerDoors_80.mat radFiles/opaque_materials.mat radFiles/Floors_40_geo.rad > images/objPict/Floors_40_geo.hdr
normtiff images/objPict/Floors_40_geo.hdr images/objPict/Floors_40_geo.tif
convert images/objPict/Floors_40_geo.tif images/objPict/Floors_40_geo.png
rm images/objPict/Floors_40_geo.hdr
rm images/objPict/Floors_40_geo.tif
echo images/objPict/Floors_40_geo.png


- - -

mkdir -p images/objPict/
objpict radFiles/InnerDoors_80.mat radFiles/opaque_materials.mat radFiles/Ceilings_80_geo.rad > images/objPict/Ceilings_80_geo.hdr
normtiff images/objPict/Ceilings_80_geo.hdr images/objPict/Ceilings_80_geo.tif
convert images/objPict/Ceilings_80_geo.tif images/objPict/Ceilings_80_geo.png
rm images/objPict/Ceilings_80_geo.hdr
rm images/objPict/Ceilings_80_geo.tif
echo images/objPict/Ceilings_80_geo.png


- - -

mkdir -p images/objPict/
objpict radFiles/InnerDoors_80.mat radFiles/opaque_materials.mat radFiles/Roofs_40_geo.rad > images/objPict/Roofs_40_geo.hdr
normtiff images/objPict/Roofs_40_geo.hdr images/objPict/Roofs_40_geo.tif
convert images/objPict/Roofs_40_geo.tif images/objPict/Roofs_40_geo.png
rm images/objPict/Roofs_40_geo.hdr
rm images/objPict/Roofs_40_geo.tif
echo images/objPict/Roofs_40_geo.png


- - -

mkdir -p images/objPict/
objpict radFiles/InnerDoors_80.mat radFiles/opaque_materials.mat radFiles/IntDoors_60_geo.rad > images/objPict/IntDoors_60_geo.hdr
normtiff images/objPict/IntDoors_60_geo.hdr images/objPict/IntDoors_60_geo.tif
convert images/objPict/IntDoors_60_geo.tif images/objPict/IntDoors_60_geo.png
rm images/objPict/IntDoors_60_geo.hdr
rm images/objPict/IntDoors_60_geo.tif
echo images/objPict/IntDoors_60_geo.png


- - -

mkdir -p images/objPict/
objpict radFiles/InnerDoors_80.mat radFiles/opaque_materials.mat radFiles/FacadeBrown_30_geo.rad > images/objPict/FacadeBrown_30_geo.hdr
normtiff images/objPict/FacadeBrown_30_geo.hdr images/objPict/FacadeBrown_30_geo.tif
convert images/objPict/FacadeBrown_30_geo.tif images/objPict/FacadeBrown_30_geo.png
rm images/objPict/FacadeBrown_30_geo.hdr
rm images/objPict/FacadeBrown_30_geo.tif
echo images/objPict/FacadeBrown_30_geo.png


- - -

mkdir -p images/objPict/
objpict radFiles/InnerDoors_80.mat radFiles/opaque_materials.mat radFiles/FacadeRegular_60_geo.rad > images/objPict/FacadeRegular_60_geo.hdr
normtiff images/objPict/FacadeRegular_60_geo.hdr images/objPict/FacadeRegular_60_geo.tif
convert images/objPict/FacadeRegular_60_geo.tif images/objPict/FacadeRegular_60_geo.png
rm images/objPict/FacadeRegular_60_geo.hdr
rm images/objPict/FacadeRegular_60_geo.tif
echo images/objPict/FacadeRegular_60_geo.png


- - -

mkdir -p images/objPict/
objpict radFiles/InnerDoors_80.mat radFiles/opaque_materials.mat radFiles/FacadeTegl_25_geo.rad > images/objPict/FacadeTegl_25_geo.hdr
normtiff images/objPict/FacadeTegl_25_geo.hdr images/objPict/FacadeTegl_25_geo.tif
convert images/objPict/FacadeTegl_25_geo.tif images/objPict/FacadeTegl_25_geo.png
rm images/objPict/FacadeTegl_25_geo.hdr
rm images/objPict/FacadeTegl_25_geo.tif
echo images/objPict/FacadeTegl_25_geo.png""",
    fireLogs=False,
    lastRunTime=1665,
    suppressWarnings=True,
    commands=["""mkdir -p images/objPict/
objpict ~/MantaRay/Rikshospitalet/radFiles/InnerDoors_80.mat ~/MantaRay/Rikshospitalet/radFiles/CurtainWallGlass_65.mat ~/MantaRay/Rikshospitalet/radFiles/Window_72.mat ~/MantaRay/Rikshospitalet/radFiles/ExternalDoorPanel_70.mat ~/MantaRay/Rikshospitalet/radFiles/Skylights_55.mat ~/MantaRay/Rikshospitalet/radFiles/Skylights_45.mat ~/MantaRay/Rikshospitalet/radFiles/IntDoors_80.mat ~/MantaRay/Rikshospitalet/radFiles/opaque_materials.mat /home/lio/MantaRay/Rikshospitalet/radFiles/Window_72_geo.rad > images/objPict/Window_72_geo.hdr
normtiff images/objPict/Window_72_geo.hdr images/objPict/Window_72_geo.tif
convert images/objPict/Window_72_geo.tif images/objPict/Window_72_geo.png
rm images/objPict/Window_72_geo.hdr
rm images/objPict/Window_72_geo.tif
echo images/objPict/Window_72_geo.png""", """mkdir -p images/objPict/
objpict ~/MantaRay/Rikshospitalet/radFiles/InnerDoors_80.mat ~/MantaRay/Rikshospitalet/radFiles/CurtainWallGlass_65.mat ~/MantaRay/Rikshospitalet/radFiles/Window_72.mat ~/MantaRay/Rikshospitalet/radFiles/ExternalDoorPanel_70.mat ~/MantaRay/Rikshospitalet/radFiles/Skylights_55.mat ~/MantaRay/Rikshospitalet/radFiles/Skylights_45.mat ~/MantaRay/Rikshospitalet/radFiles/IntDoors_80.mat ~/MantaRay/Rikshospitalet/radFiles/opaque_materials.mat /home/lio/MantaRay/Rikshospitalet/radFiles/CurtainWallGlass_65_geo.rad > images/objPict/CurtainWallGlass_65_geo.hdr
normtiff images/objPict/CurtainWallGlass_65_geo.hdr images/objPict/CurtainWallGlass_65_geo.tif
convert images/objPict/CurtainWallGlass_65_geo.tif images/objPict/CurtainWallGlass_65_geo.png
rm images/objPict/CurtainWallGlass_65_geo.hdr
rm images/objPict/CurtainWallGlass_65_geo.tif
echo images/objPict/CurtainWallGlass_65_geo.png""", """mkdir -p images/objPict/
objpict ~/MantaRay/Rikshospitalet/radFiles/InnerDoors_80.mat ~/MantaRay/Rikshospitalet/radFiles/CurtainWallGlass_65.mat ~/MantaRay/Rikshospitalet/radFiles/Window_72.mat ~/MantaRay/Rikshospitalet/radFiles/ExternalDoorPanel_70.mat ~/MantaRay/Rikshospitalet/radFiles/Skylights_55.mat ~/MantaRay/Rikshospitalet/radFiles/Skylights_45.mat ~/MantaRay/Rikshospitalet/radFiles/IntDoors_80.mat ~/MantaRay/Rikshospitalet/radFiles/opaque_materials.mat /home/lio/MantaRay/Rikshospitalet/radFiles/InnerWalls_60_geo.rad > images/objPict/InnerWalls_60_geo.hdr
normtiff images/objPict/InnerWalls_60_geo.hdr images/objPict/InnerWalls_60_geo.tif
convert images/objPict/InnerWalls_60_geo.tif images/objPict/InnerWalls_60_geo.png
rm images/objPict/InnerWalls_60_geo.hdr
rm images/objPict/InnerWalls_60_geo.tif
echo images/objPict/InnerWalls_60_geo.png""", """mkdir -p images/objPict/
objpict ~/MantaRay/Rikshospitalet/radFiles/InnerDoors_80.mat ~/MantaRay/Rikshospitalet/radFiles/CurtainWallGlass_65.mat ~/MantaRay/Rikshospitalet/radFiles/Window_72.mat ~/MantaRay/Rikshospitalet/radFiles/ExternalDoorPanel_70.mat ~/MantaRay/Rikshospitalet/radFiles/Skylights_55.mat ~/MantaRay/Rikshospitalet/radFiles/Skylights_45.mat ~/MantaRay/Rikshospitalet/radFiles/IntDoors_80.mat ~/MantaRay/Rikshospitalet/radFiles/opaque_materials.mat /home/lio/MantaRay/Rikshospitalet/radFiles/Skylights_55_geo.rad > images/objPict/Skylights_55_geo.hdr
normtiff images/objPict/Skylights_55_geo.hdr images/objPict/Skylights_55_geo.tif
convert images/objPict/Skylights_55_geo.tif images/objPict/Skylights_55_geo.png
rm images/objPict/Skylights_55_geo.hdr
rm images/objPict/Skylights_55_geo.tif
echo images/objPict/Skylights_55_geo.png""", """mkdir -p images/objPict/
objpict ~/MantaRay/Rikshospitalet/radFiles/InnerDoors_80.mat ~/MantaRay/Rikshospitalet/radFiles/CurtainWallGlass_65.mat ~/MantaRay/Rikshospitalet/radFiles/Window_72.mat ~/MantaRay/Rikshospitalet/radFiles/ExternalDoorPanel_70.mat ~/MantaRay/Rikshospitalet/radFiles/Skylights_55.mat ~/MantaRay/Rikshospitalet/radFiles/Skylights_45.mat ~/MantaRay/Rikshospitalet/radFiles/IntDoors_80.mat ~/MantaRay/Rikshospitalet/radFiles/opaque_materials.mat /home/lio/MantaRay/Rikshospitalet/radFiles/IntDoors_80_geo.rad > images/objPict/IntDoors_80_geo.hdr
normtiff images/objPict/IntDoors_80_geo.hdr images/objPict/IntDoors_80_geo.tif
convert images/objPict/IntDoors_80_geo.tif images/objPict/IntDoors_80_geo.png
rm images/objPict/IntDoors_80_geo.hdr
rm images/objPict/IntDoors_80_geo.tif
echo images/objPict/IntDoors_80_geo.png""", """mkdir -p images/objPict/
objpict ~/MantaRay/Rikshospitalet/radFiles/InnerDoors_80.mat ~/MantaRay/Rikshospitalet/radFiles/CurtainWallGlass_65.mat ~/MantaRay/Rikshospitalet/radFiles/Window_72.mat ~/MantaRay/Rikshospitalet/radFiles/ExternalDoorPanel_70.mat ~/MantaRay/Rikshospitalet/radFiles/Skylights_55.mat ~/MantaRay/Rikshospitalet/radFiles/Skylights_45.mat ~/MantaRay/Rikshospitalet/radFiles/IntDoors_80.mat ~/MantaRay/Rikshospitalet/radFiles/opaque_materials.mat /home/lio/MantaRay/Rikshospitalet/radFiles/InnerDoors_60_geo.rad > images/objPict/InnerDoors_60_geo.hdr
normtiff images/objPict/InnerDoors_60_geo.hdr images/objPict/InnerDoors_60_geo.tif
convert images/objPict/InnerDoors_60_geo.tif images/objPict/InnerDoors_60_geo.png
rm images/objPict/InnerDoors_60_geo.hdr
rm images/objPict/InnerDoors_60_geo.tif
echo images/objPict/InnerDoors_60_geo.png"""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])  # -> Stdout, Stderr, Ran
download_4 = Download(
    SftpPaths=flatten(executessh_35.Stdout),
    TargetLocalFolder="<WinHome>\objPict",
    Run=executessh_35.Ran,
    stdouts="C:\Users\mm1013\MantaRay\Rikshospitalet\objPict\Skylights_45_geo.png>JOIN<C:\Users\mm1013\MantaRay\Rikshospitalet\objPict\IntDoors_80_geo.png")  # -> FilePaths, Status, Ran
imageviewer = LBImageViewer(ImagePath_=download_4.FilePaths, _scale_=1, DisableClickable=False, SaveImgWithCoords=False, scale=1)  # -> ImagePath, Values, GIF

# ----
# Download and preview rad files
# (might take 1 min)
entwine_6 = Entwine(Branch00=window_mat_2, Branch01=window_rad_2, FlattenInputs=True)
entwine_7 = Entwine(Branch00=opaque_mat_2, Branch01=opaque_rad_2, FlattenInputs=True)
entwine_8 = Entwine(Branch00=other_mat_2, Branch01=other_rad_2, FlattenInputs=True)
falsestart_16 = LBFalseStartToggle(False)
falsestart_17 = LBFalseStartToggle(False)
overrides_39 = ApplyOverrides(Input="<WinHome>\Downloads")
falsestart_18 = LBFalseStartToggle(False)
download_5 = Download(
    LinuxFilePaths=flatten(entwine_6),
    TargetLocalFolder=overrides_39,
    Run=falsestart_18,
    stdouts="C:\Users\mm1013\MantaRay\TestingRemote\Downloads\Glass_70_mat.mat>JOIN<C:\Users\mm1013\MantaRay\TestingRemote\Downloads\Glass_70.rad")  # -> FilePaths, Status, Ran
download_6 = Download(
    LinuxFilePaths=entwine_8,
    TargetLocalFolder=overrides_39,
    Run=falsestart_16,
    stdouts="C:\Users\mm1013\MantaRay\Andrei\Downloads\polycarbon35diff55ref0spec_geo.rad")  # -> FilePaths, Status, Ran
download_7 = Download(
    LinuxFilePaths=entwine_7,
    TargetLocalFolder=overrides_39,
    Run=falsestart_17,
    stdouts="C:\Users\mm1013\MantaRay\Andrei\Downloads\RoofMullions_70_geo.rad>JOIN<C:\Users\mm1013\MantaRay\Andrei\Downloads\ContextMat_30_geo.rad>JOIN<C:\Users\mm1013\MantaRay\Andrei\Downloads\Ground_20_geo.rad>JOIN<C:\Users\mm1013\MantaRay\Andrei\Downloads\Floors_20_geo.rad>JOIN<C:\Users\mm1013\MantaRay\Andrei\Downloads\Ceilings_70_geo.rad>JOIN<C:\Users\mm1013\MantaRay\Andrei\Downloads\Roofs_20_geo.rad>JOIN<C:\Users\mm1013\MantaRay\Andrei\Downloads\RevitJintInnerWalls_50_geo.rad>JOIN<C:\Users\mm1013\MantaRay\Andrei\Downloads\RevitJintInnerDoors_50_geo.rad>JOIN<C:\Users\mm1013\MantaRay\Andrei\Downloads\RevitJfacadeFacadesWall_50_geo.rad>JOIN<C:\Users\mm1013\MantaRay\Andrei\Downloads\RevitJfacadeFacadesFrames_70_geo.rad>JOIN<C:\Users\mm1013\MantaRay\Andrei\Downloads\RevitJfacadeFacadeWHITE_70_geo.rad>JOIN<C:\Users\mm1013\MantaRay\Andrei\Downloads\RevitJfacadeWindowsFrames_70_geo.rad>JOIN<C:\Users\mm1013\MantaRay\Andrei\Downloads\RevitJfacadeDoors_55_geo.rad>JOIN<C:\Users\mm1013\MantaRay\Andrei\Downloads\RevitJfacadeDoorsMISC_55_geo.rad")  # -> FilePaths, Status, Ran
cull_4 = CullPattern(List=download_5.FilePaths, CullPattern=falsestart_18)
cull_5 = CullPattern(List=download_6.FilePaths, CullPattern=falsestart_16)
cull_6 = CullPattern(List=download_7.FilePaths, CullPattern=falsestart_17)
radviewer = RadViewer(
    RadFiles=flatten(cull_5),
    IsTwoSided=False,
    Polychromatic=True,
    ShowEdges=True,
    Transparent=True,
    ColorNames=["GlassTak_70_mat", "GlassInt_74_mat", "GlassFacade_74_mat", "GlassBSDF_70_mat", "SkylightWall_70_mat", "SlabCeiling_80_mat", "SlabFloor_30_mat", "SlabWall_50_mat", "SlabJ_50_mat", "WallExterior_50_mat"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],
    Colors=[RGB(177, 203, 218), RGB(149, 243, 118), RGB(218, 247, 105), RGB(165, 199, 252), RGB(100, 251, 165), RGB(203, 230, 172)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])  # -> Geo, ModifierNames, Modifiers, FailedWireFrame
radviewer_2 = RadViewer(
    RadFiles=flatten(cull_4),
    IsTwoSided=False,
    Polychromatic=True,
    ShowEdges=True,
    Transparent=True,
    ColorNames=["GlassTak_70_mat", "GlassInt_74_mat", "GlassFacade_74_mat", "GlassBSDF_70_mat", "SkylightWall_70_mat", "SlabCeiling_80_mat", "SlabFloor_30_mat", "SlabWall_50_mat", "SlabJ_50_mat", "WallExterior_50_mat", "Roofs_50_mat", "Doors_50_mat", "FramesCW_50_mat", "FacadeBright_70_mat", "ContextBright_70_mat", "WallInterior_70_mat", "FacadeDark_30_mat", "Frames_50_mat", "Terrain_20_mat", "Buildings_50_mat", "Glass_70_mat"],
    Colors=[RGB(177, 203, 218), RGB(149, 243, 118), RGB(218, 247, 105), RGB(165, 199, 252), RGB(100, 251, 165), RGB(203, 230, 172), RGB(169, 243, 224), RGB(238, 176, 232), RGB(242, 222, 239), RGB(146, 222, 239), RGB(144, 119, 233), RGB(174, 245, 124), RGB(120, 214, 159), RGB(156, 153, 225), RGB(117, 221, 150), RGB(184, 150, 138), RGB(158, 205, 172), RGB(189, 132, 143), RGB(106, 135, 236), RGB(102, 168, 232), RGB(245, 194, 251)])  # -> Geo, ModifierNames, Modifiers, FailedWireFrame
radviewer_3 = RadViewer(
    RadFiles=flatten(cull_6),
    IsTwoSided=False,
    Polychromatic=True,
    ShowEdges=True,
    Transparent=True,
    ColorNames=["GlassTak_70_mat", "GlassInt_74_mat", "GlassFacade_74_mat", "GlassBSDF_70_mat", "SkylightWall_70_mat", "SlabCeiling_80_mat", "SlabFloor_30_mat", "SlabWall_50_mat", "SlabJ_50_mat", "WallExterior_50_mat"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],
    Colors=[RGB(177, 203, 218), RGB(149, 243, 118), RGB(218, 247, 105), RGB(165, 199, 252), RGB(100, 251, 165), RGB(203, 230, 172)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])  # -> Geo, ModifierNames, Modifiers, FailedWireFrame

# ----
# OCTREE (overcast)
scene_rads = Text(entwine_4)
sky_ovc_3 = Text(sky_ovc)
python_13 = GhPythonScript(x=flatten(scene_rads))  # -> noNulls; inputs x: list
# ---------- python_13: Python ----------
__author__ = "mm1013"
__version__ = "2022.06.15"

import rhinoscriptsyntax as rs

noNulls = None not in x and len(x) > 0
# ---------- end python_13 ----------
entwine_9 = Entwine(Branch01=sky_ovc_3, Branch02=scene_rads, FlattenInputs=True)  # -> flatten(Radfiles)
panel_78 = Panel("""mkdir -p octrees/
oconv -r 2048 -w -f <rads> > octrees/<target>
echo octrees/<target>""")
and_2 = GateAnd(A=python_13, B=falsestart_6)
join_5 = TextJoin(Text=entwine_9, Join=" ")
overrides_40 = ApplyOverrides(Input=panel_78, Rads=graft(join_5), Target=graft("Scene_Overcast10klux.oct"))  # -> Output, DynamicOutput
executessh_36 = ExecuteSSH(
    _SSHCommands=overrides_40.DynamicOutput,
    Run=and_2,
    addPrefix=True,
    description="""mkdir -p octrees/
oconv -r 2048 -w -f skies/overcast_sky.rad radFiles/InnerDoors_80.mat radFiles/InnerDoors_80_geo.rad radFiles/CurtainWallGlass_65_geo.rad radFiles/Window_72_geo.rad radFiles/ExternalDoorPanel_70_geo.rad radFiles/Skylights_55_geo.rad radFiles/Skylights_45_geo.rad radFiles/IntDoors_80_geo.rad radFiles/opaque_materials.mat radFiles/InnerWalls_60_geo.rad radFiles/InnerDoors_60_geo.rad radFiles/CurtainWallFrames_70_geo.rad radFiles/FacadeWHITE_65_geo.rad radFiles/WindowFrames_70_geo.rad radFiles/ExternalDoors_55_geo.rad radFiles/Floors_40_geo.rad radFiles/Ceilings_80_geo.rad radFiles/Roofs_40_geo.rad radFiles/IntDoors_60_geo.rad radFiles/FacadeBrown_30_geo.rad radFiles/FacadeRegular_60_geo.rad radFiles/FacadeTegl_25_geo.rad radFiles/other_materials.mat > octrees/Scene_Overcast10klux.oct
echo octrees/Scene_Overcast10klux.oct""",
    fireLogs=True,
    lastRunTime=30990,
    name="oconv Scene_Overcast10klux.oct",
    staticDescription="""mkdir -p ~/MantaRay/Andrei/octrees/
oconv -r 2048 -w -f ~/MantaRay/Andrei/skies/overcast_sky.rad ~/MantaRay/Andrei/radFiles/Glass_70.mat /home/lio/MantaRay/Andrei/radFiles/Glass_70_geo.rad ~/MantaRay/Andrei/radFiles/opaque_materials.mat /home/lio/MantaRay/Andrei/radFiles/FloorMat_0.7_geo.rad /home/lio/MantaRay/Andrei/radFiles/Cladding_0.5_geo.rad /home/lio/MantaRay/Andrei/radFiles/ConcreteWhite_0.8_geo.rad /home/lio/MantaRay/Andrei/radFiles/ConcreteStructure_0.3_geo.rad /home/lio/MantaRay/Andrei/radFiles/ConcreteGrey_0.5_geo.rad /home/lio/MantaRay/Andrei/radFiles/IntWalls_0.9_geo.rad /home/lio/MantaRay/Andrei/radFiles/Pipes_0.03_geo.rad /home/lio/MantaRay/Andrei/radFiles/ConcreteDarker_0.1_geo.rad /home/lio/MantaRay/Andrei/radFiles/Frames_0.6_geo.rad /home/lio/MantaRay/Andrei/radFiles/Black_0.01_geo.rad /home/lio/MantaRay/Andrei/radFiles/CurvedCeiling_0.8_geo.rad /home/lio/MantaRay/Andrei/radFiles/IntWalls_0.8_geo.rad /home/lio/MantaRay/Andrei/radFiles/FloorBox_0.75_geo.rad ~/MantaRay/Andrei/radFiles/other_materials.mat > ~/MantaRay/Andrei/octrees/Scene_Overcast10klux.oct
echo ~/MantaRay/Andrei/octrees/Scene_Overcast10klux.oct""",
    suppressWarnings=False,
    results="octrees/Scene_Overcast10klux.oct",
    commands="""mkdir -p octrees/
oconv -r 2048 -w -f skies/overcast_sky.rad radFiles/InnerDoors_80.mat radFiles/CurtainWallGlass_65.mat radFiles/Window_72.mat radFiles/ExternalDoorPanel_70.mat radFiles/Skylights_55.mat radFiles/Skylights_45.mat radFiles/IntDoors_80.mat radFiles/InnerDoors_80_geo.rad radFiles/CurtainWallGlass_65_geo.rad radFiles/Window_72_geo.rad radFiles/ExternalDoorPanel_70_geo.rad radFiles/Skylights_55_geo.rad radFiles/Skylights_45_geo.rad radFiles/IntDoors_80_geo.rad radFiles/opaque_materials.mat radFiles/InnerWalls_60_geo.rad radFiles/InnerDoors_60_geo.rad radFiles/CurtainWallFrames_70_geo.rad radFiles/FacadeWHITE_65_geo.rad radFiles/WindowFrames_70_geo.rad radFiles/ExternalDoors_55_geo.rad radFiles/Floors_40_geo.rad radFiles/Ceilings_80_geo.rad radFiles/Roofs_40_geo.rad radFiles/IntDoors_60_geo.rad radFiles/FacadeBrown_30_geo.rad radFiles/FacadeRegular_60_geo.rad radFiles/FacadeTegl_25_geo.rad radFiles/FacadeWHITEish_50_geo.rad radFiles/Ground_20_geo.rad radFiles/ContextMat_40_geo.rad radFiles/RoofMullions_80_geo.rad radFiles/other_materials.mat radFiles/TRANSLUCENT_geo.rad > octrees/Scene_Overcast10klux.oct
echo octrees/Scene_Overcast10klux.oct""")  # -> Stdout, Stderr_, Ran
panel_79 = Panel(overrides_40.Output)
panel_80 = Panel(executessh_36.Stderr_)
octree_overcast = Text(executessh_36.Stdout)

# ----
# Daylight Factor simulation grid based
panel_81 = Panel("""mkdir -p results/
mkdir -p ambFiles/
mkdir -p timing/
date > timing/start.md
rtrace -af ambFiles/<af> -n 50 -w -h -I+ <ambientSettings> <octree> < <pts> > results/daylightFactor.ill
echo results/daylightFactor.ill
date > timing/end.md""")
octree_overcast_2 = Text(octree_overcast)
overrides_41 = ApplyOverrides(
    Input=panel_81,
    AmbientSettings=graft("-ab 5 -ad 1024 -lw 0.002"),
    Octree=graft(octree_overcast_2),
    Pts=graft("<pts>"),
    Af=graft("<af>"))  # -> Output, DynamicOutput
python_14 = GhPythonScript(update=flatten(overrides_41.DynamicOutput))  # -> time; inputs update: tree
# ---------- python_14: Python ----------
#if not update:
#    return self.time
"""Provides a scripting component.
    Inputs:
        x: The x script variable
        y: The y script variable
    Output:
        a: The a output variable"""
        
__author__ = "mm1013"
__version__ = "2022.08.30"
        
import rhinoscriptsyntax as rs
        
from datetime import datetime
dt = datetime.now()
        
time = "%02d_%02d_%02d_%02d%02d_%02d" % (dt.year, dt.month, dt.day, dt.hour, dt.minute, dt.second)
# ---------- end python_14 ----------
ptsfile_3 = Text(ptsfile)
overrides_42 = ApplyOverrides(Input=overrides_41.DynamicOutput, Af=graft(python_14), Pts=graft(ptsfile_3))  # -> Output, DynamicOutput
falsestart_19 = LBFalseStartToggle(False)
executessh_37 = ExecuteSSH(
    _SSHCommands_=overrides_42.DynamicOutput,
    Run=falsestart_19,
    addPrefix=True,
    description="""mkdir -p results/
mkdir -p ambFiles/
mkdir -p timing/
date > timing/start.md
rtrace -af ambFiles/2023_04_06_2339_39 -n 50 -w -h -I+ -ab 5 -ad 1024 -lw 0.002 octrees/Scene_Overcast10klux.oct < ptsFiles/points.pts > results/daylightFactor.ill
echo results/daylightFactor.ill
date > timing/end.md""",
    fireLogs=False,
    lastRunTime=269354,
    suppressWarnings=False,
    results="results/daylightFactor.ill",
    stderr="""rtracertracertracertracertracertracertracertracertracertracertracertracertracertracertracertracertracertracertracertracertracertracertracertrace: : : : : : : : rtrace: : : : : : : : : : : : : : : : signal - signal - signal - signal - signal - signal - signal - signal - signal - : signal - signal - signal - signal - signal - signal - signal - signal - signal - signal - signal - signal - signal - signal - signal - TerminateTerminateTerminateTerminateTerminateTerminateTerminateTerminateTerminate
signal - Terminate
TerminateTerminate
TerminateTerminateTerminateTerminateTerminateTerminateTerminateTerminateTerminate
TerminateTerminate
Terminate






Terminate










rtrace

: signal - Terminate
rtracertrace: : signal - rtracesignal - Terminate: Terminatesignal - 

Terminate
rtrace: signal - Terminate
rtracertrace: : signal - signal - Terminate
Terminate
rtrace: signal - Terminate
rtracertrace: : signal - signal - TerminateTerminate

rtrace: signal - Terminate
rtrace: signal - Terminate
rtrace: signal - Terminate
rtrace: signal - Terminate
rtrace: signal - Terminate
rtrace: signal - Terminate
rtrace: signal - Terminate
rtrace: signal - Terminate
rtrace: signal - Terminate
rtrace: signal - Terminate
rtracertrace: : signal - signal - Terminate
Terminate
rtrace: signal - Terminate
rtrace: signal - Terminate
rtrace: signal - Terminate
rtrace: signal - Terminate""",
    commands="""mkdir -p results/
mkdir -p ambFiles/
mkdir -p timing/
date > timing/start.md
rtrace -af ambFiles/2023_04_04_0905_54 -n 50 -w -h -I+ -ab 5 -ad 1024 -lw 0.002 octrees/Scene_Overcast10klux.oct < ~/MantaRay/Rikshospitalet/ptsFiles/points.pts > results/daylightFactor.ill
echo results/daylightFactor.ill
date > timing/end.md""")  # -> Stdout, Stderr_, Ran
executessh_38 = ExecuteSSH(
    _SSHCommands_="echo results/daylightFactor.ill",
    Run=falsestart_5,
    addPrefix=True,
    fireLogs=False,
    lastRunTime=30,
    suppressWarnings=False,
    results="results/daylightFactor.ill",
    commands="echo results/daylightFactor.ill")  # -> Stdout, Stderr_, Ran
overrides_43 = ApplyOverrides(Input="cat <ill> | rcalc -e '$1=179*($1*.265+$2*.670+$3*.065)'", Ill=graft(executessh_38.Stdout))  # -> Output, DynamicOutput
executessh_39 = ExecuteSSH(
    _SSHCommands_=overrides_43.DynamicOutput,
    Run=executessh_38.Ran,
    addPrefix=True,
    description="cat results/daylightFactor.ill | rcalc -e '$1=179*($1*.265+$2*.670+$3*.065)'",
    fireLogs=False,
    lastRunTime=31,
    suppressWarnings=False,
    commands="cat results/daylightFactor.ill | rcalc -e '$1=179*($1*.265+$2*.670+$3*.065)'")  # -> Stdout, Stderr_, Ran
gradient = Gradient(
    LowerLimit=0,
    UpperLimit=1,
    Parameter=1,
    stops=[0: RGB(0, 0, 255), 0.1: RGB(53, 0, 202), 0.2: RGB(107, 0, 148), 0.3: RGB(160, 0, 95), 0.4: RGB(214, 0, 41), 0.5: RGB(255, 12, 0), 0.6: RGB(255, 66, 0), 0.7: RGB(255, 119, 0), 0.8: RGB(255, 173, 0), 0.9: RGB(255, 226, 0), 1: RGB(255, 255, 0)])
gridsettings = GridSettings(From="0", To="5", ASteps="11", BStepSize=-1)
split = TextSplit(Text=executessh_39.Stdout)
pt_2 = Point(grid.Points)
num = Number(split)
unflatten = UnflattenTree(Tree=num, Guide=pt_2)
dam = DataDam(DataA=unflatten, BufferDelay=10000000, BufferMode=0)
gridviewer = GridViewer(
    Grids=flatten(grid.Grids),
    Results=dam,
    _Gradient=gradient,
    _MinColor=RGB(169, 169, 169),
    _MaxColor=RGB(211, 211, 211),
    _SectionType=gridsettings)  # -> ColoredMesh, LayeredMesh, Curves, Planes, TempMeshes, flatten(Colors), flatten(Values)
panel_82 = Panel(gridviewer.Values)
mesh = Mesh(gridviewer.LayeredMesh)
path_mapper = PathMapper(mesh, source="{A;B}", target="{A;B+1}")
split_2 = SplitTree(Data=path_mapper, Masks=flatten("{*;0}"))  # -> Positive, Negative
demesh = DeconstructMesh(Mesh=split_2.Positive)  # -> Vertices, Faces, Colours, Normals
mesh_2 = Mesh(split_2.Negative)
abc_a = ABC(data=mesh_2)
item_2 = ListItem(List=demesh.Vertices, Index=0, Wrap=True)
xy = XYPlane(Origin=item_2)
scale_nu = ScaleNU(Geometry=abc_a, Plane=xy, ScaleX=1, ScaleY=1, ScaleZ=Slider(1.68, range=0.01..2.1))  # -> Geometry, Transform
medges = MeshEdges(Mesh=scale_nu.Geometry)  # -> NakedEdges, InteriorEdges, NonManifoldEdges; disabled
mjoin = MeshJoin(Meshes=scale_nu.Geometry)
join_6 = JoinCurves(Curves=medges.NakedEdges, Preserve=False)  # disabled

# ----
# OCTREE (Sunny - 10 hourly skies!)
scene_rads_2 = Text(entwine_4)
falsestart_20 = LBFalseStartToggle(False)
entwine_10 = Entwine(Branch02=scene_rads_2, FlattenInputs=True)  # -> flatten(Radfiles)
python_15 = GhPythonScript(x=flatten(scene_rads_2))  # -> a; inputs x: list
# ---------- python_15: Python ----------
__author__ = "mm1013"
__version__ = "2022.06.15"

import rhinoscriptsyntax as rs

a = None not in x
# ---------- end python_15 ----------
panel_83 = Panel("""cd <proj>
mkdir -p octrees/
oconv -r 2048 -f -w <rads> > octrees/<target>
echo octrees/<target>""")
join_7 = TextJoin(Text=entwine_10, Join=" ")
overrides_44 = ApplyOverrides(Input=panel_83, Rads=graft(join_7), Target=graft("my_test_scene_NOSKY.oct"))  # -> Output, DynamicOutput
panel_84 = Panel("""cd <proj>
oconv -r 2048 -i <oldOct> -f <newRads> > octrees/<target>_<h>.oct;echo octrees/<target>_<h>.oct""")
executessh_40 = ExecuteSSH(
    _SSHCommands_=overrides_44.DynamicOutput,
    Run=[python_15, falsestart_20],
    addPrefix=True,
    description="""cd ~/MantaRay/Rikshospitalet
mkdir -p octrees/
oconv -r 2048 -f -w radFiles/InnerDoors_80.mat radFiles/InnerDoors_80_geo.rad radFiles/CurtainWallGlass_65_geo.rad radFiles/Window_72_geo.rad radFiles/ExternalDoorPanel_70_geo.rad radFiles/Skylights_55_geo.rad radFiles/Skylights_45_geo.rad radFiles/IntDoors_80_geo.rad radFiles/opaque_materials.mat radFiles/InnerWalls_60_geo.rad radFiles/InnerDoors_60_geo.rad radFiles/CurtainWallFrames_70_geo.rad radFiles/FacadeWHITE_65_geo.rad radFiles/WindowFrames_70_geo.rad radFiles/ExternalDoors_55_geo.rad radFiles/Floors_40_geo.rad radFiles/Ceilings_80_geo.rad radFiles/Roofs_40_geo.rad radFiles/IntDoors_60_geo.rad radFiles/FacadeBrown_30_geo.rad radFiles/FacadeRegular_60_geo.rad radFiles/FacadeTegl_25_geo.rad radFiles/other_materials.mat > octrees/my_test_scene_NOSKY.oct
echo octrees/my_test_scene_NOSKY.oct""",
    fireLogs=False,
    lastRunTime=1581,
    suppressWarnings=False,
    results="octrees/my_test_scene_NOSKY.oct",
    commands="""cd ~/MantaRay/TestFolder
mkdir -p octrees/
oconv -r 2048 -f -w ~/MantaRay/TestFolder/radFiles/Glass_70.mat /home/lio/MantaRay/TestFolder/radFiles/Glass_70_geo.rad ~/MantaRay/TestFolder/radFiles/opaque_materials.mat /home/lio/MantaRay/TestFolder/radFiles/FloorMat_70_geo.rad /home/lio/MantaRay/TestFolder/radFiles/Cladding_50_geo.rad /home/lio/MantaRay/TestFolder/radFiles/ConcreteWhite_80_geo.rad /home/lio/MantaRay/TestFolder/radFiles/ConcreteStructure_30_geo.rad /home/lio/MantaRay/TestFolder/radFiles/ConcreteGrey_50_geo.rad /home/lio/MantaRay/TestFolder/radFiles/IntWalls_90_geo.rad /home/lio/MantaRay/TestFolder/radFiles/Pipes_3_geo.rad /home/lio/MantaRay/TestFolder/radFiles/ConcreteDarker_10_geo.rad /home/lio/MantaRay/TestFolder/radFiles/Frames_60_geo.rad /home/lio/MantaRay/TestFolder/radFiles/Black_1_geo.rad /home/lio/MantaRay/TestFolder/radFiles/CurvedCeiling_80_geo.rad /home/lio/MantaRay/TestFolder/radFiles/IntWalls_80_geo.rad /home/lio/MantaRay/TestFolder/radFiles/FloorBox_75_geo.rad ~/MantaRay/TestFolder/radFiles/other_materials.mat > octrees/my_test_scene_NOSKY.oct
echo octrees/my_test_scene_NOSKY.oct""")  # -> Stdout, Stderr_, Ran
hours_3 = Text(hours_2)
sky_sunny = Text(graft(item.Item1))
panel_85 = Panel(executessh_40.Stdout)
overrides_45 = ApplyOverrides(
    Input=panel_84,
    OldOct=graft(executessh_40.Stdout),
    NewRads=graft(sky_sunny),
    Target=graft("my_test_scene"),
    H=graft(hours_3))  # -> Output, DynamicOutput
executessh_41 = ExecuteSSH(
    _SSHCommands_=overrides_45.DynamicOutput,
    Run=executessh_40.Ran,
    addPrefix=True,
    description="""cd ~/MantaRay/Rikshospitalet
oconv -r 2048 -i octrees/my_test_scene_NOSKY.oct -f ~/MantaRay/TestingRemote/skies/sunny_sky_8.rad > octrees/my_test_scene_0800.oct;echo octrees/my_test_scene_0800.oct


- - -

cd ~/MantaRay/Rikshospitalet
oconv -r 2048 -i octrees/my_test_scene_NOSKY.oct -f ~/MantaRay/TestingRemote/skies/sunny_sky_9.rad > octrees/my_test_scene_0900.oct;echo octrees/my_test_scene_0900.oct


- - -

cd ~/MantaRay/Rikshospitalet
oconv -r 2048 -i octrees/my_test_scene_NOSKY.oct -f ~/MantaRay/TestingRemote/skies/sunny_sky_10.rad > octrees/my_test_scene_1000.oct;echo octrees/my_test_scene_1000.oct


- - -

cd ~/MantaRay/Rikshospitalet
oconv -r 2048 -i octrees/my_test_scene_NOSKY.oct -f ~/MantaRay/TestingRemote/skies/sunny_sky_11.rad > octrees/my_test_scene_1100.oct;echo octrees/my_test_scene_1100.oct


- - -

cd ~/MantaRay/Rikshospitalet
oconv -r 2048 -i octrees/my_test_scene_NOSKY.oct -f ~/MantaRay/TestingRemote/skies/sunny_sky_12.rad > octrees/my_test_scene_1200.oct;echo octrees/my_test_scene_1200.oct


- - -

cd ~/MantaRay/Rikshospitalet
oconv -r 2048 -i octrees/my_test_scene_NOSKY.oct -f ~/MantaRay/TestingRemote/skies/sunny_sky_13.rad > octrees/my_test_scene_1300.oct;echo octrees/my_test_scene_1300.oct


- - -

cd ~/MantaRay/Rikshospitalet
oconv -r 2048 -i octrees/my_test_scene_NOSKY.oct -f ~/MantaRay/TestingRemote/skies/sunny_sky_14.rad > octrees/my_test_scene_1400.oct;echo octrees/my_test_scene_1400.oct


- - -

cd ~/MantaRay/Rikshospitalet
oconv -r 2048 -i octrees/my_test_scene_NOSKY.oct -f ~/MantaRay/TestingRemote/skies/sunny_sky_15.rad > octrees/my_test_scene_1500.oct;echo octrees/my_test_scene_1500.oct


- - -

cd ~/MantaRay/Rikshospitalet
oconv -r 2048 -i octrees/my_test_scene_NOSKY.oct -f ~/MantaRay/TestingRemote/skies/sunny_sky_16.rad > octrees/my_test_scene_1600.oct;echo octrees/my_test_scene_1600.oct


- - -

cd ~/MantaRay/Rikshospitalet
oconv -r 2048 -i octrees/my_test_scene_NOSKY.oct -f ~/MantaRay/TestingRemote/skies/sunny_sky_17.rad > octrees/my_test_scene_1700.oct;echo octrees/my_test_scene_1700.oct""",
    fireLogs=False,
    lastRunTime=704,
    suppressWarnings=False,
    results=["octrees/my_test_scene_0800.oct", "octrees/my_test_scene_0900.oct", "octrees/my_test_scene_1000.oct", "octrees/my_test_scene_1100.oct", "octrees/my_test_scene_1200.oct", "octrees/my_test_scene_1300.oct", "octrees/my_test_scene_1400.oct", "octrees/my_test_scene_1500.oct", "octrees/my_test_scene_1600.oct", "octrees/my_test_scene_1700.oct"],
    commands=["""cd ~/MantaRay/TestFolder
oconv -r 2048 -i octrees/my_test_scene_NOSKY.oct -f ~/MantaRay/TestingRemote/skies/sunny_sky_9.rad > octrees/my_test_scene_0900.oct;echo octrees/my_test_scene_0900.oct""", """cd ~/MantaRay/TestFolder
oconv -r 2048 -i octrees/my_test_scene_NOSKY.oct -f ~/MantaRay/TestingRemote/skies/sunny_sky_8.rad > octrees/my_test_scene_0800.oct;echo octrees/my_test_scene_0800.oct""", """cd ~/MantaRay/TestFolder
oconv -r 2048 -i octrees/my_test_scene_NOSKY.oct -f ~/MantaRay/TestingRemote/skies/sunny_sky_10.rad > octrees/my_test_scene_1000.oct;echo octrees/my_test_scene_1000.oct""", """cd ~/MantaRay/TestFolder
oconv -r 2048 -i octrees/my_test_scene_NOSKY.oct -f ~/MantaRay/TestingRemote/skies/sunny_sky_12.rad > octrees/my_test_scene_1200.oct;echo octrees/my_test_scene_1200.oct""", """cd ~/MantaRay/TestFolder
oconv -r 2048 -i octrees/my_test_scene_NOSKY.oct -f ~/MantaRay/TestingRemote/skies/sunny_sky_11.rad > octrees/my_test_scene_1100.oct;echo octrees/my_test_scene_1100.oct""", """cd ~/MantaRay/TestFolder
oconv -r 2048 -i octrees/my_test_scene_NOSKY.oct -f ~/MantaRay/TestingRemote/skies/sunny_sky_13.rad > octrees/my_test_scene_1300.oct;echo octrees/my_test_scene_1300.oct""", """cd ~/MantaRay/TestFolder
oconv -r 2048 -i octrees/my_test_scene_NOSKY.oct -f ~/MantaRay/TestingRemote/skies/sunny_sky_14.rad > octrees/my_test_scene_1400.oct;echo octrees/my_test_scene_1400.oct""", """cd ~/MantaRay/TestFolder
oconv -r 2048 -i octrees/my_test_scene_NOSKY.oct -f ~/MantaRay/TestingRemote/skies/sunny_sky_15.rad > octrees/my_test_scene_1500.oct;echo octrees/my_test_scene_1500.oct""", """cd ~/MantaRay/TestFolder
oconv -r 2048 -i octrees/my_test_scene_NOSKY.oct -f ~/MantaRay/TestingRemote/skies/sunny_sky_17.rad > octrees/my_test_scene_1700.oct;echo octrees/my_test_scene_1700.oct""", """cd ~/MantaRay/TestFolder
oconv -r 2048 -i octrees/my_test_scene_NOSKY.oct -f ~/MantaRay/TestingRemote/skies/sunny_sky_16.rad > octrees/my_test_scene_1600.oct;echo octrees/my_test_scene_1600.oct"""])  # -> Stdout, Stderr_, Ran

# ----
# Parallel RTRACE render
# with ambient cache - with error log
run_2 = LBFalseStartToggle(False)
octree = Text(executessh_36.Stdout)
viewfile = Text(executessh_17.Stdout)
panel_86 = Panel("""mkdir -p images/
mkdir -p ambientFiles/
vwrays -ff -x 300 -y 300 -vf <vf> -pa 1 | rtrace <radOptions> -af ambientFiles/<af> -w -n <cpus> `vwrays -d -ff -x 300 -y 300 -vf <vf> -pa 1` -ffc -e ambientFiles/<target-.>_ot.err <oct> > /dev/null
vwrays -ff -x <x> -y <y> -vf <vf> -pa 1 | rtrace <radOptions> -af ambientFiles/<af> -w -n <cpus> `vwrays -d -ff -x <x> -y <y> -vf <vf> -pa 1` -ffc -e ambientFiles/<target-.>.err <oct> > images/<target-.>.hdr
echo images/<target-.>.hdr""")
python_16 = GhPythonScript(x=viewfile)  # -> a
# ---------- python_16: Python ----------
__author__ = "mm1013"
__version__ = "2022.09.13"

import rhinoscriptsyntax as rs

a = x.split("/")[-1].split(".")[0]
# ---------- end python_16 ----------
panel_87 = Panel("<time>_<view>_render.hdr")
panel_88 = Panel("-ar 512 -as 128 -ab 2 -aa 0.2 -ad 4096")
overrides_46 = ApplyOverrides(
    Input=panel_86,
    X=graft("<x>"),
    Y=graft("<y>"),
    Vf=graft("<vf>"),
    RadOptions=graft(panel_88),
    Oct=graft(octree),
    Af=graft("<af>"),
    Time=graft("<time>"),
    View=graft("<view>"))  # -> Output, DynamicOutput
python_17 = GhPythonScript(update=overrides_46.Output)  # -> time; inputs update: tree; same code as python_14
x_5 = RemoteReceiver(x)
y_3 = RemoteReceiver(y)
overrides_47 = ApplyOverrides(
    Input=overrides_46.DynamicOutput,
    Time=graft(python_17),
    View=graft(viewname_2),
    Vf=graft(executessh_17.Stdout),
    Af=graft("ambfile2_<time>.af"),
    X=graft(x_5),
    Y=graft(y_3),
    Target=graft(panel_87))  # -> Output, DynamicOutput
falsestart_21 = LBFalseStartToggle(False)
executessh_42 = ExecuteSSH(
    _SSHCommands_=overrides_47.DynamicOutput,
    Run=run_2,
    addPrefix=True,
    description="""mkdir -p images/
mkdir -p ambientFiles/
vwrays -ff -x 300 -y 300 -vf views/Perspective2.vf -pa 1 | rtrace -ar 512 -as 128 -ab 2 -aa 0.2 -ad 4096 -af ambientFiles/ambfile2_2023_04_06_2339_32.af -w -n 63 `vwrays -d -ff -x 300 -y 300 -vf views/Perspective2.vf -pa 1` -ffc -e ambientFiles/2023_04_06_2339_32_Perspective2_render.hdr_ot.err octrees/Scene_Overcast10klux.oct > /dev/null
vwrays -ff -x 750 -y 375 -vf views/Perspective2.vf -pa 1 | rtrace -ar 512 -as 128 -ab 2 -aa 0.2 -ad 4096 -af ambientFiles/ambfile2_2023_04_06_2339_32.af -w -n 63 `vwrays -d -ff -x 750 -y 375 -vf views/Perspective2.vf -pa 1` -ffc -e ambientFiles/2023_04_06_2339_32_Perspective2_render.hdr.err octrees/Scene_Overcast10klux.oct > images/2023_04_06_2339_32_Perspective2_render.hdr.hdr
echo images/2023_04_06_2339_32_Perspective2_render.hdr.hdr""",
    fireLogs=False,
    lastRunTime=139786,
    suppressWarnings=False,
    results="images/2023_03_31_2208_54_Perspective2_render.hdr.hdr",
    commands="""mkdir -p images/
mkdir -p ambientFiles/
vwrays -ff -x 300 -y 300 -vf views/Perspective2.vf -pa 1 | rtrace -ar 512 -as 128 -ab 2 -aa 0.2 -ad 4096 -af ambientFiles/ambfile2_2023_03_31_2208_54.af -w -n 63 `vwrays -d -ff -x 300 -y 300 -vf views/Perspective2.vf -pa 1` -ffc -e ambientFiles/2023_03_31_2208_54_Perspective2_render.hdr_ot.err octrees/Scene_Overcast10klux.oct > /dev/null
vwrays -ff -x 750 -y 375 -vf views/Perspective2.vf -pa 1 | rtrace -ar 512 -as 128 -ab 2 -aa 0.2 -ad 4096 -af ambientFiles/ambfile2_2023_03_31_2208_54.af -w -n 63 `vwrays -d -ff -x 750 -y 375 -vf views/Perspective2.vf -pa 1` -ffc -e ambientFiles/2023_03_31_2208_54_Perspective2_render.hdr.err octrees/Scene_Overcast10klux.oct > images/2023_03_31_2208_54_Perspective2_render.hdr.hdr
echo images/2023_03_31_2208_54_Perspective2_render.hdr.hdr""")  # -> Stdout, Stderr_, Ran
or = GateOr(A=falsestart_21, B=executessh_42.Ran)

# ----
# Parallel RTRACE render (illuminance)
# with ambient cache (reusing file from above!)
panel_89 = Panel("""mkdir -p images/
mkdir -p ambientFiles/
vwrays -ff -x <x> -y <y> -vf <vf> -pa 1 | rtrace -i <radOptions> -af ambientFiles/<af> -w -n <cpus> `vwrays -d -ff -x <x> -y <y> -vf <vf> -pa 1` -ffc <oct> > images/<target-.>.hdr
echo images/<target-.>.hdr""")
octree_2 = Text(executessh_36.Stdout)
viewfile_2 = Text(executessh_17.Stdout)
run_3 = LBFalseStartToggle(False)
python_18 = GhPythonScript(x=viewfile_2)  # -> a; same code as python_16
overrides_48 = ApplyOverrides(
    Input=panel_89,
    X=graft("<x>"),
    Y=graft("<y>"),
    Vf=graft(viewfile_2),
    RadOptions=graft(panel_88),
    Oct=graft(octree_2),
    Af=graft("<af>"),
    View=graft(python_18),
    Time=graft("<time>"))  # -> Output, DynamicOutput
x_6 = RemoteReceiver(x)
y_4 = RemoteReceiver(y)
overrides_49 = ApplyOverrides(
    Input=overrides_48.DynamicOutput,
    Time=graft(python_17),
    View=graft(viewname_2),
    Vf=graft(executessh_17.Stdout),
    Af=graft("ambfile2_<time>.af"),
    Target=graft("<time>_<view>_render_illum.hdr"),
    X=graft(x_6),
    Y=graft(y_4))  # -> Output, DynamicOutput
executessh_43 = ExecuteSSH(
    _SSHCommands_=overrides_49.DynamicOutput,
    Run=run_3,
    addPrefix=True,
    description="""mkdir -p images/
mkdir -p ambientFiles/
vwrays -ff -x 750 -y 375 -vf views/Perspective2.vf -pa 1 | rtrace -i -ar 512 -as 128 -ab 2 -aa 0.2 -ad 4096 -af ambientFiles/ambfile2_2023_04_06_2339_32.af -w -n 63 `vwrays -d -ff -x 750 -y 375 -vf views/Perspective2.vf -pa 1` -ffc octrees/Scene_Overcast10klux.oct > images/2023_04_06_2339_32_Perspective2_render_illum.hdr.hdr
echo images/2023_04_06_2339_32_Perspective2_render_illum.hdr.hdr""",
    fireLogs=False,
    lastRunTime=6614,
    suppressWarnings=False,
    results="images/2023_03_31_2208_54_Perspective2_render_illum.hdr.hdr",
    commands="""mkdir -p images/
mkdir -p ambientFiles/
vwrays -ff -x 750 -y 375 -vf views/Perspective2.vf -pa 1 | rtrace -i -ar 512 -as 128 -ab 2 -aa 0.2 -ad 4096 -af ambientFiles/ambfile2_2023_03_31_2208_54.af -w -n 63 `vwrays -d -ff -x 750 -y 375 -vf views/Perspective2.vf -pa 1` -ffc octrees/Scene_Overcast10klux.oct > images/2023_03_31_2208_54_Perspective2_render_illum.hdr.hdr
echo images/2023_03_31_2208_54_Perspective2_render_illum.hdr.hdr""")  # -> Stdout, Stderr_, Ran

panel_90 = Panel(overrides_47.Output)

# ----
# False color with illuminance curves
# on top of luminance picture
panel_91 = Panel("falsecolor -s 0.1 -n 10 -m 1.79 -l DF -p <irrad> -i <irrad> -cp > <irrad-.>_fc4.hdr;echo <irrad-.>_fc4.hdr")
overrides_50 = ApplyOverrides(Input=panel_91, Irrad=graft(executessh_43.Stdout))  # -> Output, DynamicOutput
executessh_44 = ExecuteSSH(
    _SSHCommands_=overrides_50.DynamicOutput,
    Run=executessh_43.Ran,
    addPrefix=True,
    description="falsecolor -s 0.1 -n 10 -m 1.79 -l DF -p images/2023_03_31_2208_54_Perspective2_render_illum.hdr.hdr -i images/2023_03_31_2208_54_Perspective2_render_illum.hdr.hdr -cp > images/2023_03_31_2208_54_Perspective2_render_illum.hdr_fc4.hdr;echo images/2023_03_31_2208_54_Perspective2_render_illum.hdr_fc4.hdr",
    fireLogs=False,
    lastRunTime=573,
    suppressWarnings=False,
    results="images/2023_03_31_2208_54_Perspective2_render_illum.hdr_fc4.hdr",
    commands="falsecolor -s 0.1 -n 10 -m 1.79 -l DF -p images/2023_03_31_2208_54_Perspective2_render_illum.hdr.hdr -i images/2023_03_31_2208_54_Perspective2_render_illum.hdr.hdr -cp > images/2023_03_31_2208_54_Perspective2_render_illum.hdr_fc4.hdr;echo images/2023_03_31_2208_54_Perspective2_render_illum.hdr_fc4.hdr")  # -> Stdout, Stderr_, Ran
download_8 = Download(
    LinuxFilePaths=executessh_44.Stdout,
    Run=executessh_44.Ran,
    stdouts="C:\Users\mm1013\MantaRay\TestFolder\2023_03_31_2208_54_Perspective2_render_illum.hdr_fc4.hdr")  # -> FilePaths, Status, Ran
imageviewer_2 = LBImageViewer(ImagePath_=download_8.FilePaths, _scale_="1", DisableClickable=False, SaveImgWithCoords=False, scale=1)  # -> ImagePath, Values, GIF

# ----
# Using PCOND to set automatic exposure
# and convert to PNG
no_auto_exposure = Panel("""pfilt -1 -e +4 <hdr> > <hdr-.>_exposed2.hdr
ra_tiff <hdr-.>_exposed2.hdr <hdr-.>_exposed2.tif
convert <hdr-.>_exposed2.tif <hdr-.>_exposed2.png
echo <hdr-.>_exposed2.png""")
panel_92 = Panel("""pcond -h <hdr> <hdr-.>_exposed.hdr
ra_tiff <hdr-.>_exposed.hdr <hdr-.>_exposed.tif
convert <hdr-.>_exposed.tif <hdr-.>_exposed.png
echo <hdr-.>_exposed.png""")
overrides_51 = ApplyOverrides(Input=[no_auto_exposure, panel_92], Hdr=graft(executessh_42.Stdout))  # -> Output, DynamicOutput
executessh_45 = ExecuteSSH(
    _SSHCommands_=overrides_51.DynamicOutput,
    Run=or,
    addPrefix=True,
    description="""pfilt -1 -e +4 images/2023_03_31_2208_54_Perspective2_render.hdr.hdr > images/2023_03_31_2208_54_Perspective2_render.hdr_exposed2.hdr
ra_tiff images/2023_03_31_2208_54_Perspective2_render.hdr_exposed2.hdr images/2023_03_31_2208_54_Perspective2_render.hdr_exposed2.tif
convert images/2023_03_31_2208_54_Perspective2_render.hdr_exposed2.tif images/2023_03_31_2208_54_Perspective2_render.hdr_exposed2.png
echo images/2023_03_31_2208_54_Perspective2_render.hdr_exposed2.png
pcond -h images/2023_03_31_2208_54_Perspective2_render.hdr.hdr images/2023_03_31_2208_54_Perspective2_render.hdr_exposed.hdr
ra_tiff images/2023_03_31_2208_54_Perspective2_render.hdr_exposed.hdr images/2023_03_31_2208_54_Perspective2_render.hdr_exposed.tif
convert images/2023_03_31_2208_54_Perspective2_render.hdr_exposed.tif images/2023_03_31_2208_54_Perspective2_render.hdr_exposed.png
echo images/2023_03_31_2208_54_Perspective2_render.hdr_exposed.png""",
    fireLogs=False,
    lastRunTime=64,
    suppressWarnings=False,
    results="""images/2023_03_31_2208_54_Perspective2_render.hdr_exposed2.png
_JOIN_
images/2023_03_31_2208_54_Perspective2_render.hdr_exposed.png""",
    commands="""pfilt -1 -e +4 images/2023_03_31_2208_54_Perspective2_render.hdr.hdr > images/2023_03_31_2208_54_Perspective2_render.hdr_exposed2.hdr
ra_tiff images/2023_03_31_2208_54_Perspective2_render.hdr_exposed2.hdr images/2023_03_31_2208_54_Perspective2_render.hdr_exposed2.tif
convert images/2023_03_31_2208_54_Perspective2_render.hdr_exposed2.tif images/2023_03_31_2208_54_Perspective2_render.hdr_exposed2.png
echo images/2023_03_31_2208_54_Perspective2_render.hdr_exposed2.png
_JOIN_
pcond -h images/2023_03_31_2208_54_Perspective2_render.hdr.hdr images/2023_03_31_2208_54_Perspective2_render.hdr_exposed.hdr
ra_tiff images/2023_03_31_2208_54_Perspective2_render.hdr_exposed.hdr images/2023_03_31_2208_54_Perspective2_render.hdr_exposed.tif
convert images/2023_03_31_2208_54_Perspective2_render.hdr_exposed.tif images/2023_03_31_2208_54_Perspective2_render.hdr_exposed.png
echo images/2023_03_31_2208_54_Perspective2_render.hdr_exposed.png""")  # -> Stdout, Stderr_, Ran
download_9 = Download(
    LinuxFilePaths=executessh_45.Stdout,
    Run=executessh_45.Ran,
    stdouts="C:\Users\mm1013\MantaRay\TestFolder\2023_03_31_2208_54_Perspective2_render.hdr_exposed2.png>JOIN<C:\Users\mm1013\MantaRay\TestFolder\2023_03_31_2208_54_Perspective2_render.hdr_exposed.png")  # -> FilePaths, Status, Ran
imageviewer_3 = LBImageViewer(ImagePath_=download_9.FilePaths, _scale_="1", DisableClickable=False, SaveImgWithCoords=False, scale=1)  # -> ImagePath, Values, GIF

# ----
# False color with illuminance curves
# on top of luminance picture
panel_93 = Panel("""pcond -h <rad> <rad-.>_exposed.hdr
falsecolor -s 9000 -d 0 -l lux -p <rad-.>_exposed.hdr -i <irrad> -cl -log 3 > <rad-.>_fc.hdr;echo <rad-.>_fc.hdr""")
rad = Text(executessh_42.Stdout)
irrad = Text(executessh_43.Stdout)
bool_6 = Boolean([or, executessh_43.Ran])
overrides_52 = ApplyOverrides(Input=panel_93, Rad=graft(rad), Irrad=graft(irrad))  # -> Output, DynamicOutput
executessh_46 = ExecuteSSH(
    _SSHCommands_=overrides_52.DynamicOutput,
    Run=bool_6,
    addPrefix=True,
    description="""pcond -h images/2023_03_31_2208_54_Perspective2_render.hdr.hdr images/2023_03_31_2208_54_Perspective2_render.hdr_exposed.hdr
falsecolor -s 9000 -d 0 -l lux -p images/2023_03_31_2208_54_Perspective2_render.hdr_exposed.hdr -i images/2023_03_31_2208_54_Perspective2_render_illum.hdr.hdr -cl -log 3 > images/2023_03_31_2208_54_Perspective2_render.hdr_fc.hdr;echo images/2023_03_31_2208_54_Perspective2_render.hdr_fc.hdr""",
    fireLogs=False,
    lastRunTime=95,
    suppressWarnings=False,
    results="images/2023_03_31_2208_54_Perspective2_render.hdr_fc.hdr",
    commands="""pcond -h images/2023_03_31_2208_54_Perspective2_render.hdr.hdr images/2023_03_31_2208_54_Perspective2_render.hdr_exposed.hdr
falsecolor -s 9000 -d 0 -l lux -p images/2023_03_31_2208_54_Perspective2_render.hdr_exposed.hdr -i images/2023_03_31_2208_54_Perspective2_render_illum.hdr.hdr -cl -log 3 > images/2023_03_31_2208_54_Perspective2_render.hdr_fc.hdr;echo images/2023_03_31_2208_54_Perspective2_render.hdr_fc.hdr""")  # -> Stdout, Stderr_, Ran
download_10 = Download(
    LinuxFilePaths=executessh_46.Stdout,
    Run=executessh_46.Ran,
    stdouts="C:\Users\mm1013\MantaRay\TestFolder\2023_03_31_2208_54_Perspective2_render.hdr_fc.hdr")  # -> FilePaths, Status, Ran
imageviewer_4 = LBImageViewer(ImagePath_=download_10.FilePaths, _scale_="1", DisableClickable=False, SaveImgWithCoords=False, scale=1)  # -> ImagePath, Values, GIF

# ----
# killl the task
panel_94 = Panel("cat <LinuxHome>/ambientFiles/<target-.>_ot.err")
overrides_53 = ApplyOverrides(Input=panel_94, Target=graft(panel_87), Time=graft(python_17), View=graft(viewname_2))  # -> Output, DynamicOutput
executessh_47 = ExecuteSSH(
    _SSHCommands_=overrides_53.DynamicOutput,
    Run=falsestart_12,
    addPrefix=True,
    description="cat ~/MantaRay/Rikshospitalet/ambientFiles/2023_04_06_2339_32_Perspective2_render_ot.err",
    fireLogs=False,
    lastRunTime=64,
    suppressWarnings=False,
    stderr="cat: /home/lio/MantaRay/TestFolder/ambientFiles/2023_03_31_2208_54_Perspective2_render_ot.err: No such file or directory",
    commands="cat ~/MantaRay/TestFolder/ambientFiles/2023_03_31_2208_54_Perspective2_render_ot.err")  # -> Stdout, Stderr_, Ran
panel_95 = Panel(executessh_47.Stdout)
python_19 = GhPythonScript(errIn=executessh_47.Stdout)  # -> pid, run
# ---------- python_19: Python ----------
__author__ = "mm1013"
__version__ = "2022.10.06"

import rhinoscriptsyntax as rs

start = errIn.split(":")[0].split(" ")[-1]
print(start)
try:
    pid = int(start)
    run = True
except:
    run = False
# ---------- end python_19 ----------
falsestart_22 = LBFalseStartToggle(False)
overrides_54 = ApplyOverrides(Input="kill <pid>", Pid=graft(python_19.pid))  # -> Output, DynamicOutput
executessh_48 = ExecuteSSH(
    _SSHCommands_=overrides_54.Output,
    Run=flatten([python_19.run, falsestart_22]),
    addPrefix=True,
    fireLogs=False,
    lastRunTime=0,
    suppressWarnings=False)  # -> Stdout, Stderr_, Ran

# ----
# attempt to probe values from pixels
panel_96 = Panel("pcomb -o <hdr> | pcompos -x 2 -y 2 - -<x> -<y> | pvalue -h -H -df | total -if3 -m | sed -r 's/[\t]+/1/g'")  # disabled
pdecon = Deconstruct(Point=pt)  # -> XComponent, YComponent, ZComponent; disabled
subtraction = Subtraction(A=y_3, B=pdecon.YComponent)  # disabled
overrides_55 = ApplyOverrides(Input=panel_96, Hdr=graft(executessh_43.Stdout), X=graft(pdecon.XComponent), Y=graft(subtraction))  # -> Output, DynamicOutput; disabled
item_3 = ListItem(List=flatten(overrides_55.Output), Index=0, Wrap=True)  # disabled
executessh_49 = ExecuteSSH(
    _SSHCommands_=overrides_55.DynamicOutput,
    Run=executessh_43.Ran,
    addPrefix=True,
    description="""pcomb -o images/2023_03_31_2208_54_Perspective2_render_illum.hdr.hdr | pcompos -x 2 -y 2 - -811 --255 | pvalue -h -H -df | total -if3 -m | sed -r 's/[\t]+/1/g'


- - -

pcomb -o images/2023_03_31_2208_54_Perspective2_render_illum.hdr.hdr | pcompos -x 2 -y 2 - -812 --293 | pvalue -h -H -df | total -if3 -m | sed -r 's/[\t]+/1/g'


- - -

pcomb -o images/2023_03_31_2208_54_Perspective2_render_illum.hdr.hdr | pcompos -x 2 -y 2 - -814 --340 | pvalue -h -H -df | total -if3 -m | sed -r 's/[\t]+/1/g'


- - -

pcomb -o images/2023_03_31_2208_54_Perspective2_render_illum.hdr.hdr | pcompos -x 2 -y 2 - -816 --378 | pvalue -h -H -df | total -if3 -m | sed -r 's/[\t]+/1/g'


- - -

pcomb -o images/2023_03_31_2208_54_Perspective2_render_illum.hdr.hdr | pcompos -x 2 -y 2 - -816 --423 | pvalue -h -H -df | total -if3 -m | sed -r 's/[\t]+/1/g'


- - -

pcomb -o images/2023_03_31_2208_54_Perspective2_render_illum.hdr.hdr | pcompos -x 2 -y 2 - -1312 --93 | pvalue -h -H -df | total -if3 -m | sed -r 's/[\t]+/1/g'


- - -

pcomb -o images/2023_03_31_2208_54_Perspective2_render_illum.hdr.hdr | pcompos -x 2 -y 2 - -1308 --131 | pvalue -h -H -df | total -if3 -m | sed -r 's/[\t]+/1/g'


- - -

pcomb -o images/2023_03_31_2208_54_Perspective2_render_illum.hdr.hdr | pcompos -x 2 -y 2 - -1305 --172 | pvalue -h -H -df | total -if3 -m | sed -r 's/[\t]+/1/g'


- - -

pcomb -o images/2023_03_31_2208_54_Perspective2_render_illum.hdr.hdr | pcompos -x 2 -y 2 - -1305 --199 | pvalue -h -H -df | total -if3 -m | sed -r 's/[\t]+/1/g'


- - -

pcomb -o images/2023_03_31_2208_54_Perspective2_render_illum.hdr.hdr | pcompos -x 2 -y 2 - -1299 --231 | pvalue -h -H -df | total -if3 -m | sed -r 's/[\t]+/1/g'


- - -

pcomb -o images/2023_03_31_2208_54_Perspective2_render_illum.hdr.hdr | pcompos -x 2 -y 2 - -1627 --35 | pvalue -h -H -df | total -if3 -m | sed -r 's/[\t]+/1/g'


- - -

pcomb -o images/2023_03_31_2208_54_Perspective2_render_illum.hdr.hdr | pcompos -x 2 -y 2 - -1619 --65 | pvalue -h -H -df | total -if3 -m | sed -r 's/[\t]+/1/g'


- - -

pcomb -o images/2023_03_31_2208_54_Perspective2_render_illum.hdr.hdr | pcompos -x 2 -y 2 - -1614 --93 | pvalue -h -H -df | total -if3 -m | sed -r 's/[\t]+/1/g'


- - -

pcomb -o images/2023_03_31_2208_54_Perspective2_render_illum.hdr.hdr | pcompos -x 2 -y 2 - -1608 --125 | pvalue -h -H -df | total -if3 -m | sed -r 's/[\t]+/1/g'


- - -

pcomb -o images/2023_03_31_2208_54_Perspective2_render_illum.hdr.hdr | pcompos -x 2 -y 2 - -132 -354 | pvalue -h -H -df | total -if3 -m | sed -r 's/[\t]+/1/g'""",
    fireLogs=False,
    lastRunTime=804,
    suppressWarnings=False,
    results=["01010", "01010", "01010", "01010", "01010", "01010", "01010", "01010", "01010", "01010", "01010", "01010", "01010", "01010", "01010"],
    commands=["pcomb -o images/2023_03_31_2208_54_Perspective2_render_illum.hdr.hdr | pcompos -x 2 -y 2 - -811 --255 | pvalue -h -H -df | total -if3 -m | sed -r 's/[\t]+/1/g'", "pcomb -o images/2023_03_31_2208_54_Perspective2_render_illum.hdr.hdr | pcompos -x 2 -y 2 - -814 --340 | pvalue -h -H -df | total -if3 -m | sed -r 's/[\t]+/1/g'", "pcomb -o images/2023_03_31_2208_54_Perspective2_render_illum.hdr.hdr | pcompos -x 2 -y 2 - -812 --293 | pvalue -h -H -df | total -if3 -m | sed -r 's/[\t]+/1/g'", "pcomb -o images/2023_03_31_2208_54_Perspective2_render_illum.hdr.hdr | pcompos -x 2 -y 2 - -816 --378 | pvalue -h -H -df | total -if3 -m | sed -r 's/[\t]+/1/g'", "pcomb -o images/2023_03_31_2208_54_Perspective2_render_illum.hdr.hdr | pcompos -x 2 -y 2 - -816 --423 | pvalue -h -H -df | total -if3 -m | sed -r 's/[\t]+/1/g'", "pcomb -o images/2023_03_31_2208_54_Perspective2_render_illum.hdr.hdr | pcompos -x 2 -y 2 - -1312 --93 | pvalue -h -H -df | total -if3 -m | sed -r 's/[\t]+/1/g'", "pcomb -o images/2023_03_31_2208_54_Perspective2_render_illum.hdr.hdr | pcompos -x 2 -y 2 - -1308 --131 | pvalue -h -H -df | total -if3 -m | sed -r 's/[\t]+/1/g'", "pcomb -o images/2023_03_31_2208_54_Perspective2_render_illum.hdr.hdr | pcompos -x 2 -y 2 - -1305 --172 | pvalue -h -H -df | total -if3 -m | sed -r 's/[\t]+/1/g'", "pcomb -o images/2023_03_31_2208_54_Perspective2_render_illum.hdr.hdr | pcompos -x 2 -y 2 - -1305 --199 | pvalue -h -H -df | total -if3 -m | sed -r 's/[\t]+/1/g'", "pcomb -o images/2023_03_31_2208_54_Perspective2_render_illum.hdr.hdr | pcompos -x 2 -y 2 - -1299 --231 | pvalue -h -H -df | total -if3 -m | sed -r 's/[\t]+/1/g'", "pcomb -o images/2023_03_31_2208_54_Perspective2_render_illum.hdr.hdr | pcompos -x 2 -y 2 - -1627 --35 | pvalue -h -H -df | total -if3 -m | sed -r 's/[\t]+/1/g'", "pcomb -o images/2023_03_31_2208_54_Perspective2_render_illum.hdr.hdr | pcompos -x 2 -y 2 - -1619 --65 | pvalue -h -H -df | total -if3 -m | sed -r 's/[\t]+/1/g'", "pcomb -o images/2023_03_31_2208_54_Perspective2_render_illum.hdr.hdr | pcompos -x 2 -y 2 - -1614 --93 | pvalue -h -H -df | total -if3 -m | sed -r 's/[\t]+/1/g'", "pcomb -o images/2023_03_31_2208_54_Perspective2_render_illum.hdr.hdr | pcompos -x 2 -y 2 - -1608 --125 | pvalue -h -H -df | total -if3 -m | sed -r 's/[\t]+/1/g'", "pcomb -o images/2023_03_31_2208_54_Perspective2_render_illum.hdr.hdr | pcompos -x 2 -y 2 - -132 -354 | pvalue -h -H -df | total -if3 -m | sed -r 's/[\t]+/1/g'"])  # -> Stdout, Stderr_, Ran; disabled
panel_97 = Panel(item_3)  # disabled
python_20 = GhPythonScript(val=executessh_49.Stdout)  # -> x, y, z, ln; disabled
# ---------- python_20: Python ----------
__author__ = "mm1013"
__version__ = "2022.09.28"

import rhinoscriptsyntax as rs

length = int(len(val)/3.0)
x = val[0:length]
y = val[length:2*length]
z = val[2*length:3*length]
ln = length
# ---------- end python_20 ----------
panel_98 = Panel(executessh_49.Stdout)  # disabled

# ----
# WEA file (+ Skymatrix)
panel_99 = Panel("<LinuxHome>/weatherData")

# ---- group: Outdated
overrides_56 = ApplyOverrides(Input_=panel_99)  # -> Output, Pairs

# ----
cluster_7 = Cluster_4(x=overrides_56.Output)

upload_4 = Upload(SubfolderOverride=cluster_7, stdouts="~/simulation/weatherData/NOR_Oslo.Fornebu.014880_IWEC.epw")  # -> Status, FilePaths, Run

# ---- group: Outdated
overrides_57 = ApplyOverrides(Input_="epw2wea <epw> <epw-.>.wea 1>&2;echo <epw-.>.wea", Epw=graft(upload_4.FilePaths))  # -> Output, Pairs

executessh_wip = ExecuteSSHWIP(
    _SSHCommands=overrides_57.Output,
    Run=upload_4.Run,
    addPrefix=True,
    description="epw2wea <epw> <epw>.wea 1>&2;echo <epw>.wea",
    fireLogs=True,
    lastRunTime=8,
    name="weaFile",
    suppressWarnings=True,
    results="/home/mss/simulation/weatherData/NOR_Oslo.Fornebu.014880_IWEC.wea",
    stderr="""place OSLO/FORNEBU_NOR
latitude 59.90
longitude -10.62
time_zone -15.00
site_elevation 17.0
weather_data_file_units 1""",
    commands="epw2wea ~/simulation/weatherData/NOR_Oslo.Fornebu.014880_IWEC.epw ~/simulation/weatherData/NOR_Oslo.Fornebu.014880_IWEC.wea 1>&2;echo ~/simulation/weatherData/NOR_Oslo.Fornebu.014880_IWEC.wea")  # -> Stdout, Stderr, Ran

# ----
panel_100 = Panel(executessh_wip.Stdout)

# ----
# Annual sky-matrix 145 patches
panel_101 = Panel("gendaymtx -m 1 \"<wea>\" > <wea-.>_m1.smx;echo \"<wea-.>_m1.smx\"")

# ---- group: Outdated
overrides_58 = ApplyOverrides(Input=panel_101, Wea=graft(panel_100))  # -> Output, Pairs

executessh_wip_2 = ExecuteSSHWIP(
    _SSHCommands_=overrides_58.Output,
    Run=executessh_wip.Ran,
    addPrefix=True,
    description="gendaymtx -m 1 \"/home/mss/simulation/weatherData/NOR_Oslo.Fornebu.014880_IWEC.wea\" > /home/mss/simulation/weatherData/NOR_Oslo.Fornebu.014880_IWEC_m1.smx;echo \"/home/mss/simulation/weatherData/NOR_Oslo.Fornebu.014880_IWEC_m1.smx\"",
    fireLogs=False,
    lastRunTime=1581,
    suppressWarnings=False,
    results="/home/mss/simulation/weatherData/NOR_Oslo.Fornebu.014880_IWEC_m1.smx",
    commands="gendaymtx -m 1 \"/home/mss/simulation/weatherData/NOR_Oslo.Fornebu.014880_IWEC.wea\" > /home/mss/simulation/weatherData/NOR_Oslo.Fornebu.014880_IWEC_m1.smx;echo \"/home/mss/simulation/weatherData/NOR_Oslo.Fornebu.014880_IWEC_m1.smx\"")  # -> Stdout, Stderr_, Ran

# ----
skymatrix_smx = Panel(executessh_wip_2.Stdout)
skymtx = Text(executessh_wip_2.Stdout)

# ----
# Get diffuseHorizontal from EPW
panel_102 = Panel("rcalc -t, -e '$1=$16' <epw>")

# ---- group: Outdated
overrides_59 = ApplyOverrides(Input_=panel_102, Epw=graft(upload_4.FilePaths))  # -> Output, Pairs

executessh_wip_3 = ExecuteSSHWIP(
    _SSHCommands_=overrides_59.Output,
    Run=upload_4.Run,
    addPrefix=True,
    description="rcalc -t, -e '$1=$16' <epw>",
    fireLogs=False,
    lastRunTime=55,
    suppressWarnings=False,
    results="""0
5.4
0
5.81
0
0
0
0
0
0
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""",
    commands="rcalc -t, -e '$1=$16' ~/simulation/weatherData/NOR_Oslo.Fornebu.014880_IWEC.epw")  # -> Stdout, Stderr_, Ran

# ----
python_21 = GhPythonScript(inp=executessh_wip_3.Stdout)  # -> illum
# ---------- python_21: Python ----------
__author__ = "mm1013"
__version__ = "2022.07.04"

import rhinoscriptsyntax as rs

illum = [float(i) for i in inp.split("\n")][8:] #skipping headers
# ---------- end python_21 ----------

# ----
# EN17037 Schedule
# EN17037 Schedule
cluster_8 = Cluster_5(horizontaldiffrad=python_21)

# ---- group: visualize schedule
_3dchart = Ladybug_3DChart(inputData=flatten(cluster_8), xScale="0.25", zScale="0")  # -> readMe, graphMesh, graphCurves, legend, legendBasePts, title, titleBasePts, dataPts, conditionalHOY; disabled; plug-in component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
ladybug = Ladybug_Ladybug()  # -> Vviiiiiiiiiizzz; disabled; plug-in component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

# ----
panel_103 = Panel("""mkdir -p <proj>/views/
echo "<vf>" > <proj>/views/<target>.vf
echo <proj>/views/<target>.vf""")
concat_6 = Concatenate(FragmentA="Perspective", FragmentB="1")

# ----
# Doubleclick Me To update view
view_3 = CreateView(Viewport="Perspective")  # -> ViewfileContent, ImageRatio

panel_104 = Panel(view_3.ViewfileContent)
vf_3 = Text(view_3.ViewfileContent)
overrides_60 = ApplyOverrides(Input=panel_103, Vf=graft(vf_3), Target=graft(concat_6))  # -> Output, DynamicOutput
executessh_50 = ExecuteSSH(
    _SSHCommands_=overrides_60.DynamicOutput,
    Run=Toggle(True),
    addPrefix=True,
    description="""mkdir -p ~/MantaRay/Rikshospitalet/views/
echo "rvu -vtv -vp 75.5197777614021 9.89092850558018 3.98572082775036 -vd -0.0917128823950573 0.977503100394468 -0.189937979145807 -vu -0.017742746895685 0.189107458484822 0.981796090885479 -vh 100.097 -vv 50.000" > ~/MantaRay/Rikshospitalet/views/Perspective1.vf
echo ~/MantaRay/Rikshospitalet/views/Perspective1.vf""",
    fireLogs=False,
    lastRunTime=32.4674,
    suppressWarnings=False,
    results="/home/lio/MantaRay/Rikshospitalet/views/Perspective1.vf",
    commands="""mkdir -p ~/MantaRay/Rikshospitalet/views/
echo "rvu -vtv -vp 75.5197777614021 9.89092850558018 3.98572082775036 -vd -0.0917128823950573 0.977503100394468 -0.189937979145807 -vu -0.017742746895685 0.189107458484822 0.981796090885479 -vh 100.097 -vv 50.000" > ~/MantaRay/Rikshospitalet/views/Perspective1.vf
echo ~/MantaRay/Rikshospitalet/views/Perspective1.vf""")  # -> Stdout, Stderr_, Ran

# ----
# VIEW
file_exists = Panel("[ -f <out> ] && echo \"1\" || echo \"0\"")
item_4 = ListItem(List=flatten(executessh_50.Stdout), Index=0, Wrap=True)
panel_105 = Panel(executessh_50.Stdout)
overrides_61 = ApplyOverrides(Input=file_exists, Out=graft(item_4))  # -> Output, DynamicOutput
executessh_51 = ExecuteSSH(
    _SSHCommands_=overrides_61.DynamicOutput,
    Run=executessh_36.Ran,
    addPrefix=True,
    description="[ -f /home/lio/MantaRay/Rikshospitalet/views/Perspective1.vf ] && echo \"1\" || echo \"0\"",
    fireLogs=False,
    lastRunTime=29,
    suppressWarnings=False,
    results="1",
    commands="[ -f /home/lio/MantaRay/Rikshospitalet/views/Perspective1.vf ] && echo \"1\" || echo \"0\"")  # -> Stdout, Stderr_, Ran

# ----
# Raytracing (rfluxmtx)
# Generate daylight coefficients
panel_106 = Panel("wc -l < <ptsFile>")
points = Text(ptsfile_2)
# 2phase DDS simulation
# export PATH=$PATH.:/usr/local/radiance/bin
# export RAYPATH=.:/usr/local/radiance/lib
panel_107 = Panel("""mkdir -p <proj>/mtxs/
rfluxmtx -I+ -w -y <ptcount> -lw 0.0001 -ab 5 -ad 5000 -n <cpus> - <skyglow> -i <octree> < <points> > <proj>/mtxs/<target>;echo <proj>/mtxs/<target>""")
skyglow = Text()
octree_3 = Text()

overrides_62 = ApplyOverrides(Input=panel_106, PtsFile=graft(points))  # -> Output, DynamicOutput
executessh_52 = ExecuteSSH(
    _SSHCommands_=overrides_62.DynamicOutput,
    Run=falsestart_7,
    addPrefix=True,
    description="wc -l < ptsFiles/points.pts",
    fireLogs=False,
    lastRunTime=0,
    suppressWarnings=False)  # -> Stdout, Stderr_, Ran

# ----
# Raytracing (rfluxmtx)
# Generate daylight coefficients black (direct only)
panel_108 = Panel("dcd_illum.mtx")
panel_109 = Panel("""mkdir -p <proj>/mtxs/
rfluxmtx -w -I+ -y <ptcount> -lw 0.0002 -ab 1 -ad 5000 -n <cpus> - <skyglow> -i <octree> < <points> > <proj>/mtxs/<target>;echo <proj>/mtxs/<target>""")
octree_black = Text()
skyglow_2 = Text(skyglow)
points_2 = Text(points)

# ----
# Raytracing suns (rcontrib)
# Calculate illuminance sun coefficients for illuminance calculations
panel_110 = Panel("cdsDDS_illum.mtx")
panel_111 = Panel("""mkdir -p <proj>/mtxs/
rcontrib -w -I+ -ab 1 -y <ptcount> -n <cpus> -ad 256 -lw 1.0e-3 -dc 1 -dt 0 -dj 0 -faf -e MF:6 -f reinhart.cal -b rbin -bn Nrbins -m solar <octree> < <points> > <proj>/mtxs/<target>
echo <proj>/mtxs/<target>""")
octree_blackdds = Text()
points_3 = Text(points_2)

# ----
# RENDER WITH RAD (rif files)
# Careful that this sets -av which will brighten your overall picture
octree_4 = Data(octree_overcast)
panel_112 = Panel("""rtpict -w -n <cpus> @<options> -x 500 -y 400 -vf <vf> -af <target-.>.amb <oct> > <LinuxHome>/<target-.>_overture.hdr
rtpict -w -n <cpus> @<options> -vf <vf> -af <target-.>.amb <oct> > <LinuxHome>/<target>
echo <LinuxHome>/<target>""")
panel_113 = Panel("""pcond -h <hdr> <hdr-.>_exposed.hdr
ra_tiff <hdr-.>_exposed.hdr <hdr-.>_exposed.tif
convert <hdr-.>_exposed.tif <hdr-.>_exposed.png
echo <hdr-.>_exposed.png""")

# ----
# https://discourse.radiance-online.org/t/rad-program-for-generating-parameters/6026
panel_114 = Panel("scene.rif")
panel_115 = Panel("AMBFILE= xxx")
python_22 = GhPythonScript(update=Button())  # -> time; inputs update: tree; same code as python_14
overrides_63 = ApplyOverrides(
    Input=panel_44,
    RIF=graft(panel_43),
    Target=graft(panel_114),
    Oct=graft(octree_4),
    Zone=graft(zone_2.zone),
    Vn=graft(viewname_2),
    V=graft(executessh_17.Stdout),
    Af=graft(python_22))  # -> Output, DynamicOutput
falsestart_23 = LBFalseStartToggle(False)
executessh_53 = ExecuteSSH(
    _SSHCommands_=overrides_63.Output,
    Run=falsestart_23,
    addPrefix=True,
    fireLogs=False,
    lastRunTime=86,
    suppressWarnings=False,
    results="render.opt",
    commands="""echo "rpict= rtpict -af 2023_03_31_2155_49.af -n 63
RESOLUTION=1700
QUALITY=M
DETAIL=H
EXPOSURE=+0.0
UP= Z
INDIRECT=2
VARIABILITY=H
REPORT= 1
ZONE=E 0.00 14.49 0.00 18.21 0.00 13.53

OCTREE=octrees/Scene_Overcast10klux.oct
view=Perspective2 -vf views/Perspective2.vf" > scene.rif
rad -n -s scene.rif OPTFILE=render.opt
echo render.opt""")  # -> Stdout, Stderr_, Ran
overrides_64 = ApplyOverrides(Input="cat <target>", Target=graft(executessh_53.Stdout))  # -> Output, DynamicOutput
executessh_54 = ExecuteSSH(
    _SSHCommands_=overrides_64.Output,
    Run=executessh_53.Ran,
    addPrefix=True,
    fireLogs=False,
    lastRunTime=115,
    suppressWarnings=False,
    results="""-dp 1024
-ar 200
-ms 0.19
-ds .3
-dt .1
-dc .5
-dr 1
-ss 1
-st .1
-ab 2
-aa .1
-ad 1536
-as 392
-av 0.18 0.18 0.18
-lr 8
-lw 1e-4""",
    commands="cat render.opt")  # -> Stdout, Stderr_, Ran
panel_116 = Panel(executessh_54.Stdout)

overrides_65 = ApplyOverrides(
    Input=panel_112,
    Oct=graft(octree_4),
    Target=graft("myRender.hdr"),
    Options=graft(executessh_53.Stdout),
    Vf=graft(executessh_17.Stdout))  # -> Output, DynamicOutput
executessh_55 = ExecuteSSH(
    _SSHCommands=overrides_65.Output,
    Run=executessh_53.Ran,
    addPrefix=True,
    fireLogs=False,
    lastRunTime=5155,
    suppressWarnings=False,
    results="/home/lio/MantaRay/TestFolder/myRender.hdr",
    commands="""rtpict -w -n 63 @render.opt -x 500 -y 400 -vf views/Perspective2.vf -af myRender.amb octrees/Scene_Overcast10klux.oct > ~/MantaRay/TestFolder/myRender_overture.hdr
rtpict -w -n 63 @render.opt -vf views/Perspective2.vf -af myRender.amb octrees/Scene_Overcast10klux.oct > ~/MantaRay/TestFolder/myRender.hdr
echo ~/MantaRay/TestFolder/myRender.hdr""")  # -> Stdout, Stderr_, Ran
overrides_66 = ApplyOverrides(Input=[panel_51, panel_113], Hdr=graft(executessh_55.Stdout))  # -> Output, graft(DynamicOutput)
executessh_56 = ExecuteSSH(
    _SSHCommands_=overrides_66.DynamicOutput,
    Run=executessh_55.Ran,
    addPrefix=True,
    description="""pfilt -e -1 /home/lio/MantaRay/TestFolder/myRender.hdr > /home/lio/MantaRay/TestFolder/myRender_exposed2.hdr
ra_tiff /home/lio/MantaRay/TestFolder/myRender_exposed2.hdr /home/lio/MantaRay/TestFolder/myRender_exposed2.tif
convert /home/lio/MantaRay/TestFolder/myRender_exposed2.tif /home/lio/MantaRay/TestFolder/myRender_exposed2.png
echo /home/lio/MantaRay/TestFolder/myRender_exposed2.png


- - -

pcond -h /home/lio/MantaRay/TestFolder/myRender.hdr /home/lio/MantaRay/TestFolder/myRender_exposed.hdr
ra_tiff /home/lio/MantaRay/TestFolder/myRender_exposed.hdr /home/lio/MantaRay/TestFolder/myRender_exposed.tif
convert /home/lio/MantaRay/TestFolder/myRender_exposed.tif /home/lio/MantaRay/TestFolder/myRender_exposed.png
echo /home/lio/MantaRay/TestFolder/myRender_exposed.png""",
    fireLogs=False,
    lastRunTime=153,
    suppressWarnings=False,
    results=["/home/lio/MantaRay/TestFolder/myRender_exposed2.png", "/home/lio/MantaRay/TestFolder/myRender_exposed.png"],
    commands=["""pfilt -e -1 /home/lio/MantaRay/TestFolder/myRender.hdr > /home/lio/MantaRay/TestFolder/myRender_exposed2.hdr
ra_tiff /home/lio/MantaRay/TestFolder/myRender_exposed2.hdr /home/lio/MantaRay/TestFolder/myRender_exposed2.tif
convert /home/lio/MantaRay/TestFolder/myRender_exposed2.tif /home/lio/MantaRay/TestFolder/myRender_exposed2.png
echo /home/lio/MantaRay/TestFolder/myRender_exposed2.png""", """pcond -h /home/lio/MantaRay/TestFolder/myRender.hdr /home/lio/MantaRay/TestFolder/myRender_exposed.hdr
ra_tiff /home/lio/MantaRay/TestFolder/myRender_exposed.hdr /home/lio/MantaRay/TestFolder/myRender_exposed.tif
convert /home/lio/MantaRay/TestFolder/myRender_exposed.tif /home/lio/MantaRay/TestFolder/myRender_exposed.png
echo /home/lio/MantaRay/TestFolder/myRender_exposed.png"""])  # -> Stdout, Stderr_, Ran
download_11 = Download(
    LinuxFilePaths=flatten(executessh_56.Stdout),
    Run=executessh_56.Ran,
    stdouts="C:\Users\mm1013\MantaRay\TestFolder\myRender_exposed2.png>JOIN<C:\Users\mm1013\MantaRay\TestFolder\myRender_exposed.png")  # -> flatten(FilePaths), Status, Ran
imageviewer_5 = LBImageViewer(ImagePath_=download_11.FilePaths, _scale_="1", DisableClickable=False, SaveImgWithCoords=False, scale=1)  # -> ImagePath, Values, GIF

panel_117 = Panel(overrides_65.Output)

pt_count = Panel(executessh_52.Stdout)
ptscount = Integer(executessh_52.Stdout)

overrides_67 = ApplyOverrides(
    Input=panel_107,
    Ptcount=graft(ptscount),
    Skyglow=graft(skyglow),
    Octree=graft(octree_3),
    Points=graft(points),
    Target=graft("dc_illum.mtx"))  # -> Output, DynamicOutput
executessh_57 = ExecuteSSH(
    _SSHCommands_=overrides_67.DynamicOutput,
    Run=executessh_52.Ran,
    addPrefix=True,
    description="""mkdir -p ~/MantaRay/Rikshospitalet/mtxs/
rfluxmtx -I+ -w -y <ptcount> -lw 0.0001 -ab 5 -ad 5000 -n 63 - <skyglow> -i <octree> < ptsFiles/points.pts > ~/MantaRay/Rikshospitalet/mtxs/dc_illum.mtx;echo ~/MantaRay/Rikshospitalet/mtxs/dc_illum.mtx""",
    fireLogs=False,
    lastRunTime=0,
    suppressWarnings=False)  # -> Stdout, Stderr_, Ran

panel_118 = Panel(overrides_67.DynamicOutput)
panel_119 = Panel(executessh_57.Stdout)

# ----
# Parallel RTPICT render (luminance)
# without ambient cache - high res, low ad
# always cheeck if theres a viewfile!
supersampling_2 = Panel("4")
octree_5 = Text(octree_overcast)
viewfile_3 = Text(executessh_16.Stdout)
x_7 = RemoteReceiver(x)
y_5 = RemoteReceiver(y)
panel_120 = Panel("""mkdir -p images/
rm -r images/<target>
rtpict -n <cpus> -w -ov images/<target> -vf <vf> -x <x> -y <y> <radOptions> <oct>;echo images/<target>""")
panel_121 = Panel("<time>_rtpict_rendering_aa0_<x>_sunny_ad32_<h>")
multiplication_3 = Multiplication(A=x_7, B=supersampling_2)
multiplication_4 = Multiplication(A=y_5, B=supersampling_2)
run_4 = LBFalseStartToggle(False)
python_23 = GhPythonScript(update=run_4)  # -> time; inputs update: tree
# ---------- python_23: Python ----------
__author__ = "mm1013"
__version__ = "2022.08.30"

import rhinoscriptsyntax as rs

from datetime import datetime
dt = datetime.now()

time = "%02d_%02d_%02d_%02d%02d" % (dt.year, dt.month, dt.day, dt.hour, dt.minute)
# ---------- end python_23 ----------
hours_4 = Number("0")

# ----
# raw render of material colors
panel_122 = Panel("""rpict -vf <vf> -x <x> -y <y> <radOptions> <oct> |
pfilt -x /<ss> -y /<ss> -1 -r 0.7 > <proj>/images/<target>_colors_filt.hdr
echo <proj>/images/<target>_colors_filt.hdr""")
viewfile_4 = Text(executessh_16.Stdout)
octree_6 = Text(octree_overcast)
supersampling_3 = Panel("4")
y_6 = RemoteReceiver(y)
x_8 = RemoteReceiver(x)
multiplication_5 = Multiplication(A=x_8, B=supersampling_3)
multiplication_6 = Multiplication(A=y_6, B=supersampling_3)
overrides_68 = ApplyOverrides(
    Input=panel_122,
    Vf=graft(viewfile_4),
    X=graft(multiplication_5),
    Y=graft(multiplication_6),
    Target=graft(panel_121),
    RadOptions=graft("-ab 0 -ad 1 -aa 1 -w -av 1 1 1"),
    Oct=graft(octree_6),
    Time=graft(python_23),
    H=graft(hours_4),
    Ss=graft(supersampling_3))  # -> Output, DynamicOutput
run_5 = LBFalseStartToggle(False)
panel_123 = Panel(overrides_68.DynamicOutput)
executessh_58 = ExecuteSSH(
    _SSHCommands=overrides_68.DynamicOutput,
    Run=run_5,
    addPrefix=True,
    description="""rpict -vf /home/lio/MantaRay/Rikshospitalet/views/Perspective3.vf -x 3000 -y 1500 -ab 0 -ad 1 -aa 1 -w -av 1 1 1 octrees/Scene_Overcast10klux.oct |
pfilt -x /4 -y /4 -1 -r 0.7 > ~/MantaRay/Rikshospitalet/images/2023_04_06_2313_rtpict_rendering_aa0_3000_sunny_ad32_0_colors_filt.hdr
echo ~/MantaRay/Rikshospitalet/images/2023_04_06_2313_rtpict_rendering_aa0_3000_sunny_ad32_0_colors_filt.hdr""",
    fireLogs=True,
    lastRunTime=80956,
    name="rpict for colors (denoisr test)",
    suppressWarnings=True,
    results="/home/lio/simulation/Boston_Skylights/images/2023_01_09_1607_rtpict_rendering_aa0_20000_sunny_ad32_0_colors_filt.hdr",
    commands="""rpict -vf /home/lio/MantaRay/TestingRemote/views/Perspective1.vf -x 20000 -y 10000 -ab 0 -ad 1 -aa 1 -w -av 1 1 1 /home/lio/simulation/Boston_Skylights/octrees/my_test_scene.oct |
pfilt -x /4 -y /4 -1 -r 0.7 > ~/simulation/Boston_Skylights/images/2023_01_09_1607_rtpict_rendering_aa0_20000_sunny_ad32_0_colors_filt.hdr
echo ~/simulation/Boston_Skylights/images/2023_01_09_1607_rtpict_rendering_aa0_20000_sunny_ad32_0_colors_filt.hdr""")  # -> Stdout, Stderr, Ran
download_12 = Download(SftpPaths=flatten(executessh_58.Stdout), Run=executessh_58.Ran)  # -> FilePaths, Status, Ran
imageviewer_6 = LBImageViewer(ImagePath_=download_12.FilePaths, _scale_=1, DisableClickable=False, SaveImgWithCoords=False, scale=1)  # -> ImagePath, Values, GIF

overrides_69 = ApplyOverrides(Input=panel_121, X=graft(x_7), Time=graft("<time>"), H=graft("<h>"))  # -> Output, DynamicOutput

overrides_70 = ApplyOverrides(
    Input=panel_120,
    Vf=graft(viewfile_3),
    X=graft(multiplication_3),
    Y=graft(multiplication_4),
    Target=graft(overrides_69.Output),
    RadOptions=graft("-ab 3 -ad 8 -aa 0"),
    Oct=graft(octree_5),
    Time=graft(python_23),
    H=graft(hours_4))  # -> Output, DynamicOutput
executessh_59 = ExecuteSSH(
    _SSHCommands=overrides_70.DynamicOutput,
    Run=run_4,
    addPrefix=True,
    description="""mkdir -p images/
rm -r images/2023_04_06_2313_rtpict_rendering_aa0_750_sunny_ad32_0
rtpict -n 63 -w -ov images/2023_04_06_2313_rtpict_rendering_aa0_750_sunny_ad32_0 -vf /home/lio/MantaRay/Rikshospitalet/views/Perspective3.vf -x 3000 -y 1500 -ab 3 -ad 8 -aa 0 octrees/Scene_Overcast10klux.oct;echo images/2023_04_06_2313_rtpict_rendering_aa0_750_sunny_ad32_0""",
    fireLogs=True,
    lastRunTime=2595,
    name="rtpict luminance (denoisr test)",
    suppressWarnings=True,
    commands="""mkdir -p images/
rm -r images/2023_03_31_2105_rtpict_rendering_aa0_750_sunny_ad32_0
rtpict -n 63 -w -ov images/2023_03_31_2105_rtpict_rendering_aa0_750_sunny_ad32_0 -vf /home/lio/MantaRay/TestFolder/views/Perspective3.vf -x 3000 -y 1500 -ab 3 -ad 8 -aa 0 octrees/Scene_Overcast10klux.oct;echo images/2023_03_31_2105_rtpict_rendering_aa0_750_sunny_ad32_0""")  # -> Stdout, Stderr, Ran
panel_124 = Panel(executessh_59.Stderr)

# ----
# Get path to radiance.hdr
# (rtpict generates a whole folder of other stuff..)
panel_125 = Panel("<proj>/images/<target>")
overrides_71 = ApplyOverrides(Input=panel_125, X=graft(x_7), Target=graft(panel_121), Time=graft(python_23), H=graft(hours_4))  # -> Output, DynamicOutput
overrides_72 = ApplyOverrides(Input="ls <target>", Target=graft(overrides_71.Output))  # -> Output, DynamicOutput
executessh_60 = ExecuteSSH(
    _SSHCommands_=overrides_72.DynamicOutput,
    Run=executessh_59.Ran,
    addPrefix=True,
    description="ls ~/MantaRay/Rikshospitalet/images/2023_04_06_2313_rtpict_rendering_aa0_750_sunny_ad32_0",
    fireLogs=False,
    lastRunTime=112,
    suppressWarnings=False,
    stderr="ls: cannot access '/home/lio/MantaRay/TestFolder/images/2023_03_31_2105_rtpict_rendering_aa0_750_sunny_ad32_0': No such file or directory",
    commands="ls ~/MantaRay/TestFolder/images/2023_03_31_2105_rtpict_rendering_aa0_750_sunny_ad32_0")  # -> Stdout, Stderr_, Ran
concat_7 = Concatenate(FragmentA=overrides_71.Output, FragmentB="radiance.hdr", JoinSeparator="/")
split_3 = TextSplit(Text=executessh_60.Stdout)
concat_8 = Concatenate(FragmentA=overrides_71.Output, FragmentB=split_3, JoinSeparator="/")

# ----
# Using pfilt to downscale image
# radius per Mark Stock:
# http://markjstock.org/radmisc/aa0_test/final.html
panel_126 = Panel("pfilt -x /<ss> -y /<ss> -1 -r 0.7 <file> > <file-.>_filtered.hdr;echo <file-.>_filtered.hdr")
overrides_73 = ApplyOverrides(Input=panel_126, Ss=graft(supersampling_2), File=graft(concat_8))  # -> Output, DynamicOutput
executessh_61 = ExecuteSSH(
    _SSHCommands_=overrides_73.DynamicOutput,
    Run=executessh_59.Ran,
    addPrefix=True,
    description="pfilt -x /4 -y /4 -1 -r 0.7 ~/MantaRay/Rikshospitalet/images/2023_04_06_2313_rtpict_rendering_aa0_750_sunny_ad32_0/ > _filtered.hdr;echo _filtered.hdr",
    fireLogs=False,
    lastRunTime=70,
    suppressWarnings=False,
    results="_filtered.hdr",
    stderr="pfilt: can't open file \"/home/lio/MantaRay/TestFolder/images/2023_03_31_2105_rtpict_rendering_aa0_750_sunny_ad32_0/\"",
    commands="pfilt -x /4 -y /4 -1 -r 0.7 ~/MantaRay/TestFolder/images/2023_03_31_2105_rtpict_rendering_aa0_750_sunny_ad32_0/ > _filtered.hdr;echo _filtered.hdr")  # -> Stdout, Stderr_, Ran

# ----
# -la for titel: pcompos -la -a 3 -s 10 -b 1 1 1 <hdrFiles> > <proj>/images/<target>
# echo <proj>/images/<target>
# pcompos -a 15 -b 1 1 1 -s 5 <proj>/mtxs/skyRenders/skyTregenza*.hdr > <proj>/mtxs/skyRenders/all.hdr
panel_127 = Panel("""ra_tiff <hdrFiles> <proj>/images/<target-.>.tif
convert <proj>/images/<target-.>.tif <proj>/images/<target-.>.png
echo <proj>/images/<target-.>.png""")
panel_128 = Panel("pcond -h <hdr> <hdr-.>_exposed.hdr;echo <hdr-.>_exposed.hdr")
overrides_74 = ApplyOverrides(Input=panel_127, HdrFiles=graft(concat_7), Target=graft("render_original.png"))  # -> Output, DynamicOutput
overrides_75 = ApplyOverrides(Input=panel_128, Hdr=graft(executessh_61.Stdout))  # -> Output, DynamicOutput
panel_129 = Panel("psign -h 15 <h> | pcompos <target> 0 0 - 570 20 > <target-.>_s.hdr;echo <target-.>_s.hdr")
executessh_62 = ExecuteSSH(
    _SSHCommands_=overrides_74.DynamicOutput,
    Run=executessh_61.Ran,
    addPrefix=True,
    description="""ra_tiff ~/MantaRay/Rikshospitalet/images/2023_04_06_2313_rtpict_rendering_aa0_750_sunny_ad32_0/radiance.hdr ~/MantaRay/Rikshospitalet/images/render_original.tif
convert ~/MantaRay/Rikshospitalet/images/render_original.tif ~/MantaRay/Rikshospitalet/images/render_original.png
echo ~/MantaRay/Rikshospitalet/images/render_original.png""",
    fireLogs=False,
    lastRunTime=641,
    suppressWarnings=False,
    commands="""ra_tiff ~/MantaRay/TestFolder/images/2023_03_31_2105_rtpict_rendering_aa0_750_sunny_ad32_0/radiance.hdr ~/MantaRay/TestFolder/images/render_original.tif
convert ~/MantaRay/TestFolder/images/render_original.tif ~/MantaRay/TestFolder/images/render_original.png
echo ~/MantaRay/TestFolder/images/render_original.png""")  # -> Stdout, Stderr_, Ran
panel_130 = Panel(overrides_74.Output)
executessh_63 = ExecuteSSH(
    _SSHCommands_=overrides_75.DynamicOutput,
    Run=executessh_61.Ran,
    addPrefix=True,
    description="pcond -h _filtered.hdr _filtered_exposed.hdr;echo _filtered_exposed.hdr",
    fireLogs=False,
    lastRunTime=114,
    suppressWarnings=False,
    results="/home/lio/MantaRay/TestFolder/images/2023_03_31_2105_rtpict_rendering_aa0_750_sunny_ad32_0/radiance_filtered_exposed.hdr",
    commands="pcond -h /home/lio/MantaRay/TestFolder/images/2023_03_31_2105_rtpict_rendering_aa0_750_sunny_ad32_0/radiance_filtered.hdr /home/lio/MantaRay/TestFolder/images/2023_03_31_2105_rtpict_rendering_aa0_750_sunny_ad32_0/radiance_filtered_exposed.hdr;echo /home/lio/MantaRay/TestFolder/images/2023_03_31_2105_rtpict_rendering_aa0_750_sunny_ad32_0/radiance_filtered_exposed.hdr")  # -> Stdout, Stderr_, Ran
download_13 = Download(SftpPaths=flatten(executessh_62.Stdout), Run=executessh_61.Ran)  # -> FilePaths, Status, Ran
hours_5 = Number(hours)
item_5 = ListItem(List=download_13.FilePaths, Index=0, Wrap=True)
overrides_76 = ApplyOverrides(Input=panel_129, H=graft(hours_5), Target=graft(executessh_63.Stdout))  # -> Output, DynamicOutput
imageviewer_7 = LBImageViewer(ImagePath_=item_5, _scale_="1", DisableClickable=False, SaveImgWithCoords=False, scale=1)  # -> ImagePath, Values, GIF
lng_2 = ListLength(List=flatten(executessh_63.Stdout))
python_24 = GhPythonScript(cnt=lng_2, run=executessh_63.Ran)  # -> out, ran; inputs cnt: Int32, run: Boolean
# ---------- python_24: Python ----------
__author__ = "mm1013"
__version__ = "2022.08.30"

import rhinoscriptsyntax as rs

ran = cnt > 1 and run
# ---------- end python_24 ----------
# Pcompos for tiles
panel_131 = Panel("""pcompos -a 3 -s 10 -b 0.2 0.2 0.2 <hdrFiles> > <proj>/images/<target>
ra_tiff <proj>/images/<target> <proj>/images/<target-.>.tif
convert <proj>/images/<target-.>.tif <proj>/images/<target-.>.png
echo <proj>/images/<target-.>.png""")
executessh_64 = ExecuteSSH(
    _SSHCommands_=overrides_76.DynamicOutput,
    Run=python_24.ran,
    addPrefix=True,
    description="""psign -h 15 800 | pcompos /home/lio/MantaRay/TestFolder/images/2023_03_31_2105_rtpict_rendering_aa0_750_sunny_ad32_0/radiance_filtered_exposed.hdr 0 0 - 570 20 > /home/lio/MantaRay/TestFolder/images/2023_03_31_2105_rtpict_rendering_aa0_750_sunny_ad32_0/radiance_filtered_exposed_s.hdr;echo /home/lio/MantaRay/TestFolder/images/2023_03_31_2105_rtpict_rendering_aa0_750_sunny_ad32_0/radiance_filtered_exposed_s.hdr


- - -

psign -h 15 900 | pcompos /home/lio/MantaRay/TestFolder/images/2023_03_31_2105_rtpict_rendering_aa0_750_sunny_ad32_0/radiance_filtered_exposed.hdr 0 0 - 570 20 > /home/lio/MantaRay/TestFolder/images/2023_03_31_2105_rtpict_rendering_aa0_750_sunny_ad32_0/radiance_filtered_exposed_s.hdr;echo /home/lio/MantaRay/TestFolder/images/2023_03_31_2105_rtpict_rendering_aa0_750_sunny_ad32_0/radiance_filtered_exposed_s.hdr


- - -

psign -h 15 1000 | pcompos /home/lio/MantaRay/TestFolder/images/2023_03_31_2105_rtpict_rendering_aa0_750_sunny_ad32_0/radiance_filtered_exposed.hdr 0 0 - 570 20 > /home/lio/MantaRay/TestFolder/images/2023_03_31_2105_rtpict_rendering_aa0_750_sunny_ad32_0/radiance_filtered_exposed_s.hdr;echo /home/lio/MantaRay/TestFolder/images/2023_03_31_2105_rtpict_rendering_aa0_750_sunny_ad32_0/radiance_filtered_exposed_s.hdr


- - -

psign -h 15 1100 | pcompos /home/lio/MantaRay/TestFolder/images/2023_03_31_2105_rtpict_rendering_aa0_750_sunny_ad32_0/radiance_filtered_exposed.hdr 0 0 - 570 20 > /home/lio/MantaRay/TestFolder/images/2023_03_31_2105_rtpict_rendering_aa0_750_sunny_ad32_0/radiance_filtered_exposed_s.hdr;echo /home/lio/MantaRay/TestFolder/images/2023_03_31_2105_rtpict_rendering_aa0_750_sunny_ad32_0/radiance_filtered_exposed_s.hdr


- - -

psign -h 15 1200 | pcompos /home/lio/MantaRay/TestFolder/images/2023_03_31_2105_rtpict_rendering_aa0_750_sunny_ad32_0/radiance_filtered_exposed.hdr 0 0 - 570 20 > /home/lio/MantaRay/TestFolder/images/2023_03_31_2105_rtpict_rendering_aa0_750_sunny_ad32_0/radiance_filtered_exposed_s.hdr;echo /home/lio/MantaRay/TestFolder/images/2023_03_31_2105_rtpict_rendering_aa0_750_sunny_ad32_0/radiance_filtered_exposed_s.hdr


- - -

psign -h 15 1300 | pcompos /home/lio/MantaRay/TestFolder/images/2023_03_31_2105_rtpict_rendering_aa0_750_sunny_ad32_0/radiance_filtered_exposed.hdr 0 0 - 570 20 > /home/lio/MantaRay/TestFolder/images/2023_03_31_2105_rtpict_rendering_aa0_750_sunny_ad32_0/radiance_filtered_exposed_s.hdr;echo /home/lio/MantaRay/TestFolder/images/2023_03_31_2105_rtpict_rendering_aa0_750_sunny_ad32_0/radiance_filtered_exposed_s.hdr


- - -

psign -h 15 1400 | pcompos /home/lio/MantaRay/TestFolder/images/2023_03_31_2105_rtpict_rendering_aa0_750_sunny_ad32_0/radiance_filtered_exposed.hdr 0 0 - 570 20 > /home/lio/MantaRay/TestFolder/images/2023_03_31_2105_rtpict_rendering_aa0_750_sunny_ad32_0/radiance_filtered_exposed_s.hdr;echo /home/lio/MantaRay/TestFolder/images/2023_03_31_2105_rtpict_rendering_aa0_750_sunny_ad32_0/radiance_filtered_exposed_s.hdr


- - -

psign -h 15 1500 | pcompos /home/lio/MantaRay/TestFolder/images/2023_03_31_2105_rtpict_rendering_aa0_750_sunny_ad32_0/radiance_filtered_exposed.hdr 0 0 - 570 20 > /home/lio/MantaRay/TestFolder/images/2023_03_31_2105_rtpict_rendering_aa0_750_sunny_ad32_0/radiance_filtered_exposed_s.hdr;echo /home/lio/MantaRay/TestFolder/images/2023_03_31_2105_rtpict_rendering_aa0_750_sunny_ad32_0/radiance_filtered_exposed_s.hdr


- - -

psign -h 15 1600 | pcompos /home/lio/MantaRay/TestFolder/images/2023_03_31_2105_rtpict_rendering_aa0_750_sunny_ad32_0/radiance_filtered_exposed.hdr 0 0 - 570 20 > /home/lio/MantaRay/TestFolder/images/2023_03_31_2105_rtpict_rendering_aa0_750_sunny_ad32_0/radiance_filtered_exposed_s.hdr;echo /home/lio/MantaRay/TestFolder/images/2023_03_31_2105_rtpict_rendering_aa0_750_sunny_ad32_0/radiance_filtered_exposed_s.hdr


- - -

psign -h 15 1700 | pcompos /home/lio/MantaRay/TestFolder/images/2023_03_31_2105_rtpict_rendering_aa0_750_sunny_ad32_0/radiance_filtered_exposed.hdr 0 0 - 570 20 > /home/lio/MantaRay/TestFolder/images/2023_03_31_2105_rtpict_rendering_aa0_750_sunny_ad32_0/radiance_filtered_exposed_s.hdr;echo /home/lio/MantaRay/TestFolder/images/2023_03_31_2105_rtpict_rendering_aa0_750_sunny_ad32_0/radiance_filtered_exposed_s.hdr""",
    fireLogs=False,
    lastRunTime=446,
    suppressWarnings=False,
    results=["/home/lio/MantaRay/TestFolder/images/2023_03_31_2105_rtpict_rendering_aa0_750_sunny_ad32_0/radiance_filtered_exposed_s.hdr", "/home/lio/MantaRay/TestFolder/images/2023_03_31_2105_rtpict_rendering_aa0_750_sunny_ad32_0/radiance_filtered_exposed_s.hdr", "/home/lio/MantaRay/TestFolder/images/2023_03_31_2105_rtpict_rendering_aa0_750_sunny_ad32_0/radiance_filtered_exposed_s.hdr", "/home/lio/MantaRay/TestFolder/images/2023_03_31_2105_rtpict_rendering_aa0_750_sunny_ad32_0/radiance_filtered_exposed_s.hdr", "/home/lio/MantaRay/TestFolder/images/2023_03_31_2105_rtpict_rendering_aa0_750_sunny_ad32_0/radiance_filtered_exposed_s.hdr", "/home/lio/MantaRay/TestFolder/images/2023_03_31_2105_rtpict_rendering_aa0_750_sunny_ad32_0/radiance_filtered_exposed_s.hdr", "/home/lio/MantaRay/TestFolder/images/2023_03_31_2105_rtpict_rendering_aa0_750_sunny_ad32_0/radiance_filtered_exposed_s.hdr", "/home/lio/MantaRay/TestFolder/images/2023_03_31_2105_rtpict_rendering_aa0_750_sunny_ad32_0/radiance_filtered_exposed_s.hdr", "/home/lio/MantaRay/TestFolder/images/2023_03_31_2105_rtpict_rendering_aa0_750_sunny_ad32_0/radiance_filtered_exposed_s.hdr", "/home/lio/MantaRay/TestFolder/images/2023_03_31_2105_rtpict_rendering_aa0_750_sunny_ad32_0/radiance_filtered_exposed_s.hdr"],
    commands=["psign -h 15 800 | pcompos /home/lio/MantaRay/TestFolder/images/2023_03_31_2105_rtpict_rendering_aa0_750_sunny_ad32_0/radiance_filtered_exposed.hdr 0 0 - 570 20 > /home/lio/MantaRay/TestFolder/images/2023_03_31_2105_rtpict_rendering_aa0_750_sunny_ad32_0/radiance_filtered_exposed_s.hdr;echo /home/lio/MantaRay/TestFolder/images/2023_03_31_2105_rtpict_rendering_aa0_750_sunny_ad32_0/radiance_filtered_exposed_s.hdr", "psign -h 15 900 | pcompos /home/lio/MantaRay/TestFolder/images/2023_03_31_2105_rtpict_rendering_aa0_750_sunny_ad32_0/radiance_filtered_exposed.hdr 0 0 - 570 20 > /home/lio/MantaRay/TestFolder/images/2023_03_31_2105_rtpict_rendering_aa0_750_sunny_ad32_0/radiance_filtered_exposed_s.hdr;echo /home/lio/MantaRay/TestFolder/images/2023_03_31_2105_rtpict_rendering_aa0_750_sunny_ad32_0/radiance_filtered_exposed_s.hdr", "psign -h 15 1000 | pcompos /home/lio/MantaRay/TestFolder/images/2023_03_31_2105_rtpict_rendering_aa0_750_sunny_ad32_0/radiance_filtered_exposed.hdr 0 0 - 570 20 > /home/lio/MantaRay/TestFolder/images/2023_03_31_2105_rtpict_rendering_aa0_750_sunny_ad32_0/radiance_filtered_exposed_s.hdr;echo /home/lio/MantaRay/TestFolder/images/2023_03_31_2105_rtpict_rendering_aa0_750_sunny_ad32_0/radiance_filtered_exposed_s.hdr", "psign -h 15 1100 | pcompos /home/lio/MantaRay/TestFolder/images/2023_03_31_2105_rtpict_rendering_aa0_750_sunny_ad32_0/radiance_filtered_exposed.hdr 0 0 - 570 20 > /home/lio/MantaRay/TestFolder/images/2023_03_31_2105_rtpict_rendering_aa0_750_sunny_ad32_0/radiance_filtered_exposed_s.hdr;echo /home/lio/MantaRay/TestFolder/images/2023_03_31_2105_rtpict_rendering_aa0_750_sunny_ad32_0/radiance_filtered_exposed_s.hdr", "psign -h 15 1200 | pcompos /home/lio/MantaRay/TestFolder/images/2023_03_31_2105_rtpict_rendering_aa0_750_sunny_ad32_0/radiance_filtered_exposed.hdr 0 0 - 570 20 > /home/lio/MantaRay/TestFolder/images/2023_03_31_2105_rtpict_rendering_aa0_750_sunny_ad32_0/radiance_filtered_exposed_s.hdr;echo /home/lio/MantaRay/TestFolder/images/2023_03_31_2105_rtpict_rendering_aa0_750_sunny_ad32_0/radiance_filtered_exposed_s.hdr", "psign -h 15 1300 | pcompos /home/lio/MantaRay/TestFolder/images/2023_03_31_2105_rtpict_rendering_aa0_750_sunny_ad32_0/radiance_filtered_exposed.hdr 0 0 - 570 20 > /home/lio/MantaRay/TestFolder/images/2023_03_31_2105_rtpict_rendering_aa0_750_sunny_ad32_0/radiance_filtered_exposed_s.hdr;echo /home/lio/MantaRay/TestFolder/images/2023_03_31_2105_rtpict_rendering_aa0_750_sunny_ad32_0/radiance_filtered_exposed_s.hdr"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])  # -> Stdout, Stderr_, Ran
join_8 = TextJoin(Text=flatten(executessh_64.Stdout), Join=" ")
overrides_77 = ApplyOverrides(Input=panel_131, HdrFiles=graft(join_8), Target=graft("combined.hdr"))  # -> Output, DynamicOutput
executessh_65 = ExecuteSSH(
    _SSHCommands_=overrides_77.Output,
    Run=executessh_64.Ran,
    addPrefix=True,
    fireLogs=False,
    lastRunTime=573,
    suppressWarnings=False,
    results="/home/lio/MantaRay/TestFolder/images/combined.png",
    commands="""pcompos -a 3 -s 10 -b 0.2 0.2 0.2 /home/lio/MantaRay/TestFolder/images/2023_03_31_2105_rtpict_rendering_aa0_750_sunny_ad32_0/radiance_filtered_exposed_s.hdr /home/lio/MantaRay/TestFolder/images/2023_03_31_2105_rtpict_rendering_aa0_750_sunny_ad32_0/radiance_filtered_exposed_s.hdr /home/lio/MantaRay/TestFolder/images/2023_03_31_2105_rtpict_rendering_aa0_750_sunny_ad32_0/radiance_filtered_exposed_s.hdr /home/lio/MantaRay/TestFolder/images/2023_03_31_2105_rtpict_rendering_aa0_750_sunny_ad32_0/radiance_filtered_exposed_s.hdr /home/lio/MantaRay/TestFolder/images/2023_03_31_2105_rtpict_rendering_aa0_750_sunny_ad32_0/radiance_filtered_exposed_s.hdr /home/lio/MantaRay/TestFolder/images/2023_03_31_2105_rtpict_rendering_aa0_750_sunny_ad32_0/radiance_filtered_exposed_s.hdr /home/lio/MantaRay/TestFolder/images/2023_03_31_2105_rtpict_rendering_aa0_750_sunny_ad32_0/radiance_filtered_exposed_s.hdr /home/lio/MantaRay/TestFolder/images/2023_03_31_2105_rtpict_rendering_aa0_750_sunny_ad32_0/radiance_filtered_exposed_s.hdr /home/lio/MantaRay/TestFolder/images/2023_03_31_2105_rtpict_rendering_aa0_750_sunny_ad32_0/radiance_filtered_exposed_s.hdr /home/lio/MantaRay/TestFolder/images/2023_03_31_2105_rtpict_rendering_aa0_750_sunny_ad32_0/radiance_filtered_exposed_s.hdr > ~/MantaRay/TestFolder/images/combined.hdr
ra_tiff ~/MantaRay/TestFolder/images/combined.hdr ~/MantaRay/TestFolder/images/combined.tif
convert ~/MantaRay/TestFolder/images/combined.tif ~/MantaRay/TestFolder/images/combined.png
echo ~/MantaRay/TestFolder/images/combined.png""")  # -> Stdout, Stderr_, Ran

download_14 = Download(SftpPaths=executessh_65.Stdout, Run=executessh_65.Ran, stdouts="C:\Users\mm1013\MantaRay\TestFolder\combined.png")  # -> FilePaths, Status, Ran
imageviewer_8 = LBImageViewer(ImagePath_=download_14.FilePaths, _scale_="1", DisableClickable=False, SaveImgWithCoords=False, scale=1)  # -> ImagePath, Values, GIF

ptscount_2 = Integer(ptscount)

ptscount_3 = Integer(ptscount_2)

overrides_78 = ApplyOverrides(
    Input=panel_109,
    Ptcount=graft(ptscount_2),
    Skyglow=graft(skyglow_2),
    Octree=graft(octree_black),
    Points=graft(points_2),
    Target=graft(panel_108))  # -> Output, DynamicOutput
overrides_79 = ApplyOverrides(
    Input=panel_111,
    Ptcount=graft(ptscount_3),
    Octree=graft(octree_blackdds),
    Points=graft(points_3),
    Target=graft(panel_110))  # -> Output, DynamicOutput
executessh_66 = ExecuteSSH(
    _SSHCommands_=overrides_78.DynamicOutput,
    Run=executessh_57.Ran,
    addPrefix=True,
    description="""mkdir -p ~/MantaRay/Rikshospitalet/mtxs/
rfluxmtx -w -I+ -y <ptcount> -lw 0.0002 -ab 1 -ad 5000 -n 63 - <skyglow> -i <octree> < ptsFiles/points.pts > ~/MantaRay/Rikshospitalet/mtxs/dcd_illum.mtx;echo ~/MantaRay/Rikshospitalet/mtxs/dcd_illum.mtx""",
    fireLogs=False,
    lastRunTime=0,
    suppressWarnings=False)  # -> Stdout, Stderr_, Ran

panel_132 = Panel(executessh_66.Stdout)
panel_133 = Panel(overrides_78.DynamicOutput)

executessh_67 = ExecuteSSH(
    _SSHCommands_=overrides_79.DynamicOutput,
    Run=executessh_66.Ran,
    addPrefix=True,
    description="""mkdir -p ~/MantaRay/Rikshospitalet/mtxs/
rcontrib -w -I+ -ab 1 -y <ptcount> -n 63 -ad 256 -lw 1.0e-3 -dc 1 -dt 0 -dj 0 -faf -e MF:6 -f reinhart.cal -b rbin -bn Nrbins -m solar <octree> < ptsFiles/points.pts > ~/MantaRay/Rikshospitalet/mtxs/cdsDDS_illum.mtx
echo ~/MantaRay/Rikshospitalet/mtxs/cdsDDS_illum.mtx""",
    fireLogs=False,
    lastRunTime=0,
    suppressWarnings=False)  # -> Stdout, Stderr_, Ran

# ----
# Parallel RTPICT render with ambient cache
# Illuminance  including PFILT and overture
# overture should now automatically be included in rtpict
# Delete this one but copy the pfilt and overture
# to the section above
viewfile_5 = Text(executessh_50.Stdout)
octree_7 = Text(executessh_41.Stdout)
modifierlist = Text(flatten(cluster_4.name_mod))
octree_overcast_3 = Text(octree_overcast)
entwine_11 = Entwine(Branch00=octree_overcast_3, Branch01=octree_7, FlattenInputs=True)  # -> flatten(Result)
division_2 = Division(A=resolution, B=1.5)
octree_8 = Text(graft(entwine_11))
list_2 = ItemSelector(
    octree_8,
    {"octrees/Scene_Overcast10klux.oct", "octrees/my_test_scene_0800.oct", "octrees/my_test_scene_0900.oct", "octrees/my_test_scene_1000.oct", "octrees/my_test_scene_1100.oct", "octrees/my_test_scene_1200.oct", "octrees/my_test_scene_1300.oct", "octrees/my_test_scene_1400.oct", "octrees/my_test_scene_1500.oct", "octrees/my_test_scene_1600.oct", "octrees/my_test_scene_1700.oct"}, selected="octrees/Scene_Overcast10klux.oct")
y_7 = Number(division_2)
eval = Evaluate(F="x=y", x=octree_8, y=list_2)
panel_134 = Panel("-ab 1 -ad 4096 -lw 0.002 -aa 0.1 -ar 1024 -as 1024")
panel_135 = Panel("""cd <proj>
mkdir -p images/
mkdir -p ambFiles/
rtpict -n <cpus-1> -w -vf <vf> -x 400 -y 300 <radOptions> -af ambFiles/<ambFile> <oct> > /dev/null
rtpict -n <cpus-1> -w -vf <vf> -x <x> -y <y> <radOptions> -af ambFiles/<ambFile> <oct> | pfilt -x /2 -y /2 > images/<target>;echo images/<target>""")
x_9 = Number(x_2)
y_8 = Number(y_7)
run_6 = LBFalseStartToggle(False)
python_25 = GhPythonScript(update=run_6)  # -> time; inputs update: tree; same code as python_14

# ----
# exclude frames
panel_136 = Panel("frames")
python_26 = GhPythonScript(opaqueModifiers=modifierlist, search=panel_136)  # -> a; inputs opaqueModifiers: list, search: list
# ---------- python_26: Python ----------
__author__ = "mm1013"
__version__ = "2022.09.05"

import rhinoscriptsyntax as rs
#import Grasshopper.DataTree as dt
import ghpythonlib.treehelpers as th


o = []
for l in search:
    o.append([s for s in opaqueModifiers if l.lower() in s.lower()])
    

a = th.list_to_tree(o)
# ---------- end python_26 ----------
overrides_80 = ApplyOverrides(Input="-ae <modifier>", Modifier=graft(python_26))  # -> Output, DynamicOutput
join_9 = TextJoin(Text=flatten(overrides_80.Output), Join=" ")

hours_6 = Text(hours_2)
entwine_12 = Entwine(Branch00="ovc", Branch01=hours_6, FlattenInputs=True)  # -> flatten(Result)
cull_7 = CullPattern(List=graft(entwine_12), CullPattern=eval)  # -> flatten(List)
hours_7 = Text(cull_7)

merge = Merge(Data1=panel_134, Data2=list_2, Data3=join_9, Data4=Button())  # -> flatten(Result)
python_27 = GhPythonScript(update=merge)  # -> time; inputs update: tree; same code as python_14
overrides_81 = ApplyOverrides(Input="ambfileX_<time>.af", Time=graft(python_27))  # -> Output, DynamicOutput
overrides_82 = ApplyOverrides(
    Input=panel_135,
    Vf=graft(viewfile_5),
    RadOptions=graft(panel_134),
    AmbFile=graft(overrides_81.Output),
    Oct=graft(list_2),
    X=graft(x_9),
    Y=graft(y_8),
    Target=graft("<time>_rtpict_rendering_aa0.1_<x>_sunny_ad4096_<h>.hdr"),
    Time=graft("<time>"),
    H=graft(hours_7))  # -> Output, DynamicOutput
overrides_83 = ApplyOverrides(Input=overrides_82.Output, Time=graft(python_25))  # -> Output, DynamicOutput
executessh_68 = ExecuteSSH(
    _SSHCommands_=overrides_83.DynamicOutput,
    Run=run_6,
    addPrefix=True,
    description="""cd ~/MantaRay/Rikshospitalet
mkdir -p images/
mkdir -p ambFiles/
rtpict -n 62 -w -vf /home/lio/MantaRay/Rikshospitalet/views/Perspective1.vf -x 400 -y 300 -ab 1 -ad 4096 -lw 0.002 -aa 0.1 -ar 1024 -as 1024 -af ambFiles/ambfileX_2023_04_06_2339_33.af octrees/Scene_Overcast10klux.oct > /dev/null
rtpict -n 62 -w -vf /home/lio/MantaRay/Rikshospitalet/views/Perspective1.vf -x 750 -y 500 -ab 1 -ad 4096 -lw 0.002 -aa 0.1 -ar 1024 -as 1024 -af ambFiles/ambfileX_2023_04_06_2339_33.af octrees/Scene_Overcast10klux.oct | pfilt -x /2 -y /2 > images/2023_04_06_2313_56_rtpict_rendering_aa0.1_750_sunny_ad4096_ovc.hdr;echo images/2023_04_06_2313_56_rtpict_rendering_aa0.1_750_sunny_ad4096_ovc.hdr""",
    fireLogs=False,
    lastRunTime=11117,
    suppressWarnings=False,
    results="images/2023_03_31_2218_25_rtpict_rendering_aa0.1_750_sunny_ad4096_ovc.hdr",
    commands="""cd ~/MantaRay/TestFolder
mkdir -p images/
mkdir -p ambFiles/
rtpict -n 62 -w -vf /home/lio/MantaRay/TestFolder/views/Perspective1.vf -x 400 -y 300 -ab 1 -ad 4096 -lw 0.002 -aa 0.1 -ar 1024 -as 1024 -af ambFiles/ambfileX_2023_03_31_2131_21.af octrees/Scene_Overcast10klux.oct > /dev/null
rtpict -n 62 -w -vf /home/lio/MantaRay/TestFolder/views/Perspective1.vf -x 750 -y 500 -ab 1 -ad 4096 -lw 0.002 -aa 0.1 -ar 1024 -as 1024 -af ambFiles/ambfileX_2023_03_31_2131_21.af octrees/Scene_Overcast10klux.oct | pfilt -x /2 -y /2 > images/2023_03_31_2218_25_rtpict_rendering_aa0.1_750_sunny_ad4096_ovc.hdr;echo images/2023_03_31_2218_25_rtpict_rendering_aa0.1_750_sunny_ad4096_ovc.hdr""")  # -> Stdout, Stderr_, Ran
download_15 = Download(
    LinuxFilePaths=executessh_68.Stdout,
    Run=executessh_68.Ran,
    stdouts="C:\Users\mm1013\MantaRay\TestFolder\2023_03_31_2218_25_rtpict_rendering_aa0.1_750_sunny_ad4096_ovc.hdr")  # -> FilePaths, Status, Ran

panel_137 = Panel(overrides_83.Output)

# ----
# save pngs exposed and raw
panel_138 = Panel("""ra_tiff <hdr-.>.hdr <hdr-.>.tif
convert <hdr-.>.tif <hdr-.>.png
rm <hdr-.>.tif
echo <hdr-.>.png""")  # disabled
set_exposure_manually_e_3 = Panel("""pfilt -1 -e -3 <hdr> > <hdr-.>_filt.hdr
ra_tiff <hdr-.>_filt.hdr <hdr-.>_filt.tif
convert <hdr-.>_filt.tif <hdr-.>_filt.png
rm <hdr-.>_filt.tif
rm <hdr-.>_filt.hdr
echo <hdr-.>_filt.png""")  # disabled
panel_139 = Panel("""pcond -h <hdr> <hdr-.>_exposed.hdr
ra_tiff <hdr-.>_exposed.hdr <hdr-.>_exposed.tif
convert <hdr-.>_exposed.tif <hdr-.>_exposed.png
rm <hdr-.>_exposed.tif
rm <hdr-.>_exposed.hdr
echo <hdr-.>_exposed.png""")  # disabled
entwine_13 = Entwine(Branch00=panel_139, Branch01=panel_138, Branch02=set_exposure_manually_e_3, FlattenInputs=True)  # disabled
overrides_84 = ApplyOverrides(Input=entwine_13, Hdr=graft(executessh_68.Stdout))  # -> Output, DynamicOutput; disabled
executessh_69 = ExecuteSSH(
    _SSHCommands_=overrides_84.DynamicOutput,
    Run=download_15.Ran,
    addPrefix=True,
    description="""pcond -h images/2023_03_31_2218_25_rtpict_rendering_aa0.1_750_sunny_ad4096_ovc.hdr images/2023_03_31_2218_25_rtpict_rendering_aa0.1_750_sunny_ad4096_ovc_exposed.hdr
ra_tiff images/2023_03_31_2218_25_rtpict_rendering_aa0.1_750_sunny_ad4096_ovc_exposed.hdr images/2023_03_31_2218_25_rtpict_rendering_aa0.1_750_sunny_ad4096_ovc_exposed.tif
convert images/2023_03_31_2218_25_rtpict_rendering_aa0.1_750_sunny_ad4096_ovc_exposed.tif images/2023_03_31_2218_25_rtpict_rendering_aa0.1_750_sunny_ad4096_ovc_exposed.png
rm images/2023_03_31_2218_25_rtpict_rendering_aa0.1_750_sunny_ad4096_ovc_exposed.tif
rm images/2023_03_31_2218_25_rtpict_rendering_aa0.1_750_sunny_ad4096_ovc_exposed.hdr
echo images/2023_03_31_2218_25_rtpict_rendering_aa0.1_750_sunny_ad4096_ovc_exposed.png


- - -

ra_tiff images/2023_03_31_2218_25_rtpict_rendering_aa0.1_750_sunny_ad4096_ovc.hdr images/2023_03_31_2218_25_rtpict_rendering_aa0.1_750_sunny_ad4096_ovc.tif
convert images/2023_03_31_2218_25_rtpict_rendering_aa0.1_750_sunny_ad4096_ovc.tif images/2023_03_31_2218_25_rtpict_rendering_aa0.1_750_sunny_ad4096_ovc.png
rm images/2023_03_31_2218_25_rtpict_rendering_aa0.1_750_sunny_ad4096_ovc.tif
echo images/2023_03_31_2218_25_rtpict_rendering_aa0.1_750_sunny_ad4096_ovc.png


- - -

pfilt -1 -e -3 images/2023_03_31_2218_25_rtpict_rendering_aa0.1_750_sunny_ad4096_ovc.hdr > images/2023_03_31_2218_25_rtpict_rendering_aa0.1_750_sunny_ad4096_ovc_filt.hdr
ra_tiff images/2023_03_31_2218_25_rtpict_rendering_aa0.1_750_sunny_ad4096_ovc_filt.hdr images/2023_03_31_2218_25_rtpict_rendering_aa0.1_750_sunny_ad4096_ovc_filt.tif
convert images/2023_03_31_2218_25_rtpict_rendering_aa0.1_750_sunny_ad4096_ovc_filt.tif images/2023_03_31_2218_25_rtpict_rendering_aa0.1_750_sunny_ad4096_ovc_filt.png
rm images/2023_03_31_2218_25_rtpict_rendering_aa0.1_750_sunny_ad4096_ovc_filt.tif
rm images/2023_03_31_2218_25_rtpict_rendering_aa0.1_750_sunny_ad4096_ovc_filt.hdr
echo images/2023_03_31_2218_25_rtpict_rendering_aa0.1_750_sunny_ad4096_ovc_filt.png""",
    fireLogs=False,
    lastRunTime=159,
    suppressWarnings=False,
    results=["images/2023_03_31_2218_25_rtpict_rendering_aa0.1_750_sunny_ad4096_ovc_exposed.png", "images/2023_03_31_2218_25_rtpict_rendering_aa0.1_750_sunny_ad4096_ovc.png", "images/2023_03_31_2218_25_rtpict_rendering_aa0.1_750_sunny_ad4096_ovc_filt.png"],
    commands=["""ra_tiff images/2023_03_31_2218_25_rtpict_rendering_aa0.1_750_sunny_ad4096_ovc.hdr images/2023_03_31_2218_25_rtpict_rendering_aa0.1_750_sunny_ad4096_ovc.tif
convert images/2023_03_31_2218_25_rtpict_rendering_aa0.1_750_sunny_ad4096_ovc.tif images/2023_03_31_2218_25_rtpict_rendering_aa0.1_750_sunny_ad4096_ovc.png
rm images/2023_03_31_2218_25_rtpict_rendering_aa0.1_750_sunny_ad4096_ovc.tif
echo images/2023_03_31_2218_25_rtpict_rendering_aa0.1_750_sunny_ad4096_ovc.png""", """pcond -h images/2023_03_31_2218_25_rtpict_rendering_aa0.1_750_sunny_ad4096_ovc.hdr images/2023_03_31_2218_25_rtpict_rendering_aa0.1_750_sunny_ad4096_ovc_exposed.hdr
ra_tiff images/2023_03_31_2218_25_rtpict_rendering_aa0.1_750_sunny_ad4096_ovc_exposed.hdr images/2023_03_31_2218_25_rtpict_rendering_aa0.1_750_sunny_ad4096_ovc_exposed.tif
convert images/2023_03_31_2218_25_rtpict_rendering_aa0.1_750_sunny_ad4096_ovc_exposed.tif images/2023_03_31_2218_25_rtpict_rendering_aa0.1_750_sunny_ad4096_ovc_exposed.png
rm images/2023_03_31_2218_25_rtpict_rendering_aa0.1_750_sunny_ad4096_ovc_exposed.tif
rm images/2023_03_31_2218_25_rtpict_rendering_aa0.1_750_sunny_ad4096_ovc_exposed.hdr
echo images/2023_03_31_2218_25_rtpict_rendering_aa0.1_750_sunny_ad4096_ovc_exposed.png"""])  # -> Stdout, Stderr_, Ran; disabled
download_16 = Download(
    LinuxFilePaths=executessh_69.Stdout,
    Run=executessh_69.Ran,
    stdouts="C:\Users\mm1013\MantaRay\TestFolder\2023_03_31_2218_25_rtpict_rendering_aa0.1_750_sunny_ad4096_ovc_filt.png")  # -> flatten(FilePaths), Status, Ran; disabled
imageviewer_9 = LBImageViewer(ImagePath_=download_16.FilePaths, _scale_=2, DisableClickable=False, SaveImgWithCoords=False, scale=2)  # -> ImagePath, Values, GIF; disabled

# ----
# Create a render of facade normals
panel_140 = Panel("xform -m normalshadermaterial <rad> > <rad-.>_black.rad;echo \"<rad-.>_black.rad\"")
scene_rads_3 = Text(entwine_4)
falsestart_24 = LBFalseStartToggle(False)
view_4 = Text(executessh_16.Stdout)
target = Text(panel_121)
overrides_85 = ApplyOverrides(Input=panel_140, Rad=graft(scene_rads_3))  # -> Output, DynamicOutput
python_28 = GhPythonScript(x=flatten(scene_rads_3))  # -> a; inputs x: list; same code as python_15
and_3 = GateAnd(A=python_28, B=falsestart_24)
executessh_70 = ExecuteSSH(
    _SSHCommands=overrides_85.Output,
    Run=and_3,
    addPrefix=True,
    description="""- - -



- - -



- - -



- - -



- - -



- - -



- - -



- - -



- - -



- - -



- - -



- - -



- - -



- - -



- - -



- - -



- - -



- - -



- - -



- - -



- - -



- - -""",
    fireLogs=False,
    lastRunTime=2494,
    suppressWarnings=False,
    results=["~/MantaRay/TestingRemote/radFiles/RevitJintInnerCW_Glass_80_mat_black.rad", "~/MantaRay/TestingRemote/radFiles/RevitJintInnerDoors_80_mat_black.rad", "~/MantaRay/TestingRemote/radFiles/Skylights_65_mat_black.rad", "~/MantaRay/TestingRemote/radFiles/GlassInt_74_mat_black.rad", "~/MantaRay/TestingRemote/radFiles/RevitJfacadeFacadesCWglass_74_mat_black.rad", "~/MantaRay/TestingRemote/radFiles/RevitJfacadeWindowGlass_74_mat_black.rad", "~/MantaRay/TestingRemote/radFiles/Skylights_55_mat_black.rad", "~/MantaRay/TestingRemote/radFiles/RevitJfacadeDoorPanel_70_mat_black.rad", "/home/lio/MantaRay/TestingRemote/radFiles/RevitJintInnerCW_Glass_80_black.rad", "/home/lio/MantaRay/TestingRemote/radFiles/RevitJintInnerDoors_80_black.rad", "/home/lio/MantaRay/TestingRemote/radFiles/Skylights_65_black.rad", "/home/lio/MantaRay/TestingRemote/radFiles/GlassInt_74_black.rad", "/home/lio/MantaRay/TestingRemote/radFiles/RevitJfacadeFacadesCWglass_74_black.rad", "/home/lio/MantaRay/TestingRemote/radFiles/RevitJfacadeWindowGlass_74_black.rad", "/home/lio/MantaRay/TestingRemote/radFiles/Skylights_55_black.rad", "/home/lio/MantaRay/TestingRemote/radFiles/RevitJfacadeDoorPanel_70_black.rad", "~/MantaRay/TestingRemote/radFiles/opaque_materials_black.rad", "/home/lio/MantaRay/TestingRemote/radFiles/RevitJintInnerCWs_50_black.rad", "/home/lio/MantaRay/TestingRemote/radFiles/RANSLUCENT_black.rad", "/home/lio/MantaRay/TestingRemote/radFiles/Ceilings_70_black.rad", "/home/lio/MantaRay/TestingRemote/radFiles/RevitJintInnerDoors_50_black.rad", "/home/lio/MantaRay/TestingRemote/radFiles/RevitJintInnerWalls_50_black.rad", "/home/lio/MantaRay/TestingRemote/radFiles/Roofs_20_black.rad", "/home/lio/MantaRay/TestingRemote/radFiles/RevitJfacadeFacadesCladding_50_black.rad", "/home/lio/MantaRay/TestingRemote/radFiles/RoofMullions_70_black.rad", "/home/lio/MantaRay/TestingRemote/radFiles/Frames_50_black.rad", "/home/lio/MantaRay/TestingRemote/radFiles/SlabWall_50_black.rad", "/home/lio/MantaRay/TestingRemote/radFiles/SlabFloor_30_black.rad", "/home/lio/MantaRay/TestingRemote/radFiles/WallInterior_70_black.rad", "/home/lio/MantaRay/TestingRemote/radFiles/Doors_50_black.rad", "/home/lio/MantaRay/TestingRemote/radFiles/RevitJfacadeFacadesWall_50_black.rad", "/home/lio/MantaRay/TestingRemote/radFiles/Floors_20_black.rad", "/home/lio/MantaRay/TestingRemote/radFiles/ByggD_30_black.rad", "/home/lio/MantaRay/TestingRemote/radFiles/Furniture_black.rad", "/home/lio/MantaRay/TestingRemote/radFiles/Curves_black.rad", "/home/lio/MantaRay/TestingRemote/radFiles/ByggE_30_black.rad", "/home/lio/MantaRay/TestingRemote/radFiles/ContextBright_70_black.rad", "/home/lio/MantaRay/TestingRemote/radFiles/RevitJfacadeDoors_55_black.rad", "/home/lio/MantaRay/TestingRemote/radFiles/RevitJfacadeWindowsFrames_70_black.rad", "/home/lio/MantaRay/TestingRemote/radFiles/RevitJfacadeFacadesFrames_70_black.rad"],
    commands=["xform -m normalshadermaterial ~/MantaRay/TestingRemote/radFiles/RevitJintInnerCW_Glass_80_mat.mat > ~/MantaRay/TestingRemote/radFiles/RevitJintInnerCW_Glass_80_mat_black.rad;echo \"~/MantaRay/TestingRemote/radFiles/RevitJintInnerCW_Glass_80_mat_black.rad\"", "xform -m normalshadermaterial ~/MantaRay/TestingRemote/radFiles/Skylights_65_mat.mat > ~/MantaRay/TestingRemote/radFiles/Skylights_65_mat_black.rad;echo \"~/MantaRay/TestingRemote/radFiles/Skylights_65_mat_black.rad\"", "xform -m normalshadermaterial ~/MantaRay/TestingRemote/radFiles/GlassInt_74_mat.mat > ~/MantaRay/TestingRemote/radFiles/GlassInt_74_mat_black.rad;echo \"~/MantaRay/TestingRemote/radFiles/GlassInt_74_mat_black.rad\"", "xform -m normalshadermaterial ~/MantaRay/TestingRemote/radFiles/RevitJfacadeWindowGlass_74_mat.mat > ~/MantaRay/TestingRemote/radFiles/RevitJfacadeWindowGlass_74_mat_black.rad;echo \"~/MantaRay/TestingRemote/radFiles/RevitJfacadeWindowGlass_74_mat_black.rad\"", "xform -m normalshadermaterial ~/MantaRay/TestingRemote/radFiles/RevitJintInnerDoors_80_mat.mat > ~/MantaRay/TestingRemote/radFiles/RevitJintInnerDoors_80_mat_black.rad;echo \"~/MantaRay/TestingRemote/radFiles/RevitJintInnerDoors_80_mat_black.rad\"", "xform -m normalshadermaterial ~/MantaRay/TestingRemote/radFiles/RevitJfacadeFacadesCWglass_74_mat.mat > ~/MantaRay/TestingRemote/radFiles/RevitJfacadeFacadesCWglass_74_mat_black.rad;echo \"~/MantaRay/TestingRemote/radFiles/RevitJfacadeFacadesCWglass_74_mat_black.rad\""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])  # -> flatten(Stdout), Stderr_, Ran
panel_141 = Panel(executessh_70.Stdout)
panel_142 = Panel("""mkdir -p <proj>/octrees/
oconv -r 2048 -w -f <rads> > <proj>/octrees/<target>
echo <proj>/octrees/<target>""")
python_29 = GhPythonScript(x=flatten(executessh_70.Stdout))  # -> a; inputs x: list; same code as python_15
and_4 = GateAnd(A=python_29, B=executessh_70.Ran)

# ----
# normalshader
panel_143 = Panel("""# Materials
void glow normalglow
0
0
4 1.0 1.0 1.0 -1

normalglow colorfunc normalshadermaterial
4 red green blue normalshader.cal
0
0""")
panel_144 = Panel("echo \"<mat>\" > <LinuxHome>/radFiles/mat_normalglow.mat;echo <LinuxHome>/radFiles/mat_normalglow.mat")
overrides_86 = ApplyOverrides(Input=panel_144, Mat=graft(panel_143))  # -> Output, DynamicOutput
executessh_71 = ExecuteSSH(
    _SSHCommands_=overrides_86.DynamicOutput,
    Run=falsestart_24,
    addPrefix=True,
    description="""echo "# Materials
void glow normalglow
0
0
4 1.0 1.0 1.0 -1

normalglow colorfunc normalshadermaterial
4 red green blue normalshader.cal
0
0" > ~/MantaRay/Rikshospitalet/radFiles/mat_normalglow.mat;echo ~/MantaRay/Rikshospitalet/radFiles/mat_normalglow.mat""",
    fireLogs=False,
    lastRunTime=12,
    suppressWarnings=False,
    results="/home/lio/MantaRay/TestingRemote/radFiles/mat_normalglow.mat",
    commands="""echo "# Materials
void glow normalglow
0
0
4 1.0 1.0 1.0 -1

normalglow colorfunc normalshadermaterial
4 red green blue normalshader.cal
0
0" > ~/MantaRay/TestingRemote/radFiles/mat_normalglow.mat;echo ~/MantaRay/TestingRemote/radFiles/mat_normalglow.mat""")  # -> Stdout, Stderr_, Ran
panel_145 = Panel(overrides_86.Output)
normalshadermat = Text(executessh_71.Stdout)

entwine_14 = Entwine(Branch00=normalshadermat, Branch01=executessh_70.Stdout, FlattenInputs=True)
join_10 = TextJoin(Text=flatten(entwine_14), Join=" ")
overrides_87 = ApplyOverrides(Input=panel_142, Rads=graft(join_10), Target=graft("myNormalsScene.oct"))  # -> Output, DynamicOutput
executessh_72 = ExecuteSSH(
    _SSHCommands=overrides_87.DynamicOutput,
    Run=and_4,
    addPrefix=True,
    description="""mkdir -p ~/MantaRay/Rikshospitalet/octrees/
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""",
    fireLogs=False,
    lastRunTime=65176,
    suppressWarnings=False,
    results="/home/lio/simulation/Boston_Skylights/octrees/myNormalsScene.oct",
    commands="""mkdir -p ~/simulation/Boston_Skylights/octrees/
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""")  # -> Stdout, Stderr_, Ran

panel_146 = Panel("""rpict -vf <vf> -x <x> -y <y> <radOptions> <oct> |
pfilt -x /<ss> -y /<ss> -1 -r 0.7 > <proj>/images/<target>_normals_filt.hdr
echo <proj>/images/<target>_normals_filt.hdr""")
supersampling_4 = Panel("4")
y_9 = RemoteReceiver(y)
x_10 = RemoteReceiver(x)
multiplication_7 = Multiplication(A=x_10, B=supersampling_4)
multiplication_8 = Multiplication(A=y_9, B=supersampling_4)
overrides_88 = ApplyOverrides(
    Input=panel_146,
    Vf=graft(view_4),
    X=graft(multiplication_7),
    Y=graft(multiplication_8),
    Target=graft(target),
    RadOptions=graft("-ab 0 -ad 1 -aa 1 -w -av 1 1 1"),
    Oct=graft(executessh_72.Stdout),
    Time=graft("0"),
    H=graft("0"),
    Ss=graft(supersampling_4))  # -> Output, DynamicOutput
panel_147 = Panel(overrides_88.Output)
executessh_73 = ExecuteSSH(
    _SSHCommands=overrides_88.DynamicOutput,
    Run=executessh_72.Ran,
    addPrefix=True,
    description="""rpict -vf /home/lio/MantaRay/Rikshospitalet/views/Perspective3.vf -x 3000 -y 1500 -ab 0 -ad 1 -aa 1 -w -av 1 1 1 /home/lio/simulation/Boston_Skylights/octrees/myNormalsScene.oct |
pfilt -x /4 -y /4 -1 -r 0.7 > ~/MantaRay/Rikshospitalet/images/0_rtpict_rendering_aa0_3000_sunny_ad32_0_normals_filt.hdr
echo ~/MantaRay/Rikshospitalet/images/0_rtpict_rendering_aa0_3000_sunny_ad32_0_normals_filt.hdr""",
    fireLogs=False,
    lastRunTime=32065,
    suppressWarnings=True,
    results="/home/lio/simulation/Boston_Skylights/images/2023_01_09_1607_rtpict_rendering_aa0_20000_sunny_ad32_0_normals_filt.hdr",
    commands="""rpict -vf /home/lio/MantaRay/TestingRemote/views/Perspective1.vf -x 20000 -y 10000 -ab 0 -ad 1 -aa 1 -w -av 1 1 1 /home/lio/simulation/Boston_Skylights/octrees/myNormalsScene.oct |
pfilt -x /4 -y /4 -1 -r 0.7 > ~/simulation/Boston_Skylights/images/2023_01_09_1607_rtpict_rendering_aa0_20000_sunny_ad32_0_normals_filt.hdr
echo ~/simulation/Boston_Skylights/images/2023_01_09_1607_rtpict_rendering_aa0_20000_sunny_ad32_0_normals_filt.hdr""")  # -> Stdout, Stderr, Ran
download_17 = Download(SftpPaths=flatten(executessh_73.Stdout), Run=executessh_73.Ran)  # -> FilePaths, Status, Ran
imageviewer_10 = LBImageViewer(ImagePath_=download_17.FilePaths, _scale_=1, DisableClickable=False, SaveImgWithCoords=False, scale=1)  # -> ImagePath, Values, GIF

# ----
# normalshader
# Save the shader. Remember to set your password.
# 
# source = https://discourse.radiance-online.org/t/rendering-of-normal-map/2471/3
panel_148 = Panel("echo <pw> | sudo -S echo \"<shader>\" > /usr/local/radiance/lib/normalshader.cal")
falsestart_25 = LBFalseStartToggle(False)
panel_149 = Panel("""{
  normalshader.cal

  Look in RADIANCE/lib/rayinit.cal for more info on builtin funcs and vars
}

red = (Nx + 1)/2;
green = (Ny + 1)/2;
blue = (Nz + 1)/2;""")

nickname_2 = GH_PromptInput(Prompt="ssh password?", Ask=falsestart_25, Hide=True)

overrides_89 = ApplyOverrides(Input=panel_148, Pw=graft(nickname_2), Shader=graft(panel_149))  # -> Output, DynamicOutput
executessh_74 = ExecuteSSH(
    _SSHCommands_=overrides_89.DynamicOutput,
    Run=falsestart_25,
    addPrefix=True,
    description="""echo  | sudo -S echo "{
  normalshader.cal

  Look in RADIANCE/lib/rayinit.cal for more info on builtin funcs and vars
}

red = (Nx + 1)/2;
green = (Ny + 1)/2;
blue = (Nz + 1)/2;" > /usr/local/radiance/lib/normalshader.cal""",
    fireLogs=False,
    lastRunTime=57,
    suppressWarnings=False,
    stderr="bash: /usr/local/radiance/lib/normalshader.cal: Permission denied",
    commands="""echo YYOURPASSWORD | sudo -S echo "{
  normalshader.cal

  Look in RADIANCE/lib/rayinit.cal for more info on builtin funcs and vars
}

red = (Nx + 1)/2;
green = (Ny + 1)/2;
blue = (Nz + 1)/2;" > /usr/local/radiance/lib/normalshader.cal""")  # -> Stdout, Stderr_, Ran
panel_150 = Panel(overrides_89.Output)
panel_151 = Panel(executessh_74.Stderr_)

# ----
# Parallel RTPICT render (luminance) no cache
viewfile_6 = Text(executessh_16.Stdout)
# Delete this one but copy the multi  sky
# to the section above
octree_9 = Text(executessh_41.Stdout)
octree_overcast_4 = Text(octree_overcast)
entwine_15 = Entwine(Branch00=octree_overcast_4, Branch01=octree_9, FlattenInputs=True)  # -> flatten(Result)
panel_152 = Panel("""mkdir -p images/
rtpict -n <cpus-1> -w -vf <vf> -x <x> -y <y> <radOptions> <oct> | pfilt -x /<ss> -y /<ss> -r 0.7 > images/<target>;echo images/<target>""")
octree_10 = Text(graft(entwine_15))
list_3 = ItemSelector(
    octree_10,
    {"octrees/Scene_Overcast10klux.oct", "octrees/my_test_scene_0800.oct", "octrees/my_test_scene_0900.oct", "octrees/my_test_scene_1000.oct", "octrees/my_test_scene_1100.oct", "octrees/my_test_scene_1200.oct", "octrees/my_test_scene_1300.oct", "octrees/my_test_scene_1400.oct", "octrees/my_test_scene_1500.oct", "octrees/my_test_scene_1600.oct", "octrees/my_test_scene_1700.oct"}, selected="octrees/Scene_Overcast10klux.oct")
eval_2 = Evaluate(F="x=y", x=octree_10, y=list_3)
run_7 = LBFalseStartToggle(False)

hours_8 = Text(hours_2)
entwine_16 = Entwine(Branch00="ovc", Branch01=hours_8, FlattenInputs=True)  # -> flatten(Result)
cull_8 = CullPattern(List=graft(entwine_16), CullPattern=eval_2)  # -> flatten(List)
hours_9 = Text(cull_8)

overrides_90 = ApplyOverrides(
    Input=panel_152,
    Vf=graft(viewfile_6),
    X=graft(multiplication),
    Y=graft(multiplication_2),
    RadOptions=graft("-ab 3 -ad 16 -aa 0"),
    Oct=graft(list_3),
    Target=graft("<time>_rtpict_rendering_aa0_<x>_sunny_ad16_<h>.hdr"),
    Time=graft("<time>"),
    H=graft(hours_9),
    Ss=graft(supersampling))  # -> Output, DynamicOutput
python_30 = GhPythonScript(update=flatten(overrides_90.Output))  # -> time; inputs update: tree; same code as python_14

# ----
# Parallel RTPICT render (Illuminance)
# (takes 2.5X longer than above...)
# mkdir -p <proj>/images/
# rtpict -i -w -n 30 -vf <vf> -x <x> -y <y> <radOptions> <oct> | pfilt -x /4 -y /4 -r 0.7 > <proj>/images/<target>;echo <proj>/images/<target>
viewfile_7 = Text(executessh_16.Stdout)
panel_153 = Panel("""mkdir -p <proj>/images/
rtpict -i -w -n <cpus-2> -vf <vf> -x <x> -y <y> <radOptions> <oct> | pfilt -x /<ss> -y /<ss> -r 0.7 > <proj>/images/<target>;echo <proj>/images/<target>""")
run_8 = LBFalseStartToggle(False)
x_11 = RemoteReceiver(x)
y_10 = RemoteReceiver(y)
overrides_91 = ApplyOverrides(
    Input=panel_153,
    Vf=graft(viewfile_7),
    X=graft(x_11),
    Y=graft(y_10),
    RadOptions=graft("-ab 3 -ad 16 -aa 0"),
    Oct=graft(list_3),
    Target=graft("<time>_rtpict_rendering_aa0_<x>_sunny_ad8_<h>_illum.hdr"),
    Time=graft(python_30),
    H=graft(hours_9),
    Ss=graft(supersampling))  # -> Output, DynamicOutput
executessh_75 = ExecuteSSH(
    _SSHCommands_=flatten(overrides_91.DynamicOutput),
    Run=run_8,
    addPrefix=True,
    description="""mkdir -p ~/MantaRay/Rikshospitalet/images/
rtpict -i -w -n 61 -vf /home/lio/MantaRay/Rikshospitalet/views/Perspective3.vf -x 750 -y 375 -ab 3 -ad 16 -aa 0 octrees/Scene_Overcast10klux.oct | pfilt -x /4 -y /4 -r 0.7 > ~/MantaRay/Rikshospitalet/images/2023_04_06_2339_32_rtpict_rendering_aa0_750_sunny_ad8_ovc_illum.hdr;echo ~/MantaRay/Rikshospitalet/images/2023_04_06_2339_32_rtpict_rendering_aa0_750_sunny_ad8_ovc_illum.hdr""",
    fireLogs=False,
    lastRunTime=0,
    suppressWarnings=False)  # -> Stdout, Stderr_, Ran

overrides_92 = ApplyOverrides(Input=overrides_90.DynamicOutput, Time=graft(python_30))  # -> Output, DynamicOutput
executessh_76 = ExecuteSSH(
    _SSHCommands_=flatten(overrides_92.DynamicOutput),
    Run=run_7,
    addPrefix=True,
    description="""mkdir -p images/
rtpict -n 62 -w -vf /home/lio/MantaRay/Rikshospitalet/views/Perspective3.vf -x 3000 -y 1500 -ab 3 -ad 16 -aa 0 octrees/Scene_Overcast10klux.oct | pfilt -x /4 -y /4 -r 0.7 > images/2023_04_06_2339_32_rtpict_rendering_aa0_3000_sunny_ad16_ovc.hdr;echo images/2023_04_06_2339_32_rtpict_rendering_aa0_3000_sunny_ad16_ovc.hdr""",
    fireLogs=False,
    lastRunTime=0,
    suppressWarnings=False)  # -> Stdout, Stderr_, Ran

# ----
# orig dimensions
panel_154 = Panel("getinfo <f>")
overrides_93 = ApplyOverrides(Input=panel_154, F=graft(executessh_75.Stdout))  # -> Output, DynamicOutput
executessh_77 = ExecuteSSH(
    _SSHCommands_=overrides_93.DynamicOutput,
    Run=executessh_75.Ran,
    addPrefix=True,
    description="getinfo <f>",
    fireLogs=False,
    lastRunTime=0,
    suppressWarnings=False)  # -> Stdout, Stderr_, Ran
python_31 = GhPythonScript(x=executessh_77.Stdout)  # -> out, org_y
# ---------- python_31: Python ----------
__author__ = "mm1013"
__version__ = "2022.08.31"

import rhinoscriptsyntax as rs

lines = x.replace("\r","").split("\n")

for l in lines:
    line = l.strip()
    if line.startswith("rtrace"):
        print "RTRACE"
        li = line.split("-y")
        
        print li[1].strip().split(" ")[0]
        org_y = int(li[1].strip().split(" ")[0])
    elif line.startswith("pfilt"):
        print "PFIlT"
        li = line.split("-y")
        
        print li[1].strip().split(" ")[0]
        org_y = org_y / float(li[1].strip().split(" ")[0].replace("/",""))
# ---------- end python_31 ----------

panel_155 = Panel("""pcond -h <hdr> <hdr-.>_exposed.hdr
ra_tiff <hdr-.>_exposed.hdr <hdr-.>_exposed.tif
convert <hdr-.>_exposed.tif <hdr-.>_exposed.png
echo <hdr-.>_exposed.png""")
panel_156 = Panel("""ra_tiff <hdr-.>.hdr <hdr-.>.tif
convert <hdr-.>.tif <hdr-.>.png
echo <hdr-.>.png""")
entwine_17 = Entwine(Branch00=panel_155, Branch01=panel_156, FlattenInputs=True)
overrides_94 = ApplyOverrides(Input=entwine_17, Hdr=graft(executessh_76.Stdout))  # -> Output, DynamicOutput
executessh_78 = ExecuteSSH(
    _SSHCommands_=overrides_94.DynamicOutput,
    Run=executessh_76.Ran,
    addPrefix=True,
    description="""pcond -h <hdr> <hdr>_exposed.hdr
ra_tiff <hdr>_exposed.hdr <hdr>_exposed.tif
convert <hdr>_exposed.tif <hdr>_exposed.png
echo <hdr>_exposed.png


- - -

ra_tiff <hdr>.hdr <hdr>.tif
convert <hdr>.tif <hdr>.png
echo <hdr>.png""",
    fireLogs=False,
    lastRunTime=0,
    suppressWarnings=False)  # -> Stdout, Stderr_, Ran
download_18 = Download(LinuxFilePaths=executessh_78.Stdout, Run=executessh_78.Ran)  # -> flatten(FilePaths), Status, Ran
item_6 = ListItem(List=download_18.FilePaths, Index=0, Wrap=True)  # -> Item, Item1
imageviewer_11 = LBImageViewer(ImagePath_=item_6.Item, _scale_=3, DisableClickable=False, SaveImgWithCoords=False, scale=3)  # -> ImagePath, Values, GIF

# ----
# blurring the irrad
panel_157 = Panel("pfilt -x /3 -y /3 -r 1 <file> | pfilt -1 -x <x> -y <y> > <file-.>_filteredBlur.hdr;ra_tiff <file-.>_filteredBlur.hdr <file-.>_filteredBlur.tif;echo <file-.>_filteredBlur.hdr")
overrides_95 = ApplyOverrides(Input=panel_157, File=graft(executessh_75.Stdout), X=graft(x_4), Y=graft(python_31.org_y))  # -> Output, DynamicOutput
executessh_79 = ExecuteSSH(
    _SSHCommands_=overrides_95.DynamicOutput,
    Run=executessh_75.Ran,
    addPrefix=True,
    description="pfilt -x /3 -y /3 -r 1 <file> | pfilt -1 -x 750 -y <y> > <file>_filteredBlur.hdr;ra_tiff <file>_filteredBlur.hdr <file>_filteredBlur.tif;echo <file>_filteredBlur.hdr",
    fireLogs=False,
    lastRunTime=0,
    suppressWarnings=False)  # -> Stdout, Stderr_, Ran

# ----
# overlay illuminance falsecolor on luminance picture
panel_158 = Panel("""pcond -h <rad> | pfilt -x /2 -y /2 -r 0.7 > <rad-.>exposed_sd.hdr
pfilt -x /2 -y /2 -r 0.7 <irrad> > <irrad-.>_sd.hdr
falsecolor -s 2000 -l lux -lw 200 -lh 300 -p <rad-.>exposed_sd.hdr -i <irrad-.>_sd.hdr -cl > <rad-.>_fc.hdr
ra_tiff <rad-.>_fc.hdr <rad-.>_fc.tif
convert <rad-.>_fc.tif <rad-.>_fc.png
echo <rad-.>_fc.hdr""")
panel_159 = Panel("-log 2")
overrides_96 = ApplyOverrides(Input=panel_158, Rad=graft(executessh_76.Stdout), Irrad=graft(executessh_79.Stdout))  # -> Output, DynamicOutput
executessh_80 = ExecuteSSH(
    _SSHCommands_=overrides_96.DynamicOutput,
    Run=[executessh_75.Ran, executessh_76.Ran],
    addPrefix=True,
    description="""pcond -h <rad> | pfilt -x /2 -y /2 -r 0.7 > <rad>exposed_sd.hdr
pfilt -x /2 -y /2 -r 0.7 <irrad> > <irrad>_sd.hdr
falsecolor -s 2000 -l lux -lw 200 -lh 300 -p <rad>exposed_sd.hdr -i <irrad>_sd.hdr -cl > <rad>_fc.hdr
ra_tiff <rad>_fc.hdr <rad>_fc.tif
convert <rad>_fc.tif <rad>_fc.png
echo <rad>_fc.hdr""",
    fireLogs=False,
    lastRunTime=0,
    suppressWarnings=False)  # -> Stdout, Stderr_, Ran
download_19 = Download(LinuxFilePaths=executessh_80.Stdout, Run=executessh_80.Ran)  # -> FilePaths, Status, Ran
imageviewer_12 = LBImageViewer(ImagePath_=download_19.FilePaths, _scale_=2, DisableClickable=False, SaveImgWithCoords=False, scale=2)  # -> ImagePath, Values, GIF

# ----
# FalseColor
panel_160 = Panel("""pfilt -x /2 -y /2 -r 0.7 <irrad> | falsecolor -s 2000 -l lux -lw 200 -lh 300 > <irrad-.>_fc2.hdr
ra_tiff <irrad-.>_fc2.hdr <irrad-.>_fc2.tif
convert <irrad-.>_fc2.tif <irrad-.>_fc2.png
rm <irrad-.>_fc2.hdr
rm <irrad-.>_fc2.tif
echo <irrad-.>_fc2.png""")
overrides_97 = ApplyOverrides(Input=panel_160, Irrad=graft(executessh_75.Stdout))  # -> Output, DynamicOutput
executessh_81 = ExecuteSSH(
    _SSHCommands_=overrides_97.DynamicOutput,
    Run=executessh_75.Ran,
    addPrefix=True,
    description="""pfilt -x /2 -y /2 -r 0.7 <irrad> | falsecolor -s 2000 -l lux -lw 200 -lh 300 > <irrad>_fc2.hdr
ra_tiff <irrad>_fc2.hdr <irrad>_fc2.tif
convert <irrad>_fc2.tif <irrad>_fc2.png
rm <irrad>_fc2.hdr
rm <irrad>_fc2.tif
echo <irrad>_fc2.png""",
    fireLogs=False,
    lastRunTime=0,
    suppressWarnings=False)  # -> Stdout, Stderr_, Ran
download_20 = Download(LinuxFilePaths=executessh_81.Stdout, Run=executessh_81.Ran)  # -> FilePaths, Status, Ran
imageviewer_13 = LBImageViewer(ImagePath_=download_20.FilePaths, _scale_=2, DisableClickable=False, SaveImgWithCoords=False, scale=2)  # -> ImagePath, Values, GIF

# ----
# save pngs exposed and raw
panel_161 = Panel("""ra_tiff <hdr-.>.hdr <hdr-.>.tif
convert <hdr-.>.tif <hdr-.>.png
rm <hdr-.>.tif
echo <hdr-.>.png""")
panel_162 = Panel("""pcond -h <hdr> <hdr-.>_exposed.hdr
ra_tiff <hdr-.>_exposed.hdr <hdr-.>_exposed.tif
convert <hdr-.>_exposed.tif <hdr-.>_exposed.png
rm <hdr-.>_exposed.tif
rm <hdr-.>_exposed.hdr
echo <hdr-.>_exposed.png""")
entwine_18 = Entwine(Branch00=panel_162, Branch01=panel_161, FlattenInputs=True)
overrides_98 = ApplyOverrides(Input=entwine_18, Hdr=graft(executessh_75.Stdout))  # -> Output, DynamicOutput
executessh_82 = ExecuteSSH(
    _SSHCommands_=overrides_98.DynamicOutput,
    Run=executessh_75.Ran,
    addPrefix=True,
    description="""pcond -h <hdr> <hdr>_exposed.hdr
ra_tiff <hdr>_exposed.hdr <hdr>_exposed.tif
convert <hdr>_exposed.tif <hdr>_exposed.png
rm <hdr>_exposed.tif
rm <hdr>_exposed.hdr
echo <hdr>_exposed.png


- - -

ra_tiff <hdr>.hdr <hdr>.tif
convert <hdr>.tif <hdr>.png
rm <hdr>.tif
echo <hdr>.png""",
    fireLogs=False,
    lastRunTime=0,
    suppressWarnings=False)  # -> Stdout, Stderr_, Ran
download_21 = Download(LinuxFilePaths=executessh_82.Stdout, Run=executessh_82.Ran)  # -> flatten(FilePaths), Status, Ran
item_7 = ListItem(List=download_21.FilePaths, Index=0, Wrap=True)  # -> Item, Item1
imageviewer_14 = LBImageViewer(ImagePath_=item_7.Item, _scale_=2, DisableClickable=False, SaveImgWithCoords=False, scale=2)  # -> ImagePath, Values, GIF
imageviewer_15 = LBImageViewer(ImagePath_=item_7.Item1, _scale_=2, DisableClickable=False, SaveImgWithCoords=False, scale=2)  # -> ImagePath, Values, GIF

panel_163 = Panel("Perspective")  # disabled
panel_164 = Panel("""mkdir -p <proj>/views/
echo "<vf>" > <proj>/views/<target>.vf
echo <proj>/views/<target>.vf""")  # disabled
panel_165 = Panel("1")  # disabled
concat_9 = Concatenate(FragmentA=panel_163, FragmentB=panel_165)  # disabled
toggle_4 = BooleanToggle(True)  # disabled

# ----
# Doubleclick Me To update view
view_5 = CreateView(Viewport=panel_163)  # -> ViewfileContent, ImageRatio; disabled

panel_166 = Panel(view_5.ViewfileContent)  # disabled
vf_4 = Text(view_5.ViewfileContent)  # disabled
overrides_99 = ApplyOverrides(Input=panel_164, Vf=graft(vf_4), Target=graft(concat_9))  # -> Output, DynamicOutput; disabled
executessh_83 = ExecuteSSH(
    _SSHCommands_=overrides_99.DynamicOutput,
    Run=toggle_4,
    addPrefix=True,
    description="""mkdir -p ~/MantaRay/TestFolder/views/
echo "rvu -vtv -vp 76.210958985352 16.4300937305602 1.83584927923156 -vd -0.349680913647465 0.927360836447747 0.133135786524922 -vu 0.0469732080515546 -0.124573895254805 0.991097806649975 -vh 103.484 -vv 50.000" > ~/MantaRay/TestFolder/views/Perspective1.vf
echo ~/MantaRay/TestFolder/views/Perspective1.vf""",
    fireLogs=False,
    lastRunTime=0,
    suppressWarnings=False,
    commands="""mkdir -p ~/MantaRay/TestFolder/views/
echo "rvu -vtv -vp 76.210958985352 16.4300937305602 1.83584927923156 -vd -0.349680913647465 0.927360836447747 0.133135786524922 -vu 0.0469732080515546 -0.124573895254805 0.991097806649975 -vh 103.484 -vv 50.000" > ~/MantaRay/TestFolder/views/Perspective1.vf
echo ~/MantaRay/TestFolder/views/Perspective1.vf""")  # -> Stdout, Stderr_, Ran; disabled

# ----
# VIEW
file_exists_2 = Panel("[ -f <out> ] && echo \"1\" || echo \"0\"")  # disabled
item_8 = ListItem(List=flatten(executessh_83.Stdout), Index=0, Wrap=True)  # disabled
panel_167 = Panel(executessh_83.Stdout)  # disabled
overrides_100 = ApplyOverrides(Input=file_exists_2, Out=graft(item_8))  # -> Output, DynamicOutput; disabled
executessh_84 = ExecuteSSH(
    _SSHCommands_=overrides_100.DynamicOutput,
    Run=executessh_36.Ran,
    addPrefix=True,
    description="[ -f  ] && echo \"1\" || echo \"0\"",
    fireLogs=False,
    lastRunTime=88,
    suppressWarnings=False,
    results="1",
    commands="[ -f  ] && echo \"1\" || echo \"0\"")  # -> Stdout, Stderr_, Ran; disabled

# ----
# Parallel ACCELERAD RTRACE render
# echo "rvu -vtv -vp 0.5 4.5 1.6 -vd 0.830824 -1.13002 -0.181063 -vu 0 0 1 -vh 98.2132 -vv 79.2785 -vo 0 -va 0 -vs 0 -vl 0" > <proj>/views/myview.vf;echo <proj>/views/myview.vf
run_9 = LBFalseStartToggle(False)  # disabled
octree_11 = Text(executessh_36.Stdout)  # disabled
viewfile_8 = Text(executessh_83.Stdout)  # disabled
panel_168 = Panel("""mkdir -p <proj>/images/
vwrays -ff -x <x> -y <y> -vf <vf> -pa 1 | accelerad_rtrace <radOptions> -w `vwrays -d -ff -x <x> -y <y> -vf <vf> -pa 1` -ffc <oct> > <proj>/images/<target-.>.hdr
echo <proj>/images/<target-.>.hdr""")  # disabled
panel_169 = Panel("-as 0 -ab 3 -aa 0.2 -ad 128")  # disabled
panel_170 = Panel("-ab 3 -ad 2048")  # disabled
panel_171 = Panel("accelerad_rtrace_rendering.png")  # disabled
panel_172 = Panel("300")  # disabled
panel_173 = Panel("600")  # disabled
overrides_101 = ApplyOverrides(
    Input=panel_168,
    X=graft(panel_173),
    Y=graft(panel_172),
    Vf=graft(viewfile_8),
    RadOptions=graft(panel_169),
    Oct=graft(octree_11),
    Target=graft(panel_171))  # -> Output, DynamicOutput; disabled
executessh_85 = ExecuteSSH(
    _SSHCommands_=overrides_101.DynamicOutput,
    Run=run_9,
    addPrefix=True,
    description="""mkdir -p ~/MantaRay/TestFolder/images/
vwrays -ff -x 600 -y 300 -vf  -pa 1 | accelerad_rtrace -as 0 -ab 3 -aa 0.2 -ad 128 -w `vwrays -d -ff -x 600 -y 300 -vf  -pa 1` -ffc octrees/Scene_Overcast10klux.oct > ~/MantaRay/TestFolder/images/accelerad_rtrace_rendering.hdr
echo ~/MantaRay/TestFolder/images/accelerad_rtrace_rendering.hdr""",
    fireLogs=False,
    lastRunTime=535,
    suppressWarnings=False,
    results="/home/mss/simulation/Boston_Skylights/images/accelerad_rtrace_rendering.hdr",
    stderr="""accelerad_rtrace: internal - A supported NVIDIA GPU could not be found
(/media/nathaniel/DATA/Accelerad/src/rt/optix_radiance.c:255)""",
    commands="""mkdir -p ~/simulation/Boston_Skylights/images/
vwrays -ff -x 600 -y 300 -vf /home/mss/MantaRay/UnnamedProject/views/Perspective1.vf -pa 1 | accelerad_rtrace -as 0 -ab 3 -aa 0.2 -ad 128 -w `vwrays -d -ff -x 600 -y 300 -vf /home/mss/MantaRay/UnnamedProject/views/Perspective1.vf -pa 1` -ffc /home/mss/MantaRay/UnnamedProject/octrees/my_test_scene.oct > ~/simulation/Boston_Skylights/images/accelerad_rtrace_rendering.hdr
echo ~/simulation/Boston_Skylights/images/accelerad_rtrace_rendering.hdr""")  # -> Stdout, Stderr_, Ran; disabled
panel_174 = Panel(executessh_85.Stderr_)  # disabled

# ----
# Using PCOND to set automatic exposure
# and convert to PNG
panel_175 = Panel("""pcond -h <hdr> <hdr-.>_exposed.hdr
ra_tiff <hdr-.>_exposed.hdr <hdr-.>_exposed.tif
convert <hdr-.>_exposed.tif <hdr-.>_exposed.png
echo <hdr-.>_exposed.png""")  # disabled
overrides_102 = ApplyOverrides(Input=panel_175, Hdr=graft(executessh_85.Stdout))  # -> Output, DynamicOutput; disabled
executessh_86 = ExecuteSSH(
    _SSHCommands_=overrides_102.DynamicOutput,
    Run=executessh_85.Ran,
    addPrefix=True,
    description="""pcond -h /home/mss/simulation/Boston_Skylights/images/accelerad_rtrace_rendering.hdr /home/mss/simulation/Boston_Skylights/images/accelerad_rtrace_rendering_exposed.hdr
ra_tiff /home/mss/simulation/Boston_Skylights/images/accelerad_rtrace_rendering_exposed.hdr /home/mss/simulation/Boston_Skylights/images/accelerad_rtrace_rendering_exposed.tif
convert /home/mss/simulation/Boston_Skylights/images/accelerad_rtrace_rendering_exposed.tif /home/mss/simulation/Boston_Skylights/images/accelerad_rtrace_rendering_exposed.png
echo /home/mss/simulation/Boston_Skylights/images/accelerad_rtrace_rendering_exposed.png""",
    fireLogs=False,
    lastRunTime=546,
    suppressWarnings=False,
    results="/home/mss/MantaRay/UnnamedProject/images/rtrace_rendering_exposed.png",
    commands="""pcond -h /home/mss/MantaRay/UnnamedProject/images/rtrace_rendering.hdr /home/mss/MantaRay/UnnamedProject/images/rtrace_rendering_exposed.hdr
ra_tiff /home/mss/MantaRay/UnnamedProject/images/rtrace_rendering_exposed.hdr /home/mss/MantaRay/UnnamedProject/images/rtrace_rendering_exposed.tif
convert /home/mss/MantaRay/UnnamedProject/images/rtrace_rendering_exposed.tif /home/mss/MantaRay/UnnamedProject/images/rtrace_rendering_exposed.png
echo /home/mss/MantaRay/UnnamedProject/images/rtrace_rendering_exposed.png""")  # -> Stdout, Stderr_, Ran; disabled
download_22 = Download(LinuxFilePaths=executessh_86.Stdout, Run=executessh_86.Ran)  # -> FilePaths, Status, Ran; disabled
panel_176 = Panel("1.5")  # disabled
imageviewer_16 = LBImageViewer(ImagePath_=download_22.FilePaths, _scale_=panel_176, DisableClickable=False, SaveImgWithCoords=False, scale=1.5)  # -> ImagePath, Values, GIF; disabled

# ----
# Getting results (dctimestep)
# mkdir -p <proj>/results/
# dctimestep <dcillum> <skymtx> > <proj>/results/dctimestep_dcillum_skymtx.txt
panel_177 = Panel("""mkdir -p <proj>/results/
dctimestep <dcillum> <skymtx> | rmtxop -fa -t -c 47.4 119.9 11.6 - > <proj>/results/<target>;echo <proj>/results/<target>""")
and_5 = GateAnd(B=executessh_57.Ran)

# ---- group: Outdated
overrides_103 = ApplyOverrides(Input=panel_177)  # -> Output, Pairs

# ----
overrides_104 = ApplyOverrides(Input=panel_177, Dcillum=graft(executessh_57.Stdout), Target=graft("annualR_DC.ill"))  # -> Output, DynamicOutput

panel_178 = Panel(overrides_103.Output)

dcillum = Text(executessh_66.Stdout)
skymtx_2 = Text()
panel_179 = Panel("""mkdir -p <proj>/results/
dctimestep <dcillum> <skymtx> | rmtxop -fa -t -c 47.4 119.9 11.6 - > <proj>/results/<target>;echo <proj>/results/<target>""")
and_6 = GateAnd(A=executessh_66.Ran)

# ---- group: Outdated
overrides_105 = ApplyOverrides(Input=panel_179, Dcillum=graft(dcillum), Skymtx=graft(skymtx_2), Target=graft("annualR_DCD.ill"))  # -> Output, Pairs

# ----
panel_180 = Panel(overrides_105.Output)

panel_181 = Panel("""mkdir -p <proj>/results/
dctimestep <dcillum> <skymtx> | rmtxop -fa -t -c 47.4 119.9 11.6 - > <proj>/results/<target>;echo <proj>/results/<target>""")
m6_sky_mtx = Text()
and_7 = GateAnd(B=executessh_67.Ran)

# ---- group: Outdated
overrides_106 = ApplyOverrides(Input=panel_181, Dcillum=graft(executessh_67.Stdout), Skymtx=graft(m6_sky_mtx), Target=graft("annualR_CDS.ill"))  # -> Output, Pairs

# ----
panel_182 = Panel(overrides_106.Output)

# ----
# final step: Combine results
panel_183 = Panel("""export PATH=$PATH.:/usr/local/radiance/bin
export RAYPATH=.:/usr/local/radiance/lib
rmtxop <DCannualR> + -s -1 <DCDannualR> + <CDSannualR> > <proj>/results/<target>;echo <proj>/results/<target>""")
falsestart_26 = LBFalseStartToggle(False)
and_8 = GateAnd()
or_2 = GateOr(A=and_8, B=falsestart_26)

# ---- group: Outdated
overrides_107 = ApplyOverrides(Input_=panel_183, Target=graft("DDS_Total.ill"))  # -> Output, Pairs

# ----
panel_184 = Panel(overrides_107.Output)

# ----
# preview grid results
entwine_19 = Entwine(FlattenInputs=True)  # -> flatten(Result)
falsestart_27 = LBFalseStartToggle(False)
or_3 = GateOr(B=falsestart_27)
_17037_schedule = Integer()
pt_3 = Point()
pt_4 = Point(pt_3)

# ---- group: Outdated
download_23 = Download(
    LinuxFilePaths=entwine_19,
    Run=or_3,
    stdouts="C:\Users\mm1013/simulation\DDS_Total.ill>JOIN<C:\Users\mm1013/simulation\annualR_DCD.ill>JOIN<C:\Users\mm1013/simulation\annualR_CDS.ill")  # -> Status, FilePaths, Run

# ----
list_4 = ItemSelector(
    download_23.FilePaths,
    {"C:\Users\mm1013/simulation\DDS_Total.ill", "C:\Users\mm1013/simulation\annualR_DCD.ill", "C:\Users\mm1013/simulation\annualR_CDS.ill"}, selected="C:\Users\mm1013/simulation\DDS_Total.ill")
annualresults = AnnualResults(
    IllFile=list_4,
    Schedule=_17037_schedule,
    Min=300,
    Max=0,
    Run=download_23.Run,
    stdouts="#?RADIANCE>JOIN<rmtxop /home/mss/simulation/test_project2/results/annualR_DC.ill + -s -1 /home/mss/simulation/test_project2/results/annualR_DCD.ill + /home/mss/simulation/test_project2/results/annualR_DCD.ill>JOIN<rmtxop -fa -t -c 47.4 119.9 11.6 ->JOIN<dctimestep /home/mss/simulation/test_project2/mtxs/dc_illum.mtx /home/mss/simulation/weatherData/DNK_DRY_OFFICIAL_2001-2010_epw-fil.smx>JOIN<CAPDATE= 2022:08:18 07:16:19>JOIN<GMT= 2022:08:18 05:16:19>JOIN<Applied 1x3 matrix transform>JOIN<Transposed rows and columns>JOIN<NROWS=8760>JOIN<NCOLS=274>JOIN<NCOMP=1>JOIN<FORMAT=ascii",
    numbers=[0.8358447489, 0.8388127854, 0.8388127854, 0.84543379, 0.847260274, 0.852283105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])  # -> Headers, Results, Ran
bnd = Bounds(Numbers=annualresults.Results)

division_3 = Division(A=annualresults.Results, B=".2")
int_2 = Integer(division_3)
multiplication_9 = Multiplication(A=int_2, B=".2")

gradient_2 = Gradient(
    LowerLimit="1",
    UpperLimit="0",
    Parameter=multiplication_9,
    stops=[0: RGB(234, 38, 0), 0.25: RGB(234, 126, 0), 0.5: RGB(254, 244, 84), 0.75: RGB(173, 203, 249), 1: RGB(75, 107, 169)])
preview = CustomPreview(Geometry=pt_4, Material=gradient_2)

# ==== cluster DefaultMSS
default_value_flattened = ClusterInput()
data = ClusterInput()
data_2 = Data(data)
merge = Merge(Data1=flatten(data_2), Data2="0")  # -> flatten(Result)
default_value_flattened_2 = Data(flatten(default_value_flattened))
lng = ListLength(List=merge)
equals = Equality(FirstNumber=lng, SecondNumber="1")  # -> Equality, Inequality
cull = CullPattern(List=data_2, CullPattern=invert(equals.Equality))
panel = Panel(equals.Equality)
cull_2 = CullPattern(List=default_value_flattened_2, CullPattern=equals.Equality)
data_3 = Data([cull, cull_2])
data_4 = ClusterOutput(data_3)

# ==== cluster LargestBREP
window_breps = ClusterInput()
window_breps_2 = Brep(window_breps)
debrep = DeconstructBrep(Brep=window_breps_2)  # -> Faces, Edges, Vertices
area = Area(Geometry=debrep.Faces)  # -> Area, Centroid
sort = SortList(Keys=area.Area, ValuesA=debrep.Faces)  # -> Keys, ValuesA
item = ListItem(List=sort.ValuesA, Index=-1, Wrap=True)
group = Group(Objects=flatten(item))
grouped = ClusterOutput(group)

# ==== cluster Cluster
mod = ClusterInput()
panel = Panel(mod)
python = GhPythonScript(mod=mod)  # -> name_geo, name_mod, omod; inputs mod: list
# ---------- python: Python ----------
__author__ = "mm1013"
__version__ = "2023.03.11"

import re

regex = re.compile('[^a-zA-Z0-9_.]')

import rhinoscriptsyntax as rs



name_geo = [regex.sub('_',m.split("\n")[0].split(" ")[2]) + "_geo" for m in mod]
name_mod = [regex.sub('_',m.split("\n")[0].split(" ")[2]) for m in mod]
# ---------- end python ----------
name_mod = ClusterOutput(python.name_mod)
name_geo = ClusterOutput(python.name_geo)
panel_2 = Panel(python.name_geo)
panel_3 = Panel(python.name_mod)

# ==== cluster Cluster_2
L = ClusterInput()
lng = ListLength(List=L)
default = DefaultMSS(data=flatten(lng), default_value_flattened=flatten("0"))
bool = Boolean(default)
bool_2 = ClusterOutput(bool)

# ==== cluster N
mod = ClusterInput()
python = GhPythonScript(mod=mod)  # -> name_geo, name_mod; inputs mod: list
# ---------- python: Python ----------
__author__ = "mm1013"
__version__ = "2023.03.11"

import re

regex = re.compile('[^a-zA-Z0-9_.]')

import rhinoscriptsyntax as rs



name_geo = [regex.sub('_',m.split("\n")[0]) + "_geo" for m in mod]
name_mod = [regex.sub('_',m.split("\n")[0]) for m in mod]
# ---------- end python ----------
name_mod = ClusterOutput(python.name_mod)
name_geo = ClusterOutput(python.name_geo)

# ==== cluster Cluster_3
L = ClusterInput()
lng = ListLength(List=L)
default = DefaultMSS(data=flatten(lng), default_value_flattened=flatten(Toggle(False)))
bool = Boolean(default)
bool_2 = ClusterOutput(bool)

# ==== cluster Cluster_4
x = ClusterInput()
python = GhPythonScript(x=x)  # -> a
# ---------- python: Python ----------
__author__ = "mm1013"
__version__ = "2022.07.02"

import rhinoscriptsyntax as rs

##Removing the leading "~"
a = x[1:]
# ---------- end python ----------
a = ClusterOutput(python)

# ==== cluster Cluster_5
horizontaldiffrad = ClusterInput()
horizontaldiffrad_2 = Number(horizontaldiffrad)
lng = ListLength(List=horizontaldiffrad_2)
lng_2 = ListLength(List=horizontaldiffrad_2)
series = Series(Start=0, Step=0, Count=lng)
division = Division(A=lng, B=2)
series_2 = Series(Start=0, Step=1, Count=lng_2)
subtraction = Subtraction(A=division, B=1)
sort = SortList(Keys=horizontaldiffrad_2, ValuesA=series_2)  # -> reverse(Keys), reverse(ValuesA)
dom = ConstructDomain(DomainStart="0", DomainEnd=subtraction)
subset = SubList(List=sort.ValuesA, Domain=dom, Wrap=True)  # -> List, Index
replace = ReplaceItems(List=series, Item="1", Indices=subset.List, Wrap=False)
schedule_01 = ClusterOutput(replace)

# ==== cluster ABC
data = ClusterInput()
data_2 = Data(data)
path_mapper = PathMapper(
    data_2,
    source=["{A;B;C;D;E;F;G}", "{A;B;C;D;E;F}", "{A;B;C;D;E}", "{A;B;C;D}", "{A;B;C}", "{A;B}", "{A}"],
    target=["{A}", "{A}", "{A}", "{A}", "{A}", "{A}", "{A}"])
data_3 = Data(path_mapper)
data_4 = ClusterOutput(data_3)
