# Grasshopper definition Test_3Ph_multirooms.gh (Grasshopper 1.0.7)
# Copyright: 2021
# Copyright: 2022-11-38
# Copyright: 2022-06-43
# plug-ins: MantaRay, Human, HDTTreeUtils, LadybugGrasshopper

panel = Panel("lio")
falsestart = LBFalseStartToggle(True)
panel_2 = Panel(". /etc/profile")
panel_3 = Panel("C:\simulation")

# ----
# Connect
panel_4 = Panel("10.71.5.181")
panel_5 = Panel("mm1013")
connect = ConnectSSHFTP(User="mss", Ip="localhost", Password="_prompt", _port=22, Connect=falsestart)  # -> Status, Prefixes, Run
panel_6 = Panel(connect.Prefixes)
panel_7 = Panel(connect.Status)

od_outdated = ColourSwatch(SwatchColor=RGBA(97, 97, 97, 150))
u_updated = ColourSwatch(SwatchColor=RGBA(208, 115, 230, 112))
toggle = BooleanToggle(True)
g_general = ColourSwatch(SwatchColor=RGBA(245, 243, 237, 156))
o_outputs = ColourSwatch(SwatchColor=RGBA(160, 218, 242, 203))
s_settings = ColourSwatch(SwatchColor=RGBA(224, 145, 81, 154))
cc_core2 = ColourSwatch(SwatchColor=RGBA(230, 216, 186, 208))
y_yellow = ColourSwatch(SwatchColor=RGBA(247, 244, 64, 188))
i_inputs = ColourSwatch(SwatchColor=RGBA(125, 217, 98, 150))
c_core = ColourSwatch(SwatchColor=RGBA(235, 227, 206, 203))
r_red = ColourSwatch(SwatchColor=RGBA(242, 63, 63, 203))

# ----
# Raytrace exterior
# daylightmatrix (DMX)
raytrace_daylight_matrix_exterior = LBFalseStartToggle(False)
dmx_rad_parameters = Panel("-ab 3 -ad 1024 -lw 0.001")

# ----
# set path for epw file
path = FilePath("Z:\LINK IO - Parametrisk Design\GrasshopperInstallation\Backstage\WeatherFiles\NOR_Oslo.Fornebu.014880_IWEC\NOR_Oslo.Fornebu.014880_IWEC.epw")
panel_8 = Panel(path)

# ----
# Create octree (3ph)
create_octree = LBFalseStartToggle(False)

# ----
# Raytrace interior
# viewmatrix (VMX)
calculate_vmx_interior = LBFalseStartToggle(False)
vmx_rad_parameters = Panel("-ab 2 -ad 1024 -lw 1e-3")

# ----
# grid settings
grid_size = Panel("0.3m")
vertical_offset = Panel("0.75m")
docunits = ConvertToDocumentUnits(ValueString=vertical_offset)
docunits_2 = ConvertToDocumentUnits(ValueString=grid_size)

# ----
# Prepare!
prepare_3_phase_geo_and_wea = LBFalseStartToggle(False)

# ----
# All geometry
# simulation grids (as closed curves)
panel_9 = Panel("Daylight_Inputs::*")
panel_10 = Panel("""Mesh
Polysurface
Surface
Extrusion""")
panel_11 = Panel("""Curve
Surface""")

colorgroups = CSharpScript(
    Colors=[i_inputs, s_settings, g_general, c_core, o_outputs, r_red, y_yellow, u_updated, od_outdated, cc_core2],
    Enable=toggle,
    Rename=Toggle(False),
    RunOnce=Button(),
    Debug=Toggle(False))  # -> out; inputs Colors: list of Color, Enable: Boolean, Rename: Boolean, RunOnce: Boolean, Debug: Boolean; disabled
# ---------- colorgroups: C# usings ----------
using System.Linq;
using System.Text;
using System.Reflection;
# ---------- colorgroups: C# ----------
    msg.Clear();


    this.Component.Message = "id: " + id.ToString();

    _debug = Debug; //Set to true to have all events printed in rhino log
    _rename = Rename;

    if (Enable)
    {
      msg.AppendFormat("Set up events on ID {0}\n", id);
      SetupDict(); // Create a dictionary of the input swatches
      SetEventHandlers(); // This would do the job.


    }
    else
    {
      RemoveEventHandlers();
    }
    if (RunOnce)
    {
      foreach(Grasshopper.Kernel.Special.GH_Group grp in Grasshopper.Instances.ActiveCanvas.Document.Objects.OfType<Grasshopper.Kernel.Special.GH_Group>())
      {
        ColorGroup(grp, null); // You decide if it should run once on all existing groups

      }
    }

    Print(msg.ToString());


    // Component setup
    Component.Description = "Set up event handlers to color groups based on prefixes such as 'in_' and 'out_'.\n"
      + "Please insert only swatcheds directly into the Colors input\n\n"
      + "MIT License. Copyright Mathias Sønderskov Schaltz 2022";
    Component.Params.Input[0].Description = "Please insert only swatcheds directly into the Colors input.\nRemember to rename them";
    Component.Params.Input[1].Description = "Toggle to run...";
    Component.Params.Input[2].Description = "Set to true if you want to automatically rename the groups and remove prefix. Default is false.";
    Component.Params.Input[3].Description = "Set to true to run it once and color all existing groups.";
    Component.Params.Input[Component.Params.Input.Count - 1].Description = "Set debug to true to get all the events printed in the rhino log";
# ---------- colorgroups: C# additional code ----------
  public static Random rnd = new Random();
  public int id = rnd.Next(0, 1000);
  StringBuilder msg = new StringBuilder();
  Dictionary<string, System.Drawing.Color> colorDict = new Dictionary<string, System.Drawing.Color>();

  bool _debug = false;
  bool _rename = false;

  public bool IdExists(int id)
  {
    IList<IGH_DocumentObject> objs = Grasshopper.Instances.ActiveCanvas.Document.Objects;
    return objs
      .OfType<IGH_Component>()
      .Where(ob => ob.NickName == this.Component.NickName)
      .Where(ob => ob.GetType().ToString() == "ScriptComponents.Component_CSNET_Script")
      .Where(ob => ob.Message == "id: " + id.ToString()).Any();

  }


  public void SetupDict()
  {
    colorDict.Clear();
    // Get all inputs to "Colors"
    IList<IGH_Param> colorSources = this.Component.Params.Input[0].Sources;
    if (colorSources.Count == 0)
    {
      throw new Exception("You forgot to setup the colors. Please input swatch components and rename them");
    }
    foreach(IGH_Param source in colorSources)
    {
      //if (source.Type.ToString() == "Grasshopper.Kernel.Types.GH_Colour")
      if (source is Grasshopper.Kernel.Special.GH_ColourSwatch)
      {
        string nickName = source.NickName.Split('_')[0].Trim() + "_";
        if(!colorDict.ContainsKey(nickName))
        {
          Grasshopper.Kernel.Special.GH_ColourSwatch swatch = (Grasshopper.Kernel.Special.GH_ColourSwatch) source;
          colorDict.Add(nickName, swatch.SwatchColour);
        }
        else
        {
          throw new Exception("Multiple swatches using the same name detected. Please rename");
        }
      }
      else
      {
        throw new Exception("Whacko! Why did you input a non-swatch into the Colors? " + source.Type.ToString());
      }

    }

    msg.AppendFormat("Set up the dictionaries with {0} colors\n", colorDict.Count);
    foreach(var pairs in colorDict)
    {
      msg.AppendFormat("{0} -> {1}\n", ("\"" + pairs.Key + "\"").PadRight(5 + colorDict.Keys.Select(k => k.Length).Max()), pairs.Value);
    }
  }

  public void SetEventHandlers()
  {

    // Always remove events first to avoid duplicates
    GrasshopperDocument.ObjectsAdded -= OnObjectsAdded;
    GrasshopperDocument.ObjectsDeleted -= OnObjectsRemoved;
    GrasshopperDocument.ObjectsDeleted -= OnDeleteThisComponent;

    // Attach events
    GrasshopperDocument.ObjectsAdded += OnObjectsAdded;
    GrasshopperDocument.ObjectsDeleted += OnObjectsRemoved;
    GrasshopperDocument.ObjectsDeleted += OnDeleteThisComponent;


    foreach(Grasshopper.Kernel.Special.GH_Group grp in GrasshopperDocument.Objects.OfType<Grasshopper.Kernel.Special.GH_Group>())
    {
      grp.ObjectChanged -= ColorGroup;
      grp.ObjectChanged += ColorGroup;

      //ColorGroup(grp, null); // Make sure to run it once
    }
    msg.AppendFormat("Added the eventhandlers on {0} existing groups and on future created groups\n", GrasshopperDocument.Objects.OfType<Grasshopper.Kernel.Special.GH_Group>().Count());
  }

  public void OnObjectsAdded(object sender, GH_DocObjectEventArgs e)
  {
    bool any = false;
    foreach (Grasshopper.Kernel.Special.GH_Group grp in e.Objects.OfType<Grasshopper.Kernel.Special.GH_Group>())
    {
      grp.ObjectChanged -= ColorGroup;
      grp.ObjectChanged += ColorGroup;
      any = true;
    }

    DebugWrite(any ? "Group Objects Added: Attaching Events to ObjectChanged" : "Objects Added - but no groups");
  }

  //Same but reversed
  public void OnObjectsRemoved(object sender, GH_DocObjectEventArgs e)
  {
    bool any = false;
    foreach (Grasshopper.Kernel.Special.GH_Group grp in e.Objects.OfType<Grasshopper.Kernel.Special.GH_Group>())
    {
      grp.ObjectChanged -= ColorGroup;
      any = true;
    }

    DebugWrite(any ? "Group Objects Removed, removing event" : "Objects Removed - although not a group");

  }



  public void RemoveEventHandlers()
  {
    GrasshopperDocument.ObjectsAdded -= OnObjectsAdded;
    GrasshopperDocument.ObjectsDeleted -= OnObjectsRemoved;


    foreach(Grasshopper.Kernel.Special.GH_Group grp in GrasshopperDocument.Objects.OfType<Grasshopper.Kernel.Special.GH_Group>())
    {
      grp.ObjectChanged -= ColorGroup;

    }
    msg.AppendFormat("Removed event handlers on document and on {0} groups\n", GrasshopperDocument.Objects.OfType<Grasshopper.Kernel.Special.GH_Group>().Count());

  }

  public void ColorGroup(object sender, EventArgs e)
  {
    if (!IdExists(id))
    {
      DebugWrite("Component not relevant. Disabling old id + " + id.ToString());
      RemoveEventHandlers();
      return;
    }

    Grasshopper.Kernel.Special.GH_Group grp = sender as Grasshopper.Kernel.Special.GH_Group;
    if (grp == null) return; //not type GH_Group
    //if (!grp.NickName.EndsWith("_")) return;

    string[] nameParts = grp.NickName.Split('_');
    if (nameParts.Length <= 1)
      return;
    string prefix = grp.NickName.Split('_')[0].Trim() + '_';

    string prefixes = String.Join(", ", colorDict.Keys.Select(k => "\"" + k + "\""));

    msg.Append("prefix " + prefix + "\n");
    if (colorDict.ContainsKey(prefix))
    {
      //if (grp.NickName.EndsWith("_"))
      grp.Colour = colorDict[prefix];
      if (_rename)
      {
        grp.NickName = grp.NickName.Replace(prefix, "");
      }

      DebugWrite("Colored " + grp.NickName);

    }
    else
    {
      DebugWrite("Group changed but not relevant: prefix " + prefix + " is not among " + prefixes);
    }

  }
  public void DebugWrite(string msg)
  {
    if (_debug)
    {
      Rhino.RhinoApp.WriteLine(String.Format("[ColGrps {0}]: {1}", id, msg));
    }
  }

  public void OnDeleteThisComponent(object sender, GH_DocObjectEventArgs e)
  {

    if (e.Objects.OfType<Grasshopper.Kernel.GH_Component>().Where(o => o.NickName == this.Component.NickName).Any())
    {
      DebugWrite("Removed template component. Removing all the eventhandlers");
      RemoveEventHandlers();
    }

  }
# ---------- end colorgroups ----------

fixparams = CSharpScript(FixOnce=Button(), Enable=toggle, Debug=Toggle(False))  # -> out; inputs FixOnce: Boolean, Enable: Boolean, Debug: Boolean; disabled
# ---------- fixparams: C# usings ----------
using System.Text;
using System.Linq;
using Grasshopper.Kernel.Special;
# ---------- fixparams: C# ----------
    _debug = Debug;
    _enable = Enable;
    msg.Clear();
    this.Component.Message = "id: " + id.ToString();




    if (Enable)
    {
      SetEventHandlers();
    }
    else
    {
      RemoveEventHandlers();
    }


    if (FixOnce)
    {
      FixAll();
    }

    Print(msg.ToString());

    // Component setup
    Component.Description = "Set up event handlers to change params to show nickname and not icon"
      + "\n\n"
      + "MIT License. Copyright Mathias Sønderskov Schaltz 2022";
    Component.Params.Input[0].Description = "Run me once on the document";
    Component.Params.Input[1].Description = "Toggle to enable event listener";
    Component.Params.Input[Component.Params.Input.Count - 1].Description = "Set debug to true to get all the events printed in the rhino log";
# ---------- fixparams: C# additional code ----------
  public static Random rnd = new Random();
  public int id = rnd.Next(0, 1000);
  StringBuilder msg = new StringBuilder();
  bool _debug = false;
  bool _enable = false;

  public Dictionary<IGH_ActiveObject, HashSet<GH_Group>> groupsPerObject = new Dictionary<IGH_ActiveObject, HashSet<GH_Group>>();


  public void OnObjectsAdded(object sender, GH_DocObjectEventArgs e)
  {
    if (!IdExists(id))
    {
      DebugWrite("[FixParam] Component not relevant. Disabling old id " + id.ToString());
      RemoveEventHandlers();
      return;
    }


    if(_enable)
    {
      foreach(IGH_Param par in e.Objects.OfType<IGH_Param>())
      {
        FixInputs(par);
      }
    }


  }

  public void FixAll()
  {
    //DebugWrite("Fixing all?");
    foreach(IGH_Param par in GrasshopperDocument.Objects.OfType<IGH_Param>())
    {

      FixInputs(par);
    }
  }




  public void FixInputs(IGH_ActiveObject obj)
  {



    IGH_Param par = obj as IGH_Param;
    if (par != null)
    {

      par.IconDisplayMode = GH_IconDisplayMode.name;


    }

  }


  public void SetEventHandlers()
  {

    GrasshopperDocument.ObjectsAdded -= OnObjectsAdded;
    GrasshopperDocument.ObjectsAdded += OnObjectsAdded;
    GrasshopperDocument.ObjectsDeleted -= OnDeleteThisComponent;
    GrasshopperDocument.ObjectsDeleted += OnDeleteThisComponent;
    msg.AppendFormat("Added the eventhandlers to OnObjectsAdded\n", GrasshopperDocument.Objects.OfType<Grasshopper.Kernel.Special.GH_Group>().Count());
  }

  public void RemoveEventHandlers()
  {
    GrasshopperDocument.ObjectsAdded -= OnObjectsAdded;
    GrasshopperDocument.ObjectsDeleted -= OnDeleteThisComponent;

    msg.AppendFormat("Removed wire event handlers on document\n", GrasshopperDocument.Objects.OfType<Grasshopper.Kernel.Special.GH_Group>().Count());

  }

  public void OnDeleteThisComponent(object sender, GH_DocObjectEventArgs e)
  {

    if (e.Objects.OfType<Grasshopper.Kernel.GH_Component>().Where(o => o.NickName == this.Component.NickName).Any())
    {
      DebugWrite("Removed template component. Removing all the eventhandlers");
      RemoveEventHandlers();
    }

  }

  public bool IdExists(int id)
  {
    IList<IGH_DocumentObject> objs = Grasshopper.Instances.ActiveCanvas.Document.Objects;
    return objs
      .OfType<IGH_Component>()
      .Where(ob => ob.NickName == this.Component.NickName)
      .Where(ob => ob.GetType().ToString() == "ScriptComponents.Component_CSNET_Script")
      .Where(ob => ob.Message == "id: " + id.ToString()).Any();

  }

  public void DebugWrite(string msg)
  {
    if (_debug)
    {
      Rhino.RhinoApp.WriteLine(String.Format("[FixParams {0}]: {1}", id, msg));
    }
  }
# ---------- end fixparams ----------

fixwires = CSharpScript(FixOnce=Button(), Enable=toggle, Debug=Toggle(False))  # -> out; inputs FixOnce: Boolean, Enable: Boolean, Debug: Boolean; disabled
# ---------- fixwires: C# ----------
    _debug = Debug;
    _enable = Enable;
    msg.Clear();
    this.Component.Message = "id: " + id.ToString();


    SetDictionary();

    if (Enable)
    {
      SetEventHandlers();
    }
    else
    {
      RemoveEventHandlers();
    }


    if (FixOnce)
    {
      FixAll();
    }

    Print(msg.ToString());

    // Component setup
    Component.Description = "Set up event handlers to change all wire types across groups to faint"
      + "\n\n"
      + "MIT License. Copyright Mathias Sønderskov Schaltz 2022";
    Component.Params.Input[0].Description = "Run me once on the document";
    Component.Params.Input[1].Description = "Toggle to enable event listener";
    Component.Params.Input[Component.Params.Input.Count - 1].Description = "Set debug to true to get all the events printed in the rhino log";
# ---------- fixwires: C# additional code ----------
  public static Random rnd = new Random();
  public int id = rnd.Next(0, 1000);
  StringBuilder msg = new StringBuilder();
  bool _debug = false;
  bool _enable = false;

  public Dictionary<IGH_ActiveObject, HashSet<GH_Group>> groupsPerObject = new Dictionary<IGH_ActiveObject, HashSet<GH_Group>>();


  public void OnSolutionExpired(object sender, GH_DocUndoEventArgs e)
  {
    if(_enable)
      FixAll();
  }

  public void FixAll()
  {
    //DebugWrite("Fixing all?");
    foreach(IGH_ActiveObject key in groupsPerObject.Keys.Where(k => groupsPerObject[k].Count() > 0))
    {

      FixInputs(key);
    }
  }



  public bool HasGroup(IGH_ActiveObject obj)
  {
    return groupsPerObject[obj].Count > 0;
  }


  public void FixInputs(IGH_ActiveObject obj)
  {

    if (!IdExists(id))
    {
      DebugWrite("Component not relevant. Disabling old id " + id.ToString());
      RemoveEventHandlers();
      return;
    }

    //List<List<IGH_ActiveObject>> parents = new List<List<IGH_ActiveObject>>();
    IGH_Param par = obj as IGH_Param;
    if (par != null && par.Sources != null)
    {


      IEnumerable<IGH_ActiveObject> p = par.Sources.Select(s => s.Attributes.GetTopLevel.DocObject as IGH_ActiveObject);
      //parents.Add(p);
      if(HasGroup(obj) && p.All(o => !HasGroupsInCommon(o, obj)) && par.WireDisplay == GH_ParamWireDisplay.@default)
      {
        DebugWrite("Fixing " + par.Attributes.GetTopLevel.DocObject.NickName);
        par.WireDisplay = GH_ParamWireDisplay.faint;
      }

    }

    IGH_Component comp = obj as IGH_Component;
    if (comp != null)
    {
      foreach(IGH_Param inp in comp.Params.Input)
      {

        IEnumerable<IGH_ActiveObject> p = inp.Sources.Select(i => i.Attributes.GetTopLevel.DocObject as IGH_ActiveObject);

        if(HasGroup(obj) && p.All(o => !HasGroupsInCommon(o, obj)) && inp.WireDisplay != GH_ParamWireDisplay.faint)
        {
          DebugWrite("Fixing " + inp.Attributes.GetTopLevel.DocObject.NickName);
          inp.WireDisplay = GH_ParamWireDisplay.faint;
        }
      }

    }



  }





  public void SetDictionary()
  {
    IList<IGH_DocumentObject> objects = Grasshopper.Instances.ActiveCanvas.Document.Objects.ToList();
    //Print(String.Join(", ", objects.Select(o => o.NickName)));

    groupsPerObject = objects
      .Where(o => o.GetType() != typeof(GH_Group))
      .OfType<IGH_ActiveObject>()
      .ToDictionary(o => o, o => new HashSet<GH_Group>());

    foreach(GH_Group grp in objects.OfType<GH_Group>())
    {

      foreach(IGH_ActiveObject obj in grp.ObjectsRecursive().OfType<IGH_ActiveObject>())
      {
        groupsPerObject[obj].Add(grp);

      }
    }



  }

  public bool HasGroupsInCommon(IGH_ActiveObject obj1, IGH_ActiveObject obj2)
  {
    HashSet<GH_Group> set1 = groupsPerObject[obj1];
    HashSet<GH_Group> set2 = groupsPerObject[obj2];

    set1.IntersectWith(set2);

    return set1.Any();
  }

  public void SetEventHandlers()
  {

    GrasshopperDocument.UndoStateChanged -= OnSolutionExpired;
    GrasshopperDocument.UndoStateChanged += OnSolutionExpired;
    GrasshopperDocument.ObjectsDeleted -= OnDeleteThisComponent;
    GrasshopperDocument.ObjectsDeleted += OnDeleteThisComponent;
    msg.AppendFormat("Added the eventhandlers to UndoStateChanged\n", GrasshopperDocument.Objects.OfType<Grasshopper.Kernel.Special.GH_Group>().Count());
  }

  public void RemoveEventHandlers()
  {
    GrasshopperDocument.UndoStateChanged -= OnSolutionExpired;
    GrasshopperDocument.ObjectsDeleted -= OnDeleteThisComponent;

    msg.AppendFormat("Removed wire event handlers on document\n", GrasshopperDocument.Objects.OfType<Grasshopper.Kernel.Special.GH_Group>().Count());

  }

  public void OnDeleteThisComponent(object sender, GH_DocObjectEventArgs e)
  {

    if (e.Objects.OfType<Grasshopper.Kernel.GH_Component>().Where(o => o.NickName == this.Component.NickName).Any())
    {
      DebugWrite("Removed template component. Removing all the eventhandlers");
      RemoveEventHandlers();
    }

  }

  public bool IdExists(int id)
  {
    IList<IGH_DocumentObject> objs = Grasshopper.Instances.ActiveCanvas.Document.Objects;
    return objs
      .OfType<IGH_Component>()
      .Where(ob => ob.NickName == this.Component.NickName)
      .Where(ob => ob.GetType().ToString() == "ScriptComponents.Component_CSNET_Script")
      .Where(ob => ob.Message == "id: " + id.ToString()).Any();

  }

  public void DebugWrite(string msg)
  {
    if (_debug)
    {
      Rhino.RhinoApp.WriteLine(String.Format("[FixWire {0}]: {1}", id, msg));
    }
  }
# ---------- end fixwires ----------

bsdf_name = Panel("_GlassLT_70%")
bsdf_name_2 = Panel("_GlassLT_70%")

# ----
# genblinds
blindsname = Panel("blinds_001")
panel_12 = Panel("""mkdir -p <LinuxHome>/BSDF_Files/<projname>_radFiles
genblinds blindmat blind 0.08 2 3 28 20 +r 0.12 | xform -rz -90 -rx -90 -t 0 0 -0.15 > <LinuxHome>/BSDF_Files/<projname>_radFiles/<target>.rad;echo <LinuxHome>/BSDF_Files/<projname>_radFiles/<target>.rad""")
include_the_genblinds_result_in_the_bsdf = ValueList({"no": False, "yes": True}, selected="yes")

# ----
# Settings
# importing from rhino layers
# Examples: (_Name_refl  OR  _Name_transmission%)
# Daylight_Inputs::_Wall_50
# Daylight_Inputs::_WindowSouth_50%
# Daylight_Inputs::_Skylights_40%
# 
# For receivers (_Name_BSDF)
# Daylight_Inputs::_WindowReceiver_BSDF
# Daylight_Inputs::_Roof_BSDF
# Daylight_Inputs::_InternalGlass_BSDF
dpipeline = DynamicGeometryPipeline(
    LayerFilter=panel_9,
    TypeFilter=panel_10,
    NameFilter="*",
    GroupByLayer=False,
    GroupByType=False,
    IncludeHidden=True,
    IncludeLocked=True,
    enableFullPath=True,
    listenToAttributes=True)
dpipeline_2 = DynamicGeometryPipeline(
    LayerFilter="Daylight_Inputs::_Curves",
    TypeFilter=panel_11,
    NameFilter="*",
    GroupByLayer=False,
    GroupByType=False,
    IncludeHidden=True,
    IncludeLocked=True,
    enableFullPath=True,
    listenToAttributes=True)

# ----
# Auto section
pt = Point(Point(53.51909518, 189.2547542, 113.9008082))
plan = Plane(Plane(origin=(49.9615704, 187.2645336, 111.7766989), x=(0.9238795325, -0.3826834324, 0), y=(0.3826834324, 0.9238795325, 0)))
along = Plane(Plane(origin=(51.76482638, 191.2260022, 110.7700015), x=(0.9238798022, -0.3826827813, 0), y=(4.012087945e-07, 9.686056606e-07, 1)))
brep = Brep(<brep referenced from the Rhino model>)
cross = Plane(Plane(origin=(54.95220857, 189.9057479, 110.7700015), x=(-0.3826825854, -0.9238798833, 0), y=(8.430999378e-07, -3.492225232e-07, 1)))
xy = XYPlane(Origin=pt)
Z = UnitZ(Factor="-0.2")
area = Area(Geometry=brep)  # -> Area, Centroid
project = Project(Geometry=plan, Plane=xy)  # -> Geometry, Transform
number_slider = Slider(0, range=-15..0)
move = Move(Geometry=project.Geometry, Motion=Z)  # -> Geometry, Transform
pl_origin = PlaneOrigin(Base=along, Origin=area.Centroid)
pl_origin_2 = PlaneOrigin(Base=cross, Origin=area.Centroid)
dam = DataDam(DataA=dpipeline, BufferDelay=10000000, BufferMode=0)
project_2 = Project(Geometry=cross, Plane=pl_origin_2)  # -> Geometry, Transform
project_3 = Project(Geometry=along, Plane=pl_origin)  # -> Geometry, Transform
dom = ConstructDomain(DomainStart=number_slider, DomainEnd=Slider(7, range=0..15))
dom_2 = ConstructDomain(DomainStart=number_slider, DomainEnd=Slider(7, range=0..15))
dom_3 = ConstructDomain(DomainStart=Slider(-1.49, range=-15..0), DomainEnd=Slider(5, range=0..15))
dom_4 = ConstructDomain(DomainStart=Slider(-0.106, range=-15..0), DomainEnd=Slider(3.55, range=0..15))
dom_5 = ConstructDomain(DomainStart=Slider(-0.6, range=-15..0), DomainEnd=Slider(4.382, range=0..15))
dom_6 = ConstructDomain(DomainStart=Slider(-0.711, range=-1..1), DomainEnd=Slider(4.3, range=2..5))
meshit2 = MeshIt2(mesh_brep=dam)
rectangle = Rectangle(Plane=project_3.Geometry, XSize=dom_4, YSize=dom_2, Radius=0)  # -> Rectangle, Length
rectangle_2 = Rectangle(Plane=project_2.Geometry, XSize=dom_3, YSize=dom, Radius=0)  # -> Rectangle, Length
rectangle_3 = Rectangle(Plane=project.Geometry, XSize=dom_6, YSize=dom_5, Radius=0)  # -> Rectangle, Length
sec = MeshPlane(Mesh=meshit2, Plane=project_2.Geometry)
sec_2 = MeshPlane(Mesh=meshit2, Plane=project_3.Geometry)
sec_3 = MeshPlane(Mesh=meshit2, Plane=move.Geometry)
sec_4 = MeshPlane(Mesh=meshit2, Plane=project.Geometry)
trim = TrimWithRegion(Curve=sec, Region=rectangle_2.Rectangle)  # -> Inside, Outside
trim_2 = TrimWithRegion(Curve=sec_3, Region=rectangle_3.Rectangle)  # -> Inside, Outside
trim_3 = TrimWithRegion(Curve=sec_4, Region=rectangle_3.Rectangle)  # -> Inside, Outside
trim_4 = TrimWithRegion(Curve=sec_2, Region=rectangle.Rectangle)  # -> Inside, Outside
crv = Curve(trim.Inside)
crv_2 = Curve(trim_3.Inside)
crv_3 = Curve(trim_2.Inside)
crv_4 = Curve(trim_4.Inside)
pln = Plane(Plane(origin=(-36.43903842, 259.3831763, 111.7766989), x=(0.9238795325, -0.3826834324, 0), y=(0.3826834324, 0.9238795325, 0)))
pln_2 = Plane(Plane(origin=(-20.82258062, 252.7695813, 111.7766989), x=(0.9238795325, -0.3826834324, 0), y=(0.3826834324, 0.9238795325, 0)))
pln_3 = Plane(Plane(origin=(-26.90511074, 255.2890478, 111.7766989), x=(0.9238795325, -0.3826834324, 0), y=(0.3826834324, 0.9238795325, 0)))
orient = Orient(Geometry=brep, Source=project.Geometry, Target=pln)  # -> Geometry, Transform
panel_13 = Panel("""0.2
0.2""")
orient_2 = Orient(Geometry=rectangle_2.Rectangle, Source=project_2.Geometry, Target=pln_3)  # -> Geometry, Transform
orient_3 = Orient(Geometry=rectangle_3.Rectangle, Source=project.Geometry, Target=pln)  # -> Geometry, Transform
orient_4 = Orient(Geometry=rectangle.Rectangle, Source=project_3.Geometry, Target=pln_2)  # -> Geometry, Transform
orient_5 = Orient(Geometry=crv_3, Source=move.Geometry, Target=pln)  # -> Geometry, Transform
orient_6 = Orient(Geometry=crv_2, Source=project.Geometry, Target=pln)  # -> Geometry, Transform
edges = BrepEdges(Brep=orient.Geometry)  # -> Naked, Interior, NonManifold
orient_7 = Orient(Geometry=crv_4, Source=project_3.Geometry, Target=pln_2)  # -> Geometry, Transform
orient_8 = Orient(Geometry=crv, Source=project_2.Geometry, Target=pln_3)  # -> Geometry, Transform

# ----
# Template methods
# By Mathias Sønderskov Schaltz 2022
# Check for updates here https://github.com/Sonderwoods/GrasshopperScribbles
panel_14 = Panel(fixwires)
panel_15 = Panel(fixparams)
panel_16 = Panel(colorgroups)

# ---- group: update me
dam_2 = DataDam(DataA=dpipeline, DataB=dpipeline_2, BufferDelay=10000000, BufferMode=0)  # -> DataA, DataB

# ----
executessh = ExecuteSSH(Run=False, addPrefix=True, fireLogs=False, lastRunTime=0, suppressWarnings=False)  # -> Stdout, Stderr_, Ran
logviewer = LogViewer(Number=10)  # -> CurrentTasks, Logs
panel_17 = Panel(logviewer.Logs)
# Log of latest(10) SSH Commands
panel_18 = Panel(logviewer.CurrentTasks)
executessh_2 = ExecuteSSH(Run=False, addPrefix=True, fireLogs=False, lastRunTime=0, suppressWarnings=False)  # -> Stdout, Stderr_, Ran
overrides = ApplyOverrides()  # -> Output, DynamicOutput
# Vertex order (and normal)
# 
# source : https://www.radiance-online.org/learning/tutorials/Tutorial-ThreePhaseMethod.pdf
# FILE NAMES: *.vmx - view matrix (data)
# *.hdr - view matrix (renderings)
# *.dmx - daylight matrix
# *.skv - sky vector
# *.smx – sky matrix
# *.xml - transmission matrix (the file is xml format)
# 
# *.rad - radiance scene data
# *.oct - octree file
# *.vf - view file
# *.dat - data
# 
# source : https://www.radiance-online.org/learning/tutorials/Tutorial-ThreePhaseMethod.pdf
image = ImageSampler(Filter="Colour", Interpolate=True, Umax=1, Umin=0, Vmax=1, Vmin=0, Wrap=1)  # disabled

# ----
# importing from rhino layers
geo = Geometry(dam_2.DataA)
geo_2 = Geometry(dam_2.DataB)
objatts = ObjectAttributes(ObjectOrAttributes=geo)  # -> Name, LayerName, LayerFullPath, Color, MaterialName, LinetypeName, GroupIndices, PlotWeight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
objatts_2 = ObjectAttributes(ObjectOrAttributes=geo_2)  # -> Name, LayerName, LayerFullPath, Color, MaterialName, LinetypeName, GroupIndices, PlotWeight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
cset = CreateSet(List=objatts.LayerName)  # -> Set, Map
cset_2 = CreateSet(List=objatts_2.LayerName)  # -> Set, Map
assign_paths = AssignPaths(InputData=flatten(geo), PathsToAssign=flatten(cset.Map))
assign_paths_2 = AssignPaths(InputData=flatten(geo_2), PathsToAssign=flatten(cset_2.Map))
python = GhPythonScript(layer_name=graft(cset.Set))  # -> is_opaque, is_transparent, is_grid, is_HB_Room, is_HB_Window, is_receiver
# ---------- python: Python ----------
__author__ = "mm1013"
__version__ = "2022.01.16"

import rhinoscriptsyntax as rs

is_grid = layer_name == "Grids" or layer_name == "_Curves"

if layer_name.startswith("HB_"):
    is_opaque = is_transparent = is_grid = False
    
    is_HB_Window = layer_name.endswith("%")
    is_HB_Room = layer_name == "HB_Rooms"
    
    
else:
    if is_grid:
        is_opaque = False
        is_transparent = False
        is_receiver = False
    else:
        is_receiver = layer_name.endswith("_BSDF")
        is_transparent = layer_name.endswith("%")
        if is_transparent:
            transmittance = layer_name.split("_")[-1].replace("%","")
        is_opaque = not is_transparent and not is_receiver
# ---------- end python ----------
python_2 = GhPythonScript(layer_name=graft(cset_2.Set))  # -> is_opaque, is_transparent, is_grid, is_HB_Room, is_HB_Window
# ---------- python_2: Python ----------
__author__ = "mm1013"
__version__ = "2022.01.16"

import rhinoscriptsyntax as rs

is_grid = layer_name == "Grids" or layer_name == "_Curves"

if layer_name.startswith("HB_"):
    is_opaque = is_transparent = is_grid = False
    
    is_HB_Window = layer_name.endswith("%")
    is_HB_Room = layer_name == "HB_Rooms"
    
    
else:
    if is_grid:
        is_opaque = False
        is_transparent = False
    else:
        is_transparent = layer_name.endswith("%")
        if is_transparent:
            transmittance = layer_name.split("_")[-1].replace("%","")
        is_opaque = not is_transparent
# ---------- end python_2 ----------
layer_name = Text(cset_2.Set)
layer_name_2 = Text(cset.Set)
geo_3 = Geometry(assign_paths_2)
geo_4 = Geometry(assign_paths)

largest_brep = LargestBREP(window_breps=[<geometry referenced from the Rhino model> x224])
overrides_2 = ApplyOverrides()  # -> Output, DynamicOutput

# ----
# Glass geometries
cull = CullPattern(List=graft(layer_name_2), CullPattern=graft(python.is_transparent))  # -> simplify(List)
cull_2 = CullPattern(List=geo_4, CullPattern=python.is_transparent)
python_3 = GhPythonScript(layer_name=cull)  # -> out, transmittance, name
# ---------- python_3: Python ----------
__author__ = "mm1013"
__version__ = "2022.01.16"

import rhinoscriptsyntax as rs

try:
    transmittance = layer_name.split("_")[-1].replace("%","")
    name = layer_name.replace("%","")
except:
    transmittance = None
    name = None
# ---------- end python_3 ----------
clean = CleanTree(
    RemoveNulls=True,
    RemoveInvalid=True,
    RemoveEmpty=True,
    Tree=simplify(cull_2),
    SynchronousTree1=simplify(python_3.name),
    SynchronousTree2=simplify(python_3.transmittance))  # -> Tree, SynchronousTree1, SynchronousTree2
meshit2_2 = MeshIt2(mesh_brep=graft(clean.Tree))
name = Text(clean.SynchronousTree1)
unflatten = UnflattenTree(Tree=meshit2_2, Guide=clean.Tree)
panel_19 = Panel(name)
geo_5 = Geometry(unflatten)
meshit2_3 = MeshIt2(mesh_brep=geo_5)
transmittance = Number(expr("x/100", clean.SynchronousTree2))
concat = Concatenate(FragmentA=name, FragmentB="_mat")
mesh = Mesh(meshit2_3)

# ----
# opaque geometries
cull_3 = CullPattern(List=graft(layer_name_2), CullPattern=graft(python.is_opaque))  # -> simplify(List)
cull_4 = CullPattern(List=geo_4, CullPattern=graft(python.is_opaque))  # -> simplify(List)
python_4 = GhPythonScript(layer_name=cull_3)  # -> out, reflectance
# ---------- python_4: Python ----------
__author__ = "mm1013"
__version__ = "2022.01.16"

import rhinoscriptsyntax as rs
try:
    reflectance = layer_name.split("_")[-1]
    
except:
    reflectance = None
# ---------- end python_4 ----------
clean_2 = CleanTree(
    RemoveNulls=True,
    RemoveInvalid=True,
    RemoveEmpty=True,
    Tree=cull_3,
    SynchronousTree1=cull_4,
    SynchronousTree2=python_4.reflectance)  # -> Tree, SynchronousTree1, SynchronousTree2
geo_6 = Geometry(clean_2.SynchronousTree1)
refl = Number(clean_2.SynchronousTree2)
name_2 = Text(clean_2.Tree)
meshit2_4 = MeshIt2(mesh_brep=geo_6)
concat_2 = Concatenate(FragmentA=name_2, FragmentB="_mat")

# ----
# Grid
cull_5 = CullPattern(List=graft(layer_name), CullPattern=graft(python_2.is_grid))  # -> simplify(List)
cull_6 = CullPattern(List=graft(layer_name_2), CullPattern=graft(python.is_grid))  # -> simplify(List)
cull_7 = CullPattern(List=geo_3, CullPattern=python_2.is_grid)  # -> simplify(List)
cull_8 = CullPattern(List=geo_4, CullPattern=python.is_grid)
clean_3 = CleanTree(RemoveNulls=True, RemoveInvalid=True, RemoveEmpty=True, Tree=cull_6, SynchronousTree1=simplify(cull_8))  # -> Tree, flatten(SynchronousTree1)
clean_4 = CleanTree(RemoveNulls=True, RemoveInvalid=True, RemoveEmpty=True, Tree=cull_5, SynchronousTree1=simplify(cull_7))  # -> Tree, SynchronousTree1
boundary = BoundarySurfaces(Edges=clean_4.SynchronousTree1)  # -> flatten(Surfaces)
geo_7 = Geometry(flatten([clean_3.SynchronousTree1, boundary]))
geo_8 = Geometry(graft(geo_7))

overrides_3 = ApplyOverrides()  # -> Output, DynamicOutput
overrides_4 = ApplyOverrides()  # -> Output, DynamicOutput

# ---- group: Outdated
fixed = ApplyOverrides(Input_="echo \"<projname>\"")  # -> Output, Pairs

# ----
overrides_5 = ApplyOverrides()  # -> Output, DynamicOutput
overrides_6 = ApplyOverrides()  # -> Output, DynamicOutput

# ----
# create working directory
panel_20 = Panel("""mkdir -p <proj>
mkdir -p <LinuxHome>/weatherData
mkdir -p <proj>/obj
echo <proj>""")
overrides_7 = ApplyOverrides(Input_=panel_20)  # -> Output, Pairs

parserhinofile = ParseRhinoFile(LayerPrefix="Daylight_Inputs::_", Grids="Grids", Run=False)  # -> GlassGeometries, GlassModifiers, port, OpaqueGeometries, OpaqueModifiers, port_2, CustomGeometries, ModifierNames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
overrides_8 = ApplyOverrides()  # -> Output, DynamicOutput
convertpaths = ConvertPaths()  # -> Linux, Windows

# ----
# room numbers
lng = ListLength(List=flatten(geo_8))
series = Series(Start=0, Step=1, Count=lng)  # -> graft(Series)
roomnumber = Text(simplify(series))
room_numbers = Panel(roomnumber)

gridsettings = GridSettings(From=0, To="10", ASteps=-1, BStepSize="1")
overrides_9 = ApplyOverrides()  # -> Output, DynamicOutput
overrides_10 = ApplyOverrides()  # -> Output, DynamicOutput
gridviewer = GridViewer(_MinColor=RGB(169, 169, 169), _MaxColor=RGB(211, 211, 211), _SectionType=gridsettings)  # -> ColoredMesh, LayeredMesh, Curves, Planes, TempMeshes, flatten(Colors), flatten(Values)

cull_9 = CullPattern(List=graft(layer_name_2), CullPattern=graft(python.is_receiver))  # -> simplify(List)
cull_10 = CullPattern(List=graft(layer_name_2), CullPattern=graft(python.is_receiver))  # -> simplify(List)
cull_11 = CullPattern(List=geo_4, CullPattern=graft(python.is_receiver))  # -> simplify(List)
clean_5 = CleanTree(
    RemoveNulls=True,
    RemoveInvalid=True,
    RemoveEmpty=True,
    Tree=cull_9,
    SynchronousTree1=cull_11,
    SynchronousTree2=python_4.reflectance,
    SynchronousTree3=cull_10)  # -> Tree, SynchronousTree1, SynchronousTree2, SynchronousTree3
geo_9 = Geometry(clean_5.SynchronousTree1)
layer = Text(clean_5.SynchronousTree3)
name_3 = Text(clean_5.Tree)
long = LongestList(ListD=name_3, ListA=geo_9, ListB=layer, PaddingMode=2)  # -> ListD, ListA, ListB
name_4 = Text(long.ListD)
geo_10 = Geometry(long.ListA)
layer_2 = Text(long.ListB)

# ----
# Grid
# Setting up grid points
geo_11 = Geometry(graft(geo_8))
vertical_offset_2 = Panel(docunits)
grid_size_2 = Panel(docunits_2)
rectangle_4 = Rectangle(Plane=PlaneXY(0, 0, 0), XSize=Domain(-1, 1), YSize=Domain(-2, 2), Radius=0)  # -> Rectangle, Length
flip = Flip(Surface=geo_11, Guide=rectangle_4.Rectangle)  # -> Surface, Result
grid_size_3 = Number(grid_size_2)
offset = Number(vertical_offset_2)
custom_mesh_settings = SettingsCustom(
    StitchSeams=True,
    SimplePlanes=False,
    Refine=True,
    MinCount=16,
    MaxCount=400,
    AspectRatio=20,
    MaxDistance=0,
    MaxAngle=20,
    MinEdge=grid_size_3,
    MaxEdge=grid_size_3)
normals = Normals(geo=flip.Surface, amplitude=offset)  # -> center_2, norm_2, P
mesh_2 = MeshBrep(Brep=flip.Surface, Settings=custom_mesh_settings)
move_2 = Move(Geometry=mesh_2, Motion=normals.norm_2)  # -> Geometry, Transform
facen = FaceNormals(Mesh=move_2.Geometry)  # -> Centers, Normals

mesh2obj = MeshToObj(MapFileName="mapping", TargetFolder="objFiles")  # -> ObjFiles, MapFile, Run
mesh2obj_2 = MeshToObj(MapFileName="mapping", TargetFolder="objFiles")  # -> ObjFiles, MapFile, Run
overrides_11 = ApplyOverrides()  # -> Output, DynamicOutput
overrides_12 = ApplyOverrides()  # -> Output, DynamicOutput
overrides_13 = ApplyOverrides()  # -> Output, DynamicOutput
overrides_14 = ApplyOverrides()  # -> Output, DynamicOutput
grid = GridCreate(
    Geometry=graft(geo_11),
    GridSize_m=Slider(0.3, range=0..0.5),
    VerticalOffset_m=Slider(0.1, range=0..0.5),
    EdgeOffset_m=Slider(0.3, range=0..0.5),
    IsoCurves=True,
    GoLarge=False)  # -> Grids, Mesh, Points, Normals
overrides_15 = ApplyOverrides()  # -> Output, DynamicOutput
executessh_3 = ExecuteSSH(Run=False, addPrefix=True, fireLogs=False, lastRunTime=0, suppressWarnings=False)  # -> Stdout, Stderr_, Ran
vdis = VectorDisplay(Anchor=grid.Points, Vector=grid.Normals)
overrides_16 = ApplyOverrides()  # -> Output, DynamicOutput
overrides_17 = ApplyOverrides()  # -> Output, DynamicOutput
convertpaths_2 = ConvertPaths()  # -> Linux, Windows
convertpaths_3 = ConvertPaths()  # -> Linux, Windows
overrides_18 = ApplyOverrides()  # -> Output, DynamicOutput
mesh2obj_3 = MeshToObj(MapFileName="mapping", TargetFolder="objFiles")  # -> ObjFiles, MapFile, Run

# ----
# 10klx overcast sky (RwR p357)
# # start of sky definition for daylighting studies
# # location name: COPENHAGEN_DNK LAT: 55.63
# !gensky 5 14 14.0 -c -a 55.63 -o -12.67 -m -15.0 | xform -rz 0.0
# skyfunc glow sky_mat
# 0
# 0
# 4
# 1 1 1 0
# sky_mat source sky
# 0
# 0
# 4
# 0 0 1 180
# skyfunc glow ground_glow
# 0
# 0
# 4
# 1 .8 .5 0
# ground_glow source ground
# 0
# 0
# 4
# 0 0 -1 180
# # end of sky definition for daylighting studies
falsestart_2 = LBFalseStartToggle(False)
# NON-MULTIPHASE
# RENDERS (RTPICT)
# 
# NO BSDFS USED
bool = Boolean(falsestart_2)
and_append_the_ground = Panel("""##The 1 will be multiplie with brightfunc
skyfunc glow sky_glow
0
0
4 1 1 1 0

##Set to 1 as it will be multiplied with the gensky result
sky_glow source sky
0
0
4 0 0 1 180

##Set to 1 as it will be multiplied with the gensky result
skyfunc glow ground_glow
0
0
4 1 1 1 0

##The ground pane
ground_glow source ground
0
0
4 0 0 -1 180""")
execute_ssh_async = ExecuteSSHAsync(
    _SSHCommands_="gensky -ang 45 0 -c -B 55.866",
    Run=bool,
    addPrefix=True,
    addSuffix=True,
    description="gensky -ang 45 0 -c -B 55.866",
    fireLogs=False,
    stdouts="""# gensky -ang 45 0 -c -B 55.866
# Ground ambient level: 17.8

void brightfunc skyfunc
2 skybr skybright.cal
0
3 2 2.29e+01 3.56e+00""",
    suppressWarnings=False)  # -> Stdout, Stderr_, port, port_2, Ran
concat_3 = Concatenate(FragmentC="##Will control the gradient of the sky", FragmentA=execute_ssh_async.Stdout, FragmentB=and_append_the_ground)
panel_21 = Panel(concat_3)
panel_22 = Panel("""mkdir -p <proj>/skies/
echo "<sky>" > <proj>/skies/<target>
echo "<proj>/skies/<target>"
""")
overrides_19 = ApplyOverrides(Input=panel_22, Sky=graft(panel_21), Target=graft("overcast_sky.rad"))  # -> Output, Pairs
execute_ssh_async_2 = ExecuteSSHAsync(
    _SSHCommands_=overrides_19.Output,
    Run=execute_ssh_async.Ran,
    addPrefix=True,
    addSuffix=True,
    description="""mkdir -p ~/simulation/Boston_Skylights/skies/;echo "##Will control the gradient of the sky
# gensky -ang 45 0 -c -B 55.866
# Ground ambient level: 17.8

void brightfunc skyfunc
2 skybr skybright.cal
0
3 2 2.29e+01 3.56e+00

##The 1 will be multiplie with brightfunc
skyfunc glow sky_glow
0
0
4 1 1 1 0

##Set to 1 as it will be multiplied with the gensky result
sky_glow source sky
0
0
4 0 0 1 180

##Set to 1 as it will be multiplied with the gensky result
skyfunc glow ground_glow
0
0
4 1 1 1 0

##The ground pane
ground_glow source ground
0
0
4 0 0 -1 180" > ~/simulation/Boston_Skylights/skies/overcast_sky.rad;echo "~/simulation/Boston_Skylights/skies/overcast_sky.rad"
""",
    fireLogs=False,
    stdouts="~/simulation/Boston_Skylights/skies/overcast_sky.rad",
    suppressWarnings=False)  # -> Stdout, Stderr_, port, port_2, Ran
panel_23 = Panel(execute_ssh_async_2.Stdout)

prepare = LBFalseStartToggle(False)
run = LBFalseStartToggle(False)
overrides_20 = ApplyOverrides()  # -> Output, DynamicOutput

# ----
# sun primitive
panel_24 = Panel("echo \"void light solar 0 0 3 1e6 1e6 1e6\" > <target>;echo \"<target>\"")
overrides_21 = ApplyOverrides(Input_=panel_24, Target=graft("<LinuxHome>/suns.rad"))  # -> Output, Pairs
executessh_wip = ExecuteSSHWIP(
    _SSHCommands_=overrides_21.Output,
    Run=prepare,
    addPrefix=True,
    fireLogs=True,
    lastRunTime=8,
    name="make a sun",
    suppressWarnings=False,
    results="~/simulation/suns.rad",
    commands="echo \"void light solar 0 0 3 1e6 1e6 1e6\" > ~/simulation/suns.rad;echo \"~/simulation/suns.rad\"")  # -> Stdout, Stderr_, Ran

executessh_4 = ExecuteSSH(Run=False, addPrefix=True, fireLogs=False, lastRunTime=0, suppressWarnings=False)  # -> Stdout, Stderr_, Ran
overrides_22 = ApplyOverrides()  # -> Output, DynamicOutput
overrides_23 = ApplyOverrides()  # -> Output, DynamicOutput
executessh_5 = ExecuteSSH(Run=False, addPrefix=True, fireLogs=False, lastRunTime=0, suppressWarnings=False)  # -> Stdout, Stderr_, Ran
executessh_6 = ExecuteSSH(Run=False, addPrefix=True, fireLogs=False, lastRunTime=0, suppressWarnings=False)  # -> Stdout, Stderr_, Ran
executessh_7 = ExecuteSSH(Run=False, addPrefix=True, fireLogs=False, lastRunTime=0, suppressWarnings=False)  # -> Stdout, Stderr_, Ran

# ----
# Sun
panel_25 = Panel("""cnt 5165 | rcalc -e MF:6 -f reinsrc.cal -e Rbin=recno -o 'solar source sun 0 0 4 ${Dx} ${Dy} ${Dz} 0.553' >> <target>
echo <target>""")

overrides_24 = ApplyOverrides()  # -> Output, DynamicOutput
overrides_25 = ApplyOverrides()  # -> Output, DynamicOutput

# ---- group: Outdated
overrides_26 = ApplyOverrides(Input_=panel_25, Target=graft(executessh_wip.Stdout))  # -> Output, Pairs

# ----
executessh_8 = ExecuteSSH(Run=False, addPrefix=True, fireLogs=False, lastRunTime=0, suppressWarnings=False)  # -> Stdout, Stderr_, Ran
overrides_27 = ApplyOverrides()  # -> Output, DynamicOutput

# ----
# solar discs and modifiers for 5165 suns (=MF:6)
executessh_wip_2 = ExecuteSSHWIP(
    _SSHCommands_=overrides_26.Output,
    Run=executessh_wip.Ran,
    addPrefix=True,
    description="""cnt 5165 | rcalc -e MF:6 -f reinsrc.cal -e Rbin=recno -o 'solar source sun 0 0 4 ${Dx} ${Dy} ${Dz} 0.553' >> ~/simulation/suns.rad
echo ~/simulation/suns.rad""",
    fireLogs=True,
    lastRunTime=8,
    name="MF6 sun",
    suppressWarnings=False,
    results="/home/mss/simulation/suns.rad",
    commands="""cnt 5165 | rcalc -e MF:6 -f reinsrc.cal -e Rbin=recno -o 'solar source sun 0 0 4 ${Dx} ${Dy} ${Dz} 0.553' >> ~/simulation/suns.rad
echo ~/simulation/suns.rad""")  # -> Stdout, Stderr_, Ran

overrides_28 = ApplyOverrides()  # -> Output, DynamicOutput

button = Button()

panel_26 = Panel("""Cam1
Cam2
Cam3
Cam4
Cam5
Cam6
Cam7""")
view = CreateView(Viewport=panel_26, Update=button)  # -> ViewfileContent, ImageRatio
panel_27 = Panel(view.ViewfileContent)

overrides_29 = ApplyOverrides()  # -> Output, DynamicOutput
overrides_30 = ApplyOverrides()  # -> Output, DynamicOutput
executessh_9 = ExecuteSSH(Run=False, addPrefix=True, fireLogs=False, lastRunTime=0, suppressWarnings=False)  # -> Stdout, Stderr_, Ran
executessh_10 = ExecuteSSH(Run=False, addPrefix=True, fireLogs=False, lastRunTime=0, suppressWarnings=False)  # -> Stdout, Stderr_, Ran
executessh_11 = ExecuteSSH(Run=False, addPrefix=True, fireLogs=False, lastRunTime=0, suppressWarnings=False)  # -> Stdout, Stderr_, Ran
executessh_12 = ExecuteSSH(Run=False, addPrefix=True, fireLogs=False, lastRunTime=0, suppressWarnings=False)  # -> Stdout, Stderr_, Ran
overrides_31 = ApplyOverrides()  # -> Output, DynamicOutput
overrides_32 = ApplyOverrides()  # -> Output, DynamicOutput
overrides_33 = ApplyOverrides()  # -> Output, DynamicOutput
overrides_34 = ApplyOverrides()  # -> Output, DynamicOutput

resolution = ValueList({"750x330": 750, "1500x750": 1500, "3000x1500": 3000, "5000x2500": 5000, "7000x3500": 7000, "8000x4000": 8000, "16000x8000": 16000, "20000x12000": 20000}, selected="5000x2500")
x = Number(resolution)

resolution_2 = ValueList({"750x330": 750, "1500x750": 1500, "3000x1500": 3000, "4000x1500": 4000, "5000x2500": 5000, "6000x3000": 6000, "7000x3500": 7000, "8000x4000": 8000, "16000x8000": 16000, "20000x12000": 20000}, selected="6000x3000")
x_2 = Number(resolution_2)

# ---- group: Outdated
overrides_35 = ApplyOverrides()  # -> Output, Pairs

# ----
overrides_36 = ApplyOverrides()  # -> Output, DynamicOutput

panel_28 = Panel("head <ill> -n 13;echo \" \";echo \"Number of lines\";wc -l <ill>")
execute_ssh_async_3 = ExecuteSSHAsync(
    _SSHCommands_=<missing>,
    addPrefix=True,
    addSuffix=True,
    description="head /home/mss/simulation/test_project2/results/annualR_DCD.ill -n 13;echo \" \";echo \"Number of lines\";wc -l /home/mss/simulation/test_project2/results/annualR_DCD.ill",
    fireLogs=True,
    name="Run dctimestep",
    staticDescription="used for direct sun check",
    stdouts="""#?RADIANCE
rmtxop -fa -t -c 47.4 119.9 11.6 -
dctimestep /home/mss/simulation/test_project2/mtxs/dcd_illum.mtx /home/mss/simulation/weatherData/DNK_DRY_OFFICIAL_2001-2010_epw-fil_d_m1.smx
CAPDATE= 2022:08:18 07:19:57
GMT= 2022:08:18 05:19:57
Applied 1x3 matrix transform
Transposed rows and columns
NROWS=8760
NCOLS=274
NCOMP=1
FORMAT=ascii

 0.000000000000000e+00	 0.000000000000000e+00	 0.000000000000000e+00	 0.000000000000000e+00	 0.000000000000000e+00	 0.000000000000000e+00	 0.000000000000000e+00	 0.000000000000000e+00	 0.000000000000000e+00	 0.000000000000000e+00	 0.000000000000000e+00	 0.000000000000000e+00	 0.000000000000000e+00	 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
 
Number of lines
8772 /home/mss/simulation/test_project2/results/annualR_DCD.ill""",
    suppressWarnings=True)  # -> Stdout, Stderr, Log, port, Ran
panel_29 = Panel(execute_ssh_async_3.Stderr)

overrides_37 = ApplyOverrides()  # -> Output, DynamicOutput
overrides_38 = ApplyOverrides()  # -> Output, DynamicOutput

bsdf = BSDF(bsdf_name="LT70", bsdf_file_path_linux="~/simulation/boston2/BSDF/blinds_001__GlassTak_70_mat.xml")

bsdf_2 = BSDF(bsdf_name="MicroShade_SingleGlass", bsdf_file_path_linux="~/simulation/boston2/8mm MS-F 6014 Rot 90.xml")

overrides_39 = ApplyOverrides()  # -> Output, DynamicOutput

# ---- group: Outdated
overrides_40 = ApplyOverrides(Vf=graft("<vf>"))  # -> Output, Pairs

# ----
overrides_41 = ApplyOverrides()  # -> Output, DynamicOutput
overrides_42 = ApplyOverrides()  # -> Output, DynamicOutput
overrides_43 = ApplyOverrides()  # -> Output, DynamicOutput
panel_30 = Panel("pcond -h <hdr> <hdr-.>_exposed.hdr;echo <hdr-.>_exposed.hdr")
overrides_44 = ApplyOverrides()  # -> Output, DynamicOutput
panel_31 = Panel("pcompos -a 2 -b 1 1 1 -s 5 <files> > <proj>/images/<time>_all.hdr;echo <proj>/images/<time>_all.hdr")

# ----
# FalseColor
panel_32 = Panel("""pfilt -x /2 -y /2 -r 0.7 <irrad> | falsecolor -s 2000 -l lux -lw 200 -lh 300 > <irrad-.>_fc2.hdr
ra_tiff <irrad-.>_fc2.hdr <irrad-.>_fc2.tif
convert <irrad-.>_fc2.tif <irrad-.>_fc2.png
rm <irrad-.>_fc2.hdr
rm <irrad-.>_fc2.tif
echo <irrad-.>_fc2.png""")

panel_33 = Panel("""#?RADIANCE
A schedule from MantaRay
NCOMP=1
ROWS=<RowCount>
NCOLS=1
FORMAT=ascii
<Rows>""")
rn_to_n = GhPythonScript(x=panel_33)  # -> a
# ---------- rn_to_n: Python ----------
__author__ = "mm1013"
__version__ = "2022.09.11"

import rhinoscriptsyntax as rs

a = x.replace("\r\n","\n")
# ---------- end rn_to_n ----------
panel_34 = Panel("""mogrify -format png -gamma 2.2 -resize 50% <target>
echo <target-.>.png""")
executessh_13 = ExecuteSSH(Run=False, addPrefix=True, fireLogs=False, lastRunTime=0, suppressWarnings=False)  # -> Stdout, Stderr_, Ran
symbols = Symbols(x=rn_to_n)

# ---- group: Outdated
overrides_45 = ApplyOverrides(Input_="echo <file> > schedule_<n>.sch", File=graft(rn_to_n))  # -> Output, Pairs

# ----
panel_35 = Panel(symbols)
overrides_46 = ApplyOverrides()  # -> Output, DynamicOutput
overrides_47 = ApplyOverrides()  # -> Output, DynamicOutput

panel_36 = Panel("""0
0
0
0
0
0
0
0
1
1
1
1
1
1
1
1
1
1
0
0
0
0
0
0""")
int = Integer(panel_36)
dup = DuplicateData(Data=int, Number="365", Order=True)

falsestart_3 = LBFalseStartToggle(False)

panel_37 = Panel("""0
0
0
0
0
0
0
0
1
1
1
1
1
1
1
1
1
1
0
0
0
0
0
0""")
int_2 = Integer(panel_37)
dup_2 = DuplicateData(Data=int_2, Number="365", Order=True)

executessh_14 = ExecuteSSH(Run=False, addPrefix=True, fireLogs=False, lastRunTime=0, suppressWarnings=False)  # -> Stdout, Stderr_, Ran
ma = MassAddition(Input=dup_2)  # -> Result, PartialResults
data_blinds = Data(Tree({0}: [0, 0, 0, 0, 0.001095890411, 0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], {1}: [0, 0, 0, 0, 0, 0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], {2}: [0, 0, 0.001643835616, 0.01452054795, 0.01698630137, 0.02164383562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], {3}: [0.00301369863, 0.002465753425, 0.02328767123, 0.02493150685, 0.05643835616, 0.04520547945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], {4}: [0, 0, 0, 0, 0, 0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]))
data_no_blinds = Data(Tree({0}: [0, 0, 0, 0.001712328767, 0.0147260274, 0.004109589041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], {1}: [0, 0, 0, 0, 0, 0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], {2}: [0, 0, 0.05136986301, 0.06609589041, 0.06746575342, 0.08767123288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], {3}: [0.03253424658, 0.01301369863, 0.1010273973, 0.09212328767, 0.1715753425, 0.1695205479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], {4}: [0, 0, 0, 0, 0, 0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]))
pln_4 = Plane(Plane(origin=(52.07522972, 186.3890272, 115.72), x=(0.9238795325, -0.3826834324, 0), y=(0.3826834324, 0.9238795325, 0)))

# ----
# Setup globals
panel_38 = Panel("""proj
projfolder
projname""")
panel_39 = Panel("""~/simulation/<projname>
/simulation/<projname>
<projname>""")

# ----
# Project name
projname_and_folder = Panel("Boston_Skylights")

# ----
# stupid update script after setting name and all folders
projname = Text(projname_and_folder)
io = Io(i=projname)
executessh_wip_3 = ExecuteSSHWIP(
    _SSHCommands_=fixed.Output,
    Run=io,
    addPrefix=True,
    description="echo \"Boston_Skylights\"",
    fireLogs=False,
    lastRunTime=0,
    suppressWarnings=False,
    commands="echo \"Boston_Skylights\"")  # -> Stdout, Stderr_, Ran
python_5 = GhPythonScript(x=projname, y=executessh_wip_3.Stdout)  # -> out, a
# ---------- python_5: Python ----------
__author__ = "mm1013"
__version__ = "2022.09.12"

import rhinoscriptsyntax as rs

b = x == y
if b:
    print("Project name correctly set to " + x)
else:
    print("The project name is not yet updated.\nClick 'UPDATE' to expire the document")
a = not b
# ---------- end python_5 ----------
python_6 = GhPythonScript(x=projname, y=executessh_wip_3.Stdout)  # -> out, a
# ---------- python_6: Python ----------
__author__ = "mm1013"
__version__ = "2022.09.12"

import rhinoscriptsyntax as rs

b = x == y
if b:
    print("<projname> = " + x)
else:
    print("The project name is not yet updated.")
a = not b
# ---------- end python_6 ----------
and = GateAnd(A=python_5.a, B=executessh_wip_3.Ran)
panel_40 = Panel(python_6.out)
c_script = CSharpScript(run=and, name=projname)  # -> Name; inputs run: Boolean, name: String
# ---------- c_script: C# usings ----------
using System.Linq;
# ---------- c_script: C# ----------
    if(run && !string.IsNullOrEmpty(_name) && name != _name)
    {

      Grasshopper.Instances.ActiveCanvas.Document.ScheduleSolution(5, (i) => Refresh(i));
    }
    _name = name;
    _Name = _name;
# ---------- c_script: C# additional code ----------
  public void Refresh(object i) {

    Grasshopper.Instances.ActiveCanvas.Document.ExpireSolution();
    Guid guid = new Guid("9B21A68A-179E-4BDB-8232-0729E8CF5EA4");
    var objs = Grasshopper.Instances.ActiveCanvas.Document.Objects.Where(o => o.ComponentGuid == guid);
    foreach (GH_ActiveObject obj in objs)
    {
      //Rhino.RhinoApp.WriteLine("Fixed " + obj.NickName);
      //obj.ExpireSolution(true);
    }
    Rhino.RhinoApp.WriteLine("Expiring the document to update the ApplyOverrides to a new Projectname: " + _name);
  }

  string _name = "";
# ---------- end c_script ----------

rep = ReplaceText(Text=panel_39, Find="<projname>", Replace=projname, RecursiveReplace=False)
global_overrides = GlobalOverrides(Keys=panel_38, Values=rep)
panel_41 = Panel(global_overrides)

# ----
# Overview of all running tasks in linux
panel_43 = Panel("ps aux | grep '<AllRadProgs>'")
logviewer_2 = LogViewer(Number=10)  # -> CurrentTasks, Logs
default = DefaultMSS(data=flatten(panel_43), default_value_flattened=flatten(logviewer_2.CurrentTasks))
panel_44 = Panel(logviewer_2.CurrentTasks)
panel_45 = Panel(logviewer_2.Logs)

# ---- group: Outdated
executessh_wip_4 = ExecuteSSHWIP(
    _SSHCommands_=default,
    Run=Toggle(True),
    addPrefix=True,
    description="ps aux | grep '<AllRadProgs>'",
    fireLogs=False,
    lastRunTime=0,
    suppressWarnings=False,
    commands="ps aux | grep '<AllRadProgs>'")  # -> Stdout, Stderr_, Ran

# ----
python_7 = GhPythonScript(x=executessh_wip_4.Stdout)  # -> a
# ---------- python_7: Python ----------
__author__ = "mm1013"
__version__ = "2022.08.30"

import rhinoscriptsyntax as rs

a = [l for l in x.split("\n") if "grep" not in l]
# ---------- end python_7 ----------
panel_46 = Panel(python_7)

# ----
# Calculate the BSDF file
run_2 = LBFalseStartToggle(False)
rad_parameters = Panel("-ab 2 -ad 1024 -lw 1e-3")

# ----
# Construct BSDF file
# (and save in library)
python_8 = GhPythonScript(layer_name=bsdf_name)  # -> out, transmittance, name; same code as python_3
glassmat = GlassMat(Name=python_8.name, Transmittance_0_1=expr("x/100", python_8.transmittance))  # -> RadMaterials, RadMaterialList
bool_2 = Boolean(run_2)

# ----
# modifiers
name_5 = Text(python_8.name)
blinds_material = Panel("void plastic blindmat 0 0 5 .8 .8 .8 0 .01")
panel_47 = Panel("""mkdir -p <LinuxHome>/BSDF_Files/<projname>_radFiles
echo "<modifiers>" > <LinuxHome>/BSDF_Files/<projname>_radFiles/Mods<name>.rad
echo <LinuxHome>/BSDF_Files/<projname>_radFiles/Mods<name>.rad""")
glass_modifier = Text(glassmat.RadMaterials)
concat_4 = Concatenate(FragmentA=glass_modifier, FragmentC=blinds_material)
overrides_48 = ApplyOverrides(Input_=panel_47, Modifiers=graft(concat_4), Name=graft(name_5))  # -> Output, Pairs
executessh_15 = ExecuteSSH(
    _SSHCommands_=overrides_48.Output,
    Run=bool_2,
    addPrefix=True,
    fireLogs=False,
    lastRunTime=15,
    suppressWarnings=False,
    results="/home/mss/simulation/BSDF_Files/barnehagen_radFiles/Mods_GlassLT_70.rad",
    commands="""mkdir -p ~/simulation/BSDF_Files/barnehagen_radFiles
echo "void glass _GlassLT_70
0
0
3 0.763 0.763 0.763
void plastic blindmat 0 0 5 .8 .8 .8 0 .01" > ~/simulation/BSDF_Files/barnehagen_radFiles/Mods_GlassLT_70.rad
echo ~/simulation/BSDF_Files/barnehagen_radFiles/Mods_GlassLT_70.rad""")  # -> Stdout, Stderr_, Ran

# ----
# genblinds
name_6 = Panel(blindsname)
overrides_49 = ApplyOverrides(Input_=panel_12, Target=graft(name_6))  # -> Output, Pairs
bool_3 = Boolean(include_the_genblinds_result_in_the_bsdf)
blindsname_2 = Text(name_6)
cull_12 = CullPattern(List=blindsname_2, CullPattern=bool_3)
blindsname_3 = Text(cull_12)

# ---- group: Outdated
executessh_16 = ExecuteSSH(_SSHCommands_=overrides_49.Output, Run=bool_3, addPrefix=True, fireLogs=False, lastRunTime=0, suppressWarnings=False)  # -> Stdout, Stderr_, Ran

# ----
cull_13 = CullPattern(List=executessh_16.Stdout, CullPattern=bool_3)
blindsradfile = Text(cull_13)

# ----
# Prepare 3phase stuff
prep_3ph = Boolean(prepare_3_phase_geo_and_wea)

# ---- group: Outdated
executessh_17 = ExecuteSSH(
    _SSHCommands_=overrides_7.Output,
    Run=prep_3ph,
    addPrefix=True,
    description="""mkdir -p ~/simulation/Boston_Skylights
mkdir -p <LinuxHome>/weatherData
mkdir -p ~/simulation/Boston_Skylights/obj
echo ~/simulation/Boston_Skylights""",
    fireLogs=True,
    lastRunTime=11,
    name="Create workingdir",
    suppressWarnings=False,
    results="/home/mss/simulation/Boston_Skylights",
    commands="""mkdir -p ~/simulation/Boston_Skylights
mkdir -p ~/simulation/weatherData
mkdir -p ~/simulation/Boston_Skylights/obj
echo ~/simulation/Boston_Skylights""")  # -> Stdout, Stderr_, Ran

# ----
bool_4 = Boolean(calculate_vmx_interior)

bool_5 = Boolean(raytrace_daylight_matrix_exterior)

# ----
# setting dimensions
panel_48 = Panel("""getbbox <rad>
getbbox -h <rad>""")

# ---- group: Outdated
overrides_50 = ApplyOverrides(Input_=panel_48, Rad=graft(executessh_16.Stdout))  # -> Output, Pairs

# ----
executessh_18 = ExecuteSSH(
    _SSHCommands_=overrides_50.Output,
    Run=executessh_16.Ran,
    addPrefix=True,
    description="""getbbox <rad>
getbbox -h <rad>""",
    fireLogs=False,
    lastRunTime=17,
    suppressWarnings=False,
    results="""     xmin      xmax      ymin      ymax      zmin      zmax
        0         2 0.0535714   2.97379     -0.15 -0.0748246
_JOIN_
        0         2 0.0535714   2.97379     -0.15 -0.0748246""",
    commands="""getbbox /home/mss/simulation/BSDF_Files/Boston_Skylights_radFiles/blinds_001.rad
_JOIN_
getbbox -h /home/mss/simulation/BSDF_Files/Boston_Skylights_radFiles/blinds_001.rad""")  # -> Stdout, Stderr_, Ran

# ----
# Make sure zmax is below 0!
# Also pay attention to X/Y dims.
# Here ymax = 2 and xmax = 1
panel_49 = Panel(executessh_18.Stdout)

cluster = Cluster(l=executessh_18.Stdout)  # -> xstart_2, xend_2, ystart_2, yend_2, data

# ---- group: Outdated
overrides_51 = ApplyOverrides(
    Input_="-dim <xstart> <xend> <ystart> <yend> <zmin> 0",
    Xstart=graft(cluster.xstart_2),
    Xend=graft(cluster.xend_2),
    Ystart=graft(cluster.ystart_2),
    Yend=graft(cluster.yend_2),
    Zmin=graft(cluster.data))  # -> Output, Pairs

# ----
python_9 = GhPythonScript(x=overrides_51.Output)  # -> a
# ---------- python_9: Python ----------
__author__ = "mm1013"
__version__ = "2022.09.09"

import rhinoscriptsyntax as rs

a = x.strip("\n").strip("\r")
# ---------- end python_9 ----------

# ----
# glass pane geometry
panel_50 = Panel("""<mat> polygon window
0
0
12 0 0 0
0 <y> 0
<x> <y> 0
<x> 0 0""")
python_10 = GhPythonScript(l=executessh_18.Stdout)  # -> out, xmax, ymax; inputs l: list
# ---------- python_10: Python ----------
__author__ = "mm1013"
__version__ = "2022.08.20"

import rhinoscriptsyntax as rs
xmax = 1
ymax = 1
if len(l) == 2:
    li = [s for s in l[1].split(" ") if len(s) > 0]
    #print(li)
    xmin, xmax, ymin, ymax, zmin, zmax = [float(v) for v in li]


    if zmax > 0:
        print("Err, Zmax should be < 0!")
    else:
        print("Zmax is OK (< 0)")
# ---------- end python_10 ----------
panel_51 = Panel("""mkdir -p <LinuxHome>/BSDF_Files/<projname>_radFiles
echo "<window>" > <LinuxHome>/BSDF_Files/<projname>_radFiles/Geo<name>.rad
echo <LinuxHome>/BSDF_Files/<projname>_radFiles/Geo<name>.rad""")
panel_52 = Panel(python_10.out)
name_7 = Text(python_8.name)

# ---- group: Outdated
overrides_52 = ApplyOverrides(Input_=panel_50, Mat=graft(python_8.name), X=graft(python_10.xmax), Y=graft(python_10.ymax))  # -> Output, Pairs

overrides_53 = ApplyOverrides(Input_=panel_51, Window=graft(overrides_52.Output), Name=graft(name_7))  # -> Output, Pairs

# ----
executessh_19 = ExecuteSSH(
    _SSHCommands_=overrides_53.Output,
    Run=bool_2,
    addPrefix=True,
    description="""mkdir -p <LinuxHome>/BSDF_Files/Boston_Skylights_radFiles
echo "_GlassLT_70 polygon window
0
0
12 0 0 0
0 2.97379 0
2 2.97379 0
2 0 0" > <LinuxHome>/BSDF_Files/Boston_Skylights_radFiles/Geo_GlassLT_70.rad
echo <LinuxHome>/BSDF_Files/Boston_Skylights_radFiles/Geo_GlassLT_70.rad""",
    fireLogs=False,
    lastRunTime=36,
    suppressWarnings=False,
    results="/home/mss/simulation/BSDF_Files/barnehagen_radFiles/Geo_GlassLT_70.rad",
    commands="""mkdir -p ~/simulation/BSDF_Files/barnehagen_radFiles
echo "_GlassLT_70 polygon window
0
0
12 0 0 0
0 1.99165 0
1 1.99165 0
1 0 0" > ~/simulation/BSDF_Files/barnehagen_radFiles/Geo_GlassLT_70.rad
echo ~/simulation/BSDF_Files/barnehagen_radFiles/Geo_GlassLT_70.rad""")  # -> Stdout, Stderr_, Ran

# ----
# GenBSDF
panel_53 = Panel("""mkdir -p <LinuxHome>/BSDF_Files
genBSDF -n <cpus> -r '<params>' <dim> <radFiles> > <LinuxHome>/BSDF_Files/<projname>_<target>.xml
echo <LinuxHome>/BSDF_Files/<projname>_<target>.xml""")
glassgeo = Text(executessh_19.Stdout)
blindsgeo = Text(blindsradfile)
modifiers = Text(executessh_15.Stdout)
merge = Merge(Data1=flatten(modifiers), Data2=flatten(blindsgeo), Data3=flatten(glassgeo))
name_8 = Text(python_8.name)
join = TextJoin(Text=merge, Join=" ")

# ---- group: Outdated
convertpaths_4 = ConvertPaths(I=merge)  # -> Linux, Windows

# ----
radviewer = RadViewer(
    RadFiles=flatten(convertpaths_4.Windows),
    DisplayName="BSDF Viewer",
    IsTwoSided=False,
    Polychromatic=True,
    ShowEdges=True,
    Transparent=True,
    ColorNames=["_GlassTak_70_mat", "blindmat", "_GlassLT_70", "_GlassLT_15"],
    Colors=[RGB(199, 212, 152), RGB(102, 195, 125), RGB(190, 228, 206), RGB(234, 110, 152)])  # -> Geo, ModifierNames, Modifiers, FailedWireFrame

blindsname_4 = Text(blindsname_3)
concat_5 = Concatenate(FragmentC=blindsname_4, FragmentB=name_8)

# ---- group: Outdated
overrides_54 = ApplyOverrides(Input_="<LinuxHome>/BSDF_Files/<projname>_<target>.xml", Target=graft(concat_5))  # -> Output, Pairs

# ----
save_path = Panel(overrides_54.Output)
name_9 = Panel(concat_5)

# ---- group: Outdated
overrides_55 = ApplyOverrides(Input_=panel_53, RadFiles=graft(join), Dim=graft(python_9), Target=graft(concat_5), Params=graft(rad_parameters))  # -> Output, Pairs

# ----
executessh_20 = ExecuteSSH(
    _SSHCommands=overrides_55.Output,
    Run=[executessh_15.Ran, executessh_19.Ran],
    addPrefix=True,
    description="""mkdir -p <LinuxHome>/BSDF_Files
genBSDF -n <cpus> -r '-ab 2 -ad 1024 -lw 1e-3' -dim 0.46 1.54 0.725222 2.30214 -0.15 0 /home/mss/simulation/BSDF_Files/barnehagen_radFiles/Mods_GlassLT_70.rad /home/mss/simulation/BSDF_Files/barnehagen_radFiles/Geo_GlassLT_70.rad > <LinuxHome>/BSDF_Files/Boston_Skylights_blinds_001_GlassLT_70.xml
echo <LinuxHome>/BSDF_Files/Boston_Skylights_blinds_001_GlassLT_70.xml""",
    fireLogs=False,
    lastRunTime=77625,
    suppressWarnings=True,
    results="/home/mss/simulation/BSDF_Files/barnehagen_blinds_001_GlassLT_70.xml",
    stderr="Recover using: /usr/local/radiance/bin/genBSDF -recover /tmp/genBSDF.QXPcYS",
    commands="""mkdir -p ~/simulation/BSDF_Files
genBSDF -n 11 -r '-ab 2 -ad 1024 -lw 1e-3' -dim 0.23 0.77 0.48558 1.541785 -0.15 0 /home/mss/simulation/BSDF_Files/barnehagen_radFiles/Mods_GlassLT_70.rad /home/mss/simulation/BSDF_Files/barnehagen_radFiles/blinds_001.rad /home/mss/simulation/BSDF_Files/barnehagen_radFiles/Geo_GlassLT_70.rad > ~/simulation/BSDF_Files/barnehagen_blinds_001_GlassLT_70.xml
echo ~/simulation/BSDF_Files/barnehagen_blinds_001_GlassLT_70.xml""")  # -> Stdout, Stderr, Ran

panel_55 = Panel(executessh_20.Stdout)

# ----
# Paths
panel_56 = Panel("<projfolder>/radFiles")

# ---- group: Outdated
overrides_56 = ApplyOverrides(Input_="<projfolder>")  # -> Output, Pairs

overrides_57 = ApplyOverrides(Input_=panel_56)  # -> Output, Pairs

# ----
concat_6 = Concatenate(FragmentA=overrides_56.Output, FragmentB="/obj")

# ----
# Opaque geometry
mesh_3 = Mesh(meshit2_4)
names = Text(name_2)
modnames = Text(concat_2)

# ---- group: Outdated
mesh2obj_4 = MeshToObj(
    Mesh=mesh_3,
    Name=graft(names),
    MapFileName="mapping_opaque",
    ModifierName=graft(modnames),
    SubfolderOverride=concat_6,
    Run=executessh_17.Ran)  # -> ObjFiles, MapFile, Run

# ----
obj2rad = ObjToRad(
    ObjFiles=mesh2obj_4.ObjFiles,
    MapFile=mesh2obj_4.MapFile,
    SubfolderOverride=overrides_57.Output,
    Run=mesh2obj_4.Run,
    stdouts="~/simulation/Boston_Skylights/radFiles/_SlabJ_50.rad>JOIN<~/simulation/Boston_Skylights/radFiles/_SkylightWall_70.rad>JOIN<~/simulation/Boston_Skylights/radFiles/_Roofs_50.rad>JOIN<~/simulation/Boston_Skylights/radFiles/_Frames_50.rad>JOIN<~/simulation/Boston_Skylights/radFiles/_FramesCW_50.rad>JOIN<~/simulation/Boston_Skylights/radFiles/_FacadeDark_30.rad>JOIN<~/simulation/Boston_Skylights/radFiles/_ContextMat_30.rad>JOIN<~/simulation/Boston_Skylights/radFiles/_WallInt_70.rad>JOIN<~/simulation/Boston_Skylights/radFiles/_WallExt_50.rad>JOIN<~/simulation/Boston_Skylights/radFiles/_Doors_50.rad>JOIN<~/simulation/Boston_Skylights/radFiles/_SlabCeiling_80.rad>JOIN<~/simulation/Boston_Skylights/radFiles/_SlabFloor_30.rad>JOIN<~/simulation/Boston_Skylights/radFiles/_SlabWall_50.rad>JOIN<~/simulation/Boston_Skylights/radFiles/_HRRoof1_80.rad>JOIN<~/simulation/Boston_Skylights/radFiles/_WallInt1_70.rad>JOIN<~/simulation/Boston_Skylights/radFiles/_Frames1_50.rad>JOIN<~/simulation/Boston_Skylights/radFiles/_Ground_30.rad>JOIN<~/simulation/Boston_Skylights/radFiles/_Skylight_Vers1_70.rad")  # -> Status, RadFiles, Run
panel_57 = Panel(obj2rad.RadFiles)
opaque_rad = Text(obj2rad.RadFiles)

opaque_materials = Panel(opaque_rad)

# ----
# Setting up Receivers (Apertures/Windows/BSDFs)
# The receiver is the surfaces between
# viewmatrix and daylightmatrix.
# These will later be tagged with BSDF files
# should be per room,
# per aperture
# must be 1 branch per room
srf = Surface(geo_7)

# ----
# Coupling windows
# with rooms (TESTY!!)
# Preview me
couplezonesandwindows = CoupleZonesAndWindows(WindowSurfaces=srf, WindowNames=flatten(name_4), SimulationSurfaces=flatten(geo_10), Tol1=0.1, Tol2=-1)  # -> SimulationSurface, WindowSurface, PathsPerWindow, FlipWindow
area_2 = Area(Geometry=couplezonesandwindows.SimulationSurface)  # -> Area, Centroid
tag = TextTag(Location=area_2.Centroid, Text=roomnumber, Colour=ColourSwatch(SwatchColor=RGB(255, 255, 255)))

cset_3 = CreateSet(List=couplezonesandwindows.PathsPerWindow)  # -> Set, Map
lng_2 = ListLength(List=cset_3.Set)
larger = LargerThan(FirstNumber=lng_2, SecondNumber="1")  # -> LargerThan, OrEqualTo
panel_58 = Panel("""0
1""")
item = ListItem(List=panel_58, Index=larger.LargerThan, Wrap=True)
panel_59 = Panel(item)

# ----
# Non bsdf glass modifiers (materials)
python_11 = GhPythonScript(matname=concat)  # -> filename
# ---------- python_11: Python ----------
__author__ = "mm1013"
__version__ = "2022.07.06"

import rhinoscriptsyntax as rs

filename = matname.replace(" ","_").replace(".","_")
# ---------- end python_11 ----------
glassmat_2 = GlassMat(Name=concat, Transmittance_0_1=transmittance)  # -> RadMaterials, RadMaterialList
panel_60 = Panel("echo \"<mats>\" > <proj>/radFiles/<target>;echo \"<proj>/radFiles/<target>\"")

# ---- group: Outdated
overrides_58 = ApplyOverrides(Input_="<mat>.mat", Mat=graft(python_11))  # -> Output, Pairs

# ----
overrides_59 = ApplyOverrides(Input_=panel_60, Mats=graft(glassmat_2.RadMaterials), Target=graft(overrides_58.Output))  # -> Output, Pairs
executessh_wip_5 = ExecuteSSHWIP(
    _SSHCommands_=overrides_59.Output,
    Run=executessh_17.Ran,
    addPrefix=True,
    fireLogs=True,
    lastRunTime=59,
    name="glassMats",
    suppressWarnings=False,
    results=["~/simulation/Boston_Skylights/radFiles/_GlassTak_70_mat.mat", "~/simulation/Boston_Skylights/radFiles/_GlassInt1_74_mat.mat", "~/simulation/Boston_Skylights/radFiles/_Glass_Facade_80_mat.mat", "~/simulation/Boston_Skylights/radFiles/_GlassFacade_74_mat.mat"],
    commands=["""echo "void glass _GlassTak_70_mat
0
0
3 0.763 0.763 0.763" > ~/simulation/Boston_Skylights/radFiles/_GlassTak_70_mat.mat;echo "~/simulation/Boston_Skylights/radFiles/_GlassTak_70_mat.mat"
""", """echo "void glass _GlassInt1_74_mat
0
0
3 0.806 0.806 0.806" > ~/simulation/Boston_Skylights/radFiles/_GlassInt1_74_mat.mat;echo "~/simulation/Boston_Skylights/radFiles/_GlassInt1_74_mat.mat"
""", """echo "void glass _Glass_Facade_80_mat
0
0
3 0.872 0.872 0.872" > ~/simulation/Boston_Skylights/radFiles/_Glass_Facade_80_mat.mat;echo "~/simulation/Boston_Skylights/radFiles/_Glass_Facade_80_mat.mat"
""", """echo "void glass _GlassFacade_74_mat
0
0
3 0.806 0.806 0.806" > ~/simulation/Boston_Skylights/radFiles/_GlassFacade_74_mat.mat;echo "~/simulation/Boston_Skylights/radFiles/_GlassFacade_74_mat.mat"
"""])  # -> Stdout, Stderr_, Ran
glass_modifiers = Text(executessh_wip_5.Stdout)

non_bsdf_glass_materials = Panel(glass_modifiers)

# ----
# Window (non BSDF) geometry
panel_61 = Panel("mapping_windows")

# ---- group: Outdated
mesh2obj_5 = MeshToObj(
    Mesh=mesh,
    Name=graft(name),
    MapFileName=panel_61,
    ModifierName=graft(concat),
    SubfolderOverride=concat_6,
    Run=executessh_17.Ran)  # -> ObjFiles, MapFile, Run

# ----
obj2rad_2 = ObjToRad(
    ObjFiles=mesh2obj_5.ObjFiles,
    MapFile=mesh2obj_5.MapFile,
    SubfolderOverride=overrides_57.Output,
    Run=mesh2obj_5.Run,
    stdouts="~/simulation/Boston_Skylights/radFiles/_GlassFacade_74.rad>JOIN<~/simulation/Boston_Skylights/radFiles/_Glass_Facade_80.rad>JOIN<~/simulation/Boston_Skylights/radFiles/_GlassInt1_74.rad>JOIN<~/simulation/Boston_Skylights/radFiles/_GlassTak_70.rad")  # -> Status, RadFiles, Run
panel_62 = Panel(obj2rad_2.RadFiles)
window_rad = Text(obj2rad_2.RadFiles)

non_bsdf_glass = Panel(window_rad)

# ----
# opaque modifiers (materials)
opaquegreymat = OpaqueGreyMat(Name=concat_2, Reflectance_0_1=refl, Specularity=0, Roughness=0)  # -> flatten(RadMaterials), RadMaterialList
panel_63 = Panel("echo \"<mats>\" > <proj>/radFiles/<target>;echo \"<proj>/radFiles/<target>\"")
join_2 = TextJoin(Text=opaquegreymat.RadMaterials)

# ---- group: Outdated
overrides_60 = ApplyOverrides(Input_=panel_63, Mats=graft(join_2), Target=graft("opaque_materials.mat"))  # -> Output, Pairs

# ----
executessh_wip_6 = ExecuteSSHWIP(
    _SSHCommands_=overrides_60.Output,
    Run=executessh_17.Ran,
    addPrefix=True,
    description="""echo "void plastic _Ground_20_mat
0
0
5 0.2 0.2 0.2 0 0
void plastic _Context_20_mat
0
0
5 0.2 0.2 0.2 0 0
void plastic _Walls_50_mat
0
0
5 0.5 0.5 0.5 0 0
void plastic _Floors_20_mat
0
0
5 0.2 0.2 0.2 0 0
void plastic _Ceilings_70_mat
0
0
5 0.7 0.7 0.7 0 0
void plastic _Grids_mat
0
0
5 0 0 0 0 0
void plastic _Frames_70_mat
0
0
5 0.7 0.7 0.7 0 0" > ~/simulation/Boston_Skylights/radFiles/opaque_materials.mat;echo "~/simulation/Boston_Skylights/radFiles/opaque_materials.mat"
""",
    fireLogs=True,
    lastRunTime=56,
    name="opaqueMats",
    suppressWarnings=False,
    results="~/simulation/Boston_Skylights/radFiles/opaque_materials.mat",
    commands="""echo "void plastic _Skylight_Vers1_70_mat
0
0
5 0.700 0.700 0.700 0.000 0.000
void plastic _Ground_30_mat
0
0
5 0.300 0.300 0.300 0.000 0.000
void plastic _Frames1_50_mat
0
0
5 0.500 0.500 0.500 0.000 0.000
void plastic _WallInt1_70_mat
0
0
5 0.700 0.700 0.700 0.000 0.000
void plastic _HRRoof1_80_mat
0
0
5 0.800 0.800 0.800 0.000 0.000
void plastic _SlabWall_50_mat
0
0
5 0.500 0.500 0.500 0.000 0.000
void plastic _SlabFloor_30_mat
0
0
5 0.300 0.300 0.300 0.000 0.000
void plastic _SlabCeiling_80_mat
0
0
5 0.800 0.800 0.800 0.000 0.000
void plastic _Doors_50_mat
0
0
5 0.500 0.500 0.500 0.000 0.000
void plastic _WallExt_50_mat
0
0
5 0.500 0.500 0.500 0.000 0.000
void plastic _WallInt_70_mat
0
0
5 0.700 0.700 0.700 0.000 0.000
void plastic _ContextMat_30_mat
0
0
5 0.300 0.300 0.300 0.000 0.000
void plastic _FacadeDark_30_mat
0
0
5 0.300 0.300 0.300 0.000 0.000
void plastic _FramesCW_50_mat
0
0
5 0.500 0.500 0.500 0.000 0.000
void plastic _Frames_50_mat
0
0
5 0.500 0.500 0.500 0.000 0.000
void plastic _Roofs_50_mat
0
0
5 0.500 0.500 0.500 0.000 0.000
void plastic _SkylightWall_70_mat
0
0
5 0.700 0.700 0.700 0.000 0.000
void plastic _SlabJ_50_mat
0
0
5 0.500 0.500 0.500 0.000 0.000" > ~/simulation/Boston_Skylights/radFiles/opaque_materials.mat;echo "~/simulation/Boston_Skylights/radFiles/opaque_materials.mat"
""")  # -> Stdout, Stderr_, Ran
opaque_mat = Text(executessh_wip_6.Stdout)

opaque_materials_merged = Panel(opaque_mat)

# ----
# WEA file (+ Skymatrix)
panel_64 = Panel("<LinuxHome>/weatherData")

# ---- group: Outdated
overrides_61 = ApplyOverrides(Input_=panel_64)  # -> Output, Pairs

# ----
cluster_2 = Cluster_4(x=overrides_61.Output)

# ----
# Skydome
# The skydome is generic and not dependent on EPW etc.
panel_65 = Panel("""mkdir -p <proj>/radFiles;
echo "<skyrad>" > <proj>/radFiles/skyglow_3ph.rad
echo "<proj>/radFiles/skyglow_3ph.rad"
""")
panel_66 = Panel("""#@rfluxmtx h=r1 u=+Y
void glow sky_glow
0
0
4 1 1 1 0
sky_glow source sky
0
0
4 0 0 1 180
#@rfluxmtx h=u u=+Y
void glow ground_glow
0
0
4 1 1 1 0
ground_glow source ground
0
0
4 0 0 -1 180""")

# ---- group: Outdated
overrides_62 = ApplyOverrides(Input_=panel_65, Skyrad=graft(panel_66))  # -> Output, Pairs

# ----
executessh_21 = ExecuteSSH(
    _SSHCommands_=overrides_62.Output,
    Run=prep_3ph,
    addPrefix=True,
    description="""mkdir -p ~/simulation/Boston_Skylights/radFiles;
echo "#@rfluxmtx h=r1 u=+Y
void glow sky_glow
0
0
4 1 1 1 0
sky_glow source sky
0
0
4 0 0 1 180
#@rfluxmtx h=u u=+Y
void glow ground_glow
0
0
4 1 1 1 0
ground_glow source ground
0
0
4 0 0 -1 180" > ~/simulation/Boston_Skylights/radFiles/skyglow_3ph.rad
echo "~/simulation/Boston_Skylights/radFiles/skyglow_3ph.rad"
""",
    fireLogs=False,
    lastRunTime=12,
    suppressWarnings=False,
    results="~/simulation/Boston_Skylights/radFiles/skyglow_3ph.rad",
    commands="""mkdir -p ~/simulation/Boston_Skylights/radFiles;
echo "#@rfluxmtx h=r1 u=+Y
void glow sky_glow
0
0
4 1 1 1 0
sky_glow source sky
0
0
4 0 0 1 180
#@rfluxmtx h=u u=+Y
void glow ground_glow
0
0
4 1 1 1 0
ground_glow source ground
0
0
4 0 0 -1 180" > ~/simulation/Boston_Skylights/radFiles/skyglow_3ph.rad
echo "~/simulation/Boston_Skylights/radFiles/skyglow_3ph.rad"
""")  # -> Stdout, Stderr_, Ran
skydome = Panel(executessh_21.Stdout)
skyglow = Text(executessh_21.Stdout)

upload = Upload(
    LocalFilePaths=path,
    SubfolderOverride=cluster_2,
    Run=executessh_17.Ran,
    stdouts="~/simulation/weatherData/NOR_Oslo.Fornebu.014880_IWEC.epw")  # -> Status, FilePaths, Run

# ---- group: Outdated
overrides_63 = ApplyOverrides(Input_="epw2wea <epw> <epw-.>.wea 1>&2;echo <epw-.>.wea", Epw=graft(upload.FilePaths))  # -> Output, Pairs

executessh_wip_7 = ExecuteSSHWIP(
    _SSHCommands=overrides_63.Output,
    Run=upload.Run,
    addPrefix=True,
    description="epw2wea ~/simulation/weatherData/NOR_Oslo.Fornebu.014880_IWEC.epw ~/simulation/weatherData/NOR_Oslo.Fornebu.014880_IWEC.wea 1>&2;echo ~/simulation/weatherData/NOR_Oslo.Fornebu.014880_IWEC.wea",
    fireLogs=True,
    lastRunTime=8,
    name="weaFile",
    suppressWarnings=True,
    results="/home/mss/simulation/weatherData/NOR_Oslo.Fornebu.014880_IWEC.wea",
    stderr="""place OSLO/FORNEBU_NOR
latitude 59.90
longitude -10.62
time_zone -15.00
site_elevation 17.0
weather_data_file_units 1""",
    commands="epw2wea ~/simulation/weatherData/NOR_Oslo.Fornebu.014880_IWEC.epw ~/simulation/weatherData/NOR_Oslo.Fornebu.014880_IWEC.wea 1>&2;echo ~/simulation/weatherData/NOR_Oslo.Fornebu.014880_IWEC.wea")  # -> Stdout, Stderr, Ran

# ----
panel_67 = Panel(upload.Status)

panel_68 = Panel(executessh_wip_7.Stdout)

# ----
# Annual sky-matrix 145 patches
panel_69 = Panel("gendaymtx -m 1 \"<wea>\" > <wea-.>_m1.smx;echo \"<wea-.>_m1.smx\"")
overrides_64 = ApplyOverrides(Input=panel_69, Wea=graft(panel_68))  # -> Output, Pairs
executessh_wip_8 = ExecuteSSHWIP(
    _SSHCommands_=overrides_64.Output,
    Run=executessh_wip_7.Ran,
    addPrefix=True,
    fireLogs=False,
    lastRunTime=1581,
    suppressWarnings=False,
    results="/home/mss/simulation/weatherData/NOR_Oslo.Fornebu.014880_IWEC_m1.smx",
    commands="gendaymtx -m 1 \"/home/mss/simulation/weatherData/NOR_Oslo.Fornebu.014880_IWEC.wea\" > /home/mss/simulation/weatherData/NOR_Oslo.Fornebu.014880_IWEC_m1.smx;echo \"/home/mss/simulation/weatherData/NOR_Oslo.Fornebu.014880_IWEC_m1.smx\"")  # -> Stdout, Stderr_, Ran
skymatrix_smx = Panel(executessh_wip_8.Stdout)
skymtx = Text(executessh_wip_8.Stdout)

panel_70 = Panel(executessh_wip_7.Stderr)
wea_file = Panel(executessh_wip_7.Stdout)

# ----
# grid points
pt_2 = Point(facen.Centers)
vec = Vector(facen.Normals)

# ---- group: Outdated
overrides_65 = ApplyOverrides(Input_="<projfolder>")  # -> Output, Pairs

# ----
concat_7 = Concatenate(FragmentA=overrides_65.Output, FragmentB="/points")
points2pts = PointsToPts(Points=pt_2, Vectors=vec, Name=roomnumber, SubfolderOverride=concat_7, Run=executessh_17.Ran)  # -> PtsFile, Run
ptsfile = Text(points2pts.PtsFile)

# ----
# preview pts files
# opt1 - cat directly from linux
panel_71 = Panel("cat <pts>")  # disabled
points = Text(ptsfile)  # disabled
overrides_66 = ApplyOverrides(Input_=panel_71, Pts=graft(points))  # -> Output, Pairs; disabled
toggle_2 = BooleanToggle(False)  # disabled
execute_ssh_async_4 = ExecuteSSHAsync(
    _SSHCommands_=overrides_66.Output,
    Run=toggle_2,
    addPrefix=True,
    addSuffix=True,
    description="""cat /home/mss/simulation/boston/points/0.pts
cat /home/mss/simulation/boston/points/1.pts""",
    fireLogs=False,
    suppressWarnings=False)  # -> Stdout, Stderr_, port, port_2, Ran; disabled
ptsview = PtsViewer(PtsString=execute_ssh_async_4.Stdout)  # disabled

# ----
# Get diffuseHorizontal from EPW
panel_72 = Panel("rcalc -t, -e '$1=$16' <epw>")

# ---- group: Outdated
overrides_67 = ApplyOverrides(Input_=panel_72, Epw=graft(upload.FilePaths))  # -> Output, Pairs

# ----
executessh_wip_9 = ExecuteSSHWIP(
    _SSHCommands_=overrides_67.Output,
    Run=upload.Run,
    addPrefix=True,
    description="rcalc -t, -e '$1=$16' ~/simulation/weatherData/NOR_Oslo.Fornebu.014880_IWEC.epw",
    fireLogs=False,
    lastRunTime=55,
    suppressWarnings=False,
    results="""0
5.4
0
5.81
0
0
0
0
0
0
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""",
    commands="rcalc -t, -e '$1=$16' ~/simulation/weatherData/NOR_Oslo.Fornebu.014880_IWEC.epw")  # -> Stdout, Stderr_, Ran
python_12 = GhPythonScript(inp=executessh_wip_9.Stdout)  # -> illum
# ---------- python_12: Python ----------
__author__ = "mm1013"
__version__ = "2022.07.04"

import rhinoscriptsyntax as rs

illum = [float(i) for i in inp.split("\n")][8:] #skipping headers
# ---------- end python_12 ----------

# ----
# EN17037 Schedule
# EN17037 Schedule
cluster_3 = Cluster_3(horizontaldiffrad=python_12)

# ---- group: visualize schedule
_3dchart = Ladybug_3DChart(inputData=flatten(cluster_3), xScale="0.25", zScale="0")  # -> readMe, graphMesh, graphCurves, legend, legendBasePts, title, titleBasePts, dataPts, conditionalHOY; disabled; plug-in component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
ladybug = Ladybug_Ladybug()  # -> Vviiiiiiiiiizzz; disabled; plug-in component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

# ----
assign_paths_3 = AssignPaths(InputData=flatten(layer_2), PathsToAssign=flatten(couplezonesandwindows.PathsPerWindow))
assign_paths_4 = AssignPaths(InputData=flatten(couplezonesandwindows.PathsPerWindow), PathsToAssign=flatten(couplezonesandwindows.PathsPerWindow))
assign_paths_5 = AssignPaths(InputData=flatten(name_4), PathsToAssign=flatten(couplezonesandwindows.PathsPerWindow))
cset_4 = CreateSet(List=assign_paths_3)  # -> Set, simplify(graft(Map))
dpath = DeconstructPath(Branch=assign_paths_4)
item_2 = ListItem(List=dpath, Index=0, Wrap=True)  # -> Item, Item1
long_2 = LongestList(ListA=roomnumber, ListB=couplezonesandwindows.WindowSurface, PaddingMode=2)  # -> simplify(ListA), ListB
abx = ABX(data=item_2.Item1, pathCount=panel_59)  # -> simplify(graft(data)); inputs data: tree, pathCount: Int32
# ---------- abx: C# ----------
    DataTree<object> newTree = new DataTree<object>();
    _data.SimplifyPaths();
    var y = _data.Paths;
    if (pathCount < 1)
    {
      pathCount = 1;
    }


    for (int i = 0; i < _data.BranchCount; i++)
    {
      GH_Path oldPath = _data.Paths[i];
      GH_Path p = new GH_Path(oldPath.Indices.Take(pathCount).ToArray());


      newTree.AddRange(_data.Branches[i], p);
    }
    data = newTree;
# ---------- end abx ----------
abx_2 = ABX(data=cset_4.Map, pathCount=panel_59)  # -> simplify(graft(data)); inputs data: tree, pathCount: Int32; same code as abx
abx_3 = ABX(data=item_2.Item, pathCount=panel_59)  # -> simplify(graft(data)); inputs data: tree, pathCount: Int32; same code as abx
merge_2 = Merge(Data1=abx_3, Data2=abx, Data3=abx_2)
path_2 = ConstructPath(Indices=merge_2)
assign_paths_6 = AssignPaths(InputData=flatten(couplezonesandwindows.WindowSurface), PathsToAssign=flatten(path_2))  # -> simplify(RestructuredData)
assign_paths_7 = AssignPaths(InputData=flatten(long_2.ListA), PathsToAssign=flatten(path_2))  # -> simplify(RestructuredData)
assign_paths_8 = AssignPaths(InputData=flatten(assign_paths_5), PathsToAssign=flatten(path_2))  # -> simplify(RestructuredData)
item_3 = ListItem(List=assign_paths_7, Index=0, Wrap=True)
item_4 = ListItem(List=assign_paths_8, Index=0, Wrap=True)
m = GhPythonScript(i=item_3)  # -> i1, simplify(i2); inputs i: Int32
# ---------- m: Python ----------
__author__ = "mm1013"
__version__ = "2022.08.21"

import rhinoscriptsyntax as rs

i1 = i
i2 = "%02d" % i
# ---------- end m ----------
concat_8 = Concatenate(FragmentA=m.i2, FragmentB=item_4)
meshit2_5 = MeshIt2(mesh_brep=assign_paths_6)
python_13 = GhPythonScript(x=concat_8)  # -> a
# ---------- python_13: Python ----------
__author__ = "mm1013"
__version__ = "2022.09.06"

import rhinoscriptsyntax as rs

a = x[:-5]
# ---------- end python_13 ----------
panel_73 = Panel(python_13)

# ----
# octrees for opaques (3ph)
# This octree contains all glass and opaque,
# but NOT the receivers on the BSDF layers.
opaque_mat_2 = Text(opaque_mat)
opaque_rad_2 = Text(opaque_rad)
window_mat = Text(glass_modifiers)
window_rad_2 = Text(window_rad)
panel_74 = Panel("""mkdir -p <proj>/octrees
oconv -w -f <rads> > <proj>/octrees/<target>.oct;echo <proj>/octrees/<target>.oct""")
entwine = Entwine(Branch00=opaque_mat_2, Branch01=opaque_rad_2, Branch02=window_mat, Branch03=window_rad_2, FlattenInputs=True)  # -> flatten(Result)
join_3 = TextJoin(Text=flatten(entwine), Join=" ")

# ---- group: Outdated
overrides_68 = ApplyOverrides(Input_=panel_74, Rads=graft(join_3), Target=graft("3ph_AllGeo_NoReceivers_NoSky"))  # -> Output, Pairs

# ----
executessh_wip_10 = ExecuteSSHWIP(
    _SSHCommands_=overrides_68.Output,
    Run=flatten(create_octree),
    addPrefix=True,
    description="""mkdir -p ~/simulation//octrees
oconv -w -f ~/simulation/Boston_Skylights/radFiles/opaque_materials.mat ~/simulation/Boston_Skylights/radFiles/_SlabJ_50.rad ~/simulation/Boston_Skylights/radFiles/_SkylightWall_70.rad ~/simulation/Boston_Skylights/radFiles/_Roofs_50.rad ~/simulation/Boston_Skylights/radFiles/_Frames_50.rad ~/simulation/Boston_Skylights/radFiles/_FramesCW_50.rad ~/simulation/Boston_Skylights/radFiles/_FacadeDark_30.rad ~/simulation/Boston_Skylights/radFiles/_ContextMat_30.rad ~/simulation/Boston_Skylights/radFiles/_WallInt_70.rad ~/simulation/Boston_Skylights/radFiles/_WallExt_50.rad ~/simulation/Boston_Skylights/radFiles/_Doors_50.rad ~/simulation/Boston_Skylights/radFiles/_SlabCeiling_80.rad ~/simulation/Boston_Skylights/radFiles/_SlabFloor_30.rad ~/simulation/Boston_Skylights/radFiles/_SlabWall_50.rad ~/simulation/Boston_Skylights/radFiles/_HRRoof1_80.rad ~/simulation/Boston_Skylights/radFiles/_WallInt1_70.rad ~/simulation/Boston_Skylights/radFiles/_Frames1_50.rad ~/simulation/Boston_Skylights/radFiles/_Ground_30.rad ~/simulation/Boston_Skylights/radFiles/_Skylight_Vers1_70.rad ~/simulation/Boston_Skylights/radFiles/_GlassTak_70_mat.mat ~/simulation/Boston_Skylights/radFiles/_GlassFacade_74.rad ~/simulation/Boston_Skylights/radFiles/_Glass_Facade_80.rad ~/simulation/Boston_Skylights/radFiles/_GlassInt1_74.rad ~/simulation/Boston_Skylights/radFiles/_GlassTak_70.rad > ~/simulation//octrees/3ph_AllGeo_NoReceivers_NoSky.oct;echo ~/simulation//octrees/3ph_AllGeo_NoReceivers_NoSky.oct""",
    fireLogs=False,
    lastRunTime=19459,
    suppressWarnings=False,
    results="/home/mss/simulation/Boston_Skylights/octrees/3ph_AllGeo_NoReceivers_NoSky.oct",
    commands="""mkdir -p ~/simulation/Boston_Skylights/octrees
oconv -w -f ~/simulation/Boston_Skylights/radFiles/opaque_materials.mat ~/simulation/Boston_Skylights/radFiles/_SlabJ_50.rad ~/simulation/Boston_Skylights/radFiles/_SkylightWall_70.rad ~/simulation/Boston_Skylights/radFiles/_Roofs_50.rad ~/simulation/Boston_Skylights/radFiles/_Frames_50.rad ~/simulation/Boston_Skylights/radFiles/_FramesCW_50.rad ~/simulation/Boston_Skylights/radFiles/_FacadeDark_30.rad ~/simulation/Boston_Skylights/radFiles/_ContextMat_30.rad ~/simulation/Boston_Skylights/radFiles/_WallInt_70.rad ~/simulation/Boston_Skylights/radFiles/_WallExt_50.rad ~/simulation/Boston_Skylights/radFiles/_Doors_50.rad ~/simulation/Boston_Skylights/radFiles/_SlabCeiling_80.rad ~/simulation/Boston_Skylights/radFiles/_SlabFloor_30.rad ~/simulation/Boston_Skylights/radFiles/_SlabWall_50.rad ~/simulation/Boston_Skylights/radFiles/_HRRoof1_80.rad ~/simulation/Boston_Skylights/radFiles/_WallInt1_70.rad ~/simulation/Boston_Skylights/radFiles/_Frames1_50.rad ~/simulation/Boston_Skylights/radFiles/_Ground_30.rad ~/simulation/Boston_Skylights/radFiles/_Skylight_Vers1_70.rad ~/simulation/Boston_Skylights/radFiles/_GlassTak_70_mat.mat ~/simulation/Boston_Skylights/radFiles/_GlassInt1_74_mat.mat ~/simulation/Boston_Skylights/radFiles/_Glass_Facade_80_mat.mat ~/simulation/Boston_Skylights/radFiles/_GlassFacade_74_mat.mat ~/simulation/Boston_Skylights/radFiles/_GlassFacade_74.rad ~/simulation/Boston_Skylights/radFiles/_Glass_Facade_80.rad ~/simulation/Boston_Skylights/radFiles/_GlassInt1_74.rad ~/simulation/Boston_Skylights/radFiles/_GlassTak_70.rad > ~/simulation/Boston_Skylights/octrees/3ph_AllGeo_NoReceivers_NoSky.oct;echo ~/simulation/Boston_Skylights/octrees/3ph_AllGeo_NoReceivers_NoSky.oct""")  # -> Stdout, Stderr_, Ran
panel_75 = Panel(overrides_68.Output)
panel_76 = Panel(executessh_wip_10.Stdout)
octree = Text(executessh_wip_10.Stdout)

# ----
# preview rad files
window_mat_2 = Text(glass_modifiers)
opaque_mat_3 = Text(opaque_mat)
opaque_rad_3 = Text(opaque_rad)
window_rad_3 = Text(window_rad)
entwine_2 = Entwine(Branch00=window_mat_2, Branch01=window_rad_3, FlattenInputs=True)  # -> flatten(Result)
entwine_3 = Entwine(Branch00=opaque_mat_3, Branch01=opaque_rad_3, FlattenInputs=True)  # -> flatten(Result)

# ---- group: Outdated
convertpaths_5 = ConvertPaths(I=entwine_3)  # -> Linux, Windows

convertpaths_6 = ConvertPaths(I=entwine_2)  # -> Linux, Windows

# ----
radviewer_2 = RadViewer(
    RadFiles=flatten(convertpaths_5.Windows),
    DisplayName="opaques",
    IsTwoSided=False,
    Polychromatic=True,
    ShowEdges=True,
    Transparent=False,
    ColorNames=["_Doors_50_mat", "_SlabWall_50_mat", "_SlabJ_50_mat", "_HRRoof1_80_mat", "_WallInt1_70_mat", "_Frames1_50_mat", "_SkylightWall_70_mat", "_Roofs_50_mat", "_Frames_50_mat", "_FramesCW_50_mat", "_FacadeDark_30_mat", "_ContextMat_30_mat", "_WallInt_70_mat", "_WallExt_50_mat", "_SlabFloor_30_mat", "_Ground_30_mat", "_SlabCeiling_80_mat", "_Skylight_Vers1_70_mat", "_Structure_50_mat", "_Stair_50_mat", "_SlabFloor_20_mat", "_SlabCeiling_70_mat", "_Roof_20_mat", "_Context_30_mat", "_TerrainLARK_25_mat", "_Door_50_mat", "_WallInt_60_mat", "_Frames_70_mat"],
    Colors=[RGB(203, 150, 171), RGB(106, 190, 160), RGB(201, 174, 177), RGB(205, 158, 222), RGB(103, 250, 247), RGB(250, 218, 178), RGB(172, 136, 198), RGB(219, 133, 222), RGB(233, 173, 215), RGB(243, 121, 118), RGB(185, 190, 164), RGB(204, 140, 152), RGB(178, 241, 220), RGB(180, 192, 252), RGB(216, 119, 215), RGB(231, 108, 224), RGB(207, 160, 186), RGB(117, 202, 229), RGB(206, 143, 195), RGB(157, 127, 133), RGB(122, 153, 243), RGB(220, 159, 166), RGB(114, 247, 158), RGB(126, 199, 103), RGB(133, 105, 164), RGB(188, 246, 156), RGB(204, 168, 199), RGB(151, 252, 145)])  # -> Geo, ModifierNames, Modifiers, FailedWireFrame; disabled
radviewer_3 = RadViewer(
    RadFiles=flatten(convertpaths_6.Windows),
    DisplayName="windows",
    IsTwoSided=True,
    Polychromatic=False,
    ShowEdges=True,
    Transparent=False,
    ColorNames=["_GlassTak_70_mat", "_Roofs_50_mat", "_Frames_50_mat", "_SkylightWall_70_mat", "_SlabCeiling_80_mat", "_SlabWall_50_mat", "_WallInterior_70_mat", "_Ground_10_mat", "_FacadeDark_30_mat", "_GlassInt1_74_mat", "_GlassFacade_74_mat", "_GlassIndoor_80_mat", "_Glass_70_mat", "_Glass_80_mat", "_Glass_Facade_80_mat"],
    Colors=[RGB(162, 204, 232), RGB(119, 113, 248), RGB(230, 134, 190), RGB(110, 233, 137), RGB(234, 107, 206), RGB(165, 228, 136), RGB(186, 204, 171), RGB(180, 226, 238), RGB(180, 220, 116), RGB(155, 150, 195), RGB(119, 110, 254), RGB(246, 165, 150), RGB(250, 183, 132), RGB(229, 156, 130), RGB(188, 134, 200)])  # -> Geo, ModifierNames, Modifiers, FailedWireFrame

# ----
# save rad files
panel_77 = Panel("mapping_windows_bsdf")
concat_9 = Concatenate(FragmentA=concat_6, FragmentB="/receivers")
concat_10 = Concatenate(FragmentA=overrides_57.Output, FragmentB="/receivers")
abx_4 = ABX(data=python_13, pathCount=panel_59)  # -> data; inputs data: tree, pathCount: Int32
# ---------- abx_4: C# ----------
    DataTree<object> newTree = new DataTree<object>();
    _data.SimplifyPaths();
    var y = _data.Paths;
    if (pathCount < 1)
    {
      pathCount = 0;
    }
    GH_Path p;

    for (int i = 0; i < _data.BranchCount; i++)
    {
      GH_Path oldPath = _data.Paths[i];
      if (pathCount == 0)
      p = new GH_Path(0);
      else
      p = new GH_Path(oldPath.Indices.Take(pathCount).ToArray());  


      newTree.AddRange(_data.Branches[i], p);
    }
    data = newTree;
# ---------- end abx_4 ----------

# ---- group: Outdated
mesh2obj_6 = MeshToObj(
    Mesh=meshit2_5,
    Name=graft(python_13),
    MapFileName=panel_77,
    ModifierName=graft(python_13),
    SubfolderOverride=concat_9,
    Run=prep_3ph)  # -> ObjFiles, MapFile, Run

# ----
panel_78 = Panel(mesh2obj_6.ObjFiles)

obj2rad_3 = ObjToRad(
    ObjFiles=graft(mesh2obj_6.ObjFiles),
    MapFile=mesh2obj_6.MapFile,
    SubfolderOverride=concat_10,
    Run=mesh2obj_6.Run,
    stdouts="~/simulation/Boston_Skylights/radFiles/receivers/00_Glass_Facade.rad")  # -> Status, RadFiles, Run
window_rad_4 = Text(obj2rad_3.RadFiles)
unflatten_2 = UnflattenTree(Tree=window_rad_4, Guide=abx_4)

receiver_rad_files = Panel(unflatten_2)

name_10 = Text(python_13)
panel_79 = Panel(name_10)
vertical_glazing_rfluxmtx = Panel("#@rfluxmtx h=kf u=Z")

# ---- group: Outdated
overrides_69 = ApplyOverrides(Input_="void glow <windowMod> 0 0 4 1 1 1 0", WindowMod=graft(name_10))  # -> Output, Pairs

# ----
concat_11 = Concatenate(FragmentA=overrides_69.Output, FragmentB=vertical_glazing_rfluxmtx)

# ----
# adding rflux comments to windowRads
panel_80 = Panel("""echo "<rfluxmtx>" > <windowRad-.>_rflux.rad
cat <windowRad> >> <windowRad-.>_rflux.rad
echo <windowRad-.>_rflux.rad""")
overrides_70 = ApplyOverrides(Input_=panel_80, Rfluxmtx=graft(concat_11), WindowRad=graft(unflatten_2))  # -> Output, Pairs
executessh_22 = ExecuteSSH(
    _SSHCommands_=overrides_70.Output,
    Run=obj2rad_3.Run,
    addPrefix=True,
    fireLogs=True,
    lastRunTime=30,
    name="Add Comments",
    suppressWarnings=False,
    results=["/home/lio/simulation/Boston_Skylights/radFiles/receivers/00_Glass_rflux.rad", "/home/lio/simulation/Boston_Skylights/radFiles/receivers/00_Glass_Facade_rflux.rad"],
    commands=["""echo "void glow 00_Glass_Facade 0 0 4 1 1 1 0
#@rfluxmtx h=kf u=Z" > ~/simulation/Boston_Skylights/radFiles/receivers/00_Glass_Facade_rflux.rad
cat ~/simulation/Boston_Skylights/radFiles/receivers/00_Glass_Facade.rad >> ~/simulation/Boston_Skylights/radFiles/receivers/00_Glass_Facade_rflux.rad
echo ~/simulation/Boston_Skylights/radFiles/receivers/00_Glass_Facade_rflux.rad""", """echo "void glow 00_Glass 0 0 4 1 1 1 0
#@rfluxmtx h=kf u=Z" > ~/simulation/Boston_Skylights/radFiles/receivers/00_Glass_rflux.rad
cat ~/simulation/Boston_Skylights/radFiles/receivers/00_Glass.rad >> ~/simulation/Boston_Skylights/radFiles/receivers/00_Glass_rflux.rad
echo ~/simulation/Boston_Skylights/radFiles/receivers/00_Glass_rflux.rad"""])  # -> Stdout, Stderr_, Ran
unflatten_3 = UnflattenTree(Tree=executessh_22.Stdout, Guide=abx_4)
fenestrations_rad_rflux = Text(unflatten_3)

receiver_rad_files_2 = Panel(fenestrations_rad_rflux)

# ----
# sunny sky (SET LAT AND LON)
panel_81 = Panel("gensky 7 4 <h>:00CEST +s -a <lat> -o <lon>")
series_2 = Series(Start=8, Step=1, Count=10)
falsestart_4 = LBFalseStartToggle(False)
bool_6 = Boolean(falsestart_4)
overrides_71 = ApplyOverrides(Input_=panel_81, Lat=graft("59.9"), Lon=graft("10.7"), H=graft("11"))  # -> Output, Pairs
and_append_the_ground_2 = Panel("""##The 1 will be multiplie with brightfunc
skyfunc glow sky_glow
0
0
4 1 1 1 0

##Set to 1 as it will be multiplied with the gensky result
sky_glow source sky
0
0
4 0 0 1 180

##Set to 1 as it will be multiplied with the gensky result
skyfunc glow ground_glow
0
0
4 1 1 1 0

##The ground pane
ground_glow source ground
0
0
4 0 0 -1 180""")
panel_82 = Panel("""mkdir -p <proj>/skies/
echo "<sky>" > <proj>/skies/<target>
echo "<proj>/skies/<target>"
""")
python_14 = GhPythonScript(x="11")  # -> a; inputs x: Int32
# ---------- python_14: Python ----------
__author__ = "mm1013"
__version__ = "2022.08.30"

import rhinoscriptsyntax as rs

a = "%02d00" % x
# ---------- end python_14 ----------
hours = Text(python_14)

# ---- group: Outdated
executessh_wip_11 = ExecuteSSHWIP(
    _SSHCommands_=overrides_71.Output,
    Run=bool_6,
    addPrefix=True,
    fireLogs=False,
    lastRunTime=7,
    suppressWarnings=False,
    results="""# gensky 7 4 11:00CEST +s -a 59.9 -o 10.7
# Local solar time: 8.22
# Solar altitude and azimuth: 36.2 -72.6
# Ground ambient level: 13.8

void light solar
0
0
3 6.48e+06 6.48e+06 6.48e+06

solar source sun
0
0
4 0.769592 -0.241712 0.591018 0.5

void brightfunc skyfunc
2 skybr skybright.cal
0
7 1 7.51e+00 1.74e+01 4.56e-01 0.769592 -0.241712 0.591018""",
    commands="gensky 7 4 11:00CEST +s -a 59.9 -o 10.7")  # -> Stdout, Stderr_, Ran

# ----
panel_83 = Panel(executessh_wip_11.Stdout)
concat_12 = Concatenate(
    FragmentC="##Will control the gradient of the sky",
    FragmentA=executessh_wip_11.Stdout,
    FragmentB=and_append_the_ground_2)
overrides_72 = ApplyOverrides(
    Input=panel_82,
    Sky=graft(concat_12),
    Target=graft("<location>_sunny_sky_<h>.rad"),
    H=graft("11"),
    Location=graft("Oslo"))  # -> Output, Pairs
executessh_wip_12 = ExecuteSSHWIP(
    _SSHCommands_=overrides_72.Output,
    Run=executessh_wip_11.Ran,
    addPrefix=True,
    fireLogs=False,
    lastRunTime=9,
    suppressWarnings=False,
    results="""_JOIN_
_JOIN_
~/simulation/Boston_Skylights/skies/Oslo_sunny_sky_11.rad""",
    commands="""mkdir -p ~/simulation/Boston_Skylights/skies/
_JOIN_
echo "##Will control the gradient of the sky
# gensky 7 4 11:00CEST +s -a 59.9 -o 10.7
# Local solar time: 8.22
# Solar altitude and azimuth: 36.2 -72.6
# Ground ambient level: 13.8

void light solar
0
0
3 6.48e+06 6.48e+06 6.48e+06

solar source sun
0
0
4 0.769592 -0.241712 0.591018 0.5

void brightfunc skyfunc
2 skybr skybright.cal
0
7 1 7.51e+00 1.74e+01 4.56e-01 0.769592 -0.241712 0.591018

##The 1 will be multiplie with brightfunc
skyfunc glow sky_glow
0
0
4 1 1 1 0

##Set to 1 as it will be multiplied with the gensky result
sky_glow source sky
0
0
4 0 0 1 180

##Set to 1 as it will be multiplied with the gensky result
skyfunc glow ground_glow
0
0
4 1 1 1 0

##The ground pane
ground_glow source ground
0
0
4 0 0 -1 180" > ~/simulation/Boston_Skylights/skies/Oslo_sunny_sky_11.rad
_JOIN_
echo "~/simulation/Boston_Skylights/skies/Oslo_sunny_sky_11.rad"
""")  # -> Stdout, Stderr_, Ran
item_5 = ListItem(List=executessh_wip_12.Stdout, Index=0, Wrap=True)  # -> Item1, Item

# ----
# create black octree
window_mat_3 = Text(glass_modifiers)
window_rad_5 = Text(window_rad)
panel_84 = Panel("""mkdir -p <proj>/octrees
oconv -w -f <rads> > <proj>/octrees/my_geometry_black.oct
echo <proj>/octrees/my_geometry_black.oct""")
and_2 = GateAnd(B=executessh_wip_5.Ran)

# ----
# create black octreeDDS
suns_material = Text(executessh_wip.Stdout)
window_mat_4 = Text(glass_modifiers)
window_rad_6 = Text(window_rad)
mf6_suns = Text(executessh_wip_2.Stdout)
# Skies and Skymatrices (2ph DDS)
and_3 = GateAnd()
panel_85 = Panel("""mkdir -p <proj>/octrees
oconv -w -f <rads> > <proj>/octrees/<target>;echo <proj>/octrees/<target>""")

# ----
# Annual direct only daylight matrix with 145 patches (2ph DDS + 5ph)
panel_86 = Panel("gendaymtx -m 1 -d \"<wea>\" > <wea-.>_d_m1.smx;echo \"<wea-.>_d_m1.smx\"")
wea_file_2 = Text(executessh_wip_7.Stdout)

# ---- group: Outdated
overrides_73 = ApplyOverrides(Input=panel_86, Wea=graft(wea_file_2))  # -> Output, Pairs

# ----
executessh_wip_13 = ExecuteSSHWIP(
    _SSHCommands_=overrides_73.Output,
    Run=prepare,
    addPrefix=True,
    description="gendaymtx -m 1 -d \"/home/mss/simulation/weatherData/NOR_Oslo.Fornebu.014880_IWEC.wea\" > /home/mss/simulation/weatherData/NOR_Oslo.Fornebu.014880_IWEC_d_m1.smx;echo \"/home/mss/simulation/weatherData/NOR_Oslo.Fornebu.014880_IWEC_d_m1.smx\"",
    fireLogs=False,
    lastRunTime=1149,
    suppressWarnings=False,
    results="/home/mss/simulation/weatherData/NOR_Oslo.Fornebu.014880_IWEC_d_m1.smx",
    commands="gendaymtx -m 1 -d \"/home/mss/simulation/weatherData/NOR_Oslo.Fornebu.014880_IWEC.wea\" > /home/mss/simulation/weatherData/NOR_Oslo.Fornebu.014880_IWEC_d_m1.smx;echo \"/home/mss/simulation/weatherData/NOR_Oslo.Fornebu.014880_IWEC_d_m1.smx\"")  # -> Stdout, Stderr_, Ran
panel_87 = Panel(executessh_wip_13.Stdout)

# ----
# Sun matrix with 5165 suns (2ph DDS + 5ph)
panel_88 = Panel("gendaymtx -5 0.533 -d -m 6 \"<wea>\" > <wea-.>_d_m6.smx;echo \"<wea-.>_d_m6.smx\"")
wea_file_3 = Text(wea_file_2)
overrides_74 = ApplyOverrides(Input=panel_88, Wea=graft(wea_file_3))  # -> Output, Pairs

# ---- group: Outdated
executessh_wip_14 = ExecuteSSHWIP(
    _SSHCommands_=overrides_74.Output,
    Run=prepare,
    addPrefix=True,
    fireLogs=False,
    lastRunTime=45405,
    suppressWarnings=False,
    results="/home/mss/simulation/weatherData/NOR_Oslo.Fornebu.014880_IWEC_d_m6.smx",
    commands="gendaymtx -5 0.533 -d -m 6 \"/home/mss/simulation/weatherData/NOR_Oslo.Fornebu.014880_IWEC.wea\" > /home/mss/simulation/weatherData/NOR_Oslo.Fornebu.014880_IWEC_d_m6.smx;echo \"/home/mss/simulation/weatherData/NOR_Oslo.Fornebu.014880_IWEC_d_m6.smx\"")  # -> Stdout, Stderr_, Ran

# ----
panel_89 = Panel(executessh_wip_14.Stdout)

# ----
# blackmaterials
panel_90 = Panel("blackMaterial")
# NON-MULTIPHASE
# GRID BASED (2phaseDDS)
# 
# NO BSDFS USED
panel_91 = Panel("echo \"<mats>\" > <proj>/radFiles/<target>;echo \"<proj>/radFiles/<target>\"")
blackmatname = Text(panel_90)
opaquegreymat_2 = OpaqueGreyMat(Name=flatten(blackmatname), Reflectance_0_1="0.0", Specularity=0, Roughness=0)  # -> RadMaterials, RadMaterialList
overrides_75 = ApplyOverrides(Input_=panel_91, Mats=graft(opaquegreymat_2.RadMaterials), Target=graft("black_material.mat"))  # -> Output, Pairs

executessh_wip_15 = ExecuteSSHWIP(
    _SSHCommands_=overrides_75.Output,
    Run=prepare,
    addPrefix=True,
    fireLogs=True,
    lastRunTime=232,
    name="blackMats",
    suppressWarnings=False,
    results="~/simulation/Boston_Skylights/radFiles/black_material.mat",
    commands="""echo "void plastic blackMaterial
0
0
5 0.000 0.000 0.000 0.000 0.000" > ~/simulation/Boston_Skylights/radFiles/black_material.mat;echo "~/simulation/Boston_Skylights/radFiles/black_material.mat"
""")  # -> Stdout, Stderr_, Ran

black_mat = Text(executessh_wip_15.Stdout)

black_mat_2 = Text(black_mat)

black_mat_3 = Text(black_mat)

names_2 = Text(names)
panel_92 = Panel("xform -m <blackmat> <proj>/radFiles/<name>.rad > <proj>/radFiles/<name>_black.rad;echo \"<proj>/radFiles/<name>_black.rad\"")

# ---- group: Outdated
overrides_76 = ApplyOverrides(Input_=panel_92, Name=graft(names_2), Blackmat=graft(blackmatname))  # -> Output, Pairs

# ----
executessh_wip_16 = ExecuteSSHWIP(
    _SSHCommands_=overrides_76.Output,
    Run=prepare,
    addPrefix=True,
    description="""xform -m blackMaterial ~/simulation/Boston_Skylights/radFiles/_Ground_20.rad > ~/simulation/Boston_Skylights/radFiles/_Ground_20_black.rad;echo "~/simulation/Boston_Skylights/radFiles/_Ground_20_black.rad"


- - -

xform -m blackMaterial ~/simulation/Boston_Skylights/radFiles/_Context_20.rad > ~/simulation/Boston_Skylights/radFiles/_Context_20_black.rad;echo "~/simulation/Boston_Skylights/radFiles/_Context_20_black.rad"


- - -

xform -m blackMaterial ~/simulation/Boston_Skylights/radFiles/_Walls_50.rad > ~/simulation/Boston_Skylights/radFiles/_Walls_50_black.rad;echo "~/simulation/Boston_Skylights/radFiles/_Walls_50_black.rad"


- - -

xform -m blackMaterial ~/simulation/Boston_Skylights/radFiles/_Floors_20.rad > ~/simulation/Boston_Skylights/radFiles/_Floors_20_black.rad;echo "~/simulation/Boston_Skylights/radFiles/_Floors_20_black.rad"


- - -

xform -m blackMaterial ~/simulation/Boston_Skylights/radFiles/_Ceilings_70.rad > ~/simulation/Boston_Skylights/radFiles/_Ceilings_70_black.rad;echo "~/simulation/Boston_Skylights/radFiles/_Ceilings_70_black.rad"


- - -

xform -m blackMaterial ~/simulation/Boston_Skylights/radFiles/_Grids.rad > ~/simulation/Boston_Skylights/radFiles/_Grids_black.rad;echo "~/simulation/Boston_Skylights/radFiles/_Grids_black.rad"


- - -

xform -m blackMaterial ~/simulation/Boston_Skylights/radFiles/_Frames_70.rad > ~/simulation/Boston_Skylights/radFiles/_Frames_70_black.rad;echo "~/simulation/Boston_Skylights/radFiles/_Frames_70_black.rad"
""",
    fireLogs=True,
    lastRunTime=2954,
    name="blackRads",
    suppressWarnings=False,
    results=["~/simulation/Boston_Skylights/radFiles/_Skylight_Vers1_70_black.rad", "~/simulation/Boston_Skylights/radFiles/_Ground_30_black.rad", "~/simulation/Boston_Skylights/radFiles/_Frames1_50_black.rad", "~/simulation/Boston_Skylights/radFiles/_WallInt1_70_black.rad", "~/simulation/Boston_Skylights/radFiles/_HRRoof1_80_black.rad", "~/simulation/Boston_Skylights/radFiles/_SlabWall_50_black.rad", "~/simulation/Boston_Skylights/radFiles/_SlabFloor_30_black.rad", "~/simulation/Boston_Skylights/radFiles/_SlabCeiling_80_black.rad", "~/simulation/Boston_Skylights/radFiles/_Doors_50_black.rad", "~/simulation/Boston_Skylights/radFiles/_WallExt_50_black.rad", "~/simulation/Boston_Skylights/radFiles/_WallInt_70_black.rad", "~/simulation/Boston_Skylights/radFiles/_ContextMat_30_black.rad", "~/simulation/Boston_Skylights/radFiles/_FacadeDark_30_black.rad", "~/simulation/Boston_Skylights/radFiles/_FramesCW_50_black.rad", "~/simulation/Boston_Skylights/radFiles/_Frames_50_black.rad", "~/simulation/Boston_Skylights/radFiles/_Roofs_50_black.rad", "~/simulation/Boston_Skylights/radFiles/_SkylightWall_70_black.rad", "~/simulation/Boston_Skylights/radFiles/_SlabJ_50_black.rad"],
    commands=["xform -m blackMaterial ~/simulation/Boston_Skylights/radFiles/_Skylight_Vers1_70.rad > ~/simulation/Boston_Skylights/radFiles/_Skylight_Vers1_70_black.rad;echo \"~/simulation/Boston_Skylights/radFiles/_Skylight_Vers1_70_black.rad\"", "xform -m blackMaterial ~/simulation/Boston_Skylights/radFiles/_Ground_30.rad > ~/simulation/Boston_Skylights/radFiles/_Ground_30_black.rad;echo \"~/simulation/Boston_Skylights/radFiles/_Ground_30_black.rad\"", "xform -m blackMaterial ~/simulation/Boston_Skylights/radFiles/_Frames1_50.rad > ~/simulation/Boston_Skylights/radFiles/_Frames1_50_black.rad;echo \"~/simulation/Boston_Skylights/radFiles/_Frames1_50_black.rad\"", "xform -m blackMaterial ~/simulation/Boston_Skylights/radFiles/_WallInt1_70.rad > ~/simulation/Boston_Skylights/radFiles/_WallInt1_70_black.rad;echo \"~/simulation/Boston_Skylights/radFiles/_WallInt1_70_black.rad\"", "xform -m blackMaterial ~/simulation/Boston_Skylights/radFiles/_HRRoof1_80.rad > ~/simulation/Boston_Skylights/radFiles/_HRRoof1_80_black.rad;echo \"~/simulation/Boston_Skylights/radFiles/_HRRoof1_80_black.rad\"", "xform -m blackMaterial ~/simulation/Boston_Skylights/radFiles/_SlabWall_50.rad > ~/simulation/Boston_Skylights/radFiles/_SlabWall_50_black.rad;echo \"~/simulation/Boston_Skylights/radFiles/_SlabWall_50_black.rad\""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])  # -> Stdout, Stderr_, Ran
split = TextSplit(Text=executessh_wip_16.Stdout)
unflatten_4 = UnflattenTree(Tree=split, Guide=overrides_76.Output)
black_rad_files = Text(unflatten_4)

black_rad_files_2 = Text(black_rad_files)
entwine_4 = Entwine(Branch00=window_mat_3, Branch01=window_rad_5, Branch02=black_mat_2, Branch03=black_rad_files_2, FlattenInputs=True)  # -> flatten(Result)
join_4 = TextJoin(Text=flatten(entwine_4), Join=" ")
overrides_77 = ApplyOverrides(Input=panel_84, Rads=graft(join_4))  # -> Output, Pairs

# ---- group: Outdated
executessh_wip_17 = ExecuteSSHWIP(
    _SSHCommands_=overrides_77.Output,
    Run=prepare,
    addPrefix=True,
    description="""mkdir -p ~/simulation//octrees
oconv -w -f ~/simulation/Boston_Skylights/radFiles/_GlassTak_70_mat.mat ~/simulation/Boston_Skylights/radFiles/_GlassFacade_74.rad ~/simulation/Boston_Skylights/radFiles/_Glass_Facade_80.rad ~/simulation/Boston_Skylights/radFiles/_GlassInt1_74.rad ~/simulation/Boston_Skylights/radFiles/_GlassTak_70.rad ~/simulation/Boston_Skylights/radFiles/black_material.mat ~/simulation/Boston_Skylights/radFiles/_Skylight_Vers1_70_black.rad ~/simulation/Boston_Skylights/radFiles/_Ground_30_black.rad ~/simulation/Boston_Skylights/radFiles/_Frames1_50_black.rad ~/simulation/Boston_Skylights/radFiles/_WallInt1_70_black.rad ~/simulation/Boston_Skylights/radFiles/_HRRoof1_80_black.rad ~/simulation/Boston_Skylights/radFiles/_SlabWall_50_black.rad ~/simulation/Boston_Skylights/radFiles/_SlabFloor_30_black.rad > ~/simulation//octrees/my_geometry_black.oct
echo ~/simulation//octrees/my_geometry_black.oct""",
    fireLogs=True,
    lastRunTime=13168,
    name="octreeBlack",
    suppressWarnings=False,
    results="/home/mss/simulation/Boston_Skylights/octrees/my_geometry_black.oct",
    commands="""mkdir -p ~/simulation/Boston_Skylights/octrees
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""")  # -> Stdout, Stderr_, Ran

# ----
panel_93 = Panel(executessh_wip_17.Stdout)
octree_black = Text(executessh_wip_17.Stdout)

black_rad_files_3 = Text(black_rad_files)
entwine_5 = Entwine(
    Branch00=window_mat_4,
    Branch01=window_rad_6,
    Branch02=black_mat_3,
    Branch03=black_rad_files_3,
    Branch04=suns_material,
    Branch05=mf6_suns,
    FlattenInputs=True)  # -> flatten(Result)
join_5 = TextJoin(Text=flatten(entwine_5), Join=" ")
overrides_78 = ApplyOverrides(Input=panel_85, Rads=graft(join_5), Target=graft("my_geometry_black_sunCoeffecientsDDS.oct"))  # -> Output, Pairs

# ---- group: Outdated
executessh_wip_18 = ExecuteSSHWIP(
    _SSHCommands_=overrides_78.Output,
    Run=prepare,
    addPrefix=True,
    description="""mkdir -p ~/simulation//octrees
oconv -w -f ~/simulation/Boston_Skylights/radFiles/_GlassTak_70_mat.mat ~/simulation/Boston_Skylights/radFiles/_GlassFacade_74.rad ~/simulation/Boston_Skylights/radFiles/_Glass_Facade_80.rad ~/simulation/Boston_Skylights/radFiles/_GlassInt1_74.rad ~/simulation/Boston_Skylights/radFiles/_GlassTak_70.rad ~/simulation/Boston_Skylights/radFiles/black_material.mat ~/simulation/Boston_Skylights/radFiles/_Skylight_Vers1_70_black.rad ~/simulation/Boston_Skylights/radFiles/_Ground_30_black.rad ~/simulation/Boston_Skylights/radFiles/_Frames1_50_black.rad ~/simulation/Boston_Skylights/radFiles/_WallInt1_70_black.rad ~/simulation/Boston_Skylights/radFiles/_HRRoof1_80_black.rad ~/simulation/Boston_Skylights/radFiles/_SlabWall_50_black.rad ~/simulation/Boston_Skylights/radFiles/_SlabFloor_30_black.rad ~/simulation/suns.rad /home/mss/simulation/suns.rad > ~/simulation//octrees/my_geometry_black_sunCoeffecientsDDS.oct;echo ~/simulation//octrees/my_geometry_black_sunCoeffecientsDDS.oct""",
    fireLogs=False,
    lastRunTime=13180,
    suppressWarnings=False,
    results="/home/mss/simulation/Boston_Skylights/octrees/my_geometry_black_sunCoeffecientsDDS.oct",
    commands="""mkdir -p ~/simulation/Boston_Skylights/octrees
oconv -w -f ~/simulation/Boston_Skylights/radFiles/_GlassTak_70_mat.mat ~/simulation/Boston_Skylights/radFiles/_GlassInt1_74_mat.mat ~/simulation/Boston_Skylights/radFiles/_Glass_Facade_80_mat.mat ~/simulation/Boston_Skylights/radFiles/_GlassFacade_74_mat.mat ~/simulation/Boston_Skylights/radFiles/_GlassFacade_74.rad ~/simulation/Boston_Skylights/radFiles/_Glass_Facade_80.rad ~/simulation/Boston_Skylights/radFiles/_GlassInt1_74.rad ~/simulation/Boston_Skylights/radFiles/_GlassTak_70.rad ~/simulation/Boston_Skylights/radFiles/black_material.mat ~/simulation/Boston_Skylights/radFiles/_Skylight_Vers1_70_black.rad ~/simulation/Boston_Skylights/radFiles/_Ground_30_black.rad ~/simulation/Boston_Skylights/radFiles/_Frames1_50_black.rad ~/simulation/Boston_Skylights/radFiles/_WallInt1_70_black.rad ~/simulation/Boston_Skylights/radFiles/_HRRoof1_80_black.rad ~/simulation/Boston_Skylights/radFiles/_SlabWall_50_black.rad ~/simulation/Boston_Skylights/radFiles/_SlabFloor_30_black.rad ~/simulation/Boston_Skylights/radFiles/_SlabCeiling_80_black.rad ~/simulation/Boston_Skylights/radFiles/_Doors_50_black.rad ~/simulation/Boston_Skylights/radFiles/_WallExt_50_black.rad ~/simulation/Boston_Skylights/radFiles/_WallInt_70_black.rad ~/simulation/Boston_Skylights/radFiles/_ContextMat_30_black.rad ~/simulation/Boston_Skylights/radFiles/_FacadeDark_30_black.rad ~/simulation/Boston_Skylights/radFiles/_FramesCW_50_black.rad ~/simulation/Boston_Skylights/radFiles/_Frames_50_black.rad ~/simulation/Boston_Skylights/radFiles/_Roofs_50_black.rad ~/simulation/Boston_Skylights/radFiles/_SkylightWall_70_black.rad ~/simulation/Boston_Skylights/radFiles/_SlabJ_50_black.rad ~/simulation/suns.rad /home/mss/simulation/suns.rad > ~/simulation/Boston_Skylights/octrees/my_geometry_black_sunCoeffecientsDDS.oct;echo ~/simulation/Boston_Skylights/octrees/my_geometry_black_sunCoeffecientsDDS.oct""")  # -> Stdout, Stderr_, Ran

# ----
panel_94 = Panel(executessh_wip_18.Stdout)
octree_blackdds = Text(executessh_wip_18.Stdout)

# ---- group: Outdated
overrides_79 = ApplyOverrides(Input_="head <file> -n 20", File=graft(fenestrations_rad_rflux))  # -> flatten(Output), Pairs

# ----
executessh_23 = ExecuteSSH(
    _SSHCommands_=overrides_79.Output,
    Run=executessh_22.Ran,
    addPrefix=True,
    description="head /home/lio/simulation/Boston_Skylights/radFiles/receivers/00_Glass_rflux.rad -n 20",
    fireLogs=False,
    lastRunTime=22,
    suppressWarnings=False,
    results="""void glow 00_Glass 0 0 4 1 1 1 0
#@rfluxmtx h=kf u=Z
# obj2rad -m /home/lio/simulation/Boston_Skylights/radFiles/receivers/mapping_windows_bsdf.map -f /home/lio/simulation/Boston_Skylights/radFiles/receivers/00_Glass.obj
# Written with MantaRay plugin/GH_MeshToRad

00_Glass polygon 00_Glass_1.1
0
0
12
             53.361            190.572             117.03
             53.823            190.381             117.03
             53.433            189.439            116.442
             52.971             189.63            116.442

00_Glass polygon 00_Glass_1.2
0
0
12
             52.899            190.763             117.03
             53.361            190.572             117.03
_JOIN_
void glow 00_Glass_Facade 0 0 4 1 1 1 0
#@rfluxmtx h=kf u=Z
# obj2rad -m /home/lio/simulation/Boston_Skylights/radFiles/receivers/mapping_windows_bsdf.map -f /home/lio/simulation/Boston_Skylights/radFiles/receivers/00_Glass_Facade.obj
# Written with MantaRay plugin/GH_MeshToRad

00_Glass_Facade polygon 00_Glass_Facade_1.1
0
0
12
              51.52            186.597            112.865
              51.52            186.597            110.862
             51.261            186.705            110.862
             51.261            186.705            112.865

00_Glass_Facade polygon 00_Glass_Facade_1.2
0
0
12
             51.549            186.467            113.752
             51.549            186.467            113.018""",
    commands="""head /home/lio/simulation/Boston_Skylights/radFiles/receivers/00_Glass_rflux.rad -n 20
_JOIN_
head /home/lio/simulation/Boston_Skylights/radFiles/receivers/00_Glass_Facade_rflux.rad -n 20""")  # -> Stdout, Stderr_, Ran
panel_95 = Panel(executessh_23.Stdout)

# ---- group: Outdated
overrides_80 = ApplyOverrides(Input="cat <target>", Target=graft(execute_ssh_async_2.Stdout))  # -> Output, Pairs

# ----
execute_ssh_async_5 = ExecuteSSHAsync(
    _SSHCommands_=overrides_80.Output,
    Run=execute_ssh_async_2.Ran,
    addPrefix=True,
    addSuffix=True,
    description="cat ~/simulation/Boston_Skylights/skies/overcast_sky.rad",
    fireLogs=False,
    stdouts="""##Will control the gradient of the sky
# gensky -ang 45 0 -c -B 55.866
# Ground ambient level: 17.8

void brightfunc skyfunc
2 skybr skybright.cal
0
3 2 2.29e+01 3.56e+00

##The 1 will be multiplie with brightfunc
skyfunc glow sky_glow
0
0
4 1 1 1 0

##Set to 1 as it will be multiplied with the gensky result
sky_glow source sky
0
0
4 0 0 1 180

##Set to 1 as it will be multiplied with the gensky result
skyfunc glow ground_glow
0
0
4 1 1 1 0

##The ground pane
ground_glow source ground
0
0
4 0 0 -1 180""",
    suppressWarnings=False)  # -> Stdout, Stderr_, port, port_2, Ran
panel_96 = Panel(execute_ssh_async_5.Stdout)

overrides_81 = ApplyOverrides(Input="head <target>", Target=graft(item_5.Item1))  # -> Output, Pairs

# ---- group: Outdated
executessh_wip_19 = ExecuteSSHWIP(
    _SSHCommands_=overrides_81.Output,
    Run=executessh_wip_12.Ran,
    addPrefix=True,
    fireLogs=False,
    lastRunTime=7,
    suppressWarnings=False,
    results="""##Will control the gradient of the sky
# gensky 7 4 11:00CEST +s -a 59.9 -o 10.7
# Local solar time: 8.22
# Solar altitude and azimuth: 36.2 -72.6
# Ground ambient level: 13.8

void light solar
0
0
3 6.48e+06 6.48e+06 6.48e+06""",
    commands="head ~/simulation/Boston_Skylights/skies/Oslo_sunny_sky_11.rad")  # -> Stdout, Stderr_, Ran

# ----
panel_97 = Panel(executessh_wip_19.Stdout)

# ----
# Viewmatrix (grid based)
fenestrations_rad_rflux_2 = Text(fenestrations_rad_rflux)
octree_with_glass = Text(octree)
ptsfile_2 = Text(simplify(ptsfile))
roomnumber_2 = Text(roomnumber)
glassname = Text(python_13)
panel_98 = Panel("""mkdir -p <proj>/mtxs/3ph_vmx_grid
rfluxmtx -v -w -I+ <param> -n <cpus> -y <ptcount> - <receiver> -i <octree> < <ptsfile> > <proj>/mtxs/3ph_vmx_grid/<room>_<window>.vmx
echo <proj>/mtxs/3ph_vmx_grid/<room>_<window>.vmx""")
abx_5 = ABX(data=glassname, pathCount=panel_59)  # -> data; inputs data: tree, pathCount: Int32; same code as abx_4
m_2 = GhPythonScript(i=roomnumber_2)  # -> i1, simplify(i2); inputs i: Int32; same code as m
panel_99 = Panel(vmx_rad_parameters)
python_15 = GhPythonScript(x=flatten(glassname))  # -> a; inputs x: list
# ---------- python_15: Python ----------
__author__ = "mm1013"
__version__ = "2022.09.12"

import rhinoscriptsyntax as rs

a = []
a.append("Will calculate " + str(len(x)) + " VMXs:")
for l in x:
    a.append(l)
# ---------- end python_15 ----------
panel_100 = Panel(python_15)

# ---- group: Outdated
overrides_82 = ApplyOverrides(Input_="wc -l < <ptsFile>", PtsFile=graft(ptsfile_2))  # -> Output, Pairs

# ----
# Daylight matrix (exterior)
glassname_2 = Text(python_13)
octree_with_glass_2 = Text(octree)
fenestrations_rad_rflux_3 = Text(fenestrations_rad_rflux)
skyglow_2 = Text(skyglow)
panel_102 = Panel("""mkdir -p <proj>/mtxs/3ph_dmx;
rfluxmtx -w -v -ffa <param> -c 1000 -n <cpus> <receiver> <skyglow> -i <octree> > <proj>/mtxs/3ph_dmx/<receiverName>.dmx;echo "<proj>/mtxs/3ph_dmx/<receiverName>.dmx"
""")
abx_6 = ABX(data=glassname_2, pathCount=panel_59)  # -> data; inputs data: tree, pathCount: Int32; same code as abx_4
panel_103 = Panel(dmx_rad_parameters)
overrides_83 = ApplyOverrides(
    Input_=panel_102,
    Param=graft(panel_103),
    Receiver=graft(fenestrations_rad_rflux_3),
    ReceiverName=graft(abx_6),
    Octree=graft(octree_with_glass_2),
    Skyglow=graft(skyglow_2))  # -> flatten(Output), Pairs
python_16 = GhPythonScript(x=flatten(glassname_2))  # -> a; inputs x: list
# ---------- python_16: Python ----------
__author__ = "mm1013"
__version__ = "2022.09.12"

import rhinoscriptsyntax as rs

a = []
a.append("Will calculate " + str(len(x)) + " DMXs:")
for l in x:
    a.append(l)
# ---------- end python_16 ----------
panel_104 = Panel(python_16)

fenestrations_rad_rflux_4 = Text(flatten(glassname_2))

# ---- group: Outdated
executessh_24 = ExecuteSSH(
    _SSHCommands=overrides_83.Output,
    Run=bool_5,
    addPrefix=True,
    description="""mkdir -p ~/simulation//mtxs/3ph_dmx;
rfluxmtx -w -v -ffa -ab 3 -ad 1024 -lw 0.001 -c 1000 -n 63 /home/lio/simulation/Boston_Skylights/radFiles/receivers/00_Glass_rflux.rad ~/simulation/Boston_Skylights/radFiles/skyglow_3ph.rad -i /home/mss/simulation/Boston_Skylights/octrees/3ph_AllGeo_NoReceivers_NoSky.oct > ~/simulation//mtxs/3ph_dmx/.dmx;echo "~/simulation//mtxs/3ph_dmx/.dmx"
""",
    fireLogs=True,
    lastRunTime=215837,
    name="DaylightMatrix",
    suppressWarnings=True,
    results="""~/simulation/barnehagen/mtxs/3ph_dmx/00_receiversSouth.dmx
_JOIN_
~/simulation/barnehagen/mtxs/3ph_dmx/00_receiversSE.dmx
_JOIN_
~/simulation/barnehagen/mtxs/3ph_dmx/01_receiversNorth.dmx
_JOIN_
~/simulation/barnehagen/mtxs/3ph_dmx/02_receiversSouth.dmx
_JOIN_
~/simulation/barnehagen/mtxs/3ph_dmx/03_receiversSouth.dmx
_JOIN_
~/simulation/barnehagen/mtxs/3ph_dmx/04_receiversNorth.dmx""",
    stderr="""rfluxmtx: opening pipe to: rcontrib -fo+ -w -ab 3 -ad 1024 -lw 0.001 -n 11 -fda -c 1000 -f reinhartb.cal -p MF=1,rNx=0,rNy=0,rNz=-1,Ux=0,Uy=1,Uz=0,RHS=+1 -bn Nrbins -b rbin -m sky_glow -bn 1 -b 'if(-Dx*0-Dy*0-Dz*1,0,-1)' -m ground_glow -y 145 '!oconv -f -i /home/mss/simulation/barnehagen/octrees/full_scene.oct /home/mss/simulation/barnehagen/radFiles/skyglow_3ph.rad'
rfluxmtx: sampling 145 directions (7 elements)
rfluxmtx: opening pipe to: rcontrib -fo+ -w -ab 3 -ad 1024 -lw 0.001 -n 11 -fda -c 1000 -f reinhartb.cal -p MF=1,rNx=0,rNy=0,rNz=-1,Ux=0,Uy=1,Uz=0,RHS=+1 -bn Nrbins -b rbin -m sky_glow -bn 1 -b 'if(-Dx*0-Dy*0-Dz*1,0,-1)' -m ground_glow -y 145 '!oconv -f -i /home/mss/simulation/barnehagen/octrees/full_scene.oct /home/mss/simulation/barnehagen/radFiles/skyglow_3ph.rad'
rfluxmtx: sampling 145 directions
rfluxmtx: opening pipe to: rcontrib -fo+ -w -ab 3 -ad 1024 -lw 0.001 -n 11 -fda -c 1000 -f reinhartb.cal -p MF=1,rNx=0,rNy=0,rNz=-1,Ux=0,Uy=1,Uz=0,RHS=+1 -bn Nrbins -b rbin -m sky_glow -bn 1 -b 'if(-Dx*0-Dy*0-Dz*1,0,-1)' -m ground_glow -y 145 '!oconv -f -i /home/mss/simulation/barnehagen/octrees/full_scene.oct /home/mss/simulation/barnehagen/radFiles/skyglow_3ph.rad'
rfluxmtx: sampling 145 directions (10 elements)
rfluxmtx: opening pipe to: rcontrib -fo+ -w -ab 3 -ad 1024 -lw 0.001 -n 11 -fda -c 1000 -f reinhartb.cal -p MF=1,rNx=0,rNy=0,rNz=-1,Ux=0,Uy=1,Uz=0,RHS=+1 -bn Nrbins -b rbin -m sky_glow -bn 1 -b 'if(-Dx*0-Dy*0-Dz*1,0,-1)' -m ground_glow -y 145 '!oconv -f -i /home/mss/simulation/barnehagen/octrees/full_scene.oct /home/mss/simulation/barnehagen/radFiles/skyglow_3ph.rad'
rfluxmtx: sampling 145 directions (10 elements)
rfluxmtx: opening pipe to: rcontrib -fo+ -w -ab 3 -ad 1024 -lw 0.001 -n 11 -fda -c 1000 -f reinhartb.cal -p MF=1,rNx=0,rNy=0,rNz=-1,Ux=0,Uy=1,Uz=0,RHS=+1 -bn Nrbins -b rbin -m sky_glow -bn 1 -b 'if(-Dx*0-Dy*0-Dz*1,0,-1)' -m ground_glow -y 145 '!oconv -f -i /home/mss/simulation/barnehagen/octrees/full_scene.oct /home/mss/simulation/barnehagen/radFiles/skyglow_3ph.rad'
rfluxmtx: sampling 145 directions (6 elements)
rfluxmtx: opening pipe to: rcontrib -fo+ -w -ab 3 -ad 1024 -lw 0.001 -n 11 -fda -c 1000 -f reinhartb.cal -p MF=1,rNx=0,rNy=0,rNz=-1,Ux=0,Uy=1,Uz=0,RHS=+1 -bn Nrbins -b rbin -m sky_glow -bn 1 -b 'if(-Dx*0-Dy*0-Dz*1,0,-1)' -m ground_glow -y 145 '!oconv -f -i /home/mss/simulation/barnehagen/octrees/full_scene.oct /home/mss/simulation/barnehagen/radFiles/skyglow_3ph.rad'
rfluxmtx: sampling 145 directions (9 elements)""",
    commands="""mkdir -p ~/simulation/barnehagen/mtxs/3ph_dmx;
rfluxmtx -w -v -ffa -ab 3 -ad 1024 -lw 0.001 -c 1000 -n 11 /home/mss/simulation/barnehagen/radFiles/receivers/00_receiversSouth_rflux.rad ~/simulation/barnehagen/radFiles/skyglow_3ph.rad -i /home/mss/simulation/barnehagen/octrees/full_scene.oct > ~/simulation/barnehagen/mtxs/3ph_dmx/00_receiversSouth.dmx;echo "~/simulation/barnehagen/mtxs/3ph_dmx/00_receiversSouth.dmx"
_JOIN_
mkdir -p ~/simulation/barnehagen/mtxs/3ph_dmx;
rfluxmtx -w -v -ffa -ab 3 -ad 1024 -lw 0.001 -c 1000 -n 11 /home/mss/simulation/barnehagen/radFiles/receivers/00_receiversSE_rflux.rad ~/simulation/barnehagen/radFiles/skyglow_3ph.rad -i /home/mss/simulation/barnehagen/octrees/full_scene.oct > ~/simulation/barnehagen/mtxs/3ph_dmx/00_receiversSE.dmx;echo "~/simulation/barnehagen/mtxs/3ph_dmx/00_receiversSE.dmx"
_JOIN_
mkdir -p ~/simulation/barnehagen/mtxs/3ph_dmx;
rfluxmtx -w -v -ffa -ab 3 -ad 1024 -lw 0.001 -c 1000 -n 11 /home/mss/simulation/barnehagen/radFiles/receivers/01_receiversNorth_rflux.rad ~/simulation/barnehagen/radFiles/skyglow_3ph.rad -i /home/mss/simulation/barnehagen/octrees/full_scene.oct > ~/simulation/barnehagen/mtxs/3ph_dmx/01_receiversNorth.dmx;echo "~/simulation/barnehagen/mtxs/3ph_dmx/01_receiversNorth.dmx"
_JOIN_
mkdir -p ~/simulation/barnehagen/mtxs/3ph_dmx;
rfluxmtx -w -v -ffa -ab 3 -ad 1024 -lw 0.001 -c 1000 -n 11 /home/mss/simulation/barnehagen/radFiles/receivers/02_receiversSouth_rflux.rad ~/simulation/barnehagen/radFiles/skyglow_3ph.rad -i /home/mss/simulation/barnehagen/octrees/full_scene.oct > ~/simulation/barnehagen/mtxs/3ph_dmx/02_receiversSouth.dmx;echo "~/simulation/barnehagen/mtxs/3ph_dmx/02_receiversSouth.dmx"
_JOIN_
mkdir -p ~/simulation/barnehagen/mtxs/3ph_dmx;
rfluxmtx -w -v -ffa -ab 3 -ad 1024 -lw 0.001 -c 1000 -n 11 /home/mss/simulation/barnehagen/radFiles/receivers/03_receiversSouth_rflux.rad ~/simulation/barnehagen/radFiles/skyglow_3ph.rad -i /home/mss/simulation/barnehagen/octrees/full_scene.oct > ~/simulation/barnehagen/mtxs/3ph_dmx/03_receiversSouth.dmx;echo "~/simulation/barnehagen/mtxs/3ph_dmx/03_receiversSouth.dmx"
_JOIN_
mkdir -p ~/simulation/barnehagen/mtxs/3ph_dmx;
rfluxmtx -w -v -ffa -ab 3 -ad 1024 -lw 0.001 -c 1000 -n 11 /home/mss/simulation/barnehagen/radFiles/receivers/04_receiversNorth_rflux.rad ~/simulation/barnehagen/radFiles/skyglow_3ph.rad -i /home/mss/simulation/barnehagen/octrees/full_scene.oct > ~/simulation/barnehagen/mtxs/3ph_dmx/04_receiversNorth.dmx;echo "~/simulation/barnehagen/mtxs/3ph_dmx/04_receiversNorth.dmx"
""")  # -> Stdout, Stderr, Ran

# ----
dmx = Panel(executessh_24.Stdout)

unflatten_5 = UnflattenTree(Tree=executessh_24.Stdout, Guide=abx_6)
dmx_2 = Text(unflatten_5)

executessh_wip_20 = ExecuteSSHWIP(
    _SSHCommands_=overrides_82.Output,
    Run=points2pts.Run,
    addPrefix=True,
    description="wc -l < <ptsFile>",
    fireLogs=False,
    lastRunTime=58,
    suppressWarnings=False,
    results="154",
    commands="wc -l < /home/mss/simulation/Boston_Skylights/points/0.pts")  # -> Stdout, Stderr_, Ran
pt_count = Panel(executessh_wip_20.Stdout)
long_3 = LongestList(
    ListA=abx_5,
    ListB=fenestrations_rad_rflux_2,
    ListC=ptsfile_2,
    ListD=m_2.i2,
    ListE=executessh_wip_20.Stdout,
    PaddingMode=2)  # -> ListA, ListB, ListC, ListD, ListE
overrides_84 = ApplyOverrides(
    Input_=panel_98,
    Window=graft(long_3.ListA),
    Receiver=graft(long_3.ListB),
    Octree=graft(octree_with_glass),
    Ptsfile=graft(long_3.ListC),
    Room=graft(long_3.ListD),
    Ptcount=graft(long_3.ListE),
    Param=graft(panel_99))  # -> flatten(Output), Pairs
panel_107 = Panel(overrides_84.Output)

# ---- group: Outdated
executessh_wip_21 = ExecuteSSHWIP(
    _SSHCommands_=overrides_84.Output,
    Run=bool_4,
    addPrefix=True,
    description="""mkdir -p ~/simulation//mtxs/3ph_vmx_grid
rfluxmtx -v -w -I+ -ab 2 -ad 1024 -lw 1e-3 -n 63 -y 154 - /home/lio/simulation/Boston_Skylights/radFiles/receivers/00_Glass_rflux.rad -i /home/mss/simulation/Boston_Skylights/octrees/3ph_AllGeo_NoReceivers_NoSky.oct < <ptsfile> > ~/simulation//mtxs/3ph_vmx_grid/<room>_.vmx
echo ~/simulation//mtxs/3ph_vmx_grid/<room>_.vmx""",
    fireLogs=True,
    lastRunTime=51367,
    name="ViewMatrix grid",
    suppressWarnings=False,
    results="""/home/mss/simulation/barnehagen/mtxs/3ph_vmx_grid/00_00_receiversSouth.vmx
_JOIN_
/home/mss/simulation/barnehagen/mtxs/3ph_vmx_grid/00_00_receiversSE.vmx
_JOIN_
/home/mss/simulation/barnehagen/mtxs/3ph_vmx_grid/01_01_receiversNorth.vmx
_JOIN_
/home/mss/simulation/barnehagen/mtxs/3ph_vmx_grid/02_02_receiversSouth.vmx
_JOIN_
/home/mss/simulation/barnehagen/mtxs/3ph_vmx_grid/03_03_receiversSouth.vmx
_JOIN_
/home/mss/simulation/barnehagen/mtxs/3ph_vmx_grid/04_04_receiversNorth.vmx""",
    commands="""mkdir -p ~/simulation/barnehagen/mtxs/3ph_vmx_grid
rfluxmtx -v -w -I+ -ab 2 -ad 1024 -lw 1e-3 -n 11 -y 462 - /home/mss/simulation/barnehagen/radFiles/receivers/00_receiversSouth_rflux.rad -i /home/mss/simulation/barnehagen/octrees/full_scene.oct < /home/mss/simulation/barnehagen/points/0.pts > ~/simulation/barnehagen/mtxs/3ph_vmx_grid/00_00_receiversSouth.vmx
echo ~/simulation/barnehagen/mtxs/3ph_vmx_grid/00_00_receiversSouth.vmx
_JOIN_
mkdir -p ~/simulation/barnehagen/mtxs/3ph_vmx_grid
rfluxmtx -v -w -I+ -ab 2 -ad 1024 -lw 1e-3 -n 11 -y 462 - /home/mss/simulation/barnehagen/radFiles/receivers/00_receiversSE_rflux.rad -i /home/mss/simulation/barnehagen/octrees/full_scene.oct < /home/mss/simulation/barnehagen/points/0.pts > ~/simulation/barnehagen/mtxs/3ph_vmx_grid/00_00_receiversSE.vmx
echo ~/simulation/barnehagen/mtxs/3ph_vmx_grid/00_00_receiversSE.vmx
_JOIN_
mkdir -p ~/simulation/barnehagen/mtxs/3ph_vmx_grid
rfluxmtx -v -w -I+ -ab 2 -ad 1024 -lw 1e-3 -n 11 -y 293 - /home/mss/simulation/barnehagen/radFiles/receivers/01_receiversNorth_rflux.rad -i /home/mss/simulation/barnehagen/octrees/full_scene.oct < /home/mss/simulation/barnehagen/points/1.pts > ~/simulation/barnehagen/mtxs/3ph_vmx_grid/01_01_receiversNorth.vmx
echo ~/simulation/barnehagen/mtxs/3ph_vmx_grid/01_01_receiversNorth.vmx
_JOIN_
mkdir -p ~/simulation/barnehagen/mtxs/3ph_vmx_grid
rfluxmtx -v -w -I+ -ab 2 -ad 1024 -lw 1e-3 -n 11 -y 299 - /home/mss/simulation/barnehagen/radFiles/receivers/02_receiversSouth_rflux.rad -i /home/mss/simulation/barnehagen/octrees/full_scene.oct < /home/mss/simulation/barnehagen/points/2.pts > ~/simulation/barnehagen/mtxs/3ph_vmx_grid/02_02_receiversSouth.vmx
echo ~/simulation/barnehagen/mtxs/3ph_vmx_grid/02_02_receiversSouth.vmx
_JOIN_
mkdir -p ~/simulation/barnehagen/mtxs/3ph_vmx_grid
rfluxmtx -v -w -I+ -ab 2 -ad 1024 -lw 1e-3 -n 11 -y 292 - /home/mss/simulation/barnehagen/radFiles/receivers/03_receiversSouth_rflux.rad -i /home/mss/simulation/barnehagen/octrees/full_scene.oct < /home/mss/simulation/barnehagen/points/3.pts > ~/simulation/barnehagen/mtxs/3ph_vmx_grid/03_03_receiversSouth.vmx
echo ~/simulation/barnehagen/mtxs/3ph_vmx_grid/03_03_receiversSouth.vmx
_JOIN_
mkdir -p ~/simulation/barnehagen/mtxs/3ph_vmx_grid
rfluxmtx -v -w -I+ -ab 2 -ad 1024 -lw 1e-3 -n 11 -y 288 - /home/mss/simulation/barnehagen/radFiles/receivers/04_receiversNorth_rflux.rad -i /home/mss/simulation/barnehagen/octrees/full_scene.oct < /home/mss/simulation/barnehagen/points/4.pts > ~/simulation/barnehagen/mtxs/3ph_vmx_grid/04_04_receiversNorth.vmx
echo ~/simulation/barnehagen/mtxs/3ph_vmx_grid/04_04_receiversNorth.vmx""")  # -> Stdout, Stderr_, Ran

# ----
unflatten_6 = UnflattenTree(Tree=executessh_wip_21.Stdout, Guide=abx_5)
vmx_grid = Text(unflatten_6)

vmx = Panel(vmx_grid)

# ----
# OCTREE (Sunny - 10 hourly skies!)
scene_rads = Text(entwine)
falsestart_5 = LBFalseStartToggle(False)
sky_sunny = Text(graft(item_5.Item1))
python_17 = GhPythonScript(x=flatten(scene_rads))  # -> a; inputs x: list
# ---------- python_17: Python ----------
__author__ = "mm1013"
__version__ = "2022.06.15"

import rhinoscriptsyntax as rs

a = None not in x
# ---------- end python_17 ----------
entwine_6 = Entwine(Branch02=scene_rads, FlattenInputs=True)  # -> flatten(Radfiles)
panel_109 = Panel("""mkdir -p <proj>/octrees/
oconv -r 2048 -f -w <rads> > <proj>/octrees/<target>
echo <proj>/octrees/<target>""")
and_4 = GateAnd(A=python_17, B=falsestart_5)
join_6 = TextJoin(Text=entwine_6, Join=" ")
panel_110 = Panel("oconv -r 2048 -i <oldOct> -f <newRads> > <proj>/octrees/<target>_<h>.oct;echo <proj>/octrees/<target>_<h>.oct")
hours_2 = Text(hours)

# ---- group: Outdated
overrides_85 = ApplyOverrides(Input=panel_109, Rads=graft(join_6), Target=graft("Scene_NOSKY.oct"))  # -> Output, Pairs

executessh_wip_22 = ExecuteSSHWIP(
    _SSHCommands_=overrides_85.Output,
    Run=and_4,
    addPrefix=True,
    description="""mkdir -p ~/simulation//octrees/
oconv -r 2048 -f -w ~/simulation/Boston_Skylights/radFiles/opaque_materials.mat ~/simulation/Boston_Skylights/radFiles/_SlabJ_50.rad ~/simulation/Boston_Skylights/radFiles/_SkylightWall_70.rad ~/simulation/Boston_Skylights/radFiles/_Roofs_50.rad ~/simulation/Boston_Skylights/radFiles/_Frames_50.rad ~/simulation/Boston_Skylights/radFiles/_FramesCW_50.rad ~/simulation/Boston_Skylights/radFiles/_FacadeDark_30.rad ~/simulation/Boston_Skylights/radFiles/_ContextMat_30.rad ~/simulation/Boston_Skylights/radFiles/_WallInt_70.rad ~/simulation/Boston_Skylights/radFiles/_WallExt_50.rad ~/simulation/Boston_Skylights/radFiles/_Doors_50.rad ~/simulation/Boston_Skylights/radFiles/_SlabCeiling_80.rad ~/simulation/Boston_Skylights/radFiles/_SlabFloor_30.rad ~/simulation/Boston_Skylights/radFiles/_SlabWall_50.rad ~/simulation/Boston_Skylights/radFiles/_HRRoof1_80.rad ~/simulation/Boston_Skylights/radFiles/_WallInt1_70.rad ~/simulation/Boston_Skylights/radFiles/_Frames1_50.rad ~/simulation/Boston_Skylights/radFiles/_Ground_30.rad ~/simulation/Boston_Skylights/radFiles/_Skylight_Vers1_70.rad ~/simulation/Boston_Skylights/radFiles/_GlassTak_70_mat.mat ~/simulation/Boston_Skylights/radFiles/_GlassFacade_74.rad ~/simulation/Boston_Skylights/radFiles/_Glass_Facade_80.rad ~/simulation/Boston_Skylights/radFiles/_GlassInt1_74.rad ~/simulation/Boston_Skylights/radFiles/_GlassTak_70.rad > ~/simulation//octrees/Scene_NOSKY.oct
echo ~/simulation//octrees/Scene_NOSKY.oct""",
    fireLogs=False,
    lastRunTime=5551,
    suppressWarnings=False,
    results="/home/mss/simulation/Boston_Skylights/octrees/Scene_NOSKY.oct",
    commands="""mkdir -p ~/simulation/Boston_Skylights/octrees/
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""")  # -> Stdout, Stderr_, Ran

overrides_86 = ApplyOverrides(
    Input_=panel_110,
    OldOct=graft(executessh_wip_22.Stdout),
    NewRads=graft(sky_sunny),
    Target=graft("Scene_Sunny"),
    H=graft(hours_2))  # -> Output, Pairs

# ----
convertpaths_7 = ConvertPaths(I=executessh_wip_22.Stdout)  # -> Linux, Windows
panel_111 = Panel(executessh_wip_22.Stdout)
panel_112 = Panel(convertpaths_7.Windows)
executessh_25 = ExecuteSSH(
    _SSHCommands_=overrides_86.Output,
    Run=executessh_wip_22.Ran,
    addPrefix=True,
    description="oconv -r 2048 -i /home/mss/simulation/Boston_Skylights/octrees/Scene_NOSKY.oct -f ~/simulation/Boston_Skylights/skies/Oslo_sunny_sky_11.rad > ~/simulation//octrees/Scene_Sunny_1100.oct;echo ~/simulation//octrees/Scene_Sunny_1100.oct",
    fireLogs=False,
    lastRunTime=2313,
    suppressWarnings=False,
    results="/home/mss/simulation/Boston_Skylights/octrees/Scene_Sunny_1100.oct",
    commands="oconv -r 2048 -i /home/mss/simulation/Boston_Skylights/octrees/Scene_NOSKY.oct -f ~/simulation/Boston_Skylights/skies/Oslo_sunny_sky_11.rad > ~/simulation/Boston_Skylights/octrees/Scene_Sunny_1100.oct;echo ~/simulation/Boston_Skylights/octrees/Scene_Sunny_1100.oct")  # -> Stdout, Stderr_, Ran

# ----
# OCTREE (overcast)
scene_rads_2 = Text(entwine)
falsestart_6 = LBFalseStartToggle(False)
sky_ovc = Text(execute_ssh_async_2.Stdout)
python_18 = GhPythonScript(x=flatten(scene_rads_2))  # -> a; inputs x: list; same code as python_17
entwine_7 = Entwine(Branch01=sky_ovc, Branch02=scene_rads_2, FlattenInputs=True)  # -> flatten(Radfiles)
panel_113 = Panel("""mkdir -p <proj>/octrees/
oconv -r 2048 -w -f <rads> > <proj>/octrees/<target>
echo <proj>/octrees/<target>""")
and_5 = GateAnd(A=python_18, B=falsestart_6)
join_7 = TextJoin(Text=entwine_7, Join=" ")

# ---- group: Outdated
overrides_87 = ApplyOverrides(Input=panel_113, Rads=graft(join_7), Target=graft("Scene_Overcast.oct"))  # -> Output, Pairs

executessh_26 = ExecuteSSH(
    _SSHCommands_=overrides_87.Output,
    Run=and_5,
    addPrefix=True,
    description="""mkdir -p ~/simulation//octrees/
oconv -r 2048 -w -f ~/simulation/Boston_Skylights/radFiles/opaque_materials.mat ~/simulation/Boston_Skylights/radFiles/_SlabJ_50.rad ~/simulation/Boston_Skylights/radFiles/_SkylightWall_70.rad ~/simulation/Boston_Skylights/radFiles/_Roofs_50.rad ~/simulation/Boston_Skylights/radFiles/_Frames_50.rad ~/simulation/Boston_Skylights/radFiles/_FramesCW_50.rad ~/simulation/Boston_Skylights/radFiles/_FacadeDark_30.rad ~/simulation/Boston_Skylights/radFiles/_ContextMat_30.rad ~/simulation/Boston_Skylights/radFiles/_WallInt_70.rad ~/simulation/Boston_Skylights/radFiles/_WallExt_50.rad ~/simulation/Boston_Skylights/radFiles/_Doors_50.rad ~/simulation/Boston_Skylights/radFiles/_SlabCeiling_80.rad ~/simulation/Boston_Skylights/radFiles/_SlabFloor_30.rad ~/simulation/Boston_Skylights/radFiles/_SlabWall_50.rad ~/simulation/Boston_Skylights/radFiles/_HRRoof1_80.rad ~/simulation/Boston_Skylights/radFiles/_WallInt1_70.rad ~/simulation/Boston_Skylights/radFiles/_Frames1_50.rad ~/simulation/Boston_Skylights/radFiles/_Ground_30.rad ~/simulation/Boston_Skylights/radFiles/_Skylight_Vers1_70.rad ~/simulation/Boston_Skylights/radFiles/_GlassTak_70_mat.mat ~/simulation/Boston_Skylights/radFiles/_GlassFacade_74.rad ~/simulation/Boston_Skylights/radFiles/_Glass_Facade_80.rad ~/simulation/Boston_Skylights/radFiles/_GlassInt1_74.rad ~/simulation/Boston_Skylights/radFiles/_GlassTak_70.rad > ~/simulation//octrees/Scene_Overcast.oct
echo ~/simulation//octrees/Scene_Overcast.oct""",
    fireLogs=False,
    lastRunTime=5583,
    suppressWarnings=False,
    results="/home/mss/simulation/Boston_Skylights/octrees/Scene_Overcast.oct",
    commands="""mkdir -p ~/simulation/Boston_Skylights/octrees/
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""")  # -> Stdout, Stderr_, Ran

# ----
convertpaths_8 = ConvertPaths(I=executessh_26.Stdout)  # -> Linux, Windows
panel_114 = Panel(executessh_26.Stdout)
panel_115 = Panel(convertpaths_8.Windows)
octree_overcast = Text(executessh_26.Stdout)

# ----
# Raytracing (rfluxmtx)
# Generate daylight coefficients
panel_116 = Panel("wc -l < <ptsFile>")
# 2phase DDS simulation
# export PATH=$PATH.:/usr/local/radiance/bin
# export RAYPATH=.:/usr/local/radiance/lib
panel_117 = Panel("""mkdir -p <proj>/mtxs/
rfluxmtx -I+ -w -y <ptcount> -lw 0.0001 -ab 5 -ad 5000 -n <cpus> - <skyglow> -i <octree> < <points> > <proj>/mtxs/<target>;echo <proj>/mtxs/<target>""")
skyglow_3 = Text(skyglow)
octree_3 = Text(octree)
points_2 = Text(ptsfile)

overrides_88 = ApplyOverrides(Input=panel_116, PtsFile=graft(points_2))  # -> Output, DynamicOutput
executessh_27 = ExecuteSSH(_SSHCommands_=overrides_88.Output, Run=run, addPrefix=True, fireLogs=False, lastRunTime=0, suppressWarnings=False)  # -> Stdout, Stderr_, Ran

# ----
# Raytracing (rfluxmtx)
# Generate daylight coefficients black (direct only)
panel_118 = Panel("dcd_illum.mtx")
panel_119 = Panel("""mkdir -p <proj>/mtxs/
rfluxmtx -w -I+ -y <ptcount> -lw 0.0002 -ab 1 -ad 5000 -n <cpus> - <skyglow> -i <octree> < <points> > <proj>/mtxs/<target>;echo <proj>/mtxs/<target>""")
octree_black_2 = Text(octree_black)
skyglow_4 = Text(skyglow_3)
points_3 = Text(points_2)

# ----
# Raytracing suns (rcontrib)
# Calculate illuminance sun coefficients for illuminance calculations
panel_120 = Panel("cdsDDS_illum.mtx")
panel_121 = Panel("""mkdir -p <proj>/mtxs/
rcontrib -w -I+ -ab 1 -y <ptcount> -n <cpus> -ad 256 -lw 1.0e-3 -dc 1 -dt 0 -dj 0 -faf -e MF:6 -f reinhart.cal -b rbin -bn Nrbins -m solar <octree> < <points> > <proj>/mtxs/<target>
echo <proj>/mtxs/<target>""")
octree_blackdds_2 = Text(octree_blackdds)
points_4 = Text(points_3)

# ----
# VIEW
panel_122 = Panel("""mkdir -p <proj>/views/
echo "<vf>" > <proj>/views/<target>.vf
echo <proj>/views/<target>.vf""")
panel_123 = Panel("""vf
target""")
vf = Text(view.ViewfileContent)
file_exists = Panel("[ -f <out> ] && echo \"1\" || echo \"0\"")  # disabled

# ---- group: Outdated
overrides_89 = ApplyOverrides(Input=panel_122, Vf=graft(vf), Target=graft(panel_26))  # -> Output, Pairs

# ----
executessh_wip_23 = ExecuteSSHWIP(
    _SSHCommands_=overrides_89.Output,
    Run=button,
    addPrefix=True,
    description="""mkdir -p ~/simulation/Boston_Skylights/views/
echo "rvu -vtv -vp 7933.28984765046 -2025.36183447449 1326.3641862326 -vd -0.71032209652421 0.702922298552037 0.0366437087065571 -vu 0.0260463288693761 -0.0257749905955232 0.999328393778656 -vh 53.046 -vv 26.991" > ~/simulation/Boston_Skylights/views/Cam1.vf
echo ~/simulation/Boston_Skylights/views/Cam1.vf


- - -

mkdir -p ~/simulation/Boston_Skylights/views/
echo "rvu -vtv -vp 7933.28984765046 -2025.36183447449 1326.3641862326 -vd -0.71032209652421 0.702922298552037 0.0366437087065571 -vu 0.0260463288693761 -0.0257749905955232 0.999328393778656 -vh 53.046 -vv 26.991" > ~/simulation/Boston_Skylights/views/Cam2.vf
echo ~/simulation/Boston_Skylights/views/Cam2.vf


- - -

mkdir -p ~/simulation/Boston_Skylights/views/
echo "rvu -vtv -vp 7933.28984765046 -2025.36183447449 1326.3641862326 -vd -0.71032209652421 0.702922298552037 0.0366437087065571 -vu 0.0260463288693761 -0.0257749905955232 0.999328393778656 -vh 53.046 -vv 26.991" > ~/simulation/Boston_Skylights/views/Cam3.vf
echo ~/simulation/Boston_Skylights/views/Cam3.vf


- - -

mkdir -p ~/simulation/Boston_Skylights/views/
echo "rvu -vtv -vp 7933.28984765046 -2025.36183447449 1326.3641862326 -vd -0.71032209652421 0.702922298552037 0.0366437087065571 -vu 0.0260463288693761 -0.0257749905955232 0.999328393778656 -vh 53.046 -vv 26.991" > ~/simulation/Boston_Skylights/views/Cam4.vf
echo ~/simulation/Boston_Skylights/views/Cam4.vf


- - -

mkdir -p ~/simulation/Boston_Skylights/views/
echo "rvu -vtv -vp 7933.28984765046 -2025.36183447449 1326.3641862326 -vd -0.71032209652421 0.702922298552037 0.0366437087065571 -vu 0.0260463288693761 -0.0257749905955232 0.999328393778656 -vh 53.046 -vv 26.991" > ~/simulation/Boston_Skylights/views/Cam5.vf
echo ~/simulation/Boston_Skylights/views/Cam5.vf


- - -

mkdir -p ~/simulation/Boston_Skylights/views/
echo "rvu -vtv -vp 7933.28984765046 -2025.36183447449 1326.3641862326 -vd -0.71032209652421 0.702922298552037 0.0366437087065571 -vu 0.0260463288693761 -0.0257749905955232 0.999328393778656 -vh 53.046 -vv 26.991" > ~/simulation/Boston_Skylights/views/Cam6.vf
echo ~/simulation/Boston_Skylights/views/Cam6.vf


- - -

mkdir -p ~/simulation/Boston_Skylights/views/
echo "rvu -vtv -vp 7933.28984765046 -2025.36183447449 1326.3641862326 -vd -0.71032209652421 0.702922298552037 0.0366437087065571 -vu 0.0260463288693761 -0.0257749905955232 0.999328393778656 -vh 53.046 -vv 26.991" > ~/simulation/Boston_Skylights/views/Cam7.vf
echo ~/simulation/Boston_Skylights/views/Cam7.vf""",
    fireLogs=False,
    lastRunTime=87,
    suppressWarnings=False,
    results=["/home/mss/simulation/Boston_Skylights/views/Cam1.vf", "/home/mss/simulation/Boston_Skylights/views/Cam2.vf", "/home/mss/simulation/Boston_Skylights/views/Cam3.vf", "/home/mss/simulation/Boston_Skylights/views/Cam4.vf", "/home/mss/simulation/Boston_Skylights/views/Cam5.vf", "/home/mss/simulation/Boston_Skylights/views/Cam6.vf", "/home/mss/simulation/Boston_Skylights/views/Cam7.vf"],
    commands=["""mkdir -p ~/simulation/Boston_Skylights/views/
echo "rvu -vtv -vp 54.5230655275731 189.771132179741 112.530451883617 -vd -0.85952360010473 -0.510373595832576 0.0271656684057192 -vu 0.0233581535476728 0.013869758569378 0.999630945129286 -vh 91.803 -vv 70.000" > ~/simulation/Boston_Skylights/views/Cam1.vf
echo ~/simulation/Boston_Skylights/views/Cam1.vf""", """mkdir -p ~/simulation/Boston_Skylights/views/
echo "rvu -vtv -vp 50.4828571934949 187.009885611687 112.509728580697 -vd 0.7734653154054 0.633746198330596 0.0108241381339125 -vu -0.00695467374532792 -0.00859062828809754 0.999938914943664 -vh 102.080 -vv 80.000" > ~/simulation/Boston_Skylights/views/Cam3.vf
echo ~/simulation/Boston_Skylights/views/Cam3.vf""", """mkdir -p ~/simulation/Boston_Skylights/views/
echo "rvu -vtv -vp 54.6845244921237 189.348915704866 112.414046701193 -vd -3.9824366185726 -0.263542053898362 -0.0495895440462135 -vu 0.000151577855316523 -0.00234164963676892 0.999997246846776 -vh 91.803 -vv 70.000" > ~/simulation/Boston_Skylights/views/Cam2.vf
echo ~/simulation/Boston_Skylights/views/Cam2.vf""", """mkdir -p ~/simulation/Boston_Skylights/views/
echo "rvu -vtv -vp 52.4879514614889 188.453946167836 113.702223989042 -vd -0.00461986121715866 0.000401349762764 -0.999989247842547 -vu 2.4759381993107 -1.0317243928877 -0.0103480042752579 -vh 91.959 -vv 70.000" > ~/simulation/Boston_Skylights/views/Cam5.vf
echo ~/simulation/Boston_Skylights/views/Cam5.vf""", """mkdir -p ~/simulation/Boston_Skylights/views/
echo "rvu -vtv -vp 48.6020092000174 188.449847392455 119.102268363039 -vd 0.78736495462714 0.120483768751791 -0.604599114862374 -vu 0.597642529011398 0.0914521580348253 0.796529918024197 -vh 80.789 -vv 60.000" > ~/simulation/Boston_Skylights/views/Cam7.vf
echo ~/simulation/Boston_Skylights/views/Cam7.vf""", """mkdir -p ~/simulation/Boston_Skylights/views/
echo "rvu -vtv -vp 52.6009046664929 188.949040897885 110.964684689863 -vd -0.00483739981681815 0.00200371661074713 0.999986292247427 -vu -0.923866868199248 0.382678186635285 -0.0052359638314198 -vh 102.080 -vv 80.000" > ~/simulation/Boston_Skylights/views/Cam6.vf
echo ~/simulation/Boston_Skylights/views/Cam6.vf""", """mkdir -p ~/simulation/Boston_Skylights/views/
echo "rvu -vtv -vp 49.3858789738135 185.596802248437 112.396681775761 -vd 0.932176057811527 0.361280574108371 -0.0228941917281891 -vu 0.0204987470257173 0.0104619153249619 0.999735139773585 -vh 91.803 -vv 70.000" > ~/simulation/Boston_Skylights/views/Cam4.vf
echo ~/simulation/Boston_Skylights/views/Cam4.vf"""])  # -> Stdout, Stderr_, Ran
item_6 = ListItem(List=flatten(executessh_wip_23.Stdout), Index=0, Wrap=True)  # disabled
panel_124 = Panel(executessh_wip_23.Stdout)
overrides_90 = ApplyOverrides(Input=file_exists, Out=graft(item_6))  # -> Output, Pairs; disabled
executessh_wip_24 = ExecuteSSHWIP(
    SSHCommands=overrides_90.Output,
    Run=executessh_26.Ran,
    addPrefix=False,
    description="[ -f /home/lio/simulation/boston/views/Perspective.vf ] && echo \"1\" || echo \"0\"",
    fireLogs=False,
    lastRunTime=8,
    suppressWarnings=True,
    results="0",
    commands="[ -f /home/lio/simulation/boston/views/Perspective.vf ] && echo \"1\" || echo \"0\"")  # -> Stdout, Stderr, Ran; disabled

pt_count_2 = Panel(executessh_27.Stdout)
ptscount = Integer(executessh_27.Stdout)

overrides_91 = ApplyOverrides(
    Input=panel_117,
    ptcount=graft(ptscount),
    skyglow=graft(skyglow_3),
    octree=graft(octree_3),
    points=graft(points_2),
    target=graft("dc_illum.mtx"))  # -> Output, DynamicOutput
executessh_28 = ExecuteSSH(
    _SSHCommands_=overrides_91.Output,
    Run=executessh_27.Ran,
    addPrefix=True,
    fireLogs=False,
    lastRunTime=0,
    suppressWarnings=False)  # -> Stdout, Stderr_, Ran

panel_125 = Panel(overrides_91.Output)
panel_126 = Panel(executessh_28.Stdout)

ptscount_2 = Integer(ptscount)
overrides_92 = ApplyOverrides(
    Input=panel_119,
    Ptcount=graft(ptscount_2),
    Skyglow=graft(skyglow_4),
    Octree=graft(octree_black_2),
    Points=graft(points_3),
    Target=graft(panel_118))  # -> Output, Pairs
panel_127 = Panel(overrides_92.Output)

ptscount_3 = Integer(ptscount_2)

# ---- group: Outdated
overrides_93 = ApplyOverrides(
    Input=panel_121,
    Ptcount=graft(ptscount_3),
    Octree=graft(octree_blackdds_2),
    Points=graft(points_4),
    Target=graft(panel_120))  # -> Output, Pairs

# ----
executessh_wip_25 = ExecuteSSHWIP(
    _SSHCommands_=overrides_92.Output,
    Run=executessh_28.Ran,
    addPrefix=True,
    description="""mkdir -p ~/simulation//mtxs/
rfluxmtx -w -I+ -y <ptcount> -lw 0.0002 -ab 1 -ad 5000 -n 63 - ~/simulation/Boston_Skylights/radFiles/skyglow_3ph.rad -i /home/mss/simulation/Boston_Skylights/octrees/my_geometry_black.oct < <points> > ~/simulation//mtxs/dcd_illum.mtx;echo ~/simulation//mtxs/dcd_illum.mtx""",
    fireLogs=False,
    lastRunTime=5289,
    suppressWarnings=False,
    results="/home/mss/simulation/Boston_Skylights/mtxs/dcd_illum.mtx",
    commands="""mkdir -p ~/simulation/Boston_Skylights/mtxs/
rfluxmtx -w -I+ -y 154 -lw 0.0002 -ab 1 -ad 5000 -n 11 - ~/simulation/Boston_Skylights/radFiles/skyglow_3ph.rad -i /home/mss/simulation/Boston_Skylights/octrees/my_geometry_black.oct < /home/mss/simulation/Boston_Skylights/points/0.pts > ~/simulation/Boston_Skylights/mtxs/dcd_illum.mtx;echo ~/simulation/Boston_Skylights/mtxs/dcd_illum.mtx""")  # -> Stdout, Stderr_, Ran

panel_128 = Panel(executessh_wip_25.Stdout)

executessh_wip_26 = ExecuteSSHWIP(
    _SSHCommands_=overrides_93.Output,
    Run=executessh_wip_25.Ran,
    addPrefix=True,
    description="""mkdir -p ~/simulation//mtxs/
rcontrib -w -I+ -ab 1 -y <ptcount> -n 63 -ad 256 -lw 1.0e-3 -dc 1 -dt 0 -dj 0 -faf -e MF:6 -f reinhart.cal -b rbin -bn Nrbins -m solar /home/mss/simulation/Boston_Skylights/octrees/my_geometry_black_sunCoeffecientsDDS.oct < <points> > ~/simulation//mtxs/cdsDDS_illum.mtx
echo ~/simulation//mtxs/cdsDDS_illum.mtx""",
    fireLogs=False,
    lastRunTime=29278,
    suppressWarnings=False,
    results="""_JOIN_
_JOIN_
/home/mss/simulation/Boston_Skylights/mtxs/cdsDDS_illum.mtx""",
    commands="""mkdir -p ~/simulation/Boston_Skylights/mtxs/
_JOIN_
rcontrib -w -I+ -ab 1 -y 154 -n 11 -ad 256 -lw 1.0e-3 -dc 1 -dt 0 -dj 0 -faf -e MF:6 -f reinhart.cal -b rbin -bn Nrbins -m solar /home/mss/simulation/Boston_Skylights/octrees/my_geometry_black_sunCoeffecientsDDS.oct < /home/mss/simulation/Boston_Skylights/points/0.pts > ~/simulation/Boston_Skylights/mtxs/cdsDDS_illum.mtx
_JOIN_
echo ~/simulation/Boston_Skylights/mtxs/cdsDDS_illum.mtx""")  # -> Stdout, Stderr_, Ran

# ----
# pick between existing BSDF
# files from library!
panel_129 = Panel("find <LinuxHome>/BSDF_Files/ -type f -name \"<p>*.xml\"")
filter = ValueList({"None": "awodkwa", "This project only": "<projname>", "All projects": ""}, selected="All projects")
grep_filter = Panel("")

# ---- group: Outdated
overrides_94 = ApplyOverrides(Input_=panel_129, P=graft(filter))  # -> Output, Pairs

# ----
# overture should now automatically be included in rtpict
# Parallel RTPICT render with ambient cache
viewfile = Text(executessh_wip_23.Stdout)
octree_4 = Text(executessh_25.Stdout)
octree_overcast_2 = Text(octree_overcast)
entwine_8 = Entwine(Branch00=octree_overcast_2, Branch01=octree_4, FlattenInputs=True)  # -> flatten(Result)
division = Division(A=resolution, B=1.5)
octree_5 = Text(graft(entwine_8))
list = ItemSelector(
    octree_5,
    {"/home/mss/simulation/Boston_Skylights/octrees/Scene_Overcast.oct", "/home/mss/simulation/Boston_Skylights/octrees/Scene_Sunny_1100.oct"}, selected="/home/mss/simulation/Boston_Skylights/octrees/Scene_Overcast.oct")
y = Number(division)
eval = Evaluate(F="x=y", x=octree_5, y=list)
panel_130 = Panel("-ab 3 -ad 4096 -lw 0.0003 -aa 0.1 -ar 256 -as 1024")
panel_131 = Panel("""mkdir -p <proj>/images/
rtpict -n <cpus-1> -w -vf <vf> -x 400 -y 300 <radOptions> -af <ambFile> <oct> > /dev/null
rtpict -n <cpus-1> -w -vf <vf> -x <x> -y <y> <radOptions> -af <ambFile> <oct> | pfilt -x /2 -y /2 > <proj>/images/<target>;echo <proj>/images/<target>""")
x_3 = Number(x)
y_2 = Number(y)
run_3 = LBFalseStartToggle(False)

hours_3 = Text()
entwine_9 = Entwine(Branch00="ovc", Branch01=hours_3, FlattenInputs=True)  # -> flatten(Result)
cull_14 = CullPattern(List=graft(entwine_9), CullPattern=eval)  # -> flatten(List)
hours_4 = Text(cull_14)

executessh_wip_27 = ExecuteSSHWIP(
    _SSHCommands_=overrides_94.Output,
    Run=Toggle(True),
    addPrefix=True,
    description="find <LinuxHome>/BSDF_Files/ -type f -name \"*.xml\"",
    fireLogs=False,
    lastRunTime=0,
    suppressWarnings=False,
    commands="find <LinuxHome>/BSDF_Files/ -type f -name \"*.xml\"")  # -> Stdout, Stderr_, Ran
split_2 = TextSplit(Text=executessh_wip_27.Stdout)
panel_132 = Panel(split_2)

# ---- group: Outdated
overrides_95 = ApplyOverrides(Input_="echo <in> | grep \"<grep>\"", In=graft(split_2), Grep=graft(grep_filter))  # -> Output, Pairs

# ----
# Getting results (dctimestep)
# mkdir -p <proj>/results/
# dctimestep <dcillum> <skymtx> > <proj>/results/dctimestep_dcillum_skymtx.txt
panel_133 = Panel("""mkdir -p <proj>/results/
dctimestep <dcillum> <skymtx> | rmtxop -fa -t -c 47.4 119.9 11.6 - > <proj>/results/<target>;echo <proj>/results/<target>""")
and_6 = GateAnd(A=executessh_wip_8.Ran, B=executessh_28.Ran)
execute_ssh_async_6 = ExecuteSSHAsync(
    _SSHCommands_=<missing>,
    Run=and_6,
    addPrefix=True,
    addSuffix=True,
    description="mkdir -p ~/simulation/Boston_Skylights/results/;dctimestep /home/mss/simulation/Boston_Skylights/mtxs/dc_illum.mtx /home/mss/simulation/weatherData/NOR_Oslo.Fornebu.014880_IWEC_m1.smx | rmtxop -fa -t -c 47.4 119.9 11.6 - > ~/simulation/Boston_Skylights/results/annualR_DC.ill;echo ~/simulation/Boston_Skylights/results/annualR_DC.ill",
    fireLogs=False,
    stdouts="/home/mss/simulation/Boston_Skylights/results/annualR_DC.ill",
    suppressWarnings=False)  # -> Stdout, Stderr_, port, port_2, Ran

overrides_96 = ApplyOverrides(Input=panel_133, dcillum=graft(executessh_28.Stdout), skymtx=graft(skymtx), target=graft("annualR_DC.ill"))  # -> Output, DynamicOutput
executessh_29 = ExecuteSSH(_SSHCommands_=overrides_96.Output, Run=and_6, addPrefix=True, fireLogs=False, lastRunTime=0, suppressWarnings=False)  # -> Stdout, Stderr_, Ran

panel_134 = Panel(overrides_96.Output)
panel_135 = Panel(executessh_29.Stdout)

dcillum = Text(executessh_wip_25.Stdout)
skymtx_2 = Text(executessh_wip_13.Stdout)
panel_136 = Panel("""mkdir -p <proj>/results/
dctimestep <dcillum> <skymtx> | rmtxop -fa -t -c 47.4 119.9 11.6 - > <proj>/results/<target>;echo <proj>/results/<target>""")
and_7 = GateAnd(A=executessh_wip_25.Ran, B=executessh_wip_13.Ran)
execute_ssh_async_7 = ExecuteSSHAsync(
    _SSHCommands_=overrides_35.Output,
    Run=and_7,
    addPrefix=True,
    addSuffix=True,
    description="mkdir -p ~/simulation/Boston_Skylights/results/;dctimestep /home/mss/simulation/Boston_Skylights/mtxs/dcd_illum.mtx /home/mss/simulation/weatherData/NOR_Oslo.Fornebu.014880_IWEC_d_m1.smx | rmtxop -fa -t -c 47.4 119.9 11.6 - > ~/simulation/Boston_Skylights/results/annualR_DCD.ill;echo ~/simulation/Boston_Skylights/results/annualR_DCD.ill",
    fireLogs=True,
    name="Run dctimestep",
    staticDescription="used for direct sun check",
    stdouts="/home/mss/simulation/Boston_Skylights/results/annualR_DCD.ill",
    suppressWarnings=True)  # -> Stdout, Stderr, port, port_2, Ran

overrides_97 = ApplyOverrides(Input=panel_136, dcillum=graft(dcillum), skymtx=graft(skymtx_2), target=graft("annualR_DCD.ill"))  # -> Output, DynamicOutput
executessh_30 = ExecuteSSH(_SSHCommands_=overrides_97.Output, Run=and_7, addPrefix=True, fireLogs=False, lastRunTime=0, suppressWarnings=False)  # -> Stdout, Stderr_, Ran

panel_137 = Panel(overrides_97.Output)
panel_138 = Panel(executessh_30.Stdout)

panel_139 = Panel("""mkdir -p <proj>/results/
dctimestep <dcillum> <skymtx> | rmtxop -fa -t -c 47.4 119.9 11.6 - > <proj>/results/<target>;echo <proj>/results/<target>""")
m6_sky_mtx = Text(panel_89)
and_8 = GateAnd(A=executessh_wip_14.Ran, B=executessh_wip_26.Ran)
execute_ssh_async_8 = ExecuteSSHAsync(
    _SSHCommands_=<missing>,
    Run=and_8,
    addPrefix=True,
    addSuffix=True,
    description="mkdir -p ~/simulation/Boston_Skylights/results/;dctimestep /home/mss/simulation/Boston_Skylights/mtxs/cdsDDS_illum.mtx /home/mss/simulation/weatherData/NOR_Oslo.Fornebu.014880_IWEC_d_m6.smx | rmtxop -fa -t -c 47.4 119.9 11.6 - > ~/simulation/Boston_Skylights/results/annualR_CDS.ill;echo ~/simulation/Boston_Skylights/results/annualR_CDS.ill",
    fireLogs=True,
    name="Run dctimestep",
    staticDescription="used for direct sun check",
    stdouts="/home/mss/simulation/Boston_Skylights/results/annualR_CDS.ill",
    suppressWarnings=True)  # -> Stdout, Stderr, port, port_2, Ran

overrides_98 = ApplyOverrides(Input=panel_139, dcillum=graft(executessh_wip_26.Stdout), skymtx=graft(m6_sky_mtx), target=graft("annualR_CDS.ill"))  # -> Output, DynamicOutput
executessh_31 = ExecuteSSH(_SSHCommands_=overrides_98.Output, Run=and_8, addPrefix=True, fireLogs=False, lastRunTime=0, suppressWarnings=False)  # -> Stdout, Stderr_, Ran

panel_140 = Panel(overrides_98.Output)
panel_141 = Panel(executessh_31.Stdout)

overrides_99 = ApplyOverrides(Input=panel_28, Text=graft(executessh_31.Stdout))  # -> Output, DynamicOutput
panel_142 = Panel(executessh_31.Stderr_)

# ----
# Parallel RTPICT render (luminance) no cache
viewfile_2 = Text(executessh_wip_23.Stdout)
octree_6 = Text(executessh_25.Stdout)
octree_overcast_3 = Text(octree_overcast)
division_2 = Division(A=resolution_2, B=1.2)
entwine_10 = Entwine(Branch00=octree_overcast_3, Branch01=octree_6, FlattenInputs=True)  # -> flatten(Result)
octree_7 = Text(graft(entwine_10))
list_2 = ItemSelector(
    octree_7,
    {"/home/mss/simulation/Boston_Skylights/octrees/Scene_Overcast.oct", "/home/mss/simulation/Boston_Skylights/octrees/Scene_Sunny_1100.oct"}, selected="/home/mss/simulation/Boston_Skylights/octrees/Scene_Overcast.oct")
panel_143 = Panel("""mkdir -p <proj>/images/
rtpict -n <cpus-1> -w -vf <vf> -x <x> -y <y> <radOptions> <oct> | pfilt -x /4 -y /4 -r 0.7 | ra_rgbe -r > <proj>/images/<target>;echo <proj>/images/<target>""")
eval_2 = Evaluate(F="x=y", x=octree_7, y=list_2)
x_4 = Number(x_2)
run_4 = LBFalseStartToggle(False)

python_19 = GhPythonScript(x=viewfile_2)  # -> a
# ---------- python_19: Python ----------
__author__ = "mm1013"
__version__ = "2022.09.13"

import rhinoscriptsyntax as rs

a = x.split("/")[-1].split(".")[0]
# ---------- end python_19 ----------
y_3 = Number(division_2)

hours_5 = Text(hours)
entwine_11 = Entwine(Branch00="ovc", Branch01=hours_5, FlattenInputs=True)  # -> flatten(Result)
cull_15 = CullPattern(List=graft(entwine_11), CullPattern=eval_2)  # -> flatten(List)
hours_6 = Text(cull_15)

# ----
# import BSDFS
# use me if you want to upload a BSDF
# file from windows and use.
# 
# Have in mind that the BSDF should
# be combined of glass and shading
panel_144 = Panel("C:\Users\mm1013\Downloads\8mm MS-F 6014 Rot 90.xml")
overrides_100 = ApplyOverrides(Input_="<LinuxHome>/")  # -> Output, Pairs
falsestart_7 = LBFalseStartToggle(False)
cluster_4 = Cluster_4(x=overrides_100.Output)
panel_145 = Panel("""mkdir -p <LinuxHome>/BSDF_Files
cp <bsdfFrom> <LinuxHome>/BSDF_Files/<projname>_<bsdfTo>
rm <bsdfFrom>
echo <LinuxHome>/BSDF_Files/<projname>_<bsdfTo>""")
upload_2 = Upload(LocalFilePaths=panel_144, SubfolderOverride=cluster_4, Run=falsestart_7, stdouts="~/simulation/8mm MS-F 6014 Rot 90.xml")  # -> Status, FilePaths, Ran
python_20 = GhPythonScript(x=upload_2.FilePaths)  # -> a
# ---------- python_20: Python ----------
__author__ = "mm1013"
__version__ = "2022.09.09"

import rhinoscriptsyntax as rs

a = x = x.replace(" ","\ ")
# ---------- end python_20 ----------
python_21 = GhPythonScript(x=upload_2.FilePaths)  # -> a
# ---------- python_21: Python ----------
__author__ = "mm1013"
__version__ = "2022.09.09"

import rhinoscriptsyntax as rs

a = x.split("/")[-1].replace(" ","_")
# ---------- end python_21 ----------

# ---- group: Outdated
overrides_101 = ApplyOverrides(Input_=panel_145, BsdfFrom=graft(python_20), BsdfTo=graft(python_21))  # -> Output, Pairs

# ----
executessh_wip_28 = ExecuteSSHWIP(
    _SSHCommands_=overrides_101.Output,
    Run=upload_2.Ran,
    addPrefix=True,
    description="""mkdir -p <LinuxHome>/BSDF_Files
cp ~/simulation/8mm\ MS-F\ 6014\ Rot\ 90.xml <LinuxHome>/BSDF_Files/Boston_Skylights_8mm_MS-F_6014_Rot_90.xml
rm ~/simulation/8mm\ MS-F\ 6014\ Rot\ 90.xml
echo <LinuxHome>/BSDF_Files/Boston_Skylights_8mm_MS-F_6014_Rot_90.xml""",
    fireLogs=False,
    lastRunTime=8,
    suppressWarnings=False,
    results="/home/mss/simulation/BSDF_Files/boston2_8mm_MS-F_6014_Rot_90.xml",
    commands="""mkdir -p ~/simulation/BSDF_Files
cp ~/simulation/8mm\ MS-F\ 6014\ Rot\ 90.xml ~/simulation/BSDF_Files/boston2_8mm_MS-F_6014_Rot_90.xml
rm ~/simulation/8mm\ MS-F\ 6014\ Rot\ 90.xml
echo ~/simulation/BSDF_Files/boston2_8mm_MS-F_6014_Rot_90.xml""")  # -> Stdout, Stderr_, Ran
cluster_5 = Cluster_5(x=executessh_wip_28.Stdout)  # -> bsdf_name, bsdf_path
bsdf_3 = BSDF(bsdf_name=cluster_5.bsdf_name, bsdf_file_path_linux=cluster_5.bsdf_path)

# ----
# exclude frames
panel_146 = Panel("frames")
python_22 = GhPythonScript(opaqueModifiers=radviewer_2.ModifierNames, search=panel_146)  # -> a; inputs opaqueModifiers: list, search: list
# ---------- python_22: Python ----------
__author__ = "mm1013"
__version__ = "2022.09.05"

import rhinoscriptsyntax as rs
#import Grasshopper.DataTree as dt
import ghpythonlib.treehelpers as th


o = []
for l in search:
    o.append([s for s in opaqueModifiers if l.lower() in s.lower()])
    

a = th.list_to_tree(o)
# ---------- end python_22 ----------

# ---- group: Outdated
overrides_102 = ApplyOverrides(Input_="-ae <modifier>", Modifier=graft(python_22))  # -> Output, Pairs

# ----
join_8 = TextJoin(Text=flatten(overrides_102.Output), Join=" ")

panel_147 = Panel("head <ill> -n 13;echo \" \";echo \"Number of lines\";wc -l <ill>")
execute_ssh_async_9 = ExecuteSSHAsync(
    _SSHCommands_=<missing>,
    Run=False,
    addPrefix=True,
    addSuffix=True,
    description="head /home/mss/simulation/test_project2/results/annualR_DC.ill -n 13;echo \" \";echo \"Number of lines\";wc -l /home/mss/simulation/test_project2/results/annualR_DC.ill",
    fireLogs=False,
    stdouts="""#?RADIANCE
rmtxop -fa -t -c 47.4 119.9 11.6 -
dctimestep /home/mss/simulation/test_project2/mtxs/dc_illum.mtx /home/mss/simulation/weatherData/DNK_DRY_OFFICIAL_2001-2010_epw-fil.smx
CAPDATE= 2022:08:18 07:22:23
GMT= 2022:08:18 05:22:23
Applied 1x3 matrix transform
Transposed rows and columns
NROWS=8760
NCOLS=199
NCOMP=1
FORMAT=ascii

 0.000000000000000e+00	 0.000000000000000e+00	 0.000000000000000e+00	 0.000000000000000e+00	 0.000000000000000e+00	 0.000000000000000e+00	 0.000000000000000e+00	 0.000000000000000e+00	 0.000000000000000e+00	 0.000000000000000e+00	 0.000000000000000e+00	 0.000000000000000e+00	 0.000000000000000e+00	 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
 
Number of lines
8772 /home/mss/simulation/test_project2/results/annualR_DC.ill""",
    suppressWarnings=False)  # -> Stdout, Stderr_, Log, port, Ran

overrides_103 = ApplyOverrides(Input=panel_147, Text=graft(executessh_29.Stdout))  # -> Output, DynamicOutput
executessh_32 = ExecuteSSH(
    _SSHCommands_=overrides_103.Output,
    Run=executessh_29.Ran,
    addPrefix=True,
    fireLogs=False,
    lastRunTime=0,
    suppressWarnings=False)  # -> Stdout, Stderr_, Ran

panel_148 = Panel(executessh_32.Stdout)

panel_149 = Panel("head <ill> -n 13;echo \" \";echo \"Number of lines\";wc -l <ill>")
execute_ssh_async_10 = ExecuteSSHAsync(
    _SSHCommands_=<missing>,
    Run=False,
    addPrefix=True,
    addSuffix=True,
    description="head /home/mss/simulation/test_project2/results/annualR_DCD.ill -n 13;echo \" \";echo \"Number of lines\";wc -l /home/mss/simulation/test_project2/results/annualR_DCD.ill",
    fireLogs=False,
    stdouts="""#?RADIANCE
rmtxop -fa -t -c 47.4 119.9 11.6 -
dctimestep /home/mss/simulation/test_project2/mtxs/dcd_illum.mtx /home/mss/simulation/weatherData/DNK_DRY_OFFICIAL_2001-2010_epw-fil_d_m1.smx
CAPDATE= 2022:08:18 07:16:30
GMT= 2022:08:18 05:16:30
Applied 1x3 matrix transform
Transposed rows and columns
NROWS=8760
NCOLS=274
NCOMP=1
FORMAT=ascii

 0.000000000000000e+00	 0.000000000000000e+00	 0.000000000000000e+00	 0.000000000000000e+00	 0.000000000000000e+00	 0.000000000000000e+00	 0.000000000000000e+00	 0.000000000000000e+00	 0.000000000000000e+00	 0.000000000000000e+00	 0.000000000000000e+00	 0.000000000000000e+00	 0.000000000000000e+00	 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
 
Number of lines
8772 /home/mss/simulation/test_project2/results/annualR_DCD.ill""",
    suppressWarnings=False)  # -> Stdout, Stderr_, Log, port, Ran

overrides_104 = ApplyOverrides(Input=panel_149, Text=graft(executessh_30.Stdout))  # -> Output, DynamicOutput
executessh_33 = ExecuteSSH(
    _SSHCommands_=overrides_104.Output,
    Run=executessh_30.Ran,
    addPrefix=True,
    fireLogs=False,
    lastRunTime=0,
    suppressWarnings=False)  # -> Stdout, Stderr_, Ran

panel_150 = Panel(executessh_33.Stdout)

executessh_wip_29 = ExecuteSSHWIP(
    _SSHCommands_=flatten(overrides_95.Output),
    Run=executessh_wip_27.Ran,
    addPrefix=True,
    description="echo <in> | grep \"\"",
    fireLogs=False,
    lastRunTime=9,
    suppressWarnings=False,
    results="""/home/mss/simulation/BSDF_Files/8mm MS-F 6014 Rot 90.xml
_JOIN_
/home/mss/simulation/BSDF_Files/barnehagen_blinds_001_GlassLT_70.xml
_JOIN_
/home/mss/simulation/BSDF_Files/barnehagen__GlassLT_15.xml
_JOIN_
/home/mss/simulation/BSDF_Files/barnehagen__GlassLT_70.xml
_JOIN_
/home/mss/simulation/BSDF_Files/boston2_8mm_MS-F_6014_Rot_90.xml
_JOIN_
/home/mss/simulation/BSDF_Files/boston2_blinds_001_GlassLT_70.xml""",
    commands="""echo /home/mss/simulation/BSDF_Files/8mm MS-F 6014 Rot 90.xml | grep ""
_JOIN_
echo /home/mss/simulation/BSDF_Files/barnehagen_blinds_001_GlassLT_70.xml | grep ""
_JOIN_
echo /home/mss/simulation/BSDF_Files/barnehagen__GlassLT_15.xml | grep ""
_JOIN_
echo /home/mss/simulation/BSDF_Files/barnehagen__GlassLT_70.xml | grep ""
_JOIN_
echo /home/mss/simulation/BSDF_Files/boston2_8mm_MS-F_6014_Rot_90.xml | grep ""
_JOIN_
echo /home/mss/simulation/BSDF_Files/boston2_blinds_001_GlassLT_70.xml | grep ""
""")  # -> Stdout, Stderr_, Ran
cluster_6 = Cluster_5(x=executessh_wip_29.Stdout)  # -> bsdf_name, bsdf_path
bsdf_4 = BSDF(bsdf_name=graft(cluster_6.bsdf_name), bsdf_file_path_linux=graft(cluster_6.bsdf_path))
panel_151 = Panel(cluster_6.bsdf_path)
panel_152 = Panel(bsdf_4)

list_3 = ItemSelector(
    bsdf_4,
    {"8mm_MS-F_6014_Rot_90;/home/mss/simulation/BSDF_Files/8mm MS-F 6014 Rot 90.xml", "barnehagen_blinds_001_GlassLT_70;/home/mss/simulation/BSDF_Files/barnehagen_blinds_001_GlassLT_70.xml", "barnehagen__GlassLT_15;/home/mss/simulation/BSDF_Files/barnehagen__GlassLT_15.xml", "barnehagen__GlassLT_70;/home/mss/simulation/BSDF_Files/barnehagen__GlassLT_70.xml", "boston2_8mm_MS-F_6014_Rot_90;/home/mss/simulation/BSDF_Files/boston2_8mm_MS-F_6014_Rot_90.xml", "boston2_blinds_001_GlassLT_70;/home/mss/simulation/BSDF_Files/boston2_blinds_001_GlassLT_70.xml"}, selected=[])

dam_3 = DataDam(DataA=list_3, BufferDelay=10000000, BufferMode=0)

bsdf_5 = BSDF_2(bsdf_pairs=dam_3)  # -> name_2, path_2

# ----
# Parallel RTPICT render (Illuminance)
# (takes 2.5X longer than above...)
panel_153 = Panel("""mkdir -p <proj>/images/
rtpict -i -w -n <cpus-2> -vf <vf> -x <x> -y <y> <radOptions> <oct> | pfilt -x /4 -y /4 -r 0.7 | ra_rgbe -r > <proj>/images/<target>;echo <proj>/images/<target>""")
run_5 = LBFalseStartToggle(False)
y_4 = Number(y_3)
x_5 = Number(x_2)

merge_3 = Merge(Data1=panel_130, Data2=list, Data3=join_8, Data4=Button())  # -> flatten(Result)
python_23 = GhPythonScript(update=merge_3)  # -> time; inputs update: tree
# ---------- python_23: Python ----------
#if not update:
#    return self.time
"""Provides a scripting component.
    Inputs:
        x: The x script variable
        y: The y script variable
    Output:
        a: The a output variable"""
        
__author__ = "mm1013"
__version__ = "2022.08.30"
        
import rhinoscriptsyntax as rs
        
from datetime import datetime
dt = datetime.now()
        
time = "%02d_%02d_%02d_%02d%02d_%02d" % (dt.year, dt.month, dt.day, dt.hour, dt.minute, dt.second)
# ---------- end python_23 ----------

# ---- group: Outdated
overrides_105 = ApplyOverrides(Input_="ambfile_<time>.af", Time=graft(python_23))  # -> Output, Pairs

# ----
# rmtxop (matrixmultiplication for grid based)
# mkdir -p <proj>/results/3PhGrid
# rmtxop <vmx> <bsdf> <dmx> <smx> | rmtxop -fa -c 47.4 119.9 11.6 - > <proj>/results/3PhGrid/<aperture><bsdfName>.ill
# echo "<proj>/results/3PhGrid/<aperture><bsdfName>.ill"
skymtx_3 = Text(skymtx)
glassname_3 = Text(python_13)
roomnumber_3 = Text(roomnumber)
vmx_grid_2 = Text(vmx_grid)
panel_154 = Panel("""mkdir -p <proj>/results/3PhGrid
rmtxop <vmx> <bsdf> <dmx> <smx> | rmtxop -fa -c 47.4 119.9 11.6 - | rcollate -t > <proj>/results/3PhGrid/<room>_<aperture>_<bsdfName>.ill
echo "<proj>/results/3PhGrid/<room>_<aperture>_<bsdfName>.ill"
""")
dmx_3 = Text(dmx_2)
m_3 = GhPythonScript(i=roomnumber_3)  # -> i1, simplify(i2); inputs i: Int32; same code as m
falsestart_8 = LBFalseStartToggle(False)

abx_7 = ABX(data=glassname_3, pathCount=panel_59)  # -> data; inputs data: tree, pathCount: Int32; same code as abx_4

overrides_106 = ApplyOverrides(
    Input=panel_131,
    RadOptions=graft(panel_130),
    X=graft(x_3),
    Y=graft(y_2),
    Vf=graft(viewfile),
    Oct=graft(list),
    Target=graft("<time>_rtpict_rendering_aa0.1_<x>_sunny_ad4096_<h>.hdr"),
    Time=graft("<time>"),
    H=graft(hours_4),
    AmbFile=graft(overrides_105.Output),
    ExcludeFiles=graft(join_8))  # -> Output, Pairs
python_24 = GhPythonScript(update=overrides_106.Pairs)  # -> time; inputs update: tree; same code as python_23

# ---- group: Outdated
overrides_107 = ApplyOverrides(Input_=overrides_106.Output, Time=graft(python_24))  # -> Output, Pairs

# ----
executessh_34 = ExecuteSSH(
    _SSHCommands_=flatten(overrides_107.Output),
    Run=run_3,
    addPrefix=True,
    description="""mkdir -p ~/simulation//images/
rtpict -n 62 -w -vf /home/mss/simulation/Boston_Skylights/views/Cam1.vf -x 400 -y 300 -ab 3 -ad 4096 -lw 0.0003 -aa 0.1 -ar 256 -as 1024 -af ambfile_2023_09_01_1155_00.af /home/mss/simulation/Boston_Skylights/octrees/Scene_Overcast.oct > /dev/null
rtpict -n 62 -w -vf /home/mss/simulation/Boston_Skylights/views/Cam1.vf -x 5000 -y 3333.333333 -ab 3 -ad 4096 -lw 0.0003 -aa 0.1 -ar 256 -as 1024 -af ambfile_2023_09_01_1155_00.af /home/mss/simulation/Boston_Skylights/octrees/Scene_Overcast.oct | pfilt -x /2 -y /2 > ~/simulation//images/2023_09_01_1155_00_rtpict_rendering_aa0.1_5000_sunny_ad4096_ovc.hdr;echo ~/simulation//images/2023_09_01_1155_00_rtpict_rendering_aa0.1_5000_sunny_ad4096_ovc.hdr
mkdir -p ~/simulation//images/
rtpict -n 62 -w -vf /home/mss/simulation/Boston_Skylights/views/Cam2.vf -x 400 -y 300 -ab 3 -ad 4096 -lw 0.0003 -aa 0.1 -ar 256 -as 1024 -af ambfile_2023_09_01_1155_00.af /home/mss/simulation/Boston_Skylights/octrees/Scene_Overcast.oct > /dev/null
rtpict -n 62 -w -vf /home/mss/simulation/Boston_Skylights/views/Cam2.vf -x 5000 -y 3333.333333 -ab 3 -ad 4096 -lw 0.0003 -aa 0.1 -ar 256 -as 1024 -af ambfile_2023_09_01_1155_00.af /home/mss/simulation/Boston_Skylights/octrees/Scene_Overcast.oct | pfilt -x /2 -y /2 > ~/simulation//images/2023_09_01_1155_00_rtpict_rendering_aa0.1_5000_sunny_ad4096_ovc.hdr;echo ~/simulation//images/2023_09_01_1155_00_rtpict_rendering_aa0.1_5000_sunny_ad4096_ovc.hdr
mkdir -p ~/simulation//images/
rtpict -n 62 -w -vf /home/mss/simulation/Boston_Skylights/views/Cam3.vf -x 400 -y 300 -ab 3 -ad 4096 -lw 0.0003 -aa 0.1 -ar 256 -as 1024 -af ambfile_2023_09_01_1155_00.af /home/mss/simulation/Boston_Skylights/octrees/Scene_Overcast.oct > /dev/null
rtpict -n 62 -w -vf /home/mss/simulation/Boston_Skylights/views/Cam3.vf -x 5000 -y 3333.333333 -ab 3 -ad 4096 -lw 0.0003 -aa 0.1 -ar 256 -as 1024 -af ambfile_2023_09_01_1155_00.af /home/mss/simulation/Boston_Skylights/octrees/Scene_Overcast.oct | pfilt -x /2 -y /2 > ~/simulation//images/2023_09_01_1155_00_rtpict_rendering_aa0.1_5000_sunny_ad4096_ovc.hdr;echo ~/simulation//images/2023_09_01_1155_00_rtpict_rendering_aa0.1_5000_sunny_ad4096_ovc.hdr
mkdir -p ~/simulation//images/
rtpict -n 62 -w -vf /home/mss/simulation/Boston_Skylights/views/Cam4.vf -x 400 -y 300 -ab 3 -ad 4096 -lw 0.0003 -aa 0.1 -ar 256 -as 1024 -af ambfile_2023_09_01_1155_00.af /home/mss/simulation/Boston_Skylights/octrees/Scene_Overcast.oct > /dev/null
rtpict -n 62 -w -vf /home/mss/simulation/Boston_Skylights/views/Cam4.vf -x 5000 -y 3333.333333 -ab 3 -ad 4096 -lw 0.0003 -aa 0.1 -ar 256 -as 1024 -af ambfile_2023_09_01_1155_00.af /home/mss/simulation/Boston_Skylights/octrees/Scene_Overcast.oct | pfilt -x /2 -y /2 > ~/simulation//images/2023_09_01_1155_00_rtpict_rendering_aa0.1_5000_sunny_ad4096_ovc.hdr;echo ~/simulation//images/2023_09_01_1155_00_rtpict_rendering_aa0.1_5000_sunny_ad4096_ovc.hdr
mkdir -p ~/simulation//images/
rtpict -n 62 -w -vf /home/mss/simulation/Boston_Skylights/views/Cam5.vf -x 400 -y 300 -ab 3 -ad 4096 -lw 0.0003 -aa 0.1 -ar 256 -as 1024 -af ambfile_2023_09_01_1155_00.af /home/mss/simulation/Boston_Skylights/octrees/Scene_Overcast.oct > /dev/null
rtpict -n 62 -w -vf /home/mss/simulation/Boston_Skylights/views/Cam5.vf -x 5000 -y 3333.333333 -ab 3 -ad 4096 -lw 0.0003 -aa 0.1 -ar 256 -as 1024 -af ambfile_2023_09_01_1155_00.af /home/mss/simulation/Boston_Skylights/octrees/Scene_Overcast.oct | pfilt -x /2 -y /2 > ~/simulation//images/2023_09_01_1155_00_rtpict_rendering_aa0.1_5000_sunny_ad4096_ovc.hdr;echo ~/simulation//images/2023_09_01_1155_00_rtpict_rendering_aa0.1_5000_sunny_ad4096_ovc.hdr
mkdir -p ~/simulation//images/
rtpict -n 62 -w -vf /home/mss/simulation/Boston_Skylights/views/Cam6.vf -x 400 -y 300 -ab 3 -ad 4096 -lw 0.0003 -aa 0.1 -ar 256 -as 1024 -af ambfile_2023_09_01_1155_00.af /home/mss/simulation/Boston_Skylights/octrees/Scene_Overcast.oct > /dev/null
rtpict -n 62 -w -vf /home/mss/simulation/Boston_Skylights/views/Cam6.vf -x 5000 -y 3333.333333 -ab 3 -ad 4096 -lw 0.0003 -aa 0.1 -ar 256 -as 1024 -af ambfile_2023_09_01_1155_00.af /home/mss/simulation/Boston_Skylights/octrees/Scene_Overcast.oct | pfilt -x /2 -y /2 > ~/simulation//images/2023_09_01_1155_00_rtpict_rendering_aa0.1_5000_sunny_ad4096_ovc.hdr;echo ~/simulation//images/2023_09_01_1155_00_rtpict_rendering_aa0.1_5000_sunny_ad4096_ovc.hdr
mkdir -p ~/simulation//images/
rtpict -n 62 -w -vf /home/mss/simulation/Boston_Skylights/views/Cam7.vf -x 400 -y 300 -ab 3 -ad 4096 -lw 0.0003 -aa 0.1 -ar 256 -as 1024 -af ambfile_2023_09_01_1155_00.af /home/mss/simulation/Boston_Skylights/octrees/Scene_Overcast.oct > /dev/null
rtpict -n 62 -w -vf /home/mss/simulation/Boston_Skylights/views/Cam7.vf -x 5000 -y 3333.333333 -ab 3 -ad 4096 -lw 0.0003 -aa 0.1 -ar 256 -as 1024 -af ambfile_2023_09_01_1155_00.af /home/mss/simulation/Boston_Skylights/octrees/Scene_Overcast.oct | pfilt -x /2 -y /2 > ~/simulation//images/2023_09_01_1155_00_rtpict_rendering_aa0.1_5000_sunny_ad4096_ovc.hdr;echo ~/simulation//images/2023_09_01_1155_00_rtpict_rendering_aa0.1_5000_sunny_ad4096_ovc.hdr""",
    fireLogs=True,
    lastRunTime=4228945,
    name="rtpict",
    suppressWarnings=False,
    results="/home/lio/simulation/boston/images/2022_09_05_2050_51_rtpict_rendering_aa0.1_5000_sunny_ad16_1000.hdr",
    commands="""mkdir -p ~/simulation/boston/images/
rtpict -n 62 -w -vf /home/lio/simulation/boston/views/Perspective.vf -x 400 -y 300 -ab 3 -ad 4096 -lw 0.0005 -aa 0.1 -ar 256 -as 1024 -af ambfile_2022_09_05_2050_29.af /home/lio/simulation/boston/octrees/my_test_scene_1100.oct > /dev/null
rtpict -n 62 -w -vf /home/lio/simulation/boston/views/Perspective.vf -x 5000 -y 3333.333333 -ab 3 -ad 4096 -lw 0.0005 -aa 0.1 -ar 256 -as 1024 -af ambfile_2022_09_05_2050_29.af /home/lio/simulation/boston/octrees/my_test_scene_1100.oct | pfilt -x /2 -y /2 > ~/simulation/boston/images/2022_09_05_2050_51_rtpict_rendering_aa0.1_5000_sunny_ad16_1000.hdr;echo ~/simulation/boston/images/2022_09_05_2050_51_rtpict_rendering_aa0.1_5000_sunny_ad16_1000.hdr""")  # -> Stdout, Stderr_, Ran
convertpaths_9 = ConvertPaths(I=executessh_34.Stdout)  # -> Linux, flatten(Windows)

aperturename = Text(abx_7)
long_4 = LongestList(ListA=m_3.i2, ListB=aperturename, PaddingMode=2)  # -> ListA, ListB

# ---- group: Outdated
overrides_108 = ApplyOverrides(
    Input_=panel_154,
    Vmx=graft(vmx_grid_2),
    Aperture=graft(aperturename),
    Dmx=graft(dmx_3),
    Bsdf=graft("<bsdf>"),
    Smx=graft(skymtx_3),
    BsdfName=graft("<bsdfName>"),
    Room=graft(long_4.ListA))  # -> simplify(graft(Output)), Pairs

overrides_109 = ApplyOverrides(Input_=flatten(overrides_108.Output), BsdfName=graft(bsdf_5.name_2), Bsdf=graft(bsdf_5.path_2))  # -> graft(Output), Pairs

# ----
panel_155 = Panel(overrides_109.Output)
executessh_wip_30 = ExecuteSSHWIP(
    _SSHCommands_=overrides_109.Output,
    Run=falsestart_8,
    addPrefix=True,
    description="""mkdir -p ~/simulation//results/3PhGrid
rmtxop /home/mss/simulation/barnehagen/mtxs/3ph_vmx_grid/00_00_receiversSouth.vmx <bsdf> ~/simulation/barnehagen/mtxs/3ph_dmx/00_receiversSouth.dmx /home/mss/simulation/weatherData/NOR_Oslo.Fornebu.014880_IWEC_m1.smx | rmtxop -fa -c 47.4 119.9 11.6 - | rcollate -t > ~/simulation//results/3PhGrid/<room>__<bsdfName>.ill
echo "~/simulation//results/3PhGrid/<room>__<bsdfName>.ill"
""",
    fireLogs=True,
    lastRunTime=74806,
    name="rmtxop combining vmx+dmx",
    suppressWarnings=False,
    results=["~/simulation/barnehagen/results/3PhGrid/00_00_receiversSouth_barnehagen_blinds_001_GlassLT_70.ill", "~/simulation/barnehagen/results/3PhGrid/00_00_receiversSE_barnehagen_blinds_001_GlassLT_70.ill", "~/simulation/barnehagen/results/3PhGrid/01_01_receiversNorth_barnehagen_blinds_001_GlassLT_70.ill", "~/simulation/barnehagen/results/3PhGrid/02_02_receiversSouth_barnehagen_blinds_001_GlassLT_70.ill", "~/simulation/barnehagen/results/3PhGrid/03_03_receiversSouth_barnehagen_blinds_001_GlassLT_70.ill", "~/simulation/barnehagen/results/3PhGrid/04_04_receiversNorth_barnehagen_blinds_001_GlassLT_70.ill", "~/simulation/barnehagen/results/3PhGrid/00_00_receiversSouth_barnehagen__GlassLT_70.ill", "~/simulation/barnehagen/results/3PhGrid/00_00_receiversSE_barnehagen__GlassLT_70.ill", "~/simulation/barnehagen/results/3PhGrid/01_01_receiversNorth_barnehagen__GlassLT_70.ill", "~/simulation/barnehagen/results/3PhGrid/02_02_receiversSouth_barnehagen__GlassLT_70.ill", "~/simulation/barnehagen/results/3PhGrid/03_03_receiversSouth_barnehagen__GlassLT_70.ill", "~/simulation/barnehagen/results/3PhGrid/04_04_receiversNorth_barnehagen__GlassLT_70.ill"],
    commands=["""mkdir -p ~/simulation/barnehagen/results/3PhGrid
rmtxop /home/mss/simulation/barnehagen/mtxs/3ph_vmx_grid/00_00_receiversSouth.vmx /home/mss/simulation/BSDF_Files/barnehagen_blinds_001_GlassLT_70.xml ~/simulation/barnehagen/mtxs/3ph_dmx/00_receiversSouth.dmx /home/mss/simulation/weatherData/NOR_RO_Stavanger.AP-Sola.014150_TMYx.2007-2021_m1.smx | rmtxop -fa -c 47.4 119.9 11.6 - | rcollate -t > ~/simulation/barnehagen/results/3PhGrid/00_00_receiversSouth_barnehagen_blinds_001_GlassLT_70.ill
echo "~/simulation/barnehagen/results/3PhGrid/00_00_receiversSouth_barnehagen_blinds_001_GlassLT_70.ill"
""", """mkdir -p ~/simulation/barnehagen/results/3PhGrid
rmtxop /home/mss/simulation/barnehagen/mtxs/3ph_vmx_grid/00_00_receiversSE.vmx /home/mss/simulation/BSDF_Files/barnehagen_blinds_001_GlassLT_70.xml ~/simulation/barnehagen/mtxs/3ph_dmx/00_receiversSE.dmx /home/mss/simulation/weatherData/NOR_RO_Stavanger.AP-Sola.014150_TMYx.2007-2021_m1.smx | rmtxop -fa -c 47.4 119.9 11.6 - | rcollate -t > ~/simulation/barnehagen/results/3PhGrid/00_00_receiversSE_barnehagen_blinds_001_GlassLT_70.ill
echo "~/simulation/barnehagen/results/3PhGrid/00_00_receiversSE_barnehagen_blinds_001_GlassLT_70.ill"
""", """mkdir -p ~/simulation/barnehagen/results/3PhGrid
rmtxop /home/mss/simulation/barnehagen/mtxs/3ph_vmx_grid/01_01_receiversNorth.vmx /home/mss/simulation/BSDF_Files/barnehagen_blinds_001_GlassLT_70.xml ~/simulation/barnehagen/mtxs/3ph_dmx/01_receiversNorth.dmx /home/mss/simulation/weatherData/NOR_RO_Stavanger.AP-Sola.014150_TMYx.2007-2021_m1.smx | rmtxop -fa -c 47.4 119.9 11.6 - | rcollate -t > ~/simulation/barnehagen/results/3PhGrid/01_01_receiversNorth_barnehagen_blinds_001_GlassLT_70.ill
echo "~/simulation/barnehagen/results/3PhGrid/01_01_receiversNorth_barnehagen_blinds_001_GlassLT_70.ill"
""", """mkdir -p ~/simulation/barnehagen/results/3PhGrid
rmtxop /home/mss/simulation/barnehagen/mtxs/3ph_vmx_grid/02_02_receiversSouth.vmx /home/mss/simulation/BSDF_Files/barnehagen_blinds_001_GlassLT_70.xml ~/simulation/barnehagen/mtxs/3ph_dmx/02_receiversSouth.dmx /home/mss/simulation/weatherData/NOR_RO_Stavanger.AP-Sola.014150_TMYx.2007-2021_m1.smx | rmtxop -fa -c 47.4 119.9 11.6 - | rcollate -t > ~/simulation/barnehagen/results/3PhGrid/02_02_receiversSouth_barnehagen_blinds_001_GlassLT_70.ill
echo "~/simulation/barnehagen/results/3PhGrid/02_02_receiversSouth_barnehagen_blinds_001_GlassLT_70.ill"
""", """mkdir -p ~/simulation/barnehagen/results/3PhGrid
rmtxop /home/mss/simulation/barnehagen/mtxs/3ph_vmx_grid/03_03_receiversSouth.vmx /home/mss/simulation/BSDF_Files/barnehagen_blinds_001_GlassLT_70.xml ~/simulation/barnehagen/mtxs/3ph_dmx/03_receiversSouth.dmx /home/mss/simulation/weatherData/NOR_RO_Stavanger.AP-Sola.014150_TMYx.2007-2021_m1.smx | rmtxop -fa -c 47.4 119.9 11.6 - | rcollate -t > ~/simulation/barnehagen/results/3PhGrid/03_03_receiversSouth_barnehagen_blinds_001_GlassLT_70.ill
echo "~/simulation/barnehagen/results/3PhGrid/03_03_receiversSouth_barnehagen_blinds_001_GlassLT_70.ill"
""", """mkdir -p ~/simulation/barnehagen/results/3PhGrid
rmtxop /home/mss/simulation/barnehagen/mtxs/3ph_vmx_grid/04_04_receiversNorth.vmx /home/mss/simulation/BSDF_Files/barnehagen_blinds_001_GlassLT_70.xml ~/simulation/barnehagen/mtxs/3ph_dmx/04_receiversNorth.dmx /home/mss/simulation/weatherData/NOR_RO_Stavanger.AP-Sola.014150_TMYx.2007-2021_m1.smx | rmtxop -fa -c 47.4 119.9 11.6 - | rcollate -t > ~/simulation/barnehagen/results/3PhGrid/04_04_receiversNorth_barnehagen_blinds_001_GlassLT_70.ill
echo "~/simulation/barnehagen/results/3PhGrid/04_04_receiversNorth_barnehagen_blinds_001_GlassLT_70.ill"
"""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])  # -> flatten(Stdout), Stderr_, Ran

panel_156 = Panel(executessh_wip_30.Stdout)
ill_file = Text(executessh_wip_30.Stdout)

list_4 = ItemSelector(
    executessh_wip_30.Stdout,
    {"~/simulation/barnehagen/results/3PhGrid/00_00_receiversSouth_barnehagen_blinds_001_GlassLT_70.ill"}, selected=[])
python_25 = GhPythonScript(x=executessh_wip_30.Stdout, y=list_4)  # -> out, a; inputs y: list
# ---------- python_25: Python ----------
__author__ = "mm1013"
__version__ = "2022.09.06"

import rhinoscriptsyntax as rs

a = x in y
# ---------- end python_25 ----------
unflatten_7 = UnflattenTree(Tree=executessh_wip_30.Stdout, Guide=abx_4)
unflatten_8 = UnflattenTree(Tree=python_25.a, Guide=abx_4)
cull_16 = CullPattern(List=unflatten_7, CullPattern=unflatten_8)
unflatten_9 = UnflattenTree(Tree=list_4, Guide=abx_4)
cluster_7 = Cluster_2(L=unflatten_8)
python_26 = GhPythonScript(x=unflatten_9, y=cluster_7)  # -> a; inputs x: list, y: Int32
# ---------- python_26: Python ----------
__author__ = "mm1013"
__version__ = "2022.09.06"

import rhinoscriptsyntax as rs

if len(x) == 0:
    a = []
elif len(x) == 1:
    a = "echo " + x[0]
else:
    if y is None:
        y = 0
    rmt_files = " + ".join(x)
    
    #generating final file name
    splitted = x[0].split("/")
    p = "/".join(splitted[:-1]) + "/" + splitted[-1][:6]
    finalfile = p + "%02d" % y + "_combined.ill"
    
    
    a = 'if [ -f {0} ]; then\n    echo {0}\nelse\n    rmtxop {1} > {0};echo {0}\nfi'\
    .format(finalfile, rmt_files)
# ---------- end python_26 ----------
panel_157 = Panel(python_26)
default_2 = DefaultMSS(data=flatten(falsestart_3), default_value_flattened=flatten(list_4))

# ---- group: Outdated
executessh_wip_31 = ExecuteSSHWIP(
    _SSHCommands=python_26,
    Run=default_2,
    addPrefix=True,
    fireLogs=False,
    lastRunTime=65,
    suppressWarnings=True,
    results=["/home/mss/simulation/barnehagen/results/3PhGrid/00_00_00_combined.ill", "/home/mss/simulation/barnehagen/results/3PhGrid/01_01_receiversNorth_barnehagen__GlassLT_70.ill", "/home/mss/simulation/barnehagen/results/3PhGrid/02_02_receiversSouth_barnehagen__GlassLT_70.ill", "/home/mss/simulation/barnehagen/results/3PhGrid/03_03_receiversSouth_barnehagen__GlassLT_70.ill", "/home/mss/simulation/barnehagen/results/3PhGrid/04_04_receiversNorth_barnehagen__GlassLT_70.ill"],
    commands=["""if [ -f ~/simulation/barnehagen/results/3PhGrid/00_00_00_combined.ill ]; then
    echo ~/simulation/barnehagen/results/3PhGrid/00_00_00_combined.ill
else
    rmtxop ~/simulation/barnehagen/results/3PhGrid/00_00_receiversSouth_barnehagen__GlassLT_70.ill + ~/simulation/barnehagen/results/3PhGrid/00_00_receiversSE_barnehagen__GlassLT_70.ill > ~/simulation/barnehagen/results/3PhGrid/00_00_00_combined.ill;echo ~/simulation/barnehagen/results/3PhGrid/00_00_00_combined.ill
fi""", "echo ~/simulation/barnehagen/results/3PhGrid/01_01_receiversNorth_barnehagen__GlassLT_70.ill", "echo ~/simulation/barnehagen/results/3PhGrid/02_02_receiversSouth_barnehagen__GlassLT_70.ill", "echo ~/simulation/barnehagen/results/3PhGrid/03_03_receiversSouth_barnehagen__GlassLT_70.ill", "echo ~/simulation/barnehagen/results/3PhGrid/04_04_receiversNorth_barnehagen__GlassLT_70.ill"])  # -> Stdout, Stderr, Ran

# ----
convertpaths_10 = ConvertPaths(I=executessh_wip_31.Stdout)  # -> Linux, Windows
panel_159 = Panel(executessh_wip_31.Stdout)

y_5 = Number(y_3)

overrides_110 = ApplyOverrides(
    Input=panel_143,
    vf=graft("<vf>"),
    x=graft(x_4),
    y=graft(y_5),
    radOptions=graft("-ab 3 -ad 16 -aa 0"),
    oct=graft(octree_7),
    target=graft("<time>_<view>_aa0_<x>_sunny_ad16_<h>.hdr"),
    time=graft("<time>"),
    view=graft("<view>"),
    h=graft(entwine_11))  # -> Output, DynamicOutput
overrides_111 = ApplyOverrides(Input=overrides_110.Output, vf=graft(viewfile_2), time=graft("<time>"), view=graft(python_19))  # -> Output, DynamicOutput

python_27 = GhPythonScript(update=overrides_110.Output)  # -> time; inputs update: tree; same code as python_23
overrides_112 = ApplyOverrides(Input=overrides_111.DynamicOutput, time=graft(python_27))  # -> Output, DynamicOutput
executessh_35 = ExecuteSSH(
    _SSHCommands_=overrides_112.DynamicOutput,
    Run=run_4,
    addPrefix=True,
    description="""mkdir -p ~/simulation//images/
rtpict -n 62 -w -vf /home/mss/simulation/Boston_Skylights/views/Cam1.vf -x 6000 -y 5000 -ab 3 -ad 16 -aa 0 /home/mss/simulation/Boston_Skylights/octrees/Scene_Overcast.oct | pfilt -x /4 -y /4 -r 0.7 | ra_rgbe -r > ~/simulation//images/2023_09_01_1154_59_Cam1_aa0_6000_sunny_ad16_ovc.hdr;echo ~/simulation//images/2023_09_01_1154_59_Cam1_aa0_6000_sunny_ad16_ovc.hdr


- - -

mkdir -p ~/simulation//images/
rtpict -n 62 -w -vf /home/mss/simulation/Boston_Skylights/views/Cam2.vf -x 6000 -y 5000 -ab 3 -ad 16 -aa 0 /home/mss/simulation/Boston_Skylights/octrees/Scene_Sunny_1100.oct | pfilt -x /4 -y /4 -r 0.7 | ra_rgbe -r > ~/simulation//images/2023_09_01_1154_59_Cam2_aa0_6000_sunny_ad16_1100.hdr;echo ~/simulation//images/2023_09_01_1154_59_Cam2_aa0_6000_sunny_ad16_1100.hdr


- - -

mkdir -p ~/simulation//images/
rtpict -n 62 -w -vf /home/mss/simulation/Boston_Skylights/views/Cam3.vf -x 6000 -y 5000 -ab 3 -ad 16 -aa 0 /home/mss/simulation/Boston_Skylights/octrees/Scene_Sunny_1100.oct | pfilt -x /4 -y /4 -r 0.7 | ra_rgbe -r > ~/simulation//images/2023_09_01_1154_59_Cam3_aa0_6000_sunny_ad16_1100.hdr;echo ~/simulation//images/2023_09_01_1154_59_Cam3_aa0_6000_sunny_ad16_1100.hdr


- - -

mkdir -p ~/simulation//images/
rtpict -n 62 -w -vf /home/mss/simulation/Boston_Skylights/views/Cam4.vf -x 6000 -y 5000 -ab 3 -ad 16 -aa 0 /home/mss/simulation/Boston_Skylights/octrees/Scene_Sunny_1100.oct | pfilt -x /4 -y /4 -r 0.7 | ra_rgbe -r > ~/simulation//images/2023_09_01_1154_59_Cam4_aa0_6000_sunny_ad16_1100.hdr;echo ~/simulation//images/2023_09_01_1154_59_Cam4_aa0_6000_sunny_ad16_1100.hdr


- - -

mkdir -p ~/simulation//images/
rtpict -n 62 -w -vf /home/mss/simulation/Boston_Skylights/views/Cam5.vf -x 6000 -y 5000 -ab 3 -ad 16 -aa 0 /home/mss/simulation/Boston_Skylights/octrees/Scene_Sunny_1100.oct | pfilt -x /4 -y /4 -r 0.7 | ra_rgbe -r > ~/simulation//images/2023_09_01_1154_59_Cam5_aa0_6000_sunny_ad16_1100.hdr;echo ~/simulation//images/2023_09_01_1154_59_Cam5_aa0_6000_sunny_ad16_1100.hdr


- - -

mkdir -p ~/simulation//images/
rtpict -n 62 -w -vf /home/mss/simulation/Boston_Skylights/views/Cam6.vf -x 6000 -y 5000 -ab 3 -ad 16 -aa 0 /home/mss/simulation/Boston_Skylights/octrees/Scene_Sunny_1100.oct | pfilt -x /4 -y /4 -r 0.7 | ra_rgbe -r > ~/simulation//images/2023_09_01_1154_59_Cam6_aa0_6000_sunny_ad16_1100.hdr;echo ~/simulation//images/2023_09_01_1154_59_Cam6_aa0_6000_sunny_ad16_1100.hdr


- - -

mkdir -p ~/simulation//images/
rtpict -n 62 -w -vf /home/mss/simulation/Boston_Skylights/views/Cam7.vf -x 6000 -y 5000 -ab 3 -ad 16 -aa 0 /home/mss/simulation/Boston_Skylights/octrees/Scene_Sunny_1100.oct | pfilt -x /4 -y /4 -r 0.7 | ra_rgbe -r > ~/simulation//images/2023_09_01_1154_59_Cam7_aa0_6000_sunny_ad16_1100.hdr;echo ~/simulation//images/2023_09_01_1154_59_Cam7_aa0_6000_sunny_ad16_1100.hdr""",
    fireLogs=False,
    lastRunTime=0,
    suppressWarnings=False)  # -> Stdout, Stderr_, Ran

overrides_113 = ApplyOverrides(
    Input=panel_153,
    vf=graft("<vf>"),
    x=graft(x_5),
    y=graft(y_4),
    radOptions=graft("-ab 3 -ad 16 -aa 0"),
    oct=graft(list_2),
    target=graft("<time>_<view>_rtpict_illum_aa0_<x>_<h>_illum.hdr"),
    time=graft(python_27),
    view=graft("<view>"),
    h=graft(hours_6))  # -> Output, DynamicOutput
panel_161 = Panel(overrides_112.Output)

overrides_114 = ApplyOverrides(Input=flatten(overrides_113.Output), Vf=graft(viewfile_2), View=graft(python_19))  # -> Output, DynamicOutput
executessh_36 = ExecuteSSH(
    _SSHCommands_=overrides_114.DynamicOutput,
    Run=run_5,
    addPrefix=True,
    description="""mkdir -p ~/simulation//images/
rtpict -i -w -n 61 -vf /home/mss/simulation/Boston_Skylights/views/Cam1.vf -x 6000 -y 5000 -ab 3 -ad 16 -aa 0 /home/mss/simulation/Boston_Skylights/octrees/Scene_Overcast.oct | pfilt -x /4 -y /4 -r 0.7 | ra_rgbe -r > ~/simulation//images/2023_09_01_1154_59_Cam1_rtpict_illum_aa0_6000_ovc_illum.hdr;echo ~/simulation//images/2023_09_01_1154_59_Cam1_rtpict_illum_aa0_6000_ovc_illum.hdr


- - -

mkdir -p ~/simulation//images/
rtpict -i -w -n 61 -vf /home/mss/simulation/Boston_Skylights/views/Cam2.vf -x 6000 -y 5000 -ab 3 -ad 16 -aa 0 /home/mss/simulation/Boston_Skylights/octrees/Scene_Overcast.oct | pfilt -x /4 -y /4 -r 0.7 | ra_rgbe -r > ~/simulation//images/2023_09_01_1154_59_Cam2_rtpict_illum_aa0_6000_ovc_illum.hdr;echo ~/simulation//images/2023_09_01_1154_59_Cam2_rtpict_illum_aa0_6000_ovc_illum.hdr


- - -

mkdir -p ~/simulation//images/
rtpict -i -w -n 61 -vf /home/mss/simulation/Boston_Skylights/views/Cam3.vf -x 6000 -y 5000 -ab 3 -ad 16 -aa 0 /home/mss/simulation/Boston_Skylights/octrees/Scene_Overcast.oct | pfilt -x /4 -y /4 -r 0.7 | ra_rgbe -r > ~/simulation//images/2023_09_01_1154_59_Cam3_rtpict_illum_aa0_6000_ovc_illum.hdr;echo ~/simulation//images/2023_09_01_1154_59_Cam3_rtpict_illum_aa0_6000_ovc_illum.hdr


- - -

mkdir -p ~/simulation//images/
rtpict -i -w -n 61 -vf /home/mss/simulation/Boston_Skylights/views/Cam4.vf -x 6000 -y 5000 -ab 3 -ad 16 -aa 0 /home/mss/simulation/Boston_Skylights/octrees/Scene_Overcast.oct | pfilt -x /4 -y /4 -r 0.7 | ra_rgbe -r > ~/simulation//images/2023_09_01_1154_59_Cam4_rtpict_illum_aa0_6000_ovc_illum.hdr;echo ~/simulation//images/2023_09_01_1154_59_Cam4_rtpict_illum_aa0_6000_ovc_illum.hdr


- - -

mkdir -p ~/simulation//images/
rtpict -i -w -n 61 -vf /home/mss/simulation/Boston_Skylights/views/Cam5.vf -x 6000 -y 5000 -ab 3 -ad 16 -aa 0 /home/mss/simulation/Boston_Skylights/octrees/Scene_Overcast.oct | pfilt -x /4 -y /4 -r 0.7 | ra_rgbe -r > ~/simulation//images/2023_09_01_1154_59_Cam5_rtpict_illum_aa0_6000_ovc_illum.hdr;echo ~/simulation//images/2023_09_01_1154_59_Cam5_rtpict_illum_aa0_6000_ovc_illum.hdr


- - -

mkdir -p ~/simulation//images/
rtpict -i -w -n 61 -vf /home/mss/simulation/Boston_Skylights/views/Cam6.vf -x 6000 -y 5000 -ab 3 -ad 16 -aa 0 /home/mss/simulation/Boston_Skylights/octrees/Scene_Overcast.oct | pfilt -x /4 -y /4 -r 0.7 | ra_rgbe -r > ~/simulation//images/2023_09_01_1154_59_Cam6_rtpict_illum_aa0_6000_ovc_illum.hdr;echo ~/simulation//images/2023_09_01_1154_59_Cam6_rtpict_illum_aa0_6000_ovc_illum.hdr


- - -

mkdir -p ~/simulation//images/
rtpict -i -w -n 61 -vf /home/mss/simulation/Boston_Skylights/views/Cam7.vf -x 6000 -y 5000 -ab 3 -ad 16 -aa 0 /home/mss/simulation/Boston_Skylights/octrees/Scene_Overcast.oct | pfilt -x /4 -y /4 -r 0.7 | ra_rgbe -r > ~/simulation//images/2023_09_01_1154_59_Cam7_rtpict_illum_aa0_6000_ovc_illum.hdr;echo ~/simulation//images/2023_09_01_1154_59_Cam7_rtpict_illum_aa0_6000_ovc_illum.hdr""",
    fireLogs=True,
    lastRunTime=0,
    name="rpict",
    suppressWarnings=False)  # -> Stdout, Stderr_, Ran

panel_162 = Panel(overrides_114.Output)

# ---- group: Outdated
overrides_115 = ApplyOverrides(Input_=panel_30, Hdr=graft(executessh_35.Stdout))  # -> Output, Pairs

# ----
executessh_wip_32 = ExecuteSSHWIP(
    _SSHCommands_=overrides_115.Output,
    Run=executessh_35.Ran,
    addPrefix=True,
    description="""pcond -h <hdr> <hdr>_exposed.hdr;echo <hdr>_exposed.hdr


- - -

pcond -h <hdr> <hdr>_exposed.hdr;echo <hdr>_exposed.hdr


- - -

pcond -h <hdr> <hdr>_exposed.hdr;echo <hdr>_exposed.hdr


- - -

pcond -h <hdr> <hdr>_exposed.hdr;echo <hdr>_exposed.hdr


- - -

pcond -h <hdr> <hdr>_exposed.hdr;echo <hdr>_exposed.hdr


- - -

pcond -h <hdr> <hdr>_exposed.hdr;echo <hdr>_exposed.hdr


- - -

pcond -h <hdr> <hdr>_exposed.hdr;echo <hdr>_exposed.hdr""",
    fireLogs=False,
    lastRunTime=3165,
    suppressWarnings=False,
    results=["/home/lio/simulation/Boston_Skylights/images/2022_09_13_1129_37_Cam1_aa0_4000_sunny_ad16_ovc_exposed.hdr", "/home/lio/simulation/Boston_Skylights/images/2022_09_13_1129_37_Cam1_aa0_4000_sunny_ad16_1100_exposed.hdr", "/home/lio/simulation/Boston_Skylights/images/2022_09_13_1129_37_Cam2_aa0_4000_sunny_ad16_ovc_exposed.hdr", "/home/lio/simulation/Boston_Skylights/images/2022_09_13_1129_37_Cam2_aa0_4000_sunny_ad16_1100_exposed.hdr", "/home/lio/simulation/Boston_Skylights/images/2022_09_13_1129_37_Cam3_aa0_4000_sunny_ad16_ovc_exposed.hdr", "/home/lio/simulation/Boston_Skylights/images/2022_09_13_1129_37_Cam3_aa0_4000_sunny_ad16_1100_exposed.hdr", "/home/lio/simulation/Boston_Skylights/images/2022_09_13_1129_37_Cam4_aa0_4000_sunny_ad16_ovc_exposed.hdr", "/home/lio/simulation/Boston_Skylights/images/2022_09_13_1129_37_Cam4_aa0_4000_sunny_ad16_1100_exposed.hdr", "/home/lio/simulation/Boston_Skylights/images/2022_09_13_1129_37_Cam5_aa0_4000_sunny_ad16_ovc_exposed.hdr", "/home/lio/simulation/Boston_Skylights/images/2022_09_13_1129_37_Cam5_aa0_4000_sunny_ad16_1100_exposed.hdr"],
    commands=["pcond -h /home/lio/simulation/Boston_Skylights/images/2022_09_13_1129_37_Cam1_aa0_4000_sunny_ad16_1100.hdr /home/lio/simulation/Boston_Skylights/images/2022_09_13_1129_37_Cam1_aa0_4000_sunny_ad16_1100_exposed.hdr;echo /home/lio/simulation/Boston_Skylights/images/2022_09_13_1129_37_Cam1_aa0_4000_sunny_ad16_1100_exposed.hdr", "pcond -h /home/lio/simulation/Boston_Skylights/images/2022_09_13_1129_37_Cam2_aa0_4000_sunny_ad16_1100.hdr /home/lio/simulation/Boston_Skylights/images/2022_09_13_1129_37_Cam2_aa0_4000_sunny_ad16_1100_exposed.hdr;echo /home/lio/simulation/Boston_Skylights/images/2022_09_13_1129_37_Cam2_aa0_4000_sunny_ad16_1100_exposed.hdr", "pcond -h /home/lio/simulation/Boston_Skylights/images/2022_09_13_1129_37_Cam3_aa0_4000_sunny_ad16_1100.hdr /home/lio/simulation/Boston_Skylights/images/2022_09_13_1129_37_Cam3_aa0_4000_sunny_ad16_1100_exposed.hdr;echo /home/lio/simulation/Boston_Skylights/images/2022_09_13_1129_37_Cam3_aa0_4000_sunny_ad16_1100_exposed.hdr", "pcond -h /home/lio/simulation/Boston_Skylights/images/2022_09_13_1129_37_Cam2_aa0_4000_sunny_ad16_ovc.hdr /home/lio/simulation/Boston_Skylights/images/2022_09_13_1129_37_Cam2_aa0_4000_sunny_ad16_ovc_exposed.hdr;echo /home/lio/simulation/Boston_Skylights/images/2022_09_13_1129_37_Cam2_aa0_4000_sunny_ad16_ovc_exposed.hdr", "pcond -h /home/lio/simulation/Boston_Skylights/images/2022_09_13_1129_37_Cam3_aa0_4000_sunny_ad16_ovc.hdr /home/lio/simulation/Boston_Skylights/images/2022_09_13_1129_37_Cam3_aa0_4000_sunny_ad16_ovc_exposed.hdr;echo /home/lio/simulation/Boston_Skylights/images/2022_09_13_1129_37_Cam3_aa0_4000_sunny_ad16_ovc_exposed.hdr", "pcond -h /home/lio/simulation/Boston_Skylights/images/2022_09_13_1129_37_Cam4_aa0_4000_sunny_ad16_1100.hdr /home/lio/simulation/Boston_Skylights/images/2022_09_13_1129_37_Cam4_aa0_4000_sunny_ad16_1100_exposed.hdr;echo /home/lio/simulation/Boston_Skylights/images/2022_09_13_1129_37_Cam4_aa0_4000_sunny_ad16_1100_exposed.hdr", "pcond -h /home/lio/simulation/Boston_Skylights/images/2022_09_13_1129_37_Cam4_aa0_4000_sunny_ad16_ovc.hdr /home/lio/simulation/Boston_Skylights/images/2022_09_13_1129_37_Cam4_aa0_4000_sunny_ad16_ovc_exposed.hdr;echo /home/lio/simulation/Boston_Skylights/images/2022_09_13_1129_37_Cam4_aa0_4000_sunny_ad16_ovc_exposed.hdr", "pcond -h /home/lio/simulation/Boston_Skylights/images/2022_09_13_1129_37_Cam5_aa0_4000_sunny_ad16_ovc.hdr /home/lio/simulation/Boston_Skylights/images/2022_09_13_1129_37_Cam5_aa0_4000_sunny_ad16_ovc_exposed.hdr;echo /home/lio/simulation/Boston_Skylights/images/2022_09_13_1129_37_Cam5_aa0_4000_sunny_ad16_ovc_exposed.hdr", "pcond -h /home/lio/simulation/Boston_Skylights/images/2022_09_13_1129_37_Cam5_aa0_4000_sunny_ad16_1100.hdr /home/lio/simulation/Boston_Skylights/images/2022_09_13_1129_37_Cam5_aa0_4000_sunny_ad16_1100_exposed.hdr;echo /home/lio/simulation/Boston_Skylights/images/2022_09_13_1129_37_Cam5_aa0_4000_sunny_ad16_1100_exposed.hdr"])  # -> Stdout, Stderr_, Ran
join_9 = TextJoin(Text=flatten(executessh_35.Stdout), Join=" ")
panel_163 = Panel(executessh_wip_32.Stdout)
overrides_116 = ApplyOverrides(Input_=panel_31, Time=graft(python_27), Files=graft(join_9))  # -> Output, Pairs
overrides_117 = ApplyOverrides(Input=panel_32, Irrad=graft(executessh_36.Stdout))  # -> Output, DynamicOutput
executessh_37 = ExecuteSSH(
    _SSHCommands_=overrides_117.DynamicOutput,
    Run=False,
    addPrefix=True,
    description="""pfilt -x /2 -y /2 -r 0.7 <irrad> | falsecolor -s 2000 -l lux -lw 200 -lh 300 > <irrad>_fc2.hdr
ra_tiff <irrad>_fc2.hdr <irrad>_fc2.tif
convert <irrad>_fc2.tif <irrad>_fc2.png
rm <irrad>_fc2.hdr
rm <irrad>_fc2.tif
echo <irrad>_fc2.png


- - -

pfilt -x /2 -y /2 -r 0.7 <irrad> | falsecolor -s 2000 -l lux -lw 200 -lh 300 > <irrad>_fc2.hdr
ra_tiff <irrad>_fc2.hdr <irrad>_fc2.tif
convert <irrad>_fc2.tif <irrad>_fc2.png
rm <irrad>_fc2.hdr
rm <irrad>_fc2.tif
echo <irrad>_fc2.png


- - -

pfilt -x /2 -y /2 -r 0.7 <irrad> | falsecolor -s 2000 -l lux -lw 200 -lh 300 > <irrad>_fc2.hdr
ra_tiff <irrad>_fc2.hdr <irrad>_fc2.tif
convert <irrad>_fc2.tif <irrad>_fc2.png
rm <irrad>_fc2.hdr
rm <irrad>_fc2.tif
echo <irrad>_fc2.png


- - -

pfilt -x /2 -y /2 -r 0.7 <irrad> | falsecolor -s 2000 -l lux -lw 200 -lh 300 > <irrad>_fc2.hdr
ra_tiff <irrad>_fc2.hdr <irrad>_fc2.tif
convert <irrad>_fc2.tif <irrad>_fc2.png
rm <irrad>_fc2.hdr
rm <irrad>_fc2.tif
echo <irrad>_fc2.png


- - -

pfilt -x /2 -y /2 -r 0.7 <irrad> | falsecolor -s 2000 -l lux -lw 200 -lh 300 > <irrad>_fc2.hdr
ra_tiff <irrad>_fc2.hdr <irrad>_fc2.tif
convert <irrad>_fc2.tif <irrad>_fc2.png
rm <irrad>_fc2.hdr
rm <irrad>_fc2.tif
echo <irrad>_fc2.png


- - -

pfilt -x /2 -y /2 -r 0.7 <irrad> | falsecolor -s 2000 -l lux -lw 200 -lh 300 > <irrad>_fc2.hdr
ra_tiff <irrad>_fc2.hdr <irrad>_fc2.tif
convert <irrad>_fc2.tif <irrad>_fc2.png
rm <irrad>_fc2.hdr
rm <irrad>_fc2.tif
echo <irrad>_fc2.png


- - -

pfilt -x /2 -y /2 -r 0.7 <irrad> | falsecolor -s 2000 -l lux -lw 200 -lh 300 > <irrad>_fc2.hdr
ra_tiff <irrad>_fc2.hdr <irrad>_fc2.tif
convert <irrad>_fc2.tif <irrad>_fc2.png
rm <irrad>_fc2.hdr
rm <irrad>_fc2.tif
echo <irrad>_fc2.png""",
    fireLogs=False,
    lastRunTime=0,
    suppressWarnings=False)  # -> Stdout, Stderr_, Ran
convertpaths_11 = ConvertPaths(I=executessh_37.Stdout)  # -> Linux, flatten(Windows)
imageviewer = LBImageViewer(ImagePath_=convertpaths_11.Windows, _scale_=2, DisableClickable=False, SaveImgWithCoords=False, scale=2)  # -> ImagePath, Values, GIF

# ----
# final step: Combine results
panel_164 = Panel("""export PATH=$PATH.:/usr/local/radiance/bin
export RAYPATH=.:/usr/local/radiance/lib
rmtxop <DCannualR> + -s -1 <DCDannualR> + <CDSannualR> > <proj>/results/<target>;echo <proj>/results/<target>""")
falsestart_9 = LBFalseStartToggle(False)
and_9 = GateAnd(A=execute_ssh_async_6.Ran, B=executessh_30.Ran, C=executessh_31.Ran)
or = GateOr(A=and_9, B=falsestart_9)
execute_ssh_async_11 = ExecuteSSHAsync(
    _SSHCommands_=<missing>,
    Run=or,
    addPrefix=True,
    addSuffix=True,
    description="export PATH=$PATH.:/usr/local/radiance/bin;export RAYPATH=.:/usr/local/radiance/lib;rmtxop /home/mss/simulation/Boston_Skylights/results/annualR_DC.ill + -s -1 /home/mss/simulation/Boston_Skylights/results/annualR_DCD.ill + /home/mss/simulation/Boston_Skylights/results/annualR_CDS.ill > ~/simulation/Boston_Skylights/results/DDS_Total.ill;echo ~/simulation/Boston_Skylights/results/DDS_Total.ill",
    fireLogs=True,
    name="Combine mtxs (DC-DCD+CDS)",
    stdouts="/home/mss/simulation/Boston_Skylights/results/DDS_Total.ill",
    suppressWarnings=False)  # -> Stdout, Stderr_, port, port_2, Ran

overrides_118 = ApplyOverrides(
    Input=panel_164,
    DCannualR=graft(executessh_29.Stdout),
    DCDannualR=graft(executessh_30.Stdout),
    CDSannualR=graft(executessh_31.Stdout),
    target=graft("DDS_Total.ill"))  # -> Output, DynamicOutput
executessh_38 = ExecuteSSH(_SSHCommands_=overrides_118.Output, Run=or, addPrefix=True, fireLogs=False, lastRunTime=0, suppressWarnings=False)  # -> Stdout, Stderr_, Ran

panel_165 = Panel(overrides_118.Output)
panel_166 = Panel(executessh_38.Stdout)

# ----
# orig dimensions
panel_167 = Panel("getinfo <f>")
x_6 = Number(x_2)
division_3 = Division(A=x_6, B=4)

overrides_119 = ApplyOverrides(Input=panel_167, Text=graft(executessh_36.Stdout))  # -> Output, DynamicOutput
executessh_39 = ExecuteSSH(
    _SSHCommands_=overrides_119.DynamicOutput,
    Run=executessh_36.Ran,
    addPrefix=True,
    description="""getinfo <f>


- - -

getinfo <f>


- - -

getinfo <f>


- - -

getinfo <f>


- - -

getinfo <f>


- - -

getinfo <f>


- - -

getinfo <f>""",
    fireLogs=False,
    lastRunTime=0,
    suppressWarnings=False)  # -> Stdout, Stderr_, Ran

python_28 = GhPythonScript(x=executessh_39.Stdout)  # -> out, org_y
# ---------- python_28: Python ----------
__author__ = "mm1013"
__version__ = "2022.08.31"

import rhinoscriptsyntax as rs

lines = x.replace("\r","").split("\n")

for l in lines:
    line = l.strip()
    if line.startswith("rtrace"):
        print "RTRACE"
        li = line.split("-y")
        
        print li[1].strip().split(" ")[0]
        org_y = int(li[1].strip().split(" ")[0])
    elif line.startswith("pfilt"):
        print "PFIlT"
        li = line.split("-y")
        
        print li[1].strip().split(" ")[0]
        org_y = org_y / float(li[1].strip().split(" ")[0].replace("/",""))
# ---------- end python_28 ----------

# ----
# blurring the irrad
panel_168 = Panel("pfilt -x /3 -y /3 -r 1 <file> | pfilt -1 -x <x> -y <y> > <file-.>_filteredBlur.hdr;ra_tiff <file-.>_filteredBlur.hdr <file-.>_filteredBlur.tif;echo <file-.>_filteredBlur.hdr")
overrides_120 = ApplyOverrides(Input=panel_168, file=graft(executessh_36.Stdout), x=graft(division_3), y=graft(python_28.org_y))  # -> Output, DynamicOutput
executessh_40 = ExecuteSSH(
    _SSHCommands_=overrides_120.DynamicOutput,
    Run=executessh_36.Ran,
    addPrefix=True,
    description="""pfilt -x /3 -y /3 -r 1 <file> | pfilt -1 -x 1500 -y <y> > <file>_filteredBlur.hdr;ra_tiff <file>_filteredBlur.hdr <file>_filteredBlur.tif;echo <file>_filteredBlur.hdr


- - -

pfilt -x /3 -y /3 -r 1 <file> | pfilt -1 -x 1500 -y <y> > <file>_filteredBlur.hdr;ra_tiff <file>_filteredBlur.hdr <file>_filteredBlur.tif;echo <file>_filteredBlur.hdr


- - -

pfilt -x /3 -y /3 -r 1 <file> | pfilt -1 -x 1500 -y <y> > <file>_filteredBlur.hdr;ra_tiff <file>_filteredBlur.hdr <file>_filteredBlur.tif;echo <file>_filteredBlur.hdr


- - -

pfilt -x /3 -y /3 -r 1 <file> | pfilt -1 -x 1500 -y <y> > <file>_filteredBlur.hdr;ra_tiff <file>_filteredBlur.hdr <file>_filteredBlur.tif;echo <file>_filteredBlur.hdr


- - -

pfilt -x /3 -y /3 -r 1 <file> | pfilt -1 -x 1500 -y <y> > <file>_filteredBlur.hdr;ra_tiff <file>_filteredBlur.hdr <file>_filteredBlur.tif;echo <file>_filteredBlur.hdr


- - -

pfilt -x /3 -y /3 -r 1 <file> | pfilt -1 -x 1500 -y <y> > <file>_filteredBlur.hdr;ra_tiff <file>_filteredBlur.hdr <file>_filteredBlur.tif;echo <file>_filteredBlur.hdr


- - -

pfilt -x /3 -y /3 -r 1 <file> | pfilt -1 -x 1500 -y <y> > <file>_filteredBlur.hdr;ra_tiff <file>_filteredBlur.hdr <file>_filteredBlur.tif;echo <file>_filteredBlur.hdr""",
    fireLogs=False,
    lastRunTime=0,
    suppressWarnings=False)  # -> Stdout, Stderr_, Ran

# ----
# overlay illuminance falsecolor on luminance picture
panel_169 = Panel("""pcond -h <rad> | pfilt -x /2 -y /2 -r 0.7 > <rad-.>exposed_sd.hdr
pfilt -x /2 -y /2 -r 0.7 <irrad> > <irrad-.>_sd.hdr
falsecolor -s 2000 -l lux -lw 200 -lh 300 -p <rad-.>exposed_sd.hdr -i <irrad-.>_sd.hdr -cl > <rad-.>_fc.hdr
ra_tiff <rad-.>_fc.hdr <rad-.>_fc.tif
convert <rad-.>_fc.tif <rad-.>_fc.png
echo <rad-.>_fc.hdr""")
panel_170 = Panel("-log 2")
overrides_121 = ApplyOverrides(Input=panel_169, rad=graft(executessh_35.Stdout), irrad=graft(executessh_40.Stdout))  # -> Output, DynamicOutput
and_10 = GateAnd(A=executessh_35.Ran, B=executessh_36.Ran)

executessh_41 = ExecuteSSH(
    _SSHCommands_=overrides_121.DynamicOutput,
    Run=and_10,
    addPrefix=True,
    description="""pcond -h <rad> | pfilt -x /2 -y /2 -r 0.7 > <rad>exposed_sd.hdr
pfilt -x /2 -y /2 -r 0.7 <irrad> > <irrad>_sd.hdr
falsecolor -s 2000 -l lux -lw 200 -lh 300 -p <rad>exposed_sd.hdr -i <irrad>_sd.hdr -cl > <rad>_fc.hdr
ra_tiff <rad>_fc.hdr <rad>_fc.tif
convert <rad>_fc.tif <rad>_fc.png
echo <rad>_fc.hdr


- - -

pcond -h <rad> | pfilt -x /2 -y /2 -r 0.7 > <rad>exposed_sd.hdr
pfilt -x /2 -y /2 -r 0.7 <irrad> > <irrad>_sd.hdr
falsecolor -s 2000 -l lux -lw 200 -lh 300 -p <rad>exposed_sd.hdr -i <irrad>_sd.hdr -cl > <rad>_fc.hdr
ra_tiff <rad>_fc.hdr <rad>_fc.tif
convert <rad>_fc.tif <rad>_fc.png
echo <rad>_fc.hdr


- - -

pcond -h <rad> | pfilt -x /2 -y /2 -r 0.7 > <rad>exposed_sd.hdr
pfilt -x /2 -y /2 -r 0.7 <irrad> > <irrad>_sd.hdr
falsecolor -s 2000 -l lux -lw 200 -lh 300 -p <rad>exposed_sd.hdr -i <irrad>_sd.hdr -cl > <rad>_fc.hdr
ra_tiff <rad>_fc.hdr <rad>_fc.tif
convert <rad>_fc.tif <rad>_fc.png
echo <rad>_fc.hdr


- - -

pcond -h <rad> | pfilt -x /2 -y /2 -r 0.7 > <rad>exposed_sd.hdr
pfilt -x /2 -y /2 -r 0.7 <irrad> > <irrad>_sd.hdr
falsecolor -s 2000 -l lux -lw 200 -lh 300 -p <rad>exposed_sd.hdr -i <irrad>_sd.hdr -cl > <rad>_fc.hdr
ra_tiff <rad>_fc.hdr <rad>_fc.tif
convert <rad>_fc.tif <rad>_fc.png
echo <rad>_fc.hdr


- - -

pcond -h <rad> | pfilt -x /2 -y /2 -r 0.7 > <rad>exposed_sd.hdr
pfilt -x /2 -y /2 -r 0.7 <irrad> > <irrad>_sd.hdr
falsecolor -s 2000 -l lux -lw 200 -lh 300 -p <rad>exposed_sd.hdr -i <irrad>_sd.hdr -cl > <rad>_fc.hdr
ra_tiff <rad>_fc.hdr <rad>_fc.tif
convert <rad>_fc.tif <rad>_fc.png
echo <rad>_fc.hdr


- - -

pcond -h <rad> | pfilt -x /2 -y /2 -r 0.7 > <rad>exposed_sd.hdr
pfilt -x /2 -y /2 -r 0.7 <irrad> > <irrad>_sd.hdr
falsecolor -s 2000 -l lux -lw 200 -lh 300 -p <rad>exposed_sd.hdr -i <irrad>_sd.hdr -cl > <rad>_fc.hdr
ra_tiff <rad>_fc.hdr <rad>_fc.tif
convert <rad>_fc.tif <rad>_fc.png
echo <rad>_fc.hdr


- - -

pcond -h <rad> | pfilt -x /2 -y /2 -r 0.7 > <rad>exposed_sd.hdr
pfilt -x /2 -y /2 -r 0.7 <irrad> > <irrad>_sd.hdr
falsecolor -s 2000 -l lux -lw 200 -lh 300 -p <rad>exposed_sd.hdr -i <irrad>_sd.hdr -cl > <rad>_fc.hdr
ra_tiff <rad>_fc.hdr <rad>_fc.tif
convert <rad>_fc.tif <rad>_fc.png
echo <rad>_fc.hdr""",
    fireLogs=False,
    lastRunTime=0,
    suppressWarnings=False)  # -> Stdout, Stderr_, Ran
convertpaths_12 = ConvertPaths(I=executessh_41.Stdout)  # -> Linux, flatten(Windows)
imageviewer_2 = LBImageViewer(ImagePath_=convertpaths_12.Windows, _scale_=2, DisableClickable=False, SaveImgWithCoords=False, scale=2)  # -> ImagePath, Values, GIF

panel_171 = Panel("""ra_tiff <hdrexposed> <hdr-.>_exposed.tif
convert <hdr-.>_exposed.tif <hdr-.>_exposed.png
echo <hdr-.>_exposed.png""")
panel_172 = Panel("""ra_tiff <hdr-.>.hdr <hdr-.>.tif
convert <hdr-.>.tif <hdr-.>.png
echo <hdr-.>.png""")
entwine_12 = Entwine(Branch00=panel_171, Branch01=panel_172, FlattenInputs=True)
overrides_122 = ApplyOverrides(Input_=entwine_12, Hdr=graft(executessh_35.Stdout), Hdrexposed=graft(executessh_wip_32.Stdout))  # -> Output, Pairs

# ---- group: Outdated
executessh_wip_33 = ExecuteSSHWIP(
    _SSHCommands_=overrides_122.Output,
    Run=executessh_35.Ran,
    addPrefix=True,
    description="""ra_tiff /home/lio/simulation/Boston_Skylights/images/2022_09_13_1129_37_Cam1_aa0_4000_sunny_ad16_ovc_exposed.hdr <hdr>_exposed.tif
convert <hdr>_exposed.tif <hdr>_exposed.png
echo <hdr>_exposed.png


- - -

ra_tiff <hdr>.hdr <hdr>.tif
convert <hdr>.tif <hdr>.png
echo <hdr>.png


- - -

ra_tiff <hdr>.hdr <hdr>.tif
convert <hdr>.tif <hdr>.png
echo <hdr>.png


- - -

ra_tiff <hdr>.hdr <hdr>.tif
convert <hdr>.tif <hdr>.png
echo <hdr>.png


- - -

ra_tiff <hdr>.hdr <hdr>.tif
convert <hdr>.tif <hdr>.png
echo <hdr>.png


- - -

ra_tiff <hdr>.hdr <hdr>.tif
convert <hdr>.tif <hdr>.png
echo <hdr>.png


- - -

ra_tiff <hdr>.hdr <hdr>.tif
convert <hdr>.tif <hdr>.png
echo <hdr>.png""",
    fireLogs=False,
    lastRunTime=1064,
    name="toPNG",
    suppressWarnings=False,
    results=["/home/lio/simulation/Boston_Skylights/images/2022_09_13_1129_37_Cam1_aa0_4000_sunny_ad16_ovc_exposed.png", "/home/lio/simulation/Boston_Skylights/images/2022_09_13_1129_37_Cam1_aa0_4000_sunny_ad16_1100.png", "/home/lio/simulation/Boston_Skylights/images/2022_09_13_1129_37_Cam2_aa0_4000_sunny_ad16_ovc.png", "/home/lio/simulation/Boston_Skylights/images/2022_09_13_1129_37_Cam2_aa0_4000_sunny_ad16_1100.png", "/home/lio/simulation/Boston_Skylights/images/2022_09_13_1129_37_Cam3_aa0_4000_sunny_ad16_ovc.png", "/home/lio/simulation/Boston_Skylights/images/2022_09_13_1129_37_Cam3_aa0_4000_sunny_ad16_1100.png", "/home/lio/simulation/Boston_Skylights/images/2022_09_13_1129_37_Cam4_aa0_4000_sunny_ad16_ovc.png", "/home/lio/simulation/Boston_Skylights/images/2022_09_13_1129_37_Cam4_aa0_4000_sunny_ad16_1100.png", "/home/lio/simulation/Boston_Skylights/images/2022_09_13_1129_37_Cam5_aa0_4000_sunny_ad16_ovc.png", "/home/lio/simulation/Boston_Skylights/images/2022_09_13_1129_37_Cam5_aa0_4000_sunny_ad16_1100.png"],
    commands=["""ra_tiff /home/lio/simulation/Boston_Skylights/images/2022_09_13_1129_37_Cam1_aa0_4000_sunny_ad16_ovc_exposed.hdr /home/lio/simulation/Boston_Skylights/images/2022_09_13_1129_37_Cam1_aa0_4000_sunny_ad16_ovc_exposed.tif
convert /home/lio/simulation/Boston_Skylights/images/2022_09_13_1129_37_Cam1_aa0_4000_sunny_ad16_ovc_exposed.tif /home/lio/simulation/Boston_Skylights/images/2022_09_13_1129_37_Cam1_aa0_4000_sunny_ad16_ovc_exposed.png
echo /home/lio/simulation/Boston_Skylights/images/2022_09_13_1129_37_Cam1_aa0_4000_sunny_ad16_ovc_exposed.png""", """ra_tiff /home/lio/simulation/Boston_Skylights/images/2022_09_13_1129_37_Cam2_aa0_4000_sunny_ad16_ovc.hdr /home/lio/simulation/Boston_Skylights/images/2022_09_13_1129_37_Cam2_aa0_4000_sunny_ad16_ovc.tif
convert /home/lio/simulation/Boston_Skylights/images/2022_09_13_1129_37_Cam2_aa0_4000_sunny_ad16_ovc.tif /home/lio/simulation/Boston_Skylights/images/2022_09_13_1129_37_Cam2_aa0_4000_sunny_ad16_ovc.png
echo /home/lio/simulation/Boston_Skylights/images/2022_09_13_1129_37_Cam2_aa0_4000_sunny_ad16_ovc.png""", """ra_tiff /home/lio/simulation/Boston_Skylights/images/2022_09_13_1129_37_Cam1_aa0_4000_sunny_ad16_1100.hdr /home/lio/simulation/Boston_Skylights/images/2022_09_13_1129_37_Cam1_aa0_4000_sunny_ad16_1100.tif
convert /home/lio/simulation/Boston_Skylights/images/2022_09_13_1129_37_Cam1_aa0_4000_sunny_ad16_1100.tif /home/lio/simulation/Boston_Skylights/images/2022_09_13_1129_37_Cam1_aa0_4000_sunny_ad16_1100.png
echo /home/lio/simulation/Boston_Skylights/images/2022_09_13_1129_37_Cam1_aa0_4000_sunny_ad16_1100.png""", """ra_tiff /home/lio/simulation/Boston_Skylights/images/2022_09_13_1129_37_Cam3_aa0_4000_sunny_ad16_ovc.hdr /home/lio/simulation/Boston_Skylights/images/2022_09_13_1129_37_Cam3_aa0_4000_sunny_ad16_ovc.tif
convert /home/lio/simulation/Boston_Skylights/images/2022_09_13_1129_37_Cam3_aa0_4000_sunny_ad16_ovc.tif /home/lio/simulation/Boston_Skylights/images/2022_09_13_1129_37_Cam3_aa0_4000_sunny_ad16_ovc.png
echo /home/lio/simulation/Boston_Skylights/images/2022_09_13_1129_37_Cam3_aa0_4000_sunny_ad16_ovc.png""", """ra_tiff /home/lio/simulation/Boston_Skylights/images/2022_09_13_1129_37_Cam2_aa0_4000_sunny_ad16_1100.hdr /home/lio/simulation/Boston_Skylights/images/2022_09_13_1129_37_Cam2_aa0_4000_sunny_ad16_1100.tif
convert /home/lio/simulation/Boston_Skylights/images/2022_09_13_1129_37_Cam2_aa0_4000_sunny_ad16_1100.tif /home/lio/simulation/Boston_Skylights/images/2022_09_13_1129_37_Cam2_aa0_4000_sunny_ad16_1100.png
echo /home/lio/simulation/Boston_Skylights/images/2022_09_13_1129_37_Cam2_aa0_4000_sunny_ad16_1100.png""", """ra_tiff /home/lio/simulation/Boston_Skylights/images/2022_09_13_1129_37_Cam3_aa0_4000_sunny_ad16_1100.hdr /home/lio/simulation/Boston_Skylights/images/2022_09_13_1129_37_Cam3_aa0_4000_sunny_ad16_1100.tif
convert /home/lio/simulation/Boston_Skylights/images/2022_09_13_1129_37_Cam3_aa0_4000_sunny_ad16_1100.tif /home/lio/simulation/Boston_Skylights/images/2022_09_13_1129_37_Cam3_aa0_4000_sunny_ad16_1100.png
echo /home/lio/simulation/Boston_Skylights/images/2022_09_13_1129_37_Cam3_aa0_4000_sunny_ad16_1100.png"""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])  # -> Stdout, Stderr_, Ran

# ----
convertpaths_13 = ConvertPaths(I=executessh_wip_33.Stdout)  # -> Linux, flatten(Windows)

executessh_wip_34 = ExecuteSSHWIP(
    _SSHCommands_=overrides_116.Output,
    Run=executessh_wip_33.Ran,
    addPrefix=True,
    description="pcompos -a 2 -b 1 1 1 -s 5 <files> > ~/simulation//images/2023_09_01_1154_59_all.hdr;echo ~/simulation//images/2023_09_01_1154_59_all.hdr",
    fireLogs=False,
    lastRunTime=2455,
    suppressWarnings=False,
    results="/home/lio/simulation/Boston_Skylights/images/2022_09_13_1129_37_all.hdr",
    commands="pcompos -a 2 -b 1 1 1 -s 5 /home/lio/simulation/Boston_Skylights/images/2022_09_13_1129_37_Cam1_aa0_4000_sunny_ad16_ovc.hdr /home/lio/simulation/Boston_Skylights/images/2022_09_13_1129_37_Cam1_aa0_4000_sunny_ad16_1100.hdr /home/lio/simulation/Boston_Skylights/images/2022_09_13_1129_37_Cam2_aa0_4000_sunny_ad16_ovc.hdr /home/lio/simulation/Boston_Skylights/images/2022_09_13_1129_37_Cam2_aa0_4000_sunny_ad16_1100.hdr /home/lio/simulation/Boston_Skylights/images/2022_09_13_1129_37_Cam3_aa0_4000_sunny_ad16_ovc.hdr /home/lio/simulation/Boston_Skylights/images/2022_09_13_1129_37_Cam3_aa0_4000_sunny_ad16_1100.hdr /home/lio/simulation/Boston_Skylights/images/2022_09_13_1129_37_Cam4_aa0_4000_sunny_ad16_ovc.hdr /home/lio/simulation/Boston_Skylights/images/2022_09_13_1129_37_Cam4_aa0_4000_sunny_ad16_1100.hdr /home/lio/simulation/Boston_Skylights/images/2022_09_13_1129_37_Cam5_aa0_4000_sunny_ad16_ovc.hdr /home/lio/simulation/Boston_Skylights/images/2022_09_13_1129_37_Cam5_aa0_4000_sunny_ad16_1100.hdr > ~/simulation/Boston_Skylights/images/2022_09_13_1129_37_all.hdr;echo ~/simulation/Boston_Skylights/images/2022_09_13_1129_37_all.hdr")  # -> Stdout, Stderr_, Ran

# ---- group: Outdated
overrides_123 = ApplyOverrides(Input_=panel_34, Target=graft(executessh_wip_34.Stdout))  # -> Output, Pairs

# ----
executessh_wip_35 = ExecuteSSHWIP(
    _SSHCommands_=overrides_123.Output,
    Run=executessh_wip_34.Ran,
    addPrefix=True,
    description="""mogrify -format png -gamma 2.2 -resize 50% /home/lio/simulation/Boston_Skylights/images/2022_09_13_1129_37_all.hdr
echo /home/lio/simulation/Boston_Skylights/images/2022_09_13_1129_37_all.png""",
    fireLogs=False,
    lastRunTime=2207,
    suppressWarnings=False,
    results="/home/lio/simulation/Boston_Skylights/images/2022_09_13_1129_37_all.png",
    commands="""mogrify -format png -gamma 1.8 /home/lio/simulation/Boston_Skylights/images/2022_09_13_1129_37_all.hdr
echo /home/lio/simulation/Boston_Skylights/images/2022_09_13_1129_37_all.png""")  # -> Stdout, Stderr_, Ran
imageviewer_3 = LBImageViewer(ImagePath_=convertpaths_13.Windows, _scale_=3, DisableClickable=False, SaveImgWithCoords=False, scale=3)  # -> ImagePath, Values, GIF
convertpaths_14 = ConvertPaths(I=executessh_wip_35.Stdout)  # -> Linux, Windows
imageviewer_4 = LBImageViewer(ImagePath_=convertpaths_14.Windows, _scale_=2, DisableClickable=False, SaveImgWithCoords=False, scale=2)  # -> ImagePath, Values, GIF

sun_east = Panel("9 to 11")
sun_south = Panel("11 to 13")
sun_west = Panel("14 to 16")
work_hours = Panel("8 to 18")
all_year = ScheduleRule(HourS=work_hours)  # -> OutputSchedule, HOYS, Dates
blinds_west = ScheduleRule(HourS=sun_east)  # -> OutputSchedule, HOYS, Dates
blinds_west_2 = ScheduleRule(HourS=sun_south)  # -> OutputSchedule, HOYS, Dates
blinds_west_3 = ScheduleRule(HourS=sun_west)  # -> OutputSchedule, HOYS, Dates
and_11 = GateAnd(A=all_year.OutputSchedule, B=invert(blinds_west.OutputSchedule))
and_12 = GateAnd(A=all_year.OutputSchedule, B=invert(blinds_west_2.OutputSchedule))
and_13 = GateAnd(A=all_year.OutputSchedule, B=invert(blinds_west_3.OutputSchedule))
and_14 = GateAnd(A=all_year.OutputSchedule, B=blinds_west.OutputSchedule)
and_15 = GateAnd(A=all_year.OutputSchedule, B=blinds_west_2.OutputSchedule)
and_16 = GateAnd(A=all_year.OutputSchedule, B=blinds_west_3.OutputSchedule)
all_year_noblinds_south = Boolean(and_12)
all_year_noblinds_west = Boolean(and_13)
all_year_blinds_south = Boolean(and_15)
all_year_blinds_west = Boolean(and_16)
all_year_noblinds_east = Boolean(and_11)
all_year_blinds_east = Boolean(and_14)
entwine_13 = Entwine(Branch00=all_year_blinds_west, Branch01=all_year_noblinds_west, FlattenInputs=True)  # -> simplify(Result)
entwine_14 = Entwine(Branch00=all_year_blinds_south, Branch01=all_year_noblinds_south, FlattenInputs=True)  # -> simplify(Result)
entwine_15 = Entwine(Branch00=all_year_blinds_east, Branch01=all_year_noblinds_east, FlattenInputs=True)  # -> simplify(Result)
panel_173 = Panel("""0
1""")
path_3 = ConstructPath(Indices=panel_173)

# ----
# path  x;1 is blinds on
# path x;0 is blinds off
# n;x is per orientation
entwine_16 = Entwine(Branch0X=entwine_15, Branch1X=entwine_14, Branch2X=entwine_13, FlattenInputs=False)

branch = TreeBranch(Tree=entwine_16, Path=path_3, MaintainPaths=True)

ma_2 = MassAddition(Input=all_year_blinds_south)  # -> Result, PartialResults
ma_3 = MassAddition(Input=all_year_noblinds_south)  # -> Result, PartialResults
ma_4 = MassAddition(Input=[ma_2.Result, ma_3.Result])  # -> Result, PartialResults
division_4 = Division(A=ma_2.Result, B=ma_4.Result)
division_5 = Division(A=ma_3.Result, B=ma_4.Result)
multiplication = Multiplication(A=data_no_blinds, B=division_5)
multiplication_2 = Multiplication(A=data_blinds, B=division_4)
addition = Addition(A=multiplication, B=multiplication_2)

# ----
# save pngs exposed and raw
panel_174 = Panel("""ra_tiff <hdr-.>.hdr <hdr-.>.tif
convert <hdr-.>.tif <hdr-.>.png
rm <hdr-.>.tif
echo <hdr-.>.png""")
panel_175 = Panel("""pcond -h <hdr> <hdr-.>_exposed.hdr
ra_tiff <hdr-.>_exposed.hdr <hdr-.>_exposed.tif
convert <hdr-.>_exposed.tif <hdr-.>_exposed.png
rm <hdr-.>_exposed.tif
rm <hdr-.>_exposed.hdr
echo <hdr-.>_exposed.png""")
entwine_17 = Entwine(Branch00=panel_175, Branch01=panel_174, FlattenInputs=True)

overrides_124 = ApplyOverrides(Input=entwine_17, Text=graft(executessh_36.Stdout))  # -> Output, DynamicOutput
executessh_42 = ExecuteSSH(
    _SSHCommands_=overrides_124.DynamicOutput,
    Run=executessh_36.Ran,
    addPrefix=True,
    description="""pcond -h <hdr> <hdr>_exposed.hdr
ra_tiff <hdr>_exposed.hdr <hdr>_exposed.tif
convert <hdr>_exposed.tif <hdr>_exposed.png
rm <hdr>_exposed.tif
rm <hdr>_exposed.hdr
echo <hdr>_exposed.png


- - -

ra_tiff <hdr>.hdr <hdr>.tif
convert <hdr>.tif <hdr>.png
rm <hdr>.tif
echo <hdr>.png


- - -

ra_tiff <hdr>.hdr <hdr>.tif
convert <hdr>.tif <hdr>.png
rm <hdr>.tif
echo <hdr>.png


- - -

ra_tiff <hdr>.hdr <hdr>.tif
convert <hdr>.tif <hdr>.png
rm <hdr>.tif
echo <hdr>.png


- - -

ra_tiff <hdr>.hdr <hdr>.tif
convert <hdr>.tif <hdr>.png
rm <hdr>.tif
echo <hdr>.png


- - -

ra_tiff <hdr>.hdr <hdr>.tif
convert <hdr>.tif <hdr>.png
rm <hdr>.tif
echo <hdr>.png


- - -

ra_tiff <hdr>.hdr <hdr>.tif
convert <hdr>.tif <hdr>.png
rm <hdr>.tif
echo <hdr>.png""",
    fireLogs=False,
    lastRunTime=0,
    suppressWarnings=False)  # -> Stdout, Stderr_, Ran
convertpaths_15 = ConvertPaths(I=executessh_42.Stdout)  # -> Linux, flatten(Windows)

item_7 = ListItem(List=convertpaths_15.Windows, Index=0, Wrap=True)  # -> Item, Item1

imageviewer_5 = LBImageViewer(ImagePath_=item_7.Item, _scale_=2, DisableClickable=False, SaveImgWithCoords=False, scale=2)  # -> ImagePath, Values, GIF
imageviewer_6 = LBImageViewer(ImagePath_=item_7.Item1, _scale_=2, DisableClickable=False, SaveImgWithCoords=False, scale=2)  # -> ImagePath, Values, GIF

# ----
# preview grid results
entwine_18 = Entwine(Branch00=executessh_38.Stdout, Branch01=executessh_30.Stdout, Branch02=executessh_31.Stdout, FlattenInputs=True)  # -> flatten(Result)
falsestart_10 = LBFalseStartToggle(False)
or_2 = GateOr(B=falsestart_10)
_17037_schedule = Integer(cluster_3)
pt_3 = Point(flatten(pt_2))
pt_4 = Point(pt_3)

download = Download(SftpPaths=entwine_18, Run=or_2)  # -> FilePaths, Status, Ran

list_5 = ItemSelector(download.FilePaths)
annualresults = AnnualResults(
    IllFile=list_5,
    Schedule=_17037_schedule,
    Min=300,
    Max=0,
    Run=download.Ran,
    stdouts="#?RADIANCE>JOIN<rmtxop /home/mss/simulation/test_project2/results/annualR_DC.ill + -s -1 /home/mss/simulation/test_project2/results/annualR_DCD.ill + /home/mss/simulation/test_project2/results/annualR_DCD.ill>JOIN<rmtxop -fa -t -c 47.4 119.9 11.6 ->JOIN<dctimestep /home/mss/simulation/test_project2/mtxs/dc_illum.mtx /home/mss/simulation/weatherData/DNK_DRY_OFFICIAL_2001-2010_epw-fil.smx>JOIN<CAPDATE= 2022:08:18 07:16:19>JOIN<GMT= 2022:08:18 05:16:19>JOIN<Applied 1x3 matrix transform>JOIN<Transposed rows and columns>JOIN<NROWS=8760>JOIN<NCOLS=274>JOIN<NCOMP=1>JOIN<FORMAT=ascii",
    numbers=[0.8358447489, 0.8388127854, 0.8388127854, 0.84543379, 0.847260274, 0.852283105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])  # -> Headers, Results, Ran
bnd = Bounds(Numbers=annualresults.Results)

division_6 = Division(A=annualresults.Results, B=".2")
int_3 = Integer(division_6)
multiplication_3 = Multiplication(A=int_3, B=".2")

gradient = Gradient(
    LowerLimit="1",
    UpperLimit="0",
    Parameter=multiplication_3,
    stops=[0: RGB(234, 38, 0), 0.25: RGB(234, 126, 0), 0.5: RGB(254, 244, 84), 0.75: RGB(173, 203, 249), 1: RGB(75, 107, 169)])
preview = CustomPreview(Geometry=pt_4, Material=gradient)

# ----
# preview grid results
_17037_schedule_2 = Integer(cluster_3)
expression = Expression(x=addition, Expression="Format(\"{0:0}\", x*100)")
mesh_explode = MeshExplode(m=move_2.Geometry)  # -> out, simplify(A); same code as mesh_explode

annualresults_2 = AnnualResults(
    IllFile=flatten(convertpaths_10.Windows),
    Schedule=all_year_noblinds_south,
    Min="300",
    Max=0,
    Run=executessh_wip_31.Ran,
    numbers=[0.8884931507, 0.8643835616, 0.8043835616, 0.6306849315, 0.4684931507, 0.1619178082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])  # -> Headers, simplify(Results), Ran
long_5 = LongestList(ListA=mesh_explode.A, ListB=expression, PaddingMode=2)  # -> ListA, ListB
facen_2 = FaceNormals(Mesh=mesh_explode.A)  # -> Centers, Normals
pl_origin_3 = PlaneOrigin(Base=pln_4, Origin=facen_2.Centers)

gradient_2 = Gradient(
    LowerLimit="100",
    UpperLimit="0",
    Parameter=long_5.ListB,
    stops=[0: RGB(234, 38, 0), 0.25: RGB(234, 126, 0), 0.5: RGB(254, 244, 84), 0.75: RGB(173, 203, 249), 1: RGB(75, 107, 169)])
mcol = MeshColours(Mesh=graft(long_5.ListA), Colours=graft(gradient_2))
mjoin = MeshJoin(Meshes=flatten(mcol))
medges = MeshEdges(Mesh=mjoin)  # -> NakedEdges, InteriorEdges, NonManifoldEdges
tag_2 = TextTag3D(
    Location=flatten(pl_origin_3),
    Text=flatten(long_5.ListB),
    Size="0.13",
    Colour=ColourSwatch(SwatchColor=RGB(255, 255, 255)),
    Justification=5)
preview_2 = CustomPreview(Geometry=[medges.NakedEdges, medges.InteriorEdges], Material=ColourSwatch(SwatchColor=RGB(76, 97, 125)))

# ==== cluster Normals
amplitude = ClusterInput()
amplitude_2 = Data(amplitude)
geo = ClusterInput()
merge = Merge(Data1=flatten(amplitude_2), Data2=flatten("1m"))
geo_2 = Geometry(geo)
item = ListItem(List=merge, Index=0, Wrap=True)
facen = FaceNormals(Mesh=geo_2)  # -> Centers, Normals
U = Units(ValueString=item)
avr = Average(Input=facen.Centers)
avr_2 = Average(Input=facen.Normals)
unflatten = UnflattenTree(Tree=avr, Guide=geo_2)
unflatten_2 = UnflattenTree(Tree=avr_2, Guide=geo_2)
amp = Amplitude(Vector=unflatten_2, Amplitude=U)
pl = PlaneNormal(Origin=unflatten, ZAxis=unflatten_2)
norm = Vector(amp)
center = Point(unflatten)
P = ClusterOutput(pl)
norm_2 = ClusterOutput(norm)
center_2 = ClusterOutput(center)

# ==== cluster DefaultMSS
default_value_flattened = ClusterInput()
data = ClusterInput()
data_2 = Data(data)
merge = Merge(Data1=flatten(data_2), Data2="0")  # -> flatten(Result)
default_value_flattened_2 = Data(flatten(default_value_flattened))
lng = ListLength(List=merge)
equals = Equality(FirstNumber=lng, SecondNumber="1")  # -> Equality, Inequality
cull = CullPattern(List=data_2, CullPattern=invert(equals.Equality))
panel = Panel(equals.Equality)
cull_2 = CullPattern(List=default_value_flattened_2, CullPattern=equals.Equality)
data_3 = Data([cull, cull_2])
data_4 = ClusterOutput(data_3)

# ==== cluster MeshIt2: Meshes everything in the input. Graft the input if you want to make several meshes, otherwise returns a joined mesh.
mesh_brep = ClusterInput()
mesh_brep_2 = Geometry(simplify(mesh_brep))
tmatch = MatchText(Text=mesh_brep_2, RegEx="(mesh)", Case=False)
tmatch_2 = MatchText(Text=mesh_brep_2, RegEx="(brep)|(polysurface)|(surface)|(extrusion)", Case=False)
group = Group(Objects=mesh_brep_2)
cull = CullPattern(List=mesh_brep_2, CullPattern=tmatch_2)
mesh = MeshBrep(
    Brep=cull,
    Settings={GridMaxCount=0, GridMinCount=16, JaggedSeams=False, MaxEdgeLength=0, MinEdgeLength=0.0001, MinTolerance=0, Refine=True, RefineAngle=0, RelativeTolerance=0.65, SimplePlanes=True, Tolerance=0})  # -> simplify(Mesh)
cull_2 = CullPattern(List=mesh_brep_2, CullPattern=tmatch)  # -> simplify(List)

# ----
# Fix invalid mesh
panel = Panel("Invalid Mesh")  # disabled
mesh_2 = Mesh(mesh)  # disabled
tmatch_3 = MatchText(Text=mesh_2, RegEx=panel, Case=False)  # disabled
unweave = Unweave(List=mesh_2, UnweavePattern=tmatch_3)  # -> Data0, Data1; disabled
explode = MeshExplode(Mesh=unweave.Data1, Interpolate=False)  # -> simplify(Faces); disabled
abc_a = ABC(data=explode)  # disabled
panel_2 = Panel("0")  # disabled
num = Number(panel_2)  # disabled
area = MeshArea(Mesh=abc_a)  # -> Area, Centroid; disabled
equals = Equality(FirstNumber=area.Area, SecondNumber=num)  # -> Equality, Inequality; disabled
cull_3 = CullPattern(List=abc_a, CullPattern=equals.Inequality)  # disabled
mjoin = MeshJoin(Meshes=[cull_3, unweave.Data0])  # disabled

# ----
# Fix invalid mesh
panel_3 = Panel("Invalid Mesh")  # disabled
mesh_3 = Mesh(cull_2)  # disabled
tmatch_4 = MatchText(Text=mesh_3, RegEx=panel_3, Case=False)  # disabled
unweave_2 = Unweave(List=mesh_3, UnweavePattern=tmatch_4)  # -> Data0, Data1; disabled
explode_2 = MeshExplode(Mesh=unweave_2.Data1, Interpolate=False)  # -> simplify(Faces); disabled
abc_a_2 = ABC(data=explode_2)  # disabled
panel_4 = Panel("0")  # disabled
num_2 = Number(panel_4)  # disabled
area_2 = MeshArea(Mesh=abc_a_2)  # -> Area, Centroid; disabled
equals_2 = Equality(FirstNumber=area_2.Area, SecondNumber=num_2)  # -> Equality, Inequality; disabled
cull_4 = CullPattern(List=abc_a_2, CullPattern=equals_2.Inequality)  # disabled
mjoin_2 = MeshJoin(Meshes=[cull_4, unweave_2.Data0])  # disabled

mjoin_3 = MeshJoin(Meshes=[mesh, cull_2])
c_script = CSharpScript(mesh=mjoin_3)  # -> A; inputs mesh: Mesh
# ---------- c_script: C# ----------
    mesh.Faces.CullDegenerateFaces();
    A = mesh;
# ---------- end c_script ----------
abc_a_3 = ABC(data=mjoin)  # disabled
abc_a_4 = ABC(data=mjoin_2)  # disabled
clean = CleanTree(RemoveNulls=True, RemoveInvalid=True, RemoveEmpty=False, Tree=[abc_a_3, abc_a_4])  # disabled
mjoin_4 = MeshJoin(Meshes=clean)  # disabled
unflatten = UnflattenTree(Tree=c_script, Guide=group)
mesh_explode = MeshExplode(m=mjoin_4)  # -> out, simplify(A); disabled
# ---------- mesh_explode: VB ----------
    Component.Params.Input(0).Name = "Mesh"
    Component.Params.Input(0).Description = "Open or closed mesh"

    Component.Params.Output(1).Name = "Mesh"
    Component.Params.Output(1).Description = "If successful, a valid mesh"

    If m IsNot Nothing Then
      Dim pts As Rhino.Geometry.Collections.MeshVertexList
      Dim faces As Rhino.Geometry.Collections.MeshFaceList
      Dim clrs As Rhino.Geometry.Collections.MeshVertexColorList
      Dim i As Integer
      Dim mshs As New list(Of mesh)

      faces = m.Faces
      pts = m.Vertices
      If m.VertexColors.count() = 0 Then m.VertexColors.CreateMonotoneMesh(color.FromArgb(100, 100, 100))
      clrs = m.VertexColors

      For i = 0 To faces.count() - 1 Step 1
        Dim fc As New meshFace
        Dim face As New MeshFace
        Dim ptList As New list(Of point3d)
        Dim clrList As New list(Of color)
        Dim msh As New mesh

        face = faces(i)

        ptList.add(New point3d(pts(face.A)))
        ptList.add(New point3d(pts(face.B)))
        ptList.add(New point3d(pts(face.C)))
        If face.IsQuad Then ptList.add(New point3d(pts(face.D)))

        clrList.add(clrs(face.A))
        clrList.add(clrs(face.B))
        clrList.add(clrs(face.C))
        If face.IsQuad Then clrList.add(clrs(face.D))

        If face.IsQuad Then fc = New meshFace(0, 1, 2, 3) Else fc = New meshface(0, 1, 2)

        msh.Vertices.AddVertices(ptList.toarray())
        msh.Faces.AddFace(fc)
        msh.VertexColors.SetColors(clrList.toarray())
        mshs.add(msh)
      Next

      A = mshs
    End If
# ---------- end mesh_explode ----------
c_script_2 = CSharpScript(mesh=mjoin_4)  # -> A; inputs mesh: Mesh; disabled; same code as c_script
c_script_3 = CSharpScript(mesh=mesh_explode.A)  # -> out, A; inputs mesh: list of Mesh; disabled
# ---------- c_script_3: C# ----------
    List<bool> isValid = new List<bool>();
    for (int i = 0; i < mesh.Count; i++)
    {
      isValid.Add(mesh[i].IsValid);
    }
    
    A = isValid;
# ---------- end c_script_3 ----------
mesh_joined = Mesh(unflatten)
cullf = CullFaces(Mesh=mjoin_4, Pattern=invert(c_script_3.A))  # disabled
mesh_joined_2 = ClusterOutput(mesh_joined)

# ==== cluster LargestBREP
window_breps = ClusterInput()
window_breps_2 = Brep(window_breps)
debrep = DeconstructBrep(Brep=window_breps_2)  # -> Faces, Edges, Vertices
area = Area(Geometry=debrep.Faces)  # -> Area, Centroid
sort = SortList(Keys=area.Area, ValuesA=debrep.Faces)  # -> Keys, ValuesA
item = ListItem(List=sort.ValuesA, Index=-1, Wrap=True)
group = Group(Objects=flatten(item))
grouped = ClusterOutput(group)

# ==== cluster Cluster
l = ClusterInput()
python = GhPythonScript(l=l)  # -> xmin, xmax, ymin, ymax, zmin; inputs l: list
# ---------- python: Python ----------
__author__ = "mm1013"
__version__ = "2022.08.20"

import rhinoscriptsyntax as rs
li = [s for s in l[1].split(" ") if len(s) > 0]
#print(li)
xmin, xmax, ymin, ymax, zmin, zmax = [float(v) for v in li]


if zmax > 0:
    print("Err, Zmax should be < 0!")
else:
    print("Zmax is OK (< 0)")
# ---------- end python ----------
default = DefaultMSS(data=flatten(python.zmin), default_value_flattened=flatten("-0.2"))
panel = Panel("""0.23
0.77""")
dom = ConstructDomain(DomainStart=python.xmin, DomainEnd=python.xmax)
dom_2 = ConstructDomain(DomainStart=python.ymin, DomainEnd=python.ymax)
default_2 = DefaultMSS(data=flatten(dom), default_value_flattened=flatten("0 to 1"))
default_3 = DefaultMSS(data=flatten(dom_2), default_value_flattened=flatten("0 to 1"))
remap = RemapNumbers(Value=panel, Source=Domain(0, 1), Target=default_2)  # -> Mapped, Clipped
remap_2 = RemapNumbers(Value=panel, Source=Domain(0, 1), Target=default_3)  # -> Mapped, Clipped
item = ListItem(List=remap.Mapped, Index=0, Wrap=True)  # -> Item, Item1
item_2 = ListItem(List=remap_2.Mapped, Index=0, Wrap=True)  # -> Item, Item1
data = ClusterOutput(default)
xend = Number(item.Item1)
ystart = Number(item_2.Item)
yend = Number(item_2.Item1)
xstart = Number(item.Item)
xend_2 = ClusterOutput(xend)
ystart_2 = ClusterOutput(ystart)
yend_2 = ClusterOutput(yend)
xstart_2 = ClusterOutput(xstart)

# ==== cluster Cluster_2
L = ClusterInput()
lng = ListLength(List=L)
series = Series(Start=0, Step=1, Count=lng)
expression = Expression(x=series, Expression="2^x")
cull = CullPattern(List=expression, CullPattern=L)
ma = MassAddition(Input=cull)  # -> Result, PartialResults
R = ClusterOutput(ma.Result)

# ==== cluster Cluster_3
horizontaldiffrad = ClusterInput()
horizontaldiffrad_2 = Number(horizontaldiffrad)
lng = ListLength(List=horizontaldiffrad_2)
lng_2 = ListLength(List=horizontaldiffrad_2)
series = Series(Start=0, Step=0, Count=lng)
division = Division(A=lng, B=2)
series_2 = Series(Start=0, Step=1, Count=lng_2)
subtraction = Subtraction(A=division, B=1)
sort = SortList(Keys=horizontaldiffrad_2, ValuesA=series_2)  # -> reverse(Keys), reverse(ValuesA)
dom = ConstructDomain(DomainStart="0", DomainEnd=subtraction)
subset = SubList(List=sort.ValuesA, Domain=dom, Wrap=True)  # -> List, Index
replace = ReplaceItems(List=series, Item="1", Indices=subset.List, Wrap=False)
schedule_01 = ClusterOutput(replace)

# ==== cluster BSDF
bsdf_file_path_linux = ClusterInput()
bsdf_name = ClusterInput()
bsdf_file_path_linux_2 = Text(bsdf_file_path_linux)
bsdf_name_2 = Text(bsdf_name)
item = ListItem(List=bsdf_name_2, Index=0, Wrap=True)
item_2 = ListItem(List=bsdf_file_path_linux_2, Index=0, Wrap=True)
merge = Merge(Data1=item, Data2=item_2)
join = TextJoin(Text=merge, Join=";")  # -> flatten(Result)
bsdf_pairs = Text(join)
bsdf_pairs_2 = ClusterOutput(bsdf_pairs)

# ==== cluster BSDF_2
bsdf_pairs = ClusterInput()
bsdf_pairs_2 = Text(flatten(bsdf_pairs))
split = TextSplit(Text=bsdf_pairs_2, Separators=";")  # -> simplify(Result)
flip = FlipMatrix(Data=split)  # -> simplify(Data)
bang = ExplodeTree(Data=flip)  # -> Branch0, Branch1
python = GhPythonScript(x=bang.Branch1)  # -> out, a
# ---------- python: Python ----------
__author__ = "mm1013"
__version__ = "2022.09.09"

import rhinoscriptsyntax as rs

a = x.replace(" ","\ ")
# ---------- end python ----------
path = Text(python.a)
name = Text(bang.Branch0)
path_2 = ClusterOutput(path)
name_2 = ClusterOutput(name)

# ==== cluster Cluster_4
x = ClusterInput()
python = GhPythonScript(x=x)  # -> a
# ---------- python: Python ----------
__author__ = "mm1013"
__version__ = "2022.07.02"

import rhinoscriptsyntax as rs

##Removing the leading "~"
a = x[1:]
# ---------- end python ----------
a = ClusterOutput(python)

# ==== cluster Cluster_5
x = ClusterInput()
python = GhPythonScript(x=x)  # -> bsdf_name, bsdf_path
# ---------- python: Python ----------
__author__ = "mm1013"
__version__ = "2022.09.09"

import rhinoscriptsyntax as rs

bsdf_path = x.replace("_JOIN_","").replace("\n","").strip()
bsdf_name = bsdf_path.split(".")[0].split("/")[-1].replace(" ","_")
# ---------- end python ----------
bsdf_name = ClusterOutput(python.bsdf_name)
bsdf_path = ClusterOutput(python.bsdf_path)

# ==== cluster Symbols
x = ClusterInput()
r_to_lf = GhPythonScript(x=x)  # -> a
# ---------- r_to_lf: Python ----------
__author__ = "mm1013"
__version__ = "2022.09.11"

import rhinoscriptsyntax as rs

a = x.replace("\r\n","\\R\\N")
a = a.replace("\n\r","\\N\\R")
a = a.replace("\n","\\n\n")
a = a.replace("\r","\\r\r")
a = a.replace("\\R\\N","\\r\\n\n")
a = a.replace("\\N\\R","\\n\\r\n")
a = a.replace("\t","\\t\t")
# ---------- end r_to_lf ----------
a = ClusterOutput(r_to_lf)

# ==== cluster Io
i = ClusterInput()
default = DefaultMSS(data=flatten(Toggle(True)), default_value_flattened=flatten(i))
o = ClusterOutput(default)

# ==== cluster ABC
data = ClusterInput()
data_2 = Data(data)
path_mapper = PathMapper(
    data_2,
    source=["{A;B;C;D;E;F;G}", "{A;B;C;D;E;F}", "{A;B;C;D;E}", "{A;B;C;D}", "{A;B;C}", "{A;B}", "{A}"],
    target=["{A}", "{A}", "{A}", "{A}", "{A}", "{A}", "{A}"])
data_3 = Data(path_mapper)
data_4 = ClusterOutput(data_3)
